# Grasshopper definition HingeOnEdge.gh (Grasshopper 1.0.8)
# plug-ins: Karamba3D

X = UnitX(Factor=1)
line = LineSDL(Start="0,0,0", Direction=X, Length=1)
Z = UnitZ(Factor=1)
move = Move(Geometry=line, Motion=Z)  # -> Geometry, Transform
Y = UnitY(Factor=1)
move_2 = Move(Geometry=move.Geometry, Motion=Y)  # -> Geometry, Transform
loft = Loft(
    Curves=[line, move.Geometry],
    Options={Adjust=False, Closed=False, LoftEnds=0, LoftSimp=0, LoftType=0, Rebuild=10, Refit=0.01})
loft_2 = Loft(
    Curves=[move_2.Geometry, move.Geometry],
    Options={Adjust=False, Closed=False, LoftEnds=0, LoftSimp=0, LoftType=0, Rebuild=10, Refit=0.01})
mesh_breps = MeshBrepsKaramba3D(
    Brep=[loft, loft_2],
    MeshResolution=Slider(1, range=0.1..1),
    EdgeRefinementFactor=0.67,
    PointReduction=False,
    SmoothingStepSize=0,
    SmoothingIterations=5)  # -> Mesh, Info
end = EndPoints(Curve=move_2.Geometry)  # -> Start, End
Z_2 = UnitZ(Factor=1)
vec = VectorXYZ(XComponent="1", YComponent=0, ZComponent=0)  # -> Vector, Length
panel = Panel("""A
B""")
line_joint = LineJointKaramba3D(
    JointCurve=move.Geometry,
    ElementIdentifier="B",
    YOrientation=Vector(0, 0, 0),
    ZOrientation=Vector(0, 0, 0),
    DAlpha_deg=45,
    Ct_kN_m_m=Vector(0, 0, 0),
    Cr_kNm_m_rad=vec.Vector,
    menu=[buttons(off, off, off, on, off, off)])
loads = LoadsKaramba3D(ForceVector=Z_2, Local=False, PosInd=[end.Start, end.End], LCase="LC0", mode="Point")
surfelem = CreateSurfaceElementKaramba3D(Mesh=mesh_breps.Mesh, Identifier=panel, LimitDistance_m=0.005, Bending=True, mode="MeshToShell")  # -> Element, Points, Info
pt = Point(surfelem.Points)
pull = PullPoint(Point=pt, Geometry=line, ClosestOnly=True)  # -> ClosestPoint, Distance, Index
smaller = SmallerThan(FirstNumber=pull.Distance, SecondNumber="1e-5")  # -> SmallerThan, OrEqualTo
cull = CullPattern(List=pt, CullPattern=smaller.SmallerThan)
supp = SupportKaramba3D(PosInd=cull, menu=[buttons(on, on, on, on, on, on)])
assemble = AssembleModelKaramba3D(Elem=surfelem.Element, Support=supp, Load=loads, Joint=line_joint, LimitDistance_m=0.005)  # -> Model, Info, Mass_kg, CentreOfGravity, LoadCaseNames
analyse = AnalyseKaramba3D(Model=assemble.Model)  # -> AnalysedModel, MaximumDisplacement_cm, ResultingForce_kN, ChangeOfElasticEnergy_kNm
num = Number(analyse.MaximumDisplacement_cm)
num_2 = Number(214.3261483)
similar = CSharpScript(x=num, y=num_2)  # -> out; inputs x: Double, y: Double
# ---------- similar: C# ----------
    if (Math.Abs(x - y) > 1E-10) throw new Exception ("The values x and y are not equal.");
# ---------- end similar ----------
panel_2 = Panel(num)
panel_3 = Panel(num_2)
modelview = ModelViewKaramba3D(Model=analyse.AnalysedModel)  # -> Model, DeformedMesh, DeformedAxes, DeformedModel, MaximumDeformation
