# Grasshopper definition ModelView_SelectView_BaseLine.gh (Grasshopper 1.0.8)
# plug-ins: Karamba3D, Bifocals

box = DomainBox(Base=PlaneXY(0, 0, 0), X="0 to 10", Y="0 to 30", Z="0 to 10")
mbox = MeshBox(Base=box, XCount="3", YCount="30", ZCount="3")
medges = MeshEdges(Mesh=mbox)  # -> NakedEdges, InteriorEdges, NonManifoldEdges
yz = YZPlane(Origin="10,0,0")
dom = ConstructDomain(DomainStart=Slider(2, range=0..10), DomainEnd=Slider(16, range=0..30))
lineelem = CreateLinearElementKaramba3D(
    Line=medges.InteriorEdges,
    Identifier="B",
    LimitDistance_m=0.005,
    BucklingLengthY_m=-1,
    BucklingLengthZ_m=-1,
    BucklingLengthLT_m=-1,
    Bending=True,
    ToPolylineMaxAngle=0.03,
    ToPolylineTolerance=0.01,
    ToPolylineMaxEdgeLength=0.25,
    New=True,
    Remove=True,
    mode="LineToBeam")  # -> Element, Points, Info
pt = Point(lineelem.Points)
planesrf = PlaneSurface(Plane=yz, XSize=dom, YSize="0 to 10")
pdecon = Deconstruct(Point=pt)  # -> XComponent, YComponent, ZComponent
smaller = SmallerThan(FirstNumber=pdecon.ZComponent, SecondNumber="1E-5")  # -> SmallerThan, OrEqualTo
cull = CullPattern(List=pt, CullPattern=smaller.SmallerThan)

# ---- group: Selection via Plane
pt_2 = Point(cull)
pdecon_2 = Deconstruct(Point=pt_2)  # -> XComponent, YComponent, ZComponent
sort = SortList(Keys=pdecon_2.YComponent)  # -> Keys, ValuesA
dcon = DeleteConsecutive(Set=sort.Keys, Wrap=False)  # -> Set, Count
lng = ListLength(List=dcon.Set)  # -> expr("x-1", Length)
multiplication = Multiplication(A=lng, B=Slider(0.31, range=0..1))
item = ListItem(List=dcon.Set, Index=multiplication, Wrap=True)
pt_3 = ConstructPoint(XCoordinate=0, YCoordinate=item, ZCoordinate=0)
xz = XZPlane(Origin=pt_3)

# ----
modifyelem = ModifyElementKaramba3D(Beam=lineelem.Element, BucklingLengthY_m="8", mode="Beam")
supp = SupportKaramba3D(PosInd=cull, Ct_kN_m="10, 10, 1000", Cr_kNm_rad=Vector(0, 0, 0), menu=[buttons(off, off, off, off, off, off)])

# ---- group: Loads (Karamba3D)
loads = LoadsKaramba3D(Vector=Vector(0, 0, -1), LCase="LC0", mode="Gravity")

# ---- group: AnalyseThII (Karamba3D)
analysethii = AnalyseThIIKaramba3D(UseInitialNII=True, NIIFromCombination=True, NoTensionalNII=False, RTolerance=1e-07, MaxIterations=50)  # -> AnalysedModel, MaximumDisplacement_cm, ResultingForce_kN, ChangeOfElasticEnergy_kNm

# ---- group: Assemble Model (Karamba3D)
assemble = AssembleModelKaramba3D(Elem=modifyelem, Support=supp, Load=loads, LimitDistance_m=0.005)  # -> Model, Info, Mass_kg, CentreOfGravity, LoadCaseNames

# ---- group: Selection via Base Line
bbox = BoundingBox(Content=assemble.Model, Plane=PlaneXY(0, 0, 0))  # -> Box, Box_2
debrep = DeconstructBrep(Brep=bbox.Box)  # -> Faces, Edges, Vertices
item_2 = ListItem(List=debrep.Faces, Index="4", Wrap=True)
edges = BrepEdges(Brep=item_2)  # -> Naked, Interior, NonManifold
lng_2 = ListLength(List=edges.Naked)  # -> expr("x-1", Length)
multiplication_2 = Multiplication(A=lng_2, B=Slider(0.96, range=0..1))
item_3 = ListItem(List=edges.Naked, Index=multiplication_2, Wrap=True)

# ---- group: Analyse (Karamba3D)
analyse = AnalyseKaramba3D(Model=assemble.Model)  # -> AnalysedModel, MaximumDisplacement_cm, ResultingForce_kN, ChangeOfElasticEnergy_kNm

# ---- group: Disassemble Model (Karamba3D)
disassemble = DisassembleModelKaramba3D(Model=analyse.AnalysedModel)  # -> Model, Point, Beam, Shell, Support, Load, Line, Mesh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

# ----
data = Data([item_3, xz, planesrf, "C", "B"])
disassemble_2 = DisassembleElementKaramba3D(Element=disassemble.Beam)  # -> Element, ElementIdentifier, AxisOfElement, CrossSection, Joint, Material, LocalCoordinateSystem, ElementIsActive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

# ---- group: Model View (Karamba3D)
modelview = ModelViewKaramba3D(Model=analyse.AnalysedModel, ViewSelection=flatten(data))  # -> Model, DeformedMesh, DeformedAxes, DeformedModel, MaximumDeformation

# ----
disassemble_3 = DisassembleCrossSectionKaramba3D(CroSec=disassemble_2.CrossSection)  # -> CrossSection, FamilyNameOfCrossSection, TypeNameOfCrossSection, ElemIdentifiers, Colour, Material, LocalEccentricity_cm, Heights_cm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

# ---- group: Beam View (Karamba3D)
beamview = BeamViewKaramba3D(Model=modelview.Model)  # -> flatten(Model), MeshesOfRenderedBeams, DeformedBeamAxes, LegendColours, LegendTags

# ---- group: Assemble Model (Karamba3D)
assemble_2 = AssembleModelKaramba3D(
    Elem=disassemble.Beam,
    Support=disassemble.Support,
    Load=disassemble.Load,
    Joint=disassemble.Joint,
    LimitDistance_m=0.005)  # -> Model, Info, Mass_kg, CentreOfGravity, LoadCaseNames

# ----
disassemble_4 = DisassembleMaterialKaramba3D(Material=disassemble_3.Material)  # -> Material, TypeOfMaterial, FamilyNameOfMaterial, NameOfMaterial, ElemIdentifiers, Colour, YoungsModulusKNCm²Dir12, InPlaneShearModulus_kN_cm²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
legend = Legend(Colour=beamview.LegendColours, Tags=beamview.LegendTags, LegendType=1)
utilization = UtilizationOfElementsKaramba3D(
    AnalysedModel=beamview.Model,
    NumberOfSamplePoints=3,
    ElasticDesign=True,
    GammaM0=1,
    GammaM1=1.1,
    SwayFrame=True,
    WithDetails=False,
    mode="Beams")  # -> Model, flatten(Utilization), SigMax_kN_cm², SigMin_kN_cm², TauMax_kN_cm², UtilN, UtilVy, UtilVz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
bnd = Bounds(Numbers=utilization.Utilization)
panel = Panel(bnd)
