# Grasshopper definition OptiCroSec_Shell_Large.gh (Grasshopper 1.0.8)
# plug-ins: Karamba3D

slider = Slider(42, range=0..100)
slider_2 = Slider(100, range=0..100)
vec = VectorXYZ(XComponent=0, YComponent=0, ZComponent=0)  # -> Vector, Length
vec_2 = VectorXYZ(XComponent=slider_2, YComponent=0, ZComponent=0)  # -> Vector, Length
vec_3 = VectorXYZ(XComponent=slider_2, YComponent=slider, ZComponent=0)  # -> Vector, Length
vec_4 = VectorXYZ(XComponent=0, YComponent=slider, ZComponent=0)  # -> Vector, Length
srf4pt = _4PointSurface(CornerA=vec.Vector, CornerB=vec_2.Vector, CornerC=vec_3.Vector, CornerD=vec_4.Vector)
edges = BrepEdges(Brep=srf4pt)  # -> Naked, Interior, NonManifold
item = ListItem(List=edges.Naked, Index=Slider(3, range=0..10), Wrap=True)
slider_3 = Slider(30, range=0..70)
divide = DivideCurve(Curve=item, Count=slider_3, Kinks=False)  # -> Points, Tangents, Parameters
item_2 = ListItem(List=edges.Naked, Index=expr("1", 0), Wrap=True)
multiplication = Multiplication(A=Slider(22, range=0..100), B="10000")
mesh_uv = MeshSurface(Surface=srf4pt, UCount=Slider(30, range=0..70), VCount=slider_3, Overhang=True, Equalize=False)
range = Range(Domain="5 to 650", Steps="100")
range_2 = Range(Domain="0.1 to 5", Steps="50")
divide_2 = DivideCurve(Curve=item_2, Count=slider_3, Kinks=False)  # -> Points, Tangents, Parameters
merge = Merge(Data1=range_2, Data2=range)
supp = SupportKaramba3D(PosInd=flatten(divide_2.Points), menu=[buttons(on, on, on, on, on, on)])
crosec = CrossSectionKaramba3D(
    FamilyNameOfCrossSection="sc",
    NameOfCrossSection=merge,
    Material=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,
    Height_cm=merge,
    mode="Shell - Const")
item_3 = ListItem(List=crosec, Index=0, Wrap=True)
surfelem = CreateSurfaceElementKaramba3D(Mesh=mesh_uv, Identifier="shell", CrossSection=item_3, LimitDistance_m=0.005, Bending=True, mode="MeshToShell")  # -> Element, Points, Info
fsim = FindSimilarMember(Data=divide.Points, Set=surfelem.Points)  # -> Hit, Index
pdecon = Deconstruct(Point=fsim.Hit)  # -> XComponent, YComponent, ZComponent
bnd = Bounds(Numbers=pdecon.YComponent)
remap = RemapNumbers(Value=pdecon.YComponent, Source=bnd, Target=Domain(0, 1))  # -> Mapped, Clipped
graph = GraphMapper(
    remap.Mapped,
    x0=0,
    x1=1,
    y0=0,
    y1=1,
    container_name="Bezier",
    cpx=[0, 0.3431307971, 0.5579710007, 1],
    cpy=[0, 0.5540864468, 0.6938405633, 0])
num = Number(graph)
multiplication_2 = Multiplication(A=num, B=multiplication)
vec_5 = VectorXYZ(XComponent=0, YComponent=expr("-x", multiplication_2), ZComponent=0)  # -> Vector, Length
loads = LoadsKaramba3D(ForceVector=vec_5.Vector, Local=False, PosInd=fsim.Hit, LCase="LC0", mode="Point")
assemble = AssembleModelKaramba3D(Elem=surfelem.Element, Support=supp, Load=loads, LimitDistance_m=0.005)  # -> Model, Info, Mass_kg, CentreOfGravity, LoadCaseNames
opticrosec = OptimizeCrossSectionKaramba3D(
    Model=assemble.Model,
    CrossSections=crosec,
    MaximumUtilization=1,
    MaximumVirtualWork_kNcm=0.01,
    NumberOfUtilizationIterations="10",
    NumberOfDisplacementIterations=5,
    NumberOfDisplacementIncrementsPerIteration=2,
    DisplacementTolerance=0.01,
    NumberOfSamplePoints=3,
    ElasticDesign=True,
    GammaM0=1,
    GammaM1=1.1,
    SwayFrame=True)  # -> OptimizedModel, Info, Mass_kg, MaximumDisplacement_cm, ElasticEnergyChange_kNm, MaximumUtilizationViewInsufficientCrossSections, MaximumDisplacementViewLimitCrossSections
panel = Panel(opticrosec.Info)
use_this_toview_the_insufficient_element = Text([opticrosec.MaximumDisplacementViewLimitCrossSections, opticrosec.MaximumUtilizationViewInsufficientCrossSections])  # "Use this toview the insufficient elements"
modelview = ModelViewKaramba3D(Model=opticrosec.OptimizedModel, ViewSelection=use_this_toview_the_insufficient_element)  # -> Model, DeformedMesh, DeformedAxes, DeformedModel, MaximumDeformation
shellview = ShellViewKaramba3D(Model=modelview.Model, IndexOfLayer=0)  # -> Model, MeshesOfRenderedShells, LegendColours, LegendTags
legend = Legend(Colour=shellview.LegendColours, Tags=shellview.LegendTags, LegendType=1)
panel_2 = Panel("""true
false
false
false
false
false
false
false""")
pt = Point(surfelem.Points)
cull = CullPattern(List=pt, CullPattern=panel_2)
shelllineresults = LineResultsOnShellsKaramba3D(
    AnalysedModel=shellview.Model,
    LayerPosition=0,
    ListOfIsoValuesValuesOrSourcesOfForceFlowLinesLinesPoints=cull,
    SegmentLength_m=0,
    Smoothing=Toggle(True),
    mode="IsoLines",
    menu=[buttons(off, off, off, off, on, off, off)])  # -> Model, Lines, Value
