# Grasshopper definition 01_SimpleBeam.gh (Grasshopper 1.0.7)
# plug-ins: Karamba3D

pt = ConstructPoint(XCoordinate=0, YCoordinate=0, ZCoordinate=0)
pt_2 = ConstructPoint(XCoordinate=Slider(10, range=0..10), YCoordinate=0, ZCoordinate=Slider(1, range=0..10))
ln = Line(StartPoint=pt, EndPoint=pt_2)
Z = UnitZ(Factor="-1")
line_to_beam_karamba3d = LineToBeamKaramba3D(
    Line=ln,
    New=True,
    Remove=True,
    LimitDistance_m=0.005,
    Bending=True,
    SetBucklingLength=True,
    ToPolylineMaxAngle=0.03,
    ToPolylineTolerance=0.01,
    ToPolylineMinEdgeLength=0.25)  # -> Element, Points, Info
support_karamba3d = SupportKaramba3D(PosInd="0", menu=[buttons(on, on, on, on, on, on)])
loads_karamba3d = LoadsKaramba3D(ForceVector=Z, Local=False, PosInd="1", LCase="0", mode="Point")
assemble_model_karamba3d = AssembleModelKaramba3D(Elem=line_to_beam_karamba3d.Element, Support=support_karamba3d, Load=loads_karamba3d, LimitDistance_m=0.005)  # -> Model, Info, Mass_kg, CenterOfGravity, LoadCaseNames
analyze = AnalyzeKaramba3D(Model=assemble_model_karamba3d.Model)  # -> CalculatedModel, MaximumDisplacement_cm, ResultingForceOfGravity_kN, ElasticEnergy_kNm
panel = Panel(assemble_model_karamba3d.Model)
panel_2 = Panel([analyze.MaximumDisplacement_cm, analyze.ResultingForceOfGravity_kN, analyze.ElasticEnergy_kNm])
model_view_karamba3d = ModelViewKaramba3D(Model=analyze.CalculatedModel, ResultFactors=1, ResultCase=-1)  # -> Model, DeformedMesh, DeformedAxes, DeformedModel
beam_view_karamba3d = BeamViewKaramba3D(Model=model_view_karamba3d.Model)  # -> Model, MeshesOfRenderedBeams, DeformedBeamAxes, LegendColors, LegendTags
legend = Legend(Colour=beam_view_karamba3d.LegendColors, Tags=beam_view_karamba3d.LegendTags, LegendType=1)
