# Grasshopper definition 03_Optimization_SupportPositions - Speckle.gh (Grasshopper 1.0.7)
# plug-ins: Karamba3D, SpeckleConnector, Speckle 2

# ---- group: Create Geometry
# Send to Speckle
panel = Panel("0 to 10")
slider = Slider(5, range=2..40)
genes = GeneList(Decimals=3, Maximum=1, Minimum=0, Value=[0.964, 0.561, 0.275, 0.278, 0, 0.812, 0.686, 0.097, 0.552, 0.797])
range = Range(Domain=panel, Steps=slider)
pt = ConstructPoint(XCoordinate=range, YCoordinate=graft(range), ZCoordinate=0)
flip = FlipMatrix(Data=pt)
multiplication = Multiplication(A=slider, B=genes)
pline = PolyLine(Vertices=pt, Closed=False)
pline_2 = PolyLine(Vertices=flip, Closed=False)
dispatch = Dispatch(List=multiplication, DispatchPattern=[True, False])  # -> ListA, ListB
item = TreeItem(Tree=simplify(pt), Path=dispatch.ListA, Index=dispatch.ListB, Wrap=True)
explode = Explode(Curve=[pline, pline_2], Recursive=True)  # -> flatten(Segments), Vertices

# ----
# Receive from Speckle
panel_2 = Panel("https://app.speckle.systems/projects/610393c107/models/82801a996e")
receive = Receive(
    Stream=panel_2,
    AutoReceive=False,
    CurrentComponentState="up_to_date",
    ExpandOutput=True,
    LastInfoMessage="Matthew Tam (K3D) @ 09/10/2024 06:18:16: version 1 (id:83f8d95360)",
    ReceiveOnOpen=False,
    ReceivedCommitId="83f8d95360",
    StreamWrapper="https://app.speckle.systems/projects/610393c107/models/optimise support positions",
    selectedKitName="Objects")  # -> Info, Data
importspeckle = ImportModelFromSpeckleKaramba3DWIP(StructuralModel=receive.Data)  # -> Model, Info, Mass_kg, CentreOfGravity, LoadCaseNames
dso = DeconstructSpeckleObject(SpeckleObject=receive.Data, selectedKitName="Objects")  # -> Elements, LayerDescription, Loads, Materials, Nodes, Properties, Restraints, Specs

# ---- group: Define Materials
matselect = MaterialSelectionKaramba3D(menu=[dropdown(1), dropdown(2)])

# ----
panel_3 = Panel(importspeckle.Mass_kg)

# ---- group: Define Cross Sections
crosecrselect = CrossSectionRangeSelectorKaramba3D(MaximumHeight_cm=-1, MaximumWidth_cm=-1, Material=matselect, menu=[dropdown(0), dropdown(1), dropdown(3)])
crosecselect = CrossSectionSelectorKaramba3D(CrossSections=crosecrselect, NameOrListIndexOfCrossSection="HEA200")  # -> CrossSection, Info

# ----
analyse = AnalyseKaramba3D(Model=importspeckle.Model)  # -> AnalysedModel, MaximumDisplacement_cm, ResultingForce_kN, ChangeOfElasticEnergy_kNm
panel_4 = Panel(analyse.MaximumDisplacement_cm)
modelview = ModelViewKaramba3D(Model=analyse.AnalysedModel)  # -> Model, DeformedMesh, DeformedAxes, DeformedModel, MaximumDeformation

# ---- group: Define Supports
supp = SupportKaramba3D(PosInd=item, menu=[buttons(on, on, on, off, off, off)])

# ---- group: Define Loads
loads = LoadsKaramba3D(Vector=Vector(0, 0, -1), LCase="LC0", mode="Gravity")

# ---- group: Define Elements
lineelem = CreateLinearElementKaramba3D(
    Line=explode.Segments,
    CrossSection=crosecselect.CrossSection,
    LimitDistance_m=0.005,
    BucklingLengthY_m=-1,
    BucklingLengthZ_m=-1,
    BucklingLengthLT_m=-1,
    Bending=True,
    ToPolylineMaxAngle=0.03,
    ToPolylineTolerance=0.01,
    ToPolylineMaxEdgeLength=0.25,
    New=True,
    Remove=True,
    mode="LineToBeam")  # -> Element, Points, Info

# ----
beamview = BeamViewKaramba3D(Model=modelview.Model)  # -> Model, MeshesOfRenderedBeams, DeformedBeamAxes, LegendColours, LegendTags
legend = Legend(Colour=beamview.LegendColours, Tags=beamview.LegendTags, LegendType=1)

# ---- group: Assemble Model
assemble = AssembleModelKaramba3D(Elem=lineelem.Element, Support=supp, Load=loads, LimitDistance_m=0.005)  # -> Model, Info, Mass_kg, CentreOfGravity, LoadCaseNames

# ---- group: Optimize Cross Sections
opticrosec = OptimizeCrossSectionKaramba3D(
    Model=assemble.Model,
    CrossSections=crosecrselect,
    MaximumUtilization=1,
    MaximumDisplacement_cm="1",
    MaximumVirtualWork_kNcm=0.01,
    NumberOfUtilizationIterations=5,
    NumberOfDisplacementIterations=5,
    NumberOfDisplacementIncrementsPerIteration=2,
    DisplacementTolerance=0.01,
    NumberOfSamplePoints=3,
    ElasticDesign=True,
    GammaM0=1,
    GammaM1=1.1,
    SwayFrame=True)  # -> OptimizedModel, Info, Mass_kg, MaximumDisplacement_cm, ElasticEnergyChange_kNm, MaximumUtilizationViewInsufficientCrossSections, MaximumDisplacementViewLimitCrossSections
panel_5 = Panel(opticrosec.MaximumDisplacement_cm)

# ----
panel_6 = Panel(opticrosec.Mass_kg)
panel_7 = Panel("https://app.speckle.systems/projects/610393c107/models/82801a996e")

# ---- group: View Results
modelview_2 = ModelViewKaramba3D(Model=opticrosec.OptimizedModel)  # -> Model, DeformedMesh, DeformedAxes, DeformedModel, MaximumDeformation
beamview_2 = BeamViewKaramba3D(Model=modelview_2.Model)  # -> Model, MeshesOfRenderedBeams, DeformedBeamAxes, LegendColours, LegendTags
legend_2 = Legend(Colour=beamview_2.LegendColours, Tags=beamview_2.LegendTags, LegendType=1)

# ----
exportmodel = ExportModelToSpeckleKaramba3DWIP(Model=opticrosec.OptimizedModel)  # -> StructuralModel, Info
send = Send(
    Stream=panel_7,
    Message="version 1",
    Data=exportmodel.StructuralModel,
    AutoSend=False,
    BaseId="ba94433615ff3632a264303bf0d0d655",
    CurrentComponentState="up_to_date",
    KitName="Objects",
    OutputWrappers="https://app.speckle.systems\t610393c107\t83f8d95360",
    UseDefaultCache=True,
    selectedKitName="Objects")
