# Grasshopper definition 10_LineToBeam.gh (Grasshopper 1.0.7)
# plug-ins: Karamba3D

crv = Curve(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)
crv_2 = Curve(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)
crv_3 = Curve(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)
crv_4 = Curve(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)
crv_5 = Curve(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)
entwine = Entwine(Branch00=crv, Branch01=crv_2, Branch02=crv_3, Branch03=crv_4, Branch04=crv_5, FlattenInputs=True)  # -> flatten(Result)
panel = Panel(entwine)
join = JoinCurves(Curves=flatten(entwine), Preserve=False)
end = EndPoints(Curve=join)  # -> Start, End
panel_2 = Panel("""A
B
C
D
E""")
linetobeam = LineToBeamKaramba3D(
    Line=graft(entwine),
    Identifier=graft(panel_2),
    New=True,
    Remove=True,
    LimitDistance_m=0.005,
    SetBucklingLength=Toggle(False),
    ToPolylineMaxAngle=Slider(0.25, range=0..1),
    ToPolylineTolerance=Slider(0.295, range=0.001..1),
    ToPolylineMinEdgeLength=Slider(0.48, range=0.1..1))  # -> Element, Points, Info
merge = Merge(Data1=end.Start)
dist = Distance(PointA=end.Start, PointB=end.End)
rdpoints = RemoveDuplicatePointsKaramba3D(Point=flatten(merge), LimitDistance=0.005)  # -> OutPoint, Info, Indexes
panel_3 = Panel(dist)
pt = Point(linetobeam.Points)
lng = ListLength(List=linetobeam.Element)
panel_4 = Panel(lng)
supp = SupportKaramba3D(PosInd=rdpoints.OutPoint, menu=[buttons(on, on, on, on, on, on)])
assemble = AssembleModelKaramba3D(Elem=flatten(linetobeam.Element), Support=flatten(supp), LimitDistance_m=0.005)  # -> Model, Info, Mass_kg, CenterOfGravity, LoadCaseNames
disassemble = DisassembleElementKaramba3D(Element=linetobeam.Element)  # -> Element, ElementIdentifier, AxisOfElement, CrossSection, Joint, Material, LocalCoordinateSystem, ElementIsActive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

# ---- group: Initial estimate for the buckling length
panel_5 = Panel(disassemble.BucklingLengthLT_m)

# ----
disassemble_2 = DisassembleModelKaramba3D(Model=assemble.Model)  # -> Model, Point, Beam, Shell, Support, Load, Line, Mesh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
disassemble_3 = DisassembleElementKaramba3D(Element=disassemble_2.Beam)  # -> Element, ElementIdentifier, AxisOfElement, CrossSection, Joint, Material, LocalCoordinateSystem, ElementIsActive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

# ---- group: Calculated estimate for the bucklin length
panel_6 = Panel(disassemble_3.BucklingLengthY_m)

# ----
modelview = ModelViewKaramba3D(Model=assemble.Model, ResultFactors=1, ResultCase=-1)  # -> Model, DeformedMesh, DeformedAxes, DeformedModel
