# Grasshopper definition 11_ShellSection.gh (Grasshopper 1.0.7)
# plug-ins: Karamba3D

# ----
# Geometry and Karamba3D Model Setup
number_slider = Slider(1, range=0..1)
extend = Slider(1, range=0..10)
sqgrid = Square(Plane=PlaneXY(0, 0, 0), Size=number_slider, ExtentX=extend, ExtentY=extend)  # -> Cells, Points
flatten = FlattenTree(Tree=sqgrid.Points, Path="{0}")
panel = Panel("""0
3""")
multiplication = Multiplication(A=extend, B=Slider(0.2, range=0..0.5))
item = ListItem(List=flatten, Index=panel, Wrap=True)
Z = UnitZ(Factor=multiplication)
move = Move(Geometry=item, Motion=Z)  # -> Geometry, Transform
replace = ReplaceItems(List=flatten, Item=move.Geometry, Indices=panel, Wrap=False)
num = Number(extend)
lng = ListLength(List=flatten(replace))
subtraction = Subtraction(A=lng, B=num, C=1)
series = Series(Start=0, Step=1, Count=subtraction)
partition = PartitionList(List=series, Size=expr("x+1", num))
cull_i = CullIndex(List=partition, Indices=-1, Wrap=True)
number = Number(expr("x+1", cull_i))
i = Number(cull_i)
addition = Addition(A=i, B=num, C=1)
addition_2 = Addition(A=number, B=num, C=1)
concat = Concatenate(
    FragmentA="Q{",
    FragmentB=i,
    FragmentC=";",
    FragmentD=addition,
    FragmentE=";",
    FragmentF=addition_2,
    FragmentG=";",
    FragmentH=number,
    FragmentI="}")
conmesh = ConstructMesh(Vertices=flatten(replace), Faces=flatten(concat))
tri = Triangulate(Mesh=conmesh)  # -> Mesh, Count
demesh = DeconstructMesh(Mesh=conmesh)  # -> Vertices, Faces, Colours, Normals
dom = ConstructDomain(DomainStart=0, DomainEnd=num)
subset = SubList(List=demesh.Vertices, Domain=dom, Wrap=True)  # -> List, Index
subset_2 = SubList(List=reverse(demesh.Vertices), Domain=dom, Wrap=True)  # -> List, Index
Z_2 = UnitZ(Factor=expr("-x", Slider(5, range=0..10)))
supp = SupportKaramba3D(PosInd=flatten(subset.List), menu=[buttons(on, on, on, on, on, on)])
loads = LoadsKaramba3D(ForceVector=Z_2, Local=False, PosInd=flatten(subset_2.List), LCase="0", mode="Point")
meshtoshell = MeshToShellKaramba3D(Mesh=tri.Mesh, LimitDistance_m=0.005)  # -> Element, Points, Info
assemble = AssembleModelKaramba3D(Elem=meshtoshell.Element, Support=supp, Load=loads, LimitDistance_m=0.005)  # -> Model, Info, Mass_kg, CenterOfGravity, LoadCaseNames
analyze = AnalyzeKaramba3D(Model=assemble.Model)  # -> CalculatedModel, MaximumDisplacement_cm, ResultingForceOfGravity_kN, ElasticEnergy_kNm

medges = MeshEdges(Mesh=tri.Mesh)  # -> NakedEdges, InteriorEdges, NonManifoldEdges
preview = CustomPreview(
    Geometry=[medges.NakedEdges, medges.InteriorEdges, medges.NonManifoldEdges],
    Material=ColourSwatch(SwatchColor=RGB(255, 0, 0)))

# ----
# Polyline definition
item_2 = ListItem(List=subset.List, Index=0, Wrap=True)  # -> Item1, Item
panel_2 = Panel("""1
-1""")
entwine = Entwine(Branch00=item_2.Item1, Branch01=item_2.Item, FlattenInputs=True)
Y = UnitY(Factor=panel_2)
move_2 = Move(Geometry=graft(entwine), Motion=graft(Y))  # -> Geometry, Transform
bang = ExplodeTree(Data=move_2.Geometry)  # -> Branch0, Branch1
vec = VectorXYZ(XComponent=Slider(0.5, range=0..3), YComponent=0, ZComponent=1)  # -> Vector, Length
ln = Line(StartPoint=bang.Branch1, EndPoint=bang.Branch0)
move_3 = Move(Geometry=ln, Motion=vec.Vector)  # -> Geometry, Transform

# ----
# Direction
pt = Point(Point(0, 0, 0))
Z_3 = UnitZ(Factor=-1)
rot3d = Rotate3D(Geometry=Z_3, Angle=degrees(Slider(0, range=-90..90)), Center=pt, Axis=Vector(0, 1, 0))  # -> Geometry, Transform
vdis = VectorDisplay(Anchor=pt, Vector=rot3d.Geometry)

modelview = ModelViewKaramba3D(Model=analyze.CalculatedModel, ResultFactors=1, ResultCase=-1)  # -> Model, DeformedMesh, DeformedAxes, DeformedModel
model = ModelKaramba3D(modelview.Model)
element = ElementKaramba3D(meshtoshell.Element)
crv = Curve(move_3.Geometry)
vec_2 = Vector(rot3d.Geometry)
s_forces = ShellSectionKaramba3D(
    AnalyzedModel=model,
    Polyline=crv,
    ProjectionDirection=vec_2,
    mode="Forces",
    menu=[checkbox(on), checkbox(on), checkbox(off), slider(20), slider(1), slider(0.1), checkbox(off), checkbox(off), checkbox(off), checkbox(off), checkbox(on), checkbox(off), checkbox(off), checkbox(off), checkbox(off), slider(1)])  # -> AnalyzedModel, Polylines, FaceIndexes, MeshesOfRenderedResults, CurvesOfRenderedResults, Ntt_kN_m, Nnn_kN_m, Ntn_kN_m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

explode = Explode(Curve=s_forces.Polylines, Recursive=True)  # -> Segments, Vertices
crossed_faces = Panel(s_forces.FaceIndexes)
mtn = Panel(s_forces.Mtn_kNm_m)
point_on_projected_polyline = Panel(explode.Vertices)
preview_2 = CustomPreview(Geometry=[explode.Vertices, explode.Segments], Material=ColourSwatch(SwatchColor=RGB(255, 0, 0)))
