# Grasshopper definition 12_BeamLoads.gh (Grasshopper 1.0.7)
# plug-ins: Karamba3D

X = UnitX(Factor=1)
pt = Point("0,1,0")
line = LineSDL(Start=pt, Direction=X, Length=Slider(7, range=1..10))
Y = UnitY(Factor=1)
rot3d = Rotate3D(Geometry=line, Angle=degrees(Slider(0, range=0..30)), Center=Point(0, 0, 0), Axis=Y)  # -> Geometry, Transform
end = EndPoints(Curve=rot3d.Geometry)  # -> Start, End
genes = GenePool(Decimals=2, Maximum=1, Minimum=0, Value=[0.11, 0.34, 0.34, 0.98])
supp = SupportKaramba3D(PosInd=[end.Start, end.End], menu=[buttons(on, on, on, on, on, on)])

Z = UnitZ(Factor="-1")
beam_loads = BeamLoadsKaramba3D(
    LoadCase="LC1",
    ForceVector=Z,
    TStart=Slider(0.24, range=0..1),
    TEnd=Slider(0.72, range=0..1),
    mode="Block",
    menu=[buttons(off, off, on)])

linetobeam = LineToBeamKaramba3D(
    Line=rot3d.Geometry,
    New=True,
    Remove=True,
    LimitDistance_m=0.005,
    Bending=True,
    SetBucklingLength=True,
    ToPolylineMaxAngle=0.03,
    ToPolylineTolerance=0.01,
    ToPolylineMinEdgeLength=0.25)  # -> Element, Points, Info
panel = Panel("""0
2
2.5
1""")
Z_2 = UnitZ(Factor=Slider(0, range=0..1))
Y_2 = UnitY(Factor=Slider(0.16, range=0..1))
Z_3 = UnitZ(Factor=1)
Z_4 = UnitZ(Factor=1)

Z_5 = UnitZ(Factor="-1")
beam_loads_2 = BeamLoadsKaramba3D(
    BeamIdentifier=linetobeam.Element,
    LoadCase="LC0",
    ForceVector=Z_5,
    TPosition=Slider(0.46, range=0..1),
    mode="Concentrated",
    menu=[buttons(on, off)])

beam_loads_3 = BeamLoadsKaramba3D(
    LoadCase="LC2",
    TranslationGap=Z_2,
    RotationalGap=Y_2,
    TPosition=Slider(0.47, range=0..1),
    mode="Gap",
    menu=[buttons(on, off)])
beam_loads_4 = BeamLoadsKaramba3D(LoadCase="0", LoadDirection=Z_3, ForcesValues=panel, Ts=genes, mode="Polylinear", menu=[buttons(off, off, on)])
beam_loads_5 = BeamLoadsKaramba3D(
    LoadCase="0",
    ForceVector=Z_4,
    TStart=Slider(0.21, range=0..1),
    TStartPlateau=Slider(0.43, range=0..1),
    TEndPlateau=Slider(0.7, range=0..1),
    TEnd=Slider(0.91, range=0..1),
    mode="Trapezoidal",
    menu=[buttons(on, off, off)])
load = LoadKaramba3D(beam_loads_2)
assemble = AssembleModelKaramba3D(Elem=linetobeam.Element, Support=supp, Load=load, LimitDistance_m=0.005)  # -> Model, Info, Mass_kg, CenterOfGravity, LoadCaseNames
analyze = AnalyzeKaramba3D(Model=assemble.Model)  # -> CalculatedModel, MaximumDisplacement_cm, ResultingForceOfGravity_kN, ElasticEnergyChange_kNm
modelview = ModelViewKaramba3D(Model=analyze.CalculatedModel, ResultFactors=1, ResultCase=-1)  # -> Model, DeformedMesh, DeformedAxes, DeformedModel
beamview = BeamViewKaramba3D(Model=modelview.Model)  # -> Model, MeshesOfRenderedBeams, DeformedBeamAxes, LegendColors, LegendTags
legend = Legend(Colour=beamview.LegendColors, Tags=beamview.LegendTags, LegendType=1)
