# Grasshopper definition 22_OrthotropicMaterials.gh (Grasshopper 1.0.7)
# plug-ins: Karamba3D

list = ValueList({"Mises": 0, "Tresca": 1, "Rankine": 2, "TsaiWu": 3}, selected="Mises")
matprops = MaterialPropertiesKaramba3D(
    FamilyOfMaterial="Steel",
    Name="S235",
    YoungsModulusKNCm2Dir1=Slider(2000, range=2000..21000),
    YoungsModulusKNCm2Dir2=Slider(21000, range=2000..21000),
    InPlaneShearModulus_kN_cm2=8076,
    InPlaneLateralContractionCoefficient=-1,
    TransverseShearModulusKNCm2Dir1=8076,
    TransverseShearModulusKNCm2Dir2=8076,
    SpecificWeight_kN_m3=78.5,
    CoefficientOfThermalExpansion1CDir1=1.2e-05,
    CoefficientOfThermalExpansion1CDir2=1.2e-05,
    TensileStrengthKNCm2Dir1=23.5,
    TensileStrengthKNCm2Dir2=23.5,
    CompressiveStrengthKNCm2Dir1=-23.5,
    CompressiveStrengthKNCm2Dir2=-23.5,
    ShearStrengthKNCm2Dir12=13.6,
    TsaiWuIntCoeff=0,
    StrengthHypothesis=list,
    mode="Orthotropic")
cone = Cone(Base=PlaneXY(0, 0, 0), Radius=Slider(5.1, range=1..10), Length=Slider(3.5, range=1..10))  # -> Cone, Tip
cross_section = CrossSectionKaramba3D(FamilyNameOfCrossSection="DefaultCroSec", Material=matprops, Height_cm=1, mode="Shell - Const")
mesh_breps = MeshBrepsKaramba3D(
    Brep=cone.Cone,
    MeshResolution=Slider(0.2, range=0.2..2),
    EdgeRefinementFactor=0.67,
    PointReduction=False,
    SmoothingStepSize=0,
    SmoothingIterations=5)  # -> Mesh, Info
srf = Surface(cone.Cone)
mesh = Mesh(mesh_breps.Mesh)
facen = FaceNormals(Mesh=mesh)  # -> Centers, Normals
meshtoshell = MeshToShellKaramba3D(Mesh=mesh_breps.Mesh, CrossSection=cross_section, LimitDistance_m=0.005)  # -> Element, Points, Info
pt = Point(meshtoshell.Points)
points_from_xyz = PointsFromXYZ(point=pt, Z="-1e-5 to 1e-5", tolerance=0.001)
srf_2 = Surface(cone.Cone)
srf_cp = SurfaceClosestPoint(Point=facen.Centers, Surface=srf)  # -> Point, UVPoint, Distance
Z = UnitZ(Factor="-1")
srf_cp_2 = SurfaceClosestPoint(Point=points_from_xyz, Surface=srf_2)  # -> Point, UVPoint, Distance
evalsrf = EvaluateSurface(Surface=srf, Point=srf_cp.UVPoint)  # -> Point, Normal, UDirection, VDirection, Frame
loads = LoadsKaramba3D(Vector=Z, Mesh=mesh_breps.Mesh, LCase="0", mode="MeshLoad -Const.", menu=[buttons(off, on, off), buttons(on, on)])
evalsrf_2 = EvaluateSurface(Surface=srf_2, Point=srf_cp_2.UVPoint)  # -> Point, Normal, UDirection, VDirection, Frame
vdis = VectorDisplay(Anchor=evalsrf.Point, Vector=evalsrf.UDirection)
orientate = OrientateElemKaramba3D(Shell=meshtoshell.Element, XOrientations=evalsrf.UDirection, mode="Shell")
supp = SupportKaramba3D(PosInd=points_from_xyz, PlaneOfReference=evalsrf_2.Frame, menu=[buttons(on, on, off, off, off, off)])
assemble = AssembleModelKaramba3D(Elem=orientate, Support=supp, Load=loads, LimitDistance_m=0.005)  # -> Model, Info, Mass_kg, CenterOfGravity, LoadCaseNames
analyze = AnalyzeKaramba3D(Model=assemble.Model)  # -> CalculatedModel, MaximumDisplacement_cm, ResultingForceOfGravity_kN, ElasticEnergyChange_kNm
modelview = ModelViewKaramba3D(Model=analyze.CalculatedModel, ResultFactors=1, ResultCase=-1)  # -> Model, DeformedMesh, DeformedAxes, DeformedModel
shellview = ShellViewKaramba3D(Model=modelview.Model, IndexOfLayer=0)  # -> Model, MeshesOfRenderedShells, LegendColors, LegendTags

# ==== cluster PointsFromXYZ
tolerance = ClusterInput()
point = ClusterInput()
X = ClusterInput()
Y = ClusterInput()
Z = ClusterInput()
tolerance_2 = Number(tolerance)
point_2 = Point(point)
X_2 = Domain(X)
Y_2 = Domain(Y)
Z_2 = Domain(Z)
deconstruct = Deconstruct(Point=point_2)  # -> XComponent, YComponent, ZComponent
deconstruct_domain = DeconstructDomain(Domain=X_2)  # -> Start, End
deconstruct_domain_2 = DeconstructDomain(Domain=Y_2)  # -> Start, End
deconstruct_domain_3 = DeconstructDomain(Domain=Z_2)  # -> Start, End
absolute = Absolute(Value=tolerance_2)
subtraction = Subtraction(A=deconstruct_domain.Start, B=absolute)
addition = Addition(A=deconstruct_domain.End, B=absolute)
subtraction_2 = Subtraction(A=deconstruct_domain_2.Start, B=absolute)
addition_2 = Addition(A=deconstruct_domain_2.End, B=absolute)
subtraction_3 = Subtraction(A=deconstruct_domain_3.Start, B=absolute)
addition_3 = Addition(A=deconstruct_domain_3.End, B=absolute)
number = Number(deconstruct.XComponent)
number_2 = Number(deconstruct.YComponent)
number_3 = Number(deconstruct.ZComponent)
larger_than = LargerThan(FirstNumber=number, SecondNumber=subtraction)  # -> LargerThan, OrEqualTo
smaller_than = SmallerThan(FirstNumber=number, SecondNumber=addition)  # -> SmallerThan, OrEqualTo
larger_than_2 = LargerThan(FirstNumber=number_2, SecondNumber=subtraction_2)  # -> LargerThan, OrEqualTo
smaller_than_2 = SmallerThan(FirstNumber=number_2, SecondNumber=addition_2)  # -> SmallerThan, OrEqualTo
larger_than_3 = LargerThan(FirstNumber=number_3, SecondNumber=subtraction_3)  # -> LargerThan, OrEqualTo
smaller_than_3 = SmallerThan(FirstNumber=number_3, SecondNumber=addition_3)  # -> SmallerThan, OrEqualTo
gate_and = GateAnd(A=larger_than.OrEqualTo, B=smaller_than.OrEqualTo)
gate_and_2 = GateAnd(A=larger_than_2.OrEqualTo, B=smaller_than_2.OrEqualTo)
gate_and_3 = GateAnd(A=larger_than_3.OrEqualTo, B=smaller_than_3.OrEqualTo)
c_script = CSharpScript(value=X_2, bool=gate_and)  # -> out, result
# ---------- c_script: C# ----------
    if(_value == null)
      result_ = true;
    else result_ = _bool;
# ---------- end c_script ----------
c_script_2 = CSharpScript(value=Y_2, bool=gate_and_2)  # -> out, result; same code as c_script
c_script_3 = CSharpScript(value=Z_2, bool=gate_and_3)  # -> out, result; same code as c_script
gate_and_4 = GateAnd(A=c_script.result, B=c_script_2.result)
gate_and_5 = GateAnd(A=gate_and_4, B=c_script_3.result)
point_3 = Point(point_2)
cull_pattern = CullPattern(List=point_3, CullPattern=gate_and_5)
point_4 = Point(cull_pattern)
point_5 = ClusterOutput(point_4)
