# Grasshopper definition 25_ForceFlowLines.gh (Grasshopper 1.0.7)
# plug-ins: Karamba3D

# For details see: H. Moldenhauer: Die Visualisierung des Kraftflusses in Stahlkonstruktionen, in 'Stahlbau', Volume 81, Issue 1, pages 32-40,Ernst & Sohn, 2012.
number_slider = Slider(3.7, range=1..5)
number_slider_2 = Slider(4, range=1..10)
xz = XZPlane(Origin=Point(0, 0, 0))
dom = ConstructDomain(DomainStart="0", DomainEnd=number_slider)
dom_2 = ConstructDomain(DomainStart="0", DomainEnd=number_slider_2)
xz_2 = XZPlane(Origin=Point(0, 0, 0))
planesrf = PlaneSurface(Plane=xz, XSize=dom, YSize=dom_2)
dom_3 = ConstructDomain(DomainStart=number_slider_2, DomainEnd=number_slider_2)
cir = Circle(Plane=xz_2, Radius=Slider(1.1, range=0.1..2))
boundary = BoundarySurfaces(Edges=cir)
rdiff = RegionDifference(CurvesA=planesrf, CurvesB=boundary)
cross_section = CrossSectionKaramba3D(
    FamilyNameOfCrossSection="DefaultCroSec",
    Diameter_in="0.1",
    WallThickness_in=expr("x*0.5", "0.1"),
    mode="Circular Hollow")
boundary_2 = BoundarySurfaces(Edges=rdiff)
mesh_breps = MeshBrepsKaramba3D(
    Brep=boundary_2,
    MeshResolution=Slider(0.1, range=0.05..1),
    EdgeRefinementFactor=0.67,
    PointReduction=False,
    SmoothingStepSize="1.0",
    SmoothingIterations=5)  # -> Mesh, Info

# ---- group: Mirror Mesh
cluster = Cluster(mesh=mesh_breps.Mesh)

# ----
meshtoshell = MeshToShellKaramba3D(Mesh=mesh_breps.Mesh, LimitDistance_ft=0.005)  # -> Element, Points, Info
points_from_xyz = PointsFromXYZ(point=meshtoshell.Points, Z=dom_3, tolerance=0.001)
pdecon = Deconstruct(Point=points_from_xyz)  # -> XComponent, YComponent, ZComponent
sort = SortList(Keys=pdecon.XComponent, ValuesA=points_from_xyz)  # -> Keys, ValuesA
pline = PolyLine(Vertices=sort.ValuesA, Closed=False)
points_from_xyz_2 = PointsFromXYZ(point=meshtoshell.Points, Z="0", tolerance=0.001)
points_from_xyz_3 = PointsFromXYZ(point=meshtoshell.Points, X="0", tolerance=0.001)
explode = Explode(Curve=pline, Recursive=True)  # -> Segments, Vertices
Z = UnitZ(Factor="-10")
linetobeam = LineToBeamKaramba3D(
    Line=explode.Segments,
    Identifier="DummyBeam",
    CrossSection=cross_section,
    New=True,
    Remove=True,
    LimitDistance_ft=0.005,
    Bending=True,
    SetBucklingLength=True,
    ToPolylineMaxAngle=0.03,
    ToPolylineTolerance=0.01,
    ToPolylineMinEdgeLength=0.25)  # -> Element, Points, Info
supp = SupportKaramba3D(PosInd=points_from_xyz_2, menu=[buttons(off, on, on, off, on, off)])
supp_2 = SupportKaramba3D(PosInd=points_from_xyz_3, menu=[buttons(on, on, off, off, off, off)])
beam_loads = BeamLoadsKaramba3D(BeamIdentifier="DummyBeam", LoadCase="0", ForceVector=Z, TStart=0, TEnd=1, mode="Block", menu=[buttons(on, off, off)])
element = ElementKaramba3D(flatten([meshtoshell.Element, linetobeam.Element]))
support = SupportKaramba3D(flatten([supp, supp_2]))
assemble = AssembleModelKaramba3D(Elem=element, Support=support, Load=beam_loads, LimitDistance_m=0.005)  # -> Model, Info, Mass_kg, CenterOfGravity, LoadCaseNames
analyze = AnalyzeKaramba3D(Model=assemble.Model)  # -> CalculatedModel, MaximumDisplacement_cm, ResultingForceOfGravity_kN, ElasticEnergyChange_kNm
modelview = ModelViewKaramba3D(Model=analyze.CalculatedModel, ResultFactors=1, ResultCase=-1)  # -> Model, DeformedMesh, DeformedAxes, DeformedModel
shellview = ShellViewKaramba3D(Model=modelview.Model, IndexOfLayer=0)  # -> Model, MeshesOfRenderedShells, LegendColors, LegendTags
end = EndPoints(Curve=pline)  # -> Start, End
legend = Legend(Colour=shellview.LegendColors, Tags=shellview.LegendTags, LegendType=1)
ln = Line(StartPoint=end.Start, EndPoint=end.End)

# ---- group: Mirror Mesh
cluster_2 = Cluster(mesh=shellview.MeshesOfRenderedShells)

# ----
num = Number(number_slider_2)
midpt = CurveMiddle(Curve=ln)
debrep = DeconstructBrep(Brep=boundary_2)  # -> Faces, Edges, Vertices
multiplication = Multiplication(A=num, B=Slider(0.63, range=0..1))
item = ListItem(List=debrep.Edges, Index=0, Wrap=True)  # -> Item1, Item
Z_2 = UnitZ(Factor="-1")
Y = UnitY(Factor="1")
scale = Scale(Geometry=ln, Center=midpt, Factor="0.99")  # -> Geometry, Transform
Z_3 = UnitZ(Factor=expr("-x", multiplication))
divide = DivideCurve(Curve=item.Item1, Count=10, Kinks=False)  # -> Points, Tangents, Parameters; disabled
rot3d = Rotate3D(Geometry=Z_2, Angle=degrees(Slider(0, range=0..90)), Center=Point(0, 0, 0), Axis=Y)  # -> Geometry, Transform
move = Move(Geometry=scale.Geometry, Motion=Z_3)  # -> Geometry, Transform
Y_2 = UnitY(Factor=1)
pt = Point(flatten([sort.ValuesA, divide.Points]))
shelllineresults = LineResultsOnShellsKaramba3D(
    AnalyzedModel=shellview.Model,
    LayerPosition=0,
    GlobalForceDirections=rot3d.Geometry,
    ListOfSourcesOfForceFlowLinesLinesPoints=pt,
    SegmentLength_m=0.5,
    DA_deg=5,
    Theta_deg=Slider(0, range=0..90),
    mode="ForceFlow")  # -> AnalyzedModel, Lines
s_forces = ShellSectionKaramba3D(
    AnalyzedModel=shellview.Model,
    Polyline=move.Geometry,
    ProjectionDirection=Y_2,
    mode="Forces",
    menu=[checkbox(on), checkbox(on), checkbox(off), slider(9), slider(0.1), slider(1), checkbox(on), checkbox(on), checkbox(off), checkbox(off), checkbox(off), checkbox(off), checkbox(off), checkbox(off), checkbox(off), slider(1)])  # -> AnalyzedModel, Polylines, FaceIndexes, MeshesOfRenderedResults, CurvesOfRenderedResults, Ntt_kN_m, Nnn_kN_m, Ntn_kN_m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
vdis = VectorDisplay(Anchor="0,0,0", Vector=rot3d.Geometry)
Y_3 = UnitY(Factor="-0.05")

# ---- group: Mirror Curves
cluster_3 = Cluster_2(crv=shelllineresults.Lines)

# ----
move_2 = Move(Geometry=shelllineresults.Lines, Motion=Y_3)  # -> Geometry, Transform
join = JoinCurves(Curves=move_2.Geometry, Preserve=False)
item_2 = ListItem(List=flatten(join), Index=Slider(13, range=0..54), Wrap=True)
preview = CustomPreview(Geometry=item_2, Material=ColourSwatch(SwatchColor=RGB(255, 255, 255)))
s_forces_2 = ShellSectionKaramba3D(
    AnalyzedModel=shellview.Model,
    Polyline=join,
    ProjectionDirection=Y_2,
    mode="Forces",
    menu=[checkbox(on), checkbox(on), checkbox(off), slider(8), slider(0.1), slider(1), checkbox(on), checkbox(on), checkbox(off), checkbox(off), checkbox(off), checkbox(off), checkbox(off), checkbox(off), checkbox(off), slider(1)])  # -> AnalyzedModel, Polylines, FaceIndexes, MeshesOfRenderedResults, CurvesOfRenderedResults, Ntt_kN_m, Nnn_kN_m, Ntn_kN_m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; disabled

# ==== cluster PointsFromXYZ
tolerance = ClusterInput()
point = ClusterInput()
X = ClusterInput()
Y = ClusterInput()
Z = ClusterInput()
tolerance_2 = Number(tolerance)
point_2 = Point(point)
X_2 = Domain(X)
Y_2 = Domain(Y)
Z_2 = Domain(Z)
deconstruct = Deconstruct(Point=point_2)  # -> XComponent, YComponent, ZComponent
deconstruct_domain = DeconstructDomain(Domain=X_2)  # -> Start, End
deconstruct_domain_2 = DeconstructDomain(Domain=Y_2)  # -> Start, End
deconstruct_domain_3 = DeconstructDomain(Domain=Z_2)  # -> Start, End
absolute = Absolute(Value=tolerance_2)
subtraction = Subtraction(A=deconstruct_domain.Start, B=absolute)
addition = Addition(A=deconstruct_domain.End, B=absolute)
subtraction_2 = Subtraction(A=deconstruct_domain_2.Start, B=absolute)
addition_2 = Addition(A=deconstruct_domain_2.End, B=absolute)
subtraction_3 = Subtraction(A=deconstruct_domain_3.Start, B=absolute)
addition_3 = Addition(A=deconstruct_domain_3.End, B=absolute)
number = Number(deconstruct.XComponent)
number_2 = Number(deconstruct.YComponent)
number_3 = Number(deconstruct.ZComponent)
larger_than = LargerThan(FirstNumber=number, SecondNumber=subtraction)  # -> LargerThan, OrEqualTo
smaller_than = SmallerThan(FirstNumber=number, SecondNumber=addition)  # -> SmallerThan, OrEqualTo
larger_than_2 = LargerThan(FirstNumber=number_2, SecondNumber=subtraction_2)  # -> LargerThan, OrEqualTo
smaller_than_2 = SmallerThan(FirstNumber=number_2, SecondNumber=addition_2)  # -> SmallerThan, OrEqualTo
larger_than_3 = LargerThan(FirstNumber=number_3, SecondNumber=subtraction_3)  # -> LargerThan, OrEqualTo
smaller_than_3 = SmallerThan(FirstNumber=number_3, SecondNumber=addition_3)  # -> SmallerThan, OrEqualTo
gate_and = GateAnd(A=larger_than.OrEqualTo, B=smaller_than.OrEqualTo)
gate_and_2 = GateAnd(A=larger_than_2.OrEqualTo, B=smaller_than_2.OrEqualTo)
gate_and_3 = GateAnd(A=larger_than_3.OrEqualTo, B=smaller_than_3.OrEqualTo)
c_script = CSharpScript(value=X_2, bool=gate_and)  # -> out, result
# ---------- c_script: C# ----------
    if(_value == null)
      result_ = true;
    else result_ = _bool;
# ---------- end c_script ----------
c_script_2 = CSharpScript(value=Y_2, bool=gate_and_2)  # -> out, result; same code as c_script
c_script_3 = CSharpScript(value=Z_2, bool=gate_and_3)  # -> out, result; same code as c_script
gate_and_4 = GateAnd(A=c_script.result, B=c_script_2.result)
gate_and_5 = GateAnd(A=gate_and_4, B=c_script_3.result)
point_3 = Point(point_2)
cull_pattern = CullPattern(List=point_3, CullPattern=gate_and_5)
point_4 = Point(cull_pattern)
point_5 = ClusterOutput(point_4)

# ==== cluster Cluster
mesh = ClusterInput()
yz = YZPlane(Origin=Point(0, 0, 0))
mesh_2 = Mesh(mesh)
mirror = Mirror(Geometry=mesh_2, Plane=yz)  # -> Geometry, Transform
xy = XYPlane(Origin=Point(0, 0, 0))
mirror_2 = Mirror(Geometry=[mirror.Geometry, mesh_2], Plane=xy)  # -> Geometry, Transform
mesh_3 = Mesh([mirror.Geometry, mesh_2, mirror_2.Geometry])
mesh_4 = ClusterOutput(mesh_3)

# ==== cluster Cluster_2
crv = ClusterInput()
crv_2 = Curve(crv)
yz = YZPlane(Origin=Point(0, 0, 0))
mirror = Mirror(Geometry=crv_2, Plane=yz)  # -> Geometry, Transform
xy = XYPlane(Origin=Point(0, 0, 0))
mirror_2 = Mirror(Geometry=[mirror.Geometry, crv_2], Plane=xy)  # -> Geometry, Transform
crv_3 = Curve([mirror_2.Geometry, mirror.Geometry, crv_2])
crv_4 = ClusterOutput(crv_3)
