# Grasshopper definition 28_SimpleBuckling.gh (Grasshopper 1.0.7)
# plug-ins: Karamba3D

# Simple Buckling
L = Slider(5, range=1..20)
line = LineSDL(Start="0,1,0", Direction=Vector(0, 0, 1), Length=L)
c = Slider(800, range=10..1000)
N = Slider(-10, range=-100..-1)
end = EndPoints(Curve=line)  # -> Start, End
linetobeam = LineToBeamKaramba3D(
    Line=line,
    New=True,
    Remove=True,
    LimitDistance_m=0.005,
    Bending=True,
    SetBucklingLength=True,
    ToPolylineMaxAngle=0.03,
    ToPolylineTolerance=0.01,
    ToPolylineMinEdgeLength=0.25)  # -> Element, Points, Info
vec = VectorXYZ(XComponent=0, YComponent=c, ZComponent=0)  # -> Vector, Length
vec_2 = VectorXYZ(XComponent=0, YComponent=0, ZComponent=N)  # -> Vector, Length
supp = SupportKaramba3D(PosInd=end.Start, menu=[buttons(on, on, on, on, on, on)])
beam_joints = BeamJointsKaramba3D(
    CtKNMAtStartingNode=Vector(0, 0, 0),
    CrKNmRadAtStartingNode=vec.Vector,
    CtKNMAtEndNode=Vector(0, 0, 0),
    CrKNmRadAtEndNode=Vector(0, 0, 0),
    menu=[buttons(off, off, off, off, on, off), buttons(off, off, off, off, off, off)])
modifyelem = ModifyElementKaramba3D(Beam=linetobeam.Element, Height_cm=Slider(15.2, range=11.4..200), Thickness_cm=Slider(0.04, range=0.04..5), mode="Beam")
loads = LoadsKaramba3D(ForceVector=vec_2.Vector, Local=False, PosInd=end.End, LCase="0", mode="Point")
assemble = AssembleModelKaramba3D(Elem=modifyelem, Support=supp, Load=loads, Joint=beam_joints, LimitDistance_m=0.005)  # -> Model, Info, Mass_kg, CenterOfGravity, LoadCaseNames
analyzethii = AnalyzeThIIKaramba3D(Model=assemble.Model, LoadCase="-1", RTolerance=1e-07, MaxIterations=50, NoTensionalNII=False)  # -> CalculatedModel, MaximumDisplacement_cm, ResultingForceOfGravity_kN, ElasticEnergyChange_kNm
modelview = ModelViewKaramba3D(Model=analyzethii.CalculatedModel, ResultFactors=1, ResultCase=-1)  # -> Model, DeformedMesh, DeformedAxes, DeformedModel
bmodes = BucklingModesKaramba3D(Model=modelview.Model, FromIndex=1, NumberOfModes="1", MaximumNumberOfIterations=300, Epsilon=1e-07)  # -> ModelWithBucklingModesAsLoadCaseResults, BucklingLoadFactors
num = Number(bmodes.BucklingLoadFactors)
expression = Expression(L=L, c=c, Expression="c/L")
multiplication = Multiplication(A=num, B=N)
neg = Negative(Value=multiplication)
panel = Panel(bmodes.BucklingLoadFactors)
panel_2 = Panel(neg)
panel_3 = Panel(expression)
modelview_2 = ModelViewKaramba3D(Model=bmodes.ModelWithBucklingModesAsLoadCaseResults, ResultFactors=1, ResultCase=-1)  # -> Model, DeformedMesh, DeformedAxes, DeformedModel
beamview = BeamViewKaramba3D(Model=modelview_2.Model)  # -> Model, MeshesOfRenderedBeams, DeformedBeamAxes, LegendColors, LegendTags
