# Grasshopper definition 29_SimpleMembrane.gh (Grasshopper 1.0.7)
# plug-ins: Karamba3D

matprops = MaterialPropertiesKaramba3D(
    FamilyOfMaterial="Steel",
    Name="S235",
    YoungsModulus_kN_cm2="2130",
    InPlaneShearModulus_kN_cm2="1000",
    TransverseShearModulus_kN_cm2="1000",
    SpecificWeight_kN_m3="20",
    CoefficientOfThermalExpansion_1_C=1.2e-05,
    TensileStrength_kN_cm2=23.5,
    CompressiveStrength_kN_cm2=-23.5,
    StrengthHypothesis="MISES",
    mode="Isotrop")
planesrf = PlaneSurface(Plane=PlaneXY(0, 0, 0), XSize=Domain(-10, 10), YSize=Domain(-10, 10))
cross_section = CrossSectionKaramba3D(FamilyNameOfCrossSection="DefaultCroSec", Material=matprops, Height_cm="1", mode="Shell - Const")
mesh_breps = MeshBrepsKaramba3D(
    Brep=planesrf,
    MeshResolution=1,
    EdgeRefinementFactor=0.67,
    PointReduction=False,
    SmoothingStepSize=0,
    SmoothingIterations=5)  # -> Mesh, Info
debrep = DeconstructBrep(Brep=planesrf)  # -> Faces, Edges, Vertices
Z = UnitZ(Factor=Slider(-1, range=-10..0))
supp = SupportKaramba3D(PosInd=debrep.Vertices, menu=[buttons(on, on, on, off, off, off)])
loads = LoadsKaramba3D(Eps0=Slider(-2.381, range=-10..0), LCase="0", mode="InitialStrain")
loads_2 = LoadsKaramba3D(Vector=Z, LCase="0", mode="Gravity")  # disabled
meshtoshell = MeshToShellKaramba3D(Mesh=mesh_breps.Mesh, Identifier="A", CrossSection=cross_section, LimitDistance_m=0.005, Bending=Toggle(False))  # -> Element, Points, Info
panel = Panel(meshtoshell.Element)
load = LoadKaramba(flatten([loads, loads_2]))
support = SupportKaramba3D(supp)
assemble = AssembleModelKaramba3D(Elem=meshtoshell.Element, Support=support, Load=load, LimitDistance_m=0.005)  # -> Model, Info, Mass_kg, CenterOfGravity, LoadCaseNames
analyze = AnalyzeKaramba3D(Model=assemble.Model)  # -> CalculatedModel, MaximumDisplacement_cm, ResultingForceOfGravity_kN, ElasticEnergyChange_kNm
analyzethii = AnalyzeThIIKaramba3D(Model=assemble.Model, RTolerance=1e-07, MaxIterations=50, NoTensionalNII=False)  # -> CalculatedModel, MaximumDisplacement_cm, ResultingForceOfGravity_kN, ElasticEnergy_kNm
panel_2 = Panel(analyzethii.MaximumDisplacement_cm)
panel_3 = Panel(analyze.MaximumDisplacement_cm)
modelview = ModelViewKaramba3D(Model=analyzethii.CalculatedModel, ResultFactors=1, ResultCase=-1)  # -> Model, DeformedMesh, DeformedAxes, DeformedModel
shellview = ShellViewKaramba3D(Model=modelview.Model, IndexOfLayer=0)  # -> Model, MeshesOfRenderedShells, LegendColors, LegendTags
legend = Legend(Colour=shellview.LegendColors, Tags=shellview.LegendTags, LegendType=1)
md_slider = MDSlider(
    SliderMode=0,
    slider_value=Point(0.3693371284, 0.3797908876, 0.5),
    x_domain=Domain(0, 1),
    y_domain=Domain(0, 1),
    z_domain=Domain(0, 1))
iso = IsoCurve(Surface=reparameterize(planesrf), UVPoint=md_slider)  # -> UIsocurve, VIsocurve
s_forces = ShellSectionKaramba3D(
    AnalyzedModel=shellview.Model,
    Polyline=iso.VIsocurve,
    ProjectionDirection=Vector(0, 0, -1),
    mode="Forces",
    menu=[checkbox(on), checkbox(on), checkbox(on), slider(20), slider(0.09), slider(1), checkbox(on), checkbox(off), checkbox(off), checkbox(off), checkbox(off), checkbox(off), checkbox(off), checkbox(off), checkbox(off), slider(2.25)])  # -> AnalyzedModel, Polylines, FaceIndexes, MeshesOfRenderedResults, CurvesOfRenderedResults, Ntt_kN_m, Nnn_kN_m, Ntn_kN_m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
