# Grasshopper definition 31_InvertedCatenaryBeam.gh (Grasshopper 1.0.7)
# plug-ins: Karamba3D

# Inverted Catenary - Beam
panel = Panel("0,1,0")
Z = UnitZ(Factor=1)
pt = Point(panel)
pt_2 = Point("15,1,0")
panel_2 = Panel("""0
1""")
cat = Catenary(PointA=pt, PointB=pt_2, Length=Slider(15.1, range=15.1..30), Gravity=Z)
explode = Explode(Curve=cat, Recursive=True)  # -> Segments, Vertices
crv = Curve(cat)
Z_2 = UnitZ(Factor="-1")
intcrv = Interpolate(Vertices=explode.Vertices, Degree=3, Periodic=False, KnotStyle=1)  # -> Curve, Length, Domain
frame = CurveFrame(Curve=reparameterize(intcrv.Curve), Parameter=panel_2)
pln = Plane(frame)
supp = SupportKaramba3D(PosInd=pln, PlaneOfReference=pln, menu=[buttons(on, off, on, off, off, off)])
beam_loads = BeamLoadsKaramba3D(LoadCase="0", ForceVector=Z_2, TStart=0, TEnd=1, mode="Block", menu=[buttons(off, on, off)])
shatter = Shatter(Curve=reparameterize(intcrv.Curve), Parameters="0.5")
end = EndPoints(Curve=shatter)  # -> Start, End
item = ListItem(List=end.End, Index=0, Wrap=True)
supp_2 = SupportKaramba3D(PosInd=item, menu=[buttons(off, off, off, on, on, off)])
panel_3 = Panel("""A
B""")
linetobeam = LineToBeamKaramba3D(
    Line=graft(shatter),
    Identifier=graft(panel_3),
    New=True,
    Remove=True,
    LimitDistance_m="0.000001",
    Bending=True,
    SetBucklingLength=True,
    ToPolylineMaxAngle=Slider(0.50623, range=5e-05..1.03),
    ToPolylineTolerance=Slider(0.23297, range=5e-05..0.25),
    ToPolylineMaxEdgeLength=Slider(0.146, range=0.02..1.03))  # -> flatten(Element), Points, Info
support = SupportKaramba3D(flatten([supp, supp_2]))
load = LoadKaramba3D(flatten(beam_loads))
assemble = AssembleModelKaramba3D(Elem=linetobeam.Element, Support=support, Load=load, LimitDistance_m="0.000001")  # -> Model, Info, Mass_kg, CenterOfGravity, LoadCaseNames
analyzethii = AnalyzeThIIKaramba3D(Model=assemble.Model, LoadCase="-1", RTolerance=1e-07, MaxIterations=50, NoTensionalNII=False)  # -> CalculatedModel, MaximumDisplacement_cm, ResultingForceOfGravity_kN, ElasticEnergyChange_kNm
bmodes = BucklingModesKaramba3D(Model=analyzethii.CalculatedModel, FromIndex=1, NumberOfModes="5", MaximumNumberOfIterations=300, Epsilon=1e-07)  # -> ModelWithBucklingModesAsLoadCaseResults, BucklingLoadFactors
analyze = AnalyzeKaramba3D(Model=assemble.Model)  # -> CalculatedModel, MaximumDisplacement_cm, ResultingForceOfGravity_kN, ElasticEnergyChange_kNm
panel_4 = Panel(bmodes.BucklingLoadFactors)
panel_5 = Panel(analyze.MaximumDisplacement_cm)
panel_6 = Panel(analyzethii.MaximumDisplacement_cm)
modelview = ModelViewKaramba3D(Model=analyzethii.CalculatedModel, ResultFactors=1, ResultCase=-1)  # -> Model, DeformedMesh, DeformedAxes, DeformedModel
beamview = BeamViewKaramba3D(Model=modelview.Model)  # -> Model, MeshesOfRenderedBeams, DeformedBeamAxes, LegendColors, LegendTags
legend = Legend(Colour=beamview.LegendColors, Tags=beamview.LegendTags, LegendType=1)
b_forces = BeamForcesKaramba3D(AnalyzedModel=beamview.Model, Ts=[0, 1])  # -> AnalyzedModel, NormalForce_kN, ShearForceVz_kN, ShearForceVy_kN, TorsionalMomentMt_kNm, BendingMomentMy_kNm, BendingMomentMz_kNm
nodedisp = NodalDisplacementsKaramba3D(AnalyzedModel=beamview.Model, PositionsIndexes=item)  # -> AnalyzedModel, NodalTranslations_m, NodalRotations_rad
end_2 = EndPoints(Curve=intcrv.Curve)  # -> Start, End
nodedisp_2 = NodalDisplacementsKaramba3D(AnalyzedModel=beamview.Model, PositionsIndexes=end_2.Start)  # -> AnalyzedModel, NodalTranslations_m, NodalRotations_rad
devec = DeconstructVector(Vector=nodedisp.NodalTranslations_m)  # -> XComponent, YComponent, ZComponent
bnd = Bounds(Numbers=flatten(b_forces.NormalForce_kN))
bnd_2 = Bounds(Numbers=flatten(b_forces.BendingMomentMy_kNm))
devec_2 = DeconstructVector(Vector=nodedisp_2.NodalTranslations_m)  # -> XComponent, YComponent, ZComponent
panel_7 = Panel(bnd_2)
panel_8 = Panel(bnd)
subtraction = Subtraction(A=devec.ZComponent, B=devec_2.ZComponent)
panel_9 = Panel(subtraction)
