# Grasshopper definition 32_Nervi.gh (Grasshopper 1.0.8)
# plug-ins: Karamba3D, Hops

number_slider = Slider(10, range=5..50)
rectangle = Rectangle(Plane=PlaneXY(0, 0, 0), XSize=number_slider, YSize=number_slider, Radius=0)  # -> Rectangle, Length
unit_z = UnitZ(Factor=Slider(5, range=5..50))
move = Move(Geometry=rectangle.Rectangle, Motion=unit_z)  # -> Geometry, Transform
negative = Negative(Value=unit_z)
boundary_surfaces = BoundarySurfaces(Edges=move.Geometry)  # -> reparameterize(Surfaces)
md_slider = MDSlider(SliderMode=0, slider_value=Point(0.5, 0.5, 0.5), x_domain=Domain(0, 1), y_domain=Domain(0, 1), z_domain=Domain(0, 1))
evaluate_surface = EvaluateSurface(Surface=boundary_surfaces, Point=md_slider)  # -> Point, Normal, UDirection, VDirection, Frame
point = Point(evaluate_surface.Point)
surface = Surface(boundary_surfaces)
surface_2 = Surface(surface)
curve = Curve(move.Geometry)
move_2 = Move(Geometry=point, Motion=negative)  # -> Geometry, Transform
point_2 = Point(point)
line = Line(StartPoint=move_2.Geometry, EndPoint=point)
matselect = MaterialSelectionKaramba3D(menu=[dropdown(7), dropdown(1)])

# ---- group: Cross Section (Karamba3D)
crosec = CrossSectionKaramba3D(
    FamilyNameOfCrossSection="DefaultCroSec",
    Material=matselect,
    Height_cm="50",
    UpperFlangeWidth_cm="50",
    LowerFlangeWidth_cm="50",
    mode="Trapezoid")

crosec_2 = CrossSectionKaramba3D(FamilyNameOfCrossSection="DefaultCroSec", Material=matselect, Height_cm="20", mode="Shell - Const")

# ---- group: Mesh Breps (Karamba3D)
mesh_breps = MeshBrepsKaramba3D(
    Brep=surface,
    InclusionPoints=point,
    MeshResolution="0.1",
    EdgeRefinementFactor=0.67,
    PointReduction=False,
    SmoothingStepSize=0,
    SmoothingIterations=5)  # -> Mesh, Info

# ----
supp = SupportKaramba3D(PosInd=move_2.Geometry, menu=[buttons(on, on, on, off, off, on)])
loads = LoadsKaramba3D(Vector=Vector(0, 0, -1), LCase="LC0", mode="Gravity")
linetobeam = LineToBeamKaramba3D(
    Line=line,
    CrossSection=crosec,
    New=True,
    Remove=True,
    LimitDistance_m=0.005,
    Bending=True,
    SetBucklingLength=True,
    ToPolylineMaxAngle=0.03,
    ToPolylineTolerance=0.01,
    ToPolylineMaxEdgeLength=0.25)  # -> Element, Points, Info
mtoshell = MeshToShellKaramba3D(Mesh=mesh_breps.Mesh, CrossSection=crosec_2, LimitDistance_m=0.005)  # -> Element, Points, Info
cluster = Cluster_2(point=mtoshell.Points, X=number_slider, tolerance=0.001)
cluster_2 = Cluster_2(point=mtoshell.Points, Y=number_slider, tolerance=0.001)
element_karamba3d = ElementKaramba3D(flatten([linetobeam.Element, mtoshell.Element]))
list_item = ListItem(List=cluster, Index=0, Wrap=True)
list_item_2 = ListItem(List=cluster_2, Index=0, Wrap=True)
inclusion_points = Point([cluster, cluster_2, point])
supp_2 = SupportKaramba3D(PosInd=cluster, menu=[buttons(on, off, off, off, on, off)])
supp_3 = SupportKaramba3D(PosInd=cluster_2, menu=[buttons(off, on, off, on, off, off)])
yz_plane = YZPlane(Origin=list_item)
xz_plane = XZPlane(Origin=list_item_2)
support_karamba3d = SupportKaramba3D(flatten([supp_2, supp_3, supp]))
assemble = AssembleModelKaramba3D(Elem=element_karamba3d, Support=flatten(support_karamba3d), Load=loads, LimitDistance_m=0.005)  # -> Model, Info, Mass_kg, CentreOfGravity, LoadCaseNames
analyse = AnalyseKaramba3D(Model=assemble.Model)  # -> AnalysedModel, MaximumDisplacement_cm, ResultingForce_kN, ChangeOfElasticEnergy_kNm
modelview = ModelViewKaramba3D(Model=analyse.AnalysedModel)  # -> Model, DeformedMesh, DeformedAxes, DeformedModel, MaximumDeformation
model_karamba3d = ModelKaramba3D(analyse.AnalysedModel)

# ---- group: Shell View (Karamba3D)
shellview = ShellViewKaramba3D(Model=modelview.Model, IndexOfLayer=0)  # -> Model, MeshesOfRenderedShells, LegendColours, LegendTags

# ---- group: Beam View (Karamba3D)
beamview = BeamViewKaramba3D(Model=modelview.Model)  # -> Model, MeshesOfRenderedBeams, DeformedBeamAxes, LegendColours, LegendTags

# ----
point_3 = Point(point_2)
deconstruct = Deconstruct(Point=point_3)  # -> XComponent, YComponent, ZComponent
circle = Circle(Plane=point_3, Radius=Slider(1, range=0..2))
construct_point = ConstructPoint(XCoordinate="0", YCoordinate=deconstruct.YComponent, ZCoordinate=deconstruct.ZComponent)
divide_curve = DivideCurve(Curve=circle, Count=Slider(10, range=1..20), Kinks=False)  # -> Points, Tangents, Parameters
line_2 = Line(StartPoint=point_3, EndPoint=construct_point)
range = Range(Domain="0.3 TO 0.95", Steps=Slider(3, range=0..10))
merge = Merge(
    Data1=Slider(0.3, range=0..1),
    Data2=Slider(0.45, range=0..1),
    Data3=Slider(0.6, range=0..1),
    Data4=Slider(0.8, range=0..1),
    Data5=Slider(0.95, range=0..1))
custom_preview = CustomPreview(Geometry=[divide_curve.Points, point_3], Material=ColourSwatch(SwatchColor=RGB(0, 255, 217)))
evaluate_curve = EvaluateCurve(Curve=reparameterize(line_2), Parameter=range)  # -> Point, Tangent, Angle
model_karamba3d_2 = ModelKaramba3D(model_karamba3d)
shelllineresults = LineResultsOnShellsKaramba3D(
    AnalysedModel=model_karamba3d_2,
    ListOfSourcesOfForceFlowLinesLinesPoints=evaluate_curve.Point,
    SegmentLength_m=1,
    DA_deg=5,
    mode="PrincMoment")  # -> Model, Lines1, Lines2
shelllineresults_2 = LineResultsOnShellsKaramba3D(
    AnalysedModel=model_karamba3d_2,
    ListOfSourcesOfForceFlowLinesLinesPoints=divide_curve.Points,
    SegmentLength_m=0.5,
    DA_deg=5,
    mode="PrincMoment")  # -> Model, Lines1, Lines2
curve_2 = Curve(simplify(shelllineresults.Lines2))
dispatch_branches = CSharpScript(Lines=shelllineresults_2.Lines1, Crv=circle)  # -> out, A, B; inputs Lines: tree of Curve, Crv: Curve
# ---------- dispatch_branches: C# ----------
    var output0 = new DataTree<object>();
    var output1 = new DataTree<object>();

    for(int i = 0; i < _Lines.BranchCount; i++)
    {
      if(IsPointInside(_Crv, _Lines.Branch(i)[0].PointAt(0.5)))
        output0.AddRange(_Lines.Branch(i), _Lines.Path(i));
      else
        output1.AddRange(_Lines.Branch(i), _Lines.Path(i));
    }

    A = output0;
    B = output1;
# ---------- dispatch_branches: C# additional code ----------
  public bool IsPointInside(Curve curve, Point3d point)
  {
    var bBox = curve.GetBoundingBox(false);
    var plane = Plane.WorldXY;
    if (!curve.TryGetPlane(out plane, bBox.Min.DistanceTo(bBox.Max)))
    {
      plane = Plane.WorldXY;
    }
    point = plane.ClosestPoint(point);

    bool returnVal = false;
    switch (curve.Contains(point, plane, 1e-3))
    {
      case PointContainment.Inside:
        returnVal = true;
        break;
      case PointContainment.Coincident:
        returnVal = true;
        break;
      case PointContainment.Outside:
        returnVal = false;
        break;
      case PointContainment.Unset:
        this.Component.AddRuntimeMessage(GH_RuntimeMessageLevel.Error, "Curve Point relationship cannot be determined.");
        break;
    }
    return returnVal;
  }
# ---------- end dispatch_branches ----------
join_curves = JoinCurves(Curves=curve_2, Preserve=False)  # -> simplify(Curves)
list_item_3 = ListItem(List=curve_2, Index=0, Wrap=True)
end_points = EndPoints(Curve=list_item_3)  # -> Start, End
curve_3 = Curve(dispatch_branches.B)
join_curves_2 = JoinCurves(Curves=curve_3, Preserve=False)  # -> flatten(Curves)
shift_paths = ShiftPaths(Data=join_curves, Offset=-1)
plane_normal = PlaneNormal(Origin=end_points.Start, ZAxis=list_item_3)
join_curves_3 = JoinCurves(Curves=shift_paths, Preserve=False)  # -> reparameterize(simplify(Curves))
shift_paths_2 = ShiftPaths(Data=plane_normal, Offset=-1)
explode = Explode(Curve=graft(join_curves_2), Recursive=True)  # -> Segments, Vertices
list_item_4 = ListItem(List=shift_paths_2, Index=0, Wrap=True)
cull_index = CullIndex(List=explode.Vertices, Indices="-1", Wrap=True)
curve_plane = CurvePlane(Curve=join_curves_3, Plane=list_item_4)  # -> Points, ParamsC, ParamsP
c_script = CSharpScript(List=cull_index, n="10")  # -> out, simplify(A); inputs List: list, n: Int32
# ---------- c_script: C# usings ----------
using System.Linq;
# ---------- c_script: C# ----------
    A = _List.Where((x, i) => (i) % _n == 0);
# ---------- end c_script ----------
list_item_5 = ListItem(List=curve_plane.ParamsC, Index=0, Wrap=True)  # -> Item, Item1, Item2
list_item_6 = ListItem(List=c_script.A, Index=0, Wrap=True)  # -> Item1, Item
shatter = Shatter(Curve=join_curves_3, Parameters=simplify([list_item_5.Item, list_item_5.Item2]))
point_4 = Point(list_item_6.Item1)
list_item_7 = ListItem(List=shatter, Index=0, Wrap=True)  # -> Item, Item1, Item2
curve_4 = Curve(curve)
curve_closest_point = CurveClosestPoint(Point=point_4, Curve=curve_4)  # -> simplify(Point), Parameter, Distance
curve_5 = Curve(list_item_7.Item1)
merge_2 = Merge(Data1=c_script.A, Data2=curve_closest_point.Point)
explode_2 = Explode(Curve=curve_5, Recursive=True)  # -> Segments, Vertices
polyline = PolyLine(Vertices=merge_2, Closed=False)  # -> simplify(Polyline)
cull_index_2 = CullIndex(List=explode_2.Vertices, Indices="-1", Wrap=True)
custom_preview_2 = CustomPreview(Geometry=polyline, Material=ColourSwatch(SwatchColor=RGB(0, 42, 255)))
c_script_2 = CSharpScript(List=cull_index_2, n="10")  # -> out, A; inputs List: list, n: Int32; same code as c_script
polyline_2 = PolyLine(Vertices=c_script_2.A, Closed=invert(False))  # -> simplify(Polyline)
custom_preview_3 = CustomPreview(Geometry=polyline_2, Material=ColourSwatch(SwatchColor=RGB(255, 157, 0)))
curve_6 = Curve(polyline)
curve_7 = Curve(polyline_2)
inclusion_points_2 = Point(inclusion_points)
surface_3 = Surface(reparameterize(surface_2))
panel = Panel("https://github.com/karamba3d/K3D_Resources/raw/main/TidBits%20Examples/32_Hops_MomentsOnShell.gh")
flatten_tree = FlattenTree(Tree=[curve_7, curve_6], Path="{0}")
flatten_tree_2 = FlattenTree(Tree=inclusion_points_2, Path="{0}")
model_karamba3d_3 = ModelKaramba3D(model_karamba3d_2)
exto_j_b_son = ExportModelToJSONBSONKaramba3D(Model=model_karamba3d_3, ExportToBSON=False)
hops = Hops(
    _Path=panel,
    _Enabled=Toggle(True),
    ModelJSON=exto_j_b_son,
    Surface=surface_3,
    Curves=flatten_tree,
    BeamHeight="40",
    BeamWidth="20",
    AdditionalInclusionPoints=flatten_tree_2,
    CacheResultsInMemory=False,
    CacheSolveResults=False,
    RemoteDefinitionLocation="https://github.com/karamba3d/K3D_Resources/raw/main/TidBits%20Examples/32_Hops_MomentsOnShell.gh",
    RemoteSolveVersion=(0, 1, 0),
    ShowInput_Enabled=True,
    ShowInput_Path=True,
    SynchronousSolve=False)  # -> Info, ModelJSON
panel_2 = Panel(hops.Info)
impfrom_j_b_son = ImportModelFromJSONBSONKaramba3D(JBSON=hops.ModelJSON, ImportFromBSON=False)
analyse_2 = AnalyseKaramba3D(Model=impfrom_j_b_son)  # -> AnalysedModel, MaximumDisplacement_cm, ResultingForce_kN, ChangeOfElasticEnergy_kNm
modelview_2 = ModelViewKaramba3D(Model=analyse_2.AnalysedModel)  # -> Model, DeformedMesh, DeformedAxes, DeformedModel, MaximumDeformation

# ---- group: Shell View (Karamba3D)
shellview_2 = ShellViewKaramba3D(Model=modelview_2.Model, IndexOfLayer=0)  # -> Model, MeshesOfRenderedShells, LegendColours, LegendTags

# ---- group: Beam View (Karamba3D)
beamview_2 = BeamViewKaramba3D(Model=modelview_2.Model)  # -> Model, MeshesOfRenderedBeams, DeformedBeamAxes, LegendColours, LegendTags

# ----
mirror = Mirror(Geometry=beamview_2.MeshesOfRenderedBeams, Plane=yz_plane)  # -> Geometry, Transform
mirror_2 = Mirror(Geometry=shellview_2.MeshesOfRenderedShells, Plane=yz_plane)  # -> Geometry, Transform
mirror_3 = Mirror(Geometry=[mirror.Geometry, beamview_2.MeshesOfRenderedBeams], Plane=xz_plane)  # -> flatten(Geometry), Transform
mirror_4 = Mirror(Geometry=[shellview_2.MeshesOfRenderedShells, mirror_2.Geometry], Plane=xz_plane)  # -> flatten(Geometry), Transform
mesh_edges = MeshEdges(Mesh=[beamview_2.MeshesOfRenderedBeams, mirror_3.Geometry, mirror.Geometry])  # -> NakedEdges, InteriorEdges, NonManifoldEdges
custom_preview_4 = CustomPreview(Geometry=mesh_edges.InteriorEdges, Material="gray")

# ==== cluster Cluster_2

# ---- group: Tolerance
point = ClusterInput()  # Point

X = ClusterInput()  # Number or Interval

Y = ClusterInput()  # Number or Interval

Z = ClusterInput()  # Number or Interval

# ---- group: Cluster Input
tolerance = ClusterInput()  # Tolerance

# ----
tolerance_2 = Number(tolerance)
point_2 = Point(point)
X_2 = Data(X)
Y_2 = Data(Y)
Z_2 = Data(Z)
deconstruct = Deconstruct(Point=point_2)  # -> XComponent, YComponent, ZComponent
absolute = Absolute(Value=tolerance_2)

# ---- group: Check if Input is Number or Interval
cluster = Cluster(data=X_2, tolerance=absolute)  # -> number_3, number_4

cluster_2 = Cluster(data=Y_2, tolerance=absolute)  # -> number_3, number_4

cluster_3 = Cluster(data=Z_2, tolerance=absolute)  # -> number_3, number_4

# ----
number = Number(deconstruct.XComponent)
number_2 = Number(deconstruct.YComponent)
number_3 = Number(deconstruct.ZComponent)
larger_than = LargerThan(FirstNumber=number, SecondNumber=cluster.number_3)  # -> LargerThan, OrEqualTo
smaller_than = SmallerThan(FirstNumber=number, SecondNumber=cluster.number_4)  # -> SmallerThan, OrEqualTo
larger_than_2 = LargerThan(FirstNumber=number_2, SecondNumber=cluster_2.number_3)  # -> LargerThan, OrEqualTo
smaller_than_2 = SmallerThan(FirstNumber=number_2, SecondNumber=cluster_2.number_4)  # -> SmallerThan, OrEqualTo
larger_than_3 = LargerThan(FirstNumber=number_3, SecondNumber=cluster_3.number_3)  # -> LargerThan, OrEqualTo
smaller_than_3 = SmallerThan(FirstNumber=number_3, SecondNumber=cluster_3.number_4)  # -> SmallerThan, OrEqualTo
gate_and = GateAnd(A=larger_than.OrEqualTo, B=smaller_than.OrEqualTo)
gate_and_2 = GateAnd(A=larger_than_2.OrEqualTo, B=smaller_than_2.OrEqualTo)
gate_and_3 = GateAnd(A=larger_than_3.OrEqualTo, B=smaller_than_3.OrEqualTo)
c_script = CSharpScript(value=X_2, bool=gate_and)  # -> out, result
# ---------- c_script: C# ----------
    if(_value == null)
      result_ = true;
    else result_ = _bool;
# ---------- end c_script ----------
c_script_2 = CSharpScript(value=Y_2, bool=gate_and_2)  # -> out, result; same code as c_script
c_script_3 = CSharpScript(value=Z_2, bool=gate_and_3)  # -> out, result; same code as c_script
gate_and_4 = GateAnd(A=c_script.result, B=c_script_2.result)
gate_and_5 = GateAnd(A=gate_and_4, B=c_script_3.result)
point_3 = Point(point_2)
cull_pattern = CullPattern(List=point_3, CullPattern=gate_and_5)
point_4 = Point(cull_pattern)

# ---- group: Cluster Output
point_5 = ClusterOutput(point_4)

# ==== cluster Cluster
data = ClusterInput()
tolerance = ClusterInput()
data_2 = Data(data)
c_script = CSharpScript(x=data_2)  # -> Gate
# ---------- c_script: C# ----------
    if(x.GetType() == typeof(Interval))
      Gate = false;
    else
      Gate = true;
# ---------- end c_script ----------
stream_gate = StreamGate(Stream=data_2, Gate=c_script)  # -> Target0, Target1
deconstruct_domain = DeconstructDomain(Domain=stream_gate.Target0)  # -> Start, End
tolerance_2 = Number(tolerance)
subtraction = Subtraction(A=deconstruct_domain.Start, B=tolerance_2)
addition = Addition(A=deconstruct_domain.End, B=tolerance_2)
subtraction_2 = Subtraction(A=stream_gate.Target1, B=tolerance_2)
addition_2 = Addition(A=stream_gate.Target1, B=tolerance_2)
stream_filter = StreamFilter(Gate=c_script, Stream0=[subtraction, addition], Stream1=[subtraction_2, addition_2])
list_item = ListItem(List=stream_filter, Index=0, Wrap=True)  # -> Item, Item1
number = Number(list_item.Item)
number_2 = Number(list_item.Item1)
number_3 = ClusterOutput(number)
number_4 = ClusterOutput(number_2)
