# Grasshopper definition 36_CFDWindsimulationCube.gh (Grasshopper 1.0.7)
# plug-ins: Karamba3D, MeshEdit Components

space = Slider(10, range=0..100)
# 0. GEOMETRY
panel = Panel("5,5,0")
rectangle = Rectangle(Plane=panel, XSize=space, YSize=space, Radius=0)  # -> Rectangle, Length
box_rectangle = BoxRectangle(Rectangle=rectangle.Rectangle, Height=space)
deconstruct_brep = DeconstructBrep(Brep=box_rectangle)  # -> Faces, Edges, Vertices
area = Area(Geometry=deconstruct_brep.Faces)  # -> Area, Centroid
deconstruct = Deconstruct(Point=area.Centroid)  # -> XComponent, YComponent, ZComponent
larger_than = LargerThan(FirstNumber=deconstruct.ZComponent, SecondNumber="0")  # -> LargerThan, OrEqualTo
dispatch = Dispatch(List=deconstruct_brep.Faces, DispatchPattern=larger_than.LargerThan)  # -> ListA, ListB
mesh_resolution = Slider(2, range=0.5..4)
refine_factor = Panel("1")
mesh_breps_karamba3d = MeshBrepsKaramba3D(
    Brep=dispatch.ListA,
    MeshResolution=mesh_resolution,
    EdgeRefinementFactor=refine_factor,
    PointReduction=False,
    SmoothingStepSize=0,
    SmoothingIterations=5)  # -> Mesh, Info

environment = Brep(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)
brep = Brep(box_rectangle)

# ----
# 1. SIMPLIFY GEOMETRY
merge = Merge(Data1=environment, Data2=brep)
wall = Butterfly_WallBoundary()  # -> wall_boundary; plug-in component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
jagged = SettingsSpeed()
createbfgeometry = Butterfly_CreateButterflyGeometry(name="geometry", geo=flatten(merge), boundary=wall, mesh_set=jagged)  # -> report, BF_geo; plug-in component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

mesh = Mesh(graft(mesh_breps_karamba3d.Mesh))
mesh_plane_around_the_brep = Mesh(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)

# ----
# 4.1 sectional view of velocity
mesh_explode = MeshExplode(Mesh=mesh_plane_around_the_brep, Interpolate=False)
area_2 = Area(Geometry=mesh_explode)  # -> Area, Centroid

# ----
# 4.1 pressure cube
mesh_explode_2 = MeshExplode(Mesh=mesh_breps_karamba3d.Mesh, Interpolate=False)  # -> flatten(Faces)
offset_distance = Slider(0.25, range=0..1)
face_normals = FaceNormals(Mesh=mesh_explode_2)  # -> flatten(Centers), flatten(Normals)
multiplication = Multiplication(A=face_normals.Normals, B=offset_distance)
move = Move(Geometry=face_normals.Centers, Motion=multiplication)  # -> Geometry, Transform
remove_duplicate_points_karamba3d = RemoveDuplicatePointsKaramba3D(Point=move.Geometry, LimitDistance=0.005)  # -> flatten(OutPoint), Info, Indexes

vb_0_m_s = Slider(25, range=0..100)
# 2. WIND TUNNEL
project_name = Panel("CFD_Windsimulation_Cube_5")
scale = Panel("2")
scale_2 = Panel("1")
wind_direction = Panel("{0,1,0}")
tunnelparams = Butterfly_WindTunnelParameters(windward_x=scale_2, top_x=scale, sides_x=scale_2, leeward_x=scale_2)  # -> report, tunnel_params; plug-in component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
windvector = Butterfly_WindVector(wind_speed=vb_0_m_s, wind_direction=wind_direction)  # -> wind_vector; plug-in component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
createcasefromtunnel = Butterfly_CreateCaseFromTunnel(
    name=project_name,
    BF_geo=flatten(createbfgeometry.BF_geo),
    wind_vector=windvector,
    ref_wind_height=10,
    landscape=6,
    tunnel_params=tunnelparams.tunnel_params,
    run=Toggle(True))  # -> out, block_pts, wind_tunnel, case; plug-in component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

# ---- group: Define Elements
# 5. KARAMBA MODEL
material_selection_karamba3d = MaterialSelectionKaramba3D(menu=[dropdown(7), dropdown(5)])
heigth = Slider(10, range=0..100)
cross_section_karamba3d = CrossSectionKaramba3D(FamilyNameOfCrossSection="DefaultCroSec", Material=material_selection_karamba3d, Height_cm=heigth, mode="Shell - Const")
mesh_to_shell_karamba3d = MeshToShellKaramba3D(Mesh=mesh, CrossSection=cross_section_karamba3d, LimitDistance_m=0.005)  # -> Element, Points, Info

# ---- group: Support's
remove_duplicate_points_karamba3d_2 = RemoveDuplicatePointsKaramba3D(Point=flatten(mesh_to_shell_karamba3d.Points), LimitDistance=0.005)  # -> OutPoint, Info, Indexes
deconstruct_2 = Deconstruct(Point=remove_duplicate_points_karamba3d_2.OutPoint)  # -> XComponent, YComponent, ZComponent
larger_than_2 = LargerThan(FirstNumber=deconstruct_2.ZComponent, SecondNumber="0")  # -> LargerThan, OrEqualTo
dispatch_2 = Dispatch(List=remove_duplicate_points_karamba3d_2.OutPoint, DispatchPattern=larger_than_2.LargerThan)  # -> ListA, ListB
supp = SupportKaramba3D(PosInd=dispatch_2.ListB, menu=[buttons(on, on, on, on, on, off)])

# ----
wtgrading = Butterfly_windTunnelGrading(wind_tunnel=createcasefromtunnel.wind_tunnel, cell_size=1, cell_to_cell_ratio=1.2, wake_offset=2, height_offset=5)  # -> report, grad_xyz, cell_count_xyz, cell_count_tot, preview; plug-in component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
# 3. MESHING
blockmesh = Butterfly_blockMesh(
    case=createcasefromtunnel.case,
    grad_xyz=wtgrading.grad_xyz,
    cell_count=wtgrading.cell_count_xyz,
    overwrite=True,
    write=Toggle(True),
    run=Toggle(True))  # -> report, case; plug-in component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
loadmesh = Butterfly_LoadMesh(case=blockmesh.case, inner_mesh=False, load=Toggle(True))  # -> mesh; plug-in component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
snappyhexmesh = Butterfly_snappyHexMesh(case=blockmesh.case, glob_refine_level="1,1", write=Toggle(True), run=Toggle(True))  # -> report, case; plug-in component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

merge_2 = Merge(Data1=remove_duplicate_points_karamba3d.OutPoint, Data2=area_2.Centroid)  # -> flatten(Result)

# ----
# 4.1 Probs = points for solution
panel_2 = Panel("U, p")
probes = Butterfly_probes(points=flatten(merge_2), fields=panel_2)  # -> probes; plug-in component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

# ----
# START - CFD Simulation
true_run_simulation = BooleanToggle(True)

iteration = Slider(50, range=0..100)
write_interval = Panel("10")
# 4. SOLUTION
ras = Butterfly_RASTurbulenceModel(RAS_model="RNGkEpsilon", turbulence=True, print_coeffs=True)  # -> RAS; plug-in component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
controldict = Butterfly_controlDict(start_time=0, end_time=iteration, write_interval=write_interval, write_compression=False, purge_write=0)  # -> control_dict; plug-in component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
steadyincomp = Butterfly_SteadyIncompressibleRecipe(turbulence_prop=ras)  # -> report, recipe; plug-in component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
solutionparams = Butterfly_SolutionParameters(control_dict=controldict, probes=probes)  # -> solution_par; plug-in component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
solution = Butterfly_Solution(
    case=snappyhexmesh.case,
    recipe=steadyincomp.recipe,
    solution_par=solutionparams,
    interval=2,
    write=true_run_simulation,
    run=true_run_simulation)  # -> report, solution, is_running, timestep, residual_fields, residual_values, log_files; plug-in component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

# ---- group: Butterfly Result
# Pressure
panel_3 = Panel("p")
# RESULTS
loadprobesvalue = Butterfly_LoadProbesValue(solution=solution.solution, field=panel_3)  # -> values; plug-in component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

# ---- group: Butterly Result
# Velocity
panel_4 = Panel("U")
loadprobesvalue_2 = Butterfly_LoadProbesValue(solution=solution.solution, field=panel_4)  # -> values; plug-in component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

# ----
value_as_a_vector_m_s = Panel(loadprobesvalue_2)

# ----
# sectional view of velocity
find_similar_member = FindSimilarMember(Data=area_2.Centroid, Set=merge_2)  # -> Hit, Index
list_item = ListItem(List=loadprobesvalue_2, Index=find_similar_member.Index, Wrap=True)
point = Point(find_similar_member.Hit)
vector_length = VectorLength(Vector=list_item)
cluster = Cluster_2(relay_2=vector_length, numbers=vector_length, relay=vector_length)
scale_3 = Slider(2, range=0..2)
vector = Vector(unitize(list_item))
multiplication_2 = Multiplication(A=vector, B=scale_3)
width = Slider(0.5, range=0.5..2)
vector_display_ex = VectorDisplayEx(Point=point, Vector=multiplication_2, Colour=cluster, Width=width)

# ----
# pressure of cube
# Convert the unit pa in kN/m²
find_similar_member_2 = FindSimilarMember(Data=remove_duplicate_points_karamba3d.OutPoint, Set=merge_2)  # -> Hit, Index
list_item_2 = ListItem(List=loadprobesvalue, Index=find_similar_member_2.Index, Wrap=True)
expression = Expression(x=list_item_2, Expression="round(x/1000,2)")
bounds = Bounds(Numbers=expression)
pressure_kn_m² = Number(expression)
deconstruct_domain = DeconstructDomain(Domain=bounds)  # -> Start, End
gradient = Gradient(
    LowerLimit=deconstruct_domain.Start,
    UpperLimit=deconstruct_domain.End,
    Parameter=pressure_kn_m²,
    stops=[0: RGB(0, 0, 192), 0.4: RGB(128, 128, 255), 0.796: RGB(255, 128, 128), 1: RGB(192, 0, 0)])
cluster_2 = Cluster(
    relay_2=deconstruct_domain.Start,
    relay=deconstruct_domain.End,
    value=deconstruct_domain.Start,
    start=deconstruct_domain.Start,
    value_2=deconstruct_domain.End)  # -> colour, rounded, rectangle_2
legend = Legend(Colour=cluster_2.colour, Tags=cluster_2.rounded, Rectangle=cluster_2.rectangle_2, LegendType=1)
custom_preview = CustomPreview(Geometry=mesh_explode_2, Material=gradient)

# ---- group: load's
face_normals_2 = FaceNormals(Mesh=dispatch.ListA)  # -> Centers, flatten(Normals)
side = Slider(4, range=0..4)
side_2 = Panel("""0 = front
1 = rigth
2 = back
3 = left
4 = top""")
multiplication_3 = Multiplication(A=face_normals_2.Normals, B="-1")
signs_vector = Panel(multiplication_3)
pressure_kn_m²_2 = Number(pressure_kn_m²)
list_item_3 = ListItem(List=multiplication_3, Index=side, Wrap=True)
tree_item = TreeItem(Tree=simplify(mesh), Path=side, Index=0, Wrap=True)
multiplication_4 = Multiplication(A=pressure_kn_m²_2, B=list_item_3)
mesh_explode_3 = MeshExplode(Mesh=tree_item, Interpolate=False)
list_length = ListLength(List=mesh_explode_3)
partition_list = PartitionList(List=multiplication_4, Size=list_length)  # -> simplify(Chunks)
tree_branch = TreeBranch(Tree=partition_list, Path=side, MaintainPaths=True)

# ----
pressure_kn_m²_3 = Panel(pressure_kn_m²_2)

# ---- group: load's / Loads (Karamba3D)
loads = LoadsKaramba3D(
    Vectors=tree_branch,
    Mesh=tree_item,
    LCase="0",
    mode="MeshLoad -Variable",
    menu=[buttons(off, on, off), buttons(on, off)])  # -> flatten(Load)

# ----
panel_5 = Panel(loads)

# ---- group: Assemble Model (Karamba3D)
assemble = AssembleModelKaramba3D(Elem=flatten(mesh_to_shell_karamba3d.Element), Support=flatten(supp), Load=flatten(loads), LimitDistance_m=0.005)  # -> Model, Info, Mass_kg, CenterOfGravity, LoadCaseNames

# ---- group: Analyze (Karamba3D)
analyze = AnalyzeKaramba3D(Model=assemble.Model)  # -> CalculatedModel, MaximumDisplacement_cm, ResultingForceOfGravity_kN, ElasticEnergy_kNm

# ---- group: Model View (Karamba3D)
modelview = ModelViewKaramba3D(Model=analyze.CalculatedModel, ResultFactors=1, ResultCase=-1)  # -> Model, DeformedMesh, DeformedAxes, DeformedModel

# ----
values_in_pa = Panel(list_item_2)
pressure_in_kn_m² = Panel(pressure_kn_m²)

# ==== cluster Cluster
value = ClusterInput()
value_2 = ClusterInput()
number_slider = Slider(5, range=0..10)
absolute = Absolute(Value=value)
absolute_2 = Absolute(Value=value_2)
addition = Addition(A=absolute, B=absolute_2)
relay = ClusterInput()
relay_2 = ClusterInput()
division = Division(A=addition, B=number_slider)
addition_2 = Addition(A=number_slider, B=1)
start = ClusterInput()
construct_point = ConstructPoint(XCoordinate="-5", YCoordinate=0, ZCoordinate=0)
series = Series(Start=start, Step=division, Count=addition_2)
gradient = Gradient(
    LowerLimit=relay_2,
    UpperLimit=relay,
    Parameter=series,
    stops=[0: RGB(0, 0, 255), 0.2: RGB(153, 163, 255), 0.577: RGB(184, 203, 98), 0.804: RGB(206, 130, 20), 1: RGB(255, 0, 0)])
gradient_2 = Gradient(
    LowerLimit=relay_2,
    UpperLimit=relay,
    Parameter=series,
    stops=[0: RGB(0, 0, 192), 0.4: RGB(128, 128, 255), 0.796: RGB(255, 128, 128), 1: RGB(192, 0, 0)])
xy_plane = XYPlane(Origin=construct_point)
rectangle = Rectangle(Plane=xy_plane, XSize="7", YSize="7", Radius=0)  # -> Rectangle, Length
round_to_decimal_place = RoundToDecimalPlace(NumberX=series, DecimalPlace="2", RoundType=0)  # -> Rounded, Difference
rectangle_2 = ClusterOutput(rectangle.Rectangle)
colour = ClusterOutput(gradient_2)
rounded = ClusterOutput(round_to_decimal_place.Rounded)

# ==== cluster Cluster_2
numbers = ClusterInput()
relay = ClusterInput()
relay_2 = ClusterInput()
bounds = Bounds(Numbers=numbers)
deconstruct_domain = DeconstructDomain(Domain=bounds)  # -> Start, End
gradient = Gradient(
    LowerLimit=deconstruct_domain.Start,
    UpperLimit=deconstruct_domain.End,
    Parameter=relay,
    stops=[0.0186: RGB(75, 107, 169), 0.25: RGB(173, 203, 249), 0.5: RGB(254, 244, 84), 0.753: RGB(234, 126, 0), 1: RGB(234, 38, 0)])
legendpar = LBLegendParameters(num_decimals="1", seg_height="2", seg_width="2")  # -> leg_par; plug-in component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
colour = ClusterOutput(gradient)
createlegend = LBCreateLegend(values=relay_2, base_plane="-5,15,0", title="Velocity [m/s]", legend_par=legendpar)  # -> mesh, title_obj, label_objs, label_text, colors; plug-in component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
