# Grasshopper definition 37_ScriptedTruss.gh (Grasshopper 1.0.7)
# plug-ins: Karamba3D

# ----
# Rhino Input Curves
# Truss Maker Recursive
panel = Panel("examble: line")
panel_2 = Panel("examble: archway")

# ----
# GH Input Curves
number_slider = Slider(8, range=8..20)
height = Slider(2.3, range=1..5)
Z = UnitZ(Factor=height)
line = LineSDL(Start="0,0,0", Direction="{1,0,0}", Length=number_slider)
move = Move(Geometry=line, Motion=Z)  # -> Geometry, Transform

# ----
# Rhino Input Curves
# Truss Maker
panel_3 = Panel("examble: triangle")

# ----
# Pratt, K-Truss
crv = Curve(reparameterize(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))
crv_2 = Curve(reparameterize(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))
crv_3 = Curve(reparameterize(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))
crv_4 = Curve(reparameterize(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))

# ----
# Pratt, K-Truss
crv_5 = Curve(reparameterize(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))
crv_6 = Curve(reparameterize(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))
crv_7 = Curve(reparameterize(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))
crv_8 = Curve(reparameterize(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))

# ----
# Warren, Vierendeel
crv_9 = Curve(reparameterize(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))
crv_10 = Curve(reparameterize(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))
crv_11 = Curve(reparameterize(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))
crv_12 = Curve(reparameterize(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))

# ----
# Warren, Vierendeel
crv_13 = Curve(reparameterize(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))
crv_14 = Curve(reparameterize(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))
crv_15 = Curve(reparameterize(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))
crv_16 = Curve(reparameterize(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))

number_slider_2 = Slider(5, range=5..10)

uppergirder = Curve(reparameterize(move.Geometry))
lowergirder = Curve(reparameterize(line))
end = EndPoints(Curve=lowergirder)  # -> Start, End

type_of_truss = ValueList({"Pratt": 1, "Warren": 2, "Warren With Verticals": 3, "K-Truss": 4, "Vierendeel": 5}, selected="Pratt")
# 01 - Scripted Truss
# Difficulty: Simple
# A parametric truss that is programmed in C# is called „Truss Maker“. It is possible to choose between the truss types, Pratt, Warren, K-Truss and Vierendeel. The subdivision is can be controlled by a slider. The input for the „Truss Maker“
# are only two curves. It does not matter if these curves are imported from Rhino or modeled in Grasshopper.
# The „Truss Maker Recursive“ is a supplement to the „Truss Maker“.It can be used for large geometries. The programming creates a separate truss for each line in the truss and repeats itself recursively.
trussmaker = TrussMaker(Upper=uppergirder, Lower=lowergirder, Type=type_of_truss, N=Slider(5, range=2..12))  # -> out, UpperGirder, LowerGirder, Diagonals, Posts; inputs Upper: Curve, Lower: Curve, Type: Int32, N: Int32
# ---------- trussmaker: C# usings ----------
using System.Linq;
# ---------- trussmaker: C# ----------
    #region Component Description
    Component.Name = "Truss Maker";
    Component.NickName = "TrussMaker";
    Component.Description = "Creates different types of trusses based on given curves for upper and lower girder.";

    Component.Params.Input[0].Description = "Curve for Upper Girder.";
    Component.Params.Input[0].Name = "Upper Girder";
    Component.Params.Input[0].NickName = "Upper";
    Component.Params.Input[1].Description = "Curve for Lower Girder.";
    Component.Params.Input[1].Name = "Lower Girder";
    Component.Params.Input[1].NickName = "Lower";
    Component.Params.Input[2].Description = "Type of Truss to be generated: 1: PrattTruss; 2: WarrenTruss; 3: WarrenTrussWithVerticals; 4: KTruss; 5: VierendeelTruss";
    Component.Params.Input[2].Name = "Type of Truss";
    Component.Params.Input[2].NickName = "Type";
    Component.Params.Input[3].Description = "Number of truss subdivisions.";
    Component.Params.Input[3].Name = "Number of Subdivisions";
    Component.Params.Input[3].NickName = "N";

    Component.Params.Output[1].Description = "Upper Girder Members";
    Component.Params.Output[1].Name = "Upper Girder Members";
    Component.Params.Output[1].NickName = "UpperGirder";
    Component.Params.Output[2].Description = "Lower Girder Members";
    Component.Params.Output[2].Name = "Lower Girder Members";
    Component.Params.Output[2].NickName = "LowerGirder";
    Component.Params.Output[3].Description = "Diagonal Members";
    Component.Params.Output[3].Name = "Diagonal Members";
    Component.Params.Output[3].NickName = "Diagonals";
    Component.Params.Output[4].Description = "Posts";
    Component.Params.Output[4].Name = "Posts";
    Component.Params.Output[4].NickName = "Posts";

    #endregion


    List<Line> uGirder_ = new List<Line>();
    List<Line> lGirder_ = new List<Line>();
    List<Line> diagonals_ = new List<Line>();
    List<Line> posts_ = new List<Line>();

    switch (Type)
    {
      case 1:
        PrattTruss(N, Upper, Lower, uGirder_, lGirder_, diagonals_, posts_);
        break;
      case 2:
        WarrenTruss(N, Upper, Lower, uGirder_, lGirder_, diagonals_, posts_);
        break;
      case 3:
        WarrenTrussWithVerticals(N, Upper, Lower, uGirder_, lGirder_, diagonals_, posts_);
        break;
      case 4:
        KTruss(N, Upper, Lower, uGirder_, lGirder_, diagonals_, posts_);
        break;
      case 5:
        VierendeelTruss(N, Upper, Lower, uGirder_, lGirder_, diagonals_, posts_);
        break;
    }

    UpperGirder = uGirder_.Where(i => i.Length != 0).ToList();
    LowerGirder = lGirder_.Where(i => i.Length != 0).ToList();
    Diagonals = diagonals_.Where(i => i.Length != 0).ToList();
    Posts = posts_.Where(i => i.Length != 0).ToList();
# ---------- trussmaker: C# additional code ----------
  public void PrattTruss(int N, Curve uLine, Curve lLine, List<Line> uGirder, List<Line> lGirder, List<Line> diagonals, List<Line> posts)
  {
    for (int nInd = 0; nInd < N; ++nInd) {
      List <double> ts = new List<double>{ (nInd + 0.0) / N, (nInd + 1.0) / N };
      List <Point3d> ups = new List <Point3d>();
      List <Point3d> lps = new List <Point3d>();
      foreach (double t in ts)
      {
        ups.Add(uLine.PointAt(t));
        lps.Add(lLine.PointAt(t));
      }

      uGirder.Add(new Line(ups[0], ups[1]));
      lGirder.Add(new Line(lps[0], lps[1]));

      if (nInd == 0) {
        posts.Add(new Line(lps[0], ups[0]));
      }
      posts.Add(new Line(lps[1], ups[1]));

      diagonals.Add(new Line(ups[0], lps[1]));
    }
  }

  public void WarrenTruss(int N, Curve lLine, Curve uLine, List<Line> uGirder, List<Line> lGirder, List<Line> diagonals, List<Line> posts)
  {
    Point3d cPoint = lLine.PointAt(0);
    for (int nInd = 0; nInd < N; ++nInd) {
      List <double> ts = new List<double>{ (nInd + 0.0) / N, (nInd + 0.5) / N, (nInd + 1.0) / N };
      List <Point3d> ups = new List <Point3d>();
      List <Point3d> lps = new List <Point3d>();
      foreach (double t in ts)
      {
        ups.Add(uLine.PointAt(t));
        lps.Add(lLine.PointAt(t));
      }

      lGirder.Add(new Line(ups[0], ups[2]));
      if (nInd != 0) {
        uGirder.Add(new Line(cPoint, lps[1]));
      }
      cPoint = lps[1];

      diagonals.Add(new Line(ups[0], lps[1]));
      diagonals.Add(new Line(lps[1], ups[2]));
    }
  }

  public void WarrenTrussWithVerticals(int N, Curve uLine, Curve lLine, List<Line> uGirder, List<Line> lGirder, List<Line> diagonals, List<Line> posts)
  {
    for (int nInd = 0; nInd < N; ++nInd) {
      List <double> ts = new List<double>{ (nInd + 0.0) / N, (nInd + 0.5) / N, (nInd + 1.0) / N };
      List <Point3d> ups = new List <Point3d>();
      List <Point3d> lps = new List <Point3d>();
      foreach (double t in ts)
      {
        ups.Add(uLine.PointAt(t));
        lps.Add(lLine.PointAt(t));
      }

      uGirder.Add(new Line(ups[0], ups[1]));
      uGirder.Add(new Line(ups[1], ups[2]));
      lGirder.Add(new Line(lps[0], lps[1]));
      lGirder.Add(new Line(lps[1], lps[2]));

      if (nInd == 0) {
        posts.Add(new Line(lps[0], ups[0]));
      }
      posts.Add(new Line(lps[1], ups[1]));
      posts.Add(new Line(lps[2], ups[2]));

      diagonals.Add(new Line(ups[0], lps[1]));
      diagonals.Add(new Line(lps[1], ups[2]));
    }
  }

  public void KTruss(int N, Curve uLine, Curve lLine, List<Line> uGirder, List<Line> lGirder, List<Line> diagonals, List<Line> posts)
  {
    for (int nInd = 0; nInd < N; ++nInd) {
      List <double> ts = new List<double>{ (nInd + 0.0) / N, (nInd + 1.0) / N };
      List <Point3d> ups = new List <Point3d>();
      List <Point3d> lps = new List <Point3d>();
      List <Point3d> mps = new List <Point3d>();
      foreach (double t in ts)
      {
        var upperPoint = uLine.PointAt(t);
        ups.Add(upperPoint);
        var lowerPoint = lLine.PointAt(t);
        lps.Add(lowerPoint);
        var midPoint = (upperPoint + lowerPoint) * 0.5;
        mps.Add(midPoint);
      }

      uGirder.Add(new Line(ups[0], ups[1]));
      lGirder.Add(new Line(lps[0], lps[1]));

      if (nInd == 0) {
        posts.Add(new Line(lps[0], ups[0]));
      }
      posts.Add(new Line(lps[1], mps[1]));
      posts.Add(new Line(mps[1], ups[1]));

      diagonals.Add(new Line(mps[1], lps[0]));
      diagonals.Add(new Line(mps[1], ups[0]));
    }
  }

  public void VierendeelTruss(int N, Curve uLine, Curve lLine, List<Line> uGirder, List<Line> lGirder, List<Line> diagonals, List<Line> posts)
  {
    for (int nInd = 0; nInd < N; ++nInd) {
      List <double> ts = new List<double>{ (nInd + 0.0) / N, (nInd + 1.0) / N };
      List <Point3d> ups = new List <Point3d>();
      List <Point3d> lps = new List <Point3d>();
      foreach (double t in ts)
      {
        var upperPoint = uLine.PointAt(t);
        ups.Add(upperPoint);
        var lowerPoint = lLine.PointAt(t);
        lps.Add(lowerPoint);
      }

      uGirder.Add(new Line(ups[0], ups[1]));
      lGirder.Add(new Line(lps[0], lps[1]));

      if (nInd == 0) {
        posts.Add(new Line(lps[0], ups[0]));
      }
      posts.Add(new Line(lps[1], ups[1]));
    }
  }
# ---------- end trussmaker ----------

scale = Scale(Geometry=crv_11, Center=Point(0, 0, 0), Factor=number_slider_2)  # -> Geometry, Transform
scale_2 = Scale(Geometry=crv_12, Center=Point(0, 0, 0), Factor=number_slider_2)  # -> Geometry, Transform

crv_17 = Curve(reparameterize(scale.Geometry))
crv_18 = Curve(reparameterize(scale_2.Geometry))
end_2 = EndPoints(Curve=crv_18)  # -> Start, End

type_of_truss_2 = ValueList({"Pratt": 1, "Warren": 2, "Warren With Verticals": 3, "K-Truss": 4, "Vierendeel": 5}, selected="Warren With Verticals")
trussmakerrecursive = TrussMakerRecursive(
    Upper=crv_17,
    Lower=crv_18,
    Type=type_of_truss_2,
    N=Slider(6, range=2..10),
    MinLen=Slider(3, range=2..5),
    MaxRDepth="2",
    HtoL=Slider(0.2, range=0.1..0.5))  # -> out, UpperGirder, LowerGirder, Diagonals, Posts; inputs Upper: Curve, Lower: Curve, Type: Int32, N: Int32, MinLen: Double, MaxRDepth: Int32, HtoL: Double
# ---------- trussmakerrecursive: C# ----------
    #region Component Description
    Component.Name = "Truss Maker Recursive";
    Component.NickName = "TrussMakerRecursive";
    Component.Description = "Recursively creates different types of trusses based on given curves for upper and lower girder.";

    Component.Params.Input[0].Description = "Curve for Upper Girder.";
    Component.Params.Input[0].Name = "Upper Girder";
    Component.Params.Input[0].NickName = "Upper";
    Component.Params.Input[1].Description = "Curve for Lower Girder.";
    Component.Params.Input[1].Name = "Lower Girder";
    Component.Params.Input[1].NickName = "Lower";
    Component.Params.Input[2].Description = "Type of Truss to be generated: 1: PrattTruss; 2: WarrenTruss; 3: WarrenTrussWithVerticals; 4: KTruss; 5: VierendeelTruss";
    Component.Params.Input[2].Name = "Type of Truss";
    Component.Params.Input[2].NickName = "Type";
    Component.Params.Input[3].Description = "Number of truss subdivisions.";
    Component.Params.Input[3].Name = "Number of Subdivisions";
    Component.Params.Input[3].NickName = "N";
    Component.Params.Input[4].Description = "Minimum member length for stopping recursive truss creation.";
    Component.Params.Input[4].Name = "Minimum Member Length";
    Component.Params.Input[4].NickName = "MinLen";
    Component.Params.Input[5].Description = "Maximum depth of recursion.";
    Component.Params.Input[5].Name = "Maximum Depth of Recursion";
    Component.Params.Input[5].NickName = "MaxRDepth";
    Component.Params.Input[6].Description = "Ratio of height to length of recursively created trusses.";
    Component.Params.Input[6].Name = "Height to Length";
    Component.Params.Input[6].NickName = "HtoL";


    Component.Params.Output[1].Description = "Upper Girder Members";
    Component.Params.Output[1].Name = "Upper Girder Members";
    Component.Params.Output[1].NickName = "UpperGirder";
    Component.Params.Output[2].Description = "Lower Girder Members";
    Component.Params.Output[2].Name = "Lower Girder Members";
    Component.Params.Output[2].NickName = "LowerGirder";
    Component.Params.Output[3].Description = "Diagonal Members";
    Component.Params.Output[3].Name = "Diagonal Members";
    Component.Params.Output[3].NickName = "Diagonals";
    Component.Params.Output[4].Description = "Posts";
    Component.Params.Output[4].Name = "Posts";
    Component.Params.Output[4].NickName = "Posts";
    #endregion

    if (MinLen <= 0) {
      throw new Exception("The minimum member length needs to be larger than 0.");
    }

    List<Line> uGirder_ = new List<Line>();
    List<Line> lGirder_ = new List<Line>();
    List<Line> diagonals_ = new List<Line>();
    List<Line> posts_ = new List<Line>();

    Vector3d v0 = Upper.TangentAt(0);
    Vector3d v1 = Upper.PointAt(0) - Lower.PointAt(0);
    Vector3d normal = Vector3d.CrossProduct(v0, v1);
    normal.Unitize();

    CreateSubTruss(Upper, Lower, normal, Type, N, MinLen, MaxRDepth, HtoL, uGirder_, lGirder_, diagonals_, posts_);

    UpperGirder = uGirder_.Where(i => i.Length != 0).ToList();
    LowerGirder = lGirder_.Where(i => i.Length != 0).ToList();
    Diagonals = diagonals_.Where(i => i.Length != 0).ToList();
    Posts = posts_.Where(i => i.Length != 0).ToList();
# ---------- trussmakerrecursive: C# additional code ----------
  public void CreateSubTruss(Curve Upper, Curve Lower, Vector3d normal, int Type, int N, double MinLen, int MaxRDepth, double HtoL, List<Line> uGirder, List<Line> lGirder, List<Line> diagonals, List<Line> posts) {
    List<Line> uGirder_ = new List<Line>();
    List<Line> lGirder_ = new List<Line>();
    List<Line> diagonals_ = new List<Line>();
    List<Line> posts_ = new List<Line>();

    CreateTruss(Upper, Lower, Type, N, uGirder_, lGirder_, diagonals_, posts_);

    // further subdivide the longer beams
    List < Line > lines = new List<Line>();
    lines.AddRange(uGirder_);
    lines.AddRange(lGirder_);
    lines.AddRange(diagonals_);
    lines.AddRange(posts_);
    double minLineLength = lines.Min(i => i.Length);

    if (minLineLength < MinLen || MaxRDepth == 0) {
      // return the short beams as results
      uGirder.AddRange(uGirder_);
      lGirder.AddRange(lGirder_);
      diagonals.AddRange(diagonals_);
      posts.AddRange(posts_);
      return;
    }

    foreach (Line line in lines)
    {
      Vector3d trn = Vector3d.CrossProduct(line.Direction, normal);
      trn.Unitize();
      double L = line.Length;
      Point3d p0 = line.PointAt(0.5);
      p0.Transform(Rhino.Geometry.Transform.Translation(trn * L * HtoL * 0.5));
      Point3d p1 = line.PointAt(0.5);
      p1.Transform(Rhino.Geometry.Transform.Translation((normal * Math.Sqrt(3) - trn) * L * HtoL * 0.5));
      Point3d p2 = line.PointAt(0.5);
      p2.Transform(Rhino.Geometry.Transform.Translation((-normal * Math.Sqrt(3) - trn) * L * HtoL * 0.5));


      Curve c0 = Curve.CreateInterpolatedCurve(new List<Point3d> {line.From, p0, line.To}, 3);
      c0.Domain = new Interval(0, 1);
      Curve c1 = Curve.CreateInterpolatedCurve(new List<Point3d> {line.From, p1, line.To}, 3);
      c1.Domain = new Interval(0, 1);
      Curve c2 = Curve.CreateInterpolatedCurve(new List<Point3d> {line.From, p2, line.To}, 3);
      c2.Domain = new Interval(0, 1);

      CreateSubTruss(c0, c1, normal, Type, N, MinLen, MaxRDepth - 1, HtoL, uGirder, lGirder, diagonals, posts);
      CreateSubTruss(c0, c2, normal, Type, N, MinLen, MaxRDepth - 1, HtoL, uGirder, lGirder, diagonals, posts);
      CreateSubTruss(c1, c2, normal, Type, N, MinLen, MaxRDepth - 1, HtoL, uGirder, lGirder, diagonals, posts);
    }
  }

  public void CreateTruss(Curve Upper, Curve Lower, int Type, int N, List<Line> uGirder, List<Line> lGirder, List<Line> diagonals, List<Line> posts)
  {
    switch (Type)
    {
      case 1:
        PrattTruss(N, Upper, Lower, uGirder, lGirder, diagonals, posts);
        break;
      case 2:
        WarrenTruss(N, Upper, Lower, uGirder, lGirder, diagonals, posts);
        break;
      case 3:
        WarrenTrussWithVerticals(N, Upper, Lower, uGirder, lGirder, diagonals, posts);
        break;
      case 4:
        KTruss(N, Upper, Lower, uGirder, lGirder, diagonals, posts);
        break;
      case 5:
        VierendeelTruss(N, Upper, Lower, uGirder, lGirder, diagonals, posts);
        break;
    }
  }

  public void PrattTruss(int N, Curve lLine, Curve uLine, List<Line> uGirder, List<Line > lGirder, List<Line> diagonals, List<Line > posts)
  {
    for (int nInd = 0; nInd < N; ++nInd) {
      List <double> ts = new List<double>{ (nInd + 0.0) / N, (nInd + 1.0) / N };
      List <Point3d> ups = new List <Point3d>();
      List <Point3d> lps = new List <Point3d>();
      foreach (double t in ts)
      {
        ups.Add(uLine.PointAt(t));
        lps.Add(lLine.PointAt(t));
      }

      lGirder.Add(new Line(ups[0], ups[1]));
      uGirder.Add(new Line(lps[0], lps[1]));

      if (nInd == 0) {
        posts.Add(new Line(lps[0], ups[0]));
      }
      posts.Add(new Line(lps[1], ups[1]));

      diagonals.Add(new Line(ups[0], lps[1]));
    }
  }

  public void WarrenTruss(int N, Curve lLine, Curve uLine, List<Line> uGirder, List<Line > lGirder, List<Line> diagonals, List<Line > posts)
  {
    Point3d cPoint = lLine.PointAt(0);
    for (int nInd = 0; nInd < N; ++nInd) {
      List <double> ts = new List<double>{ (nInd + 0.0) / N, (nInd + 0.5) / N, (nInd + 1.0) / N };
      List <Point3d> ups = new List <Point3d>();
      List <Point3d> lps = new List <Point3d>();
      foreach (double t in ts)
      {
        ups.Add(uLine.PointAt(t));
        lps.Add(lLine.PointAt(t));
      }

      uGirder.Add(new Line(ups[0], ups[2]));
      if (nInd != 0) {
        lGirder.Add(new Line(cPoint, lps[1]));
      }
      cPoint = lps[1];

      diagonals.Add(new Line(ups[0], lps[1]));
      diagonals.Add(new Line(lps[1], ups[2]));
    }
  }

  public void WarrenTrussWithVerticals(int N, Curve uLine, Curve lLine, List<Line> uGirder, List<Line> lGirder, List<Line> diagonals, List<Line> posts)
  {
    for (int nInd = 0; nInd < N; ++nInd) {
      List <double> ts = new List<double>{ (nInd + 0.0) / N, (nInd + 0.5) / N, (nInd + 1.0) / N };
      List <Point3d> ups = new List <Point3d>();
      List <Point3d> lps = new List <Point3d>();
      foreach (double t in ts)
      {
        ups.Add(uLine.PointAt(t));
        lps.Add(lLine.PointAt(t));
      }

      uGirder.Add(new Line(ups[0], ups[1]));
      uGirder.Add(new Line(ups[1], ups[2]));
      lGirder.Add(new Line(lps[0], lps[1]));
      lGirder.Add(new Line(lps[1], lps[2]));

      if (nInd == 0) {
        posts.Add(new Line(lps[0], ups[0]));
      }
      posts.Add(new Line(lps[1], ups[1]));
      posts.Add(new Line(lps[2], ups[2]));

      diagonals.Add(new Line(ups[0], lps[1]));
      diagonals.Add(new Line(lps[1], ups[2]));
    }
  }

  public void KTruss(int N, Curve uLine, Curve lLine, List<Line> uGirder, List<Line> lGirder, List<Line> diagonals, List<Line> posts)
  {
    for (int nInd = 0; nInd < N; ++nInd) {
      List <double> ts = new List<double>{ (nInd + 0.0) / N, (nInd + 1.0) / N };
      List <Point3d> ups = new List <Point3d>();
      List <Point3d> lps = new List <Point3d>();
      List <Point3d> mps = new List <Point3d>();
      foreach (double t in ts)
      {
        var upperPoint = uLine.PointAt(t);
        ups.Add(upperPoint);
        var lowerPoint = lLine.PointAt(t);
        lps.Add(lowerPoint);
        var midPoint = (upperPoint + lowerPoint) * 0.5;
        mps.Add(midPoint);
      }

      uGirder.Add(new Line(ups[0], ups[1]));
      lGirder.Add(new Line(lps[0], lps[1]));

      if (nInd == 0) {
        posts.Add(new Line(lps[0], ups[0]));
      }
      posts.Add(new Line(lps[1], mps[1]));
      posts.Add(new Line(mps[1], ups[1]));

      diagonals.Add(new Line(mps[1], lps[0]));
      diagonals.Add(new Line(mps[1], ups[0]));
    }
  }

  public void VierendeelTruss(int N, Curve uLine, Curve lLine, List<Line> uGirder, List<Line> lGirder, List<Line> diagonals, List<Line> posts)
  {
    for (int nInd = 0; nInd < N; ++nInd) {
      List <double> ts = new List<double>{ (nInd + 0.0) / N, (nInd + 1.0) / N };
      List <Point3d> ups = new List <Point3d>();
      List <Point3d> lps = new List <Point3d>();
      foreach (double t in ts)
      {
        var upperPoint = uLine.PointAt(t);
        ups.Add(upperPoint);
        var lowerPoint = lLine.PointAt(t);
        lps.Add(lowerPoint);
      }

      uGirder.Add(new Line(ups[0], ups[1]));
      lGirder.Add(new Line(lps[0], lps[1]));

      if (nInd == 0) {
        posts.Add(new Line(lps[0], ups[0]));
      }
      posts.Add(new Line(lps[1], ups[1]));
    }
  }
# ---------- end trussmakerrecursive ----------

merge = Merge(Data1=trussmaker.Diagonals, Data2=trussmaker.Posts)
yz = YZPlane(Origin=end.End)
entwine = Entwine(Branch00=trussmaker.UpperGirder, Branch01=trussmaker.LowerGirder, Branch02=merge, FlattenInputs=True)
gh_mirror = CSharpScript(G=entwine, P=yz, Typ=type_of_truss)  # -> out, Gout, X; inputs G: GeometryBase, P: Plane, Typ: Int32
# ---------- gh_mirror: C# ----------
    // Component written by @garciadelcastillo

    // This component creates a Transformation that mirrors an object on a plane.

    // Compute the Transform and output it
    if ( Typ == 2 || Typ == 3 || Typ == 5)
    {
      Print("Type is Warren, no mirrow. No Lines come from this component");
    }
    else
    {
      Transform xform = Transform.Mirror(P);
      X = xform;  // *

      // Apply it to the object and output it only if it exists
      if (G != null)
      {
        G.Transform(xform);
        Gout = G;
        };;
    }


    // * NOTE:
    //   This transform stringifies to "Generic" because it doesn't use
    //   the GH-flavored transforms in Grasshopper.Kernel.Types.Transforms.
# ---------- end gh_mirror ----------
bang = ExplodeTree(Data=entwine)  # -> Branch0, Branch1, Branch2
bang_2 = ExplodeTree(Data=gh_mirror.Gout)  # -> Branch0, Branch1, Branch2
entwine_2 = Entwine(
    Branch00=[bang.Branch0, bang_2.Branch0],
    Branch01=[bang_2.Branch1, bang.Branch1],
    Branch02=[bang.Branch2, bang_2.Branch2],
    FlattenInputs=True)
clean = CleanTree(RemoveNulls=True, RemoveInvalid=True, RemoveEmpty=False, Tree=entwine_2)
line_2 = Line(clean)

merge_2 = Merge(Data1=trussmakerrecursive.Diagonals, Data2=trussmakerrecursive.Posts)
yz_2 = YZPlane(Origin=end_2.End)
entwine_3 = Entwine(Branch00=trussmakerrecursive.UpperGirder, Branch01=trussmakerrecursive.LowerGirder, Branch02=merge_2, FlattenInputs=True)
gh_mirror_2 = CSharpScript(G=entwine_3, P=yz_2, Typ=type_of_truss_2)  # -> out, Gout, X; inputs G: GeometryBase, P: Plane, Typ: Int32
# ---------- gh_mirror_2: C# ----------
    // Component written by @garciadelcastillo

    // This component creates a Transformation that mirrors an object on a plane.

    // Compute the Transform and output it
    if ( Typ == 2 || Typ == 3 || Typ == 5)
    {
      Print("Type is Warren or Vierendeel, no mirrow. No Lines come from this component");
    }
    else
    {
      Transform xform = Transform.Mirror(P);
      X = xform;  // *

      // Apply it to the object and output it only if it exists
      if (G != null)
      {
        G.Transform(xform);
        Gout = G;
        };;
    }


    // * NOTE:
    //   This transform stringifies to "Generic" because it doesn't use
    //   the GH-flavored transforms in Grasshopper.Kernel.Types.Transforms.
# ---------- end gh_mirror_2 ----------
bang_3 = ExplodeTree(Data=entwine_3)  # -> Branch0, Branch1, Branch2
bang_4 = ExplodeTree(Data=gh_mirror_2.Gout)  # -> Branch0, Branch1, Branch2
entwine_4 = Entwine(
    Branch00=[bang_3.Branch0, bang_4.Branch0],
    Branch01=[bang_4.Branch1, bang_3.Branch1],
    Branch02=[bang_3.Branch2, bang_4.Branch2],
    FlattenInputs=True)
clean_2 = CleanTree(RemoveNulls=True, RemoveInvalid=True, RemoveEmpty=False, Tree=entwine_4)
line_3 = Line(clean_2)

viewer = ParamViewer(line_2)

bang_5 = ExplodeTree(Data=line_2)  # -> Branch0, Branch1, Branch2
join = JoinCurves(Curves=[bang_5.Branch0, bang_5.Branch1], Preserve=False)  # -> flatten(Curves)
end_3 = EndPoints(Curve=join)  # -> Start, End
merge_3 = Merge(Data1=end_3.Start, Data2=end_3.End)
pdecon = Deconstruct(Point=flatten(merge_3))  # -> XComponent, YComponent, ZComponent
smaller = SmallerThan(FirstNumber=pdecon.ZComponent, SecondNumber="0.1")  # -> SmallerThan, OrEqualTo
dispatch = Dispatch(List=merge_3, DispatchPattern=smaller.SmallerThan)  # -> ListA, ListB

matselect = MaterialSelectionKaramba3D(menu=[dropdown(1), dropdown(1)])
ind = Slider(6, range=0..17)
ind_2 = Slider(40, range=0..130)
panel_5 = Panel("""Upper
Lower
web""")

# ---- group: Cross Section Range Selector (Karamba3D)
crosecrselect = CrossSectionRangeSelectorKaramba3D(MaximumHeight_cm=-1, MaximumWidth_cm=-1, Material=matselect, menu=[dropdown(1), dropdown(1), dropdown(3)])

crosecrselect_2 = CrossSectionRangeSelectorKaramba3D(MaximumHeight_cm=-1, MaximumWidth_cm=-1, Material=matselect, menu=[dropdown(1), dropdown(3), dropdown(1)])

# ---- group: Cross Section Selector (Karamba3D)
crosecselect = CrossSectionSelectorKaramba3D(CrossSections=crosecrselect, NameOrListIndexOfCrossSection=ind)  # -> CrossSection, Info

crosecselect_2 = CrossSectionSelectorKaramba3D(CrossSections=crosecrselect_2, NameOrListIndexOfCrossSection=ind_2)  # -> CrossSection, Info

# ----
entwine_5 = Entwine(
    Branch00=crosecselect.CrossSection,
    Branch01=crosecselect.CrossSection,
    Branch02=crosecselect_2.CrossSection,
    FlattenInputs=True)
panel_6 = Panel("web")

# ---- group: Loads (Karamba3D)
loads = LoadsKaramba3D(Vector=Vector(0, 0, -1), LCase="LC0", mode="Gravity")

# ----
force = Slider(-50, range=-50..0)
Z_2 = UnitZ(Factor=force)
beam_loads = BeamLoadsKaramba3D(BeamIdentifier="Upper", LoadCase="LC0", ForceVector=Z_2, TStart=0, TEnd=1, mode="Block", menu=[buttons(off, on, off)])
load = LoadKaramba3D(flatten([loads, beam_loads]))

supp = SupportKaramba3D(PosInd=dispatch.ListA, menu=[buttons(on, on, on, on, off, off)])

# ---- group: Define Supports
beam_joints = BeamJointsKaramba(
    ElementIdentifiers=panel_6,
    CtKNMAtStartingNode=Vector(0, 0, 0),
    CrKNmRadAtStartingNode=Vector(0, 0, 0),
    CtKNMAtEndNode=Vector(0, 0, 0),
    CrKNmRadAtEndNode=Vector(0, 0, 0),
    menu=[buttons(off, off, off, off, on, off), buttons(off, off, off, off, on, off)])

# ---- group: Line to Beam (Karamba3D)
linetobeam = LineToBeamKaramba3D(
    Line=line_2,
    Identifier=graft(panel_5),
    CrossSection=entwine_5,
    New=True,
    Remove=True,
    LimitDistance_m=0.005,
    Bending=True,
    SetBucklingLength=True,
    ToPolylineMaxAngle=0.03,
    ToPolylineTolerance=0.01,
    ToPolylineMaxEdgeLength=0.25)  # -> flatten(Element), Points, Info

# ---- group: Assemble Model (Karamba3D)
assemble = AssembleModelKaramba3D(Elem=linetobeam.Element, Support=supp, Load=load, Joint=beam_joints, LimitDistance_m=0.005)  # -> Model, Info, Mass_kg, CenterOfGravity, LoadCaseNames

# ----
mass_kg = Panel(assemble.Mass_kg)

# ---- group: Analyze (Karamba3D)
analyze = AnalyzeKaramba3D(Model=assemble.Model)  # -> CalculatedModel, MaximumDisplacement_cm, ResultingForceOfGravity_kN, ElasticEnergyChange_kNm

# ----
displacement_cm = Panel(analyze.MaximumDisplacement_cm)

# ---- group: Model View (Karamba3D)
modelview = ModelViewKaramba3D(Model=analyze.CalculatedModel, ResultFactors=1, ResultCase=-1)  # -> Model, DeformedMesh, DeformedAxes, DeformedModel

# ---- group: Beam View (Karamba3D)
beamview = BeamViewKaramba3D(Model=modelview.Model)  # -> Model, MeshesOfRenderedBeams, DeformedBeamAxes, LegendColors, LegendTags

# ----
legend = Legend(Colour=beamview.LegendColors, Tags=beamview.LegendTags, LegendType=1)
