# Grasshopper definition 38_CrossSectionOptimizationBeams.gh (Grasshopper 1.0.7)
# Copyright: B+G Engineers
# plug-ins: Karamba3D, Bifocals

truss_length = Slider(10, range=5..15)
truss_height = Slider(1.2, range=0..5)
truss_divisions = Slider(8, range=2..20)
pt = Point(Point(0.6132713423, 1.260593929, 0))
X = UnitX(Factor=truss_length)
move = Move(Geometry=pt, Motion=X)  # -> Geometry, Transform
merge = Merge(Data1=pt, Data2=move.Geometry)
Z = UnitZ(Factor=truss_height)
ln = Line(StartPoint=pt, EndPoint=move.Geometry)
divide = DivideCurve(Curve=ln, Count=truss_divisions, Kinks=False)  # -> Points, Tangents, Parameters
panel = Panel("""0
1""")
move_2 = Move(Geometry=divide.Points, Motion=Z)  # -> Geometry, Transform
long = LongestList(ListA=panel, ListB=divide.Points, ListC=move_2.Geometry, PaddingMode=4)  # -> ListA, ListB, ListC
pline = PolyLine(Vertices=divide.Points, Closed=False)
pline_2 = PolyLine(Vertices=move_2.Geometry, Closed=False)
p_n_c = PickNChoose(Pattern=long.ListA, Stream0=long.ListB, Stream1=long.ListC)
ln_2 = Line(StartPoint=divide.Points, EndPoint=move_2.Geometry)
panel_2 = Panel("100 to 10")
pline_3 = PolyLine(Vertices=p_n_c, Closed=False)
explode = Explode(Curve=pline_3, Recursive=True)  # -> Segments, Vertices
range = Range(Domain="10 to 100", Steps=10)
entwine = Entwine(Branch00=pline, Branch01=pline_2, Branch02=ln_2, Branch03=explode.Segments, FlattenInputs=True)
expression = Expression(x=range, Expression="x/10")
concat = Concatenate(FragmentA="Pipe", FragmentB=range)
cross_section = CrossSectionKaramba3D(
    FamilyNameOfCrossSection="Pipe",
    NameOfCrossSection=concat,
    Diameter_cm=range,
    WallThickness_cm=expression,
    mode="Circular Hollow")

# ---- group: Cross Section Range Selector (Karamba3D)
crosecrselect = CrossSectionRangeSelectorKaramba3D(MaximumHeight_cm=-1, MaximumWidth_cm=-1, menu=[dropdown(0), dropdown(1), dropdown(3)])

# ----
crosec = CrossSectionKaramba3D(cross_section)

# ---- group: Cross Section Selector (Karamba3D)
crosecselect = CrossSectionSelectorKaramba3D(CrossSections=crosec, NameOrListIndexOfCrossSection="0")  # -> CrossSection, Info

# ----
panel_3 = Panel("""A
B
C
D""")
pt_2 = Point(merge)
Z_2 = UnitZ(Factor=Slider(-10, range=-50..0))
supp = SupportKaramba3D(PosInd=pt_2, menu=[buttons(on, on, on, on, on, on)])

# ---- group: Line to Beam (Karamba3D)
linetobeam = LineToBeamKaramba3D(
    Line=entwine,
    Identifier=graft(panel_3),
    CrossSection=crosecselect.CrossSection,
    New=True,
    Remove=True,
    LimitDistance_m=0.005,
    Bending=graft(True),
    SetBucklingLength=True,
    ToPolylineMaxAngle=0.03,
    ToPolylineTolerance=0.01,
    ToPolylineMinEdgeLength=0.25)  # -> Element, Points, Info

# ----
modifyelem = ModifyElementKaramba3D(BeamIdentifierIndex="D", Bending=Toggle(False), mode="Beam")
beam_loads = BeamLoadsKaramba3D(BeamIdentifier="B", LoadCase="0", ForceVector=Z_2, TStart=0, TEnd=1, mode="Block", menu=[buttons(off, on, off)])

# ---- group: Assemble Model (Karamba3D)
assemble = AssembleModelKaramba3D(Elem=flatten([linetobeam.Element, modifyelem]), Support=supp, Load=beam_loads, LimitDistance_m=0.005)  # -> Model, Info, Mass_kg, CenterOfGravity, LoadCaseNames

# ----
panel_4 = Panel("A")
panel_5 = Panel("B")
panel_6 = Panel("0.7")
panel_7 = Panel("0.2")

# ---- group: Optimize Cross Section (Karamba3D)
opticrosec = OptimizeCrossSectionKaramba3D(
    Model=assemble.Model,
    CrossSections=crosec,
    MaximumUtilization=1,
    UltimateLimitStateIterations=5,
    DisplacementIterations=5,
    NumberOfSamplePoints=3,
    ElasticDesign=True,
    GammaM0=1,
    GammaM1=1.1,
    SwayFrame=True)  # -> ModelWithOptimizedCrossSections, Info, Mass_kg, MaximumDisplacement_cm, ElasticEnergyChange_kNm

# ---- group: Analyze (Karamba3D)
analyze = AnalyzeKaramba3D(Model=assemble.Model)  # -> CalculatedModel, MaximumDisplacement_cm, ResultingForceOfGravity_kN, ElasticEnergy_kNm

# ----
panel_8 = Panel(assemble.Mass_kg)
panel_9 = Panel(analyze.MaximumDisplacement_cm)
panel_10 = Panel(analyze.ElasticEnergy_kNm)
panel_11 = Panel(opticrosec.Mass_kg)
panel_12 = Panel(opticrosec.MaximumDisplacement_cm)
panel_13 = Panel(opticrosec.ElasticEnergyChange_kNm)

# ---- group: Model View (Karamba3D)
modelview = ModelViewKaramba3D(Model=opticrosec.ModelWithOptimizedCrossSections, ResultFactors=1, ResultCase=-1)  # -> Model, DeformedMesh, DeformedAxes, DeformedModel

# ---- group: Beam View (Karamba3D)
beamview = BeamViewKaramba3D(Model=modelview.Model)  # -> Model, MeshesOfRenderedBeams, DeformedBeamAxes, LegendColors, LegendTags

# ----
legend = Legend(Colour=beamview.LegendColors, Tags=beamview.LegendTags, LegendType=1)
