# Grasshopper definition 39_ShapeOptimisationTruss.gh (Grasshopper 1.0.7)
# Copyright: B+G Engineers
# plug-ins: Karamba3D, Bifocals

truss_length = Slider(10, range=5..15)

truss_pitch_position = Slider(0.488, range=0..1)
truss_left_height = Slider(2.1, range=0.5..5)
truss_pitch_height = Slider(3.6, range=0.5..5)
truss_right_height = Slider(2.6, range=0.5..5)

pt = Point(Point(0.6132713423, 1.260593929, 0))
panel = Panel("""0
1""")
X = UnitX(Factor=truss_length)
move = Move(Geometry=pt, Motion=X)  # -> Geometry, Transform
merge = Merge(Data1=pt, Data2=move.Geometry)
ln = Line(StartPoint=pt, EndPoint=move.Geometry)
sort = SortList(
    Keys=flatten([panel, truss_pitch_position]),
    ValuesA=flatten([truss_left_height, truss_right_height, truss_pitch_height]))  # -> Keys, ValuesA
avr = Average(Input=[truss_left_height, truss_pitch_height, truss_right_height])
galapagos = Galapagos(fitness=analyze, gene=[truss_pitch_position, truss_left_height, truss_pitch_height, truss_right_height])
dcon = DeleteConsecutive(Set=sort.Keys, Wrap=False)  # -> Set, Count
eval = EvaluateCurve(Curve=ln, Parameter=dcon.Set)  # -> Point, Tangent, Angle
pline = PolyLine(Vertices=eval.Point, Closed=False)
index = ItemIndex(List=sort.Keys, Item=dcon.Set)
explode = Explode(Curve=pline, Recursive=True)  # -> Segments, Vertices
len = Length(Curve=explode.Segments)
division = Division(A=len, B=avr)
multiplication = Multiplication(A=division, B="2")
item = ListItem(List=sort.ValuesA, Index=index, Wrap=True)
Z = UnitZ(Factor=item)
move_2 = Move(Geometry=eval.Point, Motion=Z)  # -> Geometry, Transform
pline_2 = PolyLine(Vertices=move_2.Geometry, Closed=False)
explode_2 = Explode(Curve=pline_2, Recursive=True)  # -> Segments, Vertices
divide = DivideCurve(Curve=explode.Segments, Count=multiplication, Kinks=False)  # -> Points, Tangents, Parameters
divide_2 = DivideCurve(Curve=explode_2.Segments, Count=multiplication, Kinks=False)  # -> Points, Tangents, Parameters
trim = TrimTree(Tree=divide_2.Points, Depth=1)
trim_2 = TrimTree(Tree=divide.Points, Depth=1)
rdpoints = RemoveDuplicatePointsKaramba3D(Point=trim_2, LimitDistance=0.005)  # -> OutPoint, Info, Indexes
rdpoints_2 = RemoveDuplicatePointsKaramba3D(Point=trim, LimitDistance=0.005)  # -> OutPoint, Info, Indexes
panel_2 = Panel("""0
1""")
pline_3 = PolyLine(Vertices=rdpoints.OutPoint, Closed=False)
pline_4 = PolyLine(Vertices=rdpoints_2.OutPoint, Closed=False)
long = LongestList(ListA=panel_2, ListB=rdpoints.OutPoint, ListC=rdpoints_2.OutPoint, PaddingMode=4)  # -> ListA, ListB, ListC
ln_2 = Line(StartPoint=rdpoints.OutPoint, EndPoint=rdpoints_2.OutPoint)
p_n_c = PickNChoose(Pattern=long.ListA, Stream0=long.ListB, Stream1=long.ListC)
pline_5 = PolyLine(Vertices=p_n_c, Closed=False)
explode_3 = Explode(Curve=pline_5, Recursive=True)  # -> Segments, Vertices
entwine = Entwine(Branch00=pline_3, Branch01=pline_4, Branch02=ln_2, Branch03=explode_3.Segments, FlattenInputs=True)
number_slider = Slider(15, range=0..100)
expression = Expression(x=number_slider, Expression="x/10")
concat = Concatenate(FragmentA="SHS", FragmentB=number_slider)
cross_section = CrossSectionKaramba3D(
    FamilyNameOfCrossSection="SHS",
    NameOfCrossSection=concat,
    Height_cm=number_slider,
    UpperFlangeWidth_cm=number_slider,
    LowerFlangeWidth_cm=number_slider,
    UpperFlangeThickness_cm=expression,
    LowerFlangeThickness_cm=expression,
    SidewallsThickness_cm=expression,
    FilletRadius_cm=0.6,
    mode="Box")
panel_3 = Panel("""A
B
C
D""")
Z_2 = UnitZ(Factor=Slider(-20, range=-50..0))
pt_2 = Point(merge)
supp = SupportKaramba3D(PosInd=pt_2, menu=[buttons(on, on, on, on, on, on)])

# ---- group: Line to Beam (Karamba3D)
linetobeam = LineToBeamKaramba3D(
    Line=entwine,
    Identifier=graft(panel_3),
    CrossSection=cross_section,
    New=True,
    Remove=True,
    LimitDistance_m=0.005,
    Bending=graft(True),
    SetBucklingLength=True,
    ToPolylineMaxAngle=0.03,
    ToPolylineTolerance=0.01,
    ToPolylineMinEdgeLength=0.25)  # -> Element, Points, Info

# ----
modifyelem = ModifyElementKaramba3D(BeamIdentifierIndex="D", Bending=Toggle(False), mode="Beam")
beam_loads = BeamLoadsKaramba3D(BeamIdentifier="B", LoadCase="0", ForceVector=Z_2, TStart=0, TEnd=1, mode="Block", menu=[buttons(off, on, off)])

# ---- group: Assemble Model (Karamba3D)
assemble = AssembleModelKaramba3D(Elem=flatten([linetobeam.Element, modifyelem]), Support=supp, Load=beam_loads, LimitDistance_m=0.005)  # -> Model, Info, Mass_kg, CenterOfGravity, LoadCaseNames

# ---- group: Analyze (Karamba3D)
analyze = AnalyzeKaramba3D(Model=assemble.Model)  # -> CalculatedModel, MaximumDisplacement_cm, ResultingForceOfGravity_kN, ElasticEnergy_kNm

# ----
panel_4 = Panel(analyze.MaximumDisplacement_cm)
panel_5 = Panel(assemble.Mass_kg)
panel_7 = Panel(analyze.ElasticEnergy_kNm)

# ---- group: Model View (Karamba3D)
modelview = ModelViewKaramba3D(Model=analyze.CalculatedModel, ResultFactors=1, ResultCase=-1)  # -> Model, DeformedMesh, DeformedAxes, DeformedModel

# ---- group: Beam View (Karamba3D)
beamview = BeamViewKaramba3D(Model=modelview.Model)  # -> Model, MeshesOfRenderedBeams, DeformedBeamAxes, LegendColors, LegendTags

# ----
legend = Legend(Colour=beamview.LegendColors, Tags=beamview.LegendTags, LegendType=1)
