# Grasshopper definition 41_CreatingLoadCombination.gh (Grasshopper 1.0.7)
# plug-ins: Karamba3D

# ---- group: Create Geometry
height = Slider(4, range=2..4)
height_2 = Slider(2, range=0.5..2)
length = Slider(2.5, range=0.5..4)
Z = UnitZ(Factor=height)
X = UnitX(Factor=1)
division = Division(A=height_2, B=Slider(0.5, range=0..1))
line = LineSDL(Start="0,0,0", Direction=Z, Length=height)
line_2 = LineSDL(Start=Z, Direction=X, Length=length)
series = Series(Start=0, Step=height_2, Count=Slider(5, range=0..10))
Y = UnitY(Factor=series)
move = Move(Geometry=line, Motion=Y)  # -> simplify(Geometry), Transform
move_2 = Move(Geometry=line_2, Motion=Y)  # -> simplify(Geometry), Transform
divide = DivideCurve(Curve=move_2.Geometry, Count=division, Kinks=False)  # -> Points, Tangents, Parameters
flip = FlipMatrix(Data=divide.Points)
pline = PolyLine(Vertices=flip, Closed=False)
pline_2 = PolyLine(Vertices=divide.Points, Closed=False)
explode = Explode(Curve=pline, Recursive=True)  # -> Segments, Vertices
entwine = Entwine(Branch00=move.Geometry, Branch01=pline_2, Branch02=explode.Segments, FlattenInputs=True)

# ----
simple_regular_expressions = Panel("""K1 = g|gk
K2 = 0.5*(g|gk)
L = K$
M = (1|2)*K$""")
standard_formulas = Panel("""A = 0.5*g
B = g + gk
C = 0.5*g - gk
D = 0.5*(g + gk)""")
or_vertical_bar = Panel("""E = qn|gk|qw1
F = 0.5*(g|gk)
G = (0.5|0)*g + gk
H = (0.5|1)*(g + gk)
I = (0.5|0)*g + (0.5|1)*gk
J = ((0.5|0)*g|gk)+qn""")

# ---- group: Load-Case-Combinator (Karamba3D)
lccombinator = LCCombinator(Rules=simple_regular_expressions)  # -> Load, Names, Nums

lccombinator_2 = LCCombinator(Rules=standard_formulas)  # -> Load, Names, Nums

lccombinator_3 = LCCombinator(Rules=or_vertical_bar)  # -> Load, Names, Nums

# ----
panel = Panel(lccombinator_2.Load)
panel_2 = Panel(lccombinator_3.Load)
panel_3 = Panel(lccombinator.Load)

# ---- group: Define Cross Sections / Cross Section Range Selector (Karamba3D)
crosecrselect = CroSecRSelect(MaxH=-1, MaxWidth=-1, menu=[dropdown(1), dropdown(1), dropdown(3)])

# ---- group: Define Cross Sections
item = ListItem(List=crosecrselect, Index=0, Wrap=True)

# ---- group: Define Supports
end = EndPoints(Curve=move.Geometry)  # -> Start, End

# ---- group: Define Elements
panel_4 = Panel("""Column
MainBeam
SecBeam""")

# ---- group: Define Supports / Support (Karamba3D)
supp = Supp(PosInd=end.Start, menu=[buttons(on, on, on, off, on, off)])

# ---- group: Define Elements / Create Linear Element (Karamba3D)
lineelem = LineElem(
    Line=entwine,
    Id=graft(panel_4),
    CroSec=item,
    LDist=0.005,
    BklLenY=-1,
    BklLenZ=-1,
    BklLenLT=-1,
    Bending=True,
    ToPAng=0.03,
    ToPTol=0.01,
    ToPMaxL=0.25,
    New=True,
    Remove=True,
    mode="LineToBeam")  # -> Elem, Pts, Info

# ---- group: Define Load Combinations
panel_6 = Panel("""SLS = g + gk + qn + (0|0.6)*(qw1|qw2)
ULS = 1.35 * (g + gk + qn) + (0|1)*(qw1|qw2)""")
toggle = BooleanToggle(True)
panel_7 = Panel("ULS")
panel_8 = Panel("SLS")

# ---- group: Define Load Combinations / Load Case Combination Settings (Karamba3D)
loadcasecombisettings = LoadCaseCombiSettings(LCase=panel_7, NIIFromCombination=toggle, mode="Small Disp.Th.II")

loadcasecombisettings_2 = LoadCaseCombiSettings(LCase=panel_8, mode="Small Disp.")

# ---- group: Define Load Combinations / Load-Case-Combinator (Karamba3D)
lccombinator_4 = LCCombinator(Rules=panel_6)  # -> Load, Names, Nums

# ---- group: Define Load Combinations (continued)
load = LoadKaramba3D([lccombinator_4.Load, loadcasecombisettings_2, loadcasecombisettings, lccombinator_2.Load, lccombinator_3.Load, lccombinator.Load])

# ----
panel_9 = Panel(lccombinator_4.Names)
panel_10 = Panel(lccombinator_4.Load)
panel_11 = Panel(lccombinator_4.Nums)

# ---- group: Define Loads
loft = Loft(
    Curves=flatten(move.Geometry),
    Options={Adjust=False, Closed=False, LoftEnds=0, LoftSimp=0, LoftType=0, Rebuild=10, Refit=0.01})
loft_2 = Loft(
    Curves=flatten(pline_2),
    Options={Adjust=False, Closed=False, LoftEnds=0, LoftSimp=0, LoftType=0, Rebuild=10, Refit=0.01})
panel_12 = Panel("""-0.5
0.5""")
panel_13 = Panel("""-2
-1""")
panel_14 = Panel("""qw1
qw2""")
panel_15 = Panel("Column")
panel_16 = Panel("SecBeam")
Z_2 = UnitZ(Factor=panel_12)
Z_3 = UnitZ(Factor=panel_13)
panel_17 = Panel("""gk
qn""")
panel_18 = Panel("g")

# ---- group: Define Loads / Mesh Breps (Karamba3D)
mesh_breps = MeshBreps(Brep=loft, MRes=1, ERef=0.67, PRed=False, SStep=0, SIter=5)  # -> Mesh, Info

mesh_breps_2 = MeshBreps(Brep=loft_2, MRes=1, ERef=0.67, PRed=False, SStep=0, SIter=5)  # -> Mesh, Info

# ---- group: Define Loads / Loads (Karamba3D)
loads = Loads(
    Vec=Z_3,
    Mesh=mesh_breps_2.Mesh,
    ElementIdentifiers=panel_16,
    LCase=panel_17,
    mode="MeshLoad -Const.",
    menu=[buttons(off, on, off), buttons(off, on)])

loads_2 = Loads(
    Vec=Z_2,
    Mesh=mesh_breps.Mesh,
    ElementIdentifiers=panel_15,
    LCase=panel_14,
    mode="MeshLoad -Const.",
    menu=[buttons(on, off, off), buttons(off, on)])

loads_3 = Loads(Vec=Vector(0, 0, -1), LCase=panel_18, mode="Gravity")

# ---- group: Define Loads (continued)
load_2 = LoadKaramba3D(flatten([loads_3, loads, loads_2]))

# ---- group: Assemble Model (Karamba3D)
assemble = Assemble(
    Elem=flatten(lineelem.Elem),
    Support=flatten(supp),
    Load=flatten([load_2, lccombinator_2.Load, lccombinator_3.Load, lccombinator.Load]),
    LDist=0.005)  # -> Model, Info, Mass, COG, LCNames

# ----
panel_19 = Panel(assemble.Model)

# ---- group: Model View (Karamba3D)
modelview = ModelView(Model=assemble.Model)  # -> Model, DefMesh, DefAxes, DefModel, DefMax

# ---- group: Assemble Model / Assemble Model (Karamba3D)
assemble_2 = Assemble(Elem=flatten(lineelem.Elem), Support=flatten(supp), Load=flatten([load_2, load]), LDist=0.005)  # -> Model, Info, Mass, COG, LCNames

# ----
panel_20 = Panel(load_2)

# ---- group: Optimize Cross Sections
number_slider = Slider(0.25, range=0..1)
crosec = CrossSectionKaramba3D(crosecrselect)
num = Number(length)
expression = Expression(x=num, Expression="x/100*100")
panel_21 = Panel("SLS")
panel_22 = Panel("ULS")

# ---- group: Optimize Cross Sections / Optimize Cross Section (Karamba3D)
opticrosec = OptiCroSec(
    Model=assemble_2.Model,
    CroSecs=crosec,
    MaxUtil=number_slider,
    LCasesUtil=panel_22,
    MaxDisp=expression,
    LCasesDisp=panel_21,
    MaxWork=0.01,
    UtilIter=5,
    DispIter=5,
    DispInc=2,
    DispTol=0.01,
    NSamples=3,
    Elast=True,
    GammaM0=1,
    GammaM1=1.1,
    SwayFrame=True)  # -> Model, Info, Mass, MaxDisp, DEnergy, MaxDispView, MaxUtilView

# ---- group: Optimize Cross Sections (continued)
panel_23 = Panel(opticrosec.MaxDispView)
panel_24 = Panel(opticrosec.Mass)
panel_25 = Panel(opticrosec.MaxDisp)

# ---- group: Analyse Model / Analyse (Karamba3D)
analyse = Analyse(Model=opticrosec.Model)  # -> Model, MaxDisp, Force, Energy

# ---- group: Analyse Model
panel_26 = Panel(analyse.MaxDisp)

# ---- group: View Results / Load-Case Selector (Karamba3D)
resultselect = ResultSelect(
    Model=analyse.Model,
    menu=[buttons(on, off), dropdown(6), dropdown(0), buttons(off, off, off, off, off, off, off), buttons(off, off, off, off, off, off), buttons(off, off, off, off, off, off, off, off), buttons(off, off, off, off, off, off, off, off)])  # -> Model, LCase

# ---- group: View Results / Model View (Karamba3D)
modelview_2 = ModelView(Model=resultselect.Model)  # -> Model, DefMesh, DefAxes, DefModel, DefMax

# ---- group: View Results / Reaction View (Karamba3D)
reactview = ReactView(Model=resultselect.Model)  # -> Model, LegendC, LegendT

# ---- group: View Results / Beam View (Karamba3D)
beamview = BeamView(Model=modelview_2.Model)  # -> Model, Mesh, Curves, LegendC, LegendT

# ---- group: View Results
legend = Legend(Colour=beamview.LegendC, Tags=beamview.LegendT, LegendType=1)
