# Grasshopper definition 44_OptiDisp_Frame.gh (Grasshopper 1.0.7)
# plug-ins: Karamba3D

height = Slider(4, range=1..8)
span = Slider(4, range=1..8)
line = LineSDL(Start="0,1,0", Direction=Vector(0, 0, 1), Length=height)
X = UnitX(Factor=expr("x*0.5", span))
end = EndPoints(Curve=line)  # -> Start, End
X_2 = UnitX(Factor=1)
line_2 = LineSDL(Start=end.End, Direction=X_2, Length=X)
end_2 = EndPoints(Curve=line_2)  # -> Start, End
entwine = Entwine(Branch00=line, Branch01=line_2, FlattenInputs=True)
yz = YZPlane(Origin=end_2.End)
crosecrselect = CrossSectionRangeSelectorKaramba3D(MaximumHeight_cm=-1, MaximumWidth_cm=-1, menu=[dropdown(1), dropdown(1), dropdown(3)])
mirror = Mirror(Geometry=entwine, Plane=yz)  # -> Geometry, Transform
item = ListItem(List=crosecrselect, Index=0, Wrap=True)
merge = Merge(Data1=entwine, Data2=mirror.Geometry)
panel = Panel("""column
beam""")
range = Range(Domain=Domain(0, 1), Steps=10)
X_3 = UnitX(Factor="10")
Z = UnitZ(Factor="-5")
shatter = Shatter(Curve=merge, Parameters=range)  # -> simplify(Segments)
loads = LoadsKaramba3D(ForceVector=X_3, Local=False, PosInd=end.End, LCase="wind", mode="Point")
beam_loads = BeamLoadsKaramba3D(BeamIdentifier="beam", LoadCase="snow", ForceVector=Z, TStart=0, TEnd=1, mode="Block", menu=[buttons(off, on, off)])
lccombinator = LoadCaseCombinatorKaramba3D(LoadCaseCombinationRulesKaramba3D="SLS = snow + wind")  # -> LoadCaseCombinations, NamesOfLoadCases, NumberOfLoadCases
path_mapper = PathMapper(shatter, source="{A;B} ", target="{A}")
number_slider = Slider(0.03, range=0.01..3)
merge_2 = Merge(Data1=flatten(loads), Data2=flatten(beam_loads), Data3=lccombinator.LoadCaseCombinations)
lineelem = CreateLinearElementKaramba3D(
    Line=path_mapper,
    Identifier=graft(panel),
    CrossSection=item,
    LimitDistance_m=0.005,
    BucklingLengthY_m=-1,
    BucklingLengthZ_m=-1,
    BucklingLengthLT_m=-1,
    Bending=True,
    ToPolylineMaxAngle=0.03,
    ToPolylineTolerance=0.01,
    ToPolylineMaxEdgeLength=0.25,
    New=True,
    Remove=True,
    mode="LineToBeam")  # -> flatten(Element), flatten(Points), Info
pt = Point(lineelem.Points)
pdecon = Deconstruct(Point=pt)  # -> XComponent, YComponent, ZComponent
smaller = SmallerThan(FirstNumber=pdecon.ZComponent, SecondNumber="1e-4")  # -> SmallerThan, OrEqualTo
cull = CullPattern(List=pt, CullPattern=smaller.SmallerThan)
supp = SupportKaramba3D(PosInd=cull, menu=[buttons(on, on, on, on, on, on)])
load = LoadKaramba3D(flatten(merge_2))
pt_2 = ConstructPoint(XCoordinate=0, YCoordinate=0, ZCoordinate=number_slider)
assemble = AssembleModelKaramba3D(Elem=lineelem.Element, Support=supp, Load=load, LimitDistance_m=0.005)  # -> Model, Info, Mass_kg, CentreOfGravity, LoadCaseNames
xy = XYPlane(Origin=pt_2)
X_4 = UnitX(Factor=number_slider)
X_5 = UnitX(Factor=number_slider)
Z_2 = UnitZ(Factor=Slider(0.292, range=0..1.2))
num = Number(number_slider)
neg = Negative(Value=X_5)
neg_2 = Negative(Value=Z_2)
opticrosec = OptimizeCrossSectionKaramba3D(
    Model=assemble.Model,
    CrossSections=crosecrselect,
    MaximumUtilization=1,
    LoadCasesUtil="-",
    MaximumDisplacement_cm=[neg_2, xy],
    LoadCasesDisp="SLS",
    MaximumVirtualWork_kNcm=0.01,
    NumberOfUtilizationIterations=5,
    NumberOfDisplacementIterations="20",
    NumberOfDisplacementIncrementsPerIteration=2,
    DisplacementTolerance=0.01,
    NumberOfSamplePoints=3,
    ElasticDesign=True,
    GammaM0=1,
    GammaM1=1.1,
    SwayFrame=True)  # -> OptimizedModel, Info, Mass_kg, MaximumDisplacement_cm, ElasticEnergyChange_kNm, MaximumUtilizationViewInsufficientCrossSections, MaximumDisplacementViewLimitCrossSections
panel_2 = Panel(opticrosec.MaximumDisplacement_cm)
range_2 = Range(Domain=Domain(0, 1), Steps=10)
modelview = ModelViewKaramba3D(Model=opticrosec.OptimizedModel, ViewSelection=opticrosec.MaximumDisplacementViewLimitCrossSections)  # -> Model, DeformedMesh, DeformedAxes, DeformedModel, MaximumDeformation
beamdisp = BeamDisplacementsKaramba3D(AnalysedModel=opticrosec.OptimizedModel, LoadCase="SLS", Ts=range_2)  # -> Model, Translations_m, Rotations_rad, LoadCaseIndex
multiplication = Multiplication(A=beamdisp.Translations_m, B="100")
beamview = BeamViewKaramba3D(Model=modelview.Model)  # -> Model, MeshesOfRenderedBeams, DeformedBeamAxes, LegendColours, LegendTags
devec = DeconstructVector(Vector=flatten(multiplication))  # -> XComponent, YComponent, ZComponent
legend = Legend(Colour=beamview.LegendColours, Tags=beamview.LegendTags, LegendType=1)
bnd = Bounds(Numbers=devec.XComponent)
bnd_2 = Bounds(Numbers=devec.ZComponent)
panel_3 = Panel(bnd)
panel_4 = Panel(bnd_2)
