# Grasshopper definition 44_OptiDisp_LCC.gh (Grasshopper 1.0.8)
# plug-ins: Karamba3D

height = Slider(4, range=1..8)
span = Slider(4, range=1..8)
line = LineSDL(Start="0,1,0", Direction=Vector(0, 0, 1), Length=height)
X = UnitX(Factor=expr("x*0.5", span))
end = EndPoints(Curve=line)  # -> Start, End
X_2 = UnitX(Factor=1)
line_2 = LineSDL(Start=end.End, Direction=X_2, Length=X)
end_2 = EndPoints(Curve=line_2)  # -> Start, End
entwine = Entwine(Branch00=line, Branch01=line_2, FlattenInputs=True)
yz = YZPlane(Origin=end_2.End)
mirror = Mirror(Geometry=entwine, Plane=yz)  # -> Geometry, Transform
merge = Merge(Data1=entwine, Data2=mirror.Geometry)
range = Range(Domain=Domain(0, 1), Steps=10)
crosecrselect = CrossSectionRangeSelectorKaramba3D(MaximumHeight_cm=-1, MaximumWidth_cm=-1, menu=[dropdown(1), dropdown(1), dropdown(3)])
panel = Panel("""SLS = snow + wind
ULS = 1.35 * snow + ((-1.5)|1.5) * wind""")
shatter = Shatter(Curve=merge, Parameters=range)  # -> simplify(Segments)
path_mapper = PathMapper(shatter, source="{A;B} ", target="{A}")
panel_2 = Panel("""column
beam""")
item = ListItem(List=crosecrselect, Index=0, Wrap=True)
X_3 = UnitX(Factor="10")
Z = UnitZ(Factor="-5")
lineelem = CreateLinearElementKaramba3D(
    Line=path_mapper,
    Identifier=graft(panel_2),
    CrossSection=item,
    LimitDistance_m=0.005,
    BucklingLengthY_m=-1,
    BucklingLengthZ_m=-1,
    BucklingLengthLT_m=-1,
    Bending=True,
    ToPolylineMaxAngle=0.03,
    ToPolylineTolerance=0.01,
    ToPolylineMaxEdgeLength=0.25,
    New=True,
    Remove=True,
    mode="LineToBeam")  # -> flatten(Element), flatten(Points), Info
pt = Point(lineelem.Points)
pdecon = Deconstruct(Point=pt)  # -> XComponent, YComponent, ZComponent
smaller = SmallerThan(FirstNumber=pdecon.ZComponent, SecondNumber="1e-4")  # -> SmallerThan, OrEqualTo
cull = CullPattern(List=pt, CullPattern=smaller.SmallerThan)
supp = SupportKaramba3D(PosInd=cull, menu=[buttons(on, on, on, on, on, on)])
loads = LoadsKaramba3D(ForceVector=X_3, Local=False, PosInd=end.End, LCase="wind", mode="Point")
beam_loads = BeamLoadsKaramba3D(BeamIdentifier="beam", LoadCase="snow", ForceVector=Z, TStart=0, TEnd=1, mode="Block", menu=[buttons(off, on, off)])
lccombinator = LoadCaseCombinatorKaramba3D(LoadCaseCombinationRulesKaramba3D=panel)  # -> LoadCaseCombinations, NamesOfLoadCases, NumberOfLoadCases
merge_2 = Merge(Data1=flatten(loads), Data2=flatten(beam_loads), Data3=flatten(lccombinator.LoadCaseCombinations))
load = LoadKaramba3D(flatten(merge_2))
assemble = AssembleModelKaramba3D(Elem=lineelem.Element, Support=supp, Load=load, LimitDistance_m=0.005)  # -> Model, Info, Mass_kg, CentreOfGravity, LoadCaseNames
analyse = AnalyseKaramba3D(Model=assemble.Model)  # -> AnalysedModel, MaximumDisplacement_cm, ResultingForce_kN, ChangeOfElasticEnergy_kNm
resultselect = LoadCaseSelectorKaramba3D(
    Model=analyse.AnalysedModel,
    menu=[buttons(on, on), dropdown(2), dropdown(0), buttons(off, off, off, off, off, off, off), buttons(off, off, off, off, off, off), buttons(off, off, off, off, off, off, off, off), buttons(off, off, off, off, off, off, off, off)])  # -> Model, LoadCaseSelection
range_2 = Range(Domain=Domain(0, 1), Steps=10)
utilization = UtilizationOfElementsKaramba3D(
    AnalysedModel=resultselect.Model,
    LoadCaseCombination=resultselect.LoadCaseSelection,
    NumberOfSamplePoints=3,
    ElasticDesign=True,
    GammaM0=1,
    GammaM1=1.1,
    SwayFrame=True,
    WithDetails=False,
    mode="Beams")  # -> Model, Utilization, SigMax_kN_cm², SigMin_kN_cm², TauMax_kN_cm², UtilN, UtilVy, UtilVz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
b_forces = BeamForcesKaramba3D(AnalysedModel=resultselect.Model, LoadCase=resultselect.LoadCaseSelection, Ts=[0, 1])  # -> Model, NormalForce_kN, ShearForceVz_kN, ShearForceVy_kN, TorsionalMomentMt_kNm, BendingMomentMy_kNm, BendingMomentMz_kNm, LoadCaseIndex
react = ReactionForcesKaramba3D(AnalysedModel=resultselect.Model, LoadCase=resultselect.LoadCaseSelection)  # -> Model, ReactionForces_kN, ReactionMoments_kNm, SupportPosition, SumOfReactionForces_kN, SumOfReactionMoments_kNm, GoverningLoadCaseIndex
beamdisp = BeamDisplacementsKaramba3D(AnalysedModel=resultselect.Model, LoadCase=resultselect.LoadCaseSelection, Ts=range_2)  # -> Model, Translations_m, Rotations_rad, LoadCaseIndex
modelview = ModelViewKaramba3D(Model=resultselect.Model)  # -> Model, DeformedMesh, DeformedAxes, DeformedModel, MaximumDeformation
panel_3 = Panel(react.ReactionMoments_kNm)
panel_4 = Panel(react.ReactionForces_kN)
panel_5 = Panel(b_forces.NormalForce_kN)
panel_6 = Panel(utilization.Utilization)
multiplication = Multiplication(A=beamdisp.Translations_m, B="100")
beamview = BeamViewKaramba3D(Model=modelview.Model)  # -> Model, MeshesOfRenderedBeams, DeformedBeamAxes, LegendColours, LegendTags
panel_7 = Panel(b_forces.ShearForceVz_kN)
devec = DeconstructVector(Vector=flatten(multiplication))  # -> XComponent, YComponent, ZComponent
panel_8 = Panel(b_forces.BendingMomentMy_kNm)
legend = Legend(Colour=beamview.LegendColours, Tags=beamview.LegendTags, LegendType=1)
bnd = Bounds(Numbers=devec.XComponent)
bnd_2 = Bounds(Numbers=devec.ZComponent)
panel_9 = Panel(bnd)
panel_10 = Panel(bnd_2)
