# Grasshopper definition 44_Shells+Beams.gh (Grasshopper 1.0.8)
# plug-ins: Karamba3D

# ---- group: Generate Geometry for Beams and Shell
number_slider = Slider(4, range=0..10)
Z = UnitZ(Factor="4")
planesrf = PlaneSurface(Plane=PlaneXY(0, 0, 0), XSize="20", YSize="20")
sdivide = DivideSurface(Surface=planesrf, UCount=number_slider, VCount=number_slider)  # -> Points, Normals, Parameters
# 02 - Shells and Beams
# Difficulty: Moderate | Version 2.2.0
# Combination of beam and shell elements in Karamba3D.
move = Move(Geometry=planesrf, Motion=Z)  # -> Geometry, Transform
move_2 = Move(Geometry=sdivide.Points, Motion=Z)  # -> Geometry, Transform

# ---- group: Set Cross Section
matselect = MaterialSelectionKaramba3D(menu=[dropdown(7), dropdown(6)])
panel = Panel("50")
crosec = CrossSectionKaramba3D(
    FamilyNameOfCrossSection="DefaultCroSec",
    Material=matselect,
    Height_cm=panel,
    UpperFlangeWidth_cm=panel,
    LowerFlangeWidth_cm=panel,
    mode="Trapezoid")

matselect_2 = MaterialSelectionKaramba3D(menu=[dropdown(7), dropdown(4)])
number_slider_2 = Slider(34, range=0..100)
crosec_2 = CrossSectionKaramba3D(FamilyNameOfCrossSection="DefaultCroSec", Material=matselect_2, Height_cm=number_slider_2, mode="Shell - Const")

matselect_3 = MaterialSelectionKaramba3D(menu=[dropdown(7), dropdown(6)])
expression = Expression(x="80", y=number_slider_2, Expression="-(x/2-y/2)")
Z_2 = UnitZ(Factor=expression)
num = Number(panel)
crosec_3 = CrossSectionKaramba3D(
    FamilyNameOfCrossSection="DefaultCroSec",
    Material=matselect_3,
    LocalEccentricity_cm=Z_2,
    Height_cm="80",
    UpperFlangeWidth_cm=num,
    LowerFlangeWidth_cm=num,
    mode="Trapezoid")

# ---- group: Define Line to Beams
pline = PolyLine(Vertices=move_2.Geometry, Closed=False)
explode = Explode(Curve=pline, Recursive=True)  # -> Segments, Vertices
len = Length(Curve=explode.Segments)
division = Division(A=len, B=Slider(1, range=0..10))
divide = DivideCurve(Curve=explode.Segments, Count=division, Kinks=False)  # -> Points, Tangents, Parameters
pline_2 = PolyLine(Vertices=divide.Points, Closed=False)
linetobeam = LineToBeamKaramba3D(
    Line=pline_2,
    Identifier="beams",
    CrossSection=crosec_3,
    New=True,
    Remove=True,
    LimitDistance_m=0.005,
    Bending=True,
    SetBucklingLength=True,
    ToPolylineMaxAngle=0.03,
    ToPolylineTolerance=0.01,
    ToPolylineMaxEdgeLength=0.25)  # -> Element, Points, Info

# ---- group: Define Supports
supp = SupportKaramba3D(PosInd=sdivide.Points, menu=[buttons(on, on, on, on, on, on)])

# ---- group: Define Mesh to Shell
mesh_breps = MeshBrepsKaramba3D(
    Brep=move.Geometry,
    InclusionPoints=flatten([move_2.Geometry, divide.Points]),
    MeshResolution=1,
    EdgeRefinementFactor=0.67,
    PointReduction=False,
    SmoothingStepSize=0,
    SmoothingIterations=5)  # -> Mesh, Info
mtoshell = MeshToShellKaramba3D(Mesh=mesh_breps.Mesh, Identifier="roof", CrossSection=crosec_2, LimitDistance_m=0.005)  # -> Element, Points, Info

# ---- group: Define Loads
Z_3 = UnitZ(Factor="-3")
loads = LoadsKaramba3D(Vector=Z_3, Mesh=mesh_breps.Mesh, LCase="0", mode="MeshLoad -Const.", menu=[buttons(off, on, off), buttons(on, off)])

# ---- group: Define Lines for Columns
ln = Line(StartPoint=sdivide.Points, EndPoint=move_2.Geometry)
linetobeam_2 = LineToBeamKaramba3D(
    Line=ln,
    Identifier="columns",
    CrossSection=crosec,
    New=True,
    Remove=True,
    LimitDistance_m=0.005,
    Bending=True,
    SetBucklingLength=True,
    ToPolylineMaxAngle=0.03,
    ToPolylineTolerance=0.01,
    ToPolylineMaxEdgeLength=0.25)  # -> Element, Points, Info

# ---- group: Assemble Model
assemble = AssembleModelKaramba3D(
    Elem=flatten([mtoshell.Element, linetobeam_2.Element, linetobeam.Element]),
    Support=flatten(supp),
    Load=loads,
    LimitDistance_m=0.005)  # -> Model, Info, Mass_kg, CentreOfGravity, LoadCaseNames
panel_2 = Panel(assemble.Mass_kg)

# ---- group: Analyze Model
analyze = AnalyzeKaramba3D(Model=assemble.Model)  # -> CalculatedModel, MaximumDisplacement_cm, ResultingForceOfGravity_kN, ElasticEnergyChange_kNm
panel_3 = Panel(analyze.MaximumDisplacement_cm)

# ---- group: View Results
modelview = ModelViewKaramba3D(Model=analyze.CalculatedModel, ResultFactors=1, ResultCase=-1)  # -> Model, DeformedMesh, DeformedAxes, DeformedModel
beamview = BeamViewKaramba3D(Model=modelview.Model)  # -> Model, MeshesOfRenderedBeams, DeformedBeamAxes, LegendColours, LegendTags
shellview = ShellViewKaramba3D(Model=modelview.Model, IndexOfLayer=0)  # -> Model, MeshesOfRenderedShells, LegendColours, LegendTags
legend = Legend(Colour=beamview.LegendColours, Tags=beamview.LegendTags, LegendType=1)
legend_2 = Legend(Colour=shellview.LegendColours, Tags=shellview.LegendTags, LegendType=1)

# ----
reactview = ReactionViewKaramba3D(Model=beamview.Model)  # -> Model, LegendColours, LegendTags
extosaf = ExportModelToSAFKaramba3D(
    Model=reactview.Model,
    Filepath="C:\Users\globe\Desktop\Karamba3DModel.xlsx",
    ExportNow=Toggle(False),
    OrientationGlobalCS=0,
    OrientationLocalCS=0,
    Discipline="Load-bearing structure",
    BuildingCodeIndex=0,
    LengthSegment_m=-1,
    MaximumFacesMesh=2000,
    SAFVersion="2.3.0",
    CrossSectionNameConversion="CrossSectionNameAliases.csv")  # -> Model, Info
panel_4 = Panel(extosaf.Info)
