# Grasshopper definition 47_Debugging_Supports.gh (Grasshopper 1.0.8)
# plug-ins: Karamba3D, Bifocals

truss_depth = Slider(1, range=0.1..2)
distance = Slider(6.5, range=0..10)
number_of_trusses = Slider(3, range=0..30)
list = ValueList({"Pratt Truss": 1, "Warren Truss": 2, "Warren Truss with verticals": 3, "K-Truss": 4, "Diamond": 5, "Diamond Straight": 6, "Vierendeel Truss": 7}, selected="Warren Truss with verticals")
truss_subdivisions = Slider(11, range=0..20)
Z = UnitZ(Factor=truss_depth)
crv = Curve(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)
series = Series(Start=0, Step=distance, Count=number_of_trusses)
extr = Extrude(Base=crv, Direction=Z)
X = UnitX(Factor=series)
series_2 = Series(Start=0, Step=1, Count=truss_subdivisions)
crosecrselect = CrossSectionRangeSelectorKaramba3D(MaximumHeight_cm=-1, MaximumWidth_cm=-1, menu=[dropdown(1), dropdown(0), dropdown(0)])
crosecrselect_2 = CrossSectionRangeSelectorKaramba3D(MaximumHeight_cm=-1, MaximumWidth_cm=-1, menu=[dropdown(1), dropdown(0), dropdown(0)])
panel = Panel("""	CHS 88.9x3.2
	CHS 88.9x3.2
CHS 48.3x3.2
CHS 48.3x3.2
CHS 48.3x3.2""")
expression = Expression(n=truss_subdivisions, k=series_2, Expression="(k + 1) * ((2*n) + 1) - 1")
move = Move(Geometry=extr, Motion=X)  # -> Geometry, Transform
expression_2 = Expression(n=truss_subdivisions, k=series_2, Expression="k * ((2*n) + 1)")
panel_2 = Panel("""	CHS 88.9x3.2
HEB200""")
expression_3 = Expression(n=truss_subdivisions, Expression="(n*2)+1")
surf2truss = SurfaceToTrussKaramba3D(
    Surface=reparameterize(move.Geometry),
    TrussType=list,
    NumberOfSubdivisions=truss_subdivisions,
    FlipUDirection=False,
    FlipVDirection=False,
    SwapUVDirections=Toggle(True),
    RelaxAngles=False,
    TargetPostDirection=Vector(0, 0, 0),
    MaximumRelaxationIterations=30,
    LengthTolerance=0.0001,
    DampingFactor=0.8)  # -> Info, simplify(Lines), YOrientations, ZOrientations, SpecificEnergy
crosecselect = CrossSectionSelectorKaramba3D(CrossSections=crosecrselect_2, NameOrListIndexOfCrossSection=panel)  # -> CrossSection, Info
crosecselect_2 = CrossSectionSelectorKaramba3D(CrossSections=crosecrselect, NameOrListIndexOfCrossSection=graft(panel_2))  # -> CrossSection, Info
bang = ExplodeTree(Data=surf2truss.Lines)  # -> Branch0, Branch1, Branch2, Branch3, Branch4
divide = DivideCurve(Curve=bang.Branch1, Count="2", Kinks=False)  # -> Points, Tangents, flatten(Parameters)
shatter = Shatter(Curve=bang.Branch1, Parameters=divide.Parameters)  # -> flatten(Segments)
entwine = Entwine(
    Branch00=bang.Branch0,
    Branch01=shatter,
    Branch02=bang.Branch2,
    Branch03=bang.Branch3,
    Branch04=bang.Branch4,
    FlattenInputs=True)
panel_3 = Panel("""left_diagonals
right_diagonals
vertical_struts""")
panel_4 = Panel("""columns
beams""")
panel_5 = Panel("""top_chord
bottom_chord
left_diagonals
right_diagonals
vertical_struts""")
beam_joints = BeamJointsKaramba3D(
    BeamIdentifier=panel_3,
    CtKNMAtStartingNode=Vector(0, 0, 0),
    CrKNmRadAtStartingNode=Vector(0, 0, 0),
    CtKNMAtEndNode=Vector(0, 0, 0),
    CrKNmRadAtEndNode=Vector(0, 0, 0),
    menu=[buttons(off, off, off, off, on, off), buttons(off, off, off, off, on, off)])

# ---- group: Loads (Karamba3D)
loads = LoadsKaramba3D(Vector=Vector(0, 0, -1), LCase="LC0", mode="Gravity")

# ----
lineelem = CreateLinearElementKaramba3D(
    Line=entwine,
    Identifier=panel_5,
    CrossSection=crosecselect.CrossSection,
    LimitDistance_m=0.005,
    BucklingLengthY_m=-1,
    BucklingLengthZ_m=-1,
    BucklingLengthLT_m=-1,
    Bending=True,
    ToPolylineMaxAngle=0.25,
    ToPolylineTolerance=0.1,
    ToPolylineMaxEdgeLength=0.25,
    New=True,
    Remove=True,
    mode="LineToBeam")  # -> Element, Points, Info
pt = Point(lineelem.Points)
bang_2 = ExplodeTree(Data=simplify(pt))  # -> Branch0, Branch1
partition = PartitionList(List=bang_2.Branch0, Size=expression_3)
item = ListItem(List=bang_2.Branch1, Index=[expression_2, expression], Wrap=True)
partition_2 = PartitionList(List=item, Size=truss_subdivisions)
flip = FlipMatrix(Data=partition)
move_2 = Move(Geometry=item, Motion=expr("-x", "0,0,7"))  # -> Geometry, Transform
rdpoints = RemoveDuplicatePointsKaramba3D(Point=partition_2, LimitDistance=0.005)  # -> OutPoint, Info, Indexes
pline = PolyLine(Vertices=flip, Closed=False)
pline_2 = PolyLine(Vertices=rdpoints.OutPoint, Closed=False)
explode = Explode(Curve=pline, Recursive=True)  # -> flatten(Segments), Vertices
explode_2 = Explode(Curve=pline_2, Recursive=True)  # -> flatten(Segments), Vertices
ln = Line(StartPoint=item, EndPoint=move_2.Geometry)
rdlines = RemoveDuplicateLinesKaramba3D(Line=ln, LimitDistance=0.005)  # -> OutLine, Info, Indexes
beams = Merge(Data1=explode.Segments, Data2=explode_2.Segments)
end = EndPoints(Curve=ln)  # -> Start, End
rdpoints_2 = RemoveDuplicatePointsKaramba3D(Point=end.End, LimitDistance=0.005)  # -> OutPoint, Info, Indexes
supp = SupportKaramba3D(
    PosInd=rdpoints_2.OutPoint,
    Ct_kN_m=Vector(0, 0, 0),
    Cr_kNm_rad=Vector(0, 0, 0),
    menu=[buttons(on, on, on, off, off, off)])
lineelem_2 = CreateLinearElementKaramba3D(
    Line=[beams, rdlines.OutLine],
    Identifier=graft(panel_4),
    CrossSection=crosecselect_2.CrossSection,
    LimitDistance_m=0.005,
    BucklingLengthY_m=-1,
    BucklingLengthZ_m=-1,
    BucklingLengthLT_m=-1,
    Bending=True,
    ToPolylineMaxAngle=0.25,
    ToPolylineTolerance=0.1,
    ToPolylineMaxEdgeLength=0.25,
    New=True,
    Remove=True,
    mode="LineToBeam")  # -> Element, Points, Info

# ---- group: Assemble Model (Karamba3D)
assemble = AssembleModelKaramba3D(Elem=flatten([lineelem.Element, lineelem_2.Element]), Support=supp, Load=loads, Joint=beam_joints, LimitDistance_m=0.005)  # -> Model, Info, Mass_kg, CentreOfGravity, LoadCaseNames

# ---- group: Analyse (Karamba3D)
analyse = AnalyseKaramba3D(Model=assemble.Model)  # -> AnalysedModel, MaximumDisplacement_cm, ResultingForce_kN, ChangeOfElasticEnergy_kNm

# ---- group: Model View (Karamba3D)
modelview = ModelViewKaramba3D(Model=analyse.AnalysedModel)  # -> Model, DeformedMesh, DeformedAxes, DeformedModel, MaximumDeformation

# ---- group: Beam View (Karamba3D)
beamview = BeamViewKaramba3D(Model=modelview.Model)  # -> Model, MeshesOfRenderedBeams, DeformedBeamAxes, LegendColours, LegendTags

# ----
legend = Legend(Colour=beamview.LegendColours, Tags=beamview.LegendTags, LegendType=1)
