# Grasshopper definition 49_LineLine_Intersection.gh (Grasshopper 1.0.8)
# plug-ins: Karamba3D, Bifocals

pt = Point([Point(26.10556184, 11, -10.35501374), Point(24, 0, 8.511451987), Point(23.46499846, -9, 0), Point(8, 11, 0), Point(5, 0, -6.027945374), Point(6, -9, 0), Point(-7, 11, 16.04462981), Point(-7, -2, 0), Point(-6, -9, 9.683464456)])
srfgrid = SurfaceFromPoints(Points=pt, UCount="3", Interpolate=False)
bbox = BoundingBox(Content=srfgrid, Plane=PlaneXY(0, 0, 0))  # -> Box, Box_2
debrep = DeconstructBrep(Brep=bbox.Box)  # -> Faces, Edges, Vertices
item = ListItem(List=debrep.Faces, Index="4", Wrap=True)
sdivide = DivideSurface(Surface=item, UCount=10, VCount=10)  # -> Points, Normals, Parameters
flip = FlipMatrix(Data=sdivide.Points)
pline = PolyLine(Vertices=sdivide.Points, Closed=False)
pline_2 = PolyLine(Vertices=flip, Closed=False)
Z = UnitZ(Factor=40)
extr = Extrude(Base=pline, Direction=Z)  # -> flatten(Extrusion)
extr_2 = Extrude(Base=pline_2, Direction=Z)  # -> flatten(Extrusion)
splitmul = SplitBrepMultiple(Brep=srfgrid, Cutters=extr)
splitmul_2 = SplitBrepMultiple(Brep=srfgrid, Cutters=extr_2)
debrep_2 = DeconstructBrep(Brep=splitmul)  # -> Faces, flatten(Edges), Vertices
debrep_3 = DeconstructBrep(Brep=splitmul_2)  # -> Faces, flatten(Edges), Vertices
len = Length(Curve=debrep_2.Edges)
len_2 = Length(Curve=debrep_3.Edges)
smaller = SmallerThan(FirstNumber=len, SecondNumber="5")  # -> SmallerThan, OrEqualTo
smaller_2 = SmallerThan(FirstNumber=len_2, SecondNumber="5")  # -> SmallerThan, OrEqualTo
dispatch = Dispatch(List=debrep_2.Edges, DispatchPattern=smaller.SmallerThan)  # -> ListA, ListB
dispatch_2 = Dispatch(List=debrep_3.Edges, DispatchPattern=smaller_2.SmallerThan)  # -> ListA, ListB
crv = Curve(dispatch_2.ListB)
crv_2 = Curve(dispatch.ListB)
divide = DivideCurve(Curve=crv_2, Count=10, Kinks=False)  # -> Points, Tangents, Parameters
divide_2 = DivideCurve(Curve=crv, Count=10, Kinks=False)  # -> Points, Tangents, Parameters
pline_3 = PolyLine(Vertices=divide.Points, Closed=False)
pline_4 = PolyLine(Vertices=divide_2.Points, Closed=False)
explode = Explode(Curve=pline_3, Recursive=True)  # -> Segments, Vertices
explode_2 = Explode(Curve=pline_4, Recursive=True)  # -> Segments, Vertices
line = Line(flatten(explode_2.Segments))
line_2 = Line(flatten(explode.Segments))
llinter = LineLineIntersectionKaramba3D(IntersectingLines=line_2, LinesToIntersect=line, LimitDistance_m=Slider(0.367, range=0.005..1))  # -> InterSecPoints, LineSubSegments

pt_2 = Point([Point(26.10556184, 11, -10.35501374), Point(24, 0, 8.511451987), Point(23.46499846, -9, 0), Point(8, 11, 0), Point(5, 0, -6.027945374), Point(6, -9, 0), Point(-7, 11, 16.04462981), Point(-7, -2, 0), Point(-6, -9, 9.683464456)])
srfgrid_2 = SurfaceFromPoints(Points=pt_2, UCount="3", Interpolate=False)
bbox_2 = BoundingBox(Content=srfgrid_2, Plane=PlaneXY(0, 0, 0))  # -> Box, Box_2
debrep_4 = DeconstructBrep(Brep=bbox_2.Box)  # -> Faces, Edges, Vertices
item_2 = ListItem(List=debrep_4.Faces, Index="4", Wrap=True)
sdivide_2 = DivideSurface(Surface=item_2, UCount=10, VCount=10)  # -> Points, Normals, Parameters
flip_2 = FlipMatrix(Data=sdivide_2.Points)
pline_5 = PolyLine(Vertices=sdivide_2.Points, Closed=False)
pline_6 = PolyLine(Vertices=flip_2, Closed=False)
Z_2 = UnitZ(Factor=40)
extr_3 = Extrude(Base=pline_5, Direction=Z_2)  # -> flatten(Extrusion)
extr_4 = Extrude(Base=pline_6, Direction=Z_2)  # -> flatten(Extrusion)
splitmul_3 = SplitBrepMultiple(Brep=srfgrid_2, Cutters=extr_3)
splitmul_4 = SplitBrepMultiple(Brep=srfgrid_2, Cutters=extr_4)
debrep_5 = DeconstructBrep(Brep=splitmul_3)  # -> Faces, flatten(Edges), Vertices
debrep_6 = DeconstructBrep(Brep=splitmul_4)  # -> Faces, flatten(Edges), Vertices
len_3 = Length(Curve=debrep_5.Edges)
len_4 = Length(Curve=debrep_6.Edges)
smaller_3 = SmallerThan(FirstNumber=len_3, SecondNumber="5")  # -> SmallerThan, OrEqualTo
smaller_4 = SmallerThan(FirstNumber=len_4, SecondNumber="5")  # -> SmallerThan, OrEqualTo
dispatch_3 = Dispatch(List=debrep_5.Edges, DispatchPattern=smaller_3.SmallerThan)  # -> ListA, ListB
dispatch_4 = Dispatch(List=debrep_6.Edges, DispatchPattern=smaller_4.SmallerThan)  # -> ListA, ListB
crv_3 = Curve(dispatch_4.ListB)
crv_4 = Curve(dispatch_3.ListB)
ccx = CurveCurve(CurveA=graft(crv_4), CurveB=flatten(crv_3))  # -> Points, ParamsA, ParamsB
trim = TrimTree(Tree=ccx.ParamsA, Depth=1)
shatter = Shatter(Curve=crv_4, Parameters=trim)
item_3 = ListItem(List=flatten(shatter), Index=Slider(5, range=0..15), Wrap=True)

number_slider = Slider(10, range=0..100)
pt_3 = Point([Point(-47.12890954, 6.503872539, 0), Point(-49.97887729, 3.337526796, 0), Point(-48.00663791, 0.4278873213, 0), Point(-40.47020632, -0.7678549287, 0), Point(-34.4158345, 2.659939521, 0), Point(-37.77486201, 12.68811635, 0)])
nurbs = NurbsCurve(Vertices=pt_3, Degree=3, Periodic=True)  # -> Curve, Length, Domain
series = Series(Start=0, Step=Slider(3, range=0..10), Count=number_slider)
crv_5 = Curve(nurbs.Curve)
Z_3 = UnitZ(Factor=series)
move = Move(Geometry=crv_5, Motion=Z_3)  # -> Geometry, Transform
area = Area(Geometry=move.Geometry)  # -> Area, Centroid
series_2 = Series(Start=0, Step=Slider(8, range=0..10), Count=number_slider)
rotate = Rotate(Geometry=move.Geometry, Angle=degrees(series_2), Plane=area.Centroid)  # -> Geometry, Transform
cull_i = CullIndex(List=rotate.Geometry, Indices=Slider(0, range=0..6), Wrap=True)
divide_3 = DivideCurve(Curve=cull_i, Count=Slider(35, range=0..45), Kinks=False)  # -> Points, Tangents, Parameters
divide_4 = DivideCurve(Curve=rotate.Geometry, Count=10, Kinks=False)  # -> Points, Tangents, Parameters
flip_3 = FlipMatrix(Data=divide_4.Points)
pline_7 = PolyLine(Vertices=divide_3.Points, Closed=True)
pline_8 = PolyLine(Vertices=flip_3, Closed=False)
explode_3 = Explode(Curve=pline_7, Recursive=True)  # -> Segments, Vertices
explode_4 = Explode(Curve=pline_8, Recursive=True)  # -> Segments, Vertices
llinter_2 = LineLineIntersectionKaramba3D(
    IntersectingLines=flatten(explode_3.Segments),
    LinesToIntersect=flatten(explode_4.Segments),
    LimitDistance_m=Slider(0.1, range=0..0.1))  # -> InterSecPoints, LineSubSegments
pt_4 = Point(llinter_2.InterSecPoints)
line_3 = Line(llinter_2.LineSubSegments)
