# Grasshopper definition 50_Tutorial_Introduction to Beams - 2D Warehouse Frame.gh (Grasshopper 1.0.8)
# plug-ins: Karamba3D, Bifocals

pitch_height = Slider(2, range=1..5)

# ---- group: Create Geometry
X = UnitX(Factor=1)
width = Slider(5, range=2..20)
height = Slider(5, range=2..10)
line = LineSDL(Start="0,0,0", Direction=X, Length=width)
addition = Addition(A=height, B=pitch_height)
# 01 - 2D Warehouse Frame
# Difficulty: Simple | Version 3.1.4
# In this example a simple 2d warehouse frame is calculated. The Cross Section Selector can be used to define standard Cross Sections.
# The Beam Joint Agent, can be used to define joints between specific elements
end = EndPoints(Curve=line)  # -> Start, End
Z = UnitZ(Factor=height)
avr = Average(Input=[end.Start, end.End])
Z_2 = UnitZ(Factor=addition)
move = Move(Geometry=end.Start, Motion=Z)  # -> Geometry, Transform
move_2 = Move(Geometry=avr, Motion=Z_2)  # -> Geometry, Transform
move_3 = Move(Geometry=end.End, Motion=Z)  # -> Geometry, Transform
merge = Merge(Data1=end.Start, Data2=move.Geometry, Data3=move_2.Geometry, Data4=move_3.Geometry, Data5=end.End)
pline = PolyLine(Vertices=merge, Closed=False)
explode = Explode(Curve=pline, Recursive=True)  # -> Segments, Vertices

# ---- group: Define Supports
pt = Point(end.Start)
pt_2 = Point(end.End)
supp = SupportKaramba3D(PosInd=pt, menu=[buttons(on, on, on, on, on, off)])
supp_2 = SupportKaramba3D(PosInd=pt_2, menu=[buttons(on, on, on, off, on, off)])
merge_2 = Merge(Data1=supp, Data2=supp_2)
support = SupportKaramba3D(flatten(merge_2))

# ---- group: Define Materials
matselect = MaterialSelectionKaramba3D(menu=[dropdown(1), dropdown(1), dropdown(2)])

# ---- group: Define Joints
joint_agent = BeamJointAgentKaramba3D(
    BeamIdentifier="B",
    ToElementIdentifiers="A",
    Ct_kN_m=Vector(0, 0, 0),
    Cr_kNm_rad=Vector(0, 0, 0),
    menu=[buttons(off, off, off, off, on, off)])  # disabled
joint_agent_2 = BeamJointAgentKaramba3D(
    BeamIdentifier="B",
    ToElementIdentifiers="C",
    Ct_kN_m=Vector(0, 0, 0),
    Cr_kNm_rad=Vector(0, 0, 0),
    menu=[buttons(off, off, on, off, off, off)])  # disabled
merge_3 = Merge(Data1=joint_agent, Data2=joint_agent_2)
joint = JointKaramba3D(flatten(merge_3))

# ---- group: Define Cross Sections
crosecselect = CrossSectionSelectorKaramba3D(NameOrListIndexOfCrossSection="HEA200", Material=matselect)  # -> flatten(CrossSection), Info

# ---- group: Define Elements
panel = Panel("""A
B
C
D""")
lineelem = CreateLinearElementKaramba3D(
    Line=explode.Segments,
    Identifier=panel,
    CrossSection=crosecselect.CrossSection,
    LimitDistance_m=0.005,
    BucklingLengthY_m=-1,
    BucklingLengthZ_m=-1,
    BucklingLengthLT_m=-1,
    Bending=True,
    ToPolylineMaxAngle=0.03,
    ToPolylineTolerance=0.01,
    ToPolylineMaxEdgeLength=0.25,
    New=True,
    Remove=True,
    mode="LineToBeam")  # -> Element, Points, Info

# ---- group: Define Loads
neg = Negative(Value=Slider(10, range=1..20))
panel_2 = Panel("""B
C""")
X_2 = UnitX(Factor=Slider(1.6, range=1..5))
panel_3 = Panel("""A
B""")
panel_4 = Panel("Gravity")
Z_3 = UnitZ(Factor=neg)
beam_loads = BeamLoadsKaramba3D(BeamIdentifier=panel_2, LoadCase="Roof", ForceVector=Z_3, TStart=0, TEnd=1, mode="Block", menu=[buttons(on, off, off)])
beam_loads_2 = BeamLoadsKaramba3D(BeamIdentifier=panel_3, LoadCase="Wind", ForceVector=X_2, TStart=0, TEnd=1, mode="Block", menu=[buttons(off, on, off)])
lccombinator = LoadCaseCombinatorKaramba3D(LoadCaseCombinationRulesKaramba3D="ULS = 1.35 * (Gravity + Roof) + Wind")  # -> LoadCaseCombinations, NamesOfLoadCases, NumberOfLoadCases

# ---- group: Define Loads / Loads (Karamba3D)
loads = LoadsKaramba3D(Vector=Vector(0, 0, -1), LCase=panel_4, mode="Gravity")

# ---- group: Define Loads (continued)
merge_4 = Merge(Data1=loads, Data2=beam_loads, Data3=beam_loads_2, Data4=lccombinator.LoadCaseCombinations)
load = LoadKaramba3D(flatten(merge_4))

# ---- group: Assemble Model (Karamba3D)
assemble = AssembleModelKaramba3D(Elem=lineelem.Element, Support=support, Load=load, Joint=joint, LimitDistance_m=0.005)  # -> Model, Info, Mass_kg, CentreOfGravity, LoadCaseNames

# ---- group: Assemble Model
panel_5 = Panel(assemble.Mass_kg)

# ---- group: Analyze Model / Analyse (Karamba3D)
analyse_analyze = AnalyseKaramba3D(Model=assemble.Model)  # -> AnalysedModel, MaximumDisplacement_cm, ResultingForce_kN, ChangeOfElasticEnergy_kNm

# ---- group: Analyze Model
panel_6 = Panel(analyse_analyze.MaximumDisplacement_cm)

# ---- group: View Results / Model View (Karamba3D)
modelview = ModelViewKaramba3D(Model=analyse_analyze.AnalysedModel)  # -> Model, DeformedMesh, DeformedAxes, DeformedModel, MaximumDeformation

# ---- group: View Results / Beam View (Karamba3D)
beamview = BeamViewKaramba3D(Model=modelview.Model)  # -> Model, MeshesOfRenderedBeams, DeformedBeamAxes, LegendColours, LegendTags

# ---- group: View Results
legend = Legend(Colour=beamview.LegendColours, Tags=beamview.LegendTags, LegendType=1)
