# Grasshopper definition 52_Tutorial_Introduction to Shells - Curved Plate.gh (Grasshopper 1.0.8)
# plug-ins: Karamba3D, Bifocals

number_slider = Slider(2, range=0..10)

# ---- group: Material Selection (Karamba3D)
matselect = MaterialSelectionKaramba3D(menu=[dropdown(0), dropdown(1), dropdown(2)])

# ---- group: Define Cross Sections
crosec = CrossSectionKaramba3D(FamilyNameOfCrossSection="DefaultCroSec", Material=matselect, Height_cm=Slider(1, range=1..50), mode="Shell - Const")

# ---- group: Create Geometry
number_slider_2 = Slider(1.1, range=0..5)
pt = Point(["0,0,0", "10,0,0"])
avr = Average(Input=pt)
Z = UnitZ(Factor=number_slider_2)
move = Move(Geometry=avr, Motion=Z)  # -> Geometry, Transform
# 01 - 2D Shell
# Difficulty: Simple | Version 3.1.4
# In this example a simple plate is calculated. A slider controls the Z position at the centre of the plate allow setting the curvature of the plate which is then analysed.
merge = Merge(Data1="0,0,0", Data2=move.Geometry, Data3="10,0,0")
intcrv = Interpolate(Vertices=merge, Degree=3, Periodic=False, KnotStyle=1)  # -> Curve, Length, Domain
Y = UnitY(Factor=number_slider)
line = LineSDL(Start="0,0,0", Direction=Y, Length=number_slider)
extr = Extrude(Base=intcrv.Curve, Direction=Y)
number_slider_3 = Slider(0.3, range=0.1..3)
debrep = DeconstructBrep(Brep=extr)  # -> Faces, Edges, Vertices

# ----
Z_2 = UnitZ(Factor=expr("x+0.1", number_slider_2))

# ---- group: Create Geometry (continued)
extr_2 = Extrude(Base=line, Direction=Z_2)
mesh_uv = MeshSurface(Surface=extr_2, UCount=5, VCount=5, Overhang=True, Equalize=False)

# ---- group: Create Geometry / Mesh Breps (Karamba3D)
mesh_breps = MeshBrepsKaramba3D(
    Brep=extr,
    MeshResolution=number_slider_3,
    EdgeRefinementFactor=0.67,
    PointReduction=False,
    SmoothingStepSize=0,
    SmoothingIterations=5)  # -> Mesh, Info

# ---- group: Define Supports
pt_2 = Point(debrep.Vertices)
split = SplitList(List=pt_2, Index="2")  # -> ListA, ListB
pt_3 = Point(split.ListB)
pt_4 = Point(split.ListA)
supp = SupportKaramba3D(PosInd=pt_4, menu=[buttons(on, on, on, on, on, off)])
supp_2 = SupportKaramba3D(PosInd=pt_3, menu=[buttons(on, on, on, off, off, off)])
merge_2 = Merge(Data1=supp, Data2=supp_2)
support = SupportKaramba3D(flatten(merge_2))

# ---- group: Define Elements
surfelem = CreateSurfaceElementKaramba3D(Mesh=mesh_breps.Mesh, Identifier="ShellA", CrossSection=crosec, LimitDistance_m=0.005, Bending=True, mode="MeshToShell")  # -> Element, Points, Info

# ---- group: Define Loads
neg = Negative(Value=Slider(1, range=0.1..1.1))
panel = Panel("Roof")
panel_2 = Panel("Wind")
Z_3 = UnitZ(Factor=neg)
panel_3 = Panel("Gravity")
X = UnitX(Factor=Slider(1.6, range=0.2..2))
mesh = Mesh(mesh_breps.Mesh)
mesh_2 = Mesh(mesh_uv)

# ---- group: Define Loads / Loads (Karamba3D)
loads = LoadsKaramba3D(Vector=Vector(0, 0, -1), LCase=panel_3, mode="Gravity")

loads_2 = LoadsKaramba3D(Vector=Z_3, Mesh=mesh, LCase=panel, mode="MeshLoad -Const.", menu=[buttons(off, on, off), buttons(on, on)])

loads_3 = LoadsKaramba3D(Vector=X, Mesh=mesh_2, LCase=panel_2, mode="MeshLoad -Const.", menu=[buttons(off, on, off), buttons(on, on)])

# ---- group: Define Loads (continued)
merge_3 = Merge(Data1=loads, Data2=loads_2, Data3=loads_3)
load = LoadKaramba3D(flatten(merge_3))

# ---- group: Assemble Model (Karamba3D)
assemble = AssembleModelKaramba3D(Elem=surfelem.Element, Support=support, Load=load, LimitDistance_m=0.005)  # -> Model, Info, Mass_kg, CentreOfGravity, LoadCaseNames

# ---- group: Assemble Model
panel_4 = Panel(assemble.Mass_kg)

# ---- group: Analyze Model / Analyse (Karamba3D)
analyse_analyze = AnalyseKaramba3D(Model=assemble.Model)  # -> AnalysedModel, MaximumDisplacement_cm, ResultingForce_kN, ChangeOfElasticEnergy_kNm

# ---- group: Analyze Model
panel_5 = Panel(analyse_analyze.MaximumDisplacement_cm)

# ---- group: View Results / Model View (Karamba3D)
modelview = ModelViewKaramba3D(Model=analyse_analyze.AnalysedModel)  # -> Model, DeformedMesh, DeformedAxes, DeformedModel, MaximumDeformation

# ---- group: Shell View (Karamba3D)
shellview = ShellViewKaramba3D(Model=modelview.Model, IndexOfLayer=0)  # -> Model, MeshesOfRenderedShells, LegendColours, LegendTags

# ---- group: View Results
legend = Legend(Colour=shellview.LegendColours, Tags=shellview.LegendTags, LegendType=1)

# ----
legend_2 = LegendKaramba3d(
    Colors=shellview.LegendColours,
    Tags=shellview.LegendTags,
    Legend_HasHeader=False,
    Legend_Justification=2,
    Legend_Position=2)
