# Grasshopper definition EigenMode_Connectivity.gh (Grasshopper 1.0.7)
# plug-ins: Karamba3D

# ---- group: Single Column
crv = Curve(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)

# ---- group: V Column
crv_2 = Curve([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])

# ---- group: Surfaces
connected_surface = Surface([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])

# ----
matselect = MaterialSelectionKaramba3D(menu=[dropdown(7), dropdown(6)])
matselect_2 = MaterialSelectionKaramba3D(menu=[dropdown(7), dropdown(6)])
pt = Point("0,0,0")
item = ListItem(List=connected_surface, Index=0, Wrap=True)  # -> Item2, Item1, Item
planesrf = PlaneSurface(Plane=pt, XSize="10", YSize="15")
Z = UnitZ(Factor=Slider(5, range=0..10))
relay = Relay([crv, crv_2])
mesh_breps = MeshBrepsKaramba3D(
    Brep=item.Item,
    MeshResolution="1",
    EdgeRefinementFactor=0.67,
    PointReduction=False,
    SmoothingStepSize=0,
    SmoothingIterations=5)  # -> Mesh, Info
move = Move(Geometry=planesrf, Motion=Z)  # -> Geometry, Transform
crosec = CrossSectionKaramba3D(FamilyNameOfCrossSection="DefaultCroSec", Material=matselect, Height_cm=Slider(20, range=0..100), mode="Shell - Const")
crosec_2 = CrossSectionKaramba3D(
    FamilyNameOfCrossSection="DefaultCroSec",
    Material=matselect_2,
    Height_cm="20",
    UpperFlangeWidth_cm="20",
    LowerFlangeWidth_cm="20",
    mode="Trapezoid")
merge = Merge(Data1=move.Geometry, Data2=item.Item2, Data3=item.Item1)
end = EndPoints(Curve=crv)  # -> Start, End
mesh_breps_2 = MeshBrepsKaramba3D(
    Brep=merge,
    InclusionPoints=flatten(end.Start),
    MeshResolution="1",
    EdgeRefinementFactor=0.67,
    PointReduction=False,
    SmoothingStepSize=0,
    SmoothingIterations=5)  # -> Mesh, Info
entwine = Entwine(Branch00=mesh_breps_2.Mesh, Branch01=mesh_breps.Mesh, FlattenInputs=True)
Z_2 = UnitZ(Factor=Slider(2, range=0..10))
loads = LoadsKaramba3D(
    Vector=expr("-x", Z_2),
    Mesh=mesh_breps_2.Mesh,
    LCase="LC1",
    mode="MeshLoad -Const.",
    menu=[buttons(on, off, off), buttons(on, on)])
loads_2 = LoadsKaramba3D(Vector=Vector(0, 0, -1), LCase="LC0", mode="Gravity")
lineelem = CreateLinearElementKaramba3D(
    Line=flatten(relay),
    CrossSection=crosec_2,
    LimitDistance_m=0.005,
    BucklingLengthY_m=-1,
    BucklingLengthZ_m=-1,
    BucklingLengthLT_m=-1,
    Bending=True,
    ToPolylineMaxAngle=0.03,
    ToPolylineTolerance=0.01,
    ToPolylineMaxEdgeLength=0.25,
    New=True,
    Remove=True,
    mode="LineToBeam")  # -> Element, Points, Info
surfelem = CreateSurfaceElementKaramba3D(Mesh=flatten(entwine), LimitDistance_m=0.005, Bending=True, mode="MeshToShell")  # -> Element, Points, Info
pt_2 = Point(flatten([surfelem.Points, lineelem.Points]))
pdecon = Deconstruct(Point=pt_2)  # -> XComponent, YComponent, ZComponent
smaller = SmallerThan(FirstNumber=pdecon.ZComponent, SecondNumber="0.001")  # -> SmallerThan, OrEqualTo
cull = CullPattern(List=pt_2, CullPattern=smaller.SmallerThan)
supp = SupportKaramba3D(PosInd=cull, menu=[buttons(on, on, on, off, off, off)])
relay_2 = Relay([loads, loads_2])
assemble = AssembleModelKaramba3D(
    Elem=flatten([surfelem.Element, lineelem.Element]),
    Support=supp,
    Load=flatten(relay_2),
    LimitDistance_m=0.005,
    CrossSection=crosec)  # -> Model, Info, Mass_kg, CentreOfGravity, LoadCaseNames
conparts = ConnectedPartsKaramba3D(Model=assemble.Model)  # -> simplify(ConnectedLines), simplify(ConnectedMeshes)
analyse = AnalyseKaramba3D(Model=assemble.Model)  # -> AnalysedModel, MaximumDisplacement_cm, ResultingForce_kN, ChangeOfElasticEnergy_kNm
viewer = ParamViewer(conparts.ConnectedLines)
viewer_2 = ParamViewer(conparts.ConnectedMeshes)

# ---- group: EigenModes
emodes = EigenModesKaramba3D(
    Model=analyse.AnalysedModel,
    FromIndex=Slider(1, range=0..1),
    NumberOfModes=Slider(3, range=0..5),
    WithThIIEffects=True,
    MaximumNumberOfIterations=300,
    Epsilon=1e-07)  # -> ModelWithEigenModes, Eigenvalues

# ----
concat = Concatenate(FragmentA="EigenModes/", FragmentB=Slider(0, range=0..50))
branch = TreeBranch(Tree=[conparts.ConnectedLines, conparts.ConnectedMeshes], Path=Slider(2, range=0..2), MaintainPaths=True)
modelview = ModelViewKaramba3D(Model=emodes.ModelWithEigenModes, LoadCase=concat)  # -> Model, DeformedMesh, DeformedAxes, DeformedModel, MaximumDeformation
shellview = ShellViewKaramba3D(Model=modelview.Model, IndexOfLayer=0)  # -> Model, MeshesOfRenderedShells, LegendColours, LegendTags
beamview = BeamViewKaramba3D(Model=modelview.Model)  # -> Model, MeshesOfRenderedBeams, DeformedBeamAxes, LegendColours, LegendTags
