# Grasshopper definition ModelView_Shells_And_Beams_Visibility_Options.gh (Grasshopper 1.0.7)
# plug-ins: Karamba3D

# ---- group: Generate Geometry for Beams and Shell
number_slider = Slider(4, range=0..10)
unit_z = UnitZ(Factor="4")
plane_surface = PlaneSurface(Plane=PlaneXY(0, 0, 0), XSize="20", YSize="20")
dom = ConstructDomain(DomainStart=0, DomainEnd="20")
divide_surface = DivideSurface(Surface=plane_surface, UCount=number_slider, VCount=number_slider)  # -> Points, Normals, Parameters
range = Range(Domain=dom, Steps=number_slider)
# 05 - Shells and Beams
# Difficulty: Moderate | Version 3.1.4
# Combination of beam and shell elements in Karamba3D.
move = Move(Geometry=plane_surface, Motion=unit_z)  # -> Geometry, Transform
move_2 = Move(Geometry=divide_surface.Points, Motion=unit_z)  # -> Geometry, Transform

# ---- group: Set Cross Section
matselect = MaterialSelectionKaramba3D(menu=[dropdown(7), dropdown(6)])
panel = Panel("50")
crosec = CrossSectionKaramba3D(
    FamilyNameOfCrossSection="DefaultCroSec",
    Material=matselect,
    Height_cm=panel,
    UpperFlangeWidth_cm=panel,
    LowerFlangeWidth_cm=panel,
    mode="Trapezoid")

number_slider_2 = Slider(34, range=0..100)
matselect_2 = MaterialSelectionKaramba3D(menu=[dropdown(7), dropdown(4)])
crosec_2 = CrossSectionKaramba3D(FamilyNameOfCrossSection="DefaultCroSec", Material=matselect_2, Height_cm=number_slider_2, mode="Shell - Const")

matselect_3 = MaterialSelectionKaramba3D(menu=[dropdown(7), dropdown(6)])
expression = Expression(x="80", y=number_slider_2, Expression="-(x/2-y/2)")
unit_z_2 = UnitZ(Factor=expression)
number = Number(panel)
crosec_3 = CrossSectionKaramba3D(
    FamilyNameOfCrossSection="DefaultCroSec",
    Material=matselect_3,
    LocalEccentricity_cm=unit_z_2,
    Height_cm="80",
    UpperFlangeWidth_cm=number,
    LowerFlangeWidth_cm=number,
    mode="Trapezoid")

# ---- group: Define Line to Beams
polyline = PolyLine(Vertices=move_2.Geometry, Closed=False)
explode = Explode(Curve=polyline, Recursive=True)  # -> Segments, Vertices
length = Length(Curve=explode.Segments)
division = Division(A=length, B=Slider(1, range=0..10))
divide_curve = DivideCurve(Curve=explode.Segments, Count=division, Kinks=False)  # -> Points, Tangents, Parameters
polyline_2 = PolyLine(Vertices=divide_curve.Points, Closed=False)
lineelem = CreateLinearElementKaramba3D(
    Line=polyline_2,
    Identifier="beams",
    CrossSection=crosec_3,
    LimitDistance_m=0.005,
    BucklingLengthY_m=-1,
    BucklingLengthZ_m=-1,
    BucklingLengthLT_m=-1,
    Bending=True,
    ToPolylineMaxAngle=0.03,
    ToPolylineTolerance=0.01,
    ToPolylineMaxEdgeLength=0.25,
    New=True,
    Remove=True,
    mode="LineToBeam")  # -> Element, Points, Info

# ---- group: Define Mesh to Shell
mesh_breps = MeshBrepsKaramba3D(
    Brep=move.Geometry,
    InclusionPoints=flatten([move_2.Geometry, divide_curve.Points]),
    MeshResolution=1,
    EdgeRefinementFactor=0.67,
    PointReduction=False,
    SmoothingStepSize=0,
    SmoothingIterations=5)  # -> Mesh, Info
surfelem = CreateSurfaceElementKaramba3D(Mesh=mesh_breps.Mesh, Identifier="roof", CrossSection=crosec_2, LimitDistance_m=0.005, Bending=True, mode="MeshToShell")  # -> Element, Points, Info

# ---- group: Define Supports
supp = SupportKaramba3D(PosInd=divide_surface.Points, menu=[buttons(on, on, on, on, on, on)])

# ---- group: Define Loads
unit_z_3 = UnitZ(Factor="-3")
loads = LoadsKaramba3D(
    Vector=unit_z_3,
    Mesh=mesh_breps.Mesh,
    LCase="LC0",
    mode="MeshLoad -Const.",
    menu=[buttons(off, on, off), buttons(off, on)])

# ---- group: Define Lines for Columns
line = Line(StartPoint=divide_surface.Points, EndPoint=move_2.Geometry)
lineelem_2 = CreateLinearElementKaramba3D(
    Line=line,
    Identifier="columns",
    CrossSection=crosec,
    LimitDistance_m=0.005,
    BucklingLengthY_m=-1,
    BucklingLengthZ_m=-1,
    BucklingLengthLT_m=-1,
    Bending=True,
    ToPolylineMaxAngle=0.03,
    ToPolylineTolerance=0.01,
    ToPolylineMaxEdgeLength=0.25,
    New=True,
    Remove=True,
    mode="LineToBeam")  # -> Element, Points, Info

# ---- group: Assemble Model
assemble = AssembleModelKaramba3D(
    Elem=flatten([surfelem.Element, lineelem_2.Element, lineelem.Element]),
    Support=flatten(supp),
    Load=loads,
    LimitDistance_m=0.005)  # -> Model, Info, Mass_kg, CentreOfGravity, LoadCaseNames
panel_2 = Panel(assemble.Mass_kg)

# ---- group: Analyze Model
analyse = AnalyseKaramba3D(Model=assemble.Model)  # -> AnalysedModel, MaximumDisplacement_cm, ResultingForce_kN, ChangeOfElasticEnergy_kNm
panel_3 = Panel(analyse.MaximumDisplacement_cm)

# ----
num = Number(range)
lng = ListLength(List=num)
multiplication = Multiplication(A=lng, B=Slider(0.26, range=0..1))
# "&" starts a regular expression
# "^" matches the beginning of a string
# "$" matches the end of a string
# [1-5] the numbers 1,2,3,4,5
# "|" means or
item = ListItem(List=num, Index=multiplication, Wrap=True)
Y = UnitY(Factor=1)
pt = ConstructPoint(XCoordinate=item, YCoordinate=0, ZCoordinate=0)
pt_2 = ConstructPoint(XCoordinate=0, YCoordinate=item, ZCoordinate=0)
Z = UnitZ(Factor=Slider(5, range=0.1..5))
line_2 = LineSDL(Start=pt, Direction=Y, Length=Slider(20, range=0.1..20))
move_3 = Move(Geometry=line_2, Motion=Z)  # -> Geometry, Transform
Y_2 = UnitY(Factor=1)

# ---- group: Visibility via Regular Expressions
panel_4 = Panel("&^(1|2|3|4|5)$")
panel_5 = Panel("&^[1-5]$")
panel_6 = Panel("&^(beams|[1-5])$")

# ---- group: Visibility via Name
panel_7 = Panel("columns")
panel_8 = Panel("beams")
panel_9 = Panel("roof")

# ---- group: Visibility via Plane
yz = YZPlane(Origin=pt)

# ----
xz = XZPlane(Origin=pt_2)

# ---- group: Visibility via Baseline
line_3 = LineSDL(Start=pt, Direction=Y_2, Length=1)

# ---- group: Visibility via Surface
loft = Loft(
    Curves=[line_2, move_3.Geometry],
    Options={Adjust=False, Closed=False, LoftEnds=0, LoftSimp=0, LoftType=0, Rebuild=10, Refit=0.01})

# ---- group: Visibility via Elementindex
panel_10 = Panel("""1
2
3
4
5""")

# ---- group: Visibility via Volume
box = Box({Plane=PlaneXY(2, 3, 0), X=Domain(0, 16), Y=Domain(0, 14), Z=Domain(0, 6)})

# ----
modelview = ModelViewKaramba3D(Model=analyse.AnalysedModel, ViewSelection=loft)  # -> Model, DeformedMesh, DeformedAxes, DeformedModel, MaximumDeformation
beamview = BeamViewKaramba3D(Model=modelview.Model)  # -> Model, MeshesOfRenderedBeams, DeformedBeamAxes, LegendColours, LegendTags
legend = Legend(Colour=beamview.LegendColours, Tags=beamview.LegendTags, LegendType=1)
shellview = ShellViewKaramba3D(Model=beamview.Model, IndexOfLayer=0)  # -> Model, MeshesOfRenderedShells, LegendColours, LegendTags
legend_2 = Legend(Colour=shellview.LegendColours, Tags=shellview.LegendTags, LegendType=1)
reactview = ReactionViewKaramba3D(Model=shellview.Model)  # -> Model, LegendColours, LegendTags
legend_3 = Legend(Colour=reactview.LegendColours, Tags=reactview.LegendTags, LegendType=1)
