# Grasshopper definition Surface_to_Truss.gh (Grasshopper 1.0.8)
# plug-ins: Karamba3D

# Surface To Truss
number_slider = Slider(2, range=0..4.5)
crv = Curve(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)
Z = UnitZ(Factor=number_slider)
move = Move(Geometry=crv, Motion=Z)  # -> Geometry, Transform
rulesrf = RuledSurface(CurveA=crv, CurveB=move.Geometry)
Z_2 = UnitZ(Factor=expr("-x", Slider(10, range=0..100)))
end = EndPoints(Curve=crv)  # -> Start, End
list = ValueList({"Pratt Truss": 1, "Warren Truss": 2, "Warren Truss with verticals": 3, "K-Truss": 4, "Diamond": 5, "Diamond Straight": 6, "Vierendeel Truss": 7}, selected="Warren Truss")
move_2 = Move(Geometry=[end.Start, end.End], Motion=Z_2)  # -> Geometry, Transform
surf2truss = SurfaceToTrussKaramba3D(
    Surface=reparameterize(rulesrf),
    TrussType=list,
    NumberOfSubdivisions=Slider(5, range=0..10),
    FlipUDirection=Toggle(False),
    FlipVDirection=Toggle(False),
    SwapUVDirections=Toggle(False),
    RelaxAngles=Toggle(True),
    TargetPostDirection=Vector(0, 0, 0),
    MaximumRelaxationIterations=30,
    LengthTolerance=0.0001,
    DampingFactor=0.8)  # -> Info, simplify(Lines), YOrientations, ZOrientations, SpecificEnergy
ln = Line(StartPoint=[end.Start, end.End], EndPoint=move_2.Geometry)
crosecrselect = CrossSectionRangeSelectorKaramba3D(MaximumHeight_cm=-1, MaximumWidth_cm=-1, menu=[dropdown(0), dropdown(1), dropdown(3)])
midpt = CurveMiddle(Curve=surf2truss.Lines)
midpt_2 = CurveMiddle(Curve=surf2truss.Lines)
midpt_3 = CurveMiddle(Curve=surf2truss.Lines)
end_2 = EndPoints(Curve=surf2truss.Lines)  # -> Start, End
viewer = ParamViewer(surf2truss.Lines)
panel = Panel(surf2truss.Info)
vec2pt = Vector2Pt(PointA=end_2.Start, PointB=end_2.End, Unitize=Toggle(True))  # -> Vector, Length
item = ListItem(List=crosecrselect, Index=0, Wrap=True)
vdisex = VectorDisplayEx(Point=midpt, Vector=surf2truss.YOrientations, Colour=ColourSwatch(SwatchColor=RGB(117, 233, 108)), Width=2)
vdisex_2 = VectorDisplayEx(Point=midpt_2, Vector=surf2truss.ZOrientations, Colour=ColourSwatch(SwatchColor=RGB(95, 29, 255)), Width=2)
vdisex_3 = VectorDisplayEx(Point=midpt_3, Vector=vec2pt.Vector, Colour=ColourSwatch(SwatchColor=RGB(217, 42, 28)), Width=2)
entwine = Entwine(Branch0X=surf2truss.Lines, Branch1X=ln, FlattenInputs=False)
panel_2 = Panel("""top
bottom
left_diagonal
right_diagonal
vertical
column""")
panel_3 = Panel("""true
true
false
false
true
true""")
end_3 = EndPoints(Curve=ln)  # -> Start, End
Z_3 = UnitZ(Factor=Slider(10, range=1..20))
supp = SupportKaramba3D(PosInd=end_3.End, menu=[buttons(on, on, on, on, off, off)])
loads = LoadsKaramba3D(Vector=Vector(0, 0, -1), LCase="LC0", mode="Gravity")
lineelem = CreateLinearElementKaramba3D(
    Line=entwine,
    Identifier=graft(panel_2),
    CrossSection=item,
    LimitDistance_m=0.005,
    BucklingLengthY_m=-1,
    BucklingLengthZ_m=-1,
    BucklingLengthLT_m=-1,
    Bending=graft(panel_3),
    ToPolylineMaxAngle=0.25,
    ToPolylineTolerance=0.1,
    ToPolylineMaxEdgeLength=0.25,
    New=True,
    Remove=True,
    mode="LineToTruss")  # -> Element, Points, Info
beam_loads = BeamLoadsKaramba3D(
    BeamIdentifier="top",
    LoadCase="LC0",
    ForceVector=expr("-x", Z_3),
    TStart=0,
    TEnd=1,
    mode="Block",
    menu=[buttons(off, on, off)])
clean = CleanTree(RemoveNulls=True, RemoveInvalid=True, RemoveEmpty=Toggle(True), Tree=lineelem.Element)
load = LoadKaramba3D([loads, beam_loads])
assemble = AssembleModelKaramba3D(Elem=flatten(clean), Support=flatten(supp), Load=flatten(load), LimitDistance_m=0.005)  # -> Model, Info, Mass_kg, CentreOfGravity, LoadCaseNames
crosec = CrossSectionKaramba3D(crosecrselect)
opticrosec = OptimizeCrossSectionKaramba3D(
    Model=assemble.Model,
    CrossSections=crosec,
    MaximumUtilization=1,
    MaximumVirtualWork_kNcm=0.01,
    NumberOfUtilizationIterations=5,
    NumberOfDisplacementIterations=5,
    NumberOfDisplacementIncrementsPerIteration=2,
    DisplacementTolerance=0.01,
    NumberOfSamplePoints=3,
    ElasticDesign=True,
    GammaM0=1,
    GammaM1=1.1,
    SwayFrame=True)  # -> OptimizedModel, Info, Mass_kg, MaximumDisplacement_cm, ElasticEnergyChange_kNm, MaximumUtilizationViewInsufficientCrossSections, MaximumDisplacementViewLimitCrossSections
panel_4 = Panel(opticrosec.Mass_kg)
panel_5 = Panel(opticrosec.MaximumDisplacement_cm)
analyse = AnalyseKaramba3D(Model=opticrosec.OptimizedModel)  # -> AnalysedModel, MaximumDisplacement_cm, ResultingForce_kN, ChangeOfElasticEnergy_kNm
modelview = ModelViewKaramba3D(Model=analyse.AnalysedModel)  # -> Model, DeformedMesh, DeformedAxes, DeformedModel, MaximumDeformation
beamview = BeamViewKaramba3D(Model=modelview.Model)  # -> Model, MeshesOfRenderedBeams, DeformedBeamAxes, LegendColours, LegendTags
legend = Legend(Colour=beamview.LegendColours, Tags=beamview.LegendTags, LegendType=1)
