# Grasshopper definition 09_ElementSelection.gh (Grasshopper 1.0.7)
# plug-ins: Karamba3D, Bifocals

# Beam
panel = Panel("Material_A")
# Truss
panel_2 = Panel("Material_B")
# Shell
pt0 = Point(Point(2, 1, 0))
pt1 = Point(Point(2, 0, 0))
pt2 = Point(Point(3, 0, 0))
pt3 = Point(Point(3, 1, 0))
quad = MeshQuad(CornerA="0", CornerB="1", CornerC="2", CornerD="3")
pt0_2 = Point(Point(4, 2, 0))
pt1_2 = Point(Point(4, 0, 0))
pt2_2 = Point(Point(6, 0, 0))
pt3_2 = Point(Point(6, 2, 0))
quad_2 = MeshQuad(CornerA="0", CornerB="1", CornerC="2", CornerD="3")
matprops = MaterialPropertiesKaramba3D(
    FamilyOfMaterial="Steel",
    Name=panel,
    YoungsModulus_kN_cm2=21000,
    InPlaneShearModulus_kN_cm2=8076,
    TransverseShearModulus_kN_cm2=8076,
    SpecificWeight_kN_m3=78.5,
    CoefficientOfThermalExpansion_1_C=1e-05,
    TensileStrength_kN_cm2=23.5,
    CompressiveStrength_kN_cm2=-23.5,
    StrengthHypothesis="MISES",
    mode="Isotrop")
matprops_2 = MaterialPropertiesKaramba3D(
    FamilyOfMaterial="Steel",
    Name=panel_2,
    YoungsModulus_kN_cm2=21000,
    InPlaneShearModulus_kN_cm2=8076,
    TransverseShearModulus_kN_cm2=8076,
    SpecificWeight_kN_m3=78.5,
    CoefficientOfThermalExpansion_1_C=1e-05,
    TensileStrength_kN_cm2=23.5,
    CompressiveStrength_kN_cm2=-23.5,
    StrengthHypothesis="MISES",
    mode="Isotrop")
matprops_3 = MaterialPropertiesKaramba3D(
    FamilyOfMaterial="Steel",
    Name="Material_C",
    YoungsModulus_kN_cm2=21000,
    InPlaneShearModulus_kN_cm2=8076,
    TransverseShearModulus_kN_cm2=8076,
    SpecificWeight_kN_m3=78.5,
    CoefficientOfThermalExpansion_1_C=1e-05,
    TensileStrength_kN_cm2=23.5,
    CompressiveStrength_kN_cm2=-23.5,
    StrengthHypothesis="MISES",
    mode="Isotrop")
mesh = Mesh(Vertices=[pt0, pt1, pt2, pt3], Faces=quad)
mesh_2 = Mesh(Vertices=[pt0_2, pt1_2, pt2_2, pt3_2], Faces=quad_2)
cross_section = CrossSectionKaramba3D(
    FamilyNameOfCrossSection="DefaultCroSec",
    NameOfCrossSection="CroSec_A",
    Material=matprops,
    Height_cm="10",
    UpperFlangeWidth_cm="10",
    LowerFlangeWidth_cm="10",
    mode="Trapezoid")
cross_section_2 = CrossSectionKaramba3D(
    FamilyNameOfCrossSection="DefaultCroSec",
    NameOfCrossSection="CroSec_B",
    Material=matprops_2,
    Height_cm="10",
    UpperFlangeWidth_cm="10",
    LowerFlangeWidth_cm="10",
    mode="Trapezoid")
cross_section_3 = CrossSectionKaramba3D(
    FamilyNameOfCrossSection="DefaultCroSec",
    NameOfCrossSection="CroSec_D",
    Material=matprops_3,
    Height_cm=1,
    mode="Shell - Const")
cross_section_4 = CrossSectionKaramba3D(
    FamilyNameOfCrossSection="DefaultCroSec",
    NameOfCrossSection="CroSec_C",
    Material=matprops_3,
    Height_cm="20",
    mode="Shell - Const")
swatch = ColourSwatch(SwatchColor=RGB(78, 204, 139))
swatch_2 = ColourSwatch(SwatchColor=RGB(153, 78, 204))
swatch_3 = ColourSwatch(SwatchColor=RGB(255, 255, 255))
swatch_4 = ColourSwatch(SwatchColor=RGB(201, 42, 42))
line = LineSDL(Start="0,1,0", Direction=Vector(0, 0, 1), Length="0.5")
line_2 = LineSDL(Start="0,0,0", Direction=Vector(0, 0, 1), Length=1)
line_3 = LineSDL(Start="1,0,0", Direction=Vector(0, 0, 1), Length="2")

# ---- group: Line to Beam (Karamba3D)
linetobeam = LineToBeamKaramba3D(
    Line=line_2,
    Color=swatch_3,
    Identifier="Beam_A",
    CrossSection=cross_section,
    New=True,
    Remove=True,
    LimitDistance_m=0.005,
    Bending=True,
    SetBucklingLength=True,
    ToPolylineMaxAngle=0.03,
    ToPolylineTolerance=0.01,
    ToPolylineMinEdgeLength=0.25)  # -> Element, Points, Info

linetobeam_2 = LineToBeamKaramba3D(
    Line=line,
    Color=ColourSwatch(SwatchColor=RGB(255, 255, 255)),
    Identifier="Beam_A|Beam_1",
    CrossSection=cross_section,
    New=True,
    Remove=True,
    LimitDistance_m=0.005,
    Bending=True,
    SetBucklingLength=True,
    ToPolylineMaxAngle=0.03,
    ToPolylineTolerance=0.01,
    ToPolylineMinEdgeLength=0.25)  # -> Element, Points, Info

linetobeam_3 = LineToBeamKaramba3D(
    Line=line_3,
    Color=swatch_4,
    Identifier="Truss_B|Truss_2",
    CrossSection=cross_section_2,
    New=True,
    Remove=True,
    LimitDistance_m=0.005,
    Bending=Toggle(False),
    SetBucklingLength=True,
    ToPolylineMaxAngle=0.03,
    ToPolylineTolerance=0.01,
    ToPolylineMinEdgeLength=0.25)  # -> Element, Points, Info

# ----
meshtoshell = MeshToShellKaramba3D(Mesh=mesh, Color=swatch, Identifier="Shell_C", CrossSection=cross_section_4, LimitDistance_m=0.005)  # -> Element, Points, Info
meshtoshell_2 = MeshToShellKaramba3D(
    Mesh=mesh_2,
    Color=swatch_2,
    Identifier="Membrane_D",
    CrossSection=cross_section_3,
    LimitDistance_m=0.005,
    Bending=Toggle(False))  # -> Element, Points, Info
merge = Merge(
    Data1=linetobeam.Element,
    Data2=linetobeam_2.Element,
    Data3=linetobeam_3.Element,
    Data4=meshtoshell.Element,
    Data5=meshtoshell_2.Element)

# ---- group: Assemble Model (Karamba3D)
assemble = AssembleModelKaramba3D(Elem=merge, LimitDistance_m=0.005)  # -> Model, Info, Mass_kg, CenterOfGravity, LoadCaseNames

# ----
merge_2 = Merge(Data1="Beam_A", Data2="Truss_2", Data3="Shell_C", Data4="Membrane_D")
merge_3 = Merge(Data1=swatch_3, Data2=swatch_4, Data3=swatch, Data4=swatch_2)
merge_4 = Merge(Data1=cross_section, Data2=cross_section_2, Data3=cross_section_4, Data4=cross_section_3)
merge_5 = Merge(Data1=matprops, Data2=matprops_2, Data3=matprops_3)
list = ValueList({"Truss": 0, "Beam": 1, "Membrane": 2, "Shell": 3}, selected=["Truss", "Beam"])
item = ListItem(List=merge_2, Index=Slider(0, range=0..3), Wrap=True)
item_2 = ListItem(List=merge_3, Index=Slider(0, range=0..3), Wrap=True)  # disabled
item_3 = ListItem(List=merge_4, Index=Slider(3, range=0..3), Wrap=True)  # disabled
item_4 = ListItem(List=merge_5, Index=Slider(2, range=0..2), Wrap=True)  # disabled
dom = ConstructDomain(DomainStart="0", DomainEnd=Slider(1.14, range=0..1.4))  # disabled
panel_3 = Panel(item)
panel_4 = Panel(item_2)
panel_5 = Panel(item_3)
panel_6 = Panel(item_4)
panel_7 = Panel(dom)
selectelems = SelectElementsKaramba3D(
    Model=assemble.Model,
    ElementIdentifiers=item,
    Colors=item_2,
    CrossSections=item_3,
    Materials=item_4,
    LengthIntervals=dom,
    ElementTypes=list)  # -> Model, Elements
panel_8 = Panel(selectelems.Elements)
panel_9 = Panel(selectelems.Model)
elemquery = ElementQueryKaramba3D(Model=selectelems.Model, Elements=selectelems.Elements)  # -> Model, Mass_kg, SurfaceArea, Volume_m3, Meshes
panel_10 = Panel(elemquery.Mass_kg)
panel_11 = Panel(elemquery.SurfaceArea)
panel_12 = Panel(elemquery.Volume_m3)
panel_13 = Panel(elemquery.Meshes)

# ---- group: Model View (Karamba3D)
modelview = ModelViewKaramba3D(Model=elemquery.Model, ResultFactors=1, ResultCase=-1)  # -> Model, DeformedMesh, DeformedAxes, DeformedModel

# ---- group: Beam View (Karamba3D)
beamview = BeamViewKaramba3D(Model=modelview.Model)  # -> Model, MeshesOfRenderedBeams, DeformedBeamAxes, LegendColors, LegendTags

# ---- group: Shell View (Karamba3D)
shellview = ShellViewKaramba3D(Model=beamview.Model, IndexOfLayer=0)  # -> Model, MeshesOfRenderedShells, LegendColors, LegendTags
