# Grasshopper definition 15_OptimizingWorkflows.gh (Grasshopper 1.0.7)
# plug-ins: Karamba3D

X = UnitX(Factor=1)
line = LineSDL(Start="0,0,0", Direction=X, Length="10")
Y = UnitY(Factor="10")
number_slider = Slider(6, range=0..10)
move = Move(Geometry=line, Motion=Y)  # -> Geometry, Transform
divide = DivideCurve(Curve=line, Count=number_slider, Kinks=False)  # -> Points, Tangents, Parameters
divide_2 = DivideCurve(Curve=move.Geometry, Count=number_slider, Kinks=False)  # -> Points, Tangents, Parameters
shift = ShiftList(List=divide_2.Points, Shift=Slider(4, range=1..10), Wrap=True)
ln = Line(StartPoint=divide.Points, EndPoint=divide_2.Points)
ln_2 = Line(StartPoint=divide.Points, EndPoint=shift)
crv_columns = Curve(line)
crv_main_beams_end = Curve(move.Geometry)
crv_main_beams_end_2 = Curve(ln)
crv_columns_2 = Curve(ln_2)
panel = Panel("""HEA300
HEA300
IPE80
CHS 406x13""")
entwine = Entwine(
    Branch00=crv_columns,
    Branch01=crv_main_beams_end,
    Branch02=crv_main_beams_end_2,
    Branch03=crv_columns_2,
    FlattenInputs=True)
panel_2 = Panel("""Red
Blue
Green
Pink""")
crosecselect = CrossSectionSelectorKaramba3D(NameOrListIndexOfCrossSection=graft(panel), Color=graft(panel_2))  # -> CrossSection, Info
graft = GraftTree(Tree=entwine, IncludeEmptyLists=True, IncludeNullItems=True)
cross_section = CrossSectionKaramba3D(
    FamilyNameOfCrossSection="DefaultCroSec",
    Material=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,
    Height_cm="40",
    UpperFlangeWidth_cm="20",
    LowerFlangeWidth_cm="20",
    UpperFlangeThickness_cm=0.8,
    LowerFlangeThickness_cm=0.8,
    WebThickness_cm=0.5,
    FilletRadius_cm=0,
    mode="I")
cross_section_2 = CrossSectionKaramba3D(
    FamilyNameOfCrossSection="DefaultCroSec",
    Material=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,
    Height_cm="30",
    UpperFlangeWidth_cm="20",
    LowerFlangeWidth_cm="20",
    UpperFlangeThickness_cm=0.4,
    LowerFlangeThickness_cm=0.4,
    SidewallsThickness_cm=0.4,
    FilletRadius_cm=0.6,
    mode="Box")
cross_section_3 = CrossSectionKaramba3D(
    FamilyNameOfCrossSection="DefaultCroSec",
    Material=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,
    Diameter_cm="10",
    WallThickness_cm=0.4,
    mode="Circular Hollow")
llinter = LineLineIntersectionKaramba3D(Line=flatten(graft), LimitDistance_m=0.005)  # -> IntersectionPoints, LineSubSegements
panel_3 = Panel(crosecselect.CrossSection)
match = MatchTree(Tree=llinter.LineSubSegements, Guide=graft)
entwine_2 = Entwine(Branch00=cross_section, Branch01=cross_section, Branch02=cross_section_2, Branch03=cross_section_3, FlattenInputs=True)
trim = TrimTree(Tree=match, Depth=1)
panel_4 = Panel("""A
B
C
D""")
panel_5 = Panel("""1
1
0
0""")
linetobeam = LineToBeamKaramba3D(
    Line=trim,
    Identifier=graft(panel_4),
    CrossSection=entwine_2,
    New=True,
    Remove=True,
    LimitDistance_m=0.005,
    Bending=graft(panel_5),
    SetBucklingLength=True,
    ToPolylineMaxAngle=0.03,
    ToPolylineTolerance=0.01,
    ToPolylineMinEdgeLength=0.25)  # -> Element, Points, Info
assemble = AssembleModelKaramba3D(Elem=flatten(linetobeam.Element), LimitDistance_m=0.005)  # -> Model, Info, Mass_kg, CenterOfGravity, LoadCaseNames
modelview = ModelViewKaramba3D(Model=assemble.Model, ResultFactors=1, ResultCase=-1)  # -> Model, DeformedMesh, DeformedAxes, DeformedModel
beamview = BeamViewKaramba3D(Model=modelview.Model)  # -> Model, MeshesOfRenderedBeams, DeformedBeamAxes, LegendColors, LegendTags
X_2 = UnitX(Factor=1)
number_slider_2 = Slider(6, range=0..10)
line_2 = LineSDL(Start="0,0,0", Direction=X_2, Length="10")
Y_2 = UnitY(Factor="10")
move_2 = Move(Geometry=line_2, Motion=Y_2)  # -> Geometry, Transform
divide_3 = DivideCurve(Curve=line_2, Count=number_slider_2, Kinks=False)  # -> Points, Tangents, Parameters
divide_4 = DivideCurve(Curve=move_2.Geometry, Count=number_slider_2, Kinks=False)  # -> Points, Tangents, Parameters
shift_2 = ShiftList(List=divide_4.Points, Shift=Slider(4, range=1..10), Wrap=True)
pline = PolyLine(Vertices=divide_3.Points, Closed=False)
pline_2 = PolyLine(Vertices=divide_4.Points, Closed=False)
ln_3 = Line(StartPoint=divide_3.Points, EndPoint=divide_4.Points)
ln_4 = Line(StartPoint=divide_3.Points, EndPoint=shift_2)
explode = Explode(Curve=pline, Recursive=True)  # -> Segments, Vertices
explode_2 = Explode(Curve=pline_2, Recursive=True)  # -> Segments, Vertices
ccx = CurveCurve(CurveA=graft(ln_3), CurveB=ln_4)  # -> Points, ParamsA, ParamsB
ccx_2 = CurveCurve(CurveA=graft(ln_4), CurveB=flatten([ln_4, ln_3]))  # -> Points, ParamsA, ParamsB
trim_2 = TrimTree(Tree=ccx.ParamsA, Depth=1)
trim_3 = TrimTree(Tree=ccx_2.ParamsA, Depth=1)
shatter = Shatter(Curve=graft(ln_3), Parameters=trim_2)
shatter_2 = Shatter(Curve=graft(ln_4), Parameters=trim_3)
crv_main_beams_end_3 = Curve(explode_2.Segments)
crv_columns_3 = Curve(shatter_2)
crv_columns_4 = Curve(explode.Segments)
crv_main_beams_end_4 = Curve(shatter)
cross_section_4 = CrossSectionKaramba3D(
    FamilyNameOfCrossSection="DefaultCroSec",
    Material=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,
    Height_cm="40",
    UpperFlangeWidth_cm="20",
    LowerFlangeWidth_cm="20",
    UpperFlangeThickness_cm=0.8,
    LowerFlangeThickness_cm=0.8,
    WebThickness_cm=0.5,
    FilletRadius_cm=0,
    mode="I")
cross_section_5 = CrossSectionKaramba3D(
    FamilyNameOfCrossSection="DefaultCroSec",
    Material=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,
    Height_cm="30",
    UpperFlangeWidth_cm="20",
    LowerFlangeWidth_cm="20",
    UpperFlangeThickness_cm=0.4,
    LowerFlangeThickness_cm=0.4,
    SidewallsThickness_cm=0.4,
    FilletRadius_cm=0.6,
    mode="Box")
cross_section_6 = CrossSectionKaramba3D(
    FamilyNameOfCrossSection="DefaultCroSec",
    Material=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,
    Diameter_cm="10",
    WallThickness_cm=0.4,
    mode="Circular Hollow")
linetobeam_2 = LineToBeamKaramba3D(
    Line=crv_columns_4,
    Identifier="A",
    CrossSection=cross_section_4,
    New=True,
    Remove=True,
    LimitDistance_m=0.005,
    Bending=Toggle(True),
    SetBucklingLength=True,
    ToPolylineMaxAngle=0.03,
    ToPolylineTolerance=0.01,
    ToPolylineMinEdgeLength=0.25)  # -> Element, Points, Info
linetobeam_3 = LineToBeamKaramba3D(
    Line=crv_main_beams_end_3,
    Identifier="B",
    CrossSection=cross_section_4,
    New=True,
    Remove=True,
    LimitDistance_m=0.005,
    Bending=Toggle(True),
    SetBucklingLength=True,
    ToPolylineMaxAngle=0.03,
    ToPolylineTolerance=0.01,
    ToPolylineMinEdgeLength=0.25)  # -> Element, Points, Info
linetobeam_4 = LineToBeamKaramba3D(
    Line=crv_main_beams_end_4,
    Identifier="C",
    CrossSection=cross_section_5,
    New=True,
    Remove=True,
    LimitDistance_m=0.005,
    Bending=Toggle(False),
    SetBucklingLength=True,
    ToPolylineMaxAngle=0.03,
    ToPolylineTolerance=0.01,
    ToPolylineMinEdgeLength=0.25)  # -> Element, Points, Info
linetobeam_5 = LineToBeamKaramba3D(
    Line=crv_columns_3,
    Identifier="D",
    CrossSection=cross_section_6,
    New=True,
    Remove=True,
    LimitDistance_m=0.005,
    Bending=Toggle(False),
    SetBucklingLength=True,
    ToPolylineMaxAngle=0.03,
    ToPolylineTolerance=0.01,
    ToPolylineMinEdgeLength=0.25)  # -> Element, Points, Info
assemble_2 = AssembleModelKaramba3D(
    Elem=flatten([linetobeam_2.Element, linetobeam_5.Element, linetobeam_3.Element, linetobeam_4.Element]),
    LimitDistance_m=0.005)  # -> Model, Info, Mass_kg, CenterOfGravity, LoadCaseNames
modelview_2 = ModelViewKaramba3D(Model=assemble_2.Model, ResultFactors=1, ResultCase=-1)  # -> Model, DeformedMesh, DeformedAxes, DeformedModel
beamview_2 = BeamViewKaramba3D(Model=modelview_2.Model)  # -> Model, MeshesOfRenderedBeams, DeformedBeamAxes, LegendColors, LegendTags
