# Grasshopper definition 18_SimpleShell.gh (Grasshopper 1.0.7)
# plug-ins: Bifocals, Karamba3D

rectangle = Rectangle(Plane=PlaneXY(0, 0, 0), XSize="0 to 10", YSize="0 to 10", Radius=0)  # -> Rectangle, Length
cross_section = CrossSectionKaramba3D(FamilyNameOfCrossSection="DefaultCroSec", Material=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, Height_cm="5", mode="Shell - Const")
mplane = MeshPlane(Boundary=rectangle.Rectangle, WidthCount=10, HeightCount=10)  # -> Mesh, Area
panel = Panel(mplane.Mesh)
meshtoshell = MeshToShellKaramba3D(Mesh=mplane.Mesh, CrossSection=cross_section, LimitDistance_m=0.005)  # -> Element, Points, Info
panel_2 = Panel(meshtoshell.Element)
points_from_xyz = PointsFromXYZ(point=meshtoshell.Points, X="0 to 0.5", tolerance=0.001)
points_from_xyz_2 = PointsFromXYZ(point=meshtoshell.Points, X="9.5 to 10", tolerance=0.001)
Z = UnitZ(Factor="-1")
supp = SupportKaramba3D(PosInd=points_from_xyz, menu=[buttons(on, on, on, on, on, on)])

# ---- group: Loads (Karamba3D)
loads = LoadsKaramba3D(ForceVector=Z, Local=False, PosInd=points_from_xyz_2, LCase="0", mode="Point")

# ---- group: Assemble Model (Karamba3D)
assemble = AssembleModelKaramba3D(Elem=meshtoshell.Element, Support=supp, Load=loads, LimitDistance_m=0.005)  # -> Model, Info, Mass_kg, CenterOfGravity, LoadCaseNames

# ---- group: Analyze (Karamba3D)
analyze = AnalyzeKaramba3D(Model=assemble.Model)  # -> CalculatedModel, MaximumDisplacement_cm, ResultingForceOfGravity_kN, ElasticEnergyChange_kNm

# ----
panel_3 = Panel(assemble.Mass_kg)
panel_4 = Panel(analyze.MaximumDisplacement_cm)

# ---- group: Model View (Karamba3D)
modelview = ModelViewKaramba3D(Model=analyze.CalculatedModel, ResultFactors=1, ResultCase=-1)  # -> Model, DeformedMesh, DeformedAxes, DeformedModel

# ---- group: Shell View (Karamba3D)
shellview = ShellViewKaramba3D(Model=modelview.Model, IndexOfLayer=0)  # -> Model, MeshesOfRenderedShells, LegendColors, LegendTags

# ----
legend = Legend(Colour=shellview.LegendColors, Tags=shellview.LegendTags, LegendType=1)

# ==== cluster PointsFromXYZ
tolerance = ClusterInput()
point = ClusterInput()
X = ClusterInput()
Y = ClusterInput()
Z = ClusterInput()
tolerance_2 = Number(tolerance)
point_2 = Point(point)
X_2 = Domain(X)
Y_2 = Domain(Y)
Z_2 = Domain(Z)
deconstruct = Deconstruct(Point=point_2)  # -> XComponent, YComponent, ZComponent
deconstruct_domain = DeconstructDomain(Domain=X_2)  # -> Start, End
deconstruct_domain_2 = DeconstructDomain(Domain=Y_2)  # -> Start, End
deconstruct_domain_3 = DeconstructDomain(Domain=Z_2)  # -> Start, End
absolute = Absolute(Value=tolerance_2)
subtraction = Subtraction(A=deconstruct_domain.Start, B=absolute)
addition = Addition(A=deconstruct_domain.End, B=absolute)
subtraction_2 = Subtraction(A=deconstruct_domain_2.Start, B=absolute)
addition_2 = Addition(A=deconstruct_domain_2.End, B=absolute)
subtraction_3 = Subtraction(A=deconstruct_domain_3.Start, B=absolute)
addition_3 = Addition(A=deconstruct_domain_3.End, B=absolute)
number = Number(deconstruct.XComponent)
number_2 = Number(deconstruct.YComponent)
number_3 = Number(deconstruct.ZComponent)
larger_than = LargerThan(FirstNumber=number, SecondNumber=subtraction)  # -> LargerThan, OrEqualTo
smaller_than = SmallerThan(FirstNumber=number, SecondNumber=addition)  # -> SmallerThan, OrEqualTo
larger_than_2 = LargerThan(FirstNumber=number_2, SecondNumber=subtraction_2)  # -> LargerThan, OrEqualTo
smaller_than_2 = SmallerThan(FirstNumber=number_2, SecondNumber=addition_2)  # -> SmallerThan, OrEqualTo
larger_than_3 = LargerThan(FirstNumber=number_3, SecondNumber=subtraction_3)  # -> LargerThan, OrEqualTo
smaller_than_3 = SmallerThan(FirstNumber=number_3, SecondNumber=addition_3)  # -> SmallerThan, OrEqualTo
gate_and = GateAnd(A=larger_than.OrEqualTo, B=smaller_than.OrEqualTo)
gate_and_2 = GateAnd(A=larger_than_2.OrEqualTo, B=smaller_than_2.OrEqualTo)
gate_and_3 = GateAnd(A=larger_than_3.OrEqualTo, B=smaller_than_3.OrEqualTo)
c_script = CSharpScript(value=X_2, bool=gate_and)  # -> out, result
# ---------- c_script: C# ----------
    if(_value == null)
      result_ = true;
    else result_ = _bool;
# ---------- end c_script ----------
c_script_2 = CSharpScript(value=Y_2, bool=gate_and_2)  # -> out, result; same code as c_script
c_script_3 = CSharpScript(value=Z_2, bool=gate_and_3)  # -> out, result; same code as c_script
gate_and_4 = GateAnd(A=c_script.result, B=c_script_2.result)
gate_and_5 = GateAnd(A=gate_and_4, B=c_script_3.result)
point_3 = Point(point_2)
cull_pattern = CullPattern(List=point_3, CullPattern=gate_and_5)
point_4 = Point(cull_pattern)
point_5 = ClusterOutput(point_4)
