# Grasshopper definition 19_Meshload.gh (Grasshopper 1.0.7)
# plug-ins: Karamba3D

number_slider = Slider(10, range=0..100)
surface = Surface(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)
mesh_uv = MeshSurface(Surface=surface, UCount=number_slider, VCount=number_slider, Overhang=True, Equalize=False)
mesh_edges = MeshEdges(Mesh=mesh_uv)  # -> NakedEdges, InteriorEdges, NonManifoldEdges

# ---- group: CrossSections
readcstable = ReadCrossSectionTableFromFileKaramba()  # -> CrossSection, Info
crosecrselect = CrossSectionRangeSelectorKaramba3D(
    CrossSections=readcstable.CrossSection,
    MaximumHeight_cm=-1,
    MaximumWidth_cm=-1,
    menu=[dropdown(0), dropdown(3), dropdown(2)])
crosecrselect_2 = CrossSectionRangeSelectorKaramba3D(
    CrossSections=readcstable.CrossSection,
    MaximumHeight_cm=-1,
    MaximumWidth_cm=-1,
    menu=[dropdown(0), dropdown(1), dropdown(3)])
crosecselect = CrossSectionSelectorKaramba3D(CrossSections=crosecrselect_2, NameOrListIndexOfCrossSection="0", ElementsIdentifiers="A")  # -> CrossSection, Info
crosecselect_2 = CrossSectionSelectorKaramba3D(CrossSections=crosecrselect, NameOrListIndexOfCrossSection="0", ElementsIdentifiers="B")  # -> CrossSection, Info

# ---- group: Loads
panel = Panel("B")
Z = UnitZ(Factor=Slider(-1, range=-20..20))
loads = LoadsKaramba3D(Vector=Vector(0, 0, -1), LCase="0", mode="Gravity")
loads_2 = LoadsKaramba3D(Vector=Z, Mesh=mesh_uv, LCase="0", mode="MeshLoad -Const.", menu=[buttons(off, on, off), buttons(on, on)])

# ----
load_karamba3d = LoadKaramba3D([loads, loads_2])
cross_section_karamba3d = CrossSectionKaramba3D([crosecselect.CrossSection, crosecselect_2.CrossSection])
cross_section_karamba3d_2 = CrossSectionKaramba3D([crosecrselect_2, crosecrselect])

# ---- group: Elements
panel_2 = Panel("""0,0,0
0,10,0
10,0,0
10,10,0""")
panel_3 = Panel("""A
B""")

# ----
point = Point(panel_2)

# ---- group: Elements (continued)
srfgrid = SurfaceFromPoints(Points=point, UCount="2", Interpolate=False)
sdivide = DivideSurface(Surface=srfgrid, UCount=Slider(5, range=1..30), VCount=Slider(5, range=1..30))  # -> Points, Normals, Parameters
flip = FlipMatrix(Data=sdivide.Points)
pline = PolyLine(Vertices=sdivide.Points, Closed=False)
pline_2 = PolyLine(Vertices=flip, Closed=False)
explode = Explode(Curve=pline, Recursive=True)  # -> Segments, Vertices
explode_2 = Explode(Curve=pline_2, Recursive=True)  # -> Segments, Vertices
entwine = Entwine(Branch00=explode.Segments, Branch01=explode_2.Segments, FlattenInputs=True)
linetobeam = LineToBeamKaramba3D(
    Line=entwine,
    Identifier=graft(panel_3),
    New=True,
    Remove=True,
    LimitDistance_m=0.005,
    Bending=True,
    SetBucklingLength=True,
    ToPolylineMaxAngle=0.03,
    ToPolylineTolerance=0.01,
    ToPolylineMinEdgeLength=0.25)  # -> Element, Points, Info

# ---- group: Supports
supp = SupportKaramba3D(PosInd=point, menu=[buttons(on, on, on, off, off, off)])

# ----
assemble = AssembleModelKaramba3D(
    Elem=flatten(linetobeam.Element),
    Support=flatten(supp),
    Load=flatten(load_karamba3d),
    CrossSection=flatten(cross_section_karamba3d),
    LimitDistance_m=0.005)  # -> Model, Info, Mass_kg, CenterOfGravity, LoadCaseNames
analyze = AnalyzeKaramba3D(Model=assemble.Model)  # -> CalculatedModel, MaximumDisplacement_cm, ResultingForceOfGravity_kN, ElasticEnergyChange_kNm; disabled
opticrosec = OptimizeCrossSectionKaramba3D(
    Model=assemble.Model,
    CrossSections=cross_section_karamba3d_2,
    MaximumUtilization=1,
    UltimateLimitStateIterations=5,
    DisplacementIterations=5,
    NumberOfSamplePoints=3,
    ElasticDesign=True,
    GammaM0=1,
    GammaM1=1.1,
    SwayFrame=True)  # -> ModelWithOptimizedCrossSections, Info, Mass_kg, MaximumDisplacement_cm, ElasticEnergyChange_kNm
modelview = ModelViewKaramba3D(Model=opticrosec.ModelWithOptimizedCrossSections, ResultFactors=1, ResultCase=-1)  # -> Model, DeformedMesh, DeformedAxes, DeformedModel
beamview = BeamViewKaramba3D(Model=modelview.Model)  # -> Model, MeshesOfRenderedBeams, DeformedBeamAxes, LegendColors, LegendTags
legend = Legend(Colour=beamview.LegendColors, Tags=beamview.LegendTags, LegendType=1)
