# Grasshopper definition 20_LineJointOnWall.gh (Grasshopper 1.0.7)
# plug-ins: Karamba3D

yz = YZPlane(Origin=Point(0, 0, 0))
dom = ConstructDomain(DomainStart="-5", DomainEnd="0")
dom_2 = ConstructDomain(DomainStart="0", DomainEnd="5")
dom_3 = ConstructDomain(DomainStart="-2", DomainEnd="0")
dom_4 = ConstructDomain(DomainStart="0", DomainEnd="2")
planesrf = PlaneSurface(Plane=PlaneXY(0, 0, 0), XSize=[dom, dom_2], YSize=dom_3)
planesrf_2 = PlaneSurface(Plane=yz, XSize=dom_3, YSize=[dom_3, dom_4])
merge = Merge(Data1=planesrf, Data2=planesrf_2)
matselect = MaterialSelectionKaramba3D(menu=[dropdown(2), dropdown(1)])
mesh_breps = MeshBrepsKaramba3D(
    Brep=merge,
    MeshResolution=Slider(0.3, range=0..1),
    EdgeRefinementFactor=0.67,
    PointReduction=False,
    SmoothingStepSize=0,
    SmoothingIterations=5)  # -> Mesh, Info
cross_section = CrossSectionKaramba3D(FamilyNameOfCrossSection="DefaultCroSec", Material=matselect, Height_cm="10", mode="Shell - Const")
panel = Panel("""Floor
Floor
Wall
Wall""")
meshtoshell = MeshToShellKaramba3D(Mesh=mesh_breps.Mesh, Identifier=panel, CrossSection=cross_section, LimitDistance_m=0.005)  # -> Element, Points, Info
points_from_xyz = PointsFromXYZ(point=meshtoshell.Points, Z="2.0 to 2.0", tolerance=0.001)
points_from_xyz_2 = PointsFromXYZ(point=meshtoshell.Points, X="0 to 0", Z="0 to 0", tolerance=0.001)
X = UnitX(Factor=["-5", "5"])
Z = UnitZ(Factor="-2")
yz_2 = YZPlane(Origin=X)
xy = XYPlane(Origin=Z)
pline = PolyLine(Vertices=points_from_xyz, Closed=False)
pline_2 = PolyLine(Vertices=points_from_xyz_2, Closed=False)
planesrf_3 = PlaneSurface(Plane=yz_2, XSize=Domain(-10, 10), YSize=Domain(-10, 10))
planesrf_4 = PlaneSurface(Plane=xy, XSize=Domain(-10, 10), YSize=Domain(-10, 10))
linetobeam = LineToBeamKaramba3D(
    Line=pline,
    New=True,
    Remove=True,
    LimitDistance_m=0.005,
    Bending=True,
    SetBucklingLength=True,
    ToPolylineMaxAngle=0.03,
    ToPolylineTolerance=0.01,
    ToPolylineMinEdgeLength=0.25)  # -> Element, Points, Info
points_close_to_surface = PointsCloseToSurface(point=meshtoshell.Points, surface=graft(planesrf_3), tolerance=0.001)
points_close_to_surface_2 = PointsCloseToSurface(point=meshtoshell.Points, surface=graft(planesrf_4), tolerance=0.001)
pt = ConstructPoint(XCoordinate=Slider(1000, range=1..1000), YCoordinate=0, ZCoordinate=0)
Z_2 = UnitZ(Factor=1)
X_2 = UnitX(Factor=1)
line_joint = LineJointKaramba3D(
    JointCurve=pline_2,
    AtElementIdentifier="Wall",
    YOrientation=Z_2,
    ZOrientation=Vector(0, 0, 1),
    DAlpha_deg=45,
    Ct_kN_m_m=Vector(0, 0, 0),
    Cr_kNm_m_rad=pt,
    menu=[buttons(off, off, off, on, off, off)])
supp = SupportKaramba3D(PosInd=flatten(points_close_to_surface), menu=[buttons(on, on, on, off, off, off)])
supp_2 = SupportKaramba3D(PosInd=flatten(points_close_to_surface_2), menu=[buttons(off, off, on, off, off, off)])
loads = LoadsKaramba3D(Vector=Vector(0, 0, -1), LCase="0", mode="Gravity")
beam_loads = BeamLoadsKaramba3D(
    BeamIdentifier=linetobeam.Element,
    LoadCase="0",
    ForceVector=X_2,
    TStart=0,
    TEnd=1,
    mode="Block",
    menu=[buttons(off, on, off)])
support = SupportKaramba3D(flatten([supp, supp_2]))
load = LoadKaramba3D(flatten([loads, beam_loads]))
joint = JointKaramba3D(line_joint)
assemble = AssembleModelKaramba3D(Elem=flatten([meshtoshell.Element, linetobeam.Element]), Support=support, Load=load, Joint=joint, LimitDistance_m=0.005)  # -> Model, Info, Mass_kg, CenterOfGravity, LoadCaseNames
analyze = AnalyzeKaramba3D(Model=assemble.Model)  # -> CalculatedModel, MaximumDisplacement_cm, ResultingForceOfGravity_kN, ElasticEnergyChange_kNm
panel_2 = Panel("Floor")
panel_3 = Panel("Wall")
modelview = ModelViewKaramba3D(Model=analyze.CalculatedModel, ResultFactors=1, ResultCase=-1)  # -> Model, DeformedMesh, DeformedAxes, DeformedModel
beamview = BeamViewKaramba3D(Model=modelview.Model)  # -> Model, MeshesOfRenderedBeams, DeformedBeamAxes, LegendColors, LegendTags
shellview = ShellViewKaramba3D(Model=beamview.Model, IndexOfLayer=0)  # -> Model, MeshesOfRenderedShells, LegendColors, LegendTags

# ==== cluster PointsCloseToSurface
point = ClusterInput()
surface = ClusterInput()
tolerance = ClusterInput()
point_2 = Point(point)
surface_2 = Surface(surface)
tolerance_2 = Number(tolerance)
surface_closest_point = SurfaceClosestPoint(Point=point_2, Surface=surface_2)  # -> Point, UVPoint, Distance
smaller_than = SmallerThan(FirstNumber=surface_closest_point.Distance, SecondNumber=tolerance_2)  # -> SmallerThan, OrEqualTo
cull_pattern = CullPattern(List=point_2, CullPattern=smaller_than.OrEqualTo)
point_3 = Point(cull_pattern)
point_4 = ClusterOutput(point_3)

# ==== cluster PointsFromXYZ
tolerance = ClusterInput()
point = ClusterInput()
X = ClusterInput()
Y = ClusterInput()
Z = ClusterInput()
tolerance_2 = Number(tolerance)
point_2 = Point(point)
X_2 = Domain(X)
Y_2 = Domain(Y)
Z_2 = Domain(Z)
deconstruct = Deconstruct(Point=point_2)  # -> XComponent, YComponent, ZComponent
deconstruct_domain = DeconstructDomain(Domain=X_2)  # -> Start, End
deconstruct_domain_2 = DeconstructDomain(Domain=Y_2)  # -> Start, End
deconstruct_domain_3 = DeconstructDomain(Domain=Z_2)  # -> Start, End
absolute = Absolute(Value=tolerance_2)
subtraction = Subtraction(A=deconstruct_domain.Start, B=absolute)
addition = Addition(A=deconstruct_domain.End, B=absolute)
subtraction_2 = Subtraction(A=deconstruct_domain_2.Start, B=absolute)
addition_2 = Addition(A=deconstruct_domain_2.End, B=absolute)
subtraction_3 = Subtraction(A=deconstruct_domain_3.Start, B=absolute)
addition_3 = Addition(A=deconstruct_domain_3.End, B=absolute)
number = Number(deconstruct.XComponent)
number_2 = Number(deconstruct.YComponent)
number_3 = Number(deconstruct.ZComponent)
larger_than = LargerThan(FirstNumber=number, SecondNumber=subtraction)  # -> LargerThan, OrEqualTo
smaller_than = SmallerThan(FirstNumber=number, SecondNumber=addition)  # -> SmallerThan, OrEqualTo
larger_than_2 = LargerThan(FirstNumber=number_2, SecondNumber=subtraction_2)  # -> LargerThan, OrEqualTo
smaller_than_2 = SmallerThan(FirstNumber=number_2, SecondNumber=addition_2)  # -> SmallerThan, OrEqualTo
larger_than_3 = LargerThan(FirstNumber=number_3, SecondNumber=subtraction_3)  # -> LargerThan, OrEqualTo
smaller_than_3 = SmallerThan(FirstNumber=number_3, SecondNumber=addition_3)  # -> SmallerThan, OrEqualTo
gate_and = GateAnd(A=larger_than.OrEqualTo, B=smaller_than.OrEqualTo)
gate_and_2 = GateAnd(A=larger_than_2.OrEqualTo, B=smaller_than_2.OrEqualTo)
gate_and_3 = GateAnd(A=larger_than_3.OrEqualTo, B=smaller_than_3.OrEqualTo)
c_script = CSharpScript(value=X_2, bool=gate_and)  # -> out, result
# ---------- c_script: C# ----------
    if(_value == null)
      result_ = true;
    else result_ = _bool;
# ---------- end c_script ----------
c_script_2 = CSharpScript(value=Y_2, bool=gate_and_2)  # -> out, result; same code as c_script
c_script_3 = CSharpScript(value=Z_2, bool=gate_and_3)  # -> out, result; same code as c_script
gate_and_4 = GateAnd(A=c_script.result, B=c_script_2.result)
gate_and_5 = GateAnd(A=gate_and_4, B=c_script_3.result)
point_3 = Point(point_2)
cull_pattern = CullPattern(List=point_3, CullPattern=gate_and_5)
point_4 = Point(cull_pattern)
point_5 = ClusterOutput(point_4)
