# Grasshopper definition 21_MeshTools.gh (Grasshopper 1.0.7)
# plug-ins: Karamba3D

srf = Surface(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)
brep = Brep([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])
srf_2 = Surface(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)
srf_3 = Surface(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)
crv = Curve(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)
mesh_uv = MeshSurface(Surface=srf, UCount=5, VCount=5, Overhang=True, Equalize=False)
brep_2 = Brep([srf_2, srf_3])
panel = Panel(mesh_uv)
end = EndPoints(Curve=crv)  # -> Start, End
meshtoshell = MeshToShellKaramba3D(Mesh=mesh_uv, LimitDistance_m=Slider(0.9, range=0.1..1.5))  # -> Element, Points, Info
mesh_breps = MeshBreps(
    Brep=brep,
    MeshResolution=Slider(0.33, range=0.05..3),
    EdgeRefinementFactor=0.67,
    PointReduction=False,
    SmoothingStepSize=0,
    SmoothingIterations=5)  # -> Mesh, Info
pt = Point(end.End)
panel_2 = Panel(meshtoshell.Element)
pt_2 = Point(meshtoshell.Points)
panel_3 = Panel(mesh_breps.Mesh)
mesh_breps_2 = MeshBreps(
    Brep=brep_2,
    InclusionPoints=pt,
    MeshResolution=Slider(1, range=0.05..3),
    EdgeRefinementFactor=Slider(1, range=0.01..1),
    PointReduction=Toggle(True),
    SmoothingStepSize=Slider(1, range=0.01..1),
    SmoothingIterations=Slider(0, range=0..10))  # -> Mesh, Info
panel_4 = Panel(mesh_breps_2.Mesh)
linetobeam = LineToBeamKaramba3D(
    Line=crv,
    New=True,
    Remove=True,
    LimitDistance_m=0.005,
    Bending=True,
    SetBucklingLength=True,
    ToPolylineMaxAngle=0.03,
    ToPolylineTolerance=0.01,
    ToPolylineMinEdgeLength=0.25)  # -> Element, Points, Info
panel_5 = Panel("""A
B""")
meshtoshell_2 = MeshToShellKaramba3D(Mesh=mesh_breps_2.Mesh, Identifier=panel_5, LimitDistance_m=0.005)  # -> Element, Points, Info
panel_6 = Panel(meshtoshell_2.Element)
assemble = AssembleModelKaramba3D(Elem=flatten([meshtoshell_2.Element, linetobeam.Element]), LimitDistance_m=0.005)  # -> Model, Info, Mass_kg, CenterOfGravity, LoadCaseNames
panel_7 = Panel("B")
panel_8 = Panel("A")
modelview = ModelViewKaramba3D(Model=assemble.Model, ResultFactors=1, ResultCase=-1)  # -> Model, DeformedMesh, DeformedAxes, DeformedModel
shellview = ShellViewKaramba3D(Model=modelview.Model, IndexOfLayer=0)  # -> Model, MeshesOfRenderedShells, LegendColors, LegendTags
beamview = BeamViewKaramba3D(Model=modelview.Model)  # -> Model, MeshesOfRenderedBeams, DeformedBeamAxes, LegendColors, LegendTags
mesh = Mesh(shellview.MeshesOfRenderedShells)
