# Grasshopper definition 23_CircularAndRectangularPlate.gh (Grasshopper 1.0.7)
# plug-ins: Karamba3D

# Circular and Quadratic Plates under uniform Load
# Equation numbers refer to: S. Timoshenko, S. Woinowsky-Krieger: 'Theory of Plates and Shells', second edition, ISBN 0-07-064779-8, Mc Graw-Hill, Classic Textbook Reissue, 1987.
panel = Panel("-5 to 5")
matselect = MaterialSelectionKaramba3D(menu=[dropdown(1), dropdown(6)])
rectangle = Rectangle(Plane=PlaneXY(0, 0, 0), XSize=panel, YSize=panel, Radius=0)  # -> Rectangle, Length
fillet = FilletDistance(Curve=rectangle.Rectangle, Distance=Slider(0, range=0..5))
number_slider = Slider(1, range=0..1)
cross_section = CrossSectionKaramba3D(FamilyNameOfCrossSection="DefaultCroSec", Material=matselect, Height_cm="10", mode="Shell - Const")
disassemble = DisassembleMaterialKaramba3D(Material=matselect)  # -> Material, TypeOfMaterial, FamilyNameOfMaterial, NameOfMaterial, ElemIdentifiers, Color, YoungsModulusKNCm2Dir12, InPlaneShearModulus_kN_cm2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
boundary = BoundarySurfaces(Edges=fillet)

# ---- group: lateral contraction coeffficient
expression = Expression(E=disassemble.YoungsModulusKNCm2Dir12, G=disassemble.InPlaneShearModulus_kN_cm2, Expression="E/(2*G)-1")

# ----
dedomain = DeconstructDomain(Domain=panel)  # -> Start, End
mesh_breps = MeshBrepsKaramba3D(
    Brep=boundary,
    MeshResolution=Slider(0.1, range=0.1..1),
    EdgeRefinementFactor=0.67,
    PointReduction=False,
    SmoothingStepSize=number_slider,
    SmoothingIterations=5)  # -> Mesh, Info
expression_2 = Expression(q="-1", Expression="-q/100/100")

# ---- group: Flexural plate rigidity (Equ. 3)
expression_3 = Expression(E=disassemble.YoungsModulusKNCm2Dir12, nue=expression, h="10", Expression="E*h^3/(12*(1-nue^2))")

# ----
panel_2 = Panel(expression)
expression_4 = Expression(a=dedomain.End, Expression="a*100")
meshtoshell = MeshToShellKaramba3D(Mesh=mesh_breps.Mesh, CrossSection=cross_section, LimitDistance_m=0.005)  # -> Element, Points, Info
points_close_to_curve = PointsCloseToCurve(point=meshtoshell.Points, curve=boundary, tolerance=0.001)
mesh_breps_2 = MeshBrepsKaramba3D(
    Brep=boundary,
    MeshResolution=Slider(0.2, range=0.2..1),
    EdgeRefinementFactor=0.67,
    PointReduction=False,
    SmoothingStepSize=number_slider,
    SmoothingIterations=5)  # -> Mesh, Info
Z = UnitZ(Factor="-1")
num = Number(expression_2)
num_2 = Number(expression_4)
multiplication = Multiplication(A=num_2, B="2")
supp = SupportKaramba3D(PosInd=points_close_to_curve, menu=[buttons(on, on, on, off, off, on)])
loads = LoadsKaramba3D(Vector=Z, Mesh=mesh_breps_2.Mesh, LCase="0", mode="MeshLoad -Const.", menu=[buttons(off, on, off), buttons(on, on)])
assemble = AssembleModelKaramba3D(Elem=meshtoshell.Element, Support=supp, Load=loads, LimitDistance_m=0.005)  # -> Model, Info, Mass_kg, CenterOfGravity, LoadCaseNames

# ---- group: Circular plate / Circular plate, maximum displacement (equ. 68)
expression_5 = Expression(q=num, a=num_2, D=expression_3, nue=expression, Expression="(5+nue)*q*a^4/(64*(1+nue)*D)")

# ---- group: Circular plate / Circular plate, maximum bending moment (equ. 69 and 70)
expression_6 = Expression(q=num, nue=expression, a=num_2, Expression="(3+nue)/16*q*a^2")

# ---- group: Quadratic plate / Approximation (see below equ. 132)
expression_7 = Expression(q=num, a=multiplication, D=expression_3, Expression="4*q*a^4/(π^6*D)")

# ---- group: Quadratic plate / Exact formula (equ. 132)
c_script = CSharpScript(q=num, a=multiplication, D=expression_3, nMax=Slider(30, range=1..30))  # -> out, wmax; inputs q: Double, a: Double, D: Double, nMax: Int32
# ---------- c_script: C# ----------
    double w = 0;
    for (int n = 1; n < nMax; n += 2) {
      for (int m = 1; m < nMax; m += 2) {
        w += Math.Pow(-1, (m + n) / 2 - 1) / (m * n * Math.Pow(m * m / (a * a) + n * n / (a * a), 2));
      }
    }
    w *= 16 * q / (Math.Pow(Math.PI, 6) * D);
    wmax = w;
# ---------- end c_script ----------
panel_3 = Panel(c_script.wmax)

# ---- group: Quadratic plate / See fig. 63
expression_8 = Expression(q=num, a=multiplication, Expression="0.0325*q*a^2")
expression_9 = Expression(q=num, a=multiplication, Expression="-0.0479*q*a^2")
panel_4 = Panel(expression_8)
panel_5 = Panel(expression_9)

# ----
expression_10 = Expression(q=num, a=multiplication, Expression="-0.065*q*a^2")
analyze = AnalyzeKaramba3D(Model=assemble.Model)  # -> CalculatedModel, MaximumDisplacement_cm, ResultingForceOfGravity_kN, ElasticEnergyChange_kNm
panel_6 = Panel(expression_10)

# ---- group: Quadratic plate
panel_7 = Panel(expression_7)

# ----
pt = ConstructPoint(XCoordinate=expr("-x", "8"), YCoordinate=0, ZCoordinate=0)
pt_2 = ConstructPoint(XCoordinate=expr("x", "8"), YCoordinate=0, ZCoordinate=0)

# ---- group: Circular plate
panel_8 = Panel(expression_5)
panel_9 = Panel(expression_6)

# ----
ln = Line(StartPoint=pt, EndPoint=pt_2)
rot3d = Rotate3D(Geometry=ln, Angle=degrees(Slider(45, range=0..45)), Center=Point(0, 0, 0), Axis=Vector(0, 0, 1))  # -> Geometry, Transform
Y = UnitY(Factor=Slider(0, range=-5..5))
move = Move(Geometry=rot3d.Geometry, Motion=Y)  # -> Geometry, Transform
Z_2 = UnitZ(Factor=1)
s_forces = ShellSectionKaramba3D(
    AnalyzedModel=analyze.CalculatedModel,
    Polyline=move.Geometry,
    ProjectionDirection=Z_2,
    mode="Displacements",
    menu=[checkbox(on), checkbox(off), checkbox(off), slider(20), slider(800), checkbox(off), checkbox(off), checkbox(on), checkbox(off), checkbox(off), slider(1)])  # -> AnalyzedModel, Polylines, FaceIndexes, MeshesOfRenderedResults, CurvesOfRenderedResults, XDisplacement_m, YDisplacement_m, ZDisplacement_m, ResultantTranslation_m
s_forces_2 = ShellSectionKaramba3D(
    AnalyzedModel=analyze.CalculatedModel,
    Polyline=move.Geometry,
    ProjectionDirection=Z_2,
    mode="Forces",
    menu=[checkbox(on), checkbox(on), checkbox(off), slider(20), slider(2), slider(2), checkbox(off), checkbox(off), checkbox(off), checkbox(on), checkbox(off), checkbox(off), checkbox(off), checkbox(off), checkbox(off), slider(1)])  # -> AnalyzedModel, Polylines, FaceIndexes, MeshesOfRenderedResults, CurvesOfRenderedResults, Ntt_kN_m, Nnn_kN_m, Ntn_kN_m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

# ---- group: FE results
bnd = Bounds(Numbers=s_forces_2.Mtt_kNm_m)
mmax = Panel(bnd)
wmax = Panel(analyze.MaximumDisplacement_cm)

# ----
modelview = ModelViewKaramba3D(Model=analyze.CalculatedModel, ResultFactors=1, ResultCase=-1)  # -> Model, DeformedMesh, DeformedAxes, DeformedModel
shellview = ShellViewKaramba3D(Model=modelview.Model, IndexOfLayer=0)  # -> Model, MeshesOfRenderedShells, LegendColors, LegendTags
legend = Legend(Colour=shellview.LegendColors, Tags=shellview.LegendTags, LegendType=1)
panel_10 = Panel("""False
False
True""")
cull = CullPattern(List=points_close_to_curve, CullPattern=panel_10)

# ---- group: See also figure 5.9 in 'Plates and FEM Surprises and Pitfalls', J. Blaauwendraad, ISBN 978-90-481-3595-0, Springer, 2010.
shelllineresults = LineResultsOnShellsKaramba3D(
    AnalyzedModel=shellview.Model,
    ListOfSourcesOfForceFlowLinesLinesPoints=cull,
    SegmentLength_m=0.5,
    DA_deg=5,
    mode="TransverseShear")  # -> AnalyzedModel, Lines

# ==== cluster PointsCloseToCurve
point = ClusterInput()
curve = ClusterInput()
tolerance = ClusterInput()
point_2 = Point(point)
curve_2 = Curve(reparameterize(curve))
tolerance_2 = Number(tolerance)
curve_closest_point = CurveClosestPoint(Point=point_2, Curve=curve_2)  # -> Point, Parameter, Distance
smaller_than = SmallerThan(FirstNumber=curve_closest_point.Distance, SecondNumber=tolerance_2)  # -> SmallerThan, OrEqualTo
cull_pattern = CullPattern(List=point_2, CullPattern=smaller_than.OrEqualTo)
point_3 = Point(cull_pattern)
point_4 = ClusterOutput(point_3)
