# Grasshopper definition 24_ShellsAndBeams.gh (Grasshopper 1.0.7)
# plug-ins: Karamba3D

number_slider = Slider(3, range=0..10)
planesrf = PlaneSurface(Plane=PlaneXY(0, 0, 0), XSize="20", YSize="20")
Z = UnitZ(Factor="4")
move = Move(Geometry=planesrf, Motion=Z)  # -> Geometry, Transform
sdivide = DivideSurface(Surface=planesrf, UCount=number_slider, VCount=number_slider)  # -> Points, Normals, Parameters
move_2 = Move(Geometry=sdivide.Points, Motion=Z)  # -> Geometry, Transform
matselect = MaterialSelectionKaramba3D(menu=[dropdown(7), dropdown(6)])
pline = PolyLine(Vertices=move_2.Geometry, Closed=False)
explode = Explode(Curve=pline, Recursive=True)  # -> Segments, Vertices
ln = Line(StartPoint=sdivide.Points, EndPoint=move_2.Geometry)
matselect_2 = MaterialSelectionKaramba3D(menu=[dropdown(7), dropdown(6)])
len = Length(Curve=explode.Segments)
number_slider_2 = Slider(34, range=0..100)
expression = Expression(x="80", y=number_slider_2, Expression="-(x/2-y/2)")
matselect_3 = MaterialSelectionKaramba3D(menu=[dropdown(7), dropdown(4)])
division = Division(A=len, B=Slider(1, range=0..10))
Z_2 = UnitZ(Factor=expression)
num = Number("50")
divide = DivideCurve(Curve=explode.Segments, Count=division, Kinks=False)  # -> Points, Tangents, Parameters
mesh_breps = MeshBrepsKaramba3D(
    Brep=move.Geometry,
    InclusionPoints=flatten([move_2.Geometry, divide.Points]),
    MeshResolution=1,
    EdgeRefinementFactor=0.67,
    PointReduction=False,
    SmoothingStepSize=0,
    SmoothingIterations=5)  # -> Mesh, Info
cross_section = CrossSectionKaramba3D(
    FamilyNameOfCrossSection="DefaultCroSec",
    Material=matselect,
    LocalEccentricity_cm=Z_2,
    Height_cm="80",
    UpperFlangeWidth_cm=num,
    LowerFlangeWidth_cm=num,
    mode="Trapezoid")
cross_section_2 = CrossSectionKaramba3D(
    FamilyNameOfCrossSection="DefaultCroSec",
    Material=matselect_2,
    Height_cm="50",
    UpperFlangeWidth_cm="50",
    LowerFlangeWidth_cm="50",
    mode="Trapezoid")
cross_section_3 = CrossSectionKaramba3D(FamilyNameOfCrossSection="DefaultCroSec", Material=matselect_3, Height_cm=number_slider_2, mode="Shell - Const")
pline_2 = PolyLine(Vertices=divide.Points, Closed=False)
Z_3 = UnitZ(Factor="-3")
supp = SupportKaramba3D(PosInd=sdivide.Points, menu=[buttons(on, on, on, on, on, on)])
loads = LoadsKaramba3D(Vector=Z_3, Mesh=mesh_breps.Mesh, LCase="0", mode="MeshLoad -Const.", menu=[buttons(off, on, off), buttons(on, off)])
linetobeam = LineToBeamKaramba3D(
    Line=ln,
    CrossSection=cross_section_2,
    New=True,
    Remove=True,
    LimitDistance_m=0.005,
    Bending=True,
    SetBucklingLength=True,
    ToPolylineMaxAngle=0.03,
    ToPolylineTolerance=0.01,
    ToPolylineMinEdgeLength=0.25)  # -> Element, Points, Info
linetobeam_2 = LineToBeamKaramba3D(
    Line=pline_2,
    CrossSection=cross_section,
    New=True,
    Remove=True,
    LimitDistance_m=0.005,
    Bending=True,
    SetBucklingLength=True,
    ToPolylineMaxAngle=0.03,
    ToPolylineTolerance=0.01,
    ToPolylineMinEdgeLength=0.25)  # -> Element, Points, Info
meshtoshell = MeshToShellKaramba3D(Mesh=mesh_breps.Mesh, CrossSection=cross_section_3, LimitDistance_m=0.005)  # -> Element, Points, Info
assemble = AssembleModelKaramba3D(
    Elem=flatten([meshtoshell.Element, linetobeam.Element, linetobeam_2.Element]),
    Support=flatten(supp),
    Load=loads,
    LimitDistance_m=0.005)  # -> Model, Info, Mass_kg, CenterOfGravity, LoadCaseNames
analyze = AnalyzeKaramba3D(Model=assemble.Model)  # -> CalculatedModel, MaximumDisplacement_cm, ResultingForceOfGravity_kN, ElasticEnergyChange_kNm
panel = Panel(analyze.MaximumDisplacement_cm)
modelview = ModelViewKaramba3D(Model=analyze.CalculatedModel, ResultFactors=1, ResultCase=-1)  # -> Model, DeformedMesh, DeformedAxes, DeformedModel
shellview = ShellViewKaramba3D(Model=modelview.Model, IndexOfLayer=0)  # -> Model, MeshesOfRenderedShells, LegendColors, LegendTags
beamview = BeamViewKaramba3D(Model=modelview.Model)  # -> Model, MeshesOfRenderedBeams, DeformedBeamAxes, LegendColors, LegendTags
legend = Legend(Colour=beamview.LegendColors, Tags=beamview.LegendTags, LegendType=1)
legend_2 = Legend(Colour=shellview.LegendColors, Tags=shellview.LegendTags, LegendType=1)
