# Grasshopper definition 26_PrincipalMomentsOnShell.gh (Grasshopper 1.0.7)
# plug-ins: Bifocals, Karamba3D

surface = Surface(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)
material_selection_karamba3d = MaterialSelectionKaramba3D(menu=[dropdown(7), dropdown(1)])
cross_section_karamba3d = CrossSectionKaramba3D(FamilyNameOfCrossSection="DefaultCroSec", Material=material_selection_karamba3d, Height_cm="10", mode="Shell - Const")
deconstruct_brep = DeconstructBrep(Brep=surface)  # -> Faces, Edges, Vertices
mesh_breps_karamba3d = MeshBrepsKaramba3D(
    Brep=surface,
    MeshResolution=Slider(1, range=0..10),
    EdgeRefinementFactor=0.67,
    PointReduction=False,
    SmoothingStepSize=0,
    SmoothingIterations=5)  # -> Mesh, Info
mesh_edges = MeshEdges(Mesh=mesh_breps_karamba3d.Mesh)  # -> NakedEdges, InteriorEdges, NonManifoldEdges
point = Point(deconstruct_brep.Vertices)
support_karamba3d = SupportKaramba3D(PosInd=point, menu=[buttons(on, on, on, off, off, on)])
mesh_to_shell_karamba3d = MeshToShellKaramba3D(Mesh=mesh_breps_karamba3d.Mesh, CrossSection=cross_section_karamba3d, LimitDistance_m=0.005)  # -> Element, Points, Info
loads_karamba3d = LoadsKaramba3D(Vector=Vector(0, 0, -1), LCase="0", mode="Gravity")
surface_2 = Surface(surface)
cross_section_karamba3d_2 = CrossSectionKaramba3D(cross_section_karamba3d)
support_karamba3d_2 = SupportKaramba3D(support_karamba3d)
load_karamba3d = LoadKaramba3D(loads_karamba3d)
point_2 = Point(mesh_to_shell_karamba3d.Points)
assemble_model_karamba3d = AssembleModelKaramba3D(
    Elem=flatten(mesh_to_shell_karamba3d.Element),
    Support=flatten(support_karamba3d),
    Load=flatten(loads_karamba3d),
    LimitDistance_m=0.005)  # -> Model, Info, Mass_kg, CenterOfGravity, LoadCaseNames
analyze_karamba3d = AnalyzeKaramba3D(Model=assemble_model_karamba3d.Model)  # -> CalculatedModel, MaximumDisplacement_cm, ResultingForceOfGravity_kN, ElasticEnergyChange_kNm
model_view_karamba3d = ModelViewKaramba3D(Model=analyze_karamba3d.CalculatedModel, ResultFactors=1, ResultCase=-1)  # -> Model, DeformedMesh, DeformedAxes, DeformedModel
panel = Panel("""0
1""")
cull_pattern = CullPattern(List=point_2, CullPattern=panel)
shell_view_karamba3d = ShellViewKaramba3D(Model=model_view_karamba3d.Model, IndexOfLayer=0)  # -> Model, MeshesOfRenderedShells, LegendColors, LegendTags
mesh_edges_2 = MeshEdges(Mesh=shell_view_karamba3d.MeshesOfRenderedShells)  # -> NakedEdges, InteriorEdges, NonManifoldEdges
point_3 = Point(cull_pattern)
line_results_on_shells_karamba3d = LineResultsOnShellsKaramba3D(
    AnalyzedModel=shell_view_karamba3d.Model,
    ListOfSourcesOfForceFlowLinesLinesPoints=point_3,
    SegmentLength_m=0.5,
    DA_deg=5,
    mode="PrincMoment")  # -> AnalyzedModel, Lines1, Lines2
curve = Curve(simplify(line_results_on_shells_karamba3d.Lines1))
curve_2 = Curve(simplify(line_results_on_shells_karamba3d.Lines2))
shift_paths = ShiftPaths(Data=curve, Offset=-1)
shift_paths_2 = ShiftPaths(Data=curve_2, Offset=-1)
join_curves = JoinCurves(Curves=shift_paths, Preserve=False)
join_curves_2 = JoinCurves(Curves=shift_paths_2, Preserve=False)
merge = Merge(Data1=join_curves, Data2=join_curves_2)  # -> flatten(Result)
surface_3 = Surface(surface_2)
surface_4 = Surface(reparameterize(surface_3))
project = Project(Curve=merge, Brep=surface_4, Direction=Vector(0, 0, 1))  # -> flatten(Curve)
surface_split = SurfaceSplit(Surface=surface_4, Curves=project)
brep_edges = BrepEdges(Brep=surface_split)  # -> Naked, Interior, NonManifold
explode = Explode(Curve=brep_edges.Naked, Recursive=True)  # -> Segments, Vertices
end_points = EndPoints(Curve=explode.Segments)  # -> Start, End
line = Line(StartPoint=end_points.Start, EndPoint=end_points.End)  # -> flatten(Line)
remove_duplicate_lines_karamba3d = RemoveDuplicateLinesKaramba3D(Line=line, LimitDistance=0.005)  # -> OutLine, Info, Indexes
point_on_curve = PointOnCurve(remove_duplicate_lines_karamba3d.OutLine, parameter=0.5)
surface_closest_point = SurfaceClosestPoint(Point=point_on_curve, Surface=surface_4)  # -> Point, UVPoint, Distance
material_selection_karamba3d_2 = MaterialSelectionKaramba3D(menu=[dropdown(7), dropdown(1)])
evaluate_surface = EvaluateSurface(Surface=surface_4, Point=surface_closest_point.UVPoint)  # -> Point, Normal, UDirection, VDirection, Frame
remove_duplicate_points_karamba3d = RemoveDuplicatePointsKaramba3D(Point=flatten(explode.Vertices), LimitDistance=0.005)  # -> OutPoint, Info, Indexes
cross_section_karamba3d_3 = CrossSectionKaramba3D(cross_section_karamba3d_2)
division = Division(A="10", B=2)
unit_vector = UnitVector(Vector=evaluate_surface.Normal)
division_2 = Division(A="20", B=2)
mesh_breps_karamba3d_2 = MeshBrepsKaramba3D(
    Brep=surface_3,
    InclusionPoints=remove_duplicate_points_karamba3d.OutPoint,
    MeshResolution=Slider(0.5, range=0..10),
    EdgeRefinementFactor=0.67,
    PointReduction=False,
    SmoothingStepSize=0,
    SmoothingIterations=5)  # -> Mesh, Info
negative = Negative(Value=unit_vector)
addition = Addition(A=division, B=division_2)
multiplication = Multiplication(A=negative, B=addition)
cross_section_karamba3d_4 = CrossSectionKaramba3D(
    FamilyNameOfCrossSection="DefaultCroSec",
    Material=material_selection_karamba3d_2,
    LocalEccentricity_cm=multiplication,
    Height_cm="20",
    UpperFlangeWidth_cm="5",
    LowerFlangeWidth_cm="5",
    mode="Trapezoid")
mesh_edges_3 = MeshEdges(Mesh=mesh_breps_karamba3d_2.Mesh)  # -> NakedEdges, InteriorEdges, NonManifoldEdges
mesh_to_shell_karamba3d_2 = MeshToShellKaramba3D(Mesh=mesh_breps_karamba3d_2.Mesh, CrossSection=cross_section_karamba3d_3, LimitDistance_m=0.005)  # -> Element, Points, Info
line_to_beam_karamba3d = LineToBeamKaramba3D(
    Line=remove_duplicate_lines_karamba3d.OutLine,
    CrossSection=cross_section_karamba3d_4,
    New=True,
    Remove=True,
    LimitDistance_m=0.005,
    ZOrientation=evaluate_surface.Normal,
    Bending=True,
    SetBucklingLength=True,
    ToPolylineMaxAngle=0.03,
    ToPolylineTolerance=0.01,
    ToPolylineMinEdgeLength=0.25)  # -> Element, Points, Info
support_karamba3d_3 = SupportKaramba3D(support_karamba3d_2)
load_karamba3d_2 = LoadKaramba3D(load_karamba3d)
assemble_model_karamba3d_2 = AssembleModelKaramba3D(
    Elem=flatten([mesh_to_shell_karamba3d_2.Element, line_to_beam_karamba3d.Element]),
    Support=flatten(support_karamba3d_3),
    Load=flatten(load_karamba3d_2),
    LimitDistance_m=0.005)  # -> Model, Info, Mass_kg, CenterOfGravity, LoadCaseNames
analyze_karamba3d_2 = AnalyzeKaramba3D(Model=assemble_model_karamba3d_2.Model)  # -> CalculatedModel, MaximumDisplacement_cm, ResultingForceOfGravity_kN, ElasticEnergyChange_kNm
model_view_karamba3d_2 = ModelViewKaramba3D(Model=analyze_karamba3d_2.CalculatedModel, ResultFactors=1, ResultCase=-1)  # -> Model, DeformedMesh, DeformedAxes, DeformedModel
beam_view_karamba3d = BeamViewKaramba3D(Model=model_view_karamba3d_2.Model)  # -> Model, MeshesOfRenderedBeams, DeformedBeamAxes, LegendColors, LegendTags
shell_view_karamba3d_2 = ShellViewKaramba3D(Model=model_view_karamba3d_2.Model, IndexOfLayer=0)  # -> Model, MeshesOfRenderedShells, LegendColors, LegendTags
mesh_edges_4 = MeshEdges(Mesh=beam_view_karamba3d.MeshesOfRenderedBeams)  # -> NakedEdges, InteriorEdges, NonManifoldEdges
mesh_edges_5 = MeshEdges(Mesh=shell_view_karamba3d_2.MeshesOfRenderedShells)  # -> NakedEdges, InteriorEdges, NonManifoldEdges
custom_preview = CustomPreview(Geometry=mesh_edges_4.InteriorEdges, Material="gray")
