# Grasshopper definition 27_InfluenceLines.gh (Grasshopper 1.0.7)
# plug-ins: Karamba3D

# Müller-Breslau's Principle
panel = Panel("0,1,0")
pt = Point([Point(-0.8891638063, 15.84278478, 0), Point(5.708283035, 15.38042936, 0), Point(12.92937004, 15.4220453, 0), Point(0.6756610495, 7.495171693, -0.8562972949), Point(7.742321103, 8.456903738, 7.254861739), Point(14.43608858, 6.191183089, 2.27974774), Point(0.971734617, -2.148380177, 0), Point(9.149802307, -3.109535809, -4.897652418), Point(17.65160661, -6.337229939, 0)])
pdecon = Deconstruct(Point=pt)  # -> XComponent, YComponent, ZComponent
X = UnitX(Factor=1)
pt_2 = Point(panel)
pt_3 = ConstructPoint(XCoordinate=pdecon.XComponent, YCoordinate=pdecon.YComponent, ZCoordinate=0)
line = LineSDL(Start=pt_2, Direction=X, Length=Slider(20, range=5..20))
number_slider = Slider(12, range=1..15)
md_slider = MDSlider(
    SliderMode=0,
    slider_value=Point(0.8137920659, 0.2772559189, 0.5),
    x_domain=Domain(0, 1),
    y_domain=Domain(0, 1),
    z_domain=Domain(0, 1))
md_slider_2 = MDSlider(
    SliderMode=0,
    slider_value=Point(0.3848079588, 0.391211533, 0.5),
    x_domain=Domain(0, 1),
    y_domain=Domain(0, 1),
    z_domain=Domain(0, 1))
divdist = DivideDistance(Curve=line, Distance="5.0")  # -> Points, Tangents, Parameters
srfgrid = SurfaceFromPoints(Points=pt_3, UCount="3", Interpolate=False)
pline = PolyLine(Vertices=divdist.Points, Closed=False)
split = SplitList(List=divdist.Points, Index="1")  # -> ListA, ListB
evalsrf = EvaluateSurface(Surface=srfgrid, Point=md_slider)  # -> Point, Normal, UDirection, VDirection, Frame
evalsrf_2 = EvaluateSurface(Surface=srfgrid, Point=md_slider_2)  # -> Point, Normal, UDirection, VDirection, Frame
mesh_uv = MeshSurface(Surface=srfgrid, UCount=number_slider, VCount=number_slider, Overhang=True, Equalize=False)
debrep = DeconstructBrep(Brep=srfgrid)  # -> Faces, Edges, Vertices
supp = SupportKaramba3D(PosInd=split.ListA, menu=[buttons(on, on, on, on, off, off)])
supp_2 = SupportKaramba3D(PosInd=split.ListB, menu=[buttons(off, on, on, off, off, off)])
vec = VectorXYZ(XComponent=0, YComponent="1", ZComponent=0)  # -> Vector, Length
vec_2 = VectorXYZ(XComponent=0, YComponent=0, ZComponent="1")  # -> Vector, Length
linetobeam = LineToBeamKaramba3D(
    Line=pline,
    New=True,
    Remove=True,
    LimitDistance_m=0.005,
    Bending=True,
    SetBucklingLength=True,
    ToPolylineMaxAngle=0.03,
    ToPolylineTolerance=0.01,
    ToPolylineMinEdgeLength=0.25)  # -> Element, Points, Info
crv = Curve(linetobeam.Element)
crv_2 = Curve(linetobeam.Element)
join = JoinCurves(Curves=crv, Preserve=False)
join_2 = JoinCurves(Curves=crv_2, Preserve=False)
element = ElementKaramba3D(crv)
c_script = CSharpScript(Pl=join, t=Slider(0.33, range=0..0.99))  # -> out, Elem_ind, Elem_t; inputs Pl: Polyline, t: Double
# ---------- c_script: C# ----------
    double l = Pl.Length;
    double pos = l * t;
    int ind = 0;
    foreach (Line seg in Pl.GetSegments()) {
      pos -= seg.Length;
      if (pos < 0) {
        Elem_ind = ind;
        Elem_t = 1.0 + pos / seg.Length;
        return;
      }
      ++ind;
    }
# ---------- end c_script ----------
element_2 = ElementKaramba3D(crv_2)
c_script_2 = CSharpScript(Pl=join_2, t=Slider(0.87, range=0..0.99))  # -> out, Elem_ind, Elem_t; inputs Pl: Polyline, t: Double; same code as c_script
item = ListItem(List=element_2, Index=c_script_2.Elem_ind, Wrap=True)
item_2 = ListItem(List=element, Index=c_script.Elem_ind, Wrap=True)
tri = Triangulate(Mesh=mesh_uv)  # -> Mesh, Count
Z = UnitZ(Factor="-1")
medges = MeshEdges(Mesh=tri.Mesh)  # -> NakedEdges, InteriorEdges, NonManifoldEdges
beam_loads = BeamLoadsKaramba3D(
    BeamIdentifier=item_2,
    LoadCase="Influence",
    RotationalGap=vec.Vector,
    TPosition=c_script.Elem_t,
    mode="Gap",
    menu=[buttons(on, off)])
beam_loads_2 = BeamLoadsKaramba3D(
    BeamIdentifier=item,
    LoadCase="Load",
    ForceVector=Z,
    TPosition=c_script_2.Elem_t,
    mode="Concentrated",
    menu=[buttons(off, on)])
support = SupportKaramba3D([supp, supp_2])
line_2 = Line([medges.NakedEdges, medges.InteriorEdges])
supp_3 = SupportKaramba3D(PosInd=debrep.Vertices, menu=[buttons(on, on, on, off, off, off)])
linetobeam_2 = LineToBeamKaramba3D(
    Line=line_2,
    New=True,
    Remove=True,
    LimitDistance_m=0.005,
    Bending=True,
    SetBucklingLength=True,
    ToPolylineMaxAngle=0.03,
    ToPolylineTolerance=0.01,
    ToPolylineMinEdgeLength=0.25)  # -> Element, Points, Info
crv_3 = Curve(linetobeam_2.Element)
crv_4 = Curve(linetobeam_2.Element)
midpt = CurveMiddle(Curve=crv_3)
midpt_2 = CurveMiddle(Curve=crv_4)
fsim = FindSimilarMember(Data=evalsrf.Point, Set=midpt)  # -> Hit, Index
fsim_2 = FindSimilarMember(Data=evalsrf_2.Point, Set=midpt_2)  # -> Hit, Index
item_3 = ListItem(List=fsim.Index, Index=0, Wrap=True)
item_4 = ListItem(List=fsim_2.Index, Index=0, Wrap=True)
load = LoadKaramba3D([beam_loads, beam_loads_2])
assemble = AssembleModelKaramba3D(Elem=linetobeam.Element, Support=support, Load=load, LimitDistance_m=0.005)  # -> Model, Info, Mass_kg, CenterOfGravity, LoadCaseNames
item_5 = ListItem(List=crv_3, Index=item_3, Wrap=True)
item_6 = ListItem(List=crv_4, Index=item_4, Wrap=True)
crv_cp = CurveClosestPoint(Point=evalsrf.Point, Curve=reparameterize(item_5))  # -> Point, Parameter, Distance
crv_cp_2 = CurveClosestPoint(Point=evalsrf_2.Point, Curve=reparameterize(item_6))  # -> Point, Parameter, Distance
vec_3 = VectorXYZ(XComponent=0, YComponent="1", ZComponent=0)  # -> Vector, Length
vec_4 = VectorXYZ(XComponent=0, YComponent=0, ZComponent="1")  # -> Vector, Length
vec_5 = VectorXYZ(XComponent=0, YComponent="1", ZComponent=0)  # -> Vector, Length
Z_2 = UnitZ(Factor="-1")
element_3 = ElementKaramba3D(item_5)
element_4 = ElementKaramba3D(item_6)
analyze = AnalyzeKaramba3D(Model=assemble.Model)  # -> CalculatedModel, MaximumDisplacement_cm, ResultingForceOfGravity_kN, ElasticEnergyChange_kNm
beam_loads_3 = BeamLoadsKaramba3D(
    BeamIdentifier=element_3,
    LoadCase="Influence",
    RotationalGap=vec_3.Vector,
    TPosition=crv_cp.Parameter,
    mode="Gap",
    menu=[buttons(on, off)])
beam_loads_4 = BeamLoadsKaramba3D(
    BeamIdentifier=element_4,
    LoadCase="Load",
    ForceVector=Z_2,
    TPosition=crv_cp_2.Parameter,
    mode="Concentrated",
    menu=[buttons(off, on)])
b_forces = BeamForcesKaramba3D(AnalyzedModel=analyze.CalculatedModel, BeamsIdentifiers=item_2, LoadCase="Load", Ts=c_script.Elem_t)  # -> AnalyzedModel, NormalForce_kN, ShearForceVz_kN, ShearForceVy_kN, TorsionalMomentMt_kNm, BendingMomentMy_kNm, BendingMomentMz_kNm
beamdisp = BeamDisplacementsKaramba3D(AnalyzedModel=analyze.CalculatedModel, BeamsIdentifiers=item, LoadCase="Influence", Ts=c_script_2.Elem_t)  # -> AnalyzedModel, Translations_m, Rotations_rad
load_2 = LoadKaramba3D(flatten([beam_loads_3, beam_loads_4]))
assemble_2 = AssembleModelKaramba3D(Elem=linetobeam_2.Element, Support=supp_3, Load=load_2, LimitDistance_m=0.005)  # -> Model, Info, Mass_kg, CenterOfGravity, LoadCaseNames
dprod = DotProduct(VectorA=beamdisp.Translations_m, VectorB=Z, Unitize=False)
analyze_2 = AnalyzeKaramba3D(Model=assemble_2.Model)  # -> CalculatedModel, MaximumDisplacement_cm, ResultingForceOfGravity_kN, ElasticEnergyChange_kNm
b_forces_2 = BeamForcesKaramba3D(AnalyzedModel=analyze_2.CalculatedModel, BeamsIdentifiers=element_3, LoadCase="Load", Ts=crv_cp.Parameter)  # -> AnalyzedModel, NormalForce_kN, ShearForceVz_kN, ShearForceVy_kN, TorsionalMomentMt_kNm, BendingMomentMy_kNm, BendingMomentMz_kNm
beamdisp_2 = BeamDisplacementsKaramba3D(AnalyzedModel=analyze_2.CalculatedModel, BeamsIdentifiers=element_4, LoadCase="Influence", Ts=crv_cp_2.Parameter)  # -> AnalyzedModel, Translations_m, Rotations_rad
panel_2 = Panel(b_forces.ShearForceVz_kN)
panel_3 = Panel(b_forces.BendingMomentMy_kNm)
panel_4 = Panel(dprod)
dprod_2 = DotProduct(VectorA=beamdisp_2.Translations_m, VectorB=Z_2, Unitize=False)
modelview = ModelViewKaramba3D(Model=analyze.CalculatedModel, ResultFactors=1, ResultCase=-1)  # -> Model, DeformedMesh, DeformedAxes, DeformedModel
panel_5 = Panel(b_forces_2.ShearForceVz_kN)
panel_6 = Panel(b_forces_2.BendingMomentMy_kNm)
panel_7 = Panel(dprod_2)
crv_5 = Curve(modelview.DeformedAxes)
modelview_2 = ModelViewKaramba3D(Model=analyze_2.CalculatedModel, ResultFactors=1, ResultCase=-1)  # -> Model, DeformedMesh, DeformedAxes, DeformedModel
beamview = BeamViewKaramba3D(Model=modelview.Model)  # -> Model, MeshesOfRenderedBeams, DeformedBeamAxes, LegendColors, LegendTags
beamview_2 = BeamViewKaramba3D(Model=modelview_2.Model)  # -> Model, MeshesOfRenderedBeams, DeformedBeamAxes, LegendColors, LegendTags
