# Grasshopper definition 32_Hops_MomentsOnShell.gh (Grasshopper 1.0.7)
# plug-ins: Karamba3D

model_json = GetString(AtLeast=1, AtMost=2147483647, TreeAccess=True)
surface = GetGeometry(AtLeast=1, AtMost=2147483647, DeleteInput=False, Filter=1073741848, TreeAccess=True)
curves = GetGeometry(AtLeast=1, AtMost=2147483647, DeleteInput=False, Filter=1073741828, TreeAccess=True)
beam_height = GetNumber(AtLeast=1, AtMost=1, Maximum=1.797693135e+308, Minimum=-1.797693135e+308, TreeAccess=False)
beam_width = GetNumber(AtLeast=1, AtMost=1, Maximum=1.797693135e+308, Minimum=-1.797693135e+308, TreeAccess=False)
additional_inclusion_points = GetGeometry(AtLeast=0, AtMost=2147483647, DeleteInput=False, Filter=1073741825, TreeAccess=True)
import_model_from_json_or_bson_karamba3d = ImportModelFromJSONOrBSONKaramba3D(JBSON=model_json, ImportFromBSON=False)
point = Point(flatten(additional_inclusion_points))
model_karamba3d = ModelKaramba3D(import_model_from_json_or_bson_karamba3d)
surface_2 = Surface(surface)
curve = Curve(curves)
number = Number(beam_height)
number_2 = Number(beam_width)
surface_3 = Surface(reparameterize(surface_2))
curve_2 = Curve(curve)
panel = Panel(number)
panel_2 = Panel(number_2)
project = Project(Curve=curve_2, Brep=surface_3, Direction=Vector(0, 0, 1))  # -> flatten(Curve)
disassemble_model_karamba3d = DisassembleModelKaramba3D(Model=model_karamba3d)  # -> Model, Point, Beam, Shell, Support, Load, Line, Mesh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
surface_split = SurfaceSplit(Surface=surface_3, Curves=project)
disassemble_element_karamba3d = DisassembleElementKaramba3D(Element=disassemble_model_karamba3d.Shell)  # -> Element, ElementIdentifier, AxisOfElement, CrossSection, Joint, Material, LocalCoordinateSystem, ElementIsActive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
disassemble_element_karamba3d_2 = DisassembleElementKaramba3D(Element=disassemble_model_karamba3d.Beam)  # -> Element, ElementIdentifier, AxisOfElement, CrossSection, Joint, Material, LocalCoordinateSystem, ElementIsActive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
brep_edges = BrepEdges(Brep=surface_split)  # -> Naked, Interior, NonManifold
load_karamba3d = LoadKaramba3D(disassemble_model_karamba3d.Load)
point_2 = Point(point)
cross_section_karamba3d = CrossSectionKaramba3D(disassemble_element_karamba3d.CrossSection)
support_karamba3d = SupportKaramba3D(disassemble_model_karamba3d.Support)
element_karamba3d = ElementKaramba3D(disassemble_element_karamba3d_2.Element)
explode = Explode(Curve=brep_edges.Naked, Recursive=True)  # -> Segments, Vertices
end_points = EndPoints(Curve=explode.Segments)  # -> Start, End
line = Line(StartPoint=end_points.Start, EndPoint=end_points.End)  # -> flatten(Line)
remove_duplicate_lines_karamba3d = RemoveDuplicateLinesKaramba3D(Line=line, LimitDistance=0.005)  # -> OutLine, Info, Indexes
point_on_curve = PointOnCurve(remove_duplicate_lines_karamba3d.OutLine, parameter=0.5)
disassemble_cross_section_karamba3d = DisassembleCrossSectionKaramba3D(CroSec=disassemble_element_karamba3d.CrossSection)  # -> CrossSection, FamilyNameOfCrossSection, TypeNameOfCrossSection, ElemIdentifiers, Color, Material, LocalEccentricity_cm, Heights_cm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
surface_closest_point = SurfaceClosestPoint(Point=point_on_curve, Surface=surface_3)  # -> Point, UVPoint, Distance
evaluate_surface = EvaluateSurface(Surface=surface_3, Point=surface_closest_point.UVPoint)  # -> Point, Normal, UDirection, VDirection, Frame
remove_duplicate_points_karamba3d = RemoveDuplicatePointsKaramba3D(Point=flatten([explode.Vertices, point_2]), LimitDistance=0.005)  # -> OutPoint, Info, Indexes
division = Division(A=disassemble_cross_section_karamba3d.Heights_cm, B=2)
unit_vector = UnitVector(Vector=evaluate_surface.Normal)
panel_3 = Panel(panel)
division_2 = Division(A=panel_3, B=2)
panel_4 = Panel(panel_2)
mesh_breps_karamba3d = MeshBrepsKaramba3D(
    Brep=surface_3,
    InclusionPoints=remove_duplicate_points_karamba3d.OutPoint,
    MeshResolution=Slider(0.1, range=0..10),
    EdgeRefinementFactor=0.67,
    PointReduction=False,
    SmoothingStepSize=0,
    SmoothingIterations=5)  # -> Mesh, Info
negative = Negative(Value=unit_vector)
addition = Addition(A=division, B=division_2)
cross_section_karamba3d_2 = CrossSectionKaramba3D(cross_section_karamba3d)
support_karamba3d_2 = SupportKaramba3D(support_karamba3d)
load_karamba3d_2 = LoadKaramba3D(load_karamba3d)
element_karamba3d_2 = ElementKaramba3D(element_karamba3d)
multiplication = Multiplication(A=negative, B=addition)
cross_section_karamba3d_3 = CrossSectionKaramba3D(
    FamilyNameOfCrossSection="DefaultCroSec",
    Material=disassemble_cross_section_karamba3d.Material,
    LocalEccentricity_cm=multiplication,
    Height_cm=panel_3,
    UpperFlangeWidth_cm=panel_4,
    LowerFlangeWidth_cm=panel_4,
    mode="Trapezoid")
mesh_edges = MeshEdges(Mesh=mesh_breps_karamba3d.Mesh)  # -> NakedEdges, InteriorEdges, NonManifoldEdges
mesh_to_shell_karamba3d = MeshToShellKaramba3D(Mesh=mesh_breps_karamba3d.Mesh, CrossSection=cross_section_karamba3d_2, LimitDistance_m=0.005)  # -> Element, Points, Info
line_to_beam_karamba3d = LineToBeamKaramba3D(
    Line=remove_duplicate_lines_karamba3d.OutLine,
    CrossSection=cross_section_karamba3d_3,
    New=True,
    Remove=True,
    LimitDistance_m=0.005,
    ZOrientation=evaluate_surface.Normal,
    Bending=True,
    SetBucklingLength=True,
    ToPolylineMaxAngle=0.03,
    ToPolylineTolerance=0.01,
    ToPolylineMinEdgeLength=0.25)  # -> Element, Points, Info
element_karamba3d_3 = ElementKaramba3D([mesh_to_shell_karamba3d.Element, line_to_beam_karamba3d.Element, element_karamba3d_2])
assemble_model_karamba3d = AssembleModelKaramba3D(
    Elem=flatten(element_karamba3d_3),
    Support=flatten(support_karamba3d_2),
    Load=flatten(load_karamba3d_2),
    LimitDistance_m=0.005)  # -> Model, Info, Mass_kg, CenterOfGravity, LoadCaseNames
analyze_karamba3d = AnalyzeKaramba3D(Model=assemble_model_karamba3d.Model)  # -> CalculatedModel, MaximumDisplacement_cm, ResultingForceOfGravity_kN, ElasticEnergyChange_kNm
export_model_to_json_bson_karamba3d = ExportModelToJSONBSONKaramba3D(Model=analyze_karamba3d.CalculatedModel, ExportToBSON=False)
license_karamba3d = LicenseKaramba3D()
panel_5 = Panel(license_karamba3d)

# ---- group: RH_OUT: Info
text = Text(license_karamba3d)

# ---- group: RH_OUT: Model JSON
text_2 = Text(export_model_to_json_bson_karamba3d)
