# Grasshopper definition 32_Nervi.gh (Grasshopper 1.0.7)
# plug-ins: Karamba3D, Hops

number_slider = Slider(10, range=5..50)
rectangle = Rectangle(Plane=PlaneXY(0, 0, 0), XSize=number_slider, YSize=number_slider, Radius=0)  # -> Rectangle, Length
unit_z = UnitZ(Factor=Slider(5, range=5..50))
move = Move(Geometry=rectangle.Rectangle, Motion=unit_z)  # -> Geometry, Transform
negative = Negative(Value=unit_z)
boundary_surfaces = BoundarySurfaces(Edges=move.Geometry)  # -> reparameterize(Surfaces)
md_slider = MDSlider(SliderMode=0, slider_value=Point(0.5, 0.5, 0.5), x_domain=Domain(0, 1), y_domain=Domain(0, 1), z_domain=Domain(0, 1))
evaluate_surface = EvaluateSurface(Surface=boundary_surfaces, Point=md_slider)  # -> Point, Normal, UDirection, VDirection, Frame
point = Point(evaluate_surface.Point)
surface = Surface(boundary_surfaces)
surface_2 = Surface(surface)
curve = Curve(move.Geometry)
move_2 = Move(Geometry=point, Motion=negative)  # -> Geometry, Transform
material_selection_karamba3d = MaterialSelectionKaramba3D(menu=[dropdown(7), dropdown(1)])
point_2 = Point(point)
line = Line(StartPoint=move_2.Geometry, EndPoint=point)
cross_section_karamba3d = CrossSectionKaramba3D(
    FamilyNameOfCrossSection="DefaultCroSec",
    Material=material_selection_karamba3d,
    Height_cm="50",
    UpperFlangeWidth_cm="50",
    LowerFlangeWidth_cm="50",
    mode="Trapezoid")
cross_section_karamba3d_2 = CrossSectionKaramba3D(FamilyNameOfCrossSection="DefaultCroSec", Material=material_selection_karamba3d, Height_cm="20", mode="Shell - Const")
mesh_breps_karamba3d = MeshBrepsKaramba3D(
    Brep=surface,
    InclusionPoints=point,
    MeshResolution="0.1",
    EdgeRefinementFactor=0.67,
    PointReduction=False,
    SmoothingStepSize=0,
    SmoothingIterations=5)  # -> Mesh, Info
line_to_beam_karamba3d = LineToBeamKaramba3D(
    Line=line,
    CrossSection=cross_section_karamba3d,
    New=True,
    Remove=True,
    LimitDistance_m=0.005,
    Bending=True,
    SetBucklingLength=True,
    ToPolylineMaxAngle=0.03,
    ToPolylineTolerance=0.01,
    ToPolylineMinEdgeLength=0.25)  # -> Element, Points, Info
support_karamba3d = SupportKaramba3D(PosInd=move_2.Geometry, menu=[buttons(on, on, on, off, off, on)])
mesh_to_shell_karamba3d = MeshToShellKaramba3D(Mesh=mesh_breps_karamba3d.Mesh, CrossSection=cross_section_karamba3d_2, LimitDistance_m=0.005)  # -> Element, Points, Info
cluster = Cluster_2(point=mesh_to_shell_karamba3d.Points, X=number_slider, tolerance=0.001)
cluster_2 = Cluster_2(point=mesh_to_shell_karamba3d.Points, Y=number_slider, tolerance=0.001)
loads_karamba3d = LoadsKaramba3D(Vector=Vector(0, 0, -1), LCase="0", mode="Gravity")
element_karamba3d = ElementKaramba3D(flatten([line_to_beam_karamba3d.Element, mesh_to_shell_karamba3d.Element]))
support_karamba3d_2 = SupportKaramba3D(PosInd=cluster, menu=[buttons(on, off, off, off, on, off)])
support_karamba3d_3 = SupportKaramba3D(PosInd=cluster_2, menu=[buttons(off, on, off, on, off, off)])
list_item = ListItem(List=cluster, Index=0, Wrap=True)
list_item_2 = ListItem(List=cluster_2, Index=0, Wrap=True)
inclusion_points = Point([cluster, cluster_2, point])
yz_plane = YZPlane(Origin=list_item)
xz_plane = XZPlane(Origin=list_item_2)
support_karamba3d_4 = SupportKaramba3D(flatten([support_karamba3d_2, support_karamba3d_3, support_karamba3d]))
assemble_model_karamba3d = AssembleModelKaramba3D(Elem=element_karamba3d, Support=flatten(support_karamba3d_4), Load=loads_karamba3d, LimitDistance_m=0.005)  # -> Model, Info, Mass_kg, CenterOfGravity, LoadCaseNames
analyze_karamba3d = AnalyzeKaramba3D(Model=assemble_model_karamba3d.Model)  # -> CalculatedModel, MaximumDisplacement_cm, ResultingForceOfGravity_kN, ElasticEnergyChange_kNm
model_karamba3d = ModelKaramba3D(analyze_karamba3d.CalculatedModel)
model_view_karamba3d = ModelViewKaramba3D(Model=analyze_karamba3d.CalculatedModel, ResultFactors=1, ResultCase=-1)  # -> Model, DeformedMesh, DeformedAxes, DeformedModel
beam_view_karamba3d = BeamViewKaramba3D(Model=model_view_karamba3d.Model)  # -> Model, MeshesOfRenderedBeams, DeformedBeamAxes, LegendColors, LegendTags
shell_view_karamba3d = ShellViewKaramba3D(Model=model_view_karamba3d.Model, IndexOfLayer=0)  # -> Model, MeshesOfRenderedShells, LegendColors, LegendTags
point_3 = Point(point_2)
deconstruct = Deconstruct(Point=point_3)  # -> XComponent, YComponent, ZComponent
circle = Circle(Plane=point_3, Radius=Slider(1, range=0..2))
construct_point = ConstructPoint(XCoordinate="0", YCoordinate=deconstruct.YComponent, ZCoordinate=deconstruct.ZComponent)
divide_curve = DivideCurve(Curve=circle, Count=Slider(10, range=1..20), Kinks=False)  # -> Points, Tangents, Parameters
line_2 = Line(StartPoint=point_3, EndPoint=construct_point)
range = Range(Domain="0.3 TO 0.95", Steps=Slider(3, range=0..10))
merge = Merge(
    Data1=Slider(0.3, range=0..1),
    Data2=Slider(0.45, range=0..1),
    Data3=Slider(0.6, range=0..1),
    Data4=Slider(0.8, range=0..1),
    Data5=Slider(0.95, range=0..1))
custom_preview = CustomPreview(Geometry=[divide_curve.Points, point_3], Material=ColourSwatch(SwatchColor=RGB(0, 255, 217)))
evaluate_curve = EvaluateCurve(Curve=reparameterize(line_2), Parameter=range)  # -> Point, Tangent, Angle
model_karamba3d_2 = ModelKaramba3D(model_karamba3d)
line_results_on_shells_karamba3d = LineResultsOnShellsKaramba3D(
    AnalyzedModel=model_karamba3d_2,
    ListOfSourcesOfForceFlowLinesLinesPoints=evaluate_curve.Point,
    SegmentLength_m=1,
    DA_deg=5,
    mode="PrincMoment")  # -> AnalyzedModel, Lines1, Lines2
line_results_on_shells_karamba3d_2 = LineResultsOnShellsKaramba3D(
    AnalyzedModel=model_karamba3d_2,
    ListOfSourcesOfForceFlowLinesLinesPoints=divide_curve.Points,
    SegmentLength_m=0.5,
    DA_deg=5,
    mode="PrincMoment")  # -> AnalyzedModel, Lines1, Lines2
dispatch_branches = CSharpScript(Lines=line_results_on_shells_karamba3d_2.Lines1, Crv=circle)  # -> out, A, B; inputs Lines: tree of Curve, Crv: Curve
# ---------- dispatch_branches: C# ----------
    var output0 = new DataTree<object>();
    var output1 = new DataTree<object>();

    for(int i = 0; i < _Lines.BranchCount; i++)
    {
      if(IsPointInside(_Crv, _Lines.Branch(i)[0].PointAt(0.5)))
        output0.AddRange(_Lines.Branch(i), _Lines.Path(i));
      else
        output1.AddRange(_Lines.Branch(i), _Lines.Path(i));
    }

    A = output0;
    B = output1;
# ---------- dispatch_branches: C# additional code ----------
  public bool IsPointInside(Curve curve, Point3d point)
  {
    var bBox = curve.GetBoundingBox(false);
    var plane = Plane.WorldXY;
    if (!curve.TryGetPlane(out plane, bBox.Min.DistanceTo(bBox.Max)))
    {
      plane = Plane.WorldXY;
    }
    point = plane.ClosestPoint(point);

    bool returnVal = false;
    switch (curve.Contains(point, plane, 1e-3))
    {
      case PointContainment.Inside:
        returnVal = true;
        break;
      case PointContainment.Coincident:
        returnVal = true;
        break;
      case PointContainment.Outside:
        returnVal = false;
        break;
      case PointContainment.Unset:
        this.Component.AddRuntimeMessage(GH_RuntimeMessageLevel.Error, "Curve Point relationship cannot be determined.");
        break;
    }
    return returnVal;
  }
# ---------- end dispatch_branches ----------
curve_2 = Curve(simplify(line_results_on_shells_karamba3d.Lines2))
join_curves = JoinCurves(Curves=curve_2, Preserve=False)  # -> simplify(Curves)
list_item_3 = ListItem(List=curve_2, Index=0, Wrap=True)
curve_3 = Curve(dispatch_branches.B)
end_points = EndPoints(Curve=list_item_3)  # -> Start, End
join_curves_2 = JoinCurves(Curves=curve_3, Preserve=False)  # -> flatten(Curves)
shift_paths = ShiftPaths(Data=join_curves, Offset=-1)
plane_normal = PlaneNormal(Origin=end_points.Start, ZAxis=list_item_3)
explode = Explode(Curve=graft(join_curves_2), Recursive=True)  # -> Segments, Vertices
join_curves_3 = JoinCurves(Curves=shift_paths, Preserve=False)  # -> reparameterize(simplify(Curves))
shift_paths_2 = ShiftPaths(Data=plane_normal, Offset=-1)
list_item_4 = ListItem(List=shift_paths_2, Index=0, Wrap=True)
cull_index = CullIndex(List=explode.Vertices, Indices="-1", Wrap=True)
curve_plane = CurvePlane(Curve=join_curves_3, Plane=list_item_4)  # -> Points, ParamsC, ParamsP
c_script = CSharpScript(List=cull_index, n="10")  # -> out, simplify(A); inputs List: list, n: Int32
# ---------- c_script: C# usings ----------
using System.Linq;
# ---------- c_script: C# ----------
    A = _List.Where((x, i) => (i) % _n == 0);
# ---------- end c_script ----------
list_item_5 = ListItem(List=c_script.A, Index=0, Wrap=True)  # -> Item1, Item
list_item_6 = ListItem(List=curve_plane.ParamsC, Index=0, Wrap=True)  # -> Item, Item1, Item2
point_4 = Point(list_item_5.Item1)
curve_4 = Curve(curve)
shatter = Shatter(Curve=join_curves_3, Parameters=simplify([list_item_6.Item, list_item_6.Item2]))
curve_closest_point = CurveClosestPoint(Point=point_4, Curve=curve_4)  # -> simplify(Point), Parameter, Distance
list_item_7 = ListItem(List=shatter, Index=0, Wrap=True)  # -> Item, Item1, Item2
merge_2 = Merge(Data1=c_script.A, Data2=curve_closest_point.Point)
curve_5 = Curve(list_item_7.Item1)
explode_2 = Explode(Curve=curve_5, Recursive=True)  # -> Segments, Vertices
polyline = PolyLine(Vertices=merge_2, Closed=False)  # -> simplify(Polyline)
cull_index_2 = CullIndex(List=explode_2.Vertices, Indices="-1", Wrap=True)
custom_preview_2 = CustomPreview(Geometry=polyline, Material=ColourSwatch(SwatchColor=RGB(0, 42, 255)))
c_script_2 = CSharpScript(List=cull_index_2, n="10")  # -> out, A; inputs List: list, n: Int32; same code as c_script
polyline_2 = PolyLine(Vertices=c_script_2.A, Closed=invert(False))  # -> simplify(Polyline)
custom_preview_3 = CustomPreview(Geometry=polyline_2, Material=ColourSwatch(SwatchColor=RGB(255, 157, 0)))
curve_6 = Curve(polyline_2)
curve_7 = Curve(polyline)
inclusion_points_2 = Point(inclusion_points)
surface_3 = Surface(reparameterize(surface_2))
panel = Panel("https://github.com/karamba3d/K3D_Tools/raw/main/TidBits/32_Hops_MomentsOnShell.gh")
flatten_tree = FlattenTree(Tree=[curve_6, curve_7], Path="{0}")
flatten_tree_2 = FlattenTree(Tree=inclusion_points_2, Path="{0}")
model_karamba3d_3 = ModelKaramba3D(model_karamba3d_2)
export_model_to_json_bson_karamba3d = ExportModelToJSONBSONKaramba3D(Model=model_karamba3d_3, ExportToBSON=False)
hops = Hops(
    _Path=panel,
    _Enabled=Toggle(True),
    ModelJSON=export_model_to_json_bson_karamba3d,
    Surface=surface_3,
    Curves=flatten_tree,
    BeamHeight="40",
    BeamWidth="20",
    AdditionalInclusionPoints=flatten_tree_2,
    CacheResultsInMemory=False,
    CacheSolveResults=False,
    RemoteDefinitionLocation="https://github.com/karamba3d/K3D_Tools/raw/main/TidBits/32_Hops_MomentsOnShell.gh",
    RemoteSolveVersion=(0, 1, 0),
    ShowInput_Enabled=True,
    ShowInput_Path=True,
    SynchronousSolve=False)  # -> Info, ModelJSON
import_model_from_json_or_bson_karamba3d = ImportModelFromJSONOrBSONKaramba3D(JBSON=hops.ModelJSON, ImportFromBSON=False)
panel_2 = Panel(hops.Info)
analyze_karamba3d_2 = AnalyzeKaramba3D(Model=import_model_from_json_or_bson_karamba3d)  # -> CalculatedModel, MaximumDisplacement_cm, ResultingForceOfGravity_kN, ElasticEnergyChange_kNm
model_view_karamba3d_2 = ModelViewKaramba3D(Model=analyze_karamba3d_2.CalculatedModel, ResultFactors=1, ResultCase=-1)  # -> Model, DeformedMesh, DeformedAxes, DeformedModel
beam_view_karamba3d_2 = BeamViewKaramba3D(Model=model_view_karamba3d_2.Model)  # -> Model, MeshesOfRenderedBeams, DeformedBeamAxes, LegendColors, LegendTags
shell_view_karamba3d_2 = ShellViewKaramba3D(Model=model_view_karamba3d_2.Model, IndexOfLayer=0)  # -> Model, MeshesOfRenderedShells, LegendColors, LegendTags
mirror = Mirror(Geometry=beam_view_karamba3d_2.MeshesOfRenderedBeams, Plane=yz_plane)  # -> Geometry, Transform
mirror_2 = Mirror(Geometry=shell_view_karamba3d_2.MeshesOfRenderedShells, Plane=yz_plane)  # -> Geometry, Transform
mirror_3 = Mirror(Geometry=[mirror.Geometry, beam_view_karamba3d_2.MeshesOfRenderedBeams], Plane=xz_plane)  # -> flatten(Geometry), Transform
mirror_4 = Mirror(Geometry=[shell_view_karamba3d_2.MeshesOfRenderedShells, mirror_2.Geometry], Plane=xz_plane)  # -> flatten(Geometry), Transform
mesh_edges = MeshEdges(Mesh=[beam_view_karamba3d_2.MeshesOfRenderedBeams, mirror_3.Geometry, mirror.Geometry])  # -> NakedEdges, InteriorEdges, NonManifoldEdges
custom_preview_4 = CustomPreview(Geometry=mesh_edges.InteriorEdges, Material="gray")

# ==== cluster Cluster_2

# ---- group: Tolerance
point = ClusterInput()  # Point

X = ClusterInput()  # Number or Interval

Y = ClusterInput()  # Number or Interval

Z = ClusterInput()  # Number or Interval

# ---- group: Cluster Input
tolerance = ClusterInput()  # Tolerance

# ----
tolerance_2 = Number(tolerance)
point_2 = Point(point)
X_2 = Data(X)
Y_2 = Data(Y)
Z_2 = Data(Z)
deconstruct = Deconstruct(Point=point_2)  # -> XComponent, YComponent, ZComponent
absolute = Absolute(Value=tolerance_2)

# ---- group: Check if Input is Number or Interval
cluster = Cluster(data=X_2, tolerance=absolute)  # -> number_3, number_4

cluster_2 = Cluster(data=Y_2, tolerance=absolute)  # -> number_3, number_4

cluster_3 = Cluster(data=Z_2, tolerance=absolute)  # -> number_3, number_4

# ----
number = Number(deconstruct.XComponent)
number_2 = Number(deconstruct.YComponent)
number_3 = Number(deconstruct.ZComponent)
larger_than = LargerThan(FirstNumber=number, SecondNumber=cluster.number_3)  # -> LargerThan, OrEqualTo
smaller_than = SmallerThan(FirstNumber=number, SecondNumber=cluster.number_4)  # -> SmallerThan, OrEqualTo
larger_than_2 = LargerThan(FirstNumber=number_2, SecondNumber=cluster_2.number_3)  # -> LargerThan, OrEqualTo
smaller_than_2 = SmallerThan(FirstNumber=number_2, SecondNumber=cluster_2.number_4)  # -> SmallerThan, OrEqualTo
larger_than_3 = LargerThan(FirstNumber=number_3, SecondNumber=cluster_3.number_3)  # -> LargerThan, OrEqualTo
smaller_than_3 = SmallerThan(FirstNumber=number_3, SecondNumber=cluster_3.number_4)  # -> SmallerThan, OrEqualTo
gate_and = GateAnd(A=larger_than.OrEqualTo, B=smaller_than.OrEqualTo)
gate_and_2 = GateAnd(A=larger_than_2.OrEqualTo, B=smaller_than_2.OrEqualTo)
gate_and_3 = GateAnd(A=larger_than_3.OrEqualTo, B=smaller_than_3.OrEqualTo)
c_script = CSharpScript(value=X_2, bool=gate_and)  # -> out, result
# ---------- c_script: C# ----------
    if(_value == null)
      result_ = true;
    else result_ = _bool;
# ---------- end c_script ----------
c_script_2 = CSharpScript(value=Y_2, bool=gate_and_2)  # -> out, result; same code as c_script
c_script_3 = CSharpScript(value=Z_2, bool=gate_and_3)  # -> out, result; same code as c_script
gate_and_4 = GateAnd(A=c_script.result, B=c_script_2.result)
gate_and_5 = GateAnd(A=gate_and_4, B=c_script_3.result)
point_3 = Point(point_2)
cull_pattern = CullPattern(List=point_3, CullPattern=gate_and_5)
point_4 = Point(cull_pattern)

# ---- group: Cluster Output
point_5 = ClusterOutput(point_4)

# ==== cluster Cluster
data = ClusterInput()
tolerance = ClusterInput()
data_2 = Data(data)
c_script = CSharpScript(x=data_2)  # -> Gate
# ---------- c_script: C# ----------
    if(x.GetType() == typeof(Interval))
      Gate = false;
    else
      Gate = true;
# ---------- end c_script ----------
stream_gate = StreamGate(Stream=data_2, Gate=c_script)  # -> Target0, Target1
deconstruct_domain = DeconstructDomain(Domain=stream_gate.Target0)  # -> Start, End
tolerance_2 = Number(tolerance)
subtraction = Subtraction(A=deconstruct_domain.Start, B=tolerance_2)
addition = Addition(A=deconstruct_domain.End, B=tolerance_2)
subtraction_2 = Subtraction(A=stream_gate.Target1, B=tolerance_2)
addition_2 = Addition(A=stream_gate.Target1, B=tolerance_2)
stream_filter = StreamFilter(Gate=c_script, Stream0=[subtraction, addition], Stream1=[subtraction_2, addition_2])
list_item = ListItem(List=stream_filter, Index=0, Wrap=True)  # -> Item, Item1
number = Number(list_item.Item)
number_2 = Number(list_item.Item1)
number_3 = ClusterOutput(number)
number_4 = ClusterOutput(number_2)
