# Grasshopper definition 33_BucklingLength.gh (Grasshopper 1.0.7)
# plug-ins: Karamba3D, Bifocals

# ---- group: Cross Section Range Selector (Karamba3D)
crosecrselect = CrossSectionRangeSelectorKaramba3D(MaximumHeight_cm=-1, MaximumWidth_cm=-1, menu=[dropdown(1), dropdown(2), dropdown(1)])

# ----
# Buckling - Effective Length
panel = Panel("0,1,0")
Z = UnitZ(Factor=1)
line = LineSDL(Start=panel, Direction=Z, Length=Slider(15, range=1..30))
divide = DivideCurve(Curve=line, Count=10, Kinks=False)  # -> Points, Tangents, Parameters
range = Range(Domain=Domain(0, 1), Steps=10)
item = ListItem(List=crosecrselect, Index=Slider(50, range=1..50), Wrap=True)
end = EndPoints(Curve=line)  # -> Start, End
Z_2 = UnitZ(Factor="-100")
ln = Line(StartPoint="1,1,7.5", EndPoint="0,1,7.5")
shatter = Shatter(Curve=line, Parameters=range)
pline = PolyLine(Vertices=divide.Points, Closed=False)
supp = SupportKaramba3D(PosInd=end.Start, menu=[buttons(on, on, on, off, off, on)])
supp_2 = SupportKaramba3D(PosInd=end.End, menu=[buttons(on, on, off, off, off, on)])

# ---- group: Line to Beam (Karamba3D)
linetobeam = LineToBeamKaramba3D(
    Line=pline,
    CrossSection=item,
    New=True,
    Remove=True,
    LimitDistance_m=0.005,
    Bending=True,
    SetBucklingLength=True,
    ToPolylineMaxAngle=0.03,
    ToPolylineTolerance=0.01,
    ToPolylineMaxEdgeLength=0.25)  # -> flatten(Element), Points, Info

# ---- group: Loads (Karamba3D)
loads = LoadsKaramba3D(ForceVector=Z_2, Local=False, PosInd=end.End, LCase="0", mode="Point")

# ----
support = SupportKaramba3D([supp, supp_2])
load = LoadKaramba3D(loads)
modifyelem = ModifyElementKaramba3D(Beam=linetobeam.Element, BucklingLengthY_m=Slider(26, range=15..100), mode="Beam")
disassemble = DisassembleElementKaramba3D(Element=linetobeam.Element)  # -> Element, ElementIdentifier, AxisOfElement, CrossSection, Joint, Material, LocalCoordinateSystem, ElementIsActive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

# ---- group: Assemble Model (Karamba3D)
assemble = AssembleModelKaramba3D(Elem=modifyelem, Support=support, Load=load, LimitDistance_m=0.005)  # -> Model, Info, Mass_kg, CenterOfGravity, LoadCaseNames

# ----
panel_2 = Panel(disassemble.BucklingLengthY_m)
panel_3 = Panel(assemble.Mass_kg)

# ---- group: Disassemble Model (Karamba3D)
disassemble_2 = DisassembleModelKaramba3D(Model=assemble.Model)  # -> Model, Point, Beam, Shell, Support, Load, Line, Mesh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

# ---- group: Optimize Cross Section (Karamba3D)
opticrosec = OptimizeCrossSectionKaramba3D(
    Model=assemble.Model,
    CrossSections=crosecrselect,
    MaximumUtilization=1,
    UltimateLimitStateIterations=5,
    DisplacementIterations=5,
    NumberOfSamplePoints=3,
    ElasticDesign=True,
    GammaM0=1,
    GammaM1=1.1,
    SwayFrame=True)  # -> ModelWithOptimizedCrossSections, Info, Mass_kg, MaximumDisplacement_cm, ElasticEnergyChange_kNm

# ----
disassemble_3 = DisassembleElementKaramba3D(Element=disassemble_2.Beam)  # -> Element, ElementIdentifier, AxisOfElement, CrossSection, Joint, Material, LocalCoordinateSystem, ElementIsActive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
panel_4 = Panel(opticrosec.Mass_kg)
panel_5 = Panel(disassemble_3.BucklingLengthY_m)
panel_6 = Panel(disassemble_3.BucklingLengthZ_m)

# ---- group: Model View (Karamba3D)
modelview = ModelViewKaramba3D(Model=opticrosec.ModelWithOptimizedCrossSections, ResultFactors=1, ResultCase=-1)  # -> Model, DeformedMesh, DeformedAxes, DeformedModel

# ----
panel_7 = Panel(disassemble_3.BucklingLengthLT_m)

# ---- group: Beam View (Karamba3D)
beamview = BeamViewKaramba3D(Model=modelview.Model)  # -> Model, MeshesOfRenderedBeams, DeformedBeamAxes, LegendColors, LegendTags

# ----
legend = Legend(Colour=beamview.LegendColors, Tags=beamview.LegendTags, LegendType=1)
