# Grasshopper definition 01_BucklingBridge.gh (Grasshopper 1.0.7)
# Copyright: Karamba3D
# plug-ins: Karamba3D

# ---- group: Create Geometry
pt = Point(Point(5, 5, 0))
pt_2 = Point(Point(55, 5, 0))
spacing = Slider(2.8, range=0.5..5)
width = Slider(5, range=2..12)
height = Slider(4, range=0.5..10)
vec2pt = Vector2Pt(PointA=pt, PointB=pt_2, Unitize=False)  # -> Vector, Length
aligndim = AlignedDimension(Plane=PlaneXY(0, 0, 0), PointA=pt, PointB=pt_2, Offset=-5, Text="{0:0.00}", Size=1)
division = Division(A=vec2pt.Length, B=spacing)
panel = Panel("""-0.5
-0.5
0.0
0.5
0.5""")
panel_2 = Panel("""1
0
0
0
1""")
# 01 - Buckling Bridge
# Difficulty: Moderate (PRO version only)
# A U-shaped bridge is analyzed using Second Order Theory to view the buckling modes. Scroll through the loadcases to see how the structure buckles. The diagonal members are treated as truss elements.
# The vibrations of the bridge can be view with the Natural Vibrations component.
align = AlignPlane(Plane=pt, Direction=vec2pt.Vector)  # -> Plane, Angle
range = Range(Domain=vec2pt.Length, Steps=division)
multiplication = Multiplication(A=width, B=panel)
multiplication_2 = Multiplication(A=height, B=panel_2)
pt_3 = PointOriented(BasePlane=align.Plane, UComponent=range, VComponent=graft(multiplication), WComponent=graft(multiplication_2))  # -> simplify(Point)
pline = PolyLine(Vertices=pt_3, Closed=False)  # -> flatten(Polyline)
flip = FlipMatrix(Data=pt_3)
bang = ExplodeTree(Data=pt_3)  # -> Branch0, Branch1, Branch2, Branch3, Branch4
cluster = Cluster_3(pt=bang.Branch0, pt_2=bang.Branch1)
cluster_2 = Cluster_3(pt=bang.Branch4, pt_2=bang.Branch3)
pline_2 = PolyLine(Vertices=flip, Closed=False)
cull_i = CullIndex(List=pline, Indices="2", Wrap=True)
shift = ShiftList(List=bang.Branch2, Shift=1, Wrap=False)
explode = Explode(Curve=pline_2, Recursive=True)  # -> Segments, Vertices
explode_2 = Explode(Curve=cull_i, Recursive=True)  # -> Segments, Vertices
ln = Line(StartPoint=bang.Branch1, EndPoint=shift)
ln_2 = Line(StartPoint=bang.Branch3, EndPoint=shift)
line = Line([cluster, cluster_2, ln, ln_2])
entwine = Entwine(Branch00=explode.Segments, Branch01=explode_2.Segments, Branch02=line, FlattenInputs=True)

# ---- group: Define Materials
matselect = MaterialSelectionKaramba3D(menu=[dropdown(1), dropdown(2)])

# ---- group: Define Cross Sections
crosecrselect = CrossSectionRangeSelectorKaramba3D(MaximumHeight_cm=-1, MaximumWidth_cm=-1, menu=[dropdown(0), dropdown(0), dropdown(3)])
i = Slider(5, range=0..20)
i_2 = Slider(3, range=0..20)
i_3 = Slider(8, range=0..20)
merge = Merge(Data1=i, Data2=i_3, Data3=i_2)  # -> graft(Result)
crosecselect = CrossSectionSelectorKaramba3D(CrossSections=crosecrselect, NameOrListIndexOfCrossSection=merge, Material=matselect)  # -> CrossSection, Info

# ---- group: Define Supports
panel_3 = Panel("""1
2""")
item = ListItem(List=cull_i, Index=panel_3, Wrap=True)
end = EndPoints(Curve=item)  # -> Start, End
pln = Plane(align.Plane)
supp = SupportKaramba3D(PosInd=end.Start, PlaneOfReference=pln, menu=[buttons(on, on, on, off, off, off)])
supp_2 = SupportKaramba3D(PosInd=end.End, PlaneOfReference=pln, menu=[buttons(off, on, on, off, off, off)])
support = SupportKaramba([supp, supp_2])

# ---- group: Orient Elements
panel_4 = Panel("""U
M""")
orientate = OrientateElemKaramba3D(BeamIdentifier=panel_4, Alpha_deg="90", mode="Beam")

# ---- group: Define Elements
panel_5 = Panel("""U
M
D""")
truss = Panel("""1
1
0""")
linetobeam = LineToBeamKaramba3D(
    Line=entwine,
    Identifier=graft(panel_5),
    CrossSection=crosecselect.CrossSection,
    New=True,
    Remove=True,
    LimitDistance_m=0.005,
    Bending=graft(truss),
    SetBucklingLength=True,
    ToPolylineMaxAngle=0.03,
    ToPolylineTolerance=0.01,
    ToPolylineMinEdgeLength=0.25)  # -> Element, Points, Info
element = ElementKaramba(flatten([orientate, linetobeam.Element]))

# ---- group: Define Loads
cluster_3 = Cluster(P=flatten(pt_3))
panel_6 = Panel("""1
2""")
mass_kg_m² = Panel("500")
item_2 = ListItem(List=cull_i, Index=panel_6, Wrap=True)
cluster_4 = Cluster_2(M=cluster_3, x=mass_kg_m², C=item_2)  # -> R, i
Z = UnitZ(Factor="-5")
panel_7 = Panel("U")
loads = LoadsKaramba3D(Vector=Vector(0, 0, -1), LCase="0", mode="Gravity")
pmass = PointMassKaramba(Mass=cluster_4.R, PosInd=cluster_4.i, Density=7850)

# ----
loads_2 = LoadsKaramba3D(
    Vector=Z,
    Mesh=cluster_3,
    ElementIdentifiers=panel_7,
    LCase="0",
    mode="MeshLoad -Const.",
    menu=[buttons(off, on, off), buttons(off, on)])

# ---- group: Define Loads (continued)
load = LoadKaramba(flatten([loads, loads_2, pmass]))

# ---- group: Assemble Model
assemble = AssembleModelKaramba3D(Elem=element, Support=support, Load=load, LimitDistance_m=0.005)  # -> Model, Info, Mass_kg, CenterOfGravity, LoadCaseNames

# ---- group: Analyze Model using Second Order Theory
analyzethii = AnalyzeThIIKaramba3D(Model=assemble.Model, RTolerance=1e-07, MaxIterations=50, NoTensionalNII=False)  # -> CalculatedModel, MaximumDisplacement_cm, ResultingForceOfGravity_kN, ElasticEnergy_kNm
panel_8 = Panel(analyzethii.MaximumDisplacement_cm)

# ---- group: Calculate Buckling Modes
bmodes = BucklingModesKaramba3D(Model=analyzethii.CalculatedModel, FromIndex=1, NumberOfModes="10", MaximumNumberOfIterations=300, Epsilon=1e-07)  # -> ModelWithBucklingModesAsLoadCaseResults, BucklingLoadFactors
panel_9 = Panel(bmodes.BucklingLoadFactors)

# ---- group: Calculate Natural Vibrations
nvibes = NaturalVibrationsKaramba(Model=analyzethii.CalculatedModel, FromIndex=1, NumberOfModes="10", MaximumNumberOfIterations=30, Epsilon=1e-05)  # -> ModelWithVibrationModesAsLoadCaseResults, NaturalFrequencies_Hz, ModalMass_kg, ParticipationFactorInGlobalXYAndZDirection
panel_10 = Panel(nvibes.NaturalFrequencies_Hz)

# ---- group: View Results
lc = Slider(0, range=0..9)
modelview = ModelViewKaramba3D(Model=bmodes.ModelWithBucklingModesAsLoadCaseResults, ResultFactors=1, ResultCase=lc)  # -> Model, DeformedMesh, DeformedAxes, DeformedModel
beamview = BeamViewKaramba3D(Model=modelview.Model)  # -> Model, MeshesOfRenderedBeams, DeformedBeamAxes, LegendColors, LegendTags

modelview_2 = ModelViewKaramba3D(Model=analyzethii.CalculatedModel, ResultFactors=1, ResultCase=-1)  # -> Model, DeformedMesh, DeformedAxes, DeformedModel

# ----
beamview_2 = BeamViewKaramba3D(Model=modelview_2.Model)  # -> Model, MeshesOfRenderedBeams, DeformedBeamAxes, LegendColors, LegendTags

# ---- group: View Results (continued)
legend = Legend(Colour=beamview_2.LegendColors, Tags=beamview_2.LegendTags, LegendType=1)

lc_2 = Slider(0, range=0..9)

# ----
modelview_3 = ModelViewKaramba3D(Model=nvibes.ModelWithVibrationModesAsLoadCaseResults, ResultFactors=1, ResultCase=lc_2)  # -> Model, DeformedMesh, DeformedAxes, DeformedModel

# ---- group: View Results (continued)
beamview_3 = BeamViewKaramba3D(Model=modelview_3.Model)  # -> Model, MeshesOfRenderedBeams, DeformedBeamAxes, LegendColors, LegendTags

# ==== cluster Cluster
P = ClusterInput()
hull = ConvexHull(Points=P, Plane=PlaneXY(0, 0, 0))  # -> Hull, HullZ, Indices
Z = UnitZ(Factor="-0.1")
move = Move(Geometry=hull.Hull, Motion=Z)  # -> Geometry, Transform
dim = Dimensions(Surface=move.Geometry)  # -> UDimension, VDimension
mesh_uv = MeshSurface(Surface=move.Geometry, UCount=dim.UDimension, VCount=dim.VDimension, Overhang=True, Equalize=False)
M = ClusterOutput(mesh_uv)

# ==== cluster Cluster_2
M = ClusterInput()
C = ClusterInput()
x = ClusterInput()
area = MeshArea(Mesh=M)  # -> Area, Centroid
facen = FaceNormals(Mesh=M)  # -> Centers, Normals
cp = ControlPoints(Curve=C)  # -> flatten(Points), Weights, Knots
lng = ListLength(List=facen.Centers)
pull = PullPoint(Point=facen.Centers, Geometry=cp.Points, ClosestOnly=True)  # -> ClosestPoint, Distance
division = Division(A=area.Area, B=lng)
pgroups = PointGroups(Points=pull.ClosestPoint, Distance=0.01)  # -> Groups, Indices
lng_2 = ListLength(List=pgroups.Groups)  # -> flatten(Length)
expression = Expression(x=x, y=division, z=lng_2, Expression="x*y*z")
item = ListItem(List=pgroups.Groups, Index=0, Wrap=True)  # -> flatten(Item)
R = ClusterOutput(expression)
i = ClusterOutput(item)

# ==== cluster Cluster_3
pt = ClusterInput()
pt_2 = ClusterInput()
pt_3 = Point(pt)
pt_4 = Point(pt_2)
shift = ShiftList(List=pt_3, Shift=1, Wrap=False)
shift_2 = ShiftList(List=pt_4, Shift=1, Wrap=False)
short = ShortestList(ListA=pt_4, ListB=shift, TrimMode=2)  # -> ListA, ListB
short_2 = ShortestList(ListA=pt_3, ListB=shift_2, TrimMode=2)  # -> ListA, ListB
ln = Line(StartPoint=short.ListA, EndPoint=short.ListB)
ln_2 = Line(StartPoint=short_2.ListA, EndPoint=short_2.ListB)
cull_i = CullIndex(List=ln, Indices=0, Wrap=True)
culln = CullNth(List=cull_i, CullFrequency=2)
culln_2 = CullNth(List=ln_2, CullFrequency=2)
line = Line([culln_2, culln])
line_2 = ClusterOutput(line)
