# Grasshopper definition 01_BucklingSimulation3dPrintedConcrete_v2.gh (Grasshopper 1.0.7)
# plug-ins: Karamba3D, Human

# ---- group: Define Load
loads = LoadsKaramba3D(Vector=Vector(0, 0, -1), LCase="0", mode="Gravity")

# ---- group: Select Geometry
# Witteveen+Bos
# Author: Shaun Wu, Jordy Vos, Nelson Xiong Neng
gate = Slider(0, range=0..1)
crv = Curve(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)
crv_2 = Curve(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)
filter = StreamFilter(Gate=gate, Stream0=crv, Stream1=crv_2)

# ---- group: Slice Geometry according to Layercount and Height
printheight_m = Slider(1, range=0.1..1)
layerheigth_m = Slider(0.01, range=0.005..0.02)
progress = Slider(0.73, range=0..1)
expression = Expression(x=printheight_m, y=layerheigth_m, z=progress, Expression="Round((x/y*z) ,0)")
panel = Panel(expression)
multiplication = Multiplication(A=layerheigth_m, B=expression)
pt = ConstructPoint(XCoordinate="0", YCoordinate="0", ZCoordinate=multiplication)
planesrf = PlaneSurface(Plane=pt, XSize=Domain(-3, 3), YSize=Domain(-1, 5))

# ---- group: Select Geometry (continued)
Z = UnitZ(Factor=printheight_m)
extr = Extrude(Base=filter, Direction=Z)
# 01 Buckling Simulation for 3D Printing in Fresh Concrete (Version 2)
# Difficulty: Moderate
# This definition takes surface input and creates contour slices. These slices are assigned different material properties based on the aging properties of the 3d printed concrete and then analysed in Karamba3D to see when the 3d printed
# object starts to buckle. Zero length springs are assigned at the supports to accurately simulate the support conditions. This definition uses a custom C# component to define the material properties for each print layer.
# 
# 1. change the layercount slider to change the layers printed
# 2. the layer thickness can be adapted with the contour distance
# 3. different input geometries can be tested
# This work is licensed under a Creative Commons Attribution 4.0 licence. You are free to copy, communicate and adapt the work, so long as you attribute the work in the manner specified by the author or licensor (but not in any way that suggests that they endorse you or your use of the work). A copy of this licence is available at https://creativecommons.org/licenses/by-sa/4.0/ or write to info@creativecommons.org
geo = Geometry(extr)

# ---- group: Slice Geometry according to Layercount and Height (continued)
bbx = BrepBrep(BrepA=planesrf, BrepB=geo)  # -> Curves, Points
srfsplit = SurfaceSplit(Surface=geo, Curves=bbx.Curves)
item = ListItem(List=srfsplit, Index=0, Wrap=True)

# ---- group: Define Shell
mesh_breps = MeshBrepsKaramba3D(
    Brep=flatten(item),
    MeshResolution=layerheigth_m,
    EdgeRefinementFactor=0.67,
    PointReduction=False,
    SmoothingStepSize=0,
    SmoothingIterations=5)  # -> Mesh, Info
mjoin = MeshJoin(Meshes=mesh_breps.Mesh)
meshtoshell = MeshToShellKaramba3D(Mesh=mjoin, LimitDistance_m=0.005)  # -> Element, Points, Info

# ---- group: Define Material and Cross Section / extracts centroid and calculates area for each meshface
c_script = CSharpScript(mesh=mjoin)  # -> out, centroid, area; inputs mesh: Mesh
# ---------- c_script: C# ----------
    List<Point3d> centroids = new List<Point3d>();
    List<double> areas = new List<double>();

    int i = 0;
    foreach(MeshFace face in mesh.Faces)
    {
      centroids.Add(mesh.Faces.GetFaceCenter(i));
      areas.Add(FaceArea(i, mesh));
      i++;
    }
    centroid = centroids;
    area = areas;
# ---------- c_script: C# additional code ----------
  private double FaceArea(int i, Mesh mesh)
  {
    int A = mesh.Faces.GetFace(i).A;
    int B = mesh.Faces.GetFace(i).B;
    int C = mesh.Faces.GetFace(i).C;

    var p1 = mesh.Vertices.Point3dAt(A);
    var p2 = mesh.Vertices.Point3dAt(B);
    var p3 = mesh.Vertices.Point3dAt(C);

    var v1 = p2 - p1;
    var v2 = p3 - p1;
    var area = (Vector3d.CrossProduct(v1, v2).Length) / 2;

    return area;
  }
# ---------- end c_script ----------

# ---- group: Define Material and Cross Section
# Sorts MeshFaces in cylindrical coordinate system:
# Generates Karamba3D Material for each MeshFace according to age.
panel_2 = Panel("0,0,0")
panel_3 = Panel("5000")
X = UnitX(Factor=1)
pt_2 = Point(panel_2)
c_script_2 = CSharpScript(
    centroids=c_script.centroid,
    area=c_script.area,
    center=pt_2,
    dir=X,
    layerheight=layerheigth_m,
    printspeed=panel_3,
    E="0.78",
    E_factor="0.000012",
    fy="0.0005984",
    fy_factor="0.000014",
    gamma="20.2",
    alphaT="0.00001",
    Reference=["C:\Program Files\Rhino 7\Plug-ins\Karamba\karamba.gha", "C:\Program Files\Rhino 7\Plug-ins\Karamba\karambaCommon.dll"])  # -> out, sorted_points, material; inputs centroids: list of Point3d, area: list of Double, center: Point3d, dir: Vector3d, layerheight: Double, printspeed: Int32, E: Double, E_factor: Double, fy: Double, fy_factor: Double, gamma: Double, alphaT: Double
# ---------- c_script_2: C# usings ----------
using Karamba.Materials;
using Karamba.GHopper.Materials;
using System.Linq;

public struct CylCoord
{
  public double THETA { get; set;}
  public Point3d CENTROID { get; set;}
  public double AREA { get; set;}
  public int INDEX { get; set;}

  public CylCoord(Point3d centroid, double theta, double area, int i):this()
  {
    this.THETA = theta;
    this.CENTROID = centroid;
    this.AREA = area;
    this.INDEX = i;
  }
}
# ---------- c_script_2: C# ----------
    List<CylCoord> cylcoords = new List<CylCoord>();
    int i = 0;
    // ##### assign values to cylinder coordinates struct - add to list
    foreach(Point3d centroid in centroids)
    {
      double theta = GetTheta(centroid, center, dir);
      theta *= 180 / Math.PI;

      CylCoord zC = new CylCoord(centroid, theta, area[i], i);
      cylcoords.Add(zC);

      i++;
    }
    // ##### sort list by Z and Angle(theta)
    int res = GetResolution(layerheight);
    //List<CylCoord> sorted = cylcoords.OrderBy(c => c.CENTROID.Z).ThenBy(t => t.THETA).ToList();
    List<CylCoord> sorted = cylcoords.OrderBy(c => Math.Round(c.CENTROID.Z, res)).ThenBy(t => t.THETA).ToList();

    sorted.Reverse();

    double age = 0;
    GH_FemMaterial[] matProp = new GH_FemMaterial[sorted.Count];
    List<Point3d> sorted_Points = new List<Point3d>();
    // ##### calculate materialproperties
    foreach (CylCoord cylcoord in sorted)
    {
      age += GetAge(cylcoord.AREA, printspeed, layerheight);
      double E_M = CalcProperties(E, E_factor, age);
      double Fy = CalcProperties(fy, fy_factor, age);
      double g123 = E_M / 2.6;

      FemMaterial_Isotrop mat = new FemMaterial_Isotrop("Concrete", "3DCP", E_M, g123, g123, gamma, Fy, -23.5, FemMaterial.FlowHypothesis.mises, alphaT, null);
      matProp[cylcoord.INDEX] = new GH_FemMaterial(mat);

      sorted_Points.Add(cylcoord.CENTROID);
      //Print("Theta({0})::Centroid({1})::i({2})", cylcoord.THETA, cylcoord.CENTROID, cylcoord.INDEX);
    }
    material = matProp;
    sorted_points = sorted_Points;
# ---------- c_script_2: C# additional code ----------
  public double GetTheta(Point3d centroid, Point3d center, Vector3d dir)
  {
    // generate second vector -> plane to evaluate angle on
    Vector3d dir2 = new Vector3d(dir.Y, dir.X, dir.Z);
    Plane plane = new Plane(center, dir, dir2);

    // get vector between centerpoint of mesh and current centroid -> calc angle
    Vector3d vec = new Vector3d(centroid.X - center.X, centroid.Y - center.Y, centroid.Z - center.Z);
    double theta = Vector3d.VectorAngle(vec, dir, plane);

    return theta;
  }

  public double GetAge(double area, int printspeed, double l_height)
  { // [mm]
    l_height *= 1000;
    area *= 1e+6;
    return ((printspeed * l_height) / area);
  }

  public double CalcProperties(double num, double factor, double age)
  {
    return (num + factor * age);
  }

  public int GetResolution(double layerheight)
  {
    bool start = false;
    int res = 0;
    foreach(var s in layerheight.ToString())
    {
      if(s == '.')
      {
        start = true;
      }
      else if(start){ res++; }
    }
    return res;
  }
# ---------- end c_script_2 ----------
printwidth_cm = Slider(5, range=0.1..100)
cross_section = CrossSectionKaramba3D(FamilyNameOfCrossSection="DefaultCroSec", Materials=c_script_2.material, Heights_cm=printwidth_cm, mode="Shell - Var")

# ---- group: MeshFace Centroids; "Printpath"
number_slider = Slider(0, range=0..1000)  # disabled
intcrv = Interpolate(Vertices=c_script_2.sorted_points, Degree=1, Periodic=False, KnotStyle=1)  # -> Curve, Length, Domain
item_2 = ListItem(List=c_script_2.sorted_points, Index=number_slider, Wrap=True)  # disabled
swatch = ColourSwatch(SwatchColor=RGB(0, 255, 221))  # disabled
preview = CustomPreview(Geometry=item_2, Material=swatch)  # disabled
preview_2 = CustomPreview(Geometry=intcrv.Curve, Material=ColourSwatch(SwatchColor=RGBA(178, 255, 0, 108)))

# ---- group: Define Supports
cluster = Cluster(L=meshtoshell.Points, P=meshtoshell.Points)
supp = SupportKaramba3D(PosInd=cluster, menu=[buttons(on, on, on, on, on, on)])

# ---- group: Assemble Model
assemble = AssembleModelKaramba3D(
    Elem=flatten(meshtoshell.Element),
    Support=flatten(supp),
    Load=flatten(loads),
    CrossSection=flatten(cross_section),
    LimitDistance_m=0.005)  # -> Model, Info, Mass_kg, CenterOfGravity, LoadCaseNames

# ---- group: Analyze Model
analyzethii = AnalyzeThIIKaramba3D(
    Model=assemble.Model,
    RTolerance=Slider(0.0001, range=0..1),
    MaxIterations=Slider(100, range=0..100),
    NoTensionalNII=Toggle(True))  # -> CalculatedModel, MaximumDisplacement_cm, ResultingForceOfGravity_kN, ElasticEnergy_kNm
panel_4 = Panel(analyzethii.MaximumDisplacement_cm)

# ---- group: View Results
modelview = ModelViewKaramba3D(Model=analyzethii.CalculatedModel, ResultFactors=1, ResultCase=-1)  # -> Model, DeformedMesh, DeformedAxes, DeformedModel

# ----
shellview = ShellViewKaramba3D(Model=modelview.Model, IndexOfLayer=0)  # -> Model, MeshesOfRenderedShells, LegendColors, LegendTags

# ---- group: Render Text to Screen
panel_5 = Panel(shellview.LegendTags)
expression_2 = Expression(
    x="Maximum Displacement: ",
    y=analyzethii.MaximumDisplacement_cm,
    z="cm",
    Expression="Format(\"{0}{1:0.000} {2}\", x, y, z)")
expression_3 = Expression(x="PrintWidth: ", y=printwidth_cm, z="cm", Expression="Format(\"{0}{1} {2}\", x, y, z)")
expression_4 = Expression(x="PrintSpeed: ", y=panel_3, z="mm/min", Expression="Format(\"{0}{1} {2}\", x, y, z)")
expression_5 = Expression(x="Layer: ", y=expression, Expression="Format(\"{0}{1}\", x, y)")
item_3 = ListItem(List=panel_5, Index=Slider(1, range=0..1), Wrap=True)
item_4 = ListItem(List=panel_5, Index="-2", Wrap=True)
expression_6 = Expression(x="MinStress:  ", y=item_3, z="[kN/cm2]", Expression="Format(\"{0}{1} {2}\", x, y, z)")
expression_7 = Expression(x="MaxStress: ", y=item_4, z="[kN/cm2]", Expression="Format(\"{0}{1} {2}\", x, y, z)")
merge = Merge(
    Data1=flatten(expression_5),
    Data2=flatten(expression_2),
    Data3=flatten(expression_3),
    Data4=flatten(expression_4),
    Data6=flatten(expression_6),
    Data7=flatten(expression_7))
lng = ListLength(List=merge)
series = Series(Start="100", Step="30", Count=lng)
pt_3 = ConstructPoint(XCoordinate="100", YCoordinate=series, ZCoordinate=0)
texttoscreen = RenderTextToScreen(
    Text=merge,
    Location=pt_3,
    Size=Slider(20, range=0..100),
    Color=ColourSwatch(SwatchColor=RGB(255, 255, 255)),
    m_scWithvp=False)

# ---- group: View Results (continued)
mesh = Mesh(shellview.MeshesOfRenderedShells)
legend = Legend(Colour=shellview.LegendColors, Tags=shellview.LegendTags, LegendType=1)

# ==== cluster Cluster
L = ClusterInput()
P = ClusterInput()
pdecon = Deconstruct(Point=P)  # -> XComponent, YComponent, ZComponent
expression = Expression(x=pdecon.ZComponent, Expression="if (x ≤ 0.001, true, false)")
cull = CullPattern(List=L, CullPattern=expression)
L_2 = ClusterOutput(cull)
