# Grasshopper definition 01_BucklingSimulation3dPrintedConcrete_v2_SW.gh (Grasshopper 1.0.7)
# plug-ins: Karamba3D, Human

# ---- group: Define Cross Sections
panel = Panel("Spring")
pt = ConstructPoint(XCoordinate="1E10", YCoordinate="1E10", ZCoordinate="1E10")
pt_2 = ConstructPoint(XCoordinate="1E-6", YCoordinate="1E-6", ZCoordinate="1E-6")
cross_section = CrossSectionKaramba3D(
    FamilyNameOfCrossSection="DefaultCroSec",
    ElementIdentifier=panel,
    CTranslation_kN_m=pt,
    CRotation_kNm_rad=pt_2,
    mode="Spring")

# ---- group: Define Load
loads = LoadsKaramba3D(Vector=Vector(0, 0, -1), LCase="0", mode="Gravity")

# ---- group: Slice Geometry according to Layercount and Height
layerheigth_m = Slider(0.01, range=0.005..0.02)
printheight_m = Slider(0.3, range=0.1..1)
progress = Slider(1, range=0..1)
expression = Expression(x=printheight_m, y=layerheigth_m, z=progress, Expression="Round((x/y*z) ,0)")
multiplication = Multiplication(A=layerheigth_m, B=expression)
panel_2 = Panel(expression)
pt_3 = ConstructPoint(XCoordinate="0", YCoordinate="0", ZCoordinate=multiplication)
planesrf = PlaneSurface(Plane=pt_3, XSize=Domain(-3, 3), YSize=Domain(-1, 5))

# ---- group: Geometry
# Witteveen+Bos
# Author: Shaun Wu, Jordy Vos, Nelson Xiong Neng
radius_cylinder_m = Slider(0.25, range=0..1)
# 01 Buckling Simulation for 3D Printing in Fresh Concrete (Version 2)
# Difficulty: Moderate
# This definition takes surface input and creates contour slices. These slices are assigned different material properties based on the aging properties of the 3d printed concrete and then analysed in Karamba3D to see when the 3d printed
# object starts to buckle. Zero length springs are assigned at the supports to accurately simulate the support conditions. This definition uses a custom C# component to define the material properties for each print layer.
# 
# 1. change the layercount slider to change the layers printed
# 2. the layer thickness can be adapted with the contour distance
# 3. different input geometries can be tested
panel_3 = Panel("0,0,0")
circle = Circle(Plane=panel_3, Radius=radius_cylinder_m)
Z = UnitZ(Factor=printheight_m)
# This work is licensed under a Creative Commons Attribution 4.0 licence. You are free to copy, communicate and adapt the work, so long as you attribute the work in the manner specified by the author or licensor (but not in any way that suggests that they endorse you or your use of the work). A copy of this licence is available at https://creativecommons.org/licenses/by-sa/4.0/ or write to info@creativecommons.org
extr = Extrude(Base=circle, Direction=Z)
geo = Geometry(extr)

# ---- group: Slice Geometry according to Layercount and Height (continued)
bbx = BrepBrep(BrepA=planesrf, BrepB=geo)  # -> Curves, Points
srfsplit = SurfaceSplit(Surface=geo, Curves=bbx.Curves)
item = ListItem(List=srfsplit, Index=0, Wrap=True)

# ---- group: Define Elements
pt_4 = ConstructPoint(XCoordinate=0, YCoordinate=0, ZCoordinate=0)

# ---- group: Define Shell
mesh_breps = MeshBrepsKaramba3D(
    Brep=flatten(item),
    MeshResolution=layerheigth_m,
    EdgeRefinementFactor=0.67,
    PointReduction=False,
    SmoothingStepSize=0,
    SmoothingIterations=5)  # -> Mesh, Info
mjoin = MeshJoin(Meshes=mesh_breps.Mesh)

# ---- group: Define Material and Cross Section / extracts centroid and calculates area for each meshface
c_script = CSharpScript(mesh=mjoin)  # -> out, centroid, area; inputs mesh: Mesh
# ---------- c_script: C# ----------
    List<Point3d> centroids = new List<Point3d>();
    List<double> areas = new List<double>();

    int i = 0;
    foreach(MeshFace face in mesh.Faces)
    {
      centroids.Add(mesh.Faces.GetFaceCenter(i));
      areas.Add(FaceArea(i, mesh));
      i++;
    }
    centroid = centroids;
    area = areas;
# ---------- c_script: C# additional code ----------
  private double FaceArea(int i, Mesh mesh)
  {
    int A = mesh.Faces.GetFace(i).A;
    int B = mesh.Faces.GetFace(i).B;
    int C = mesh.Faces.GetFace(i).C;

    var p1 = mesh.Vertices.Point3dAt(A);
    var p2 = mesh.Vertices.Point3dAt(B);
    var p3 = mesh.Vertices.Point3dAt(C);

    var v1 = p2 - p1;
    var v2 = p3 - p1;
    var area = (Vector3d.CrossProduct(v1, v2).Length) / 2;

    return area;
  }
# ---------- end c_script ----------

# ---- group: Define Material and Cross Section
# Sorts MeshFaces in cylindrical coordinate system:
# Generates Karamba3D Material for each MeshFace according to age.
panel_4 = Panel("0.00781")
panel_5 = Panel("5000")
X = UnitX(Factor=1)
pt_5 = Point("0,0,0")
printwidth_cm = Slider(5, range=0.1..100)
c_script_2 = CSharpScript(
    centroids=c_script.centroid,
    area=c_script.area,
    center=pt_5,
    dir=X,
    layerheight=layerheigth_m,
    printspeed=panel_5,
    E="78.1",
    E_factor="0.000012",
    fy="0.0005984",
    fy_factor="0.000014",
    gamma="20.2",
    alphaT="0.00001",
    Reference=["C:\Program Files\Rhino 7\Plug-ins\Karamba\karamba.gha", "C:\Program Files\Rhino 7\Plug-ins\Karamba\karambaCommon.dll"])  # -> flatten(out), sorted_face_age, sorted_points, sorted_MatProp, Material, Es; inputs centroids: list of Point3d, area: list of Double, center: Point3d, dir: Vector3d, layerheight: Double, printspeed: Int32, E: Double, E_factor: Double, fy: Double, fy_factor: Double, gamma: Double, alphaT: Double
# ---------- c_script_2: C# usings ----------
using Karamba.Materials;
using Karamba.GHopper.Materials;
using System.Linq;

public struct CylCoord
{
  public double THETA { get; set;}
  public Point3d CENTROID { get; set;}
  public double AREA { get; set;}
  public int INDEX { get; set;}

  public CylCoord(Point3d centroid, double theta, double area, int i):this()
  {
    this.THETA = theta;
    this.CENTROID = centroid;
    this.AREA = area;
    this.INDEX = i;
  }
}
# ---------- c_script_2: C# ----------
    List<CylCoord> cylcoords = new List<CylCoord>();
    int i = 0;
    // ##### assign values to cylinder coordinates struct - add to list
    foreach(Point3d centroid in centroids)
    {
      double theta = GetTheta(centroid, center, dir);
      theta *= 180 / Math.PI;

      CylCoord zC = new CylCoord(centroid, theta, area[i], i);
      cylcoords.Add(zC);

      i++;
    }
    int res = GetResolution(layerheight);

    // ##### sort list by Z and Angle(theta)
    List<CylCoord> sorted = cylcoords.OrderBy(c => Math.Round(c.CENTROID.Z, res)).ThenBy(t => t.THETA).ToList();

    sorted.Reverse();

    double age = 0;
    GH_FemMaterial[] matProp = new GH_FemMaterial[sorted.Count]; // array size of MeshFace count

    List<Point3d> sorted_Points = new List<Point3d>();
    //
    List<double> sortedAge = new List<double>();
    List<GH_FemMaterial> sortedMatProp = new List<GH_FemMaterial>();
    //
    List<double> E_Ms = new List<double>();

    // ##### calculate materialproperties
    foreach (CylCoord cylcoord in sorted)
    {
      age += GetAge(cylcoord.AREA, printspeed, layerheight);
      double E_M = CalcProperties(E, E_factor, age);
      E_Ms.Add(E_M);
      double Fy = CalcProperties(fy, fy_factor, age);
      double g123 = E_M / 2.6;

      FemMaterial_Isotrop mat = new FemMaterial_Isotrop("Concrete", "3DCP", E_M, g123, g123, gamma, Fy,  -23.5, FemMaterial.FlowHypothesis.mises, alphaT, null);
      matProp[cylcoord.INDEX] = new GH_FemMaterial(mat);

      sorted_Points.Add(cylcoord.CENTROID);
      sortedAge.Add(age);
      sortedMatProp.Add(new GH_FemMaterial(mat));
    }
    //
    sorted_face_age = sortedAge;
    sorted_MatProp = sortedMatProp;
    //
    sorted_points = sorted_Points;
    Material = matProp;
    Es = E_Ms;
# ---------- c_script_2: C# additional code ----------
  public double GetTheta(Point3d centroid, Point3d center, Vector3d dir)
  {
    // generate second vector -> plane to evaluate angle on
    Vector3d dir2 = new Vector3d(dir.Y, dir.X, dir.Z);
    Plane plane = new Plane(center, dir, dir2);

    // get vector between centerpoint of mesh and current centroid -> calc angle
    Vector3d vec = new Vector3d(centroid.X - center.X, centroid.Y - center.Y, centroid.Z - center.Z);
    double theta = Vector3d.VectorAngle(vec, dir, plane);

    return theta;
  }

  public double GetAge(double area, int printspeed, double l_height)
  { // [mm]
    //l_height *= 1000;
    area *= 1e+3;
    return(area / (printspeed * l_height));
  }

  public double CalcProperties(double num, double factor, double age)
  {
    return (num / 10000 + (factor * age)) * 10000;
  }

  public int GetResolution(double layerheight)
  { //zähle Dezimalstellen
    bool start = false;
    int res = 0;
    foreach(var s in layerheight.ToString())
    {
      if(s == '.')
      {
        start = true;
      }
      else if(start){ res++; }
    }
    return res;
  }
# ---------- end c_script_2 ----------
panel_6 = Panel("shell")
disassemble = DisassembleMaterialKaramba3D(Material=c_script_2.Material)  # -> Material, TypeOfMaterial, FamilyNameOfMaterial, NameOfMaterial, ElemIdentifiers, Color, simplify(YoungsModulusKNCm2Dir12), InPlaneShearModulus_kN_cm2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
cross_section_2 = CrossSectionKaramba3D(
    FamilyNameOfCrossSection="DefaultCroSec",
    ElementIdentifier=panel_6,
    Materials=c_script_2.Material,
    Heights_cm=printwidth_cm,
    mode="Shell - Var")
panel_7 = Panel(disassemble.YoungsModulusKNCm2Dir12)

# ---- group: Define Shell (continued)
meshtoshell = MeshToShellKaramba3D(Mesh=mjoin, Identifier=panel_6, CrossSection=cross_section_2, LimitDistance_m=0.005)  # -> Element, Points, Info

# ---- group: Define Elements (continued)
pt_6 = Point(flatten(meshtoshell.Points))
rdpoints = RemoveDuplicatePointsKaramba3D(Point=pt_6, LimitDistance=0.005)  # -> OutPoint, Info, Indexes
pdecon = Deconstruct(Point=rdpoints.OutPoint)  # -> XComponent, YComponent, ZComponent
smaller = SmallerThan(FirstNumber=pdecon.ZComponent, SecondNumber=Slider(0.001, range=0..0.001))  # -> SmallerThan, OrEqualTo
cull = CullPattern(List=rdpoints.OutPoint, CullPattern=smaller.OrEqualTo)  # -> simplify(List)
merge = Merge(Data1=cull, Data2=cull)
ln = Line(StartPoint=cull, EndPoint=cull)
linetobeam = LineToBeamKaramba3D(
    Line=ln,
    Identifier=panel,
    CrossSection=cross_section,
    Points=merge,
    New=True,
    Remove=True,
    LimitDistance_m=0.005,
    Bending=True,
    SetBucklingLength=True,
    ToPolylineMaxAngle=0.03,
    ToPolylineTolerance=0.01,
    ToPolylineMinEdgeLength=0.25)  # -> Element, Points, Info
vec2pt = Vector2Pt(PointA=pt_4, PointB=cull, Unitize=False)  # -> Vector, Length
orientate = OrientateElemKaramba3D(Beam=linetobeam.Element, XOrientation=vec2pt.Vector, mode="Beam")

# ---- group: Define Supports
list_length = ListLength(List=cull)
panel_9 = Panel(list_length)
series = Series(Start=panel_9, Step=1, Count=panel_9)
supp = SupportKaramba3D(PosInd=series, menu=[buttons(on, on, on, on, on, on)])

# ----
element_karamba3d = ElementKaramba3D([meshtoshell.Element, orientate])

# ---- group: Select MeshFace - Position, Age, Applied Material
cluster = Cluster(
    list=c_script_2.sorted_points,
    list_2=c_script_2.sorted_face_age,
    list_3=c_script_2.sorted_MatProp,
    index=Slider(2000, range=0..2000))  # -> i, i_2, i_3
panel_10 = Panel([cluster.i, cluster.i_2, cluster.i_3])
point = Point(cluster.i)
preview = CustomPreview(Geometry=point, Material=ColourSwatch(SwatchColor=RGB(255, 0, 0)))

# ---- group: "Printpath"
intcrv = Interpolate(Vertices=c_script_2.sorted_points, Degree=1, Periodic=False, KnotStyle=1)  # -> Curve, Length, Domain
preview_2 = CustomPreview(Geometry=intcrv.Curve, Material=ColourSwatch(SwatchColor=RGBA(98, 255, 0, 154)))  # disabled

# ----
cross_section_karamba3d = CrossSectionKaramba3D([cross_section_2, cross_section])

# ---- group: Assemble Model
assemble = AssembleModelKaramba3D(
    Point=flatten(linetobeam.Points),
    Elem=flatten(element_karamba3d),
    Support=flatten(supp),
    Load=flatten(loads),
    CrossSection=flatten(cross_section_karamba3d),
    LimitDistance_m=0.005)  # -> Model, Info, Mass_kg, CenterOfGravity, LoadCaseNames

# ---- group: Analyze Model
analyzethii = AnalyzeThIIKaramba3D(
    Model=assemble.Model,
    RTolerance=Slider(0.0001, range=0..1),
    MaxIterations=Slider(100, range=0..100),
    NoTensionalNII=Toggle(True))  # -> CalculatedModel, MaximumDisplacement_cm, ResultingForceOfGravity_kN, ElasticEnergy_kNm
panel_11 = Panel(analyzethii.MaximumDisplacement_cm)

# ---- group: View Results
modelview = ModelViewKaramba3D(Model=analyzethii.CalculatedModel, ResultFactors=1, ResultCase=-1, ElementIdentifiersBreps=panel_6)  # -> Model, DeformedMesh, DeformedAxes, DeformedModel
shellview = ShellViewKaramba3D(Model=modelview.Model, IndexOfLayer=0)  # -> Model, MeshesOfRenderedShells, LegendColors, LegendTags
mesh = Mesh(shellview.MeshesOfRenderedShells)
legend = Legend(Colour=shellview.LegendColors, Tags=shellview.LegendTags, LegendType=1)

# ---- group: Render Text to Screen
panel_12 = Panel(shellview.LegendTags)
expression_2 = Expression(
    x="Maximum Displacement: ",
    y=analyzethii.MaximumDisplacement_cm,
    z="cm",
    Expression="Format(\"{0}{1:0.000} {2}\", x, y, z)")
expression_3 = Expression(x="PrintWidth: ", y=printwidth_cm, z="cm", Expression="Format(\"{0}{1} {2}\", x, y, z)")
expression_4 = Expression(x="PrintSpeed: ", y=panel_5, z="mm/min", Expression="Format(\"{0}{1} {2}\", x, y, z)")
expression_5 = Expression(x="Layer: ", y=expression, Expression="Format(\"{0}{1}\", x, y)")
item_2 = ListItem(List=panel_12, Index=Slider(1, range=0..1), Wrap=True)
item_3 = ListItem(List=panel_12, Index="-2", Wrap=True)
expression_6 = Expression(x="MinStress:  ", y=item_2, z="[kN/cm2]", Expression="Format(\"{0}{1} {2}\", x, y, z)")
expression_7 = Expression(x="MaxStress: ", y=item_3, z="[kN/cm2]", Expression="Format(\"{0}{1} {2}\", x, y, z)")
merge_2 = Merge(
    Data1=flatten(expression_5),
    Data2=flatten(expression_2),
    Data3=flatten(expression_3),
    Data4=flatten(expression_4),
    Data6=flatten(expression_6),
    Data7=flatten(expression_7))
lng = ListLength(List=merge_2)
series_2 = Series(Start="100", Step="30", Count=lng)
pt_7 = ConstructPoint(XCoordinate="100", YCoordinate=series_2, ZCoordinate=0)
texttoscreen = RenderTextToScreen(
    Text=merge_2,
    Location=pt_7,
    Size=Slider(20, range=0..100),
    Color=ColourSwatch(SwatchColor=RGB(0, 0, 0)),
    m_scWithvp=False)

# ==== cluster Cluster
list = ClusterInput()
list_2 = ClusterInput()
list_3 = ClusterInput()
index = ClusterInput()
list_item = ListItem(List=list, Index=index, Wrap=True)
list_item_2 = ListItem(List=list_2, Index=index, Wrap=True)
list_item_3 = ListItem(List=list_3, Index=index, Wrap=True)
i = ClusterOutput(list_item)
i_2 = ClusterOutput(list_item_2)
i_3 = ClusterOutput(list_item_3)
