# Grasshopper definition 01_InputCurvesAsTruss.gh (Grasshopper 1.0.7)
# plug-ins: Karamba3D

# ---- group: Reference Geometry
# to apply to a new model:
# right-click and set multiple points;
# 
# ** points must be near intended supports;
# definition will automatically snap to closest node in model
pt = Point([<point referenced from the Rhino model> x3])

# to apply to a new model:
# right-click and set multiple curves;
# 
# ** pay close attention to intersections of rhino curves;
# Karamba3D will not read joints if lines are not intersecting
crv = Curve([<curve referenced from the Rhino model> x3])
explode = Explode(Curve=crv, Recursive=True)  # -> flatten(Segments), Vertices
# 01 Input Curves As Truss
# Difficulty: Simple
# This definition takes curve input from rhino, converts them to beams and measures performance under loading conditions
# 
# Steps to alter:
# 1. change slider that controls loads: notice the behavior of the hinge and roller supports as truss deflects
# 2. toggle the "modify element" component to change beams to axial-only loads; hinged joints
# 3. turn control points on in rhino to adjust the geometry of the truss
llinter = LineLineIntersectionKaramba(Line=explode.Segments, LengthTolerance=0.01)  # -> IntersectionPoints, flatten(LineSubSegements)

# to apply to a new model:
# right-click and set multiple points;
# 
# ** points must be near intended supports;
# definition will automatically snap to closest node in model
pt_2 = Point(<point referenced from the Rhino model>)

# to apply to a new model:
# right-click and set multiple points;
# 
# ** points must be near intended supports;
# definition will automatically snap to closest node in model
pt_3 = Point(<point referenced from the Rhino model>)

# ---- group: Define Cross Sections
crosecrselect = CrossSectionRangeSelectorKaramba3D(MaximumHeight_cm=-1, MaximumWidth_cm=-1, menu=[dropdown(3), dropdown(1), dropdown(1)])
index = Slider(0, range=0..272)
crosecselect = CrossSectionSelectorKaramba3D(CrossSections=crosecrselect, NameOrListIndexOfCrossSection=index)  # -> CrossSection, Info
panel = Panel(crosecselect.CrossSection)

# ---- group: Define Elements
# an ideal truss has hinged joints and
#  members carry only axial loads
toggle = BooleanToggle(False)
# This work is licensed under a Creative Commons Attribution 4.0 licence. You are free to copy, communicate and adapt the work, so long as you attribute the work in the manner specified by the author or licensor (but not in any way that suggests that they endorse you or your use of the work). A copy of this licence is available at http://http://creativecommons.org/licenses/by/4.0/ or write to info@creativecommons.org
panel_2 = Panel("beams")
linetobeam = LineToBeamKaramba3D(
    Line=llinter.LineSubSegements,
    Identifier=panel_2,
    CrossSection=crosecselect.CrossSection,
    New=True,
    Remove=True,
    LimitDistance_m=0.005,
    Bending=toggle,
    SetBucklingLength=True,
    ToPolylineMaxAngle=0.03,
    ToPolylineTolerance=0.01,
    ToPolylineMinEdgeLength=0.25)  # -> Element, Points, Info

# ---- group: Define Loads
# live load applied as uniform distributed (mesh) loads
# ** note: low mesh density can
# result in uneven distribution of load
# LIVE LOAD REFERENCE:
# ref: The Structural Basis of Architecture, Sandaker et al.
# residential (typical) 	2 kN/m2  	.04 kip/ft2
# office (tyipcal)  			3 kN/m2  	.06 kip/ft2
# public plazas  	12 kN/m2  	.25 kip/ft2
# athletic facilities (typical)  5 kN/m2  	.1 kip/ft2
# hospitals (operating rooms)  3 kN/m2   .06 kip/ft2
# libraries (book stacks)  7 kN/m2   .15 kip/ft2
# manufacturing (typical)  6 kN/m2   .125 kip/ft2
# heavy equipment   12 kN/m2   .25 kip/ft2
# schools (classrooms)   2 kN/m2   .04 kip/ft2
# schools (hallways)   5 kN/m2   .1 kip/ft2
live_load = Slider(-14.179, range=-50..-0.04)
fsim = FindSimilarMember(Data=pt, Set=linetobeam.Points)  # -> Hit, Index
Z = UnitZ(Factor="-1")
Z_2 = UnitZ(Factor=live_load)
loads = LoadsKaramba3D(Vector=Z, LCase="0", mode="Gravity")
loads_2 = LoadsKaramba3D(ForceVector=Z_2, Local=False, PosInd=fsim.Hit, LCase="0", mode="Point")
load = LoadKaramba3D(flatten([loads, loads_2]))

# ---- group: Define Supports
# ROLLER support can translate in the x
# direction and rotate about the y axis
# PIN support cannot translate in any
# direction but  can rotate about the y axis
# out of plane support for all nodes:
# restrain all nodes out of plane for
# 2d analysis
fsim_2 = FindSimilarMember(Data=pt_2, Set=linetobeam.Points)  # -> Hit, Index
fsim_3 = FindSimilarMember(Data=pt_3, Set=linetobeam.Points)  # -> Hit, Index
cull_i = CullIndex(List=linetobeam.Points, Indices=[fsim_2.Index, fsim_3.Index], Wrap=True)
supp = SupportKaramba3D(PosInd=fsim_2.Hit, menu=[buttons(off, on, on, on, off, on)])
supp_2 = SupportKaramba3D(PosInd=fsim_3.Hit, menu=[buttons(on, on, on, on, off, on)])
supp_3 = SupportKaramba3D(PosInd=cull_i, menu=[buttons(off, on, off, on, off, on)])
support = SupportKaramba(flatten([supp, supp_3, supp_2]))

# ---- group: Assemble Model
assemble = AssembleModelKaramba3D(Elem=linetobeam.Element, Support=support, Load=load, LimitDistance_m=0.005)  # -> Model, Info, Mass_kg, CenterOfGravity, LoadCaseNames

# ---- group: Analyze Model
analyze = AnalyzeKaramba3D(Model=assemble.Model)  # -> CalculatedModel, MaximumDisplacement_cm, ResultingForceOfGravity_kN, ElasticEnergy_kNm
displacement = Panel(analyze.MaximumDisplacement_cm)

# ---- group: Check Beam Internal Forces
# -You can call a specific group of beams using
# the 'BeamIds' input.
# -Adding '3' to the resolution input provides values
# at the middle of each beam in addition to the
# two ends (default).
panel_3 = Panel("3")
cluster = Cluster(C=panel_3)
b_forces = BeamForcesKaramba3D(AnalyzedModel=analyze.CalculatedModel, Ts=cluster)  # -> AnalyzedModel, NormalForce_kN, ShearForceVz_kN, ShearForceVy_kN, BendingMomentMt_kNm, BendingMomentMy_kNm, BendingMomentMz_kNm, LoadCaseIndex
panel_4 = Panel(b_forces.NormalForce_kN)

# ---- group: View Results
modelview = ModelViewKaramba3D(Model=analyze.CalculatedModel, ResultFactors=1, ResultCase=-1)  # -> Model, DeformedMesh, DeformedAxes, DeformedModel

# ----
beamview = BeamViewKaramba3D(Model=modelview.Model)  # -> Model, MeshesOfRenderedBeams, DeformedBeamAxes, LegendColors, LegendTags

# ---- group: View Results (continued)
legend = Legend(Colour=beamview.LegendColors, Tags=beamview.LegendTags, LegendType=1)

# ---- group: Check Beam Displacements
# -You can call a specific group of beams using
# the 'BeamIds' input.
# -Adding '3' to the resolution input provides values
# at the middle of each beam in addition to the
# two ends (default).
panel_5 = Panel("3")

# ----
cluster_2 = Cluster(C=panel_5)
beamdisp = BeamDisplacementsKaramba3D(AnalyzedModel=analyze.CalculatedModel, Ts=cluster_2)  # -> AnalyzedModel, simplify(Translations_m), Rotations_rad, LoadCaseIndex

# ---- group: Check Beam Displacements (continued)
panel_6 = Panel(beamdisp.Translations_m)

# ==== cluster Cluster
C = ClusterInput()
series = Series(Start=0, Step=1, Count=C)
bnd = Bounds(Numbers=series)
remap = RemapNumbers(Value=series, Source=bnd, Target="0 to 1")  # -> Mapped, Clipped
C_2 = ClusterOutput(remap.Clipped)
