# Grasshopper definition 01_ParametricSpaceFrame_3_1_4.gh (Grasshopper 1.0.7)
# plug-ins: Karamba3D

# ---- group: Create Geometry
pt = Point([Point(0, 0, 0), Point(1.76064073, 5.673376558, 0.9397803144), Point(5.647464446, -2.542302237, 0), Point(6.72837259, 6.675133214, -0.9484775072)])
srfgrid = SurfaceFromPoints(Points=pt, UCount="2", Interpolate=False)
offset_l = OffsetSurfaceLoose(Surface=srfgrid, Distance=Slider(1.3, range=0.2..2), Retrim=False)
merge = Merge(Data1=srfgrid, Data2=offset_l)
# 01 - Parametric Space Frame
# Difficulty: Moderate | Version 3.1.4
# The Surface To Truss component allows a variety of truss geometries to be generated from an input surface. The axes are sorted into branches which can directly be fed into a Create Linear Element component.
sdivide = DivideSurface(Surface=merge, UCount=Slider(3, range=0..10), VCount=Slider(3, range=0..10))  # -> simplify(Points), Normals, Parameters
path_mapper = PathMapper(sdivide.Points, source="{A;B}(i)", target="{A;i}")
pline = PolyLine(Vertices=sdivide.Points, Closed=False)
explode = Explode(Curve=pline, Recursive=True)  # -> reparameterize(Segments), Vertices
pline_2 = PolyLine(Vertices=path_mapper, Closed=False)
explode_2 = Explode(Curve=pline_2, Recursive=True)  # -> reparameterize(Segments), Vertices
path_mapper_2 = PathMapper(explode_2.Segments, source="{A;B;C}(i)", target="{i;B;C}")
path_mapper_3 = PathMapper(explode.Segments, source="{A;B;C}(i)", target="{i;B;C}")
loft = Loft(Curves=path_mapper_3, Options={Adjust=False, Closed=False, LoftEnds=0, LoftSimp=0, LoftType=0, Rebuild=10, Refit=0.01})
loft_2 = Loft(Curves=path_mapper_2, Options={Adjust=False, Closed=False, LoftEnds=0, LoftSimp=0, LoftType=0, Rebuild=10, Refit=0.01})
merge_2 = Merge(Data1=loft, Data2=loft_2)
list = ValueList({"Pratt": "1", "Warren": "2", "Warren Vertical": "3", "K Truss": "4", "Diamond": "5", "Diamond Straight": "6", "Vierendeel": "7"}, selected="K Truss")
s2t = SurfaceToTruss(
    Surface=reparameterize(merge_2),
    TrussType=list,
    NumberOfSubdivisions="1",
    FlipUDirection=False,
    FlipVDirection=False,
    SwapUVDirections=Toggle(True),
    RelaxAngles=False,
    TargetPostDirection=Vector(0, 0, 0),
    MaximumRelaxationIterations=30,
    LengthTolerance=0.0001,
    DampingFactor=0.8)  # -> Info, Lines, YOrientations, ZOrientations, SpecificEnergy

# ---- group: Define Supports
srf = Surface(merge)
item = ListItem(List=srf, Index=0, Wrap=True)
debrep = DeconstructBrep(Brep=item)  # -> Faces, Edges, Vertices
supp = SupportKaramba3D(PosInd=debrep.Vertices, menu=[buttons(on, on, on, off, off, off)])

# ---- group: Define Loads
loads = LoadsKaramba3D(Vector=Vector(0, 0, -1), LCase="LC0", mode="Gravity")

# ---- group: Define Elements
lineelem = CreateLinearElementKaramba3D(
    Line=s2t.Lines,
    LimitDistance_m=0.005,
    BucklingLengthY_m=-1,
    BucklingLengthZ_m=-1,
    BucklingLengthLT_m=-1,
    Bending=True,
    ToPolylineMaxAngle=0.03,
    ToPolylineTolerance=0.01,
    ToPolylineMaxEdgeLength=0.25,
    New=True,
    Remove=True,
    mode="LineToBeam")  # -> Element, Points, Info

# ---- group: Assemble Model
assemble = AssembleModelKaramba3D(Elem=flatten(lineelem.Element), Support=supp, Load=loads, LimitDistance_m=0.005)  # -> Model, Info, Mass_kg, CentreOfGravity, LoadCaseNames

# ---- group: Analyse Model
analyse = AnalyseKaramba3D(Model=assemble.Model)  # -> AnalysedModel, MaximumDisplacement_cm, ResultingForce_kN, ChangeOfElasticEnergy_kNm
panel = Panel(analyse.MaximumDisplacement_cm)

# ---- group: View Results
modelview = ModelViewKaramba3D(Model=analyse.AnalysedModel)  # -> Model, DeformedMesh, DeformedAxes, DeformedModel, MaximumDeformation
beamview = BeamViewKaramba3D(Model=modelview.Model)  # -> Model, MeshesOfRenderedBeams, DeformedBeamAxes, LegendColours, LegendTags
