# Grasshopper definition 01_SimpleCanopy_3_1_4.gh (Grasshopper 1.0.7)
# plug-ins: Karamba3D

# ---- group: Create Geometry
height = Slider(4, range=2..4)
length = Slider(2.5, range=0.5..4)
height_2 = Slider(2, range=0.5..2)
Z = UnitZ(Factor=height)
X = UnitX(Factor=1)
division = Division(A=height_2, B=Slider(0.5, range=0..1))
line = LineSDL(Start="0,0,0", Direction=Z, Length=height)
line_2 = LineSDL(Start=Z, Direction=X, Length=length)
series = Series(Start=0, Step=height_2, Count=Slider(5, range=0..10))
Y = UnitY(Factor=series)
# 01 - SimpleCanopy
# Difficulty: Moderate | Version 3.1.4
# A parametric steel canopy structure is optimised for several load cases and load combinations
move = Move(Geometry=line, Motion=Y)  # -> simplify(Geometry), Transform
move_2 = Move(Geometry=line_2, Motion=Y)  # -> simplify(Geometry), Transform
divide = DivideCurve(Curve=move_2.Geometry, Count=division, Kinks=False)  # -> Points, Tangents, Parameters
flip = FlipMatrix(Data=divide.Points)
pline = PolyLine(Vertices=flip, Closed=False)
explode = Explode(Curve=pline, Recursive=True)  # -> Segments, Vertices
pline_2 = PolyLine(Vertices=divide.Points, Closed=False)
entwine = Entwine(Branch00=move.Geometry, Branch01=pline_2, Branch02=explode.Segments, FlattenInputs=True)

# ---- group: Define Loads
loft = Loft(
    Curves=flatten(move.Geometry),
    Options={Adjust=False, Closed=False, LoftEnds=0, LoftSimp=0, LoftType=0, Rebuild=10, Refit=0.01})
loft_2 = Loft(
    Curves=flatten(pline_2),
    Options={Adjust=False, Closed=False, LoftEnds=0, LoftSimp=0, LoftType=0, Rebuild=10, Refit=0.01})
mesh_breps = MeshBrepsKaramba3D(Brep=loft, MeshResolution=1, EdgeRefinementFactor=0.67, PointReduction=False, SmoothingStepSize=0, SmoothingIterations=5)  # -> Mesh, Info
mesh_breps_2 = MeshBrepsKaramba3D(
    Brep=loft_2,
    MeshResolution=1,
    EdgeRefinementFactor=0.67,
    PointReduction=False,
    SmoothingStepSize=0,
    SmoothingIterations=5)  # -> Mesh, Info
panel = Panel("""-0.5
0.5""")
panel_2 = Panel("""-2
-1""")
panel_3 = Panel("""qw1
qw2""")
Z_2 = UnitZ(Factor=panel_2)
Z_3 = UnitZ(Factor=panel)
panel_4 = Panel("""gk
qn""")
loads = LoadsKaramba3D(Vector=Vector(0, 0, -1), LCase="g", mode="Gravity")
loads_2 = LoadsKaramba3D(
    Vector=Z_2,
    Mesh=mesh_breps_2.Mesh,
    ElementIdentifiers="SecBeam",
    LCase=panel_4,
    mode="MeshLoad -Const.",
    menu=[buttons(off, on, off), buttons(off, on)])
loads_3 = LoadsKaramba3D(
    Vector=Z_3,
    Mesh=mesh_breps.Mesh,
    ElementIdentifiers="Column",
    LCase=panel_3,
    mode="MeshLoad -Const.",
    menu=[buttons(on, off, off), buttons(off, on)])
load = LoadKaramba3D([loads, loads_2, loads_3])

# ---- group: Define Load Combinations
panel_5 = Panel("""SLS = g + gk + qn + (0|0.6)*(qw1|qw2)
ULS = 1.35 * (g + gk + qn) + (0|1)*(qw1|qw2)""")
lccombinator = LoadCaseCombinatorKaramba3D(LoadCaseCombinationRulesKaramba3D=panel_5)  # -> LoadCaseCombinations, NamesOfLoadCases, NumberOfLoadCases
loadcasecombisettings = LoadCaseCombinationSettingsKaramba3D(LCase="ULS", NIIFromCombination=Toggle(True), mode="Small Disp.Th.II")
loadcasecombisettings_2 = LoadCaseCombinationSettingsKaramba3D(LCase="SLS", mode="Small Disp.")
load_2 = LoadKaramba3D([lccombinator.LoadCaseCombinations, loadcasecombisettings_2, loadcasecombisettings])

# ---- group: Define Cross Sections
crosecrselect = CrossSectionRangeSelectorKaramba3D(MaximumHeight_cm=-1, MaximumWidth_cm=-1, menu=[dropdown(1), dropdown(1), dropdown(3)])
item = ListItem(List=crosecrselect, Index=0, Wrap=True)

# ---- group: Define Supports
end = EndPoints(Curve=move.Geometry)  # -> Start, End
supp = SupportKaramba3D(PosInd=end.Start, menu=[buttons(on, on, on, off, on, off)])

# ---- group: Define Elements
panel_6 = Panel("""Column
MainBeam
SecBeam""")
lineelem = CreateLinearElementKaramba3D(
    Line=entwine,
    Identifier=graft(panel_6),
    CrossSection=item,
    LimitDistance_m=0.005,
    BucklingLengthY_m=-1,
    BucklingLengthZ_m=-1,
    BucklingLengthLT_m=-1,
    Bending=True,
    ToPolylineMaxAngle=0.03,
    ToPolylineTolerance=0.01,
    ToPolylineMaxEdgeLength=0.25,
    New=True,
    Remove=True,
    mode="LineToBeam")  # -> Element, Points, Info

# ---- group: Assemble Model
assemble = AssembleModelKaramba3D(Elem=flatten(lineelem.Element), Support=flatten(supp), Load=flatten([load, load_2]), LimitDistance_m=0.005)  # -> Model, Info, Mass_kg, CentreOfGravity, LoadCaseNames

# ---- group: Optimize Cross Sections
crosec = CrossSectionKaramba3D(crosecrselect)
num = Number(length)
expression = Expression(x=num, Expression="x/100*100")
opticrosec = OptimizeCrossSectionKaramba3D(
    Model=assemble.Model,
    CrossSections=crosec,
    MaximumUtilization=Slider(0.25, range=0..1),
    LoadCasesUtil="ULS",
    MaximumDisplacement_cm=expression,
    LoadCasesDisp="SLS",
    MaximumVirtualWork_kNcm=0.01,
    NumberOfUtilizationIterations=5,
    NumberOfDisplacementIterations=5,
    NumberOfDisplacementIncrementsPerIteration=2,
    DisplacementTolerance=0.01,
    NumberOfSamplePoints=3,
    ElasticDesign=True,
    GammaM0=1,
    GammaM1=1.1,
    SwayFrame=True)  # -> OptimizedModel, Info, Mass_kg, MaximumDisplacement_cm, ElasticEnergyChange_kNm, MaximumDisplacementViewLimitCrossSections, MaximumUtilizationViewInsufficientCrossSections
panel_7 = Panel(opticrosec.MaximumDisplacementViewLimitCrossSections)
panel_8 = Panel(opticrosec.Mass_kg)
panel_9 = Panel(opticrosec.MaximumDisplacement_cm)

# ---- group: Analyse Model
analyse = AnalyseKaramba3D(Model=opticrosec.OptimizedModel)  # -> AnalysedModel, MaximumDisplacement_cm, ResultingForce_kN, ChangeOfElasticEnergy_kNm
panel_10 = Panel(analyse.MaximumDisplacement_cm)

# ---- group: View Results
resultselect = LoadCaseSelectorKaramba3D(
    Model=analyse.AnalysedModel,
    menu=[buttons(on, off), dropdown(6), dropdown(0), buttons(off, off, off, off, off, off, off), buttons(off, off, off, off, off, off), buttons(off, off, off, off, off, off, off, off), buttons(off, off, off, off, off, off, off, off)])  # -> Model, LoadCaseSelection
modelview = ModelViewKaramba3D(Model=resultselect.Model)  # -> Model, DeformedMesh, DeformedAxes, DeformedModel, MaximumDeformation
reactview = ReactionViewKaramba3D(Model=resultselect.Model)  # -> Model, LegendColours, LegendTags
beamview = BeamViewKaramba3D(Model=modelview.Model)  # -> Model, MeshesOfRenderedBeams, DeformedBeamAxes, LegendColours, LegendTags
legend = Legend(Colour=reactview.LegendColours, Tags=reactview.LegendTags, LegendType=1)
legend_2 = Legend(Colour=beamview.LegendColours, Tags=beamview.LegendTags, LegendType=1)
