# Grasshopper definition 01_SpaceBall.gh (Grasshopper 1.0.7)
# plug-ins: Karamba3D

# ---- group: Geometry / Inside
geo = Geometry([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])

# ---- group: Geometry / Ropes
geo_2 = Geometry([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])

# ---- group: Geometry / Outer
geo_3 = Geometry([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])

# ---- group: Geometry
explode = Explode(Curve=geo_3, Recursive=True)  # -> Segments, flatten(Vertices)
debrep = DeconstructBrep(Brep=geo)  # -> Faces, Edges, Vertices
explode_2 = Explode(Curve=geo_2, Recursive=True)  # -> Segments, Vertices
# 01 - Space Ball
# Difficulty: Moderate
# This signature children's playground equipment is comprised of a frame and a cablenet structure. Initial strain is defined in the net and the entire structure is analyzed in Second Order Theory.
# Move the position of the child to see how the structure deforms. (Definition by Georg Lobe)
rdlines = RemoveDuplicateLinesKaramba3D(Line=flatten(debrep.Edges), LimitDistance=0.005)  # -> OutLine, Info, Indexes
rdlines_2 = RemoveDuplicateLinesKaramba3D(Line=flatten(explode_2.Segments), LimitDistance=0.005)  # -> OutLine, Info, Indexes
crv = Curve(flatten(explode.Segments))
curvepoint = PointOnCurve(crv, parameter=0.5)
pdecon = Deconstruct(Point=curvepoint)  # -> XComponent, YComponent, ZComponent
expression = Expression(x=pdecon.ZComponent, Expression="if(x ≤ 0.001, False, True)")
merge = Merge(Data1=rdlines.OutLine, Data2=rdlines_2.OutLine)  # -> flatten(Result)
cull = CullPattern(List=crv, CullPattern=expression)

# ---- group: Define Beam-Cross Section
matselect = MaterialSelectionKaramba3D(menu=[dropdown(1), dropdown(1)])
cross_section = CrossSectionKaramba3D(
    FamilyNameOfCrossSection="DefaultCroSec",
    Material=matselect,
    Diameter_cm="8",
    WallThickness_cm=0.4,
    mode="Circular Hollow")

# ---- group: Define Net-Cross Section
matselect_2 = MaterialSelectionKaramba3D(menu=[dropdown(1), dropdown(1)])
cross_section_2 = CrossSectionKaramba3D(
    FamilyNameOfCrossSection="DefaultCroSec",
    Material=matselect_2,
    Diameter_cm="1.5",
    WallThickness_cm=0.4,
    mode="Circular Hollow")

# ---- group: Define Outer Beam-Elements
crv_2 = Curve(cull)
rdlines_3 = RemoveDuplicateLinesKaramba3D(Line=crv_2, LimitDistance=0.005)  # -> OutLine, Info, Indexes
linetobeam = LineToBeamKaramba3D(
    Line=rdlines_3.OutLine,
    Identifier="beam",
    CrossSection=cross_section,
    New=True,
    Remove=True,
    LimitDistance_m=0.005,
    Bending=Toggle(True),
    SetBucklingLength=True,
    ToPolylineMaxAngle=0.03,
    ToPolylineTolerance=0.01,
    ToPolylineMinEdgeLength=0.25)  # -> Element, Points, Info

# ---- group: Define Supports
cluster = Cluster(point=linetobeam.Points)
supp = SupportKaramba3D(PosInd=cluster, menu=[buttons(on, on, on, off, off, off)])

# ---- group: Define Loads
eps0 = Slider(0.4, range=0..3)
position_monkey = Slider(0.425, range=0..1)
crv_3 = Curve(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)
panel = Panel("""0
1""")
loads = LoadsKaramba3D(Vector="{0,0,-1}", LCase=panel, mode="Gravity")
eval = EvaluateCurve(Curve=reparameterize(crv_3), Parameter=position_monkey)  # -> Point, Tangent, Angle
neg = Negative(Value=eps0)
X = UnitX(Factor=neg)
panel_2 = Panel("net")
panel_3 = Panel("-1")
srf = Surface(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)
orient = Orient(Geometry=srf, Source=PlaneXY(0, 0, 0), Target=eval.Point)  # -> Geometry, Transform
preview = CustomPreview(Geometry=[orient.Geometry, crv_3], Material=ColourSwatch(SwatchColor=RGBA(186, 186, 186, 120)))
weight_of_child_kg = Panel("20")

# ----
loads_2 = LoadsKaramba3D(Eps0=X, ElementIdentifiers=panel_2, LCase=panel_3, mode="InitialStrain")

# ---- group: Define and Orientate the Net-Elements
rdlines_4 = RemoveDuplicateLinesKaramba3D(Line=merge, LimitDistance=0.005)  # -> OutLine, Info, Indexes
toggle = BooleanToggle(False)
panel_4 = Panel("net")
end = EndPoints(Curve=rdlines_4.OutLine)  # -> Start, End
vec2pt = Vector2Pt(PointA=end.Start, PointB=end.End, Unitize=Toggle(True))  # -> Vector, Length

# ----
linetobeam_2 = LineToBeamKaramba3D(
    Line=rdlines_4.OutLine,
    Identifier=panel_4,
    New=True,
    Remove=True,
    LimitDistance_m=0.005,
    Bending=toggle,
    SetBucklingLength=True,
    ToPolylineMaxAngle=0.03,
    ToPolylineTolerance=0.01,
    ToPolylineMinEdgeLength=0.25)  # -> Element, Points, Info

# ---- group: Define Loads (continued)
rdpoints = RemoveDuplicatePointsKaramba3D(Point=linetobeam_2.Points, LimitDistance=0.005)  # -> OutPoint, Info, Indexes
dist = Distance(PointA=rdpoints.OutPoint, PointB=eval.Point)
expression_2 = Expression(x=dist, Expression="if(x ≤ 0.3, False, True)")
cull_2 = CullPattern(List=rdpoints.OutPoint, CullPattern=invert(expression_2))
lng = ListLength(List=cull_2)
division = Division(A=weight_of_child_kg, B=lng)
Z = UnitZ(Factor=expr("-x/100", division))
loads_3 = LoadsKaramba3D(ForceVector=Z, Local=False, PosInd=cull_2, LCase="1", mode="Point")
merge_2 = Merge(Data1=loads, Data2=loads_2, Data3=loads_3)  # -> flatten(Result)
load = LoadKaramba3D(merge_2)

# ---- group: Define and Orientate the Net-Elements (continued)
orientate = OrientateElemKaramba3D(Beam=linetobeam_2.Element, XOrientation=vec2pt.Vector, mode="Beam")
modifyelem = ModifyElementKaramba3D(Beam=orientate, CrossSection=cross_section_2, NII_kN="1", mode="Beam")

# ----
element = ElementKaramba3D([modifyelem, linetobeam.Element])

# ---- group: Assamble Model
assemble = AssembleModelKaramba3D(Elem=flatten(element), Support=flatten(supp), Load=flatten(load), LimitDistance_m=0.005)  # -> Model, Info, Mass_kg, CenterOfGravity, LoadCaseNames

# ---- group: Analyze Model
analyzethii = AnalyzeThIIKaramba3D(Model=assemble.Model, RTolerance=1e-07, MaxIterations=50, NoTensionalNII=False)  # -> CalculatedModel, MaximumDisplacement_cm, ResultingForceOfGravity_kN, ElasticEnergy_kNm
panel_5 = Panel(analyzethii.MaximumDisplacement_cm)
panel_6 = Panel(analyzethii.ResultingForceOfGravity_kN)
panel_7 = Panel(analyzethii.ElasticEnergy_kNm)

# ---- group: View Beam Results
modelview = ModelViewKaramba3D(Model=analyzethii.CalculatedModel, ResultFactors=1, ResultCase=-1)  # -> Model, DeformedMesh, DeformedAxes, DeformedModel
beamview = BeamViewKaramba3D(Model=modelview.Model)  # -> Model, MeshesOfRenderedBeams, DeformedBeamAxes, LegendColors, LegendTags
legend = Legend(Colour=beamview.LegendColors, Tags=beamview.LegendTags, LegendType=1)

# ==== cluster Cluster
point = ClusterInput()
point_2 = Point(point)
deconstruct = Deconstruct(Point=point_2)  # -> XComponent, YComponent, ZComponent
expression = Expression(x=deconstruct.ZComponent, Expression="if(x=0, true, false)")
cull_pattern = CullPattern(List=point_2, CullPattern=expression)
point_3 = Point(cull_pattern)
point_4 = ClusterOutput(point_3)
