# Grasshopper definition 03_Optimization_InclinedColumnPositions.gh (Grasshopper 1.0.7)
# plug-ins: Karamba3D, Octopus

# ---- group: Create Geometry
genes = GenePool(
    Decimals=2,
    Maximum=1,
    Minimum=0,
    Value=[0.665057336, 0.7077662486, 0.1745052601, 0.4113113332, 0.6070020028, 0.7648282618, 0.2847266512, 0.234322781, 0.05803681769, 0.04016988055, 0.8630773999, 0.5202322027, 0.3532711247, 0.8044202345, 0.7323035874, 0.8809566366, 0.9537981276, 0.2454335597, 0.6324080497, 0.391114483])
genes_2 = GenePool(
    Decimals=2,
    Maximum=1,
    Minimum=0,
    Value=[0.04004128913, 0.09347920476, 0.5730534145, 0.8053407946, 0.3802742397, 0.7345801615, 0.4802135903, 0.1309763088, 0.9488566339, 0.9626441298, 0.2623109883, 0.1368457183, 0.7142720111, 0.765837049, 0.09710815101, 0.3887123712, 0.4905778314, 0.1193665021, 0.9254428342, 0.2234916698])
remap = RemapNumbers(Value=genes_2, Source=Domain(0, 1), Target="0.15 to 0.85")  # -> Mapped, Clipped
remap_2 = RemapNumbers(Value=genes, Source=Domain(0, 1), Target="-3.5 to 3.5")  # -> Mapped, Clipped
# 03 - Optimization of Inclined Column Positions
# Difficulty: Hard (PRO version only)
# The position of inclined columns for a shell roof structure is optimized. This shows how beams and shells are integrated into a single model.
# 3d shapes are used during the optimization to reduce the columns from intersecting predefined regions. The surface, boxes and region of columns can be altered.
srf = Surface(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)
dispatch = Dispatch(List=remap.Mapped, DispatchPattern=[True, False])  # -> ListA, ListB
vec = VectorXYZ(XComponent=dispatch.ListA, YComponent=dispatch.ListB, ZComponent=0)  # -> Vector, Length
evalsrf = EvaluateSurface(Surface=reparameterize(srf), Point=vec.Vector)  # -> Point, Normal, UDirection, VDirection, Frame
devec = DeconstructVector(Vector=evalsrf.Point)  # -> XComponent, YComponent, ZComponent
dispatch_2 = Dispatch(List=remap_2.Mapped, DispatchPattern=[True, False])  # -> ListA, ListB
crv = Curve(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)
sdivide = DivideSurface(Surface=srf, UCount=1, VCount=1)  # -> flatten(Points), Normals, Parameters
addition = Addition(A=devec.XComponent, B=dispatch_2.ListA)
addition_2 = Addition(A=devec.YComponent, B=dispatch_2.ListB)
item = ListItem(List=sdivide.Points, Index=0, Wrap=True)  # -> Item, Item1, Item2, Item3
pt = ConstructPoint(XCoordinate=addition, YCoordinate=addition_2, ZCoordinate=0)
boundary = BoundarySurfaces(Edges=crv)
r = Slider(1.5, range=0.5..4)
pull = PullPoint(Point=pt, Geometry=boundary, ClosestOnly=True)  # -> ClosestPoint, Distance
preview = CustomPreview(Geometry=boundary, Shader=ColourSwatch(SwatchColor=RGB(207, 207, 207)))
aligndim = AlignedDimension(
    Plane=PlaneXY(0, 0, 0),
    PointA=[item.Item, item.Item2],
    PointB=[item.Item1, item.Item],
    Offset=4,
    Text="{0:0.00}",
    Size=1)
pt_2 = Point(evalsrf.Point)
mesh_breps = MeshBreps(
    Brep=srf,
    InclusionPoints=pt_2,
    MeshResolution=r,
    EdgeRefinementFactor=0.67,
    PointReduction=False,
    SmoothingStepSize=0.8,
    SmoothingIterations=5)  # -> Mesh, Info
ln = Line(StartPoint=pt_2, EndPoint=pull.ClosestPoint)

# ---- group: Define Materials
matselect = MaterialSelectionKaramba3D(menu=[dropdown(1), dropdown(2)])

matselect_2 = MaterialSelectionKaramba3D(menu=[dropdown(9), dropdown(19)])

# ---- group: Define Cross Sections
range = Range(Domain="5 to 55", Steps=10)
concat = Concatenate(FragmentA="shell", FragmentB=range)
cross_section = CrossSectionKaramba3D(
    FamilyNameOfCrossSection="shell",
    NameOfCrossSection=graft(concat),
    Material=matselect_2,
    Height_cm=graft(range),
    mode="Shell - Const")  # -> flatten(CrossSection)
crosecselect = CrossSectionSelectorKaramba3D(CrossSections=cross_section)  # -> CrossSection, Info

range_2 = Range(Domain="5 to 35", Steps=10)
concat_2 = Concatenate(FragmentA="r", FragmentB=range_2)
cross_section_2 = CrossSectionKaramba3D(
    FamilyNameOfCrossSection="r",
    NameOfCrossSection=concat_2,
    Material=matselect,
    Diameter_cm=range_2,
    WallThickness_cm=expr("x*0.1", range_2),
    mode="Circular Hollow")
crosecselect_2 = CrossSectionSelectorKaramba3D(CrossSections=cross_section_2)  # -> CrossSection, Info

# ---- group: Define Joints
beam_joints = BeamJointsKaramba(
    ElementIdentifiers="b",
    CtKNMAtStartingNode=Vector(0, 0, 0),
    CrKNmRadAtStartingNode="{0,1,1}",
    CtKNMAtEndNode=Vector(0, 0, 0),
    CrKNmRadAtEndNode=Vector(0, 0, 0),
    menu=[buttons(off, off, off, off, on, on), buttons(off, off, off, off, off, off)])

# ---- group: Define Elements
linetobeam = LineToBeamKaramba3D(
    Line=ln,
    Identifier="b",
    CrossSection=crosecselect_2.CrossSection,
    New=True,
    Remove=True,
    LimitDistance_m=0.005,
    Bending=True,
    SetBucklingLength=True,
    ToPolylineMaxAngle=0.03,
    ToPolylineTolerance=0.01,
    ToPolylineMinEdgeLength=0.25)  # -> Element, Points, Info
meshtoshell = MeshToShellKaramba3D(Mesh=mesh_breps.Mesh, Identifier="s", CrossSection=crosecselect.CrossSection, LimitDistance_m=0.005)  # -> Element, Points, Info

# ---- group: Define Supports
supp = SupportKaramba3D(PosInd=pull.ClosestPoint, menu=[buttons(on, on, on, off, off, off)])

# ---- group: Define Loads
panel = Panel("""{0,-2,0}
{0,2,0}
{0,2,0}
{0,-2,0}""")
subsrf = Isotrim(Surface=reparameterize(srf), Domain=[Domain2(u=0..0.5, v=0..1), Domain2(u=0.5..1, v=0..1)])
panel_2 = Panel("""4
5""")
panel_3 = Panel("""{0,0,-1}
{2,0,0}
{0,2,0}
{-2,0,0}
{0,-2,0}""")
panel_4 = Panel("""-1
0
1
2
3""")
panel_5 = Panel("{0,0,1.35}")
panel_6 = Panel("-1")
partition = PartitionList(List=panel, Size=2)
mesh = MeshBrep(
    Brep=subsrf,
    Settings={GridMaxCount=0, GridMinCount=16, JaggedSeams=False, MaxEdgeLength=0, MinEdgeLength=0.0001, MinTolerance=0, Refine=True, RefineAngle=0, RelativeTolerance=0.65, SimplePlanes=True, Tolerance=0})
loads = LoadsKaramba3D(
    Vector=partition,
    Mesh=mesh,
    LCase=graft(panel_2),
    mode="MeshLoad -Const.",
    menu=[buttons(off, off, on), buttons(on, off)])
loads_2 = LoadsKaramba3D(
    Vector=panel_3,
    Mesh=mesh_breps.Mesh,
    LCase=panel_4,
    mode="MeshLoad -Const.",
    menu=[buttons(off, off, on), buttons(on, off)])

# ----
loads_3 = LoadsKaramba3D(Vector=panel_5, LCase=panel_6, mode="Gravity")

# ---- group: Define Loads (continued)
load = LoadKaramba3D(flatten([loads_2, loads_3, loads]))

# ---- group: Assemble Model
assemble = AssembleModelKaramba3D(
    Elem=flatten([linetobeam.Element, meshtoshell.Element]),
    Support=supp,
    Load=load,
    Joint=beam_joints,
    LimitDistance_m=0.005)  # -> Model, Info, Mass_kg, CenterOfGravity, LoadCaseNames

# ---- group: Optimize Cross Sections
max_deformation = Panel("9/150")
opticrosec = OptimizeCrossSectionKaramba3D(
    Model=assemble.Model,
    CrossSections=flatten([cross_section, cross_section_2]),
    MaximumUtilization=1,
    MaximumDisplacement_cm=max_deformation,
    UltimateLimitStateIterations=5,
    DisplacementIterations=5,
    NumberOfSamplePoints=3,
    ElasticDesign=True,
    GammaM0=1,
    GammaM1=1.1,
    SwayFrame=True)  # -> ModelWithOptimizedCrossSections, Info, Mass_kg, MaximumDisplacement_cm, ElasticEnergy_kNm
panel_7 = Panel(opticrosec.MaximumDisplacement_cm)

# ---- group: Analyze Model - FREE VERSION
analyze = AnalyzeKaramba3D(Model=assemble.Model)  # -> CalculatedModel, MaximumDisplacement_cm, ResultingForceOfGravity_kN, ElasticEnergy_kNm
panel_8 = Panel(analyze.MaximumDisplacement_cm)

# ---- group: View Results
panel_9 = Panel("""0
1
2
3
4
5""")
sort = SortList(Keys=opticrosec.MaximumDisplacement_cm, ValuesA=panel_9)  # -> Keys, ValuesA
item_2 = ListItem(List=reverse(sort.ValuesA), Index=0, Wrap=True)
item_3 = ListItem(List=reverse(sort.Keys), Index=0, Wrap=True)
panel_10 = Panel(item_3)
modelview = ModelViewKaramba3D(Model=opticrosec.ModelWithOptimizedCrossSections, ResultFactors=1, ResultCase=item_2)  # -> Model, DeformedMesh, DeformedAxes, DeformedModel
beamview = BeamViewKaramba3D(Model=modelview.Model)  # -> Model, MeshesOfRenderedBeams, DeformedBeamAxes, LegendColors, LegendTags
shellview = ShellViewKaramba3D(Model=modelview.Model, IndexOfLayer=0)  # -> Model, MeshesOfRenderedShells, LegendColors, LegendTags
legend = Legend(Colour=beamview.LegendColors, Tags=beamview.LegendTags, LegendType=1)
legend_2 = Legend(Colour=shellview.LegendColors, Tags=shellview.LegendTags, LegendType=1)

# ---- group: Multi Objective Optimization with Octopus - mass, conflicts with 3d shapes, distribution of column positions
mesh_2 = Mesh([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])
con = DelaunayEdges(Points=pull.ClosestPoint, Plane=PlaneXY(0, 0, 0))  # -> Connectivity, Edges
preview_2 = CustomPreview(Geometry=mesh_2, Shader=ColourSwatch(SwatchColor=RGBA(255, 255, 255, 168)))
len = Length(Curve=con.Edges)
mjoin = MeshJoin(Meshes=mesh_2)
preview_3 = CustomPreview(Geometry=con.Edges, Shader=ColourSwatch(SwatchColor=RGB(115, 115, 115)))
sort_2 = SortList(Keys=len)  # -> Keys, ValuesA
mcx = MeshCurve(Mesh=mjoin, Curve=ln)  # -> flatten(Points), Faces
item_4 = ListItem(List=sort_2.Keys, Index=0, Wrap=True)
lng = ListLength(List=mcx.Points)  # -> expr("x/2", Length)
neg = Negative(Value=item_4)
num = Number(opticrosec.Mass_kg)
merge = Merge(Data1=flatten(num), Data2=flatten(lng), Data3=flatten(neg))
octopus = Octopus(Phenotype=mjoin, OctopusData_gene=[genes, genes_2], OctopusData_obj=[num_2, txt])
num_2 = Number(merge)
panel_11 = Panel(num_2)
panel_12 = Panel("""total Mass
Conflicts
Distribution""")
txt = Text(panel_12)

# ---- group: Single Objective Optimization with Galapagos - max. Displacement
num_3 = Number(opticrosec.MaximumDisplacement_cm)
sort_3 = SortList(Keys=num_3)  # -> Keys, ValuesA
item_5 = ListItem(List=reverse(sort_3.Keys), Index=0, Wrap=True)
galapagos = Galapagos(fitness=num_4, gene=[genes, genes_2])
num_4 = Number(item_5)
panel_13 = Panel(num_4)
