# Grasshopper definition 04_LargeDeformationShell.gh (Grasshopper 1.0.7)
# plug-ins: Karamba3D, Human

# ---- group: Create Geometry - Variation 1
pt = Point([Point(33.96332901, 1.32551419, 0), Point(2.017045573, 10.76809706, 0), Point(10.17070721, 37.6476561, 0), Point(33.81881526, 42.32263155, 0), Point(57.75311296, 32.8257045, 0), Point(73.36081434, 23.95538702, 0), Point(62.06920813, 9.608368494, 0), Point(46.49277597, 24.18034478, 0)])
d = Slider(0.54, range=0.1..2)
t = Slider(0.53, range=0..1)
o = Slider(0.29, range=0..1)
voronoi = Voronoi(Points=pt, BruteForceOverride=False)
xy = XYPlane(Origin=Point(0, 0, 0))
pline = PolyLine(Vertices=pt, Closed=True)
item = ListItem(List=pt, Index=0, Wrap=True)  # -> Item1, Item, Item1_2, Item2
trim = TrimWithRegion(Curve=voronoi, Region=pline, Plane=xy)  # -> Inside, Outside
aligndim = AlignedDimension(
    Plane=PlaneXY(0, 0, 0),
    PointA=[item.Item, item.Item1, item.Item1_2],
    PointB=[item.Item1_2, item.Item, item.Item2],
    Offset=2,
    Text="{0:0.00}",
    Size=1)
# 04 - Large Deformation of a Shell
# Difficulty: Hard
# Using the Large Deformation Analysis we can simulate the behaviour of a hanging model to find the optimum form for the applied stresses. The principle stress lines of the shell can be view after the analysis.
# For viewing in the FREE Version use a Analyze Model component instead of the Optimize Cross Section component. For viewing in the Trial Version set the Mesh Resolution of the Mesh Breps component to 10.
end = EndPoints(Curve=trim.Inside)  # -> Start, End
eval = EvaluateCurve(Curve=reparameterize(trim.Inside), Parameter=o)  # -> Point, Tangent, Angle
avr = Average(Input=[end.Start, end.End])
ln = Line(StartPoint=end.Start, EndPoint=end.End)
eval_2 = EvaluateLength(Curve=ln, Length=d, Normalized=False)  # -> Point, Tangent, Parameter
ln_2 = Line(StartPoint=avr, EndPoint=eval.Point)
eval_3 = EvaluateCurve(Curve=ln, Parameter=eval_2.Parameter)  # -> flatten(Point), Tangent, Angle
eval_4 = EvaluateCurve(Curve=ln, Parameter=expr("1-x", eval_2.Parameter))  # -> flatten(Point), Tangent, Angle
eval_5 = EvaluateCurve(Curve=ln_2, Parameter=t)  # -> flatten(Point), Tangent, Angle
circle = Circle3Pt(PointA=eval_3.Point, PointB=eval_4.Point, PointC=eval_5.Point)  # -> Circle, Plane, Radius
xy_2 = XYPlane(Origin=Point(0, 0, 0))
trim_2 = TrimWithRegion(Curve=circle.Circle, Region=pline, Plane=xy_2)  # -> flatten(Inside), Outside
end_2 = EndPoints(Curve=trim_2.Inside)  # -> Start, End
shift = ShiftList(List=end_2.End, Shift=1, Wrap=True)
crv = Curve(trim_2.Inside)
ln_3 = Line(StartPoint=end_2.Start, EndPoint=shift)

# ---- group: Create Geometry - Variation 2
pt_2 = Point([Point(108.5416597, 6.725562972, 0), Point(84.83303144, 11.08020898, 0), Point(82.49442525, 37.04680182, 0), Point(105.315996, 44.14326197, 0), Point(119.8314827, 35.63127082, 0), Point(134.5888941, 31.80509829, 0), Point(143.2981861, 22.20874877, 0), Point(130.8245815, 16.82988768, 0), Point(119.3476331, 18.0074646, 0)])
pline_2 = PolyLine(Vertices=pt_2, Closed=True)
item_2 = ListItem(List=pt_2, Index=0, Wrap=True)  # -> Item1, Item, Item1_2, Item2
disc = Discontinuity(Curve=pline_2, Level=1)  # -> Points, Parameters
aligndim_2 = AlignedDimension(
    Plane=PlaneXY(0, 0, 0),
    PointA=[item_2.Item, item_2.Item1, item_2.Item1_2],
    PointB=[item_2.Item1_2, item_2.Item, item_2.Item2],
    Offset=2,
    Text="{0:0.00}",
    Size=1)
explode = Explode(Curve=pline_2, Recursive=True)  # -> Segments, Vertices
hframe = HorizontalFrame(Curve=reparameterize(explode.Segments), Parameter=1)
shift_2 = ShiftList(List=disc.Points, Shift="2", Wrap=True)
d_2 = Slider(0.6, range=0.1..2)
l = Slider(0.27, range=0.1..1)
a = Slider(0.147, range=-0.785..0.785)
prot = RotatePlane(Plane=hframe, Angle=3.141592654)
polar = ToPolar(Point=shift_2, System=prot)  # -> Phi, Theta, Radius
pt_3 = PointCylindrical(BasePlane=prot, Angle=expr("x/2", polar.Phi), Radius=1, Elevation=0)
vec2pt = Vector2Pt(PointA=prot, PointB=pt_3, Unitize=True)  # -> Vector, Length
crv_2 = Curve(explode.Segments)
shift_3 = ShiftList(List=vec2pt.Vector, Shift="-1", Wrap=True)
len = Length(Curve=crv_2)
expression = Expression(x=vec2pt.Vector, l=len, y=l, Expression="x*l²*y*0.1")
expression_2 = Expression(x=shift_3, l=len, y=l, Expression="x*l²*y*0.1")
subtraction = Subtraction(A=len, B=d_2)
eval_6 = EvaluateCurve(Curve=crv_2, Parameter=subtraction)  # -> Point, Tangent, Angle
vrot = Rotate(Vector=expression, Axis=Vector(0, 0, 1), Angle=expr("-x", a))
eval_7 = EvaluateCurve(Curve=crv_2, Parameter=d_2)  # -> Point, Tangent, Angle
vrot_2 = Rotate(Vector=expression_2, Axis=Vector(0, 0, 1), Angle=a)
shift_4 = ShiftList(List=eval_7.Point, Shift="1", Wrap=True)
vdis = VectorDisplay(Anchor=eval_6.Point, Vector=vrot)
bzspan = BezierSpan(StartPoint=eval_6.Point, StartTangent=vrot, EndPoint=eval_7.Point, EndTangent=vrot_2)  # -> Curve, Length, Domain
vdis_2 = VectorDisplay(Anchor=eval_7.Point, Vector=vrot_2)
ln_4 = Line(StartPoint=eval_6.Point, EndPoint=shift_4)

# ---- group: Toggle between Variations & Mesh Geometry
toggle = BooleanToggle(False)
filter = StreamFilter(Gate=toggle, Stream0=flatten(crv), Stream1=flatten(bzspan.Curve))
filter_2 = StreamFilter(Gate=toggle, Stream0=flatten(ln_3), Stream1=flatten(ln_4))
mres = Slider(0.6, range=0.5..10)
boundary = BoundarySurfaces(Edges=[filter, filter_2])
mesh_breps = MeshBreps(
    Brep=boundary,
    MeshResolution=mres,
    EdgeRefinementFactor="0.5",
    PointReduction=False,
    SmoothingStepSize=0.6,
    SmoothingIterations=5)  # -> Mesh, Info

# ---- group: Define Cross Sections
cross_section = CrossSectionKaramba3D(
    FamilyNameOfCrossSection="DefaultCroSec",
    ElementIdentifier="S",
    Material=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,
    Height_cm="30",
    mode="Shell - Const")

# ---- group: Define Loads
Z = UnitZ(Factor=1)
loads = LoadsKaramba3D(Vector=Z, LCase="0", mode="Gravity")

# ---- group: Define Elements
meshtoshell = MeshToShellKaramba3D(Mesh=mesh_breps.Mesh, Identifier="S", CrossSection=cross_section, LimitDistance_m=0.005)  # -> Element, Points, Info

# ---- group: Define Supports
pt_4 = Point(meshtoshell.Points)
pull = PullPoint(Point=pt_4, Geometry=filter_2, ClosestOnly=True)  # -> ClosestPoint, Distance
smaller = SmallerThan(FirstNumber=pull.Distance, SecondNumber="0.01")  # -> SmallerThan, OrEqualTo
cull = CullPattern(List=pt_4, CullPattern=smaller.SmallerThan)
supp = SupportKaramba3D(PosInd=cull, menu=[buttons(on, on, on, off, off, on)])

# ---- group: Assemble Model
assemble = AssembleModelKaramba3D(Elem=meshtoshell.Element, Support=supp, Load=loads, LimitDistance_m=0.005)  # -> Model, Info, Mass_kg, CenterOfGravity, LoadCaseNames

# ---- group: Perform Large Deformation Analysis
i = Slider(20, range=5..50)
d_3 = Slider(5, range=0..10)
ladeform = LargeDeformationAnalysisKaramba3D(Model=assemble.Model, Increments=i, MaximumDisplacement_m=d_3)  # -> CalculatedModel, MaximumDisplacement_cm
panel = Panel(ladeform.MaximumDisplacement_cm)

# ---- group: Define Materials
matselect = MaterialSelectionKaramba3D(menu=[dropdown(9), dropdown(19)])

# ---- group: Define Cross Sections
range = Range(Domain="5 to 50", Steps=10)
concat = Concatenate(FragmentA="Shell", FragmentB=range)
cross_section_2 = CrossSectionKaramba3D(
    FamilyNameOfCrossSection="Shell",
    NameOfCrossSection=graft(concat),
    ElementIdentifier="S",
    Material=matselect,
    Height_cm=graft(range),
    mode="Shell - Const")  # -> flatten(CrossSection)
crosecselect = CrossSectionSelectorKaramba3D(CrossSections=cross_section_2, NameOrListIndexOfCrossSection="0")  # -> CrossSection, Info

# ---- group: Disassemble Model
disassemble = DisassembleModelKaramba3D(Model=ladeform.CalculatedModel)  # -> Model, Point, Beam, Shell, Support, Load, Line, Mesh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

# ---- group: Define Loads
loads_2 = LoadsKaramba3D(Vector=Vector(0, 0, -1), LCase="0", mode="Gravity")

# ---- group: Assign New Cross Section
modifyelem = ModifyElementKaramba3D(Shell=disassemble.Shell, CrossSection=crosecselect.CrossSection, mode="Shell")

# ---- group: Assemble Model
assemble_2 = AssembleModelKaramba3D(Point=disassemble.Point, Elem=modifyelem, Support=disassemble.Support, Load=loads_2, LimitDistance_m=0.005)  # -> Model, Info, Mass_kg, CenterOfGravity, LoadCaseNames

# ---- group: Optimize Cross Sections
opticrosec = OptimizeCrossSectionKaramba3D(
    Model=assemble_2.Model,
    CrossSections=cross_section_2,
    MaximumUtilization=1,
    UltimateLimitStateIterations=5,
    DisplacementIterations=5,
    NumberOfSamplePoints=3,
    ElasticDesign=True,
    GammaM0=1,
    GammaM1=1.1,
    SwayFrame=True)  # -> ModelWithOptimizedCrossSections, Info, Mass_kg, MaximumDisplacement_cm, ElasticEnergy_kNm
panel_2 = Panel(opticrosec.Mass_kg)

# ---- group: Analyze Model / Analyze Model (Free Version)
analyze = AnalyzeKaramba3D(Model=assemble_2.Model)  # -> CalculatedModel, MaximumDisplacement_cm, ResultingForceOfGravity_kN, ElasticEnergy_kNm
panel_3 = Panel(analyze.MaximumDisplacement_cm)

# ----
panel_4 = Panel(opticrosec.MaximumDisplacement_cm)

# ---- group: View Results
modelview = ModelViewKaramba3D(Model=opticrosec.ModelWithOptimizedCrossSections, ResultFactors=1, ResultCase=-1)  # -> Model, DeformedMesh, DeformedAxes, DeformedModel
shellview = ShellViewKaramba3D(Model=modelview.Model, IndexOfLayer=0)  # -> Model, MeshesOfRenderedShells, LegendColors, LegendTags
legend = Legend(Colour=shellview.LegendColors, Tags=shellview.LegendTags, LegendType=1)

# ---- group: Visualise Principal Stress Lines
popgeo = PopulateGeometry(Geometry=shellview.MeshesOfRenderedShells, Count=Slider(200, range=20..200), Seed=1)
medges = MeshEdges(Mesh=shellview.MeshesOfRenderedShells)  # -> NakedEdges, InteriorEdges, NonManifoldEdges
shelllineresults = LineResultsOnShellsKaramba3D(
    AnalyzedModel=shellview.Model,
    LayerPosition=Slider(0, range=-1..1),
    ListOfSourcesOfPrincipalStressLinesLinesPoints=flatten(popgeo),
    SegmentLength_m=0.5,
    DA_deg=5,
    mode="PrincStress")  # -> AnalyzedModel, Lines1, Lines2
previewlw = CustomPreviewLineweights(Geometry=medges.NakedEdges, Shader=ColourSwatch(SwatchColor=RGB(0, 0, 0)), Thickness="2")
join = JoinCurves(Curves=shelllineresults.Lines1, Preserve=False)
join_2 = JoinCurves(Curves=shelllineresults.Lines2, Preserve=False)
subcrv = SubCurve(BaseCurve=join, Domain="0 to 20")
subcrv_2 = SubCurve(BaseCurve=join_2, Domain="0 to 20")
preview = CustomPreview(Geometry=subcrv_2, Shader=ColourSwatch(SwatchColor=RGB(255, 0, 0)))
preview_2 = CustomPreview(Geometry=subcrv, Shader=ColourSwatch(SwatchColor=RGB(0, 0, 255)))
