# Grasshopper definition 05_Projectedarrayoflines.gh (Grasshopper 1.0.7)
# plug-ins: Karamba3D

# ---- group: Create Geometry
crv = Curve([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])
loft = Loft(Curves=crv, Options={Adjust=False, Closed=False, LoftEnds=0, LoftSimp=0, LoftType=0, Rebuild=10, Refit=0.01})
range = Range(Domain="0.3*pi to 0.8*pi", Steps=Slider(16, range=0..20))
range_2 = Range(Domain="0.8*pi to 1.3*pi", Steps=Slider(10, range=0..20))
pt = PointCylindrical(BasePlane=PlaneXY(0, 0, 0), Angle=range, Radius=1, Elevation=0)
pt_2 = PointCylindrical(BasePlane=PlaneXY(0, 0, 0), Angle=range_2, Radius=1, Elevation=0)
# 05 - Projected Array of Lines
# Difficulty: Hard (PRO version only)
# A set of lines are projected onto a surface. The cross section optimiser determines the appropriate cross section sizes for each element. By setting eccentricites for the beam elements, the beams are aligned with the original surface.
srf = Surface(loft)
pt_3 = Point(Point(-0.3840705608, -10.0484383, 0))
pt_4 = Point(Point(8.094820132, 2.717709761, 0))
line = LineSDL(Start=pt_3, Direction=pt, Length=40)
line_2 = LineSDL(Start=pt_4, Direction=pt_2, Length=40)
edges = BrepEdges(Brep=srf)  # -> Naked, Interior, NonManifold
project = Project(Curve=line, Brep=srf, Direction=Vector(0, 0, 1))  # -> flatten(Curve)
project_2 = Project(Curve=line_2, Brep=srf, Direction=Vector(0, 0, 1))  # -> flatten(Curve)
explode = Explode(Curve=edges.Naked, Recursive=True)  # -> Segments, Vertices
entwine = Entwine(Branch00=project, Branch01=project_2, Branch02=explode.Segments, FlattenInputs=True)
ccx = CurveCurve(CurveA=reparameterize(graft(entwine)), CurveB=flatten(entwine))  # -> simplify(Points), simplify(ParamsA), ParamsB
trim = TrimTree(Tree=ccx.ParamsA, Depth=1)
sort = SortList(Keys=trim)  # -> Keys, ValuesA
dcon = DeleteConsecutive(Set=sort.Keys, Wrap=False)  # -> Set, Count
consec = ConsecutiveDomains(Numbers=dcon.Set, Additive=False)
subcrv = SubCurve(BaseCurve=reparameterize(graft(entwine)), Domain=consec)
len = Length(Curve=subcrv)
expression = Expression(x=len, y=Slider(0.33, range=0..1), Expression="max((x/y),2)")
reb = RebuildCurve(Curve=subcrv, Degree=1, Count=expression, Tangents=False)
explode_2 = Explode(Curve=reb, Recursive=True)  # -> simplify(Segments), Vertices
trim_2 = TrimTree(Tree=explode_2.Segments, Depth=2)

# ---- group: Define Supports
end = EndPoints(Curve=entwine)  # -> Start, End
rdpoints = RemoveDuplicatePointsKaramba(Point=flatten([end.Start, end.End]), LimitDistance=0.005)  # -> OutPoint, Info, Indexes
item = ListItem(List=crv, Index=0, Wrap=True)  # -> Item1, Item
pt_5 = Point(flatten(rdpoints.OutPoint))
crv_2 = Curve([item.Item1, item.Item])
end_2 = EndPoints(Curve=crv_2)  # -> Start, End
pull = PullPoint(Point=pt_5, Geometry=crv_2, ClosestOnly=True)  # -> ClosestPoint, Distance
aligndim = AlignedDimension(Plane=PlaneXY(0, 0, 0), PointA=end_2.Start, PointB=end_2.End, Offset=1, Text="{0:0.00}", Size=0.2)
smaller = SmallerThan(FirstNumber=pull.Distance, SecondNumber=0.01)  # -> SmallerThan, OrEqualTo
cull = CullPattern(List=pt_5, CullPattern=smaller.SmallerThan)
supp = SupportKaramba3D(PosInd=cull, menu=[buttons(on, on, on, off, off, off)])

# ---- group: Define Cross Sections
range_3 = Range(Domain="10 to 50", Steps="20")
expression_2 = Expression(x="R", y="5", z=range_3, Expression="x & \" \" & y & \"x\" & z")
cross_section = CrossSectionKaramba3D(
    FamilyNameOfCrossSection="R",
    NameOfCrossSection=expression_2,
    Material=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,
    Height_cm=range_3,
    UpperFlangeWidth_cm="5",
    LowerFlangeWidth_cm="5",
    UpperFlangeThickness_cm="1",
    LowerFlangeThickness_cm="1",
    SidewallsThickness_cm=0.4,
    FilletRadius_cm=0.6,
    mode="Box")
Z = UnitZ(Factor=expr("(-x/2)", range_3))
eccent_crosec = EccentricityOnCrossSectionKaramba(CrossSection=cross_section, LocalEccentricity_cm=Z)
item_2 = ListItem(List=eccent_crosec, Index=0, Wrap=True)

# ---- group: Define Joints
panel = Panel("""0
1""")
branch = TreeBranch(Tree=trim_2, Path=panel, MaintainPaths=True)  # -> flatten(Branch)
end_3 = EndPoints(Curve=branch)  # -> Start, End
lng = ListLength(List=end_3.Start)
pull_2 = PullPoint(Point=end_3.Start, Geometry=edges.Naked, ClosestOnly=True)  # -> ClosestPoint, Distance
pull_3 = PullPoint(Point=end_3.End, Geometry=edges.Naked, ClosestOnly=True)  # -> ClosestPoint, Distance
series = Series(Start=0, Step=1, Count=lng)
smaller_2 = SmallerThan(FirstNumber=pull_2.Distance, SecondNumber=0.001)  # -> SmallerThan, OrEqualTo
smaller_3 = SmallerThan(FirstNumber=pull_3.Distance, SecondNumber=0.001)  # -> SmallerThan, OrEqualTo
int = Integer(series)
cull_2 = CullPattern(List=int, CullPattern=smaller_2.SmallerThan)
cull_3 = CullPattern(List=int, CullPattern=smaller_3.SmallerThan)
beam_joints = BeamJointsKaramba(
    ElementIdentifiers=cull_2,
    CtKNMAtStartingNode=Vector(0, 0, 0),
    CrKNmRadAtStartingNode=Vector(0, 0, 0),
    CtKNMAtEndNode=Vector(0, 0, 0),
    CrKNmRadAtEndNode=Vector(0, 0, 0),
    menu=[buttons(off, off, off, off, on, off), buttons(off, off, off, off, off, off)])
beam_joints_2 = BeamJointsKaramba(
    ElementIdentifiers=cull_3,
    CtKNMAtStartingNode=Vector(0, 0, 0),
    CrKNmRadAtStartingNode=Vector(0, 0, 0),
    CtKNMAtEndNode=Vector(0, 0, 0),
    CrKNmRadAtEndNode=Vector(0, 0, 0),
    menu=[buttons(off, off, off, off, off, off), buttons(off, off, off, off, on, off)])

# ---- group: Define Loads
Z_2 = UnitZ(Factor="-2")
mesh = MeshBrep(
    Brep=srf,
    Settings={GridMaxCount=0, GridMinCount=0, JaggedSeams=False, MaxEdgeLength=0.5, MinEdgeLength=0.5, MinTolerance=0, Refine=True, RefineAngle=0, RelativeTolerance=0.65, SimplePlanes=False, Tolerance=0})
loads = LoadsKaramba3D(Vector=Vector(0, 0, -1), LCase="0", mode="Gravity")
loads_2 = LoadsKaramba3D(Vector=Z_2, Mesh=mesh, LCase="0", mode="MeshLoad -Const.", menu=[buttons(off, on, off), buttons(on, off)])
load = LoadKaramba3D(flatten([loads, loads_2]))

# ---- group: Define Elements
beam_ids = Panel("""A
B
C""")
linetobeam = LineToBeamKaramba3D(
    Line=trim_2,
    Identifier=graft(beam_ids),
    CrossSection=item_2,
    New=True,
    Remove=True,
    LimitDistance_m=0.005,
    Bending=True,
    SetBucklingLength=True,
    ToPolylineMaxAngle=0.03,
    ToPolylineTolerance=0.01,
    ToPolylineMinEdgeLength=0.25)  # -> flatten(Element), Points, Info

# ---- group: Assemble Model
assemble = AssembleModelKaramba3D(Elem=linetobeam.Element, Support=supp, Load=load, Joint=flatten([beam_joints, beam_joints_2]), LimitDistance_m=0.005)  # -> Model, Info, Mass_kg, CenterOfGravity, LoadCaseNames

# ---- group: Optimize Cross Sections
opticrosec = OptimizeCrossSectionKaramba3D(
    Model=assemble.Model,
    ElemIdentifiers="A",
    CrossSections=eccent_crosec,
    MaximumUtilization=1,
    UltimateLimitStateIterations=5,
    DisplacementIterations=5,
    NumberOfSamplePoints=3,
    ElasticDesign=True,
    GammaM0=1,
    GammaM1=1.1,
    SwayFrame=True)  # -> ModelWithOptimizedCrossSections, Info, Mass_kg, MaximumDisplacement_cm, ElasticEnergy_kNm
mass = Panel(opticrosec.Mass_kg)
displacement = Panel(opticrosec.MaximumDisplacement_cm)

# ---- group: View Results
modelview = ModelViewKaramba3D(Model=opticrosec.ModelWithOptimizedCrossSections, ResultFactors=1, ResultCase=-1)  # -> Model, DeformedMesh, DeformedAxes, DeformedModel
beamview = BeamViewKaramba3D(Model=modelview.Model)  # -> Model, MeshesOfRenderedBeams, DeformedBeamAxes, LegendColors, LegendTags
legend = Legend(Colour=beamview.LegendColors, Tags=beamview.LegendTags, LegendType=1)
