# Grasshopper definition 05_SetSmartModules.gh (Grasshopper 1.0.7)
# plug-ins: Karamba3D

# ---- group: Reference Geometry
srf = Surface(<surface referenced from the Rhino model>)
number_slider = Slider(15, range=0..50)
number_slider_2 = Slider(10, range=0..50)
# 05 Set Smart Modules
# Difficulty: Hard
# This definition takes surface input from rhino, divides it as a mesh according to density sliders, analyzes the distribution of forces on the mesh and applies a series of rhino-modeled modules according to the force pattern.
# steps to alter:
# 1. change slider that controls mesh density
# 2. change the graph-mapper to adjust the domain of results
# 3. input new surface
# 4. define new modules
# This work is licensed under a Creative Commons Attribution 4.0 licence. You are free to copy, communicate and adapt the work, so long as you attribute the work in the manner specified by the author or licensor (but not in any way that suggests that they endorse you or your use of the work). A copy of this licence is available at http://http://creativecommons.org/licenses/by/4.0/ or write to info@creativecommons.org
mesh_uv = MeshSurface(Surface=srf, UCount=number_slider, VCount=number_slider_2, Overhang=True, Equalize=False)
divide = DivideDomain²(Domain=srf, UCount=number_slider, VCount=number_slider_2)

brep = Brep(<brep referenced from the Rhino model>)
brep_2 = Brep(<brep referenced from the Rhino model>)
brep_3 = Brep(<brep referenced from the Rhino model>)
brep_4 = Brep(<brep referenced from the Rhino model>)
entwine = Entwine(Branch00=brep, Branch01=brep_2, Branch02=brep_3, Branch03=brep_4, FlattenInputs=True)  # -> simplify(Result)

# to apply to a new model:
# right-click and set multiple points;
# 
# ** points must be near intended supports;
# definition will automatically snap to closest node in model
pt = Point([<point referenced from the Rhino model> x2])

# ---- group: Define Loads
live_load = Slider(-2, range=-5..5)
Z = UnitZ(Factor="-1")
Z_2 = UnitZ(Factor=live_load)
mesh = Mesh(mesh_uv)
loads = LoadsKaramba3D(Vector=Z, LCase="0", mode="Gravity")
loads_2 = LoadsKaramba3D(Vector=Z_2, Mesh=mesh, LCase="0", mode="MeshLoad -Const.", menu=[buttons(on, off, off), buttons(on, on)])
load = LoadKaramba3D(flatten([loads, loads_2]))

# ---- group: Define Elements
panel = Panel("baseShell")
meshtoshell = MeshToShellKaramba3D(Mesh=mesh_uv, Identifier=panel, LimitDistance_m=0.005)  # -> Element, Points, Info

# ---- group: Define Supports
fsim = FindSimilarMember(Data=pt, Set=meshtoshell.Points)  # -> Hit, Index
supp = SupportKaramba3D(PosInd=fsim.Hit, menu=[buttons(on, on, on, on, on, on)])

# ---- group: Assemble Model
assemble = AssembleModelKaramba3D(Elem=meshtoshell.Element, Support=supp, Load=load, LimitDistance_m=0.005)  # -> Model, Info, Mass_kg, CenterOfGravity, LoadCaseNames

# ---- group: Analyze Model
analyze = AnalyzeKaramba3D(Model=assemble.Model)  # -> CalculatedModel, MaximumDisplacement_cm, ResultingForceOfGravity_kN, ElasticEnergy_kNm
displacement = Panel(analyze.MaximumDisplacement_cm)

# ---- group: View Results
modelview = ModelViewKaramba3D(Model=analyze.CalculatedModel, ResultFactors=1, ResultCase=-1)  # -> Model, DeformedMesh, DeformedAxes, DeformedModel
shellview = ShellViewKaramba3D(Model=modelview.Model, IndexOfLayer=0)  # -> Model, MeshesOfRenderedShells, LegendColors, LegendTags
legend = Legend(Colour=shellview.LegendColors, Tags=shellview.LegendTags, LegendType=1)

# ---- group: Set Modules
utilization = UtilizationOfElementsKaramba3D(AnalyzedModel=analyze.CalculatedModel, ElementsIdentifiers=panel, mode="Shells")  # -> AnalyzedModel, Utilization
s_forces = ShellForcesKaramba3D(AnalyzedModel=analyze.CalculatedModel, LCase=0, mode="Principal")  # -> AnalyzedModel, FirstPrincipalNormalForce_kN_m, SecondPrincipalNormalForce_kN_m, FirstPrincipalMoment_kNm_m, SecondPrincipalMoment_kNm_m, ShearForceInLocalXDirection_kN_m, ShearForceInLocalYDirection_kN_m
brep_5 = Brep(entwine)
sbox = SurfaceBox(Surface=srf, Domain=divide, Height=Slider(0.795, range=0..10))
bbox = BoundingBox(Content=brep_5, Plane=PlaneXY(0, 0, 0))  # -> Box, Box_2
panel_2 = Panel("""215, 225, 225
215, 175, 175
215, 125, 125
219, 50, 0""")
legend_2 = Legend(Colour=panel_2, Tags=panel_2, LegendType=1)

# ---- group: Set Modules / Compute Face Averages: Utilization
cull = CullPattern(List=utilization.Utilization, CullPattern=[False, True])  # -> graft(List)
cull_2 = CullPattern(List=utilization.Utilization, CullPattern=[True, False])  # -> graft(List)
avr = Average(Input=simplify([cull, cull_2]))
bnd = Bounds(Numbers=flatten(utilization.Utilization))
remap = RemapNumbers(Value=avr, Source=bnd, Target=Domain(0, 1))  # -> Mapped, Clipped

# ---- group: Set Modules / Compute Face Averages: In-Plane Force
cull_3 = CullPattern(List=s_forces.FirstPrincipalNormalForce_kN_m, CullPattern=[False, True])  # -> graft(List)
cull_4 = CullPattern(List=s_forces.FirstPrincipalNormalForce_kN_m, CullPattern=[True, False])  # -> graft(List)
avr_2 = Average(Input=simplify([cull_3, cull_4]))
bnd_2 = Bounds(Numbers=flatten(s_forces.FirstPrincipalNormalForce_kN_m))
remap_2 = RemapNumbers(Value=avr_2, Source=bnd_2, Target=Domain(0, 1))  # -> Mapped, Clipped

# ---- group: Set Modules / Compute Face Averages: Moment Force
cull_5 = CullPattern(List=s_forces.FirstPrincipalMoment_kNm_m, CullPattern=[False, True])  # -> graft(List)
cull_6 = CullPattern(List=s_forces.FirstPrincipalMoment_kNm_m, CullPattern=[True, False])  # -> graft(List)
avr_3 = Average(Input=simplify([cull_5, cull_6]))
bnd_3 = Bounds(Numbers=flatten(s_forces.FirstPrincipalMoment_kNm_m))
remap_3 = RemapNumbers(Value=avr_3, Source=bnd_3, Target=Domain(0, 1))  # -> Mapped, Clipped

# ---- group: Set Modules / remap results to number of reference modules
# PLUG IN DIFFERENT FORCE
# TYPES TO SEE RESULTS
graph = GraphMapper(
    remap_2.Mapped,
    x0=0,
    x1=1,
    y0=0,
    y1=1,
    container_name="Bezier",
    cpx=[0, 0.4590162337, 0.9913064837, 1],
    cpy=[0, 0.5364995003, 1, 1])
remap_4 = RemapNumbers(Value=flatten(graph), Source=Domain(0, 1), Target="0 to 3")  # -> Mapped, Clipped

# ---- group: Set Modules / split list into boolean pattern for each reference module
number_slider_3 = Slider(0, range=0..100)
int = Integer(remap_4.Mapped)
addition = Addition(A=number_slider_3, B=1)
addition_2 = Addition(A=addition, B=1)
addition_3 = Addition(A=addition_2, B=1)
equals = Equality(FirstNumber=number_slider_3, SecondNumber=int)  # -> Equality, Inequality
equals_2 = Equality(FirstNumber=addition, SecondNumber=int)  # -> Equality, Inequality
equals_3 = Equality(FirstNumber=addition_2, SecondNumber=int)  # -> Equality, Inequality
equals_4 = Equality(FirstNumber=addition_3, SecondNumber=int)  # -> Equality, Inequality
entwine_2 = Entwine(
    Branch00=equals.Equality,
    Branch01=equals_2.Equality,
    Branch02=equals_3.Equality,
    Branch03=equals_4.Equality,
    FlattenInputs=True)

# ---- group: Set Modules (continued)
cull_7 = CullPattern(List=sbox, CullPattern=entwine_2)
morph = BoxMorph(Geometry=brep_5, Reference=simplify(bbox.Box), Target=cull_7)
preview = CustomPreview(Geometry=morph, Shader=graft(panel_2))
