# Grasshopper definition 01_ElementSetsInABeamGrid.gh (Grasshopper 1.0.7)
# plug-ins: Karamba3D

# ---- group: Generate Geometry
planesrf = PlaneSurface(Plane=PlaneXY(0, 0, 0), XSize=Domain(-10, 10), YSize=Domain(-10, 10))
sdivide = DivideSurface(Surface=planesrf, UCount=10, VCount=10)  # -> Points, Normals, Parameters
flip = FlipMatrix(Data=sdivide.Points)
# 01 - Element Sets in a Beam Grid
# Difficulty: Simple | Version 2.2.0
# This example shows how to use the Element Set Component in combination with the Cross Section Optimizer for beams.
pline = PolyLine(Vertices=sdivide.Points, Closed=False)
pline_2 = PolyLine(Vertices=flip, Closed=False)
explode = Explode(Curve=pline, Recursive=True)  # -> Segments, Vertices
explode_2 = Explode(Curve=pline_2, Recursive=True)  # -> Segments, Vertices

# ---- group: Set Cross Section
range = Range(Domain="20 to 80", Steps=10)
cross_section = CrossSectionKaramba3D(FamilyNameOfCrossSection="DefaultCroSec", Diameter_cm=range, WallThickness_cm=0.4, mode="Circular Hollow")
item = ListItem(List=cross_section, Index=0, Wrap=True)

# ---- group: Line To Beam
entwine = Entwine(Branch00=explode.Segments, Branch01=explode_2.Segments, FlattenInputs=True)
panel = Panel("""A
B""")
linetobeam = LineToBeamKaramba3D(
    Line=entwine,
    Identifier=graft(panel),
    CrossSection=item,
    New=True,
    Remove=True,
    LimitDistance_m=0.005,
    Bending=True,
    SetBucklingLength=True,
    ToPolylineMaxAngle=0.03,
    ToPolylineTolerance=0.01,
    ToPolylineMaxEdgeLength=0.25)  # -> Element, Points, Info

# ---- group: Define Supports
debrep = DeconstructBrep(Brep=planesrf)  # -> Faces, Edges, Vertices
supp = SupportKaramba3D(PosInd=debrep.Vertices, menu=[buttons(on, on, on, off, off, off)])

# ---- group: Define Loads
Z = UnitZ(Factor="-3")
loads = LoadsKaramba3D(Vector=Z, LCase="0", mode="Gravity")

# ---- group: Element Set
mkset = MakeElementSetKaramba3D(ElementIdentifiers=panel, SetIdentifier="Set A", MinimumSplitLength_m=0.001)

# ---- group: Assemble Model
assemble = AssembleModelKaramba3D(Elem=flatten(linetobeam.Element), Support=supp, Load=loads, BeamSet=mkset, LimitDistance_m=0.005)  # -> Model, Info, Mass_kg, CenterOfGravity, LoadCaseNames

# ---- group: Cross Section Optimizer - ElementID
opticrosec = OptimizeCrossSectionKaramba3D(
    Model=assemble.Model,
    ElemIdentifiers="A",
    CrossSections=cross_section,
    MaximumUtilization=1,
    UltimateLimitStateIterations=5,
    DisplacementIterations=5,
    NumberOfSamplePoints=3,
    ElasticDesign=True,
    GammaM0=1,
    GammaM1=1.1,
    SwayFrame=True)  # -> ModelWithOptimizedCrossSections, Info, Mass_kg, MaximumDisplacement_cm, ElasticEnergyChange_kNm
mass = Panel(opticrosec.Mass_kg)
displacement = Panel(opticrosec.MaximumDisplacement_cm)

# ---- group: Cross Section Optimizer - GroupID
opticrosec_2 = OptimizeCrossSectionKaramba3D(
    Model=assemble.Model,
    GroupIdentifiers="A",
    CrossSections=cross_section,
    MaximumUtilization=1,
    UltimateLimitStateIterations=5,
    DisplacementIterations=5,
    NumberOfSamplePoints=3,
    ElasticDesign=True,
    GammaM0=1,
    GammaM1=1.1,
    SwayFrame=True)  # -> ModelWithOptimizedCrossSections, Info, Mass_kg, MaximumDisplacement_cm, ElasticEnergyChange_kNm
mass_2 = Panel(opticrosec_2.Mass_kg)
displacement_2 = Panel(opticrosec_2.MaximumDisplacement_cm)

# ---- group: Cross Section Optimizer - ElementID & GroupID
opticrosec_3 = OptimizeCrossSectionKaramba3D(
    Model=assemble.Model,
    ElemIdentifiers="A",
    GroupIdentifiers="A",
    CrossSections=cross_section,
    MaximumUtilization=1,
    UltimateLimitStateIterations=5,
    DisplacementIterations=5,
    NumberOfSamplePoints=3,
    ElasticDesign=True,
    GammaM0=1,
    GammaM1=1.1,
    SwayFrame=True)  # -> ModelWithOptimizedCrossSections, Info, Mass_kg, MaximumDisplacement_cm, ElasticEnergyChange_kNm
mass_3 = Panel(opticrosec_3.Mass_kg)
displacement_3 = Panel(opticrosec_3.MaximumDisplacement_cm)

# ---- group: Cross Section Optimizer for ElementSet
opticrosec_4 = OptimizeCrossSectionKaramba3D(
    Model=assemble.Model,
    GroupIdentifiers="Set A",
    CrossSections=cross_section,
    MaximumUtilization=1,
    UltimateLimitStateIterations=5,
    DisplacementIterations=5,
    NumberOfSamplePoints=3,
    ElasticDesign=True,
    GammaM0=1,
    GammaM1=1.1,
    SwayFrame=True)  # -> ModelWithOptimizedCrossSections, Info, Mass_kg, MaximumDisplacement_cm, ElasticEnergyChange_kNm
mass_4 = Panel(opticrosec_4.Mass_kg)
displacement_4 = Panel(opticrosec_4.MaximumDisplacement_cm)

# ---- group: Cross Section Optimizer
opticrosec_5 = OptimizeCrossSectionKaramba3D(
    Model=assemble.Model,
    CrossSections=cross_section,
    MaximumUtilization=1,
    UltimateLimitStateIterations=5,
    DisplacementIterations=5,
    NumberOfSamplePoints=3,
    ElasticDesign=True,
    GammaM0=1,
    GammaM1=1.1,
    SwayFrame=True)  # -> ModelWithOptimizedCrossSections, Info, Mass_kg, MaximumDisplacement_cm, ElasticEnergyChange_kNm
mass_5 = Panel(opticrosec_5.Mass_kg)
displacement_5 = Panel(opticrosec_5.MaximumDisplacement_cm)

# ---- group: Choose one of the different CrossSection Optimizers
list = ValueList({"Cross Section Optimizer": 0, "Cross Section Optimizer - ElementID": 1, "Cross Section Optimizer - GroupID": 2, "Cross Section Optimizer - ElementID & GroupID": 3, "Cross Section Optimizer - ElementSet": 4}, selected="Cross Section Optimizer - ElementID")

# ---- group: Selection of the CrossSection Optimizer
entwine_2 = Entwine(
    Branch00=opticrosec_5.ModelWithOptimizedCrossSections,
    Branch01=opticrosec.ModelWithOptimizedCrossSections,
    Branch02=opticrosec_2.ModelWithOptimizedCrossSections,
    Branch03=opticrosec_3.ModelWithOptimizedCrossSections,
    Branch04=opticrosec_4.ModelWithOptimizedCrossSections,
    FlattenInputs=True)
path = ConstructPath(Indices=list)
split = SplitTree(Data=simplify(entwine_2), Masks=flatten(path))  # -> Positive, Negative
model = ModelKaramba3D(split.Positive)

# ---- group: View Results
modelview = ModelViewKaramba3D(Model=model, ResultFactors=1, ResultCase=-1)  # -> Model, DeformedMesh, DeformedAxes, DeformedModel
beamview = BeamViewKaramba3D(Model=modelview.Model)  # -> Model, MeshesOfRenderedBeams, DeformedBeamAxes, LegendColors, LegendTags
legend = Legend(Colour=beamview.LegendColors, Tags=beamview.LegendTags, LegendType=1)
