# Grasshopper definition 01_InputCurvesAndAnalyzeStructure.gh (Grasshopper 1.0.7)
# plug-ins: Karamba3D

# ---- group: Reference Geometry
# to apply to a new model:
# right-click and set multiple surface
# ** note: low mesh density can
# result in uneven distribution of load
srf = Surface([<surface referenced from the Rhino model> x4])
number_slider = Slider(76, range=0..100)
mesh_uv = MeshSurface(Surface=srf, UCount=number_slider, VCount=number_slider, Overhang=True, Equalize=False)

# to apply to a new model:
# right-click and set multiple curves;
# 
# ** pay close attention to intersections of rhino curves;
# Karamba3D will not read joints if lines are not intersecting
crv = Curve([<curve referenced from the Rhino model> x195])
explode = Explode(Curve=crv, Recursive=True)  # -> flatten(Segments), Vertices
# 01 Input Curves and Analyze Structure
# Difficulty: Moderate
# This definition takes curve input from rhino, converts them to beams and optimizes each cross section.
# 
# Steps to alter:
# 1. change slider that controls loads
# 2. alter existing geometry
# 3. test your own curves, surface loads, and support point input
llinter = LineLineIntersectionKaramba(Line=explode.Segments, LengthTolerance=0.01)  # -> IntersectionPoints, flatten(LineSubSegements)

# to apply to a new model:
# right-click and set multiple points;
# 
# ** points must be near intended supports;
# definition will automatically snap to closest node in model
pt = Point([<point referenced from the Rhino model> x10])

# ---- group: Define Cross Sections
# This work is licensed under a Creative Commons Attribution 4.0 licence. You are free to copy, communicate and adapt the work, so long as you attribute the work in the manner specified by the author or licensor (but not in any way that suggests that they endorse you or your use of the work). A copy of this licence is available at http://http://creativecommons.org/licenses/by/4.0/ or write to info@creativecommons.org
crosecrselect = CrossSectionRangeSelectorKaramba3D(MaximumHeight_cm=-1, MaximumWidth_cm=-1, menu=[dropdown(3), dropdown(1), dropdown(1)])
index = Slider(0, range=0..272)
crosecselect = CrossSectionSelectorKaramba3D(CrossSections=crosecrselect, NameOrListIndexOfCrossSection=index)  # -> CrossSection, Info
panel = Panel(crosecselect.CrossSection)

# ---- group: Define Elements
linetobeam = LineToBeamKaramba3D(
    Line=llinter.LineSubSegements,
    Color=ColourSwatch(SwatchColor=RGB(0, 0, 255)),
    Identifier="beams",
    CrossSection=crosecselect.CrossSection,
    New=True,
    Remove=True,
    LimitDistance_m=0.005,
    Bending=True,
    SetBucklingLength=True,
    ToPolylineMaxAngle=0.03,
    ToPolylineTolerance=0.01,
    ToPolylineMinEdgeLength=0.25)  # -> Element, Points, Info

# ---- group: Define Supports
fsim = FindSimilarMember(Data=pt, Set=linetobeam.Points)  # -> Hit, Index
supp = SupportKaramba3D(PosInd=fsim.Hit, menu=[buttons(on, on, on, off, off, off)])

# ---- group: Define Loads
# live load applied as uniform distributed (mesh) loads
# ** note: low mesh density can
# result in uneven distribution of load
# LIVE LOAD REFERENCE:
# ref: The Structural Basis of Architecture, Sandaker et al.
# residential (typical) 	2 kN/m2  	.04 kip/ft2
# office (tyipcal)  			3 kN/m2  	.06 kip/ft2
# public plazas  	12 kN/m2  	.25 kip/ft2
# athletic facilities (typical)  5 kN/m2  	.1 kip/ft2
# hospitals (operating rooms)  3 kN/m2   .06 kip/ft2
# libraries (book stacks)  7 kN/m2   .15 kip/ft2
# manufacturing (typical)  6 kN/m2   .125 kip/ft2
# heavy equipment   12 kN/m2   .25 kip/ft2
# schools (classrooms)   2 kN/m2   .04 kip/ft2
# schools (hallways)   5 kN/m2   .1 kip/ft2
live_load = Slider(-2, range=-5..5)
Z = UnitZ(Factor="-1")
Z_2 = UnitZ(Factor=live_load)

# ----
loads = LoadsKaramba3D(Vector=Z, LCase="0", mode="Gravity")
loads_2 = LoadsKaramba3D(Vector=Z_2, Mesh=mesh_uv, LCase="0", mode="MeshLoad -Const.", menu=[buttons(off, on, off), buttons(on, on)])

# ---- group: Define Loads (continued)
load = LoadKaramba3D(flatten([loads, loads_2]))

# ---- group: Assemble Model
assemble = AssembleModelKaramba3D(Elem=linetobeam.Element, Support=supp, Load=load, LimitDistance_m=0.005)  # -> Model, Info, Mass_kg, CenterOfGravity, LoadCaseNames
mass = Panel(assemble.Mass_kg)

# ---- group: Analyze Model - FREE VERSION
analyze = AnalyzeKaramba3D(Model=assemble.Model)  # -> CalculatedModel, MaximumDisplacement_cm, ResultingForceOfGravity_kN, ElasticEnergy_kNm
displacement = Panel(analyze.MaximumDisplacement_cm)

# ---- group: Optimize Cross Section
opticrosec = OptimizeCrossSectionKaramba3D(
    Model=assemble.Model,
    CrossSections=crosecrselect,
    MaximumUtilization=1,
    UltimateLimitStateIterations=5,
    DisplacementIterations=5,
    NumberOfSamplePoints=3,
    ElasticDesign=True,
    GammaM0=1,
    GammaM1=1.1,
    SwayFrame=True)  # -> ModelWithOptimizedCrossSections, Info, Mass_kg, MaximumDisplacement_cm, ElasticEnergy_kNm
mass_2 = Panel(opticrosec.Mass_kg)
displacement_2 = Panel(opticrosec.MaximumDisplacement_cm)

# ---- group: Check Beam Internal Forces
# -You can call a specific group of beams using
# the 'BeamIds' input.
# -Adding '3' to the resolution input provides values
# at the middle of each beam in addition to the
# two ends (default).
panel_2 = Panel("3")
cluster = Cluster(C=panel_2)
b_forces = BeamForcesKaramba3D(AnalyzedModel=opticrosec.ModelWithOptimizedCrossSections, Ts=cluster)  # -> AnalyzedModel, NormalForce_kN, ShearForceVz_kN, ShearForceVy_kN, BendingMomentMt_kNm, BendingMomentMy_kNm, BendingMomentMz_kNm, LoadCaseIndex
panel_3 = Panel(b_forces.NormalForce_kN)

# ---- group: View Results
modelview = ModelViewKaramba3D(Model=opticrosec.ModelWithOptimizedCrossSections, ResultFactors=1, ResultCase=-1)  # -> Model, DeformedMesh, DeformedAxes, DeformedModel
beamview = BeamViewKaramba3D(Model=modelview.Model)  # -> Model, MeshesOfRenderedBeams, DeformedBeamAxes, LegendColors, LegendTags
legend = Legend(Colour=beamview.LegendColors, Tags=beamview.LegendTags, LegendType=1)

# ==== cluster Cluster
C = ClusterInput()
series = Series(Start=0, Step=1, Count=C)
bnd = Bounds(Numbers=series)
remap = RemapNumbers(Value=series, Source=bnd, Target="0 to 1")  # -> Mapped, Clipped
C_2 = ClusterOutput(remap.Clipped)
