# Grasshopper definition 01_InputSurfacesAsShell.gh (Grasshopper 1.0.7)
# plug-ins: Karamba3D

# ---- group: Reference Geometry
# Set the mesh uv count to 7 (49 faces) for the trial version of Karamba3D
# (may result in inaccurate results due to the low mesh resolution)
# 
# To apply to a new model: right-click and set a new surface
brep = Brep(<brep referenced from the Rhino model>)
number_slider = Slider(20, range=0..100)
# 01 Input Surfaces As Shell
# Difficulty: Simple
# This definition takes surface input from rhino, converts them to shells and measures performance under loading conditions
# 
# Steps to alter:
# 1. change slider that controls the mesh density
# 2. change the support positions: notice the behavior of the principle stress lines
# 3. change the load directions
# This work is licensed under a Creative Commons Attribution 4.0 licence. You are free to copy, communicate and adapt the work, so long as you attribute the work in the manner specified by the author or licensor (but not in any way that suggests that they endorse you or your use of the work). A copy of this licence is available at http://http://creativecommons.org/licenses/by/4.0/ or write to info@creativecommons.org
mesh_uv = MeshSurface(Surface=brep, UCount=number_slider, VCount=number_slider, Overhang=True, Equalize=False)

# ---- group: Define Cross Sections
cross_section = CrossSectionKaramba3D(
    FamilyNameOfCrossSection="DefaultCroSec",
    Material=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,
    Height_cm=Slider(4, range=0..10),
    mode="Shell - Const")

# ---- group: Define Elements
meshtoshell = MeshToShellKaramba3D(Mesh=mesh_uv, Identifier="shell", CrossSection=cross_section, LimitDistance_m=0.005)  # -> Element, Points, Info
rdpoints = RemoveDuplicatePointsKaramba(Point=meshtoshell.Points, LDist=0.005)  # -> OutPoint, Info, Indexes
points = PointList(Points=rdpoints.OutPoint, Size=Slider(0.116, range=0..1))

# ---- group: Define Supports
# ALTERNATE support input between
# points on the bottom (lowest z value) - FALSE and
# either end (extreme x values) - TRUE of the shell
pt = Point(rdpoints.OutPoint)
pdecon = Deconstruct(Point=pt)  # -> XComponent, YComponent, ZComponent
pdecon_2 = Deconstruct(Point=pt)  # -> XComponent, YComponent, ZComponent
sort = SortList(Keys=pdecon.XComponent)  # -> Keys, ValuesA
rev = ReverseList(List=sort.Keys)
sort_2 = SortList(Keys=pdecon_2.ZComponent)  # -> Keys, ValuesA
item = ListItem(List=rev, Index="0", Wrap=True)
item_2 = ListItem(List=sort.Keys, Index="0", Wrap=True)
item_3 = ListItem(List=sort_2.Keys, Index="0", Wrap=True)
smaller = SmallerThan(FirstNumber=pdecon.XComponent, SecondNumber=item_2)  # -> SmallerThan, OrEqualTo
larger = LargerThan(FirstNumber=pdecon.XComponent, SecondNumber=item)  # -> LargerThan, OrEqualTo
expression = Expression(x=item_3, y=Slider(0, range=0..10), Expression="x+y")
cull = CullPattern(List=pt, CullPattern=smaller.OrEqualTo)
cull_2 = CullPattern(List=pt, CullPattern=larger.OrEqualTo)
smaller_2 = SmallerThan(FirstNumber=pdecon_2.ZComponent, SecondNumber=expression)  # -> SmallerThan, OrEqualTo
cull_3 = CullPattern(List=pt, CullPattern=smaller_2.OrEqualTo)

# ---- group: Define Supports / LOWEST Z supports
supp = SupportKaramba3D(PosInd=cull_3, menu=[buttons(on, on, on, on, on, off)])

# ---- group: Define Supports / END X supports
supp_2 = SupportKaramba3D(PosInd=[cull, cull_2], menu=[buttons(on, on, on, on, on, off)])

# ---- group: Define Supports (continued)
filter = StreamFilter(Gate=Toggle(True), Stream0=supp, Stream1=supp_2)

# ---- group: Define Loads
# Toggle between Vertical Loads - False
# and Lateral Loads - True
pt_2 = Point(rdpoints.OutPoint)
live_load = Slider(-35.851, range=-50..-0.04)
pdecon_3 = Deconstruct(Point=pt_2)  # -> XComponent, YComponent, ZComponent
sort_3 = SortList(Keys=pdecon_3.ZComponent)  # -> Keys, ValuesA
rev_2 = ReverseList(List=sort_3.Keys)
Z = UnitZ(Factor=live_load)
X = UnitX(Factor=live_load)
item_4 = ListItem(List=rev_2, Index="0", Wrap=True)
filter_2 = StreamFilter(Gate=Toggle(False), Stream0=Z, Stream1=X)
larger_2 = LargerThan(FirstNumber=pdecon_3.ZComponent, SecondNumber=item_4)  # -> LargerThan, OrEqualTo
cull_4 = CullPattern(List=pt_2, CullPattern=larger_2.OrEqualTo)
Z_2 = UnitZ(Factor="-1")
loads = LoadsKaramba3D(Vector=Z_2, LCase="0", mode="Gravity")

# ----
loads_2 = LoadsKaramba3D(ForceVector=filter_2, Local=False, PosInd=cull_4, LCase="0", mode="Point")

# ---- group: Define Loads (continued)
load = LoadKaramba3D(flatten([loads, loads_2]))

# ---- group: Assemble Model
assemble = AssembleModelKaramba3D(Elem=meshtoshell.Element, Support=filter, Load=load, LimitDistance_m=0.005)  # -> Model, Info, Mass_kg, CenterOfGravity, LoadCaseNames

# ---- group: Analyze Model
analyze = AnalyzeKaramba3D(Model=assemble.Model)  # -> CalculatedModel, MaximumDisplacement_cm, ResultingForceOfGravity_kN, ElasticEnergy_kNm
displacement = Panel(analyze.MaximumDisplacement_cm)

# ---- group: View Results
modelview = ModelViewKaramba3D(Model=analyze.CalculatedModel, ResultFactors=1, ResultCase=-1)  # -> Model, DeformedMesh, DeformedAxes, DeformedModel
shellview = ShellViewKaramba3D(Model=modelview.Model, IndexOfLayer=0)  # -> Model, MeshesOfRenderedShells, LegendColors, LegendTags
legend = Legend(Colour=shellview.LegendColors, Tags=shellview.LegendTags, LegendType=1)

# ---- group: Check Beam Displacements
panel = Panel("""0
0
0
0
0
1""")
cull_5 = CullPattern(List=rdpoints.OutPoint, CullPattern=panel)
shelllineresults = LineResultsOnShellsKaramba3D(
    AnalyzedModel=modelview.Model,
    LayerPosition=0,
    ListOfSourcesOfPrincipalStressLinesLinesPoints=cull_5,
    SegmentLength_m=0.5,
    DA_deg=5,
    mode="PrincStress")  # -> AnalyzedModel, Lines1, Lines2
rgb = ColourRGB(Alpha=255, Red=0, Green=0, Blue="250")
rgb_2 = ColourRGB(Alpha=255, Red="250", Green=0, Blue=0)
preview = CustomPreview(Geometry=shelllineresults.Lines1, Shader=rgb)
preview_2 = CustomPreview(Geometry=shelllineresults.Lines2, Shader=rgb_2)
