# Grasshopper definition 01_MovingLoadOnCantilever.gh (Grasshopper 1.0.7)
# plug-ins: Karamba3D

# ---- group: Generate Cantilever Beam
range = Range(Domain="0 to 10", Steps=Slider(9, range=0..10))
pt = ConstructPoint(XCoordinate=range, YCoordinate=0, ZCoordinate=0)
# 00 - Cantilever + Point Load + Cross Section Optimization
# Difficulty: Simple | Version 2.2.0
# This example shows how to use the Cross Section Optimizer with a moving point load.
pline = PolyLine(Vertices=pt, Closed=False)
explode = Explode(Curve=pline, Recursive=True)  # -> Segments, Vertices

# ---- group: Set Cross Section
crosecrselect = CrossSectionRangeSelectorKaramba3D(MaximumHeight_cm=-1, MaximumWidth_cm=-1, menu=[dropdown(0), dropdown(1), dropdown(3)])
beam_ids = Panel("Beams_A")
crosecselect = CrossSectionSelectorKaramba3D(CrossSections=crosecrselect, NameOrListIndexOfCrossSection="HEA200", ElementsIdentifiers=beam_ids)  # -> CrossSection, Info

# ---- group: Define Loads
Z = UnitZ(Factor="-10")
item = ListItem(List=pt, Index=Slider(9, range=0..9), Wrap=False)
loads = LoadsKaramba3D(ForceVector=Z, Local=False, PosInd=item, LCase="0", mode="Point")
loads_2 = LoadsKaramba3D(Vector=Vector(0, 0, -1), LCase="0", mode="Gravity")
load = LoadKaramba3D(flatten([loads, loads_2]))

# ---- group: Define Supports
item_2 = ListItem(List=pt, Index=0, Wrap=True)
supp = SupportKaramba3D(PosInd=item_2, menu=[buttons(on, on, on, on, on, on)])

# ---- group: Line To Beam
beam_ids_2 = Panel("Beams_A")
linetobeam = LineToBeamKaramba3D(
    Line=explode.Segments,
    Identifier=beam_ids_2,
    CrossSection=crosecselect.CrossSection,
    New=True,
    Remove=True,
    LimitDistance_m=0.005,
    Bending=True,
    SetBucklingLength=True,
    ToPolylineMaxAngle=0.03,
    ToPolylineTolerance=0.01,
    ToPolylineMaxEdgeLength=0.25)  # -> Element, Points, Info

# ---- group: Assemble Model
assemble = AssembleModelKaramba3D(Elem=linetobeam.Element, Support=supp, Load=load, LimitDistance_m=0.005)  # -> Model, Info, Mass_kg, CenterOfGravity, LoadCaseNames

# ---- group: Analyze Model / Cross Section Optimization
opticrosec = OptimizeCrossSectionKaramba3D(
    Model=assemble.Model,
    CrossSections=crosecrselect,
    MaximumUtilization=1,
    UltimateLimitStateIterations=5,
    DisplacementIterations=5,
    NumberOfSamplePoints=3,
    ElasticDesign=True,
    GammaM0=1,
    GammaM1=1.1,
    SwayFrame=True)  # -> ModelWithOptimizedCrossSections, Info, Mass_kg, MaximumDisplacement_cm, ElasticEnergyChange_kNm
analyze = AnalyzeKaramba3D(Model=assemble.Model)  # -> CalculatedModel, MaximumDisplacement_cm, ResultingForceOfGravity_kN, ElasticEnergyChange_kNm; disabled
mass = Panel(opticrosec.Mass_kg)
displacement = Panel(opticrosec.MaximumDisplacement_cm)

# ---- group: View Results
modelview = ModelViewKaramba3D(Model=opticrosec.ModelWithOptimizedCrossSections, ResultFactors=1, ResultCase=-1)  # -> Model, DeformedMesh, DeformedAxes, DeformedModel
beamview = BeamViewKaramba3D(Model=modelview.Model)  # -> Model, MeshesOfRenderedBeams, DeformedBeamAxes, LegendColors, LegendTags
legend = Legend(Colour=beamview.LegendColors, Tags=beamview.LegendTags, LegendType=1)

# ----
mesh_edges = MeshEdges(Mesh=beamview.MeshesOfRenderedBeams)  # -> NakedEdges, InteriorEdges, NonManifoldEdges
custom_preview = CustomPreview(Geometry=[mesh_edges.NakedEdges, mesh_edges.InteriorEdges, mesh_edges.NonManifoldEdges], Material="black")
