# Grasshopper definition 01_SimpleBeam.gh (Grasshopper 1.0.7)
# Copyright: B+G Engineers
# plug-ins: Karamba3D

# ---- group: Create Geometry
pt = Point(Point(0.6132713423, 1.260593929, 0))
pt_2 = Point(Point(5.613271342, 1.260593929, 0))
# 01 - Simple Beam
# Difficulty: Simple
# A simple cantilevering beam with one fixed support and one point load, using the Cross Section and Material Selector
ln = Line(StartPoint=pt, EndPoint=pt_2)
aligndim = AlignedDimension(Plane=PlaneXY(0, 0, 0), PointA=pt, PointB=pt_2, Offset=-1, Text="{0:0.00}", Size=0.2)

# ---- group: Define Materials
matselect = MaterialSelectionKaramba3D(menu=[dropdown(1), dropdown(2)])

# ---- group: Define Cross Sections
crosecrselect = CrossSectionRangeSelectorKaramba3D(MaximumHeight_cm=-1, MaximumWidth_cm=-1, menu=[dropdown(0), dropdown(1), dropdown(3)])
i = Slider(4, range=0..10)
crosecselect = CrossSectionSelectorKaramba3D(CrossSections=crosecrselect, NameOrListIndexOfCrossSection=i, Material=matselect)  # -> CrossSection, Info

# ---- group: Define Loads
f = Slider(-7.3, range=-10..10)
Z = UnitZ(Factor=f)
loads = LoadsKaramba3D(ForceVector=Z, Local=False, PosInd=pt_2, LCase="0", mode="Point")

# ---- group: Define Elements
linetobeam = LineToBeamKaramba3D(
    Line=ln,
    Color=ColourSwatch(SwatchColor=RGB(0, 42, 255)),
    Identifier="BeamA",
    CrossSection=crosecselect.CrossSection,
    New=True,
    Remove=True,
    LimitDistance_m=0.005,
    Bending=True,
    SetBucklingLength=True,
    ToPolylineMaxAngle=0.03,
    ToPolylineTolerance=0.01,
    ToPolylineMinEdgeLength=0.25)  # -> Element, Points, Info

# ---- group: Define Supports
supp = SupportKaramba3D(PosInd=pt, menu=[buttons(on, on, on, on, on, on)])

# ---- group: Assemble Model
assemble = AssembleModelKaramba3D(Elem=linetobeam.Element, Support=supp, Load=loads, LimitDistance_m=0.005)  # -> Model, Info, Mass_kg, CenterOfGravity, LoadCaseNames

# ---- group: Analyze Model
analyze = AnalyzeKaramba3D(Model=assemble.Model)  # -> CalculatedModel, MaximumDisplacement_cm, ResultingForceOfGravity_kN, ElasticEnergy_kNm
panel = Panel(analyze.MaximumDisplacement_cm)

# ---- group: View Results
modelview = ModelViewKaramba3D(Model=analyze.CalculatedModel, ResultFactors=1, ResultCase=-1)  # -> Model, DeformedMesh, DeformedAxes, DeformedModel
beamview = BeamViewKaramba3D(Model=modelview.Model)  # -> Model, MeshesOfRenderedBeams, DeformedBeamAxes, LegendColors, LegendTags
legend = Legend(Colour=beamview.LegendColors, Tags=beamview.LegendTags, LegendType=1)
