# Grasshopper definition 01_SimplySupportedBeam.gh (Grasshopper 1.0.7)
# plug-ins: Karamba3D

# ---- group: Define Materials
matselect = MaterialSelectionKaramba3D(menu=[dropdown(1), dropdown(2)])

# ---- group: Define Cross Sections
i = Slider(0, range=0..10)
crosecrselect = CrossSectionRangeSelectorKaramba3D(MaximumHeight_cm=-1, MaximumWidth_cm=-1, menu=[dropdown(0), dropdown(1), dropdown(3)])
crosecselect = CrossSectionSelectorKaramba3D(CrossSections=crosecrselect, NameOrListIndexOfCrossSection=i, Material=matselect)  # -> CrossSection, Info

# ---- group: Create Geometry
pt = Point(Point(0.6132713423, 1.260593929, 0))
pt_2 = Point(Point(10.6132713, 1.260593929, 0))
aligndim = AlignedDimension(Plane=PlaneXY(0, 0, 0), PointA=pt, PointB=pt_2, Offset=-1, Text="{0:0.00}", Size=0.2)
# 01 - Simply Supported Beam
# Difficulty: Simple
# A single span beam with two supports and different loads are applied in various loadcases - gravity, point load and line load. The moment section forces can be visualized in the Beam View component.
# Move the second support to see how it affects the structural behaviour.
ln = Line(StartPoint=pt, EndPoint=pt_2)

# ---- group: Define Supports
position_support = Slider(1, range=0.5..1)
end = EndPoints(Curve=ln)  # -> Start, End
eval = EvaluateCurve(Curve=ln, Parameter=position_support)  # -> Point, Tangent, Angle
supp = SupportKaramba3D(PosInd=end.Start, menu=[buttons(on, on, on, on, on, on)])
supp_2 = SupportKaramba3D(PosInd=eval.Point, menu=[buttons(on, on, on, on, on, on)])
support = SupportKaramba3D(flatten([supp, supp_2]))

# ---- group: Define Loads
point_load_kn = Slider(2, range=0.1..5)
positon_point_load = Slider(0.34, range=0..1)
line_load_kn = Slider(1, range=0.1..5)
Z = UnitZ(Factor=point_load_kn)
Z_2 = UnitZ(Factor=line_load_kn)
eval_2 = EvaluateCurve(Curve=ln, Parameter=positon_point_load)  # -> Point, Tangent, Angle
neg = Negative(Value=Z)
neg_2 = Negative(Value=Z_2)
loads = LoadsKaramba3D(Vector=Vector(0, 0, -1), LCase="0", mode="Gravity")
loads_2 = LoadsKaramba3D(ForceVector=neg, Local=False, PosInd=eval_2.Point, LCase="1", mode="Point")
beam_loads = BeamLoadsKaramba3D(BeamIdentifier="BeamA", LoadCase="2", ForceVector=neg_2, TStart=0, TEnd=1, mode="Block", menu=[buttons(on, off, off)])
load = LoadKaramba3D(flatten([loads, loads_2, beam_loads]))

# ---- group: Create Geometry (continued)
shatter = Shatter(Curve=ln, Parameters=[position_support, positon_point_load])  # -> reparameterize(Segments)

# ---- group: Define Elements
linetobeam = LineToBeamKaramba3D(
    Line=shatter,
    Color=ColourSwatch(SwatchColor=RGB(0, 42, 255)),
    Identifier="BeamA",
    CrossSection=crosecselect.CrossSection,
    New=True,
    Remove=True,
    LimitDistance_m=0.005,
    Bending=True,
    SetBucklingLength=True,
    ToPolylineMaxAngle=0.03,
    ToPolylineTolerance=0.01,
    ToPolylineMinEdgeLength=0.25)  # -> Element, Points, Info

# ---- group: Assemble Model
assemble = AssembleModelKaramba3D(Elem=linetobeam.Element, Support=support, Load=load, LimitDistance_m=0.005)  # -> Model, Info, Mass_kg, CenterOfGravity, LoadCaseNames

# ---- group: Analyze Model
analyze = AnalyzeKaramba3D(Model=assemble.Model)  # -> CalculatedModel, MaximumDisplacement_cm, ResultingForceOfGravity_kN, ElasticEnergy_kNm
panel = Panel(analyze.MaximumDisplacement_cm)

# ---- group: View Results
cluster = Cluster(C="20")
modelview = ModelViewKaramba3D(Model=analyze.CalculatedModel, ResultFactors=1, ResultCase=-1)  # -> Model, DeformedMesh, DeformedAxes, DeformedModel
b_forces = BeamForcesKaramba3D(AnalyzedModel=analyze.CalculatedModel, Ts=cluster)  # -> AnalyzedModel, NormalForce_kN, ShearForceVz_kN, ShearForceVy_kN, BendingMomentMt_kNm, BendingMomentMy_kNm, BendingMomentMz_kNm, LoadCaseIndex
num = Number(analyze.MaximumDisplacement_cm)
beamview = BeamViewKaramba3D(Model=modelview.Model)  # -> Model, MeshesOfRenderedBeams, DeformedBeamAxes, LegendColors, LegendTags
abs = Absolute(Value=b_forces.BendingMomentMy_kNm)
sort = SortList(Keys=flatten(abs), ValuesA=flatten(b_forces.BendingMomentMy_kNm))  # -> Keys, ValuesA
sort_2 = SortList(Keys=flatten(num), ValuesA=flatten(num))  # -> Keys, ValuesA
legend = Legend(Colour=beamview.LegendColors, Tags=beamview.LegendTags, LegendType=1)
item = ListItem(List=reverse(sort.ValuesA), Index=0, Wrap=True)
item_2 = ListItem(List=reverse(sort_2.ValuesA), Index=0, Wrap=True)
expression = Expression(x=item, Expression="\"Max. Bending Moment My: \" &Round(x,1)& \" kNm\"")
expression_2 = Expression(x=item_2, Expression="\"Max. Displacement: \" &Round(x,1)& \" cm\"")
panel_2 = Panel("""0,-0.5,-2
0,-0.5,-2.5""")
xz = XZPlane(Origin=panel_2)
tag = TextTag3D(Location=xz, Text=[expression, expression_2], Size="0.3", Justification=7)

# ==== cluster Cluster
C = ClusterInput()
series = Series(Start=0, Step=1, Count=C)
bnd = Bounds(Numbers=series)
remap = RemapNumbers(Value=series, Source=bnd, Target="0 to 1")  # -> Mapped, Clipped
C_2 = ClusterOutput(remap.Clipped)
