# Grasshopper definition 02_AnyShell.gh (Grasshopper 1.0.7)
# plug-ins: Karamba3D

# ---- group: Internalized Mesh
mesh = Mesh(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)

# ---- group: Define Material
readmattable = ReadMaterialTableFromFileKaramba3D()
shell_ids = Panel("Shell")
matselect = MaterialSelectionKaramba3D(
    Materials=readmattable,
    NameOrListIndexOfMaterial="Concrete",
    ElementIdentifier=shell_ids,
    menu=[dropdown(0), dropdown(0)])

# ---- group: Define Cross Section
shell_ids_2 = Panel("Shell")
cross_section = CrossSectionKaramba3D(
    FamilyNameOfCrossSection="DefaultCroSec",
    ElementIdentifier=shell_ids_2,
    Material=matselect,
    Height_cm="20",
    mode="Shell - Const")

# ---- group: Define Elements
# 02 - Any Shell
# Difficulty: Moderate | Version 2.2.0
# Any imported Mesh from Rhino can be plugged into the setup for simple analysis. Visualize the different Line Results on the input shell.
shell_ids_3 = Panel("Shell")
meshtoshell = MeshToShellKaramba3D(Mesh=mesh, Identifier=shell_ids_3, CrossSection=cross_section, LimitDistance_m=0.005)  # -> Element, Points, Info

# ---- group: Define Supports
points_from_xyz = PointsFromXYZ(point=meshtoshell.Points, Z="0.1", tolerance=0.001)
supp = SupportKaramba3D(PosInd=points_from_xyz, menu=[buttons(on, on, on, off, off, off)])

# ---- group: Define Loads
loads = LoadsKaramba3D(Vector=Vector(0, 0, -1), LCase="0", mode="Gravity")

# ---- group: Assemble Model
assemble = AssembleModelKaramba3D(Elem=flatten(meshtoshell.Element), Support=flatten(supp), Load=flatten(loads), LimitDistance_m=0.005)  # -> Model, Info, Mass_kg, CenterOfGravity, LoadCaseNames
mass = Panel(assemble.Mass_kg)

# ---- group: Analyze Model
analyze = AnalyzeKaramba3D(Model=assemble.Model)  # -> CalculatedModel, MaximumDisplacement_cm, ResultingForceOfGravity_kN, ElasticEnergyChange_kNm
dispalcement = Panel(analyze.MaximumDisplacement_cm)

# ---- group: Points for Line Results on Shells
popgeo = PopulateGeometry(Geometry=mesh, Count=Slider(100, range=0..100), Seed=1)

# ----
preview = CustomPreview(Geometry=mesh, Material=ColourSwatch(SwatchColor=RGBA(204, 204, 204, 113)))

model = ModelKaramba3D(analyze.CalculatedModel)

# ---- group: View Results
modelview = ModelViewKaramba3D(Model=analyze.CalculatedModel, ResultFactors=1, ResultCase=-1)  # -> Model, DeformedMesh, DeformedAxes, DeformedModel
shellview = ShellViewKaramba3D(Model=modelview.Model, IndexOfLayer=0)  # -> Model, MeshesOfRenderedShells, LegendColors, LegendTags
legend = Legend(Colour=shellview.LegendColors, Tags=shellview.LegendTags, LegendType=1)

# ---- group: Line Results on Shells / Principal Moment Lines
shelllineresults = LineResultsOnShellsKaramba3D(AnalyzedModel=model, ListOfSourcesOfForceFlowLinesLinesPoints=popgeo, SegmentLength_m=0.5, DA_deg=5, mode="PrincMoment")  # -> AnalyzedModel, Lines1, Lines2

# ---- group: Line Results on Shells
number_slider = Slider(1, range=-1..1)
number_slider_2 = Slider(0, range=-1..1)
Z = UnitZ(Factor=1)
preview_2 = CustomPreview(Geometry=shelllineresults.Lines1, Shader=ColourSwatch(SwatchColor=RGB(224, 0, 224)))
preview_3 = CustomPreview(Geometry=shelllineresults.Lines2, Shader=ColourSwatch(SwatchColor=RGB(0, 0, 255)))

# ---- group: Line Results on Shells / Iso Lines
shelllineresults_2 = LineResultsOnShellsKaramba3D(
    AnalyzedModel=model,
    LayerPosition=number_slider,
    ListOfIsoValuesValuesOrSourcesOfForceFlowLinesLinesPoints=popgeo,
    SegmentLength_m=0,
    Smoothing=False,
    mode="IsoLines",
    menu=[buttons(off, off, off, on, off, off, off)])  # -> AnalyzedModel, Lines, Value

# ---- group: Line Results on Shells / Force Flow Lines
shelllineresults_3 = LineResultsOnShellsKaramba3D(
    AnalyzedModel=model,
    LayerPosition=number_slider_2,
    GlobalForceDirections=Z,
    ListOfSourcesOfForceFlowLinesLinesPoints=popgeo,
    SegmentLength_m=0.5,
    DA_deg=5,
    Theta_deg=0,
    mode="ForceFlow")  # -> AnalyzedModel, Lines

# ---- group: Line Results on Shells (continued)
bnd = Bounds(Numbers=flatten(shelllineresults_2.Value))
remap = RemapNumbers(Value=shelllineresults_2.Value, Source=bnd, Target=Domain(0, 1))  # -> Mapped, Clipped
gradient = Gradient(LowerLimit=0, UpperLimit=1, Parameter=remap.Mapped, stops=[0: RGB(0, 128, 0), 0.5: RGB(255, 255, 0), 1: RGB(255, 0, 0)])
preview_4 = CustomPreview(Geometry=shelllineresults_2.Lines, Shader=gradient)

# ----
preview_5 = CustomPreview(Geometry=shelllineresults_3.Lines, Shader=ColourSwatch(SwatchColor=RGB(0, 69, 10)))

# ==== cluster PointsFromXYZ
tolerance = ClusterInput()
point = ClusterInput()
X = ClusterInput()
Y = ClusterInput()
Z = ClusterInput()
tolerance_2 = Number(tolerance)
point_2 = Point(point)
X_2 = Domain(X)
Y_2 = Domain(Y)
Z_2 = Domain(Z)
deconstruct = Deconstruct(Point=point_2)  # -> XComponent, YComponent, ZComponent
deconstruct_domain = DeconstructDomain(Domain=X_2)  # -> Start, End
deconstruct_domain_2 = DeconstructDomain(Domain=Y_2)  # -> Start, End
deconstruct_domain_3 = DeconstructDomain(Domain=Z_2)  # -> Start, End
absolute = Absolute(Value=tolerance_2)
subtraction = Subtraction(A=deconstruct_domain.Start, B=absolute)
addition = Addition(A=deconstruct_domain.End, B=absolute)
subtraction_2 = Subtraction(A=deconstruct_domain_2.Start, B=absolute)
addition_2 = Addition(A=deconstruct_domain_2.End, B=absolute)
subtraction_3 = Subtraction(A=deconstruct_domain_3.Start, B=absolute)
addition_3 = Addition(A=deconstruct_domain_3.End, B=absolute)
number = Number(deconstruct.XComponent)
number_2 = Number(deconstruct.YComponent)
number_3 = Number(deconstruct.ZComponent)
larger_than = LargerThan(FirstNumber=number, SecondNumber=subtraction)  # -> LargerThan, OrEqualTo
smaller_than = SmallerThan(FirstNumber=number, SecondNumber=addition)  # -> SmallerThan, OrEqualTo
larger_than_2 = LargerThan(FirstNumber=number_2, SecondNumber=subtraction_2)  # -> LargerThan, OrEqualTo
smaller_than_2 = SmallerThan(FirstNumber=number_2, SecondNumber=addition_2)  # -> SmallerThan, OrEqualTo
larger_than_3 = LargerThan(FirstNumber=number_3, SecondNumber=subtraction_3)  # -> LargerThan, OrEqualTo
smaller_than_3 = SmallerThan(FirstNumber=number_3, SecondNumber=addition_3)  # -> SmallerThan, OrEqualTo
gate_and = GateAnd(A=larger_than.OrEqualTo, B=smaller_than.OrEqualTo)
gate_and_2 = GateAnd(A=larger_than_2.OrEqualTo, B=smaller_than_2.OrEqualTo)
gate_and_3 = GateAnd(A=larger_than_3.OrEqualTo, B=smaller_than_3.OrEqualTo)
c_script = CSharpScript(value=X_2, bool=gate_and)  # -> out, result
# ---------- c_script: C# ----------
    if(_value == null)
      result_ = true;
    else result_ = _bool;
# ---------- end c_script ----------
c_script_2 = CSharpScript(value=Y_2, bool=gate_and_2)  # -> out, result; same code as c_script
c_script_3 = CSharpScript(value=Z_2, bool=gate_and_3)  # -> out, result; same code as c_script
gate_and_4 = GateAnd(A=c_script.result, B=c_script_2.result)
gate_and_5 = GateAnd(A=gate_and_4, B=c_script_3.result)
point_3 = Point(point_2)
cull_pattern = CullPattern(List=point_3, CullPattern=gate_and_5)
point_4 = Point(cull_pattern)
point_5 = ClusterOutput(point_4)
