# Grasshopper definition 02_ElementSetsInShells.gh (Grasshopper 1.0.7)
# plug-ins: Karamba3D

# ---- group: Generate Geometry
planesrf = PlaneSurface(Plane=PlaneXY(0, 0, 0), XSize=Domain(-10, 10), YSize=Domain(-10, 10))
sdivide = DivideSurface(Surface=planesrf, UCount=10, VCount=10)  # -> Points, Normals, Parameters
# 02 - Element Sets in Shells
# Difficulty: Simple | Version 2.2.0
# This example shows how to use the Element Set Component in combination with the Cross Section Optimizer for shells.
mesh_breps = MeshBreps(
    Brep=planesrf,
    InclusionPoints=flatten(sdivide.Points),
    MeshResolution=1,
    EdgeRefinementFactor=0.67,
    PointReduction=False,
    SmoothingStepSize=0,
    SmoothingIterations=5)  # -> Mesh, Info

# ---- group: Set Cross Section - Constant
demesh = DeconstructMesh(Mesh=mesh_breps.Mesh)  # -> Vertices, Faces, Colours, Normals
lng = ListLength(List=flatten(demesh.Faces))
range = Range(Domain="20 to 100", Steps=lng)
cross_section = CrossSectionKaramba3D(FamilyNameOfCrossSection="DefaultCroSec", Height_cm=range, mode="Shell - Const")
item = ListItem(List=cross_section, Index=0, Wrap=True)

# ---- group: Generate Geometry
planesrf_2 = PlaneSurface(Plane=PlaneXY(0, 0, 0), XSize=Domain(-10, 10), YSize=Domain(-10, 10))
divide = DivideDomain²(Domain=planesrf_2, UCount=10, VCount=10)
subsrf = Isotrim(Surface=planesrf_2, Domain=divide)
mesh_breps_2 = MeshBreps(
    Brep=subsrf,
    MeshResolution=1,
    EdgeRefinementFactor=0.67,
    PointReduction=False,
    SmoothingStepSize=0,
    SmoothingIterations=5)  # -> Mesh, Info

# ---- group: Set Cross Section
demesh_2 = DeconstructMesh(Mesh=mesh_breps_2.Mesh)  # -> Vertices, Faces, Colours, Normals
lng_2 = ListLength(List=flatten(demesh_2.Faces))
range_2 = Range(Domain="20 to 100", Steps=lng_2)
cross_section_2 = CrossSectionKaramba3D(FamilyNameOfCrossSection="DefaultCroSec", Height_cm=range_2, mode="Shell - Const")
item_2 = ListItem(List=cross_section_2, Index=0, Wrap=True)

# ---- group: Mesh to Shell
lng_3 = ListLength(List=mesh_breps_2.Mesh)
series = Series(Start="1", Step=1, Count=lng_3)
concat = Concatenate(FragmentA="Face_", FragmentB=series)
meshtoshell = MeshToShellKaramba3D(Mesh=mesh_breps_2.Mesh, Identifier=concat, CrossSection=item_2, LimitDistance_m=0.005)  # -> Element, Points, Info

# ---- group: Element Sets
partition = PartitionList(List=series, Size=20)
tstat = TreeStatistics(Tree=partition)  # -> Paths, Length, Count
series_2 = Series(Start=0, Step=1, Count=tstat.Count)
range_3 = Range(Domain=Domain(0, 1), Steps=expr("x-1", tstat.Count))
concat_2 = Concatenate(FragmentA="Set", FragmentB=series_2)
gradient = Gradient(
    LowerLimit=0,
    UpperLimit=1,
    Parameter=range_3,
    stops=[0: RGB(234, 38, 0), 0.25: RGB(234, 126, 0), 0.5: RGB(254, 244, 84), 0.75: RGB(173, 203, 249), 1: RGB(75, 107, 169)])
mkset = MakeElementSetKaramba(ElementIdentifiers=partition, SetIdentifier=graft(concat_2), MinimumSplitLength_m=0.001, ColorOfTheSet=graft(gradient))

# ---- group: Define Supports
debrep = DeconstructBrep(Brep=planesrf)  # -> Faces, Edges, Vertices
supp = SupportKaramba3D(PosInd=debrep.Vertices, menu=[buttons(on, on, on, off, off, off)])

debrep_2 = DeconstructBrep(Brep=planesrf_2)  # -> Faces, Edges, Vertices
supp_2 = SupportKaramba3D(PosInd=debrep_2.Vertices, menu=[buttons(on, on, on, off, off, off)])

# ---- group: Define Loads
Z = UnitZ(Factor="-3")
loads = LoadsKaramba3D(Vector=Z, LCase="0", mode="Gravity")

Z_2 = UnitZ(Factor="-3")
loads_2 = LoadsKaramba3D(Vector=Z_2, LCase="0", mode="Gravity")

# ---- group: Mesh to Shell
meshtoshell_2 = MeshToShellKaramba3D(Mesh=mesh_breps.Mesh, Identifier="A", CrossSection=item, LimitDistance_m=0.005)  # -> Element, Points, Info

# ---- group: Assemble Model
assemble = AssembleModelKaramba3D(Elem=meshtoshell_2.Element, Support=supp, Load=loads, LimitDistance_m=0.005)  # -> Model, Info, Mass_kg, CenterOfGravity, LoadCaseNames
mass = Panel(assemble.Mass_kg)

assemble_2 = AssembleModelKaramba3D(Elem=flatten(meshtoshell.Element), Support=supp_2, Load=loads_2, BeamSet=flatten(mkset), LimitDistance_m=0.005)  # -> Model, Info, Mass_kg, CenterOfGravity, LoadCaseNames
mass_2 = Panel(assemble_2.Mass_kg)

# ---- group: Optimize Cross Section - GroupID
opticrosec = OptimizeCrossSectionKaramba3D(
    Model=assemble.Model,
    GroupIdentifiers="A",
    CrossSections=cross_section,
    MaximumUtilization=1,
    UltimateLimitStateIterations=5,
    DisplacementIterations=5,
    NumberOfSamplePoints=3,
    ElasticDesign=True,
    GammaM0=1,
    GammaM1=1.1,
    SwayFrame=True)  # -> ModelWithOptimizedCrossSections, Info, Mass_kg, MaximumDisplacement_cm, ElasticEnergyChange_kNm
displacement = Panel(opticrosec.MaximumDisplacement_cm)

# ---- group: Optimize Cross Section - ElementID
opticrosec_2 = OptimizeCrossSectionKaramba3D(
    Model=assemble.Model,
    ElemIdentifiers="A",
    CrossSections=cross_section,
    MaximumUtilization=1,
    UltimateLimitStateIterations=5,
    DisplacementIterations=5,
    NumberOfSamplePoints=3,
    ElasticDesign=True,
    GammaM0=1,
    GammaM1=1.1,
    SwayFrame=True)  # -> ModelWithOptimizedCrossSections, Info, Mass_kg, MaximumDisplacement_cm, ElasticEnergyChange_kNm
displacement_2 = Panel(opticrosec_2.MaximumDisplacement_cm)

# ---- group: Optimize Cross Section - GroupID
opticrosec_3 = OptimizeCrossSectionKaramba3D(
    Model=assemble_2.Model,
    GroupIdentifiers=concat,
    CrossSections=cross_section_2,
    MaximumUtilization=1,
    UltimateLimitStateIterations=5,
    DisplacementIterations=5,
    NumberOfSamplePoints=3,
    ElasticDesign=True,
    GammaM0=1,
    GammaM1=1.1,
    SwayFrame=True)  # -> ModelWithOptimizedCrossSections, Info, Mass_kg, MaximumDisplacement_cm, ElasticEnergyChange_kNm
displacement_3 = Panel(opticrosec_3.MaximumDisplacement_cm)

# ---- group: Optimize Cross Section - Element Set
opticrosec_4 = OptimizeCrossSectionKaramba3D(
    Model=assemble_2.Model,
    GroupIdentifiers=concat_2,
    CrossSections=cross_section_2,
    MaximumUtilization=1,
    UltimateLimitStateIterations=5,
    DisplacementIterations=5,
    NumberOfSamplePoints=3,
    ElasticDesign=True,
    GammaM0=1,
    GammaM1=1.1,
    SwayFrame=True)  # -> ModelWithOptimizedCrossSections, Info, Mass_kg, MaximumDisplacement_cm, ElasticEnergyChange_kNm
displacement_4 = Panel(opticrosec_4.MaximumDisplacement_cm)

# ----
mass_3 = Panel(opticrosec_2.Mass_kg)
mass_4 = Panel(opticrosec.Mass_kg)
mass_5 = Panel(opticrosec_3.Mass_kg)
mass_6 = Panel(opticrosec_4.Mass_kg)

# ---- group: Choose one of the different CrossSection Optimizers
list = ValueList({"Cross Section Optimizer - ElementID": 0, "Cross Section Optimizer - GroupID": 1, "Cross Section Optimizer - GroupID with Faces": 2, "Cross Section Optimizer - ElementSet": 3}, selected="Cross Section Optimizer - GroupID with Faces")

# ---- group: Selection of the CrossSection Optimizer
entwine = Entwine(
    Branch00=opticrosec_2.ModelWithOptimizedCrossSections,
    Branch01=opticrosec.ModelWithOptimizedCrossSections,
    Branch02=opticrosec_3.ModelWithOptimizedCrossSections,
    Branch03=opticrosec_4.ModelWithOptimizedCrossSections,
    FlattenInputs=True)
path = ConstructPath(Indices=list)
split = SplitTree(Data=simplify(entwine), Masks=flatten(path))  # -> Positive, Negative
model = ModelKaramba3D(split.Positive)

# ---- group: View Results
modelview = ModelViewKaramba3D(Model=model, ResultFactors=1, ResultCase=-1)  # -> Model, DeformedMesh, DeformedAxes, DeformedModel
shellview = ShellViewKaramba3D(Model=modelview.Model, IndexOfLayer=0)  # -> Model, MeshesOfRenderedShells, LegendColors, LegendTags
legend = Legend(Colour=shellview.LegendColors, Tags=shellview.LegendTags, LegendType=1)
