# Grasshopper definition 02_PointloadsOnAShell.gh (Grasshopper 1.0.7)
# plug-ins: MeshEdit Components, Karamba3D

# ---- group: Define Geometry
pt = Point(Point(2.338024316, 2.548378995, 0))
panel = Panel("""0
4
8""")
panel_2 = Panel("""0
1
0""")
panel_3 = Panel("""0
1
0""")
panel_4 = Panel("""0
6
12""")
multiplication = Multiplication(A=panel_2, B=Slider(0, range=-2..2))
multiplication_2 = Multiplication(A=panel_3, B=Slider(0, range=-2..2))
# 02 - Point Loads on a Shell
pt_2 = PointOriented(BasePlane=pt, UComponent=panel, VComponent=multiplication, WComponent=0)
pt_3 = PointOriented(BasePlane=pt, UComponent=0, VComponent=multiplication_2, WComponent=panel_4)
# Difficulty: Simple | Version 2.2.0
# Arbitary points on a shell are used to define loads perpendicular to the shell. A unique material property is also assigned to the shell.
nurbs = NurbsCurve(Vertices=pt_2, Degree=2, Periodic=False)  # -> Curve, Length, Domain
nurbs_2 = NurbsCurve(Vertices=pt_3, Degree=2, Periodic=False)  # -> Curve, Length, Domain
sumsrf = SumSurface(CurveA=nurbs.Curve, CurveB=nurbs_2.Curve)
number_slider = Slider(16, range=0..100)
number_slider_2 = Slider(27, range=0..100)
sdivide = DivideSurface(Surface=sumsrf, UCount=number_slider, VCount=number_slider_2)  # -> Points, Normals, Parameters
points = PointList(Points=sdivide.Points, Size=1)

# ---- group: Define Material
fy_scherheit = Panel("2.5/2")
matprops = MaterialPropertiesKaramba3D(
    FamilyOfMaterial="Steel",
    Name="S235",
    ElementIdentifier="Gussglas",
    YoungsModulus_kN_cm2="7000",
    InPlaneShearModulus_kN_cm2="2845",
    TransverseShearModulus_kN_cm2=8076,
    SpecificWeight_kN_m3="25",
    CoefficientOfThermalExpansion_1_C="9e-6",
    TensileStrength_kN_cm2=fy_scherheit,
    CompressiveStrength_kN_cm2=-23.5,
    StrengthHypothesis="MISES",
    mode="Isotrop")

# ---- group: Define Loads
multiplication_3 = Multiplication(A=number_slider, B=[Slider(0.28, range=0..1), Slider(0.4, range=0..1), Slider(0.74, range=0..1)])
multiplication_4 = Multiplication(A=number_slider_2, B=[Slider(0.28, range=0..1), Slider(0.59, range=0..1), Slider(0.17, range=0..1)])
item = TreeItem(Tree=simplify(sdivide.Points), Path=multiplication_3, Index=multiplication_4, Wrap=True)
Y = UnitY(Factor="2")
loads = LoadsKaramba3D(ForceVector=Y, Local=False, PosInd=item, LCase="0", mode="Point")

# ---- group: Define Cross Section
cross_section = CrossSectionKaramba3D(FamilyNameOfCrossSection="DefaultCroSec", Material=matprops, Height_cm="1", mode="Shell - Const")

# ---- group: Define Elements
frompoints = MeshFromPoints(Points=flatten(sdivide.Points), UDirection=expr("x+1", number_slider), VDirection=expr("x+1", number_slider_2))
meshtoshell = MeshToShellKaramba3D(Mesh=frompoints, Identifier="A", CrossSection=cross_section, LimitDistance_m=0.005)  # -> Element, Points, Info

# ---- group: Define Supports
tstat = TreeStatistics(Tree=sdivide.Points)  # -> Paths, Length, Count
item_2 = ListItem(List=tstat.Paths, Index=0, Wrap=True)  # -> Item1, Item
merge = Merge(Data1=item_2.Item, Data2=item_2.Item1)
split = SplitTree(Data=sdivide.Points, Masks=flatten(merge))  # -> Positive, Negative
cull_i = CullIndex(List=split.Positive, Indices="0", Wrap=True)
cull_i_2 = CullIndex(List=reverse(cull_i), Indices="0", Wrap=True)  # -> reverse(simplify(List))
item_3 = ListItem(List=reverse(sdivide.Points), Index=0, Wrap=True)
item_4 = ListItem(List=sdivide.Points, Index=0, Wrap=True)
fsim = FindSimilarMember(Data=item_4, Set=meshtoshell.Points)  # -> Hit, Index
fsim_2 = FindSimilarMember(Data=item_3, Set=meshtoshell.Points)  # -> Hit, Index
fsim_3 = FindSimilarMember(Data=cull_i_2, Set=meshtoshell.Points)  # -> Hit, Index
supp = SupportKaramba3D(PosInd=[fsim.Hit, fsim_2.Hit], menu=[buttons(on, on, off, off, on, off)])
supp_2 = SupportKaramba3D(PosInd=fsim_3.Hit, menu=[buttons(off, on, on, off, off, off)])
support = SupportKaramba3D([supp, supp_2])

# ---- group: Assemble Model
assemble = AssembleModelKaramba3D(Elem=flatten(meshtoshell.Element), Support=flatten(support), Load=flatten(loads), LimitDistance_m=0.005)  # -> Model, Info, Mass_kg, CenterOfGravity, LoadCaseNames

# ---- group: Analyze Model
analyze = AnalyzeKaramba3D(Model=assemble.Model)  # -> CalculatedModel, MaximumDisplacement_cm, ResultingForceOfGravity_kN, ElasticEnergyChange_kNm
panel_5 = Panel(analyze.MaximumDisplacement_cm)

# ---- group: View Results
modelview = ModelViewKaramba3D(Model=analyze.CalculatedModel, ResultFactors=1, ResultCase=-1)  # -> Model, DeformedMesh, DeformedAxes, DeformedModel
shellview = ShellViewKaramba3D(Model=modelview.Model, IndexOfLayer=0)  # -> Model, MeshesOfRenderedShells, LegendColors, LegendTags
legend = Legend(Colour=shellview.LegendColors, Tags=shellview.LegendTags, LegendType=1)
