# Grasshopper definition 04_LargeDeformationVoronoiGridshell.gh (Grasshopper 1.0.7)
# Copyright: Karamba3D
# plug-ins: MeshEdit Components, Weaverbird, Karamba3D

# ---- group: Create Geometry
pt = Point([Point(8.666055418, 8.465737706, 0), Point(40.95674764, 4.607729938, 0), Point(28.92526197, 22.60767562, 0), Point(2.278675989, 24.28851277, 0)])
Z = UnitZ(Factor=1)
item = ListItem(List=pt, Index=0, Wrap=True)  # -> Item, Item1, Item2, Item3
addition = Addition(A=pt, B=Z)
aligndim = AlignedDimension(
    Plane=PlaneXY(0, 0, 0),
    PointA=[item.Item, item.Item3],
    PointB=[item.Item1, item.Item],
    Offset=-2,
    Text="{0:0.00}",
    Size=1)
# 04 - Large Deformation of a Voronoi Gridshell
pt_2 = Point(addition)
pline = PolyLine(Vertices=pt_2, Closed=True)
# Difficulty: Hard (PRO version only)
# Using the Large Deformation Analysis we can simulate the behaviour of a hanging model to find the optimum form for a Voronoi gridshell.
# The Beam Joint Agent component releases rotation in 2 axes at the connection with the columns.
boundary = BoundarySurfaces(Edges=pline)
popgeo = PopulateGeometry(Geometry=boundary, Count=Slider(7, range=0..20), Seed=1)
voronoi = Voronoi(Points=flatten(popgeo), BruteForceOverride=False)
incurve = PointInCurve(Point=pt_2, Curve=graft(voronoi))  # -> Relationship, Point
trim = TrimWithRegion(Curve=voronoi, Region=pline)  # -> Inside, Outside
disc = Discontinuity(Curve=trim.Inside, Level=1)  # -> Points, Parameters
cull = CullPattern(List=pt_2, CullPattern=incurve.Relationship)
merge = Merge(Data1=simplify(cull), Data2=simplify(disc.Points))
path_mapper = PathMapper(merge, source=["{A}", "{A;B}"], target=["{A}", "{A}"])
del = DelaunayMesh(Points=path_mapper, Plane=PlaneXY(0, 0, 0))
f = Slider(2.5, range=0..3)
medges = MeshEdges(Mesh=del)  # -> NakedEdges, InteriorEdges, NonManifoldEdges
len = Length(Curve=medges.NakedEdges)
expression = Expression(x=len, y=f, Expression="max(int(x*y/2)*2,2)")
area = MeshArea(Mesh=del)  # -> Area, Centroid
divide = DivideCurve(Curve=medges.NakedEdges, Count=expression, Kinks=False)  # -> simplify(Points), Tangents, Parameters
multiplication = Multiplication(A=area.Area, B=f)
trim_2 = TrimTree(Tree=divide.Points, Depth=1)
popgeo_2 = PopulateGeometry(Geometry=del, Count=multiplication, Seed=1, Points=trim_2)  # -> simplify(Population)
cullpt = CullDuplicates(Points=[trim_2, popgeo_2], Tolerance=0.1, CullMode=3)  # -> Points, Indices, Valence
del_2 = DelaunayMesh(Points=cullpt.Points, Plane=PlaneXY(0, 0, 0))
wblaplace = WeaverbirdsLaplacianSmoothing(MeshCurves=del_2, Level=Slider(14, range=0..20), SmoothNakedEdges=0, Thin=1)
cluster = Cluster(C=trim.Inside, B=Slider(0.8, range=0.5..2))
medges_2 = MeshEdges(Mesh=wblaplace)  # -> NakedEdges, InteriorEdges, NonManifoldEdges
line = LineSDL(Start=cluster, Direction=Vector(0, 0, 1), Length=-1)
entwine = Entwine(Branch00=medges_2.NakedEdges, Branch01=medges_2.InteriorEdges, Branch02=line, FlattenInputs=True)

# ---- group: Define Materials
matselect = MaterialSelectionKaramba3D(menu=[dropdown(1), dropdown(2)])

# ---- group: Define Cross Sections
range = Range(Domain="5 to 40", Steps=10)
concat = Concatenate(FragmentA="R", FragmentB=range)
lng = ListLength(List=range)  # -> expr("x-1", Length)
panel = Panel("""1
0
0.5""")
cross_section = CrossSectionKaramba3D(
    FamilyNameOfCrossSection="R",
    NameOfCrossSection=concat,
    Material=matselect,
    Diameter_cm=range,
    WallThickness_cm=expr("x*0.05", range),
    mode="Circular Hollow")
multiplication_2 = Multiplication(A=lng, B=panel)
crosecselect = CrossSectionSelectorKaramba3D(CrossSections=cross_section, NameOrListIndexOfCrossSection=multiplication_2)  # -> CrossSection, Info

# ---- group: Define Elements
panel_2 = Panel("""A
B
S""")
linetobeam = LineToBeamKaramba3D(
    Line=entwine,
    Identifier=graft(panel_2),
    CrossSection=graft(crosecselect.CrossSection),
    New=True,
    Remove=True,
    LimitDistance_m=0.005,
    Bending=True,
    SetBucklingLength=True,
    ToPolylineMaxAngle=0.03,
    ToPolylineTolerance=0.01,
    ToPolylineMinEdgeLength=0.25)  # -> Element, Points, Info

# ---- group: Define Supports
cluster_2 = Cluster_2(M=wblaplace)  # -> P, M_2
project = Project(Geometry=cluster, Plane=PlaneXY(0, 0, 0))  # -> Geometry, Transform
rdpoints = RemoveDuplicatePointsKaramba3D(Point=cluster_2.P, LimitDistance=0.005)  # -> OutPoint, Info, Indexes
supp = SupportKaramba3D(PosInd=project.Geometry, menu=[buttons(on, on, on, off, off, off)])
supp_2 = SupportKaramba3D(PosInd=rdpoints.OutPoint, menu=[buttons(on, on, off, off, off, off)])

# ---- group: Define Loads
Z_2 = UnitZ(Factor=1)
loads = LoadsKaramba3D(Vector=Z_2, LCase="0", mode="Gravity")

# ---- group: Assemble Model
assemble = AssembleModelKaramba3D(Elem=flatten(linetobeam.Element), Support=flatten([supp, supp_2]), Load=loads, LimitDistance_m=0.005)  # -> Model, Info, Mass_kg, CenterOfGravity, LoadCaseNames

# ---- group: Perform Large Deformation Analysis
d = Slider(4, range=0..10)
ladeform = LargeDeformationAnalysisKaramba3D(Model=assemble.Model, Increments=Slider(20, range=0..20), MaximumDisplacement_m=d)  # -> CalculatedModel, MaximumDisplacement_cm
panel_3 = Panel(ladeform.MaximumDisplacement_cm)

# ---- group: Disassemble & Reassemble Model
disassemble = DisassembleModelKaramba(Model=ladeform.CalculatedModel)  # -> Model, Point, Beam, Shell, Support, Load, Line, Mesh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

# ---- group: Redefine Loads
weldvertices = MeshWeldVertices(Mesh=cluster_2.M_2, Tolerance=0.01)  # -> RuntimeMessage, Mesh
Z_3 = UnitZ(Factor="-10")
loads_2 = LoadsKaramba3D(Vector=Vector(0, 0, -1), LCase="0", mode="Gravity")
loads_3 = LoadsKaramba3D(Vector=Z_3, Mesh=weldvertices.Mesh, LCase="0", mode="MeshLoad -Const.", menu=[buttons(on, off, off), buttons(on, on)])
load = LoadKaramba3D([loads_3, loads_2])

# ---- group: Define Joints
panel_4 = Panel("""A
B""")
panel_5 = Panel("S")
joint_agent = BeamJointAgentKaramba3D(
    AtElementIdentifiers=panel_4,
    ToElementIdentifiers=panel_5,
    Ct_kN_m=Vector(0, 0, 0),
    Cr_kNm_rad="{0,0.1,0.1}",
    menu=[buttons(off, off, off, off, on, on)])

# ---- group: Redefine Elements
disassemble_2 = DisassembleElementKaramba3D(Element=disassemble.Beam)  # -> Element, ElementIdentifier, AxisOfElement, CrossSection, Joint, Material, LocalCoordinateSystem, ElementIsActive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
linetobeam_2 = LineToBeamKaramba3D(
    Line=disassemble_2.AxisOfElement,
    Identifier=disassemble_2.ElementIdentifier,
    CrossSection=disassemble_2.CrossSection,
    New=True,
    Remove=True,
    LimitDistance_m=0.005,
    Bending=True,
    SetBucklingLength=True,
    ToPolylineMaxAngle=0.03,
    ToPolylineTolerance=0.01,
    ToPolylineMinEdgeLength=0.25)  # -> Element, Points, Info

# ---- group: Define Supports
support = SupportKaramba3D(flatten(supp))

# ---- group: Reassemble Model
assemble_2 = AssembleModelKaramba3D(Elem=linetobeam_2.Element, Support=support, Load=load, Joint=joint_agent, LimitDistance_m=0.005)  # -> Model, Info, Mass_kg, CenterOfGravity, LoadCaseNames

# ---- group: Analyze Model
crosec = CrossSectionKaramba3D(cross_section)
opticrosec = OptimizeCrossSectionKaramba3D(
    Model=assemble_2.Model,
    CrossSections=crosec,
    MaximumUtilization=1,
    UltimateLimitStateIterations=5,
    DisplacementIterations=5,
    NumberOfSamplePoints=3,
    ElasticDesign=True,
    GammaM0=1,
    GammaM1=1.1,
    SwayFrame=True)  # -> ModelWithOptimizedCrossSections, Info, Mass_kg, MaximumDisplacement_cm, ElasticEnergy_kNm
panel_6 = Panel(opticrosec.Mass_kg)
panel_7 = Panel(opticrosec.MaximumDisplacement_cm)

# ---- group: View Results
modelview = ModelViewKaramba3D(Model=opticrosec.ModelWithOptimizedCrossSections, ResultFactors=1, ResultCase=-1)  # -> Model, DeformedMesh, DeformedAxes, DeformedModel
beamview = BeamViewKaramba3D(Model=modelview.Model)  # -> Model, MeshesOfRenderedBeams, DeformedBeamAxes, LegendColors, LegendTags
legend = Legend(Colour=beamview.LegendColors, Tags=beamview.LegendTags, LegendType=1)

# ==== cluster Cluster
C = ClusterInput()
explode = Explode(Curve=C, Recursive=True)  # -> Segments, Vertices
len = Length(Curve=explode.Segments)
avr = Average(Input=flatten(len))
B = ClusterInput()
multiplication = Multiplication(A=avr, B=B)
curvepoint = PointOnCurve(explode.Segments, parameter=0.5)
larger = LargerThan(FirstNumber=len, SecondNumber=multiplication)  # -> LargerThan, OrEqualTo
cull = CullPattern(List=curvepoint, CullPattern=larger.LargerThan)  # -> flatten(List)
cullpt = CullDuplicates(Points=flatten(cull), Tolerance=0.1, CullMode=3)  # -> Points, Indices, Valence
P = ClusterOutput(cullpt.Points)

# ==== cluster Cluster_2
M = ClusterInput()
mjoin = MeshJoin(Meshes=flatten(M))
M_2 = ClusterOutput(mjoin)
weldvertices = MeshWeldVertices(Mesh=mjoin, Tolerance=0.01)  # -> RuntimeMessage, Mesh
nakededge = MeshNakedEdge(Mesh=weldvertices.Mesh)  # -> V, A, B
sort = SortList(Keys=[nakededge.A, nakededge.B])  # -> Keys, ValuesA
dcon = DeleteConsecutive(Set=sort.Keys, Wrap=False)  # -> Set, Count
item = ListItem(List=nakededge.V, Index=dcon.Set, Wrap=True)
cullpt = CullDuplicates(Points=flatten(item), Tolerance=0.1, CullMode=3)  # -> Points, Indices, Valence
P = ClusterOutput(cullpt.Points)
