# Grasshopper definition 01_BarrelVaultWithWindLoad.gh (Grasshopper 1.0.8)
# plug-ins: Karamba3D, Human

# ---- group: Define GEOMETRY INPUTS
xy = XYPlane(Origin=Point(0, 0, 0))
span_at_supports_d_m = Slider(12, range=4..40)
length_m = Slider(15, range=4..40)
height_at_supports_h_m = Slider(3, range=0..20)
midspan_rise_f_m = Slider(3, range=0..5)
x_divisions = Slider(12, range=4..20)
y_divisions = Slider(10, range=4..20)
rad = Radians(Degrees=Slider(0, range=0..100))
# 01 - Barrel Vault with Wind Load
# Difficulty: Hard | Version 3.1.6
# A barrel vault gridshell example used to show how Eurocode based wind loads can be applied and how different grids perform under the applied loads.
# Gravity and wind pressure loads are generated and applied using mesh loading and allow the engineer to study span, rise, height above ground and grid typologies.
prot = RotatePlane(Plane=xy, Angle=rad)
height_at_supports_h_m_2 = Number(height_at_supports_h_m)
span_at_supports_d_m_2 = Number(span_at_supports_d_m)
midspan_rise_f_m_2 = Number(midspan_rise_f_m)
x_divisions_2 = Number(x_divisions)
y_divisions_2 = Number(y_divisions)
length_m_2 = Number(length_m)
base_plane = Plane(prot)

# ----
# Data based on BS EN 1991-1-4:2005.
# Section 7.2.8: Figure 7.11.
# 
# The script recreates the sloped lines analytically and solves for interpolation at specific parametric values.
# 
# When f/d is between 0.2 and 0.3, two values of A need to be checked, if h/d > 0. If h/d >= 0.5, then the original curves are used. If h/d is between 0 and 0.5, interpolated curves are generated and shown on the graph.
# 
# The chart_path points to the folder where the grasshopper file is saved and creates a folder to store temporary images whenever a new set of values is requested. These get recycled so memory is not clogged. However, save_snapshot button allows for saving a specific graph in the folder. Saved images are of higher quality than Image Resource preview allows.
# 
# Note: When sliding parameters around, the python script might freeze due to the image saving and rendering. Best to choose values and type them in.
midspan_rise_f_m_3 = Number(midspan_rise_f_m_2)
height_at_supports_h_m_3 = Number(height_at_supports_h_m_2)
span_at_supports_d_m_3 = Number(span_at_supports_d_m_2)
save_png = Button()
division = Division(A=height_at_supports_h_m_3, B=span_at_supports_d_m_3)
division_2 = Division(A=midspan_rise_f_m_3, B=span_at_supports_d_m_3)
py3 = Python3Script(f_over_d=division_2, h_over_d=division, save_snapshot=save_png)  # -> out, summary, cpe, info, chart_path; inputs f_over_d: Double, h_over_d: Double, save_snapshot: Boolean
# ---------- py3: Python ----------
# r: matplotlib
"""
EN 1991-1-4 Figure 7.11 — Vaulted roof cpe,10
Grasshopper Python 3 (ScriptEditor) component with live matplotlib chart

Inputs:
    f_over_d  : float  — rise/span ratio (>= 0.05; values > 0.5 are clamped to 0.5)
    h_over_d  : float  — springing height/span ratio

Outputs:
    cpe        : DataTree[float] — pressure coefficients along wind direction (4 quarters: A, B, B, C)
                     {0} = branch 1: [A_up, B, B, C]  — primary load case
                     {1} = branch 2: [A_lo, B, B, C]  — secondary case in two-value region, else empty
    summary    : str   — multi-line summary of inputs, regime, outputs
    info       : str   — full sanity check table
    chart_path : str   — path to generated PNG, wire into Image Resource
"""

import os
import tempfile
import matplotlib
matplotlib.use('Agg')
import matplotlib.pyplot as plt
from matplotlib.patches import Rectangle
from matplotlib.lines import Line2D
from matplotlib.ticker import MultipleLocator

# Grasshopper DataTree bindings
from Grasshopper.Kernel.Data import GH_Path
from Grasshopper import DataTree

# ------------------------------------------------------------------
# Colour palette
# ------------------------------------------------------------------
COL_A_H0     = '#8ec5f0'
COL_A_INTERP = '#4a90d9'
COL_A_H05    = '#1f4e79'
COL_B        = '#2ca02c'
COL_C        = '#9467bd'
COL_MARKER_EDGE = 'black'

# ------------------------------------------------------------------
# Applicability check
# ------------------------------------------------------------------
if f_over_d < 0.05:
    raise ValueError(
        "f/d = {:.4f} is below the applicability limit of 0.05. "
        "EN 1991-1-4 Figure 7.11 is not applicable for flat roofs — "
        "use §7.2.3 (flat roofs) instead.".format(f_over_d)
    )


# ------------------------------------------------------------------
# Core cpe function
# ------------------------------------------------------------------
def _cpe(fd, hd):
    fd_c = min(fd, 0.5)
    a0 = 1.6 * fd_c
    if fd_c <= 0.1:
        lo = up = -0.7 - 5.0 * fd_c
    elif fd_c < 0.2:
        lo = up = -1.2
    elif fd_c <= 0.3:
        lo = -1.2 + 9.0 * (fd_c - 0.2)
        up = (8.0 / 3.0) * (fd_c - 0.2)
    else:
        lo = up = (8.0 / 3.0) * (fd_c - 0.2)
    tt = min(max(hd / 0.5, 0.0), 1.0)
    au = (1.0 - tt) * a0 + tt * up
    al = (1.0 - tt) * a0 + tt * lo
    b = -0.7 - 1.0 * fd_c
    c = -0.7 + 3.0 * fd_c if fd_c <= 0.1 else -0.4
    return au, al, b, c


# ------------------------------------------------------------------
# Current values
# ------------------------------------------------------------------
A_upper, A_lower, B_val, C_val = _cpe(f_over_d, h_over_d)


# ------------------------------------------------------------------
# Assemble DataTree output
# ------------------------------------------------------------------
in_two_value_region = (0.2 <= f_over_d <= 0.3) and (h_over_d > 0.0)

cpe = DataTree[float]()
# Branch 1: primary load case — A_up, B, B, C
cpe.AddRange([A_upper, B_val, B_val, C_val], GH_Path(0))
# Branch 2: secondary — A_lo, B, B, C in two-value region, else empty
if in_two_value_region and abs(A_upper - A_lower) > 1e-6:
    cpe.AddRange([A_lower, B_val, B_val, C_val], GH_Path(1))
else:
    cpe.EnsurePath(GH_Path(1))  # empty branch, still exists


# ------------------------------------------------------------------
# Multi-line summary
# ------------------------------------------------------------------
f_clamped = f_over_d > 0.5
if in_two_value_region:
    regime_note = "f/d within two-value region — check both Wind01 and Wind02"
elif f_clamped:
    regime_note = "f/d > 0.5 — values clamped to f/d = 0.5 (constant beyond)"
else:
    regime_note = "single-value regime — Branch {1} empty & Wind 02 has 0 length vectors"
summary = (
    "f/d = {:.3f}  h/d = {:.3f}\n"
    "{}\n"
    "Branch {{0}}: [A={:+.3f}, B={:+.3f}, B={:+.3f}, C={:+.3f}]"
).format(f_over_d, h_over_d, regime_note, A_upper, B_val, B_val, C_val)
if in_two_value_region and abs(A_upper - A_lower) > 1e-6:
    summary += "\nBranch {{1}}: [A={:+.3f}, B={:+.3f}, B={:+.3f}, C={:+.3f}]".format(
        A_lower, B_val, B_val, C_val)


# ------------------------------------------------------------------
# Sanity check table
# ------------------------------------------------------------------
lines = []
lines.append("=" * 60)
lines.append(" EN 1991-1-4 Figure 7.11 — Vaulted roof cpe,10 sanity check")
lines.append("=" * 60)
lines.append("")
lines.append(f"{'f/d':>6} {'h/d':>6}  {'A_up':>7} {'A_lo':>7} {'B':>7} {'C':>7}")
lines.append("-" * 46)
for hd in [0.0, 0.5]:
    for fd in [0.05, 0.10, 0.15, 0.20, 0.25, 0.30, 0.35, 0.40, 0.45, 0.50]:
        au, al, b, c = _cpe(fd, hd)
        lines.append(f"{fd:>6.2f} {hd:>6.2f}  {au:>7.3f} {al:>7.3f} {b:>7.3f} {c:>7.3f}")
    lines.append("")
lines.append("-" * 46)
lines.append(" Current inputs — cpe per quarter strip (A, B, B, C):")
lines.append(f"   f/d = {f_over_d:.3f}   h/d = {h_over_d:.3f}")
lines.append("")
lines.append(f"   Branch {{0}}: [{A_upper:+.3f}, {B_val:+.3f}, {B_val:+.3f}, {C_val:+.3f}]")
if in_two_value_region and abs(A_upper - A_lower) > 1e-6:
    lines.append(f"   Branch {{1}}: [{A_lower:+.3f}, {B_val:+.3f}, {B_val:+.3f}, {C_val:+.3f}]")
else:
    lines.append(f"   Branch {{1}}: (empty — single-value regime)")
lines.append("=" * 60)
info = "\n".join(lines)
print(info)

# ------------------------------------------------------------------
# Exact vertex lists for each curve (piecewise-linear, no sampling)
# ------------------------------------------------------------------
FD_MAX_PLOT = 0.6

# Curve vertices as (x-list, y-list). Extend to FD_MAX_PLOT with clamped values.
A_h0_x = [0.05, 0.5, FD_MAX_PLOT]
A_h0_y = [0.08, 0.80, 0.80]

# Zone A (h/d ≥ 0.5) — upper branch:
#   descend → flat → vertical jump at f/d=0.2 → ascend to (0.5, 0.8) → clamp
A_h05_upper_x = [0.05, 0.10, 0.20, 0.20, 0.50, FD_MAX_PLOT]
A_h05_upper_y = [-0.95, -1.20, -1.20, 0.00, 0.80, 0.80]

# Zone A (h/d ≥ 0.5) — lower branch:
#   descend → flat → ascending diagonal → vertical jump at f/d=0.3 → ascend → clamp
A_h05_lower_x = [0.05, 0.10, 0.20, 0.30, 0.30, 0.50, FD_MAX_PLOT]
A_h05_lower_y = [-0.95, -1.20, -1.20, -0.30, 0.267, 0.80, 0.80]

B_x = [0.05, 0.50, FD_MAX_PLOT]
B_y = [-0.75, -1.20, -1.20]

C_x = [0.05, 0.10, 0.50, FD_MAX_PLOT]
C_y = [-0.55, -0.40, -0.40, -0.40]

# Interpolated A curves (vertex-aligned to A_h05 upper/lower)
t = min(max(h_over_d / 0.5, 0.0), 1.0)
show_interp = 0.0 < h_over_d < 0.5
if show_interp:
    # Evaluate A(h=0) = 1.6·min(x, 0.5) at each vertex x of A_h05 curves
    A_h0_at_up = [1.6 * min(x, 0.5) for x in A_h05_upper_x]
    A_h0_at_lo = [1.6 * min(x, 0.5) for x in A_h05_lower_x]
    A_interp_upper_x = A_h05_upper_x
    A_interp_upper_y = [(1 - t) * a + t * u for a, u in zip(A_h0_at_up, A_h05_upper_y)]
    A_interp_lower_x = A_h05_lower_x
    A_interp_lower_y = [(1 - t) * a + t * l for a, l in zip(A_h0_at_lo, A_h05_lower_y)]


# ------------------------------------------------------------------
# Build the figure
# ------------------------------------------------------------------
fig, ax = plt.subplots(figsize=(9, 6), dpi=100)

ax.add_patch(Rectangle((0.2, -1.3), 0.1, 2.2,
                       facecolor='#ffe680', edgecolor='none', alpha=0.4, zorder=0))

ax.axvline(0.05, color='grey', linestyle=':', linewidth=1, zorder=1)
ax.text(0.052, 0.65, 'f/d = 0.05\n(applicability)', fontsize=9, color='grey', va='top')

ax.axvline(0.5, color='grey', linestyle=':', linewidth=1, zorder=1)
ax.text(0.508, 0.65, 'f/d = 0.5\n(clamped\nbeyond)', fontsize=9, color='grey', va='top')

ax.axhline(0, color='black', linewidth=0.6, zorder=1)
ax.grid(True, linestyle='--', linewidth=0.4, alpha=0.5, zorder=0)

curve_handles = []
curve_handles.append(ax.plot(A_h0_x, A_h0_y, color=COL_A_H0, linewidth=1.8, label='A (h=0)')[0])
curve_handles.append(ax.plot(A_h05_upper_x, A_h05_upper_y, color=COL_A_H05, linewidth=1.8, label='A (h/d≥0.5)')[0])
ax.plot(A_h05_lower_x, A_h05_lower_y, color=COL_A_H05, linewidth=1.8)
curve_handles.append(ax.plot(B_x, B_y, color=COL_B, linewidth=1.8, label='B')[0])
curve_handles.append(ax.plot(C_x, C_y, color=COL_C, linewidth=1.8, label='C')[0])

if show_interp:
    interp_handle = ax.plot(A_interp_upper_x, A_interp_upper_y, color=COL_A_INTERP,
                            linewidth=1.4, linestyle='--', alpha=0.9,
                            label=f'A interp (h/d={h_over_d:.2f})')[0]
    ax.plot(A_interp_lower_x, A_interp_lower_y, color=COL_A_INTERP,
            linewidth=1.4, linestyle='--', alpha=0.9)
    curve_handles.append(interp_handle)

marker_kw = dict(marker='o', markersize=9, markeredgecolor=COL_MARKER_EDGE,
                 markeredgewidth=1.4, linestyle='none', zorder=5)

if show_interp:
    A_marker_color = COL_A_INTERP
elif h_over_d >= 0.5:
    A_marker_color = COL_A_H05
else:
    A_marker_color = COL_A_H0

marker_x = min(f_over_d, 0.5)
ax.plot(marker_x, A_upper, markerfacecolor=A_marker_color, **marker_kw)
show_a_lo = in_two_value_region and abs(A_upper - A_lower) > 1e-6
if show_a_lo:
    ax.plot(marker_x, A_lower, markerfacecolor=A_marker_color, **marker_kw)
ax.plot(marker_x, B_val, markerfacecolor=COL_B, **marker_kw)
ax.plot(marker_x, C_val, markerfacecolor=COL_C, **marker_kw)

ax.text(0.25, 0.65, 'A in two-value\nregion', fontsize=9, color='#997a00',
        ha='center', va='top', style='italic')

ax.set_xlim(0, FD_MAX_PLOT)
ax.set_ylim(-1.3, 0.9)
ax.set_xticks([0, 0.1, 0.2, 0.3, 0.4, 0.5, 0.6])
ax.yaxis.set_major_locator(MultipleLocator(0.2))
ax.set_xlabel('f/d')
ax.set_ylabel('$c_{pe,10}$')
ax.set_title(f'EN 1991-1-4 Fig 7.11 — Vaulted roof $c_{{pe,10}}$\n'
             f'f/d = {f_over_d:.3f}, h/d = {h_over_d:.3f}',
             fontsize=10)

leg1 = ax.legend(handles=curve_handles, loc='upper left',
                 bbox_to_anchor=(1.02, 1.0), fontsize=8,
                 title='Curves', title_fontsize=9, framealpha=0.9)
ax.add_artist(leg1)

def _marker_proxy(color):
    return Line2D([0], [0], marker='o', color='none',
                  markerfacecolor=color, markeredgecolor=COL_MARKER_EDGE,
                  markeredgewidth=1.2, markersize=9)

point_handles = [_marker_proxy(A_marker_color)]
point_labels = [f'A_up = {A_upper:+.3f}']
if show_a_lo:
    point_handles.append(_marker_proxy(A_marker_color))
    point_labels.append(f'A_lo = {A_lower:+.3f}')
point_handles.append(_marker_proxy(COL_B))
point_labels.append(f'B    = {B_val:+.3f}')
point_handles.append(_marker_proxy(COL_C))
point_labels.append(f'C    = {C_val:+.3f}')

ax.legend(handles=point_handles, labels=point_labels, loc='upper left',
          bbox_to_anchor=(1.02, 0.55), fontsize=8,
          title='Current values', title_fontsize=9, framealpha=0.9)

fig.subplots_adjust(right=0.72)

# ------------------------------------------------------------------
# Determine chart output paths.
# Root: <definition_folder>/images/            → user snapshots (persistent)
# Sub:  <definition_folder>/images/temp/       → live preview cycle (5 files)
# Falls back to %TEMP% if the definition hasn't been saved yet.
# ------------------------------------------------------------------
if '_png_idx' not in globals():
    _png_idx = 0
_png_idx = (_png_idx + 1) % 5

_doc = ghenv.Component.OnPingDocument()
_doc_path = _doc.FilePath if _doc is not None else None

if _doc_path:
    _base_dir = os.path.dirname(_doc_path)
else:
    _base_dir = tempfile.gettempdir()

images_dir = os.path.join(_base_dir, 'images')
temp_dir = os.path.join(images_dir, 'temp')
os.makedirs(temp_dir, exist_ok=True)  # creates both levels

# Live preview PNG (rotates through 5 slots)
chart_path = os.path.join(temp_dir, f'karamba_ec1_fig7_11_{_png_idx}.png')
fig.savefig(chart_path, bbox_inches='tight', dpi=120)

# Optional archival snapshot in the parent images/ folder
if save_snapshot:
    snapshot_name = f'karamba_ec1_fig7_11_fd_{f_over_d:.3f}_hd_{h_over_d:.3f}.png'
    snapshot_path = os.path.join(images_dir, snapshot_name)
    fig.savefig(snapshot_path, bbox_inches='tight', dpi=120)
    print(f"Snapshot saved: {snapshot_path}")

plt.close(fig)
# ---------- end py3 ----------
image_resource = ImageResource(py3.chart_path)
panel = Panel(division_2)
panel_2 = Panel(division)
cpe = Data(py3.cpe)
texttoscreen = RenderTextToScreen(Text=py3.summary, Location="{50,50,0}", Size=12, Color=RGB(0, 0, 0), m_scWithvp=False)
cpe_values = Panel(cpe)
panel_3 = Panel(py3.info)

# ---- group: Define LOADING INPUTS
wind_load_kn_m2 = Slider(1.5, range=-1.5..1.5)
superimposed_dead_load_kn_m2 = Slider(0.8, range=0..1)
superimposed_dead_load_kn_m2_2 = Number(superimposed_dead_load_kn_m2)
wind_load_kn_m2_2 = Number(wind_load_kn_m2)

# ----
define_grid_type = ValueList({"Orthogonal": 0, "Diagonal (fine)": 1, "Diagonal (coarse)": 2}, selected="Orthogonal")

# ---- group: Define Vault Surface
length_m_3 = Number(length_m_2)
base_plane_2 = Plane(base_plane)
span_at_supports_d_m_4 = Number(span_at_supports_d_m_2)
height_at_supports_h_m_4 = Number(height_at_supports_h_m_2)
midspan_rise_f_m_4 = Number(midspan_rise_f_m_2)
deplane = DeconstructPlane(Plane=base_plane_2)  # -> Origin, XAxis, YAxis, ZAxis
amp = Amplitude(Vector=deplane.ZAxis, Amplitude=height_at_supports_h_m_4)
move = Move(Geometry=base_plane_2, Motion=amp)  # -> Geometry, Transform
deplane_2 = DeconstructPlane(Plane=move.Geometry)  # -> Origin, XAxis, YAxis, ZAxis
amp_2 = Amplitude(Vector=deplane_2.YAxis, Amplitude=span_at_supports_d_m_4)
move_2 = Move(Geometry=deplane_2.Origin, Motion=amp_2)  # -> Geometry, Transform
amp_3 = Amplitude(Vector=deplane_2.XAxis, Amplitude=length_m_3)
ln = Line(StartPoint=deplane_2.Origin, EndPoint=move_2.Geometry)
midpt = CurveMiddle(Curve=ln)
amp_4 = Amplitude(Vector=deplane_2.ZAxis, Amplitude=midspan_rise_f_m_4)
end = EndPoints(Curve=ln)  # -> Start, End
move_3 = Move(Geometry=midpt, Motion=amp_4)  # -> Geometry, Transform
arc = Arc3Pt(PointA=end.Start, PointB=move_3.Geometry, PointC=end.End)  # -> Arc, Plane, Radius
extr = Extrude(Base=arc.Arc, Direction=amp_3)
vault_profile_curve = Curve(arc.Arc)
vault_surface = Surface(extr)

# ---- group: Define Vault Base Mesh
x_divisions_3 = Number(x_divisions_2)
vault_surface_2 = Surface(vault_surface)
y_divisions_3 = Number(y_divisions_2)
mesh_uv = MeshSurface(Surface=vault_surface_2, UCount=x_divisions_3, VCount=y_divisions_3, Overhang=Toggle(False), Equalize=Toggle(True))
vault_mesh = Mesh(mesh_uv)

# ---- group: Define Vault Loading Mesh
mesh_loading_density = ValueList({"0.10m": 0.10, "0.25m": 0.25, "0.50m": 0.50, "0.75m": 0.75, "1.00m": 1.00, "1.50m": 1.50}, selected="0.50m")
vault_surface_3 = Surface(vault_surface)
cluster = Cluster(vaultsurface=vault_surface_3, meshtargetsize=mesh_loading_density)
loadingmesh = Mesh(cluster)

# ---- group: Define Wind Loads
# Note: When only one case is required, Wind02 contains 0 length vectors.
wind_load_kn_m2_3 = Number(wind_load_kn_m2_2)
cpe_2 = Data(cpe)
loadingmesh_2 = Mesh(loadingmesh)
vault_surface_4 = Surface(vault_surface)
facen = FaceNormals(Mesh=loadingmesh_2)  # -> Centers, Normals
srf_cp = SurfaceClosestPoint(Point=facen.Centers, Surface=vault_surface_4)  # -> Point, UVPoint, Distance
pdecon = Deconstruct(Point=srf_cp.UVPoint)  # -> XComponent, YComponent, ZComponent
expression = Expression(x=pdecon.YComponent, Expression="Round(x,3)")
bnd = Bounds(Numbers=expression)
div = DivideDomain(Domain=bnd, Count=4)
dedomain = DeconstructDomain(Domain=div)  # -> Start, End
item = ListItem(List=dedomain.Start, Index=0, Wrap=True)  # -> Item, Item1, Item2, Item3
num = Number(expression)
larger = LargerThan(FirstNumber=num, SecondNumber=item.Item1)  # -> LargerThan, OrEqualTo
larger_2 = LargerThan(FirstNumber=num, SecondNumber=item.Item2)  # -> LargerThan, OrEqualTo
larger_3 = LargerThan(FirstNumber=num, SecondNumber=item.Item3)  # -> LargerThan, OrEqualTo
loadingmesh_3 = Mesh(loadingmesh_2)
addition = Addition(A=larger.OrEqualTo, B=larger_2.OrEqualTo)
demesh = DeconstructMesh(Mesh=loadingmesh_3)  # -> Vertices, Faces, Colours, Normals
addition_2 = Addition(A=addition, B=larger_3.OrEqualTo)
multiplication = Multiplication(A=wind_load_kn_m2_3, B=cpe_2)
bang = ExplodeTree(Data=cpe_2)  # -> Branch0, Branch1
sift = SiftPattern(List=demesh.Faces, SiftPattern=addition_2)  # -> Output0, Output1, Output2, Output3
sift_2 = SiftPattern(List=facen.Normals, SiftPattern=addition_2)  # -> Output0, Output1, Output2, Output3
neg = Negative(Value=multiplication)
lng = ListLength(List=bang.Branch1)
entwine = Entwine(Branch00=sift.Output0, Branch01=sift.Output1, Branch02=sift.Output2, Branch03=sift.Output3, FlattenInputs=True)
entwine_2 = Entwine(Branch00=sift_2.Output0, Branch01=sift_2.Output1, Branch02=sift_2.Output2, Branch03=sift_2.Output3, FlattenInputs=True)
bang_2 = ExplodeTree(Data=neg)  # -> Branch0, Branch1
equals = Equality(FirstNumber=lng, SecondNumber=0)  # -> Equality, Inequality
clean = CleanTree(RemoveNulls=True, RemoveInvalid=True, RemoveEmpty=False, Tree=entwine)
clean_2 = CleanTree(RemoveNulls=True, RemoveInvalid=True, RemoveEmpty=False, Tree=entwine_2)
filter = StreamFilter(Gate=equals.Equality, Stream0=bang_2.Branch1, Stream1="0")
conmesh = ConstructMesh(Vertices=demesh.Vertices, Faces=flatten(clean))
mjoin = MeshJoin(Meshes=conmesh)
panel_4 = Panel("""Direction 1
Direction 2""")
amp_5 = Amplitude(Vector=clean_2, Amplitude=graft(filter))
amp_6 = Amplitude(Vector=clean_2, Amplitude=graft(bang_2.Branch0))
mesh = Mesh(mjoin)
entwine_3 = Entwine(Branch00=amp_6, Branch01=amp_5, FlattenInputs=True)
entwine_4 = Entwine(Branch00=mesh, Branch01=mesh, FlattenInputs=True)
entwine_5 = Entwine(Branch00=panel_4, Branch01=panel_4, FlattenInputs=True)
entwine_6 = Entwine(Branch00="Wind01", Branch01="Wind02", FlattenInputs=True)
lng_2 = ListLength(List=entwine_3)
cull = CullPattern(List=entwine_3, CullPattern=lng_2)
cull_2 = CullPattern(List=entwine_4, CullPattern=lng_2)
cull_3 = CullPattern(List=entwine_5, CullPattern=lng_2)
cull_4 = CullPattern(List=entwine_6, CullPattern=lng_2)
clean_3 = CleanTree(RemoveNulls=True, RemoveInvalid=True, RemoveEmpty=True, Tree=cull)
clean_4 = CleanTree(RemoveNulls=True, RemoveInvalid=True, RemoveEmpty=True, Tree=cull_2)
clean_5 = CleanTree(RemoveNulls=True, RemoveInvalid=True, RemoveEmpty=True, Tree=cull_3)
clean_6 = CleanTree(RemoveNulls=True, RemoveInvalid=True, RemoveEmpty=True, Tree=cull_4)
meshload_var = LoadsKaramba3D(
    Vectors=clean_3,
    Mesh=clean_4,
    ElementIdentifiers=clean_5,
    LCase=clean_6,
    LineLoadsPerElement=Slider(1, range=0..10),
    MinimumLineLoadLength_m=0.5,
    mode="MeshLoad -Variable",
    menu=[buttons(off, on, off), buttons(off, on)])

# ---- group: Wall Height Display
base_plane_3 = Plane(base_plane)
vault_surface_5 = Surface(vault_surface)
edges = BrepEdges(Brep=vault_surface_5)  # -> Naked, Interior, NonManifold
eval = EvaluateLength(Curve=edges.Naked, Length=0.5, Normalized=True)  # -> Point, Tangent, Parameter
deplane_3 = DeconstructPlane(Plane=base_plane_3)  # -> Origin, XAxis, YAxis, ZAxis
dprod = DotProduct(VectorA=deplane_3.XAxis, VectorB=eval.Tangent, Unitize=True)
height_at_supports_h_m_5 = Number(height_at_supports_h_m_2)
num_2 = Number("0.01")
expression_2 = Expression(dot=dprod, tol=num_2, Expression="if(Abs(Abs(dot) - 1) < tol, true, false)")
amp_7 = Amplitude(Vector=deplane_3.ZAxis, Amplitude=height_at_supports_h_m_5)
neg_2 = Negative(Value=amp_7)
cull_5 = CullPattern(List=edges.Naked, CullPattern=expression_2)
extr_2 = Extrude(Base=cull_5, Direction=neg_2)
preview = CustomPreview(Geometry=extr_2, Material=ColourSwatch(SwatchColor=RGBA(199, 179, 184, 150)))

# ---- group: Define Vault DIAGONAL Grid (fine)
vault_mesh_2 = Mesh(vault_mesh)
demesh_2 = DeconstructMesh(Mesh=vault_mesh_2)  # -> Vertices, Faces, Colours, Normals
deface = DeconstructFace(Face=demesh_2.Faces)  # -> CornerA, CornerB, CornerC, CornerD
item_2 = ListItem(List=demesh_2.Vertices, Index=deface.CornerA, Wrap=True)
item_3 = ListItem(List=demesh_2.Vertices, Index=deface.CornerC, Wrap=True)
item_4 = ListItem(List=demesh_2.Vertices, Index=deface.CornerB, Wrap=True)
item_5 = ListItem(List=demesh_2.Vertices, Index=deface.CornerD, Wrap=True)
ln_2 = Line(StartPoint=item_2, EndPoint=item_3)
ln_3 = Line(StartPoint=item_4, EndPoint=item_5)
join = JoinCurves(Curves=ln_2, Preserve=False)
join_2 = JoinCurves(Curves=ln_3, Preserve=False)
dir_diag_01_fine = Curve(join)
dir_diag_02_fine = Curve(join_2)

# ---- group: Define Vault DIAGONAL Grid (coarse)
lng_3 = ListLength(List=demesh_2.Faces)
y_divisions_4 = Number(y_divisions_2)
series = Series(Start=0, Step=1, Count=lng_3)
integer_division = IntegerDivision(A=series, B=y_divisions_4)
mod = Modulus(A=series, B=y_divisions_4)
addition_3 = Addition(A=integer_division, B=mod)
mod_2 = Modulus(A=addition_3, B=2)
equals_2 = Equality(FirstNumber=mod_2, SecondNumber=0)  # -> Equality, Inequality
dispatch = Dispatch(List=ln_2, DispatchPattern=equals_2.Equality)  # -> ListA, ListB
dispatch_2 = Dispatch(List=ln_3, DispatchPattern=equals_2.Inequality)  # -> ListA, ListB
join_3 = JoinCurves(Curves=dispatch.ListA, Preserve=False)
join_4 = JoinCurves(Curves=dispatch_2.ListA, Preserve=False)
dir_diag_01_coarse = Curve(join_3)
dir_diag_02_coarse = Curve(join_4)

# ---- group: Define Vault ORTHOGONAL Grid
vault_mesh_3 = Mesh(vault_mesh)
warpweft = WarpWeft(Mesh=vault_mesh_3)  # -> Warp, Weft, NakedA, NakedB
join_5 = JoinCurves(Curves=warpweft.Warp, Preserve=False)
join_6 = JoinCurves(Curves=warpweft.Weft, Preserve=False)
item_6 = ListItem(List=join_5, Index=0, Wrap=True)  # -> Item1, Item
shift = ShiftList(List=join_5, Shift=1, Wrap=invert(True))
shift_2 = ShiftList(List=join_6, Shift=1, Wrap=invert(True))
shift_3 = ShiftList(List=shift, Shift=-1, Wrap=invert(True))
shift_4 = ShiftList(List=shift_2, Shift=-1, Wrap=invert(True))
boundary_beams = Curve([item_6.Item1, item_6.Item])
dir_ortho_01 = Curve(shift_3)
dir_ortho_02 = Curve(shift_4)

# ---- group: Pressure Diagram Display
base_plane_4 = Plane(base_plane)
vault_profile_curve_2 = Curve(vault_profile_curve)
spacing_display_m = Slider(2.6, range=0..5)
cpe_3 = Data(cpe)
scaling_factor = Slider(2, range=0..10)
cluster_2 = Cluster_2(plane=base_plane_4, vault_curve=vault_profile_curve_2, spacing=spacing_display_m, cpe=cpe_3, scaling=scaling_factor)  # -> srf_pressure_2, srf_suction_2, pt_tag_2
dot = AnnotationDot(Location=cluster_2.pt_tag_2, PrimaryText=["Wind01", "Wind02"])
preview_2 = CustomPreview(Geometry=cluster_2.srf_pressure_2, Material=ColourSwatch(SwatchColor=RGBA(253, 47, 96, 150)))
preview_3 = CustomPreview(Geometry=cluster_2.srf_suction_2, Material=ColourSwatch(SwatchColor=RGBA(49, 148, 255, 150)))

# ---- group: Define Material
matselect = MaterialSelectionKaramba3D(Colour=ColourSwatch(SwatchColor=RGB(51, 46, 191)), menu=[dropdown(1), dropdown(1), dropdown(4)])
mat_steel = MaterialKaramba3D(matselect)

# ---- group: Define Cross Section
mat_steel_2 = MaterialKaramba3D(mat_steel)
crosecrselect = CrossSectionRangeSelectorKaramba3D(
    MaximumHeight_cm=-1,
    MaximumWidth_cm=-1,
    Material=mat_steel_2,
    menu=[dropdown(1), dropdown(2), dropdown(1), dropdown(37)])
crosecrselect_2 = CrossSectionRangeSelectorKaramba3D(
    MaximumHeight_cm=-1,
    MaximumWidth_cm=-1,
    Material=mat_steel_2,
    menu=[dropdown(1), dropdown(2), dropdown(1), dropdown(78)])
entwine_7 = Entwine(Branch00=crosecrselect, Branch01=crosecrselect, Branch02=crosecrselect_2, FlattenInputs=True)

# ---- group: Define Elements
dir_ortho_01_2 = Curve(dir_ortho_01)
grid_type_orho_0_diag_fine_1_diag_coarse = Integer(define_grid_type)  # "Grid Type: Orho = 0 : Diag (fine) = 1 : Diag (coarse) = 2"
dir_diag_01_fine_2 = Curve(dir_diag_01_fine)
dir_diag_01_coarse_2 = Curve(dir_diag_01_coarse)
dir_ortho_02_2 = Curve(dir_ortho_02)
dir_diag_02_fine_2 = Curve(dir_diag_02_fine)
dir_diag_02_coarse_2 = Curve(dir_diag_02_coarse)
boundary_beams_2 = Curve(boundary_beams)
filter_2 = StreamFilter(
    Gate=grid_type_orho_0_diag_fine_1_diag_coarse,
    Stream0=dir_ortho_01_2,
    Stream1=dir_diag_01_fine_2,
    Stream2=dir_diag_01_coarse_2)
filter_3 = StreamFilter(
    Gate=grid_type_orho_0_diag_fine_1_diag_coarse,
    Stream0=dir_ortho_02_2,
    Stream1=dir_diag_02_fine_2,
    Stream2=dir_diag_02_coarse_2)
entwine_8 = Entwine(Branch00=filter_2, Branch01=filter_3, Branch02=boundary_beams_2, FlattenInputs=True)
panel_5 = Panel("""Direction 1
Direction 2
Boundary""")
linetobeam = CreateLinearElementKaramba3D(
    Line=entwine_8,
    Identifier=graft(panel_5),
    CrossSection=entwine_7,
    LimitDistance_m=0.005,
    BucklingLengthY_m=-1,
    BucklingLengthZ_m=-1,
    BucklingLengthLT_m=-1,
    Bending=True,
    ToPolylineMaxAngle=0.25,
    ToPolylineTolerance=0.1,
    ToPolylineMaxEdgeLength=0.25,
    New=True,
    Remove=True,
    mode="LineToBeam",
    GuidGeneratorSeed=1229242077)  # -> Element, Points, Info

# ---- group: Define Supports
end_2 = EndPoints(Curve=entwine_8)  # -> Start, End
rdpoints = RemoveDuplicatePointsKaramba3D(Point=flatten([end_2.Start, end_2.End]), LimitDistance=0.005)  # -> OutPoint, Info, Indexes
height_at_supports_h_m_6 = Number(height_at_supports_h_m_2)
pdecon_2 = Deconstruct(Point=rdpoints.OutPoint)  # -> XComponent, YComponent, ZComponent
num_3 = Number("0.01")
expression_3 = Expression(z=pdecon_2.ZComponent, h=height_at_supports_h_m_6, tol=num_3, Expression="if(abs(z-h)<tol,True,False)")
cull_6 = CullPattern(List=rdpoints.OutPoint, CullPattern=expression_3)
supp = SupportKaramba3D(PosInd=cull_6, Ct_kN_m=Vector(0, 0, 0), Cr_kNm_rad=Vector(0, 0, 0), menu=[buttons(on, on, on, off, off, off)])

# ---- group: Define SW
Z = UnitZ(Factor=Slider(-1, range=-3..1))
gravity = LoadsKaramba3D(Vector=Z, LCase="SW", mode="Gravity")

# ---- group: Define SDL
superimposed_dead_load_kn_m2_3 = Number(superimposed_dead_load_kn_m2_2)
loadingmesh_4 = Mesh(loadingmesh)
neg_3 = Negative(Value=superimposed_dead_load_kn_m2_3)
panel_6 = Panel("""Direction 1
Direction 2""")
Z_2 = UnitZ(Factor=neg_3)
meshload_const = LoadsKaramba3D(
    Vector=Z_2,
    Mesh=loadingmesh_4,
    ElementIdentifiers=panel_6,
    LCase="SDL",
    LineLoadsPerElement=Slider(1, range=0..10),
    MinimumLineLoadLength_m=0.5,
    mode="MeshLoad -Const.",
    menu=[buttons(off, on, off), buttons(on, on)])

# ---- group: Define Load Combinations
panel_7 = Panel("""G = SW + SDL
W = Wind01 | Wind02
ULS = 1.35*G + 1.5*W
SLS = 1.00*G + 1.00*W""")
lccombinator = LoadCaseCombinatorKaramba3D(LoadCaseCombinationRulesKaramba3D=panel_7)  # -> LoadCaseCombinations, NamesOfLoadCases, NumberOfLoadCases

# ----
panel_8 = Panel("""Direction 1
Direction 2""")
joint_agent = BeamJointAgentKaramba3D(
    BeamIdentifier=panel_8,
    ToElementIdentifiers="Boundary",
    Ct_kN_m=Vector(0, 0, 0),
    Cr_kNm_rad=Vector(0, 0, 0),
    menu=[buttons(off, off, off, off, on, on)])

support = SupportKaramba3D(flatten(supp))
joint = JointKaramba3D(flatten(joint_agent))
element = ElementKaramba3D(flatten(linetobeam.Element))
entwine_9 = Entwine(
    Branch00=gravity,
    Branch01=meshload_const,
    Branch02=meshload_var,
    Branch03=lccombinator.LoadCaseCombinations,
    FlattenInputs=True)
clean_7 = CleanTree(RemoveNulls=True, RemoveInvalid=True, RemoveEmpty=True, Tree=entwine_9)
load = LoadKaramba3D(flatten(clean_7))

assemble = AssembleModelKaramba3D(Elem=flatten(element), Support=flatten(support), Load=flatten(load), Joint=flatten(joint), LimitDistance_m=0.005)  # -> Model, Info, Mass_kg, CentreOfGravity, LoadCaseNames
panel_9 = Panel(assemble.Info)
system_mass_kg = Panel(assemble.Mass_kg)

# ---- group: Analyze Model
analyse = AnalyseKaramba3D(Model=assemble.Model)  # -> AnalysedModel, MaximumDisplacement_cm, ResultingForce_kN, ChangeOfElasticEnergy_kNm
panel_10 = Panel(assemble.LoadCaseNames)
panel_11 = Panel(analyse.MaximumDisplacement_cm)

# ---- group: Calculate Eigenmodes
eigen_modes = EigenModesKaramba3D(
    Model=analyse.AnalysedModel,
    FromIndex=1,
    NumberOfModes="10",
    WithThIIEffects=False,
    MaximumNumberOfIterations=300,
    Epsilon=1e-07)  # -> ModelWithEigenModes, Eigenvalues

# ---- group: Export File STP
press_to_export = Button()
dstv_name_extension = Panel("ENG07-Simple Vault.stp")
folder_path_for_export = FilePath("C:\Users\drago\OneDrive\Desktop\")
filter_4 = StreamFilter(Gate=press_to_export, Stream1=eigen_modes.ModelWithEigenModes)
concat = Concatenate(FragmentA=folder_path_for_export, FragmentB=dstv_name_extension)
extodstv = ExportModelToDStVKaramba3D(
    Model=filter_4,
    Path=concat,
    ExportPath="C:\Users\drago\OneDrive\Desktop\ENG01-Canopy.stp",
    menu=[buttons(off, off, off, on, off, off)])  # -> DStV, Info
panel_12 = Panel(extodstv.DStV)

# ----
press_to_export_2 = Button()
saf_name_extension = Panel("ENG07-Simple Vault.saf")
folder_path_for_export_2 = FilePath("C:\Users\drago\OneDrive\Desktop\")
concat_2 = Concatenate(FragmentA=folder_path_for_export_2, FragmentB=saf_name_extension)
safexport = ExportModelToSAFKaramba3D(
    Model=eigen_modes.ModelWithEigenModes,
    Filepath=concat_2,
    ExportNow=press_to_export_2,
    OrientationGlobalCS=0,
    OrientationLocalCS=0,
    Discipline="Load-bearing structure",
    BuildingCodeIndex=0,
    LengthSegment_m=-1,
    MaximumFacesMesh=2000,
    SAFVersion="1.0.5",
    CrossSectionNameConversion="CrossSectionNameAliases.csv")  # -> Model, Info
panel_13 = Panel(safexport.Info)

resultselect = ResultSelectorKaramba3D(
    Model=eigen_modes.ModelWithEigenModes,
    menu=[buttons(on, on), dropdown(2), dropdown(0), buttons(off, off, off, off, off, off, off), buttons(off, off, off, off, off, off), buttons(off, off, off, off, off, off, off, off), buttons(off, off, off, off, off, off, off, off)])  # -> Model, LoadCaseSelection
modelview = ModelViewKaramba3D(Model=resultselect.Model)  # -> Model, DeformedMesh, DeformedAxes, DeformedModel, MaximumDeformation
beamview = BeamViewKaramba3D(Model=modelview.Model)  # -> Model, MeshesOfRenderedBeams, DeformedBeamAxes, LegendColours, LegendTags
legend = LegendKaramba3D(
    Colors=beamview.LegendColours,
    Tags=beamview.LegendTags,
    Scale=0.45,
    Textsize=30,
    Legend_HasHeader=False,
    Legend_Justification=2,
    Legend_Position=2)

# ---- group: Results - Reaction Forces
react = ReactionForcesKaramba3D(AnalysedModel=beamview.Model)  # -> Model, ReactionForces_kN, ReactionMoments_kNm, SupportPosition, SumOfReactionForces_kN, SumOfReactionMoments_kNm, GoverningLoadCaseIndex
reactview = ReactionViewKaramba3D(Model=modelview.Model)  # -> Model, LegendColours, LegendTags
panel_14 = Panel(react.SumOfReactionForces_kN)

# ==== cluster Cluster
vaultsurface = ClusterInput()
meshtargetsize = ClusterInput()
meshtargetsize_2 = Number(meshtargetsize)
vaultsurface_2 = Surface(vaultsurface)
dim = Dimensions(Surface=vaultsurface_2)  # -> UDimension, VDimension
division = Division(A=dim.UDimension, B=meshtargetsize_2)
division_2 = Division(A=dim.VDimension, B=meshtargetsize_2)
round = Round(Number=division)  # -> Nearest, Floor, Ceiling
round_2 = Round(Number=division_2)  # -> Nearest, Floor, Ceiling
mesh_uv = MeshSurface(Surface=vaultsurface_2, UCount=round.Nearest, VCount=round_2.Nearest, Overhang=True, Equalize=False)
loadingmeshes = Mesh(mesh_uv)
loadingmeshes_2 = ClusterOutput(loadingmeshes)

# ==== cluster Cluster_2
vault_curve = ClusterInput()
plane = ClusterInput()
spacing = ClusterInput()
cpe = ClusterInput()
scaling = ClusterInput()
vault_curve_2 = Curve(vault_curve)
plane_2 = Plane(plane)
spacing_2 = Number(spacing)
cpe_2 = Data(cpe)
scaling_2 = Number(scaling)
null = NullItem(Item=cpe_2)  # -> NullFlags, InvalidFlags, Description
divide = DivideCurve(Curve=vault_curve_2, Count=4, Kinks=False)  # -> Points, Tangents, Parameters
cset = CreateSet(List=null.NullFlags)  # -> Set, Map
shatter = Shatter(Curve=vault_curve_2, Parameters=divide.Parameters)
bang = ExplodeTree(Data=cset.Set)  # -> Branch0, Branch1
bang_2 = ExplodeTree(Data=cpe_2)  # -> Branch0, Branch1
pframe = PerpFrame(Curve=reparameterize(shatter), Parameter=0.5)
filter = StreamFilter(Gate=bang.Branch1, Stream0=scaling_2)
deplane = DeconstructPlane(Plane=pframe)  # -> Origin, XAxis, YAxis, ZAxis
pl = ConstructPlane(Origin=deplane.Origin, XAxis=deplane.XAxis, YAxis=deplane.ZAxis)
multiplication = Multiplication(A=bang_2.Branch0, B=scaling_2)
multiplication_2 = Multiplication(A=bang_2.Branch1, B=filter)
crv = Curve(shatter)
larger = LargerThan(FirstNumber=multiplication, SecondNumber=0)  # -> LargerThan, OrEqualTo
larger_2 = LargerThan(FirstNumber=multiplication_2, SecondNumber=0)  # -> LargerThan, OrEqualTo
offset = OffsetCurve(Curve=crv, Distance=multiplication, Plane=pl, Corners=1)
offset_2 = OffsetCurve(Curve=crv, Distance=multiplication_2, Plane=pl, Corners=1)
graft = GraftTree(Tree=crv, IncludeEmptyLists=True, IncludeNullItems=True)
deplane_2 = DeconstructPlane(Plane=plane_2)  # -> Origin, XAxis, YAxis, ZAxis
neg = Negative(Value=spacing_2)
loft = Loft(Curves=[graft, offset], Options={Adjust=False, Closed=False, LoftEnds=0, LoftSimp=0, LoftType=0, Rebuild=10, Refit=0.01})  # -> flatten(Loft)
loft_2 = Loft(
    Curves=[graft, offset_2],
    Options={Adjust=False, Closed=False, LoftEnds=0, LoftSimp=0, LoftType=0, Rebuild=10, Refit=0.01})  # -> flatten(Loft)
amp = Amplitude(Vector=deplane_2.XAxis, Amplitude=neg)
multiplication_3 = Multiplication(A=amp, B=2)
end = EndPoints(Curve=vault_curve_2)  # -> Start, End
move = Move(Geometry=loft, Motion=amp)  # -> Geometry, Transform
move_2 = Move(Geometry=end.Start, Motion=amp)  # -> Geometry, Transform
move_3 = Move(Geometry=end.Start, Motion=multiplication_3)  # -> Geometry, Transform
move_4 = Move(Geometry=loft_2, Motion=multiplication_3)  # -> Geometry, Transform
dispatch = Dispatch(List=move.Geometry, DispatchPattern=larger.LargerThan)  # -> ListA, ListB
filter_2 = StreamFilter(Gate=bang.Branch1, Stream0=move_3.Geometry)
dispatch_2 = Dispatch(List=move_4.Geometry, DispatchPattern=larger_2.LargerThan)  # -> ListA, ListB
srf_pressure = Surface([dispatch.ListA, dispatch_2.ListA])
srf_suction = Surface([dispatch.ListB, dispatch_2.ListB])
pt_tag = Point([move_2.Geometry, filter_2])
pt_tag_2 = ClusterOutput(pt_tag)
srf_suction_2 = ClusterOutput(srf_suction)
srf_pressure_2 = ClusterOutput(srf_pressure)
