# Grasshopper definition 01_BucklingBridge.gh (Grasshopper 1.0.7)
# Copyright: Karamba3D
# plug-ins: Karamba3D

# ---- group: Create Geometry
pt = Point(Point(5, 5, 0))
pt_2 = Point(Point(55, 5, 0))
spacing = Slider(2.8, range=0.5..5)
width = Slider(5, range=2..12)
height = Slider(4, range=0.5..10)
vec2pt = Vector2Pt(PointA=pt, PointB=pt_2, Unitize=False)  # -> Vector, Length
aligndim = AlignedDimension(Plane=PlaneXY(0, 0, 0), PointA=pt, PointB=pt_2, Offset=-5, Text="{0:0.00}", Size=1)
panel = Panel("""-0.5
-0.5
0.0
0.5
0.5""")
panel_2 = Panel("""1
0
0
0
1""")
division = Division(A=vec2pt.Length, B=spacing)
# 01 - Buckling Bridge
# Difficulty: Moderate | Version 3.1.4
# A U-shaped bridge is analyzed using Second Order Theory to view the buckling modes. Scroll through the loadcases to see how the structure buckles. The diagonal members are treated as truss elements.
# The vibrations of the bridge can be view with the Natural Vibrations component.
align = AlignPlane(Plane=pt, Direction=vec2pt.Vector)  # -> Plane, Angle
range = Range(Domain=vec2pt.Length, Steps=division)
multiplication = Multiplication(A=width, B=panel)
multiplication_2 = Multiplication(A=height, B=panel_2)
pt_3 = PointOriented(BasePlane=align.Plane, UComponent=range, VComponent=graft(multiplication), WComponent=graft(multiplication_2))  # -> simplify(Point)
pline = PolyLine(Vertices=pt_3, Closed=False)  # -> flatten(Polyline)
flip = FlipMatrix(Data=pt_3)
bang = ExplodeTree(Data=pt_3)  # -> Branch0, Branch1, Branch2, Branch3, Branch4
cluster = Cluster_3(pt=bang.Branch0, pt_2=bang.Branch1)
cluster_2 = Cluster_3(pt=bang.Branch4, pt_2=bang.Branch3)
shift = ShiftList(List=bang.Branch2, Shift=1, Wrap=False)
pline_2 = PolyLine(Vertices=flip, Closed=False)
cull_i = CullIndex(List=pline, Indices="2", Wrap=True)
explode = Explode(Curve=pline_2, Recursive=True)  # -> Segments, Vertices
explode_2 = Explode(Curve=cull_i, Recursive=True)  # -> Segments, Vertices
ln = Line(StartPoint=bang.Branch1, EndPoint=shift)
ln_2 = Line(StartPoint=bang.Branch3, EndPoint=shift)
line = Line([cluster, cluster_2, ln, ln_2])
entwine = Entwine(Branch00=explode.Segments, Branch01=explode_2.Segments, Branch02=line, FlattenInputs=True)

# ---- group: Define Materials
matselect = MatSelect(menu=[dropdown(1), dropdown(2)])

# ---- group: Define Cross Sections
crosecrselect = CroSecRSelect(MaxH=-1, MaxWidth=-1, menu=[dropdown(0), dropdown(0), dropdown(3)])
i = Slider(5, range=0..20)
i_2 = Slider(8, range=0..20)
i_3 = Slider(3, range=0..20)
merge = Merge(Data1=i, Data2=i_2, Data3=i_3)  # -> graft(Result)
crosecselect = CroSecSelect(CroSec=crosecrselect, NameInd=merge, Mat=matselect)  # -> CroSec, Info

# ---- group: Define Supports
panel_3 = Panel("""1
2""")
item = ListItem(List=cull_i, Index=panel_3, Wrap=True)
end = EndPoints(Curve=item)  # -> Start, End
pln = Plane(align.Plane)
supp = Supp(PosInd=end.Start, Plane=pln, menu=[buttons(on, on, on, off, off, off)])
supp_2 = Supp(PosInd=end.End, Plane=pln, menu=[buttons(off, on, on, off, off, off)])
support = SupportKaramba([supp, supp_2])

# ---- group: Define Loads
cluster_3 = Cluster(P=flatten(pt_3))
panel_4 = Panel("""1
2""")
mass_kg_m² = Panel("500")
item_2 = ListItem(List=cull_i, Index=panel_4, Wrap=True)
cluster_4 = Cluster_2(M=cluster_3, x=mass_kg_m², C=item_2)  # -> R, i
Z = UnitZ(Factor="-5")
panel_5 = Panel("U")
loads = Loads(
    Vec=Z,
    Mesh=cluster_3,
    ElementIdentifiers=panel_5,
    LCase="LC0",
    mode="MeshLoad -Const.",
    menu=[buttons(off, on, off), buttons(off, on)])
loads_2 = Loads(Vec=Vector(0, 0, -1), LCase="LC0", mode="Gravity")
pmass = PMass(Mass=cluster_4.R, SFacs=Vector(1, 1, 1), PosInd=cluster_4.i, Rho=7850)
load = LoadKaramba(flatten([loads_2, loads, pmass]))

# ---- group: Orient Elements
panel_6 = Panel("""U
M""")
orientate = Orientate(BeamId=panel_6, Alpha="90", mode="Beam")

# ---- group: Define Elements
truss = Panel("""1
1
0""")
panel_7 = Panel("""U
M
D""")
lineelem = LineElem(
    Line=entwine,
    Id=graft(panel_7),
    CroSec=crosecselect.CroSec,
    LDist=0.005,
    BklLenY=-1,
    BklLenZ=-1,
    BklLenLT=-1,
    Bending=graft(truss),
    ToPAng=0.03,
    ToPTol=0.01,
    ToPMaxL=0.25,
    New=True,
    Remove=True,
    mode="LineToBeam")  # -> Elem, Pts, Info
element = ElementKaramba(flatten([orientate, lineelem.Elem]))

# ---- group: Assemble Model
assemble = Assemble(Elem=element, Support=support, Load=load, LDist=0.005)  # -> Model, Info, Mass, COG, LCNames

# ---- group: Analyze Model using Second Order Theory
analysethii = AnalyseThII(Model=assemble.Model, InitialNII=True, CombiNII=True, NoTenNII=False, RTol=1e-07, MaxIter=50)  # -> Model, Disp, Force, Energy
panel_8 = Panel(analysethii.Disp)

# ---- group: Calculate Buckling Modes
bmodes_karamba3d = BModesKaramba3D(Model=analysethii.Model, FromInd=1, NModes="10", MaxIter=300, Eps=1e-07)  # -> Model, BLFacs
panel_9 = Panel(bmodes_karamba3d.BLFacs)

# ---- group: Calculate Natural Vibrations
nvibes = NVibes(Model=analysethii.Model, FromInd=1, NModes="10", ThII=True, MaxIter=30, Eps=1e-05)  # -> Model, NFrequ, MMass, PartiF
panel_10 = Panel(nvibes.NFrequ)

# ---- group: View Results
lc = Slider(0, range=0..9)
modelview = ModelView(Model=bmodes_karamba3d.Model, LCase=lc)  # -> Model, DefMesh, DefAxes, DefModel, DefMax
beamview = BeamView(Model=modelview.Model)  # -> Model, Mesh, Curves, LegendC, LegendT

lc_2 = Slider(0, range=0..9)
modelview_2 = ModelView(Model=nvibes.Model, LCase=lc_2)  # -> Model, DefMesh, DefAxes, DefModel, DefMax
beamview_2 = BeamView(Model=modelview_2.Model)  # -> Model, Mesh, Curves, LegendC, LegendT

modelview_3 = ModelView(Model=analysethii.Model)  # -> Model, DefMesh, DefAxes, DefModel, DefMax
beamview_3 = BeamView(Model=modelview_3.Model)  # -> Model, Mesh, Curves, LegendC, LegendT
legend = Legend(Colour=beamview_3.LegendC, Tags=beamview_3.LegendT, LegendType=1)

# ==== cluster Cluster
P = ClusterInput()
hull = ConvexHull(Points=P, Plane=PlaneXY(0, 0, 0))  # -> Hull, HullZ, Indices
Z = UnitZ(Factor="-0.1")
move = Move(Geometry=hull.Hull, Motion=Z)  # -> Geometry, Transform
dim = Dimensions(Surface=move.Geometry)  # -> UDimension, VDimension
mesh_uv = MeshSurface(Surface=move.Geometry, UCount=dim.UDimension, VCount=dim.VDimension, Overhang=True, Equalize=False)
M = ClusterOutput(mesh_uv)

# ==== cluster Cluster_2
M = ClusterInput()
C = ClusterInput()
x = ClusterInput()
area = MeshArea(Mesh=M)  # -> Area, Centroid
facen = FaceNormals(Mesh=M)  # -> Centers, Normals
cp = ControlPoints(Curve=C)  # -> flatten(Points), Weights, Knots
lng = ListLength(List=facen.Centers)
pull = PullPoint(Point=facen.Centers, Geometry=cp.Points, ClosestOnly=True)  # -> ClosestPoint, Distance
division = Division(A=area.Area, B=lng)
pgroups = PointGroups(Points=pull.ClosestPoint, Distance=0.01)  # -> Groups, Indices
lng_2 = ListLength(List=pgroups.Groups)  # -> flatten(Length)
expression = Expression(x=x, y=division, z=lng_2, Expression="x*y*z")
item = ListItem(List=pgroups.Groups, Index=0, Wrap=True)  # -> flatten(Item)
R = ClusterOutput(expression)
i = ClusterOutput(item)

# ==== cluster Cluster_3
pt = ClusterInput()
pt_2 = ClusterInput()
pt_3 = Point(pt)
pt_4 = Point(pt_2)
shift = ShiftList(List=pt_3, Shift=1, Wrap=False)
shift_2 = ShiftList(List=pt_4, Shift=1, Wrap=False)
short = ShortestList(ListA=pt_4, ListB=shift, TrimMode=2)  # -> ListA, ListB
short_2 = ShortestList(ListA=pt_3, ListB=shift_2, TrimMode=2)  # -> ListA, ListB
ln = Line(StartPoint=short_2.ListA, EndPoint=short_2.ListB)
ln_2 = Line(StartPoint=short.ListA, EndPoint=short.ListB)
cull_i = CullIndex(List=ln_2, Indices=0, Wrap=True)
culln = CullNth(List=cull_i, CullFrequency=2)
culln_2 = CullNth(List=ln, CullFrequency=2)
line = Line([culln_2, culln])
line_2 = ClusterOutput(line)
