# Grasshopper definition 01_BucklingSimulation3dPrintedConcrete.gh (Grasshopper 1.0.7)
# plug-ins: Karamba3D, Human

# ---- group: Create Geometry
# Witteveen+Bos
# Author: Shaun Wu, Jordy Vos, Nelson Xiong Neng
objectrad_m = Slider(0.25, range=0..1)
objectht_m = Slider(1, range=0..1.5)
cir = Circle(Plane=PlaneXY(0, 0, 0), Radius=objectrad_m)
Z = UnitZ(Factor=objectht_m)
# 01 Buckling Simulation for 3D Printing in Fresh Concrete
# Difficulty: Moderate
# This definition takes surface input and creates contour slices. These slices are assigned different material properties based on the aging properties of the 3d printed concrete and then analysed in Karamba3D to see when the 3d printed
# object starts to buckle. Zero length springs are assigned at the supports to accurately simulate the support conditions.
# 
# 1. change the layercount slider to change the layers printed
# 2. the layer thickness can be adapted with the contour distance
# 3. different input geometries can be tested
extr = Extrude(Base=cir, Direction=Z)

# ----
layercount = Slider(20, range=3..40)

# ---- group: Slicing Geometry
# This work is licensed under a Creative Commons Attribution 4.0 licence. You are free to copy, communicate and adapt the work, so long as you attribute the work in the manner specified by the author or licensor (but not in any way that suggests that they endorse you or your use of the work). A copy of this licence is available at https://creativecommons.org/licenses/by-sa/4.0/ or write to info@creativecommons.org
contour = Contour(Shape=extr, Point=Point(0, 0, 0), Direction=Vector(0, 0, 1), Distance=Slider(0.01, range=0..0.01))  # -> flatten(Contours)
series = Series(Start=0, Step=1, Count=layercount)
item = ListItem(List=contour, Index=series, Wrap=False)
clean = CleanTree(RemoveNulls=True, RemoveInvalid=True, RemoveEmpty=False, Tree=item)
len = Length(Curve=clean)  # -> flatten(Length)

# ---- group: Define Cross Sections
pt = ConstructPoint(XCoordinate="1E10", YCoordinate="1E10", ZCoordinate="1E10")
pt_2 = ConstructPoint(XCoordinate="1E-6", YCoordinate="1E-6", ZCoordinate="1E-6")
panel = Panel("Spring")
crosec = CrossSectionKaramba3D(
    FamilyNameOfCrossSection="DefaultCroSec",
    ElementIdentifier=panel,
    CTranslation_kN_m=pt,
    CRotation_kNm_rad=pt_2,
    mode="Spring")

# ---- group: Mesh Geometry
shift = ShiftList(List=clean, Shift=1, Wrap=False)  # -> graft(List)
shift_2 = ShiftList(List=clean, Shift=-1, Wrap=False)  # -> graft(List)
merge = Merge(Data1=shift_2, Data2=shift)
loft = Loft(Curves=merge, Options={Adjust=True, Closed=False, LoftEnds=0, LoftSimp=0, LoftType=0, Rebuild=10, Refit=0.01})  # -> flatten(Loft)
mesh_uv = MeshSurface(Surface=loft, UCount=Slider(1, range=0..1), VCount=Slider(100, range=0..1000), Overhang=True, Equalize=False)  # -> graft(Mesh)

# ---- group: Define Loads
loads = LoadsKaramba3D(Vector=Vector(0, 0, -1), LCase="LC0", mode="Gravity")

# ---- group: Define Materials / Aging
convertto_mm = Slider(1000, range=0..100000)
printspeed_mm_min = Slider(5000, range=0..20000)
shift_3 = ShiftList(List=len, Shift=1, Wrap=False)
lng = ListLength(List=shift_3)
multiplication = Multiplication(A=shift_3, B=convertto_mm)

# ---- group: Define Materials / Aging / aging in min
division = Division(A=multiplication, B=printspeed_mm_min)

# ---- group: Define Materials / Aging (continued)
python = GhPythonScript(mins=division)  # -> out, aging; inputs mins: list
# ---------- python: Python ----------
__author__ = "WUD"
__version__ = "2019.11.12"

import rhinoscriptsyntax as rs

finalAging= []
for min in mins:
    if len(finalAging) == 0:
        finalAging.append(min)
    else:
        for i in range(len(finalAging)):
            finalAging[i] += min
        finalAging.append(min)
aging = finalAging
# ---------- end python ----------

# ---- group: Define Materials / Material Naming
python_2 = GhPythonScript(name="Shell_", length=lng)  # -> out, graft(myName)
# ---------- python_2: Python ----------
__author__ = "WUD"
__version__ = "2019.10.23"

import rhinoscriptsyntax as rs

finalName=[]
for i in range(length):
    currentName = name+str(i)
    print currentName
    finalName.append(currentName)
    
myName = finalName
# ---------- end python_2 ----------

# ---- group: Define Materials
number_slider = Slider(0, range=0..50)
panel_2 = Panel("3DCP")
alphat = Panel("0.00001")
panel_3 = Panel("concrete")

# ---- group: Define Materials / Young's Module
eval = Evaluate(F="0.00781 + 0.000012*t + testValue", t=python.aging, testValue=number_slider)  # -> graft(r)

# ---- group: Define Materials / Shear Module
division_2 = Division(A=eval, B="2.6")  # -> graft(Result)

# ---- group: Define Materials / Yield Strength
eval_2 = Evaluate(F="0.0005984 + 0.000014*t + testValue", t=python.aging, testValue=number_slider)  # -> graft(r)

# ---- group: Define Materials (continued)
matprops = MaterialPropertiesKaramba3D(
    FamilyOfMaterial=panel_3,
    Name=panel_2,
    ElementIdentifier=python_2.myName,
    YoungsModulus_kN_cm²=eval,
    InPlaneShearModulus_kN_cm²=division_2,
    TransverseShearModulus_kN_cm²=division_2,
    SpecificWeight_kN_m³=Slider(20.2, range=0..100),
    CoefficientOfThermalExpansion_1=alphat,
    TensileStrength_kN_cm²=eval_2,
    CompressiveStrength_kN_cm²=-23.5,
    StrengthHypothesis="MISES",
    mode="Isotrop")  # -> graft(Material)

# ---- group: Define Cross Sections
printwidth_cm = Slider(5, range=0..25)
crosec_2 = CrossSectionKaramba3D(
    FamilyNameOfCrossSection=panel_3,
    NameOfCrossSection=panel_2,
    ElementIdentifier=python_2.myName,
    Material=simplify(matprops),
    Height_cm=printwidth_cm,
    mode="Shell - Const")  # -> simplify(CrossSection)

# ---- group: Define Elements
mesh = Mesh(mesh_uv)
surfelem = CreateSurfaceElementKaramba3D(
    Mesh=simplify(mesh),
    Identifier=simplify(python_2.myName),
    CrossSection=crosec_2,
    LimitDistance_m=0.005,
    Bending=True,
    mode="MeshToShell")  # -> flatten(Element), Points, Info

pt_3 = Point(flatten(surfelem.Points))
rdpoints = RemoveDuplicatePointsKaramba3D(Point=pt_3, LimitDistance=0.005)  # -> OutPoint, Info, Indexes
pdecon = Deconstruct(Point=rdpoints.OutPoint)  # -> XComponent, YComponent, ZComponent
smaller = SmallerThan(FirstNumber=pdecon.ZComponent, SecondNumber=Slider(0.001, range=0..0.001))  # -> SmallerThan, OrEqualTo
cull = CullPattern(List=rdpoints.OutPoint, CullPattern=smaller.OrEqualTo)  # -> simplify(List)
ln = Line(StartPoint=cull, EndPoint=cull)
merge_2 = Merge(Data1=cull, Data2=cull)
lineelem = CreateLinearElementKaramba3D(
    Line=ln,
    Identifier=panel,
    CrossSection=crosec,
    LimitDistance_m=0.005,
    BucklingLengthY_m=-1,
    BucklingLengthZ_m=-1,
    BucklingLengthLT_m=-1,
    Bending=True,
    ToPolylineMaxAngle=0.03,
    ToPolylineTolerance=0.01,
    ToPolylineMaxEdgeLength=0.25,
    Points=merge_2,
    New=True,
    Remove=True,
    mode="LineToBeam")  # -> Element, Points, Info
pt_4 = ConstructPoint(XCoordinate=0, YCoordinate=0, ZCoordinate=0)
vec2pt = Vector2Pt(PointA=pt_4, PointB=cull, Unitize=False)  # -> Vector, Length
orientate = OrientateElemKaramba3D(Beam=lineelem.Element, XOrientation=vec2pt.Vector, mode="Beam")

# ---- group: Define Supports
lng_2 = ListLength(List=cull)
panel_4 = Panel(lng_2)
series_2 = Series(Start=panel_4, Step=1, Count=panel_4)
supp = SupportKaramba3D(PosInd=series_2, menu=[buttons(on, on, on, on, on, on)])

# ---- group: Assemble Model
assemble = AssembleModelKaramba3D(
    Elem=flatten([surfelem.Element, orientate]),
    Support=flatten(supp),
    Load=flatten(loads),
    LimitDistance_m=0.005,
    Points=flatten(lineelem.Points),
    CrossSection=flatten([crosec_2, crosec]),
    Material=flatten(matprops))  # -> Model, Info, Mass_kg, CentreOfGravity, LoadCaseNames

# ---- group: Analyze Model
analysethii = AnalyseThIIKaramba3D(
    Model=assemble.Model,
    UseInitialNII=True,
    NIIFromCombination=True,
    NoTensionalNII=Toggle(True),
    RTolerance=Slider(0.0001, range=0..1),
    MaxIterations=Slider(100, range=0..100))  # -> AnalysedModel, MaximumDisplacement_cm, ResultingForce_kN, ChangeOfElasticEnergy_kNm
displacement = Panel(analysethii.MaximumDisplacement_cm)

# ---- group: View Results
modelview = ModelViewKaramba3D(Model=analysethii.AnalysedModel)  # -> Model, DeformedMesh, DeformedAxes, DeformedModel, MaximumDeformation
shellview = ShellViewKaramba3D(Model=modelview.Model, IndexOfLayer=0)  # -> Model, MeshesOfRenderedShells, LegendColours, LegendTags
mjoin = MeshJoin(Meshes=shellview.MeshesOfRenderedShells)
legend = Legend(Colour=shellview.LegendColours, Tags=shellview.LegendTags, LegendType=1)

# ---- group: Render Text to Screen
lng_3 = ListLength(List=clean)
panel_5 = Panel(shellview.LegendTags)
expression = Expression(x="Layer: ", y=lng_3, Expression="Format(\"{0}{1}\", x, y)")
expression_2 = Expression(
    x="MaximumDisplacement: ",
    y=analysethii.MaximumDisplacement_cm,
    z="cm",
    Expression="Format(\"{0}{1:0.000} {2}\", x, y, z)")
expression_3 = Expression(x="PrintWidth: ", y=printwidth_cm, z="cm", Expression="Format(\"{0}{1} {2}\", x, y, z)")
expression_4 = Expression(x="PrintSpeed: ", y=printspeed_mm_min, z="mm/min", Expression="Format(\"{0}{1} {2}\", x, y, z)")
multiplication_2 = Multiplication(A=objectrad_m, B=Slider(100, range=0..100))
expression_5 = Expression(x="ObjectRadius: ", y=multiplication_2, z="cm", Expression="Format(\"{0}{1} {2}\", x, y, z)")
item_2 = ListItem(List=panel_5, Index=Slider(1, range=0..1), Wrap=True)
item_3 = ListItem(List=panel_5, Index="-2", Wrap=True)
expression_6 = Expression(x="MinStress:  ", y=item_2, z="[kN/cm2]", Expression="Format(\"{0}{1} {2}\", x, y, z)")
expression_7 = Expression(x="MaxStress: ", y=item_3, z="[kN/cm2]", Expression="Format(\"{0}{1} {2}\", x, y, z)")
merge_3 = Merge(
    Data1=flatten(expression),
    Data2=flatten(expression_2),
    Data3=flatten(expression_3),
    Data4=flatten(expression_4),
    Data5=flatten(expression_5),
    Data6=flatten(expression_6),
    Data7=flatten(expression_7))
lng_4 = ListLength(List=merge_3)
series_3 = Series(Start="100", Step="30", Count=lng_4)
pt_5 = ConstructPoint(XCoordinate="100", YCoordinate=series_3, ZCoordinate=0)
texttoscreen = RenderTextToScreen(Text=merge_3, Location=pt_5, Size=Slider(20, range=0..100), Color=RGB(0, 0, 0), m_scWithvp=False)
