# Grasshopper definition 01_CrossSectionOptimization_Spline.gh (Grasshopper 1.0.7)
# plug-ins: Karamba3D

# ---- group: Generate Geometry
pt = Point([Point(-5.7596263, -5.210415933, 0), Point(-2.420360762, 0.3132960405, 0), Point(3.447640055, -6.957411748, 0), Point(7.926912901, 2.108199806, 0)])
nurbs = NurbsCurve(Vertices=pt, Degree=3, Periodic=False)  # -> Curve, Length, Domain

# ---- group: Define Cross Section
# 01 - Cross Section Optimization of a Spline
# Difficulty: Moderate | Version 3.1.4
# Input a spline and use parameters to control how the spline is converted into polylines to be analyzed as a beam. The support and load positions can be moved using the sliders.
crosecrselect = CrossSectionRangeSelectorKaramba3D(MaximumHeight_cm=-1, MaximumWidth_cm=-1, menu=[dropdown(0), dropdown(1), dropdown(2)])
crosecselect = CrossSectionSelectorKaramba3D(CrossSections=crosecrselect)  # -> CrossSection, Info

# ---- group: Define Elements
lineelem = CreateLinearElementKaramba3D(
    Line=nurbs.Curve,
    Identifier="A",
    CrossSection=crosecselect.CrossSection,
    LimitDistance_m=0.005,
    BucklingLengthY_m=-1,
    BucklingLengthZ_m=-1,
    BucklingLengthLT_m=-1,
    Bending=True,
    ToPolylineMaxAngle=Slider(0.1, range=0..10),
    ToPolylineTolerance=Slider(0.24, range=0..1),
    ToPolylineMaxEdgeLength=Slider(0.8, range=0..10),
    New=True,
    Remove=True,
    mode="LineToBeam")  # -> Element, Points, Info

# ---- group: Define Supports
lng = ListLength(List=lineelem.Points)  # -> expr("x-1", Length)
multiplication = Multiplication(A=lng, B=Slider(0, range=0..1))
multiplication_2 = Multiplication(A=lng, B=[Slider(0.372, range=0..1), Slider(0.183, range=0..1)])
supp = SupportKaramba3D(PosInd=multiplication, menu=[buttons(on, on, on, off, off, on)])
supp_2 = SupportKaramba3D(PosInd=multiplication_2, menu=[buttons(off, off, on, off, off, off)])
support = SupportKaramba3D([supp_2, supp])

# ---- group: Define Loads
multiplication_3 = Multiplication(A=lng, B=Slider(0.843, range=0..1))
Z = UnitZ(Factor=Slider(-8.7, range=-10..10))
loads = LoadsKaramba3D(Vector=Vector(0, 0, -1), LCase="LC0", mode="Gravity")
loads_2 = LoadsKaramba3D(ForceVector=Z, Local=False, PosInd=multiplication_3, LCase="LC0", mode="Point")
load = LoadKaramba3D([loads, loads_2])

# ---- group: Assemble Model
assemble = AssembleModelKaramba3D(Elem=flatten(lineelem.Element), Support=flatten(support), Load=flatten(load), LimitDistance_m=0.005)  # -> Model, Info, Mass_kg, CentreOfGravity, LoadCaseNames

# ---- group: Optimize Cross Section
opticrosec = OptimizeCrossSectionKaramba3D(
    Model=assemble.Model,
    CrossSections=crosecrselect,
    MaximumUtilization=1,
    MaximumVirtualWork_kNcm=0.01,
    NumberOfUtilizationIterations=5,
    NumberOfDisplacementIterations=5,
    NumberOfDisplacementIncrementsPerIteration=2,
    DisplacementTolerance=0.01,
    NumberOfSamplePoints=3,
    ElasticDesign=True,
    GammaM0=1,
    GammaM1=1.1,
    SwayFrame=True)  # -> OptimizedModel, Info, Mass_kg, MaximumDisplacement_cm, ElasticEnergyChange_kNm, MaximumUtilizationViewInsufficientCrossSections, MaximumDisplacementViewLimitCrossSections
displacement = Panel(opticrosec.MaximumDisplacement_cm)

# ---- group: View Results
modelview = ModelViewKaramba3D(Model=opticrosec.OptimizedModel)  # -> Model, DeformedMesh, DeformedAxes, DeformedModel, MaximumDeformation
beamview = BeamViewKaramba3D(Model=modelview.Model)  # -> Model, MeshesOfRenderedBeams, DeformedBeamAxes, LegendColours, LegendTags
legend = Legend(Colour=beamview.LegendColours, Tags=beamview.LegendTags, LegendType=1)

beamview_2 = BeamViewKaramba3D(Model=modelview.Model)  # -> Model, MeshesOfRenderedBeams, DeformedBeamAxes, LegendColours, LegendTags
move = Move(Geometry=beamview_2.MeshesOfRenderedBeams, Motion="{0,0,2}")  # -> Geometry, Transform
beamview_3 = BeamViewKaramba3D(Model=modelview.Model)  # -> Model, MeshesOfRenderedBeams, DeformedBeamAxes, LegendColours, LegendTags
move_2 = Move(Geometry=beamview_3.MeshesOfRenderedBeams, Motion="{0,0,4}")  # -> Geometry, Transform
beamview_4 = BeamViewKaramba3D(Model=modelview.Model)  # -> Model, MeshesOfRenderedBeams, DeformedBeamAxes, LegendColours, LegendTags
move_3 = Move(Geometry=beamview_4.MeshesOfRenderedBeams, Motion="{0,0,6}")  # -> Geometry, Transform
