# Grasshopper definition 01_ElementSetsInABeamGrid.gh (Grasshopper 1.0.7)
# plug-ins: Karamba3D

# ---- group: Generate Geometry
planesrf = PlaneSurface(Plane=PlaneXY(0, 0, 0), XSize=Domain(-10, 10), YSize=Domain(-10, 10))
sdivide = DivideSurface(Surface=planesrf, UCount=10, VCount=10)  # -> Points, Normals, Parameters
flip = FlipMatrix(Data=sdivide.Points)
# 01 - Element Sets in a Beam Grid
# Difficulty: Simple | Version 3.1.4
# This example shows how to use the Element Set Component in combination with the Cross Section Optimizer for beams.
pline = PolyLine(Vertices=sdivide.Points, Closed=False)
pline_2 = PolyLine(Vertices=flip, Closed=False)
explode = Explode(Curve=pline, Recursive=True)  # -> Segments, Vertices
explode_2 = Explode(Curve=pline_2, Recursive=True)  # -> Segments, Vertices

# ---- group: Set Cross Section
range = Range(Domain="20 to 80", Steps=10)
crosec = CrossSectionKaramba3D(FamilyNameOfCrossSection="DefaultCroSec", Diameter_cm=range, WallThickness_cm=0.4, mode="Circular Hollow")
item = ListItem(List=crosec, Index=0, Wrap=True)

# ---- group: Line To Beam
entwine = Entwine(Branch00=explode.Segments, Branch01=explode_2.Segments, FlattenInputs=True)
panel = Panel("""A
B""")
lineelem = CreateLinearElementKaramba3D(
    Line=entwine,
    Identifier=graft(panel),
    CrossSection=item,
    LimitDistance_m=0.005,
    BucklingLengthY_m=-1,
    BucklingLengthZ_m=-1,
    BucklingLengthLT_m=-1,
    Bending=True,
    ToPolylineMaxAngle=0.03,
    ToPolylineTolerance=0.01,
    ToPolylineMaxEdgeLength=0.25,
    New=True,
    Remove=True,
    mode="LineToBeam")  # -> Element, Points, Info

# ---- group: Define Supports
debrep = DeconstructBrep(Brep=planesrf)  # -> Faces, Edges, Vertices
supp = SupportKaramba3D(PosInd=debrep.Vertices, menu=[buttons(on, on, on, off, off, off)])

# ---- group: Define Loads
Z = UnitZ(Factor="-3")
loads = LoadsKaramba3D(Vector=Z, LCase="LC0", mode="Gravity")

# ---- group: Element Set
mkset = MakeElementSetKaramba3D(ElementIdentifiers=panel, SetIdentifier="Set A", MinimumSplitLength_m=0.001)

# ---- group: Assemble Model
assemble = AssembleModelKaramba3D(Elem=flatten(lineelem.Element), Support=supp, Load=loads, BeamSet=mkset, LimitDistance_m=0.005)  # -> Model, Info, Mass_kg, CentreOfGravity, LoadCaseNames

# ---- group: Cross Section Optimizer - ElementID
opticrosec = OptimizeCrossSectionKaramba3D(
    Model=assemble.Model,
    ElemIdentifiers="A",
    CrossSections=crosec,
    MaximumUtilization=1,
    MaximumVirtualWork_kNcm=0.01,
    NumberOfUtilizationIterations=5,
    NumberOfDisplacementIterations=5,
    NumberOfDisplacementIncrementsPerIteration=2,
    DisplacementTolerance=0.01,
    NumberOfSamplePoints=3,
    ElasticDesign=True,
    GammaM0=1,
    GammaM1=1.1,
    SwayFrame=True)  # -> OptimizedModel, Info, Mass_kg, MaximumDisplacement_cm, ElasticEnergyChange_kNm, MaximumUtilizationViewInsufficientCrossSections, MaximumDisplacementViewLimitCrossSections
mass = Panel(opticrosec.Mass_kg)
displacement = Panel(opticrosec.MaximumDisplacement_cm)

# ---- group: Cross Section Optimizer - GroupID
opticrosec_2 = OptimizeCrossSectionKaramba3D(
    Model=assemble.Model,
    GroupIdentifiers="A",
    CrossSections=crosec,
    MaximumUtilization=1,
    MaximumVirtualWork_kNcm=0.01,
    NumberOfUtilizationIterations=5,
    NumberOfDisplacementIterations=5,
    NumberOfDisplacementIncrementsPerIteration=2,
    DisplacementTolerance=0.01,
    NumberOfSamplePoints=3,
    ElasticDesign=True,
    GammaM0=1,
    GammaM1=1.1,
    SwayFrame=True)  # -> OptimizedModel, Info, Mass_kg, MaximumDisplacement_cm, ElasticEnergyChange_kNm, MaximumUtilizationViewInsufficientCrossSections, MaximumDisplacementViewLimitCrossSections
mass_2 = Panel(opticrosec_2.Mass_kg)
displacement_2 = Panel(opticrosec_2.MaximumDisplacement_cm)

# ---- group: Cross Section Optimizer - ElementID & GroupID
opticrosec_3 = OptimizeCrossSectionKaramba3D(
    Model=assemble.Model,
    ElemIdentifiers="A",
    GroupIdentifiers="A",
    CrossSections=crosec,
    MaximumUtilization=1,
    MaximumVirtualWork_kNcm=0.01,
    NumberOfUtilizationIterations=5,
    NumberOfDisplacementIterations=5,
    NumberOfDisplacementIncrementsPerIteration=2,
    DisplacementTolerance=0.01,
    NumberOfSamplePoints=3,
    ElasticDesign=True,
    GammaM0=1,
    GammaM1=1.1,
    SwayFrame=True)  # -> OptimizedModel, Info, Mass_kg, MaximumDisplacement_cm, ElasticEnergyChange_kNm, MaximumUtilizationViewInsufficientCrossSections, MaximumDisplacementViewLimitCrossSections
mass_3 = Panel(opticrosec_3.Mass_kg)
displacement_3 = Panel(opticrosec_3.MaximumDisplacement_cm)

# ---- group: Cross Section Optimizer for ElementSet
opticrosec_4 = OptimizeCrossSectionKaramba3D(
    Model=assemble.Model,
    GroupIdentifiers="Set A",
    CrossSections=crosec,
    MaximumUtilization=1,
    MaximumVirtualWork_kNcm=0.01,
    NumberOfUtilizationIterations=5,
    NumberOfDisplacementIterations=5,
    NumberOfDisplacementIncrementsPerIteration=2,
    DisplacementTolerance=0.01,
    NumberOfSamplePoints=3,
    ElasticDesign=True,
    GammaM0=1,
    GammaM1=1.1,
    SwayFrame=True)  # -> OptimizedModel, Info, Mass_kg, MaximumDisplacement_cm, ElasticEnergyChange_kNm, MaximumUtilizationViewInsufficientCrossSections, MaximumDisplacementViewLimitCrossSections
mass_4 = Panel(opticrosec_4.Mass_kg)
displacement_4 = Panel(opticrosec_4.MaximumDisplacement_cm)

# ---- group: CrossSection Optimizer
opticrosec_5 = OptimizeCrossSectionKaramba3D(
    Model=assemble.Model,
    CrossSections=crosec,
    MaximumUtilization=1,
    MaximumVirtualWork_kNcm=0.01,
    NumberOfUtilizationIterations=5,
    NumberOfDisplacementIterations=5,
    NumberOfDisplacementIncrementsPerIteration=2,
    DisplacementTolerance=0.01,
    NumberOfSamplePoints=3,
    ElasticDesign=True,
    GammaM0=1,
    GammaM1=1.1,
    SwayFrame=True)  # -> OptimizedModel, Info, Mass_kg, MaximumDisplacement_cm, ElasticEnergyChange_kNm, MaximumUtilizationViewInsufficientCrossSections, MaximumDisplacementViewLimitCrossSections
mass_5 = Panel(opticrosec_5.Mass_kg)
displacement_5 = Panel(opticrosec_5.MaximumDisplacement_cm)

# ---- group: Choose one of the different CrossSection Optimizers
list = ValueList({"Cross Section Optimizer": 0, "Cross Section Optimizer - ElementID": 1, "Cross Section Optimizer - GroupID": 2, "Cross Section Optimizer - ElementID & GroupID": 3, "Cross Section Optimizer - ElementSet": 4}, selected="Cross Section Optimizer - ElementID")

# ---- group: Selection of the CrossSection Optimizer
entwine_2 = Entwine(
    Branch00=opticrosec_5.OptimizedModel,
    Branch01=opticrosec.OptimizedModel,
    Branch02=opticrosec_2.OptimizedModel,
    Branch03=opticrosec_3.OptimizedModel,
    Branch04=opticrosec_4.OptimizedModel,
    FlattenInputs=True)
path = ConstructPath(Indices=list)
split = SplitTree(Data=simplify(entwine_2), Masks=flatten(path))  # -> Positive, Negative
model = ModelKaramba3D(split.Positive)

# ---- group: View Resul
modelview = ModelViewKaramba3D(Model=model)  # -> Model, DeformedMesh, DeformedAxes, DeformedModel, MaximumDeformation
beamview = BeamViewKaramba3D(Model=modelview.Model)  # -> Model, MeshesOfRenderedBeams, DeformedBeamAxes, LegendColours, LegendTags
legend = Legend(Colour=beamview.LegendColours, Tags=beamview.LegendTags, LegendType=1)
