# Grasshopper definition 01_HighRiseSystems.gh (Grasshopper 1.0.7)
# plug-ins: Karamba3D

# ---- group: Global Parameters
bays = Slider(6, range=2..8)
storeys = Slider(30, range=4..30)
bay_width = Panel("6")
storey_height = Panel("4")
# 01 - High Rise Systems
# Difficulty: Moderate | Version 3.1.4
# Shows the effect of different kinds of horizontal bracing systems. Feel free to alter the number of bays and storeys.
series = Series(Start=0, Step=bay_width, Count=bays)
series_2 = Series(Start=0, Step=storey_height, Count=storeys)
vec = VectorXYZ(XComponent=graft(series), YComponent=0, ZComponent=series_2)  # -> simplify(Vector), Length

# ---- group: Define Cross Sections
height = Panel("""30
20""")
width = Panel("""20
20""")
t = Panel("""2
2""")
crosec = CrossSectionKaramba3D(
    FamilyNameOfCrossSection="DefaultCroSec",
    Material=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,
    Height_cm=graft(height),
    UpperFlangeWidth_cm=graft(width),
    LowerFlangeWidth_cm=graft(width),
    UpperFlangeThickness_cm=graft(t),
    LowerFlangeThickness_cm=graft(t),
    SidewallsThickness_cm=graft(t),
    FilletRadius_cm=0.6,
    mode="Box")

height_2 = Panel("""30
20
15""")
width_2 = Panel("""20
20
15""")
t_2 = Panel("""2
2
3""")
crosec_2 = CrossSectionKaramba3D(
    FamilyNameOfCrossSection="DefaultCroSec",
    Material=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,
    Height_cm=graft(height_2),
    UpperFlangeWidth_cm=graft(width_2),
    LowerFlangeWidth_cm=graft(width_2),
    UpperFlangeThickness_cm=graft(t_2),
    LowerFlangeThickness_cm=graft(t_2),
    SidewallsThickness_cm=graft(t_2),
    FilletRadius_cm=0.6,
    mode="Box")

height_3 = Panel("""30
20
15""")
width_3 = Panel("""20
20
15""")
t_3 = Panel("""2
2
3""")
crosec_3 = CrossSectionKaramba3D(
    FamilyNameOfCrossSection="DefaultCroSec",
    Material=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,
    Height_cm=graft(height_3),
    UpperFlangeWidth_cm=graft(width_3),
    LowerFlangeWidth_cm=graft(width_3),
    UpperFlangeThickness_cm=graft(t_3),
    LowerFlangeThickness_cm=graft(t_3),
    SidewallsThickness_cm=graft(t_3),
    FilletRadius_cm=0.6,
    mode="Box")

height_4 = Panel("""30
20
15
20""")
width_4 = Panel("""20
20
15
20""")
t_4 = Panel("""2
2
3
3""")
crosec_4 = CrossSectionKaramba3D(
    FamilyNameOfCrossSection="DefaultCroSec",
    Material=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,
    Height_cm=graft(height_4),
    UpperFlangeWidth_cm=graft(width_4),
    LowerFlangeWidth_cm=graft(width_4),
    UpperFlangeThickness_cm=graft(t_4),
    LowerFlangeThickness_cm=graft(t_4),
    SidewallsThickness_cm=graft(t_4),
    FilletRadius_cm=0.6,
    mode="Box")

# ---- group: Create Geometry
vec_2 = Vector(vec.Vector)
move = Move(Geometry=vec_2, Translation="90,0,0")  # -> Geometry, Transform
series_3 = Series(Start=-1, Step=-3, Count=3)
vec_3 = Vector("90,0,0")
vec_4 = Vector(Vector(0, 0, -5))
flip = FlipMatrix(Data=move.Geometry)
addition = Addition(A=vec_3, B=vec_4)
Z = UnitZ(Factor=series_3)
pline = PolyLine(Vertices=move.Geometry, Closed=False)
pline_2 = PolyLine(Vertices=flip, Closed=False)
move_2 = Move(Geometry=addition, Motion=Z)  # -> Geometry, Transform
explode = Explode(Curve=pline, Recursive=True)  # -> flatten(Segments), Vertices
explode_2 = Explode(Curve=pline_2, Recursive=True)  # -> flatten(Segments), Vertices
xz = XZPlane(Origin=move_2.Geometry)
path_mapper = PathMapper(explode_2.Segments, source="{A}", target="{1}")
path_mapper_2 = PathMapper(explode.Segments, source="{A}", target="{0}")

# ---- group: Define Elements
lng = ListLength(List=[path_mapper_2, path_mapper])  # -> flatten(Length)
item = ListItem(List=lng, Index=0, Wrap=True)
series_4 = Series(Start=flatten(["0", item]), Step=1, Count=lng)  # -> simplify(Series)
int = Integer(series_4)
concat = Concatenate(FragmentA="E", FragmentB=int)
lineelem = CreateLinearElementKaramba3D(
    Line=[path_mapper_2, path_mapper],
    Identifier=concat,
    CrossSection=crosec,
    LimitDistance_m=0.005,
    BucklingLengthY_m=-1,
    BucklingLengthZ_m=-1,
    BucklingLengthLT_m=-1,
    Bending=True,
    ToPolylineMaxAngle=0.03,
    ToPolylineTolerance=0.01,
    ToPolylineMaxEdgeLength=0.25,
    New=True,
    Remove=True,
    mode="LineToBeam")  # -> Element, Points, Info

# ---- group: Define Loads
item_2 = ListItem(List=flip, Index=0, Wrap=True)  # -> flatten(Item)
vec_5 = VectorXYZ(XComponent="100", YComponent=0, ZComponent=0)  # -> Vector, Length
lng_2 = ListLength(List=item_2)
division = Division(A=vec_5.Vector, B=lng_2)
loads = LoadsKaramba3D(ForceVector=division, Local=False, PosInd=item_2, LCase="LC0", mode="Point")
loads_2 = LoadsKaramba3D(Vector="0,0,-2", LCase="LC0", mode="Gravity")
load = LoadKaramba3D([loads, loads_2])

# ---- group: Define Supports
item_3 = ListItem(List=move.Geometry, Index=0, Wrap=True)  # -> flatten(Item)
supp = SupportKaramba3D(PosInd=item_3, menu=[buttons(on, on, on, on, on, off)])

# ---- group: Assemble Model
assemble = AssembleModelKaramba3D(Elem=flatten(lineelem.Element), Support=supp, Load=load, LimitDistance_m=0.005)  # -> Model, Info, Mass_kg, CentreOfGravity, LoadCaseNames
panel = Panel(assemble.Mass_kg)

# ---- group: Analyze Model
analyse = AnalyseKaramba3D(Model=assemble.Model)  # -> AnalysedModel, MaximumDisplacement_cm, ResultingForce_kN, ChangeOfElasticEnergy_kNm
panel_2 = Panel(analyse.MaximumDisplacement_cm)

# ---- group: Create Geometry (continued)
num = Number(flatten(analyse.MaximumDisplacement_cm))
num_2 = Number(flatten(assemble.Mass_kg))
expression = Expression(x=num, Expression="Format(\"Displacement = {0} cm\", Int(x))")
expression_2 = Expression(x=num_2, Expression="Format(\"Mass = {0} t\", Round(x/1000,2))")
tag = TextTag3D(Location=graft(xz), Text=graft(["Frame", expression, expression_2]), Size=1.6, Justification=7)

# ---- group: View Results
modelview = ModelViewKaramba3D(Model=analyse.AnalysedModel)  # -> Model, DeformedMesh, DeformedAxes, DeformedModel, MaximumDeformation
beamview = BeamViewKaramba3D(Model=modelview.Model)  # -> Model, MeshesOfRenderedBeams, DeformedBeamAxes, LegendColours, LegendTags
legend = Legend(Colour=beamview.LegendColours, Tags=beamview.LegendTags, LegendType=1)

# ---- group: Create Geometry
num_3 = Number(storeys)
vec_6 = Vector(vec.Vector)
larger = LargerThan(FirstNumber=num_3, SecondNumber="7")  # -> LargerThan, OrEqualTo
filter = StreamFilter(Gate=larger.LargerThan, Stream0="1", Stream1="3")
division_2 = Division(A=num_3, B=4)
move_3 = Move(Geometry=vec_6, Translation="-50,0,0")  # -> Geometry, Transform
lng_3 = ListLength(List=vec_6)
series_5 = Series(Start=division_2, Step=division_2, Count=filter)
series_6 = Series(Start=-1, Step=-3, Count=3)
vec_7 = Vector("-50,0,0")
vec_8 = Vector(Vector(0, 0, -5))
lng_4 = ListLength(List=flatten(lng_3))
expression_3 = Expression(x=series_5, Expression="Floor(x)")
addition_2 = Addition(A=vec_7, B=vec_8)
Z_2 = UnitZ(Factor=series_6)
flip_2 = FlipMatrix(Data=move_3.Geometry)
eval = Evaluate(F="Floor(x/2-1)", x=lng_4)
addition_3 = Addition(A=expression_3, B=1)
move_4 = Move(Geometry=addition_2, Motion=Z_2)  # -> Geometry, Transform
pline_3 = PolyLine(Vertices=move_3.Geometry, Closed=False)
pline_4 = PolyLine(Vertices=flip_2, Closed=False)
addition_4 = Addition(A=eval, B=1)
item_4 = ListItem(List=move_3.Geometry, Index=expression_3, Wrap=True)
item_5 = ListItem(List=move_3.Geometry, Index=addition_3, Wrap=True)
explode_3 = Explode(Curve=pline_3, Recursive=True)  # -> flatten(Segments), Vertices
explode_4 = Explode(Curve=pline_4, Recursive=True)  # -> flatten(Segments), Vertices
branch = TreeBranch(Tree=move_3.Geometry, Path=eval, MaintainPaths=False)
branch_2 = TreeBranch(Tree=move_3.Geometry, Path=addition_4, MaintainPaths=False)
flip_3 = FlipMatrix(Data=item_4)
flip_4 = FlipMatrix(Data=item_5)
xz_2 = XZPlane(Origin=move_4.Geometry)
cull = CullPattern(List=branch, CullPattern=[False, True])
cull_2 = CullPattern(List=branch_2, CullPattern=[True, False])
weave = Weave(Pattern=[0, 1], Stream0=cull_2, Stream1=cull, NullGaps=False)
pline_5 = PolyLine(Vertices=weave, Closed=False)
explode_5 = Explode(Curve=pline_5, Recursive=True)  # -> flatten(Segments), Vertices
path_mapper_3 = PathMapper(explode_4.Segments, source="{A}", target="{1}")
path_mapper_4 = PathMapper(explode_5.Segments, source="{A}", target="{2}")
path_mapper_5 = PathMapper(explode_3.Segments, source="{A}", target="{0}")

# ----
merge = Merge(Data1=flip_3, Data2=flip_4)

# ---- group: Define Loads
item_6 = ListItem(List=flip_2, Index=0, Wrap=True)  # -> flatten(Item)
vec_9 = VectorXYZ(XComponent="100", YComponent=0, ZComponent=0)  # -> Vector, Length
lng_5 = ListLength(List=item_6)
division_3 = Division(A=vec_9.Vector, B=lng_5)
loads_3 = LoadsKaramba3D(ForceVector=division_3, Local=False, PosInd=item_6, LCase="LC0", mode="Point")
loads_4 = LoadsKaramba3D(Vector="0,0,-2", LCase="LC0", mode="Gravity")
load_2 = LoadKaramba3D([loads_3, loads_4])

# ---- group: Define Supports
pt = Point(move_3.Geometry)
cull_i = CullIndex(List=pt, Indices="0", Wrap=True)  # -> flatten(List)
item_7 = ListItem(List=pt, Index="0", Wrap=True)  # -> flatten(Item)
supp_2 = SupportKaramba3D(PosInd=item_7, menu=[buttons(on, on, on, on, on, off)])
supp_3 = SupportKaramba3D(PosInd=cull_i, menu=[buttons(off, on, off, off, off, off)])

# ---- group: Create Geometry
vec_10 = Vector(vec.Vector)
num_4 = Number(bays)
num_5 = Number(storeys)
series_7 = Series(Start=expr("x-1", num_4), Step=-1, Count=num_4)
series_8 = Series(Start=0, Step=1, Count=num_4)
series_9 = Series(Start=series_7, Step=expr("x-1", num_4), Count=num_5)  # -> simplify(Series)
series_10 = Series(Start=series_8, Step=expr("x-1", num_4), Count=num_5)  # -> simplify(Series)
move_5 = Move(Geometry=vec_10, Translation="-120,0,0")  # -> Geometry, Transform
flip_5 = FlipMatrix(Data=move_5.Geometry)
item_8 = ListItem(List=move_5.Geometry, Index=series_10, Wrap=False)
item_9 = ListItem(List=move_5.Geometry, Index=series_9, Wrap=False)
vec_11 = Vector(Vector(0, 0, -5))
series_11 = Series(Start=-1, Step=-3, Count=3)
vec_12 = Vector("-120,0,0")
pline_6 = PolyLine(Vertices=move_5.Geometry, Closed=False)
pline_7 = PolyLine(Vertices=flip_5, Closed=False)
flip_6 = FlipMatrix(Data=item_8)
flip_7 = FlipMatrix(Data=item_9)
addition_5 = Addition(A=vec_12, B=vec_11)
Z_3 = UnitZ(Factor=series_11)
move_6 = Move(Geometry=addition_5, Motion=Z_3)  # -> Geometry, Transform
explode_6 = Explode(Curve=pline_6, Recursive=True)  # -> flatten(Segments), Vertices
explode_7 = Explode(Curve=pline_7, Recursive=True)  # -> flatten(Segments), Vertices
clean = CleanTree(RemoveNulls=True, RemoveInvalid=True, RemoveEmpty=True, Tree=flip_6)
clean_2 = CleanTree(RemoveNulls=True, RemoveInvalid=True, RemoveEmpty=True, Tree=flip_7)
xz_3 = XZPlane(Origin=move_6.Geometry)
pline_8 = PolyLine(Vertices=clean, Closed=False)
pline_9 = PolyLine(Vertices=clean_2, Closed=False)
clean_3 = CleanTree(Data=[pline_8, pline_9], CleanInvalid=True, CleanEmpty=True)
explode_8 = Explode(Curve=clean_3, Recursive=True)  # -> flatten(Segments), Vertices
path_mapper_6 = PathMapper(explode_6.Segments, source="{A}", target="{0}")
path_mapper_7 = PathMapper(explode_7.Segments, source="{A}", target="{1}")
path_mapper_8 = PathMapper(explode_8.Segments, source="{A}", target="{2}")

# ---- group: Define Elements
lng_6 = ListLength(List=[path_mapper_6, path_mapper_7, path_mapper_8])  # -> flatten(Length)
item_10 = ListItem(List=lng_6, Index=0, Wrap=True)
series_12 = Series(Start=flatten(["0", item_10]), Step=1, Count=lng_6)  # -> simplify(Series)
int_2 = Integer(series_12)
concat_2 = Concatenate(FragmentA="E", FragmentB=int_2)
members = Panel("""col
slab
bracing""")
lineelem_2 = CreateLinearElementKaramba3D(
    Line=[path_mapper_6, path_mapper_7, path_mapper_8],
    Identifier=concat_2,
    CrossSection=crosec_2,
    LimitDistance_m=0.005,
    BucklingLengthY_m=-1,
    BucklingLengthZ_m=-1,
    BucklingLengthLT_m=-1,
    Bending=False,
    ToPolylineMaxAngle=0.03,
    ToPolylineTolerance=0.01,
    ToPolylineMaxEdgeLength=0.25,
    New=True,
    Remove=True,
    mode="LineToTruss")  # -> Element, Points, Info

# ---- group: Define Loads
item_11 = ListItem(List=flip_5, Index=0, Wrap=True)  # -> flatten(Item)
vec_13 = VectorXYZ(XComponent="100", YComponent=0, ZComponent=0)  # -> Vector, Length
lng_7 = ListLength(List=item_11)
division_4 = Division(A=vec_13.Vector, B=lng_7)
loads_5 = LoadsKaramba3D(ForceVector=division_4, Local=False, PosInd=item_11, LCase="LC0", mode="Point")
loads_6 = LoadsKaramba3D(Vector="0,0,-2", LCase="LC0", mode="Gravity")
load_3 = LoadKaramba3D([loads_6, loads_5])

# ---- group: Define Supports
pt_2 = Point(move_5.Geometry)
cull_i_2 = CullIndex(List=pt_2, Indices="0", Wrap=True)  # -> flatten(List)
item_12 = ListItem(List=pt_2, Index="0", Wrap=True)  # -> flatten(Item)
supp_4 = SupportKaramba3D(PosInd=item_12, menu=[buttons(on, on, on, on, on, off)])
supp_5 = SupportKaramba3D(PosInd=cull_i_2, menu=[buttons(off, on, off, off, off, off)])

# ---- group: Assemble Model
assemble_2 = AssembleModelKaramba3D(Elem=flatten(lineelem_2.Element), Support=flatten([supp_4, supp_5]), Load=flatten(load_3), LimitDistance_m=0.005)  # -> Model, Info, Mass_kg, CentreOfGravity, LoadCaseNames
panel_3 = Panel(assemble_2.Mass_kg)

# ---- group: Analyze Model
analyse_2 = AnalyseKaramba3D(Model=assemble_2.Model)  # -> AnalysedModel, MaximumDisplacement_cm, ResultingForce_kN, ChangeOfElasticEnergy_kNm
panel_4 = Panel(analyse_2.MaximumDisplacement_cm)

# ---- group: Create Geometry (continued)
num_6 = Number(flatten(assemble_2.Mass_kg))
num_7 = Number(flatten(analyse_2.MaximumDisplacement_cm))
expression_4 = Expression(x=num_7, Expression="Format(\"Displacement = {0} cm\", Int(x))")
expression_5 = Expression(x=num_6, Expression="Format(\"Mass = {0} t\", Round(x/1000,2))")
tag_2 = TextTag3D(Location=graft(xz_3), Text=graft(["Crossbracing", expression_4, expression_5]), Size=1.6, Justification=7)

# ---- group: View Results
modelview_2 = ModelViewKaramba3D(Model=analyse_2.AnalysedModel)  # -> Model, DeformedMesh, DeformedAxes, DeformedModel, MaximumDeformation
beamview_2 = BeamViewKaramba3D(Model=modelview_2.Model)  # -> Model, MeshesOfRenderedBeams, DeformedBeamAxes, LegendColours, LegendTags
legend_2 = Legend(Colour=beamview_2.LegendColours, Tags=beamview_2.LegendTags, LegendType=1)

# ---- group: Create Geometry
vec_14 = Vector(vec.Vector)
move_7 = Move(Geometry=vec_14, Translation="20,0,0")  # -> Geometry, Transform
lng_8 = ListLength(List=vec_14)
series_13 = Series(Start=-1, Step=-3, Count=3)
vec_15 = Vector("20,0,0")
vec_16 = Vector(Vector(0, 0, -5))
lng_9 = ListLength(List=flatten(lng_8))
flip_8 = FlipMatrix(Data=move_7.Geometry)
Z_4 = UnitZ(Factor=series_13)
addition_6 = Addition(A=vec_15, B=vec_16)
eval_2 = Evaluate(F="Floor(x/2-1)", x=lng_9)
move_8 = Move(Geometry=addition_6, Motion=Z_4)  # -> Geometry, Transform
pline_10 = PolyLine(Vertices=move_7.Geometry, Closed=False)
pline_11 = PolyLine(Vertices=flip_8, Closed=False)
addition_7 = Addition(A=eval_2, B=1)
explode_9 = Explode(Curve=pline_10, Recursive=True)  # -> flatten(Segments), Vertices
explode_10 = Explode(Curve=pline_11, Recursive=True)  # -> flatten(Segments), Vertices
branch_3 = TreeBranch(Tree=move_7.Geometry, Path=eval_2, MaintainPaths=False)
branch_4 = TreeBranch(Tree=move_7.Geometry, Path=addition_7, MaintainPaths=False)
xz_4 = XZPlane(Origin=move_8.Geometry)
cull_3 = CullPattern(List=branch_3, CullPattern=[False, True])
cull_4 = CullPattern(List=branch_4, CullPattern=[True, False])
weave_2 = Weave(Pattern=[1, 0], Stream0=cull_3, Stream1=cull_4, NullGaps=False)
pline_12 = PolyLine(Vertices=weave_2, Closed=False)
explode_11 = Explode(Curve=pline_12, Recursive=True)  # -> flatten(Segments), Vertices
path_mapper_9 = PathMapper(explode_9.Segments, source="{A}", target="{0}")
path_mapper_10 = PathMapper(explode_10.Segments, source="{A}", target="{1}")
path_mapper_11 = PathMapper(explode_11.Segments, source="{A}", target="{2}")

# ---- group: Define Elements
lng_10 = ListLength(List=[path_mapper_9, path_mapper_10, path_mapper_11])  # -> flatten(Length)
item_13 = ListItem(List=lng_10, Index=0, Wrap=True)
series_14 = Series(Start=flatten(["0", item_13]), Step=1, Count=lng_10)  # -> simplify(Series)
int_3 = Integer(series_14)
concat_3 = Concatenate(FragmentA="E", FragmentB=int_3)
lineelem_3 = CreateLinearElementKaramba3D(
    Line=[path_mapper_9, path_mapper_10, path_mapper_11],
    Identifier=concat_3,
    CrossSection=crosec_3,
    LimitDistance_m=0.005,
    BucklingLengthY_m=-1,
    BucklingLengthZ_m=-1,
    BucklingLengthLT_m=-1,
    Bending=False,
    ToPolylineMaxAngle=0.03,
    ToPolylineTolerance=0.01,
    ToPolylineMaxEdgeLength=0.25,
    New=True,
    Remove=True,
    mode="LineToTruss")  # -> Element, Points, Info

# ---- group: Define Loads
item_14 = ListItem(List=flip_8, Index=0, Wrap=True)  # -> flatten(Item)
vec_17 = VectorXYZ(XComponent="100", YComponent=0, ZComponent=0)  # -> Vector, Length
lng_11 = ListLength(List=item_14)
division_5 = Division(A=vec_17.Vector, B=lng_11)
loads_7 = LoadsKaramba3D(ForceVector=division_5, Local=False, PosInd=item_14, LCase="LC0", mode="Point")
loads_8 = LoadsKaramba3D(Vector="0,0,-2", LCase="LC0", mode="Gravity")
load_4 = LoadKaramba3D([loads_7, loads_8])

# ---- group: Define Supports
pt_3 = Point(move_7.Geometry)
cull_i_3 = CullIndex(List=pt_3, Indices="0", Wrap=True)  # -> flatten(List)
item_15 = ListItem(List=pt_3, Index="0", Wrap=True)  # -> flatten(Item)
supp_6 = SupportKaramba3D(PosInd=item_15, menu=[buttons(on, on, on, on, on, off)])
supp_7 = SupportKaramba3D(PosInd=cull_i_3, menu=[buttons(off, on, off, off, off, off)])

# ---- group: Assemble Model
assemble_3 = AssembleModelKaramba3D(Elem=flatten(lineelem_3.Element), Support=flatten([supp_6, supp_7]), Load=flatten(load_4), LimitDistance_m=0.005)  # -> Model, Info, Mass_kg, CentreOfGravity, LoadCaseNames
panel_5 = Panel(assemble_3.Mass_kg)

# ---- group: Analyze Model
analyse_3 = AnalyseKaramba3D(Model=assemble_3.Model)  # -> AnalysedModel, MaximumDisplacement_cm, ResultingForce_kN, ChangeOfElasticEnergy_kNm
panel_6 = Panel(analyse_3.MaximumDisplacement_cm)

# ---- group: Create Geometry (continued)
num_8 = Number(flatten(analyse_3.MaximumDisplacement_cm))
num_9 = Number(flatten(assemble_3.Mass_kg))
expression_6 = Expression(x=num_8, Expression="Format(\"Displacement = {0} cm\", Int(x))")
expression_7 = Expression(x=num_9, Expression="Format(\"Mass = {0} t\", Round(x/1000,2))")
tag_3 = TextTag3D(Location=graft(xz_4), Text=graft(["Core", expression_6, expression_7]), Size=1.6, Justification=7)

# ---- group: View Results
modelview_3 = ModelViewKaramba3D(Model=analyse_3.AnalysedModel)  # -> Model, DeformedMesh, DeformedAxes, DeformedModel, MaximumDeformation
beamview_3 = BeamViewKaramba3D(Model=modelview_3.Model)  # -> Model, MeshesOfRenderedBeams, DeformedBeamAxes, LegendColours, LegendTags
legend_3 = Legend(Colour=beamview_3.LegendColours, Tags=beamview_3.LegendTags, LegendType=1)

# ---- group: Create Geometry (continued)
prox = Proximity3D(Points=merge, Group=4, MinRadius=7, MaxRadius=8)  # -> Links, Topology
rdlines = RemoveDuplicateLinesKaramba3D(Line=flatten(prox.Links), LimitDistance=0.005)  # -> flatten(OutLine), Info, Indexes
path_mapper_12 = PathMapper(rdlines.OutLine, source="{A}", target="{3}")

# ---- group: Define Elements
lng_12 = ListLength(List=[path_mapper_5, path_mapper_3, path_mapper_4, path_mapper_12])  # -> flatten(Length)
item_16 = ListItem(List=lng_12, Index=0, Wrap=True)
series_15 = Series(Start=flatten(["0", item_16]), Step=1, Count=lng_12)  # -> simplify(Series)
int_4 = Integer(series_15)
concat_4 = Concatenate(FragmentA="E", FragmentB=int_4)
members_2 = Panel("""col
slab
core
outr""")
lineelem_4 = CreateLinearElementKaramba3D(
    Line=[path_mapper_5, path_mapper_3, path_mapper_4, path_mapper_12],
    Identifier=concat_4,
    CrossSection=crosec_4,
    LimitDistance_m=0.005,
    BucklingLengthY_m=-1,
    BucklingLengthZ_m=-1,
    BucklingLengthLT_m=-1,
    Bending=False,
    ToPolylineMaxAngle=0.03,
    ToPolylineTolerance=0.01,
    ToPolylineMaxEdgeLength=0.25,
    New=True,
    Remove=True,
    mode="LineToTruss")  # -> Element, Points, Info

# ---- group: Assemble Model
assemble_4 = AssembleModelKaramba3D(Elem=flatten(lineelem_4.Element), Support=flatten([supp_2, supp_3]), Load=flatten(load_2), LimitDistance_m=0.005)  # -> Model, Info, Mass_kg, CentreOfGravity, LoadCaseNames
panel_7 = Panel(assemble_4.Mass_kg)

# ---- group: Analyze Model
analyse_4 = AnalyseKaramba3D(Model=assemble_4.Model)  # -> AnalysedModel, MaximumDisplacement_cm, ResultingForce_kN, ChangeOfElasticEnergy_kNm
panel_8 = Panel(analyse_4.MaximumDisplacement_cm)

# ---- group: Create Geometry (continued)
num_10 = Number(flatten(analyse_4.MaximumDisplacement_cm))
num_11 = Number(flatten(assemble_4.Mass_kg))
expression_8 = Expression(x=num_10, Expression="Format(\"Displacement = {0} cm\", Int(x))")
expression_9 = Expression(x=num_11, Expression="Format(\"Mass = {0} t\", Round(x/1000,2))")
tag_4 = TextTag3D(Location=graft(xz_2), Text=graft(["Core + Outrigger", expression_8, expression_9]), Size=1.6, Justification=7)

# ---- group: View Results
modelview_4 = ModelViewKaramba3D(Model=analyse_4.AnalysedModel)  # -> Model, DeformedMesh, DeformedAxes, DeformedModel, MaximumDeformation
beamview_4 = BeamViewKaramba3D(Model=modelview_4.Model)  # -> Model, MeshesOfRenderedBeams, DeformedBeamAxes, LegendColours, LegendTags
legend_4 = Legend(Colour=beamview_4.LegendColours, Tags=beamview_4.LegendTags, LegendType=1)
