# Grasshopper definition 01_HorizontalTrussFacadeSystem.gh (Grasshopper 1.0.8)
# plug-ins: Karamba3D

# ---- group: Define GEOMETRY INPUTS
span_m = Slider(9, range=4..20)
height_at_supports_m = Slider(12, range=4..35)
angle_deg = Slider(0, range=-45..45)
truss_depth_m = Slider(2, range=0..5)
height_divisions = ValueList({"1", "2", "3", "4", "5", "6", "7", "8", "9", "10"}, selected="4")
mullion_divisions = ValueList({"1", "2", "3", "4", "5", "6", "7", "8", "9", "10"}, selected="6")
xy = XYPlane(Origin=Point(0, 0, 0))
Y = UnitY(Factor=1)
rot3d = Rotate3D(Geometry=xy, Angle=degrees(angle_deg), Center=xy, Axis=Y)  # -> Geometry, Transform
height_at_supports_m_2 = Number(height_at_supports_m)
# 01 - Horizontal Truss Facade System
# Difficulty: Hard | Version 3.1.6
# A simple and regular steel facade structure which uses horizontal trusses to span the horizontal direction and support mullions.
# Gravity and wind pressure loads are generated and applied using mesh loading and allow the engineer to study facade segmentation and geometry versus structural performance.
span_at_supports_m = Number(span_m)
mullion_divisions_2 = Number(mullion_divisions)
height_divisions_2 = Number(height_divisions)
truss_depth_m_2 = Number(truss_depth_m)
base_plane = Plane(rot3d.Geometry)

# ---- group: Define LOADING INPUTS
glazing_load_kn_m2 = Slider(0.5, range=0..1)
wind_load_kn_m2 = Slider(1, range=-1.5..1.5)
glazing_load_kn_m2_2 = Number(glazing_load_kn_m2)
wind_load_kn_m2_2 = Number(wind_load_kn_m2)

# ---- group: Initial Geometry Setup
span_at_supports_m_2 = Number(span_at_supports_m)
height_at_supports_m_3 = Number(height_at_supports_m_2)
xy_2 = XYPlane(Origin=Point(0, 0, 0))
base_plane_2 = Plane(base_plane)
deplane = DeconstructPlane(Plane=xy_2)  # -> Origin, XAxis, YAxis, ZAxis
amp = Amplitude(Vector=deplane.YAxis, Amplitude=span_at_supports_m_2)
amp_2 = Amplitude(Vector=deplane.ZAxis, Amplitude=height_at_supports_m_3)
move = Move(Geometry=deplane.Origin, Motion=amp)  # -> Geometry, Transform
base_plane_3 = Plane(base_plane)
merge = Merge(Data1=deplane.Origin, Data2=move.Geometry)  # -> flatten(Result)
deplane_2 = DeconstructPlane(Plane=base_plane_3)  # -> Origin, XAxis, YAxis, ZAxis
pl = ConstructPlane(Origin=deplane_2.Origin, XAxis=deplane_2.YAxis, YAxis=deplane_2.ZAxis)
move_2 = Move(Geometry=merge, Motion=amp_2)  # -> Geometry, Transform
X = UnitX(Factor=1)
projecta = ProjectAlong(Geometry=move_2.Geometry, Plane=pl, Direction=X)  # -> Geometry, Transform
bottom_points = Point(merge)
top_points = Point(projecta.Geometry)

# ---- group: Setup division points
bottom_points_2 = Point(bottom_points)
top_points_2 = Point(top_points)
ln = Line(StartPoint=bottom_points_2, EndPoint=top_points_2)
height_divisions_3 = Number(height_divisions_2)
graft = GraftTree(Tree=ln, IncludeEmptyLists=True, IncludeNullItems=True)
divide = DivideCurve(Curve=graft, Count=height_divisions_3, Kinks=False)  # -> simplify(Points), simplify(Tangents), Parameters
main_division_points = Point(divide.Points)

# ---- group: Setup horizontal reference geometry
main_division_points_2 = Point(graft(main_division_points))
relitem2 = RelativeItems(TreeA=main_division_points_2, TreeB=main_division_points_2, Offset="{1;0}", WrapPaths=False, WrapItems=False)  # -> ItemA, ItemB
ln_2 = Line(StartPoint=relitem2.ItemA, EndPoint=relitem2.ItemB)
horizontal_elements = Curve(ln_2)

# ---- group: Preparation of MESHES for loading
horizontal_elements_2 = Curve(horizontal_elements)
yz = YZPlane(Origin=Point(0, 0, 0))
base_plane_4 = Plane(base_plane)
mesh_loading_density = ValueList({"0.10m": 0.10, "0.25m": 0.25, "0.50m": 0.50, "0.75m": 0.75, "1.00m": 1.00, "1.50m": 1.50}, selected="0.10m")
bbox = BoundingBox(Content=flatten(horizontal_elements_2), Plane=PlaneXY(0, 0, 0), UnionBox=True)  # -> Box, Box_2
mesh_uv = MeshSurface(Surface=bbox.Box, UCount=1, VCount=1, Overhang=True, Equalize=False)
cluster = Cluster(zonemeshes=mesh_uv, meshtargetsize=mesh_loading_density)
deplane_3 = DeconstructPlane(Plane=base_plane_4)  # -> Origin, XAxis, YAxis, ZAxis
pl_2 = ConstructPlane(Origin=deplane_3.Origin, XAxis=deplane_3.YAxis, YAxis=deplane_3.ZAxis)
X_2 = UnitX(Factor=1)
loadingmesh = Mesh(cluster)
projecta_2 = ProjectAlong(Geometry=loadingmesh, Plane=pl_2, Direction=X_2)  # -> Geometry, Transform
alignedloadingmesh = Mesh(projecta_2.Geometry)

# ---- group: Generate truss surfaces
truss_depth_m_3 = Number(truss_depth_m_2)
base_plane_5 = Plane(base_plane)
horizontal_elements_3 = Curve(horizontal_elements)
deplane_4 = DeconstructPlane(Plane=base_plane_5)  # -> Origin, XAxis, YAxis, ZAxis
division = Division(A=truss_depth_m_3, B=2)
end = EndPoints(Curve=horizontal_elements_3)  # -> Start, End
midpt = CurveMiddle(Curve=horizontal_elements_3)
amp_3 = Amplitude(Vector=deplane_4.XAxis, Amplitude=division)
move_3 = Move(Geometry=midpt, Motion=amp_3)  # -> Geometry, Transform
arc = Arc3Pt(PointA=end.Start, PointB=move_3.Geometry, PointC=end.End)  # -> Arc, Plane, Radius
merge_2 = Merge(Data1=horizontal_elements_3, Data2=arc.Arc)
loft = Loft(Curves=merge_2, Options={Adjust=False, Closed=False, LoftEnds=0, LoftSimp=0, LoftType=0, Rebuild=10, Refit=0.01})
truss_surfaces = Surface(loft)

# ---- group: Generate Axis
list = ValueList({"Pratt Truss": 1, "Warren Truss": 2, "Warren Truss with verticals": 3, "K-Truss": 4, "Diamond": 5, "Diamond Straight": 6, "Vierendeel Truss": 7}, selected="Warren Truss")
truss_surfaces_2 = Surface(truss_surfaces)
mullion_divisions_3 = Number(mullion_divisions_2)
surf2truss = SurfaceToTrussKaramba3D(
    Surface=reparameterize(truss_surfaces_2),
    TrussType=list,
    NumberOfSubdivisions=mullion_divisions_3,
    FlipUDirection=False,
    FlipVDirection=False,
    SwapUVDirections=Toggle(True),
    RelaxAngles=False,
    TargetPostDirection=Vector(0, 0, 0),
    MaximumRelaxationIterations=30,
    LengthTolerance=0.0001,
    DampingFactor=0.8)  # -> Info, simplify(Lines), YOrientations, ZOrientations, SpecificEnergy
split = SplitTree(Data=surf2truss.Lines, Masks=flatten("{*;0}"))  # -> Positive, Negative
split_2 = SplitTree(Data=surf2truss.Lines, Masks=flatten("{*;2,3}"))  # -> Positive, Negative
split_3 = SplitTree(Data=surf2truss.Lines, Masks=flatten("{*;1}"))  # -> Positive, Negative
join = JoinCurves(Curves=split.Positive, Preserve=False)
join_2 = JoinCurves(Curves=split_3.Positive, Preserve=False)
explode = Explode(Curve=join_2, Recursive=True)  # -> Segments, Vertices
flip = FlipMatrix(Data=explode.Vertices)
pline = PolyLine(Vertices=flip, Closed=False)
explode_2 = Explode(Curve=pline, Recursive=True)  # -> Segments, Vertices
end_2 = EndPoints(Curve=pline)  # -> flatten(Start), End
panel = Panel("""-1
0""")
cull_i = CullIndex(List=end_2.Start, Indices=panel, Wrap=True)
support_points_bottom = Point(cull_i)
front_chord = Curve(join_2)
back_chord = Curve(join)
end_3 = EndPoints(Curve=back_chord)  # -> Start, End
support_points_truss = Point(simplify([end_3.Start, end_3.End]))
diagonals = Curve(split_2.Positive)
mullions = Curve(explode_2.Segments)

# ---- group: Define Materials
matselect = MaterialSelectionKaramba3D(Colour=ColourSwatch(SwatchColor=RGB(51, 46, 191)), menu=[dropdown(1), dropdown(1), dropdown(4)])
mat_steel = MaterialKaramba3D(matselect)

# ---- group: Define Cross Sections
mat_steel_2 = MaterialKaramba3D(mat_steel)
crosecrselect = CrossSectionRangeSelectorKaramba3D(
    MaximumHeight_cm=-1,
    MaximumWidth_cm=-1,
    Material=mat_steel_2,
    menu=[dropdown(1), dropdown(2), dropdown(1), dropdown(42)])
crosecrselect_2 = CrossSectionRangeSelectorKaramba3D(
    MaximumHeight_cm=-1,
    MaximumWidth_cm=-1,
    Material=mat_steel_2,
    menu=[dropdown(1), dropdown(3), dropdown(1), dropdown(23)])
crosecrselect_3 = CrossSectionRangeSelectorKaramba3D(
    MaximumHeight_cm=-1,
    MaximumWidth_cm=-1,
    Material=mat_steel_2,
    menu=[dropdown(1), dropdown(2), dropdown(1), dropdown(35)])
entwine = Entwine(Branch00=crosecrselect, Branch01=crosecrselect, Branch02=crosecrselect_3, FlattenInputs=True)

# ---- group: Define Load Combinations
panel_2 = Panel("""G = SW + SDL
SLS.G = G
SLS.W = G + WL
ULS.G = 1.35*G
ULS.W = 1.35*G + 1.5*WL
ULS.all = ULS.G | ULS.W""")
lccombinator = LoadCaseCombinatorKaramba3D(LoadCaseCombinationRulesKaramba3D=panel_2)  # -> LoadCaseCombinations, NamesOfLoadCases, NumberOfLoadCases

# ---- group: Define Loads
alignedloadingmesh_2 = Mesh(alignedloadingmesh)
number_slider = Slider(12, range=0..20)
number_slider_2 = Slider(0.2, range=0..1)
wind_load_kn_m2_3 = Number(wind_load_kn_m2_2)
alignedloadingmesh_3 = Mesh(alignedloadingmesh)
glazing_load_kn_m2_3 = Number(glazing_load_kn_m2_2)
facen = FaceNormals(Mesh=alignedloadingmesh_3)  # -> Centers, Normals
avr = Average(Input=facen.Normals)
Z = UnitZ(Factor=glazing_load_kn_m2_3)
amp_4 = Amplitude(Vector=avr, Amplitude=wind_load_kn_m2_3)
neg = Negative(Value=Z)
loads = LoadsKaramba3D(Vector=Vector(0, 0, -1), LCase="SW", mode="Gravity")
loads_2 = LoadsKaramba3D(
    Vector=neg,
    Mesh=alignedloadingmesh_2,
    ElementIdentifiers="Glazing.Mullions",
    LCase="SDL",
    LineLoadsPerElement=number_slider,
    MinimumLineLoadLength_m=number_slider_2,
    mode="MeshLoad -Const.",
    menu=[buttons(off, on, off), buttons(off, on)])
loads_3 = LoadsKaramba3D(
    Vector=amp_4,
    Mesh=alignedloadingmesh_3,
    ElementIdentifiers=["Glazing.Mullions", "Truss.Chord.Front"],
    LCase="WL",
    LineLoadsPerElement=number_slider,
    MinimumLineLoadLength_m=number_slider_2,
    mode="MeshLoad -Const.",
    menu=[buttons(off, on, off), buttons(off, on)])

# ----
base_plane_6 = Plane(base_plane)
deplane_5 = DeconstructPlane(Plane=base_plane_6)  # -> Origin, XAxis, YAxis, ZAxis
entwine_2 = Entwine(Branch00=deplane_5.XAxis, Branch01=deplane_5.XAxis, FlattenInputs=True)
mullions_2 = Curve(mullions)
lineelem = CreateLinearElementKaramba3D(
    Line=mullions_2,
    Identifier="Glazing.Mullions",
    CrossSection=crosecrselect_2,
    LimitDistance_m=0.005,
    ZOrientation=entwine_2,
    BucklingLengthY_m=-1,
    BucklingLengthZ_m=-1,
    BucklingLengthLT_m=-1,
    Bending=True,
    ToPolylineMaxAngle=0.25,
    ToPolylineTolerance=0.1,
    ToPolylineMaxEdgeLength=0.25,
    New=True,
    Remove=True,
    mode="LineToBeam",
    GuidGeneratorSeed=1142275002)  # -> Element, Points, Info

panel_3 = Panel("""Glazing.Mullions
Truss.Diagonals""")
panel_4 = Panel("""Truss.Chord.Front
Truss.Chord""")
joint_agent = BeamJointAgentKaramba3D(
    BeamIdentifier=panel_3,
    ToElementIdentifiers=panel_4,
    Ct_kN_m=Vector(0, 0, 0),
    Cr_kNm_rad=Vector(0, 0, 0),
    menu=[buttons(off, off, off, off, on, on)])

front_chord_2 = Curve(front_chord)
back_chord_2 = Curve(back_chord)
diagonals_2 = Curve(diagonals)

entwine_3 = Entwine(Branch00=back_chord_2, Branch01=front_chord_2, Branch02=diagonals_2, FlattenInputs=True)
entwine_4 = Entwine(Branch00="Truss.Chord.Back", Branch01="Truss.Chord.Front", Branch02="Truss.Diagonals", FlattenInputs=True)
lineelem_2 = CreateLinearElementKaramba3D(
    Line=entwine_3,
    Identifier=entwine_4,
    CrossSection=entwine,
    LimitDistance_m=0.005,
    BucklingLengthY_m=-1,
    BucklingLengthZ_m=-1,
    BucklingLengthLT_m=-1,
    Bending=True,
    ToPolylineMaxAngle=0.25,
    ToPolylineTolerance=0.1,
    ToPolylineMaxEdgeLength=0.25,
    New=True,
    Remove=True,
    mode="LineToBeam",
    GuidGeneratorSeed=1819577723)  # -> Element, Points, Info

# ---- group: Define Supports
support_points_bottom_2 = Point(support_points_bottom)
support_points_truss_2 = Point(support_points_truss)
supp = SupportKaramba3D(
    PosInd=support_points_truss_2,
    Ct_kN_m=Vector(0, 0, 0),
    Cr_kNm_rad=Vector(0, 0, 0),
    menu=[buttons(on, on, on, off, on, off)])
supp_2 = SupportKaramba3D(
    PosInd=support_points_bottom_2,
    Ct_kN_m=Vector(0, 0, 0),
    Cr_kNm_rad=Vector(0, 0, 0),
    menu=[buttons(on, on, on, off, off, off)])

# ----
support = SupportKaramba3D([supp, supp_2])
joint = JointKaramba3D(flatten(joint_agent))
load = LoadKaramba3D([loads, loads_2, loads_3, lccombinator.LoadCaseCombinations])
element = ElementKaramba3D([lineelem_2.Element, lineelem.Element])

# ---- group: Assemble Model
assemble = AssembleModelKaramba3D(Elem=flatten(element), Support=flatten(support), Load=flatten(load), Joint=flatten(joint), LimitDistance_m=0.005)  # -> Model, Info, Mass_kg, CentreOfGravity, LoadCaseNames
system_mass_kg = Panel(assemble.Mass_kg)

# ---- group: Analyze Model
analyse = AnalyseKaramba3D(Model=assemble.Model)  # -> AnalysedModel, MaximumDisplacement_cm, ResultingForce_kN, ChangeOfElasticEnergy_kNm
panel_5 = Panel(assemble.LoadCaseNames)
panel_6 = Panel(analyse.MaximumDisplacement_cm)

# ---- group: Eigenmodes Analysis Model
emodes = EigenModesKaramba3D(
    Model=analyse.AnalysedModel,
    FromIndex=1,
    NumberOfModes=Slider(10, range=0..50),
    WithThIIEffects=False,
    MaximumNumberOfIterations=300,
    Epsilon=1e-07)  # -> ModelWithEigenModes, Eigenvalues
panel_7 = Panel(emodes.Eigenvalues)

# ----
resultselect = ResultSelectorKaramba3D(
    Model=emodes.ModelWithEigenModes,
    menu=[buttons(on, on), dropdown(7), dropdown(0), buttons(off, off, off, off, off, off, off), buttons(off, off, off, off, off, off), buttons(off, off, off, off, off, off, off, off), buttons(off, off, off, off, off, off, off, off)])  # -> Model, LoadCaseSelection
modelview = ModelViewKaramba3D(Model=resultselect.Model)  # -> Model, DeformedMesh, DeformedAxes, DeformedModel, MaximumDeformation
beamview = BeamViewKaramba3D(Model=modelview.Model)  # -> Model, MeshesOfRenderedBeams, DeformedBeamAxes, LegendColours, LegendTags
legend = LegendKaramba3D(
    Colors=beamview.LegendColours,
    Tags=beamview.LegendTags,
    Scale=0.8,
    Textsize=30,
    Legend_HasHeader=False,
    Legend_Justification=2,
    Legend_Position=2)

# ---- group: Export File STP
press_to_export = Button()
folder_path_for_export = FilePath("C:\Users\drago\OneDrive\Desktop\")
dstv_name_extension = Panel("ENG03-Hybrid Truss.stp")
filter = StreamFilter(Gate=press_to_export, Stream1=emodes.ModelWithEigenModes)
concat = Concatenate(FragmentA=folder_path_for_export, FragmentB=dstv_name_extension)
extodstv = ExportModelToDStVKaramba3D(
    Model=filter,
    Path=concat,
    ExportPath="C:\Users\drago\OneDrive\Desktop\ENG01-Canopy.stp",
    menu=[buttons(off, off, off, on, off, off)])  # -> DStV, Info
panel_8 = Panel(extodstv.DStV)

# ----
press_to_export_2 = Button()
folder_path_for_export_2 = FilePath("C:\Users\drago\OneDrive\Desktop\")
saf_name_extension = Panel("ENG03-Hybrid Truss.saf")
concat_2 = Concatenate(FragmentA=folder_path_for_export_2, FragmentB=saf_name_extension)
extosaf = ExportModelToSAFKaramba3D(
    Model=emodes.ModelWithEigenModes,
    Filepath=concat_2,
    ExportNow=press_to_export_2,
    OrientationGlobalCS=0,
    OrientationLocalCS=0,
    Discipline="Load-bearing structure",
    BuildingCodeIndex=0,
    LengthSegment_m=-1,
    MaximumFacesMesh=2000,
    SAFVersion="1.0.5",
    CrossSectionNameConversion="CrossSectionNameAliases.csv")  # -> Model, Info
panel_9 = Panel(extosaf.Info)

# ---- group: Results - Reaction Forces
react = ReactionForcesKaramba3D(AnalysedModel=beamview.Model)  # -> Model, ReactionForces_kN, ReactionMoments_kNm, SupportPosition, SumOfReactionForces_kN, SumOfReactionMoments_kNm, GoverningLoadCaseIndex
reactview = ReactionViewKaramba3D(Model=beamview.Model)  # -> Model, LegendColours, LegendTags
panel_10 = Panel(react.SumOfReactionForces_kN)

# ==== cluster Cluster
zonemeshes = ClusterInput()
zonemeshes_2 = Mesh(zonemeshes)
meshtargetsize = ClusterInput()
medges = MeshEdges(Mesh=zonemeshes_2)  # -> NakedEdges, InteriorEdges, NonManifoldEdges
meshtargetsize_2 = Number(meshtargetsize)
join = JoinCurves(Curves=medges.NakedEdges, Preserve=False)
trim = TrimTree(Tree=join, Depth=2)
boundary = BoundarySurfaces(Edges=trim)
dim = Dimensions(Surface=boundary)  # -> UDimension, VDimension
division = Division(A=dim.UDimension, B=meshtargetsize_2)
division_2 = Division(A=dim.VDimension, B=meshtargetsize_2)
round = Round(Number=division)  # -> Nearest, Floor, Ceiling
round_2 = Round(Number=division_2)  # -> Nearest, Floor, Ceiling
mesh_uv = MeshSurface(Surface=boundary, UCount=round.Nearest, VCount=round_2.Nearest, Overhang=True, Equalize=False)
loadingmeshes = Mesh(mesh_uv)
loadingmeshes_2 = ClusterOutput(loadingmeshes)
