# Grasshopper definition 01_HybridTrussRoof.gh (Grasshopper 1.0.8)
# plug-ins: Karamba3D, Pufferfish, Human

trigger = Trigger(Interval=300000, TimerInterval=300000, Target=py3)
py3 = Python3Script(showFaintWires=Toggle(True))
# ---------- py3: Python ----------
import rhinoscriptsyntax as rs
import Grasshopper as gh
import Grasshopper.Kernel as gk
import Grasshopper.Kernel.Special as gks

def set_wire_properties():
    doc = ghenv.Component.OnPingDocument()  # Get the current Grasshopper document

    # Iterate through all objects in the document
    for obj in doc.Objects:
        if isinstance(obj, gk.Special.GH_Group):
            # Skip groups, we are focusing on components
            continue
            
        # We can try to find all params
        if isinstance(obj, gk.IGH_Param):
            # Set wire display mode (Faint, Hidden, or Default)
            if obj.WireDisplay == gk.GH_ParamWireDisplay.hidden:
                continue
            else: obj.WireDisplay = wireType
            
        
        # If it's a component, we should check its params
        if isinstance(obj, gk.GH_Component):
            for param in obj.Params.Input:
                if param.WireDisplay == gk.GH_ParamWireDisplay.hidden:
                    continue
                else: param.WireDisplay = wireType
            for param in obj.Params.Output:
                if param.WireDisplay == gk.GH_ParamWireDisplay.hidden:
                    continue
                else: param.WireDisplay = wireType

# Run the function
if showFaintWires:
    wireType = gk.GH_ParamWireDisplay.faint
else:
    wireType = gk.GH_ParamWireDisplay.default
set_wire_properties()
# ---------- end py3 ----------
load_zone_visualisation = ValueList({"OFF": 0, "ON": 1}, selected="ON")
truss_divisions = ValueList({"6", "8", "10"}, selected="6")

# ---- group: GEOEMETRY INPUTS
purlin_spacing_m = ValueList({"0.5", "0.75", "1.00", "1.50"}, selected="0.5")
bay_number = ValueList({"1", "3", "5", "7", "9"}, selected="5")
yz = YZPlane(Origin=Point(0, 0, 0))
span_m = Slider(85.5, range=0..100)
scaling_factor_for_fun = Slider(1, range=0.95..1.05)
height_at_supports_m = Slider(13, range=0..100)
height_at_midspan_m = Slider(15.8, range=0..40)
truss_depth_at_start_m = Slider(6, range=1..10)
truss_depth_at_midspan_m = Slider(4.9, range=1..10)
portal_frame_width_m = Slider(4, range=1..10)
bay_width_m = Slider(8, range=0..10)
truss_depth_at_midspan_m_2 = Number(truss_depth_at_midspan_m)
truss_depth_at_start_m_2 = Number(truss_depth_at_start_m)
portal_frame_width_m_2 = Number(portal_frame_width_m)
height_at_supports_m_2 = Number(height_at_supports_m)
height_at_midspan_m_2 = Number(height_at_midspan_m)
span_at_supports_m = Number(span_m)
purlin_spacing_m_2 = Number(purlin_spacing_m)
scaling_factor = Number(scaling_factor_for_fun)
bay_number_2 = Number(bay_number)
bay_width_m_2 = Number(bay_width_m)
# 03 - Hybrid Truss Roof Structure
# Difficulty: Hard | Version 3.1.4
# A simple steel roof canopy structure can be easily controlled using several sliders.
# Wind suction and pressure is generated using a c# algorithm according to BS EN 1991-1-4:2005 based on the different parameters and applied as several mesh loads in two main directions.
truss_plane = Plane(yz)

# ---- group: Define WIND LOADING INPUTS
terrain_category = ValueList({"0", "I": 1, "II": 2, "III": 3, "IV": 4}, selected="0")
basic_velocity_wind_pressure_q_b_kn_m2 = Slider(0.32, range=0.25..2)
list = ValueList({"Wind X": 0, "Wind -X": 1, "Wind Y": 2, "Wind -Y": 3}, selected="Wind X")
wind_direction = Integer(list)
X = UnitX(Factor=1)
X_2 = UnitX(Factor=1)  # -> expr("-x", UnitVector)
Y = UnitY(Factor=1)
Y_2 = UnitY(Factor=1)  # -> expr("-x", UnitVector)
wind_direction_2 = Integer(wind_direction)
filter = StreamFilter(Gate=wind_direction_2, Stream0=X, Stream1=X_2, Stream2=Y, Stream3=Y_2)
direction_vector = Vector(filter)
terrain_category_2 = Number(terrain_category)
q_b_kn_m2 = Number(basic_velocity_wind_pressure_q_b_kn_m2)

# ---- group: EC 1 Data For Rectangular Buildings - FLAT ROOF
# Data based on BS EN 1991-1-4:2005.
# Section 7.2.3: Figure 7.6 and Table 7.2
coefficients = Panel("""C_pe,10
C_pe,1""")
zone_i_suction = Panel("""-0.2
-0.2""")
zone_f = Panel("""-1.8
-2.5""")
zone_g = Panel("""-1.2
-2.0""")
zone_h = Panel("""-0.7
-1.2""")
zone_i_pressure = Panel("""+0.2
+0.2""")
entwine = Entwine(Branch00=zone_f, Branch01=zone_g, Branch02=zone_h, Branch03=zone_i_suction, Branch04=zone_i_pressure, FlattenInputs=True)

# ---- group: EC 1 Terrain Category Data
# Data based on BS EN 1991-1-4:2005.
# Section 4.3.2: Table 4.1
terrain_category_3 = Panel("""0
1
2
3
4""")
terrain_data_category = Number(terrain_category_3)
z_0_m = Panel("""0.003
0.01
0.05
0.3
1""")
terrain_data_z_0_m = Number(z_0_m)
z_min_m = Panel("""1
1
2
5
10""")
terrain_data_z_min_m = Number(z_min_m)

# ---- group: EC 1 Data For Rectangular Buildings - VERTICAL WALLS
# Data based on BS EN 1991-1-4:2005.
# Section 7.2.2: Figure 7.5 and Table 7.1
panel = Panel("""5
1
0.25""")
building_data_h_d = Number(panel)
c_pe_10 = Panel("""-1.2
-1.2
-1.2""")
building_data_a_c_pe_10 = Number(c_pe_10)
c_pe_10_2 = Panel("""-0.8
-0.8
-0.8""")
building_data_b_c_pe_10 = Number(c_pe_10_2)
c_pe_10_3 = Panel("""-0.5
-0.5
-0.5""")
building_data_c_c_pe_10 = Number(c_pe_10_3)
c_pe_10_4 = Panel("""+0.8
+0.8
+0.7""")
building_data_d_c_pe_10 = Number(c_pe_10_4)
c_pe_10_5 = Panel("""-0.7
-0.5
-0.3""")
building_data_e_c_pe_10 = Number(c_pe_10_5)

# ----
building_data_d_c_pe_10_2 = Number(building_data_d_c_pe_10)
building_data_a_c_pe_10_2 = Number(building_data_a_c_pe_10)
building_data_c_c_pe_10_2 = Number(building_data_c_c_pe_10)
building_data_e_c_pe_10_2 = Number(building_data_e_c_pe_10)
building_data_b_c_pe_10_2 = Number(building_data_b_c_pe_10)
terrain_data_z_min_m_2 = Number(terrain_data_z_min_m)
terrain_data_category_2 = Number(terrain_data_category)
terrain_data_z_0_m_2 = Number(terrain_data_z_0_m)
building_data_h_d_2 = Number(building_data_h_d)
entwine_2 = Entwine(
    Branch00=building_data_h_d_2,
    Branch01=building_data_a_c_pe_10_2,
    Branch02=building_data_b_c_pe_10_2,
    Branch03=building_data_c_c_pe_10_2,
    Branch04=building_data_d_c_pe_10_2,
    Branch05=building_data_e_c_pe_10_2,
    FlattenInputs=True)
entwine_3 = Entwine(Branch00=terrain_data_category_2, Branch01=terrain_data_z_0_m_2, Branch02=terrain_data_z_min_m_2, FlattenInputs=True)
panel_2 = Panel(entwine_3)
panel_3 = Panel(entwine_2)
building_data_walls = Number(entwine_2)
terrain_data = Number(entwine_3)

truss_divisions_2 = Number(truss_divisions)
load_visualisation = Integer(load_zone_visualisation)
panel_4 = Panel(entwine)
building_data_flat_roof = Number(entwine)

# ---- group: Define Truss Reference Geometry
# Note: Flat Roof Clauses in Eurocode apply for a roof with an angle between -5 and +5.
# 
# The angle calculated is based on the angle created to the middle point of the top chord.
# 
# For this scenario, the angle is not constant along the roof and therefore we can extend the approximation of a flat roof to within reasonable engineering judgement.
cluster = Cluster(
    truss_plane=truss_plane,
    span_at_supports_m=span_at_supports_m,
    height_at_supports_m=height_at_supports_m_2,
    height_at_midspan_m=height_at_midspan_m_2,
    truss_depth_at_start_m=truss_depth_at_start_m_2,
    truss_depth_at_midspan_m=truss_depth_at_midspan_m_2,
    portal_frame_width_m=portal_frame_width_m_2)  # -> truss_plane_6, support_points_2, columns_2, frame_angle_2, truss_surface_2, approximate_roof_angle
entwine_4 = Entwine(
    Branch00=cluster.truss_plane_6,
    Branch01=cluster.support_points_2,
    Branch02=cluster.columns_2,
    Branch03=cluster.frame_angle_2,
    Branch04=cluster.truss_surface_2,
    FlattenInputs=True)  # -> simplify(Result)
approximate_roof_angle_deg = Panel(cluster.approximate_roof_angle)
truss_definition = Geometry(entwine_4)

# ---- group: Define Array of Trusses
scaling_factor_2 = Number(scaling_factor)
truss_definition_2 = Geometry(truss_definition)
bay_number_3 = Number(bay_number_2)
bay_width_m_3 = Number(bay_width_m_2)
expression = Expression(n=bay_number_3, Expression="n+1")
graft = GraftTree(Tree=truss_definition_2, IncludeEmptyLists=True, IncludeNullItems=True)
series = Series(Start=0, Step=bay_width_m_3, Count=expression)
series_2 = Series(Start=0, Step=1, Count=expression)
tstat = TreeStatistics(Tree=graft)  # -> Paths, Length, Count
bang = ExplodeTree(Data=truss_definition_2)  # -> Branch0, Branch1, Branch2, Branch3, Branch4
pow = Power(A=scaling_factor_2, B=series_2)
dup = DuplicateData(Data=series, Number=tstat.Count, Order=True)
dup_2 = DuplicateData(Data=pow, Number=tstat.Count, Order=True)
deplane = DeconstructPlane(Plane=bang.Branch0)  # -> Origin, XAxis, YAxis, ZAxis
partition = PartitionList(List=dup, Size=expression)
partition_2 = PartitionList(List=dup_2, Size=expression)
match = MatchTree(Tree=partition, Guide=graft)
match_2 = MatchTree(Tree=partition_2, Guide=graft)
amp = Amplitude(Vector=deplane.ZAxis, Amplitude=match)
move = Move(Geometry=graft, Motion=amp)  # -> Geometry, Transform
scale_nu = ScaleNU(Geometry=move.Geometry, Plane=bang.Branch0, ScaleX=match_2, ScaleY=1, ScaleZ=1)  # -> Geometry, Transform
path_mapper = PathMapper(scale_nu.Geometry, source="{A;B}[i]", target="{i;A}")
truss_definition_for_all = Geometry(path_mapper)

# ---- group: Define Basic Truss Elements
truss_definition_for_all_2 = Geometry(truss_definition_for_all)
split = SplitTree(Data=truss_definition_for_all_2, Masks=flatten("{?;1}"))  # -> Positive, Negative
split_2 = SplitTree(Data=truss_definition_for_all_2, Masks=flatten("{?;2}"))  # -> Positive, Negative
split_3 = SplitTree(Data=truss_definition_for_all_2, Masks=flatten("{?;3}"))  # -> Positive, Negative
split_4 = SplitTree(Data=truss_definition_for_all_2, Masks=flatten("{?;4}"))  # -> Positive, Negative
debrep = DeconstructBrep(Brep=split_4.Positive)  # -> Faces, Edges, Vertices
item = ListItem(List=debrep.Edges, Index=0, Wrap=True)  # -> Item, Item1, Item2, Item3
truss_divisions_3 = Number(truss_divisions_2)
flip = FlipCurve(Curve=item.Item2)  # -> Curve, Flag
divide = DivideCurve(Curve=flip.Curve, Count=expr("x+1", truss_divisions_3), Kinks=False)  # -> simplify(Points), Tangents, Parameters
divide_2 = DivideCurve(Curve=item.Item, Count=truss_divisions_3, Kinks=False)  # -> simplify(Points), Tangents, Parameters
shift = ShiftList(List=divide.Points, Shift=1, Wrap=False)
shift_2 = ShiftList(List=shift, Shift=-1, Wrap=False)  # -> simplify(List)
index = ItemIndex(List=shift_2, Item=shift_2)
item_2 = ListItem(List=divide_2.Points, Index=expr("x+1", index), Wrap=True)
item_3 = ListItem(List=divide_2.Points, Index=index, Wrap=True)
pline = PolyLine(Vertices=divide_2.Points, Closed=False)
pline_2 = PolyLine(Vertices=divide.Points, Closed=False)
merge = Merge(Data1=item.Item1, Data2=item.Item3)  # -> simplify(Result)
explode = Explode(Curve=pline, Recursive=True)  # -> simplify(Segments), Vertices
explode_2 = Explode(Curve=pline_2, Recursive=True)  # -> simplify(Segments), Vertices
ln = Line(StartPoint=shift_2, EndPoint=item_3)
ln_2 = Line(StartPoint=shift_2, EndPoint=item_2)
support_points = Point(simplify(split.Positive))
frame_angle = Line(simplify(split_3.Positive))
bottom_chord = Line(explode.Segments)
frame_corner = Line(merge)
columns = Line(simplify(split_2.Positive))
diagonal_01 = Line(ln)
diagonal_02 = Line(ln_2)
top_chord = Line(explode_2.Segments)

# ---- group: Define Top Chord Subdivison (based on assumed purlin subdivision)
top_chord_2 = Line(top_chord)
join = JoinCurves(Curves=top_chord_2, Preserve=False)
explode_3 = Explode(Curve=join, Recursive=True)  # -> Segments, Vertices
intcrv = Interpolate(Vertices=explode_3.Vertices, Degree=3, Periodic=False, KnotStyle=1)  # -> Curve, Length, Domain
crv_cp = CurveClosestPoint(Point=explode_3.Vertices, Curve=intcrv.Curve)  # -> Point, Parameter, Distance
shatter = Shatter(Curve=intcrv.Curve, Parameters=crv_cp.Parameter)
purlin_spacing_m_3 = Number(purlin_spacing_m_2)
len = Length(Curve=shatter)
division = Division(A=len, B=purlin_spacing_m_3)
round = Round(Number=division)  # -> Nearest, Floor, Ceiling
divide_3 = DivideCurve(Curve=shatter, Count=round.Floor, Kinks=False)  # -> simplify(Points), Tangents, Parameters
pline_3 = PolyLine(Vertices=divide_3.Points, Closed=False)
explode_4 = Explode(Curve=pline_3, Recursive=True)  # -> simplify(Segments), Vertices
trim = TrimTree(Tree=explode_4.Segments, Depth=1)
top_chord_divided = Line(trim)

# ---- group: Define Transverse Beams
top_chord_3 = Line(top_chord)
bottom_chord_2 = Line(bottom_chord)
end = EndPoints(Curve=top_chord_3)  # -> Start, End
end_2 = EndPoints(Curve=bottom_chord_2)  # -> Start, End
rdpoints = RemoveDuplicatePointsKaramba3D(Point=[end.Start, end.End], LimitDistance=0.005)  # -> OutPoint, Info, Indexes
rdpoints_2 = RemoveDuplicatePointsKaramba3D(Point=[end_2.Start, end_2.End], LimitDistance=0.005)  # -> OutPoint, Info, Indexes
flip_2 = FlipMatrix(Data=rdpoints.OutPoint)
flip_3 = FlipMatrix(Data=rdpoints_2.OutPoint)
pline_4 = PolyLine(Vertices=flip_2, Closed=False)
pline_5 = PolyLine(Vertices=flip_3, Closed=False)
explode_5 = Explode(Curve=pline_4, Recursive=True)  # -> simplify(Segments), Vertices
explode_6 = Explode(Curve=pline_5, Recursive=True)  # -> simplify(Segments), Vertices
tstat_2 = TreeStatistics(Tree=explode_6.Segments)  # -> Paths, Length, Count
item_4 = ListItem(List=tstat_2.Paths, Index=0, Wrap=True)  # -> Item2, Item1, Item, Item1_2
split_5 = SplitTree(Data=explode_6.Segments, Masks=flatten([item_4.Item2, item_4.Item1, item_4.Item, item_4.Item1_2]))  # -> Positive, Negative
crv = Curve(explode_5.Segments)
crv_2 = Curve(split_5.Positive)
transverse_beams_bottom = Line(crv_2)
transverse_beams_top = Line(crv)

# ---- group: Define Bracing Elements
cluster_2 = Cluster_3(top_chord=top_chord, bottom_chord=bottom_chord, columns=columns)
split_6 = SplitTree(Data=cluster_2, Masks=flatten("{0;4,5}"))  # -> Positive, Negative
number_slider = Slider(1, range=0..10)
list_2 = ValueList({"Pratt Truss": 1, "Warren Truss": 2, "Warren Truss with verticals": 3, "K-Truss": 4, "Diamond": 5, "Diamond Straight": 6, "Vierendeel Truss": 7}, selected="Diamond Straight")
bracing_surfaces = Surface(split_6.Positive)
surf2truss = SurfaceToTrussKaramba3D(
    Surface=reparameterize(graft(bracing_surfaces)),
    TrussType=list_2,
    NumberOfSubdivisions=number_slider,
    FlipUDirection=False,
    FlipVDirection=False,
    SwapUVDirections=False,
    RelaxAngles=False,
    TargetPostDirection=Vector(0, 0, 0),
    MaximumRelaxationIterations=30,
    LengthTolerance=0.0001,
    DampingFactor=0.8)  # -> Info, simplify(Lines), YOrientations, ZOrientations, SpecificEnergy
surf2truss_2 = SurfaceToTrussKaramba3D(
    Surface=reparameterize(graft(split_6.Negative)),
    TrussType=list_2,
    NumberOfSubdivisions=number_slider,
    FlipUDirection=False,
    FlipVDirection=False,
    SwapUVDirections=False,
    RelaxAngles=False,
    TargetPostDirection=Vector(0, 0, 0),
    MaximumRelaxationIterations=30,
    LengthTolerance=0.0001,
    DampingFactor=0.8)  # -> Info, simplify(Lines), YOrientations, ZOrientations, SpecificEnergy
data = Data(surf2truss.Lines)
data_2 = Data(surf2truss_2.Lines)
split_7 = SplitTree(Data=data, Masks=flatten("{*;2}"))  # -> simplify(Positive), Negative
split_8 = SplitTree(Data=data, Masks=flatten("{*;3}"))  # -> simplify(Positive), Negative
split_9 = SplitTree(Data=data_2, Masks=flatten("{*;2}"))  # -> simplify(Positive), Negative
split_10 = SplitTree(Data=data_2, Masks=flatten("{*;3}"))  # -> simplify(Positive), Negative
diagonal_01_2 = Line(split_7.Positive)
diagonal_01_3 = Line(split_9.Positive)
diagonal_02_2 = Line(split_8.Positive)
diagonal_02_3 = Line(split_10.Positive)
join_2 = JoinCurves(Curves=diagonal_01_3, Preserve=False)
join_3 = JoinCurves(Curves=diagonal_02_3, Preserve=False)
end_3 = EndPoints(Curve=join_2)  # -> Start, End
end_4 = EndPoints(Curve=join_3)  # -> Start, End
ln_3 = Line(StartPoint=end_3.Start, EndPoint=end_3.End)
ln_4 = Line(StartPoint=end_4.Start, EndPoint=end_4.End)
data_3 = Data([ln_4, ln_3])
bracing_diagonals_truss = Line(data_3)
bracing_diagonals_wall = Line([diagonal_01_2, diagonal_02_2])

# ---- group: Define Bracing Elements Roof
cluster_3 = Cluster_2(top_chord=top_chord)
list_3 = ValueList({"Pratt Truss": 1, "Warren Truss": 2, "Warren Truss with verticals": 3, "K-Truss": 4, "Diamond": 5, "Diamond Straight": 6, "Vierendeel Truss": 7}, selected="Diamond Straight")
top_chord_bracing_surfaces = Surface(cluster_3)
surf2truss_3 = SurfaceToTrussKaramba3D(
    Surface=reparameterize(graft(top_chord_bracing_surfaces)),
    TrussType=list_3,
    NumberOfSubdivisions=Slider(1, range=0..10),
    FlipUDirection=False,
    FlipVDirection=False,
    SwapUVDirections=False,
    RelaxAngles=False,
    TargetPostDirection=Vector(0, 0, 0),
    MaximumRelaxationIterations=30,
    LengthTolerance=0.0001,
    DampingFactor=0.8)  # -> Info, simplify(Lines), YOrientations, ZOrientations, SpecificEnergy
data_4 = Data(surf2truss_3.Lines)
split_11 = SplitTree(Data=data_4, Masks=flatten("{*;2}"))  # -> simplify(Positive), Negative
split_12 = SplitTree(Data=data_4, Masks=flatten("{*;3}"))  # -> simplify(Positive), Negative
diagonal_01_4 = Line(split_11.Positive)
diagonal_02_4 = Line(split_12.Positive)
join_4 = JoinCurves(Curves=diagonal_01_4, Preserve=False)
join_5 = JoinCurves(Curves=diagonal_02_4, Preserve=False)
end_5 = EndPoints(Curve=join_4)  # -> Start, End
end_6 = EndPoints(Curve=join_5)  # -> Start, End
ln_5 = Line(StartPoint=end_5.Start, EndPoint=end_5.End)
ln_6 = Line(StartPoint=end_6.Start, EndPoint=end_6.End)
bracing = Data([ln_6, ln_5])
bracing_diagonals_roof = Line(bracing)

# ----
bottom_chord_3 = Line(bottom_chord)
shift_3 = ShiftList(List=bottom_chord_3, Shift=1, Wrap=invert(True))
item_5 = ListItem(List=bottom_chord_3, Index=0, Wrap=True)  # -> Item1, Item
shift_4 = ShiftList(List=shift_3, Shift=-1, Wrap=invert(True))
bottom_chord_glulam = Line(simplify([item_5.Item1, item_5.Item]))
bottom_chord_cable = Line(simplify(shift_4))

diagonal_01_5 = Line(diagonal_01)
diagonal_02_5 = Line(diagonal_02)
lng = ListLength(List=diagonal_01_5)
lng_2 = ListLength(List=diagonal_02_5)
split_13 = SplitList(List=diagonal_01_5, Index=expr("x/2", lng))  # -> ListA, ListB
split_14 = SplitList(List=diagonal_02_5, Index=expr("x/2", lng_2))  # -> ListA, ListB
diagonals_glulam = Line(simplify([split_13.ListA, split_14.ListB]))
diagonals_steel = Line(simplify([split_13.ListB, split_14.ListA]))

columns_2 = Line(columns)
divide_4 = DivideCurve(Curve=columns_2, Count=2, Kinks=False)  # -> simplify(Points), Tangents, Parameters
shift_5 = ShiftList(List=divide_4.Points, Shift=1, Wrap=invert(True))
shift_6 = ShiftList(List=shift_5, Shift=-1, Wrap=invert(True))
pline_6 = PolyLine(Vertices=divide_4.Points, Closed=False)
graft_2 = GraftTree(Tree=simplify(shift_6), IncludeEmptyLists=True, IncludeNullItems=True)
explode_7 = Explode(Curve=pline_6, Recursive=True)  # -> simplify(Segments), Vertices
path_mapper_2 = PathMapper(graft_2, source="{A;B;C}", target="{B;C}")
path_mapper_3 = PathMapper(explode_7.Segments, source="{A;B}", target="{B}")
data_5 = Data(path_mapper_2)
pline_7 = PolyLine(Vertices=data_5, Closed=False)
explode_8 = Explode(Curve=pline_7, Recursive=True)  # -> Segments, Vertices
divide_5 = DivideCurve(Curve=explode_8.Segments, Count=2, Kinks=False)  # -> Points, Tangents, Parameters
pline_8 = PolyLine(Vertices=divide_5.Points, Closed=False)  # -> simplify(Polyline)
transverse_beams_side_wall = Curve(pline_8)
columns_divided = Line(path_mapper_3)

columns_3 = Line(columns)
top_chord_divided_2 = Line(top_chord_divided)
bbox = BoundingBox(Content=flatten([columns_3, top_chord_divided_2]), Plane=PlaneXY(0, 0, 0), UnionBox=True)  # -> Box, Box_2
building_box = Box(bbox.Box)
building_box_2 = Box(building_box)
debrep_2 = DeconstructBrep(Brep=building_box_2)  # -> Faces, Edges, Vertices
debox = DeconstructBox(Box=building_box_2)  # -> Plane, X, Y, Z
area = Area(Geometry=debrep_2.Faces)  # -> Area, Centroid
dedomain = DeconstructDomain(Domain=debox.Z)  # -> Start, End
pdecon = Deconstruct(Point=area.Centroid)  # -> XComponent, YComponent, ZComponent
subtraction = Subtraction(A=dedomain.End, B=dedomain.Start)
sort = SortList(Keys=pdecon.ZComponent, ValuesA=debrep_2.Faces)  # -> Keys, ValuesA
item_6 = ListItem(List=reverse(sort.ValuesA), Index=0, Wrap=True)
roof_height_h = Number(subtraction)
roof_outline = Curve(item_6)

# ---- group: Calculation of MESH LOADING PARAMETERS
building_data_walls_2 = Number(building_data_walls)
direction_vector_2 = Vector(direction_vector)
building_box_3 = Box(building_box)
terrain_category_4 = Number(terrain_category_2)
q_b_kn_m2_2 = Number(q_b_kn_m2)
terrain_data_2 = Number(terrain_data)
int = Integer(terrain_category_4)
c_script = CSharpScript(
    box=building_box_3,
    terrainCat=int,
    qb=q_b_kn_m2_2,
    buildingData=building_data_walls_2,
    terrainData=terrain_data_2,
    windDir=direction_vector_2,
    nMidStrips=Slider(1, range=0..10))  # -> out, Info, zoneMeshes, zoneCpe, zoneQp, profile; inputs box: Box, terrainCat: Int32, qb: Double, buildingData: tree of Double, terrainData: tree of Double, windDir: Vector3d, nMidStrips: Int32
# ---------- c_script: C# ----------
// Grasshopper Script Instance
#region Usings
using System;
using System.Linq;
using System.Collections;
using System.Collections.Generic;
using System.Drawing;

using Rhino;
using Rhino.Geometry;

using Grasshopper;
using Grasshopper.Kernel;
using Grasshopper.Kernel.Data;
using Grasshopper.Kernel.Types;
#endregion

public class Script_Instance : GH_ScriptInstance
{
    #region Notes
    /* 
      Members:
        RhinoDoc RhinoDocument
        GH_Document GrasshopperDocument
        IGH_Component Component
        int Iteration

      Methods (Virtual & overridable):
        Print(string text)
        Print(string format, params object[] args)
        Reflect(object obj)
        Reflect(object obj, string method_name)
    */
    #endregion

    // GH C# Script Component: Wall Zones - EN 1991-1-4 Section 7.2
    // Inputs:
    //   box         (Box)                     - Building bounding box
    //   terrainCat  (int)                     - Terrain category (0-4)
    //   qb          (double)                  - Basic velocity pressure [kN/m²]
    //   buildingData (DataTree<double>)       - Table 7.1 data tree
    //   terrainData  (DataTree<double>)       - Table 4.1 terrain data tree
    //   windDir     (Vector3d)               - Wind direction vector (+X, -X, +Y, -Y)
    //   nMidStrips  (int)                     - Number of strips for middle zone (h>2b case)
    //
    // Outputs:
    //   Info         (string)                 - Diagnostic output
    //   zoneMeshes   (DataTree<Mesh>)         - Zone meshes: {0}=A, {1}=B, {2}=C, {3}=D, {4}=E
    //   zoneCpe      (DataTree<double>)       - cpe,10 per mesh: {0}=A, {1}=B, {2}=C, {3}=D, {4}=E
    //   zoneQp       (DataTree<double>)       - qp per mesh: {0}=A, {1}=B, {2}=C, {3}=D, {4}=E
    //   profile      (string)                 - Windward face profile case

    private void RunScript(
		Box box,
		int terrainCat,
		double qb,
		DataTree<double> buildingData,
		DataTree<double> terrainData,
		Vector3d windDir,
		int nMidStrips,
		ref object Info,
		ref object zoneMeshes,
		ref object zoneCpe,
		ref object zoneQp,
		ref object profile)
    {
        // ============================================================
        // INPUT VALIDATION
        // ============================================================
        if (!box.IsValid)
        {
            AddRuntimeMessage(GH_RuntimeMessageLevel.Error, "Invalid box input.");
            return;
        }
        if (terrainCat < 0 || terrainCat > 4)
        {
            AddRuntimeMessage(GH_RuntimeMessageLevel.Error, "Terrain category must be 0-4.");
            return;
        }
        if (qb <= 0)
        {
            AddRuntimeMessage(GH_RuntimeMessageLevel.Error, "qb must be positive.");
            return;
        }
        if (windDir.Length < 0.01)
        {
            AddRuntimeMessage(GH_RuntimeMessageLevel.Error, "Wind direction vector is zero.");
            return;
        }
        if (nMidStrips < 1) nMidStrips = 2;

        // ============================================================
        // EXTRACT DIMENSIONS AND ORIGIN FROM BOX
        // ============================================================
        Point3d[] corners = box.GetCorners();
        Point3d origin = corners[0];

        double b1 = box.X.Length;
        double b2 = box.Y.Length;
        double h  = box.Z.Length;

        if (b1 <= 0 || b2 <= 0 || h <= 0)
        {
            AddRuntimeMessage(GH_RuntimeMessageLevel.Error, "Box has zero or negative dimensions.");
            return;
        }

        Vector3d axisX = box.Plane.XAxis;
        Vector3d axisY = box.Plane.YAxis;
        Vector3d axisZ = box.Plane.ZAxis;

        Point3d boxCenter = origin + 0.5 * b1 * axisX + 0.5 * b2 * axisY + 0.5 * h * axisZ;

        // ============================================================
        // DETERMINE b, d, AND WIND SENSE FROM DIRECTION
        // ============================================================
        double bVal, dVal;
        string dirLabel;
        bool windAlongX = Math.Abs(windDir.X) > Math.Abs(windDir.Y);
        double s;
        double aw_ww;

        if (windAlongX)
        {
            bVal = b2;
            dVal = b1;
            bool positive = windDir.X > 0;
            s = positive ? 1.0 : -1.0;
            aw_ww = positive ? 0.0 : b1;
            dirLabel = positive ? "+X" : "-X";
        }
        else
        {
            bVal = b1;
            dVal = b2;
            bool positive = windDir.Y > 0;
            s = positive ? 1.0 : -1.0;
            aw_ww = positive ? 0.0 : b2;
            dirLabel = positive ? "+Y" : "-Y";
        }

        // ============================================================
        // TERRAIN LOOKUP (Table 4.1)
        // ============================================================
        List<double> z0List = terrainData.Branch(terrainData.Paths[1]);
        List<double> zminList = terrainData.Branch(terrainData.Paths[2]);

        double z0 = z0List[terrainCat];
        double zmin = zminList[terrainCat];
        double kr = 0.19 * Math.Pow(z0 / 0.05, 0.07);

        // ============================================================
        // PEAK VELOCITY PRESSURE AT h (Expression 4.8)
        // ============================================================
        double qpH_val = ComputeQp(h, z0, zmin, kr, qb);

        // ============================================================
        // h/d RATIO AND TABLE 7.1 INTERPOLATION
        // ============================================================
        double hd = h / dVal;

        double[] hdArr = buildingData.Branch(buildingData.Paths[0]).ToArray();
        double[] cpeAArr = buildingData.Branch(buildingData.Paths[1]).ToArray();
        double[] cpeBArr = buildingData.Branch(buildingData.Paths[2]).ToArray();
        double[] cpeCArr = buildingData.Branch(buildingData.Paths[3]).ToArray();
        double[] cpeDArr = buildingData.Branch(buildingData.Paths[4]).ToArray();
        double[] cpeEArr = buildingData.Branch(buildingData.Paths[5]).ToArray();

        if (hdArr.Length > 1 && hdArr[0] > hdArr[hdArr.Length - 1])
        {
            Array.Reverse(hdArr);
            Array.Reverse(cpeAArr);
            Array.Reverse(cpeBArr);
            Array.Reverse(cpeCArr);
            Array.Reverse(cpeDArr);
            Array.Reverse(cpeEArr);
        }

        bool hdExceeds5 = hd > hdArr[hdArr.Length - 1];
        double hdClamped = Math.Max(hdArr[0], Math.Min(hdArr[hdArr.Length - 1], hd));

        double cpeA_val = Interpolate(hdArr, cpeAArr, hdClamped);
        double cpeB_val = Interpolate(hdArr, cpeBArr, hdClamped);
        double cpeC_val = Interpolate(hdArr, cpeCArr, hdClamped);
        double cpeD_val = Interpolate(hdArr, cpeDArr, hdClamped);
        double cpeE_val = Interpolate(hdArr, cpeEArr, hdClamped);

        // ============================================================
        // ZONE GEOMETRY — SIDE FACES (Figure 7.5)
        // ============================================================
        double eVal = Math.Min(bVal, 2.0 * h);

        double wA = eVal / 5.0;
        double wB;
        double wC;

        if (dVal > eVal)
        {
            wB = 4.0 * eVal / 5.0;
            wC = dVal - eVal;
        }
        else
        {
            wB = dVal - wA;
            wC = 0.0;
        }

        bool zoneCExists = wC > 0.0;
        bool zoneBExists = wB > 0.0;

        // ============================================================
        // WINDWARD FACE STRIPS (Figure 7.4)
        // ============================================================
        var dStrips = new List<double[]>();
        int profileType;

        if (h <= bVal)
        {
            profileType = 1;
            dStrips.Add(new double[] { 0, h, h, qpH_val });
        }
        else if (h <= 2.0 * bVal)
        {
            profileType = 2;
            double qpB = ComputeQp(bVal, z0, zmin, kr, qb);
            dStrips.Add(new double[] { 0, bVal, bVal, qpB });
            dStrips.Add(new double[] { bVal, h, h, qpH_val });
        }
        else
        {
            profileType = 3;
            double zBot = bVal;
            double zTop = h - bVal;
            double midH = zTop - zBot;
            double stripH = midH / nMidStrips;

            double qpBot = ComputeQp(bVal, z0, zmin, kr, qb);
            dStrips.Add(new double[] { 0, bVal, bVal, qpBot });

            for (int i = 0; i < nMidStrips; i++)
            {
                double zb = zBot + i * stripH;
                double zt = zBot + (i + 1) * stripH;
                double ze = zt;
                double qpStrip = ComputeQp(ze, z0, zmin, kr, qb);
                dStrips.Add(new double[] { zb, zt, ze, qpStrip });
            }

            dStrips.Add(new double[] { h - bVal, h, h, qpH_val });
        }

        string profileCase;
        if (profileType == 1)
            profileCase = "h <= b : Uniform pressure over full height, ze = h";
        else if (profileType == 2)
            profileCase = "b < h <= 2b : Two strips (lower ze=b, upper ze=h)";
        else
            profileCase = "h > 2b : Bottom strip b, " + nMidStrips + " middle strips, top strip b";

        // ============================================================
        // MESH TREE SETUP
        // ============================================================
        var meshTree = new DataTree<Mesh>();
        var cpeTree = new DataTree<double>();
        var qpTree = new DataTree<double>();

        var pathA = new GH_Path(0);
        var pathB = new GH_Path(1);
        var pathC = new GH_Path(2);
        var pathD = new GH_Path(3);
        var pathE = new GH_Path(4);

        meshTree.EnsurePath(pathA);
        meshTree.EnsurePath(pathB);
        meshTree.EnsurePath(pathC);
        meshTree.EnsurePath(pathD);
        meshTree.EnsurePath(pathE);

        cpeTree.EnsurePath(pathA);
        cpeTree.EnsurePath(pathB);
        cpeTree.EnsurePath(pathC);
        cpeTree.EnsurePath(pathD);
        cpeTree.EnsurePath(pathE);

        qpTree.EnsurePath(pathA);
        qpTree.EnsurePath(pathB);
        qpTree.EnsurePath(pathC);
        qpTree.EnsurePath(pathD);
        qpTree.EnsurePath(pathE);

        double a0 = aw_ww;
        double a1 = aw_ww + s * wA;
        double a2 = aw_ww + s * (wA + wB);
        double aE = aw_ww + s * eVal;
        double aL = aw_ww + s * dVal;

        // ============================================================
        // MESH GENERATION — SIDE FACES (A, B, C), LEEWARD (E), WINDWARD (D)
        // ============================================================
        if (windAlongX)
        {
            // Side face at y = 0
            meshTree.Add(MakeQuadWorld(origin, axisX, axisY, axisZ, boxCenter,
                a0, 0, 0,  a1, 0, 0,  a1, 0, h,  a0, 0, h), pathA);
            if (zoneBExists)
                meshTree.Add(MakeQuadWorld(origin, axisX, axisY, axisZ, boxCenter,
                    a1, 0, 0,  a2, 0, 0,  a2, 0, h,  a1, 0, h), pathB);
            if (zoneCExists)
                meshTree.Add(MakeQuadWorld(origin, axisX, axisY, axisZ, boxCenter,
                    aE, 0, 0,  aL, 0, 0,  aL, 0, h,  aE, 0, h), pathC);

            // Side face at y = b2
            meshTree.Add(MakeQuadWorld(origin, axisX, axisY, axisZ, boxCenter,
                a0, b2, 0,  a1, b2, 0,  a1, b2, h,  a0, b2, h), pathA);
            if (zoneBExists)
                meshTree.Add(MakeQuadWorld(origin, axisX, axisY, axisZ, boxCenter,
                    a1, b2, 0,  a2, b2, 0,  a2, b2, h,  a1, b2, h), pathB);
            if (zoneCExists)
                meshTree.Add(MakeQuadWorld(origin, axisX, axisY, axisZ, boxCenter,
                    aE, b2, 0,  aL, b2, 0,  aL, b2, h,  aE, b2, h), pathC);

            // Leeward E
            meshTree.Add(MakeQuadWorld(origin, axisX, axisY, axisZ, boxCenter,
                aL, 0, 0,  aL, b2, 0,  aL, b2, h,  aL, 0, h), pathE);

            // Windward D strips
            foreach (var strip in dStrips)
            {
                double zb = strip[0];
                double zt = strip[1];
                meshTree.Add(MakeQuadWorld(origin, axisX, axisY, axisZ, boxCenter,
                    a0, 0, zb,  a0, b2, zb,  a0, b2, zt,  a0, 0, zt), pathD);
            }
        }
        else
        {
            // Side face at x = 0
            meshTree.Add(MakeQuadWorld(origin, axisX, axisY, axisZ, boxCenter,
                0, a0, 0,  0, a1, 0,  0, a1, h,  0, a0, h), pathA);
            if (zoneBExists)
                meshTree.Add(MakeQuadWorld(origin, axisX, axisY, axisZ, boxCenter,
                    0, a1, 0,  0, a2, 0,  0, a2, h,  0, a1, h), pathB);
            if (zoneCExists)
                meshTree.Add(MakeQuadWorld(origin, axisX, axisY, axisZ, boxCenter,
                    0, aE, 0,  0, aL, 0,  0, aL, h,  0, aE, h), pathC);

            // Side face at x = b1
            meshTree.Add(MakeQuadWorld(origin, axisX, axisY, axisZ, boxCenter,
                b1, a0, 0,  b1, a1, 0,  b1, a1, h,  b1, a0, h), pathA);
            if (zoneBExists)
                meshTree.Add(MakeQuadWorld(origin, axisX, axisY, axisZ, boxCenter,
                    b1, a1, 0,  b1, a2, 0,  b1, a2, h,  b1, a1, h), pathB);
            if (zoneCExists)
                meshTree.Add(MakeQuadWorld(origin, axisX, axisY, axisZ, boxCenter,
                    b1, aE, 0,  b1, aL, 0,  b1, aL, h,  b1, aE, h), pathC);

            // Leeward E
            meshTree.Add(MakeQuadWorld(origin, axisX, axisY, axisZ, boxCenter,
                0, aL, 0,  b1, aL, 0,  b1, aL, h,  0, aL, h), pathE);

            // Windward D strips
            foreach (var strip in dStrips)
            {
                double zb = strip[0];
                double zt = strip[1];
                meshTree.Add(MakeQuadWorld(origin, axisX, axisY, axisZ, boxCenter,
                    0, a0, zb,  b1, a0, zb,  b1, a0, zt,  0, a0, zt), pathD);
            }
        }

        // ============================================================
        // POPULATE cpe AND qp TREES
        // ============================================================
        int meshCountA = meshTree.Branch(pathA).Count;
        for (int i = 0; i < meshCountA; i++)
        {
            cpeTree.Add(cpeA_val, pathA);
            qpTree.Add(qpH_val, pathA);
        }

        int meshCountB = meshTree.Branch(pathB).Count;
        for (int i = 0; i < meshCountB; i++)
        {
            cpeTree.Add(cpeB_val, pathB);
            qpTree.Add(qpH_val, pathB);
        }

        int meshCountC = meshTree.Branch(pathC).Count;
        for (int i = 0; i < meshCountC; i++)
        {
            cpeTree.Add(cpeC_val, pathC);
            qpTree.Add(qpH_val, pathC);
        }

        int meshCountE = meshTree.Branch(pathE).Count;
        for (int i = 0; i < meshCountE; i++)
        {
            cpeTree.Add(cpeE_val, pathE);
            qpTree.Add(qpH_val, pathE);
        }

        foreach (var strip in dStrips)
        {
            cpeTree.Add(cpeD_val, pathD);
            qpTree.Add(strip[3], pathD);
        }

        // ============================================================
        // BUILD INFO STRING
        // ============================================================
        var sb = new System.Text.StringBuilder();

        sb.AppendLine("========================================");
        sb.AppendLine(" WALL ZONES — EN 1991-1-4 Section 7.2");
        sb.AppendLine("========================================");
        sb.AppendLine();

        sb.AppendLine("--- Box Geometry ---");
        sb.AppendFormat("  Origin          : ({0:F2}, {1:F2}, {2:F2})\n", origin.X, origin.Y, origin.Z);
        sb.AppendFormat("  b1 (along X)    : {0:F2} m\n", b1);
        sb.AppendFormat("  b2 (along Y)    : {0:F2} m\n", b2);
        sb.AppendFormat("  h               : {0:F2} m\n", h);
        sb.AppendLine();

        sb.AppendLine("--- Wind Direction ---");
        sb.AppendFormat("  Direction       : {0}\n", dirLabel);
        sb.AppendFormat("  b (crosswind)   : {0:F2} m\n", bVal);
        sb.AppendFormat("  d (along-wind)  : {0:F2} m\n", dVal);
        sb.AppendLine();

        sb.AppendLine("--- Terrain (Table 4.1) ---");
        sb.AppendFormat("  Category        : {0}\n", terrainCat);
        sb.AppendFormat("  z0              : {0} m\n", z0);
        sb.AppendFormat("  zmin            : {0} m\n", zmin);
        sb.AppendFormat("  kr              : {0:F4}\n", kr);
        sb.AppendLine();

        sb.AppendLine("--- Pressure ---");
        sb.AppendFormat("  qb              : {0:F3} kN/m2\n", qb);
        sb.AppendFormat("  qp(h)           : {0:F3} kN/m2\n", qpH_val);
        sb.AppendLine();

        sb.AppendLine("--- Zone Geometry (Figure 7.5) ---");
        sb.AppendFormat("  h/d             : {0:F3}\n", hd);
        sb.AppendFormat("  e = min(b,2h)   : {0:F2} m\n", eVal);
        sb.AppendFormat("  Zone A width    : e/5   = {0:F2} m\n", wA);
        if (zoneBExists)
            sb.AppendFormat("  Zone B width    : {0}  = {1:F2} m\n",
                dVal > eVal ? "4e/5 " : "d-wA ", wB);
        else
            sb.AppendFormat("  Zone B          : does not exist (wA >= d)\n");
        if (zoneCExists)
            sb.AppendFormat("  Zone C width    : d-e   = {0:F2} m\n", wC);
        else
            sb.AppendFormat("  Zone C          : does not exist (d <= e)\n");
        sb.AppendLine();

        sb.AppendLine("--- Coefficients cpe,10 (Table 7.1) ---");
        sb.AppendFormat("  Zone A          : {0:F2}\n", cpeA_val);
        if (zoneBExists)
            sb.AppendFormat("  Zone B          : {0:F2}\n", cpeB_val);
        else
            sb.AppendFormat("  Zone B          : N/A\n");
        if (zoneCExists)
            sb.AppendFormat("  Zone C          : {0:F2}\n", cpeC_val);
        else
            sb.AppendFormat("  Zone C          : N/A\n");
        sb.AppendFormat("  Zone D          : {0:F2}\n", cpeD_val);
        sb.AppendFormat("  Zone E          : {0:F2}\n", cpeE_val);
        sb.AppendLine();

        sb.AppendLine("--- Windward Profile (Figure 7.4) ---");
        sb.AppendFormat("  {0}\n", profileCase);
        sb.AppendLine();

        sb.AppendLine("--- Zone D Strips ---");
        for (int i = 0; i < dStrips.Count; i++)
        {
            var strip = dStrips[i];
            sb.AppendFormat("  Strip {0}: z = {1:F2} to {2:F2} m, ze = {3:F2} m, qp = {4:F3} kN/m2\n",
                i, strip[0], strip[1], strip[2], strip[3]);
        }
        sb.AppendLine();

        sb.AppendLine("--- Tree Structure ---");
        sb.AppendLine("  {0} Zone A : " + meshTree.Branch(pathA).Count + " meshes");
        sb.AppendLine("  {1} Zone B : " + meshTree.Branch(pathB).Count + " meshes");
        sb.AppendLine("  {2} Zone C : " + meshTree.Branch(pathC).Count + " meshes");
        sb.AppendLine("  {3} Zone D : " + meshTree.Branch(pathD).Count + " meshes");
        sb.AppendLine("  {4} Zone E : " + meshTree.Branch(pathE).Count + " meshes");
        sb.AppendLine();

        if (hdExceeds5)
        {
            sb.AppendLine("WARNING: h/d = " + hd.ToString("F2") + " exceeds Table 7.1 max (5.0).");
            sb.AppendLine("  Coefficients clamped to h/d = 5.0 values.");
            AddRuntimeMessage(GH_RuntimeMessageLevel.Warning,
                "h/d = " + hd.ToString("F2") + " exceeds Table 7.1 range. Clamped to 5.0.");
        }

        if (h < zmin)
        {
            sb.AppendLine("NOTE: Building height h < zmin.");
            sb.AppendLine("  qp evaluated at zmin = " + zmin.ToString("F1") + " m (Clause 4.3.2).");
        }

        sb.AppendLine();
        sb.AppendLine("========================================");
        sb.AppendLine(" ASSUMPTIONS");
        sb.AppendLine("========================================");
        sb.AppendLine();

        sb.AppendLine("  Geometry");
        sb.AppendLine("    - Rectangular enclosed building (Section 7.2)");
        sb.AppendLine("    - Bounding box approximation: real geometry");
        sb.AppendLine("      may differ, zones computed for enclosing rectangle");
        sb.AppendLine("    - Building origin at box corner[0]");
        sb.AppendLine();

        sb.AppendLine("  Wind Climate");
        sb.AppendLine("    - Flat terrain: co(z) = 1.0 (no orography)");
        sb.AppendLine("    - Turbulence factor kI = 1.0 (recommended)");
        sb.AppendLine("    - Air density rho = 1.25 kg/m3 (sea level, in qb)");
        sb.AppendLine("    - No altitude correction applied");
        sb.AppendLine("    - Cardinal wind directions only (no diagonal)");
        sb.AppendLine("    - Perpendicular-to-face governs (Section 7.2)");
        sb.AppendLine();

        sb.AppendLine("  Pressure Profile");
        sb.AppendLine("    - Standard EN logarithmic profile (Cl. 4.3-4.5)");
        sb.AppendLine("    - Not a National Annex variant (e.g. DIN power-law)");
        sb.AppendLine("    - qp(z) = ce(z) * qb");
        sb.AppendLine("    - ce(z) = kr^2 * [ln^2(z/z0) + 7*ln(z/z0)]");
        sb.AppendLine("    - z clamped to max(z, zmin) per Cl. 4.3.2");
        sb.AppendLine("    - Zones A,B,C,E: ze = h (Cl. 7.2.2(1) Note)");
        sb.AppendLine("    - Zone D strips: ze = top of each strip");
        sb.AppendLine();

        sb.AppendLine("  Coefficients");
        sb.AppendLine("    - cpe,10 throughout (loaded area >= 10 m2)");
        sb.AppendLine("    - No cpe,1 correction for small areas");
        sb.AppendLine("    - Linear interpolation of Table 7.1 for D and E");
        sb.AppendLine("    - h/d clamped to range [0.25, 5.0]");
        sb.AppendLine();

        sb.AppendLine("  Zone Geometry");
        sb.AppendLine("    - Side face widths per Figure 7.5");
        sb.AppendLine("    - wB capped to d-wA when d < e (Figure 7.5)");
        sb.AppendLine("    - Middle zone (h>2b) divided into equal strips");
        sb.AppendLine("      (user-specified, not prescribed by code)");
        sb.AppendLine();

        sb.AppendLine("  Not Included");
        sb.AppendLine("    - Structural factor cscd (taken as 1.0)");
        sb.AppendLine("    - Internal pressure cpi (external only)");
        sb.AppendLine("    - Torsional loading (Cl. 7.1.2)");

        // ============================================================
        // ASSIGN OUTPUTS
        // ============================================================
        Info = sb.ToString();
        zoneMeshes = meshTree;
        zoneCpe = cpeTree;
        zoneQp = qpTree;
        profile = profileCase;
    }

    // ============================================================
    // HELPER: Compute qp(z) = ce(z) * qb
    // ============================================================
    private double ComputeQp(double z, double z0, double zmin, double kr, double qb)
    {
        double zEff = Math.Max(z, zmin);
        double lnZ = Math.Log(zEff / z0);
        double ce = kr * kr * (lnZ * lnZ + 7.0 * lnZ);
        return ce * qb;
    }

    // ============================================================
    // HELPER: Create quad mesh, ensure normal points outward from box
    // ============================================================
    private Mesh MakeQuadWorld(
        Point3d origin, Vector3d axX, Vector3d axY, Vector3d axZ,
        Point3d boxCenter,
        double x0, double y0, double z0,
        double x1, double y1, double z1,
        double x2, double y2, double z2,
        double x3, double y3, double z3)
    {
        Point3d p0 = LocalToWorld(origin, axX, axY, axZ, x0, y0, z0);
        Point3d p1 = LocalToWorld(origin, axX, axY, axZ, x1, y1, z1);
        Point3d p2 = LocalToWorld(origin, axX, axY, axZ, x2, y2, z2);
        Point3d p3 = LocalToWorld(origin, axX, axY, axZ, x3, y3, z3);

        var m = new Mesh();
        m.Vertices.Add(p0);
        m.Vertices.Add(p1);
        m.Vertices.Add(p2);
        m.Vertices.Add(p3);
        m.Faces.AddFace(0, 1, 2, 3);
        m.Normals.ComputeNormals();

        Point3d faceCenter = new Point3d(
            (p0.X + p1.X + p2.X + p3.X) / 4.0,
            (p0.Y + p1.Y + p2.Y + p3.Y) / 4.0,
            (p0.Z + p1.Z + p2.Z + p3.Z) / 4.0);

        Vector3d outward = faceCenter - boxCenter;
        Vector3d normal = m.Normals[0];

        if (Vector3d.Multiply(outward, normal) < 0)
        {
            m.Flip(true, true, true);
        }

        return m;
    }

    private Point3d LocalToWorld(
        Point3d origin, Vector3d axX, Vector3d axY, Vector3d axZ,
        double x, double y, double z)
    {
        return origin + x * axX + y * axY + z * axZ;
    }

    // ============================================================
    // LINEAR INTERPOLATION (ascending x array)
    // ============================================================
    private double Interpolate(double[] xs, double[] ys, double x)
    {
        if (x <= xs[0]) return ys[0];
        if (x >= xs[xs.Length - 1]) return ys[ys.Length - 1];

        for (int i = 0; i < xs.Length - 1; i++)
        {
            if (x >= xs[i] && x <= xs[i + 1])
            {
                double t = (x - xs[i]) / (xs[i + 1] - xs[i]);
                return ys[i] + t * (ys[i + 1] - ys[i]);
            }
        }
        return ys[ys.Length - 1];
    }
}
# ---------- end c_script ----------
meshes = Panel(c_script.zoneMeshes)
zonemesheswalls = Mesh(c_script.zoneMeshes)
zonecpewalls = Number(c_script.zoneCpe)
zoneqpwalls = Number(c_script.zoneQp)
qp_kn_m2 = Panel(c_script.zoneQp)
zonemesheswalls_2 = Mesh(zonemesheswalls)
zonecpewalls_2 = Number(zonecpewalls)
zoneqpwalls_2 = Number(zoneqpwalls)
cpe = Panel(c_script.zoneCpe)
panel_5 = Panel(c_script.profile)
wind_loading_information = Panel(c_script.Info)

# ----
building_data_flat_roof_2 = Number(building_data_flat_roof)
direction_vector_3 = Vector(direction_vector)
roof_height_h_2 = Number(roof_height_h)
building_box_4 = Box(building_box)
c_script_2 = CSharpScript(
    buildingBox=building_box_4,
    windDirections=direction_vector_3,
    h=roof_height_h_2,
    roofEdgeType="0",
    flatRoofData=building_data_flat_roof_2)  # -> out, zonePlans, zonePlanMeshes, zoneLabels, zoneCpe10, zoneCpe1, info; inputs buildingBox: Box, windDirections: list of Vector3d, h: Double, roofEdgeType: Int32, flatRoofData: tree of Double
# ---------- c_script_2: C# ----------
// #region using
using System;
using System.Collections.Generic;
using System.Drawing;
using System.Linq;
using System.IO;
using Grasshopper;
using Grasshopper.Kernel;
using Grasshopper.Kernel.Data;
using Grasshopper.Kernel.Types;
using Rhino;
using Rhino.Collections;
using Rhino.Geometry;
using Rhino.DocObjects;
// #endregion

public class Script_Instance : GH_ScriptInstance
{
    #region Notes
    /*
     * EN 1991-1-4 §7.2.3 — Flat Roof Wind Pressure Zones (v02)
     *
     * Sharp eaves only (roofEdgeType = 0). For parapet/curved/mansard later,
     * pre-interpolate Table 7.2 upstream and feed via flatRoofData; the
     * component itself does not own Table 7.2.
     *
     * CONVENTION: buildingBox is the building's rectangular wind envelope —
     * the EC1 §7.2 footprint, not the actual roof outline. Must enclose the
     * real roof. Oversizing is harmless: overhanging zone meshes are ignored
     * downstream during face classification. Undersizing leaves real roof
     * area uncovered (code violation) — user's responsibility.
     *
     * Algorithm (per wind direction):
     *   1. Anchor a local frame on the box's top face: X = windDir (XY-projected),
     *      Y = Z × X, origin at top of box.Plane.Origin.
     *   2. Project the 4 top corners into local (x,y); bbox gives b, d.
     *   3. e = min(b, 2h).
     *   4. Build zone rectangles per Figure 7.6 (sharp eaves):
     *        F1, F2 : e/10 × e/4   at windward corners
     *        G      : e/10 × (b − e/2)
     *        H      : (e/2 − e/10) × b
     *        I      : (d − e/2) × b   — emitted twice (I_pos, I_neg)
     *      Clamp for degenerate cases (d ≤ e/10, d ≤ e/2, b ≤ e/2).
     *   5. Each zone → 4 world points → polyline + single quad-face mesh.
     *   6. Emit cpe10, cpe1 from flatRoofData by zone.
     *
     * Output paths: {dirIndex; zoneIndex}, fixed mapping:
     *   0 F1   1 F2   2 G   3 H   4 I_pos   5 I_neg
     * Sparse: clamped-out zones simply omit their path.
     */
    #endregion

    private void RunScript(
		Box buildingBox,
		List<Vector3d> windDirections,
		double h,
		int roofEdgeType,
		DataTree<double> flatRoofData,
		ref object zonePlans,
		ref object zonePlanMeshes,
		ref object zoneLabels,
		ref object zoneCpe10,
		ref object zoneCpe1,
		ref object info)
    {
        // -------- Typed local trees --------
        var zonePlansT      = new DataTree<Curve>();
        var zonePlanMeshesT = new DataTree<Mesh>();
        var zoneLabelsT     = new DataTree<string>();
        var zoneCpe10T      = new DataTree<double>();
        var zoneCpe1T       = new DataTree<double>();

        // -------- Validate --------
        if (!buildingBox.IsValid)
            throw new ArgumentException("buildingBox is required and must be valid.");
        if (windDirections == null || windDirections.Count == 0)
            throw new ArgumentException("windDirections is required.");
        if (h <= 0)
            throw new ArgumentException("h must be positive.");
        if (roofEdgeType != 0)
            throw new NotImplementedException(
                "roofEdgeType = " + roofEdgeType + " not implemented. Only sharp eaves (0) supported.");
        if (flatRoofData == null || flatRoofData.BranchCount != 5)
            throw new ArgumentException(
                "flatRoofData must be a DataTree with 5 branches (F, G, H, I_suction, I_pressure), each [cpe10, cpe1].");
        for (int i = 0; i < 5; i++)
            if (flatRoofData.Branch(i).Count != 2)
                throw new ArgumentException(
                    "flatRoofData branch " + i + " must contain 2 values [cpe10, cpe1].");

        // -------- Top face anchor --------
        Point3d topOrigin = buildingBox.Plane.Origin
                        + buildingBox.Plane.ZAxis * buildingBox.Z.T1;
        Point3d[] all = buildingBox.GetCorners();
        Point3d[] topCorners = new[] { all[4], all[5], all[6], all[7] };

        const double DEG = 1e-9;

        // ============================================================
        // BUILD INFO STRING (header + global sections)
        // ============================================================
        var sb = new System.Text.StringBuilder();

        sb.AppendLine("========================================");
        sb.AppendLine(" FLAT ROOF ZONES — EN 1991-1-4 §7.2.3");
        sb.AppendLine("========================================");
        sb.AppendLine();

        sb.AppendLine("--- Box Geometry ---");
        sb.AppendFormat("  Origin          : ({0:F2}, {1:F2}, {2:F2})\n",
            buildingBox.Plane.Origin.X, buildingBox.Plane.Origin.Y, buildingBox.Plane.Origin.Z);
        sb.AppendFormat("  Bx (along X)    : {0:F2} m\n", buildingBox.X.Length);
        sb.AppendFormat("  By (along Y)    : {0:F2} m\n", buildingBox.Y.Length);
        sb.AppendFormat("  Bz (along Z)    : {0:F2} m\n", buildingBox.Z.Length);
        sb.AppendFormat("  h (input)       : {0:F2} m\n", h);
        sb.AppendLine();

        sb.AppendLine("--- Edge Type ---");
        sb.AppendFormat("  roofEdgeType    : {0} (sharp eaves)\n", roofEdgeType);
        sb.AppendLine();

        sb.AppendLine("--- Coefficients (from flatRoofData, Table 7.2) ---");
        sb.AppendLine("                          cpe,10    cpe,1");
        sb.AppendFormat("  Zone F                : {0,6:F2}   {1,6:F2}\n",
            flatRoofData.Branch(0)[0], flatRoofData.Branch(0)[1]);
        sb.AppendFormat("  Zone G                : {0,6:F2}   {1,6:F2}\n",
            flatRoofData.Branch(1)[0], flatRoofData.Branch(1)[1]);
        sb.AppendFormat("  Zone H                : {0,6:F2}   {1,6:F2}\n",
            flatRoofData.Branch(2)[0], flatRoofData.Branch(2)[1]);
        sb.AppendFormat("  Zone I_suction        : {0,6:F2}   {1,6:F2}\n",
            flatRoofData.Branch(3)[0], flatRoofData.Branch(3)[1]);
        sb.AppendFormat("  Zone I_pressure       : {0,6:F2}   {1,6:F2}\n",
            flatRoofData.Branch(4)[0], flatRoofData.Branch(4)[1]);
        sb.AppendLine();

        // -------- Wind direction loop --------
        for (int d_i = 0; d_i < windDirections.Count; d_i++)
        {
            Vector3d wd = windDirections[d_i];
            wd.Z = 0;
            if (!wd.Unitize())
            {
                AddRuntimeMessage(GH_RuntimeMessageLevel.Warning,
                    "Wind direction at index " + d_i + " could not be unitized — skipped.");
                continue;
            }

            // Angle for label
            double angleDeg = Math.Atan2(wd.Y, wd.X) * 180.0 / Math.PI;
            if (angleDeg < 0) angleDeg += 360.0;
            string dirLabel = string.Format("({0:F2}, {1:F2}), θ = {2:F1}°",
                wd.X, wd.Y, angleDeg);

            // Local frame
            Vector3d xAxis = wd;
            Vector3d yAxis = Vector3d.CrossProduct(Vector3d.ZAxis, xAxis);
            yAxis.Unitize();

            // Project top corners into local (x, y)
            double xmin = double.MaxValue, xmax = double.MinValue;
            double ymin = double.MaxValue, ymax = double.MinValue;
            for (int k = 0; k < 4; k++)
            {
                Vector3d v = topCorners[k] - topOrigin;
                double lx = v * xAxis;
                double ly = v * yAxis;
                if (lx < xmin) xmin = lx;
                if (lx > xmax) xmax = lx;
                if (ly < ymin) ymin = ly;
                if (ly > ymax) ymax = ly;
            }

            double b      = ymax - ymin;
            double dDepth = xmax - xmin;
            double e      = Math.Min(b, 2.0 * h);
            double e10    = e / 10.0;
            double e4     = e / 4.0;
            double e2     = e / 2.0;

            double xF = Math.Min(xmin + e10, xmax);
            double xH = Math.Min(xmin + e2,  xmax);
            double yF1 = ymin + e4;
            double yF2 = ymax - e4;

            // Zone dimensions for info
            double wG = b - e2;                                  // G width (always > 0)
            bool zoneH_exists = (dDepth - e10) > DEG;
            bool zoneI_exists = (dDepth - e2)  > DEG;
            double dH = Math.Min(e2, dDepth) - e10;              // H depth (clamped)
            double dI = dDepth - e2;                             // I depth

            // ============================================================
            // INFO: per-direction section
            // ============================================================
            sb.AppendFormat("--- Wind Direction [{0}] ---\n", d_i);
            sb.AppendFormat("  Direction       : {0}\n", dirLabel);
            sb.AppendFormat("  b (crosswind)   : {0:F2} m\n", b);
            sb.AppendFormat("  d (along-wind)  : {0:F2} m\n", dDepth);
            sb.AppendLine();

            sb.AppendLine("  Zone Geometry (Figure 7.6)");
            sb.AppendFormat("    e = min(b,2h)   : {0:F2} m\n", e);
            sb.AppendFormat("    e/10            : {0:F2} m   (F, G depth)\n", e10);
            sb.AppendFormat("    e/4             : {0:F2} m   (F width)\n", e4);
            sb.AppendFormat("    e/2             : {0:F2} m   (H/I split)\n", e2);
            sb.AppendLine();

            sb.AppendLine("  Zone Dimensions (depth × width)");
            sb.AppendFormat("    F1              : {0:F2} × {1:F2} m\n", e10, e4);
            sb.AppendFormat("    F2              : {0:F2} × {1:F2} m\n", e10, e4);
            sb.AppendFormat("    G               : {0:F2} × {1:F2} m\n", e10, wG);
            if (zoneH_exists)
                sb.AppendFormat("    H               : {0:F2} × {1:F2} m\n", dH, b);
            else
                sb.AppendLine ("    H               : does not exist (d ≤ e/10)");
            if (zoneI_exists)
            {
                sb.AppendFormat("    I_suction       : {0:F2} × {1:F2} m\n", dI, b);
                sb.AppendFormat("    I_pressure      : {0:F2} × {1:F2} m\n", dI, b);
            }
            else
            {
                sb.AppendLine ("    I               : does not exist (d ≤ e/2)");
            }
            sb.AppendLine();

            // Runtime warnings for unusual cases
            if (!zoneH_exists)
            {
                AddRuntimeMessage(GH_RuntimeMessageLevel.Warning,
                    "Wind direction [" + d_i + "]: d (" + dDepth.ToString("F2") +
                    ") ≤ e/10 (" + e10.ToString("F2") + "). Only F+G zones generated.");
            }

            // -------- Emit zones --------
            Emit(0, "F1",          0, xmin,        ymin, xF,   yF1,
                topOrigin, xAxis, yAxis, d_i, flatRoofData,
                zonePlansT, zonePlanMeshesT, zoneLabelsT, zoneCpe10T, zoneCpe1T);

            Emit(1, "F2",          0, xmin,        yF2,  xF,   ymax,
                topOrigin, xAxis, yAxis, d_i, flatRoofData,
                zonePlansT, zonePlanMeshesT, zoneLabelsT, zoneCpe10T, zoneCpe1T);

            Emit(2, "G",           1, xmin,        yF1,  xF,   yF2,
                topOrigin, xAxis, yAxis, d_i, flatRoofData,
                zonePlansT, zonePlanMeshesT, zoneLabelsT, zoneCpe10T, zoneCpe1T);

            if (zoneH_exists)
                Emit(3, "H",       2, xmin + e10,  ymin, xH,   ymax,
                    topOrigin, xAxis, yAxis, d_i, flatRoofData,
                    zonePlansT, zonePlanMeshesT, zoneLabelsT, zoneCpe10T, zoneCpe1T);

            if (zoneI_exists)
            {
                Emit(4, "I_suction",  3, xmin + e2, ymin, xmax, ymax,
                    topOrigin, xAxis, yAxis, d_i, flatRoofData,
                    zonePlansT, zonePlanMeshesT, zoneLabelsT, zoneCpe10T, zoneCpe1T);

                Emit(5, "I_pressure", 4, xmin + e2, ymin, xmax, ymax,
                    topOrigin, xAxis, yAxis, d_i, flatRoofData,
                    zonePlansT, zonePlanMeshesT, zoneLabelsT, zoneCpe10T, zoneCpe1T);
            }
        }

        // ============================================================
        // INFO: tree structure summary
        // ============================================================
        sb.AppendLine("--- Output Tree Structure ---");
        sb.AppendLine("  Path = {dirIndex; zoneIndex}");
        sb.AppendLine("  Zone index : 0=F1, 1=F2, 2=G, 3=H, 4=I_suction, 5=I_pressure");
        sb.AppendLine("  Sparse: paths omitted when zone clamps out.");
        sb.AppendLine();

        // ============================================================
        // ASSUMPTIONS
        // ============================================================
        sb.AppendLine("========================================");
        sb.AppendLine(" ASSUMPTIONS");
        sb.AppendLine("========================================");
        sb.AppendLine();

        sb.AppendLine("  Geometry");
        sb.AppendLine("    - Rectangular building envelope (§7.2.3)");
        sb.AppendLine("    - buildingBox approximates the real footprint:");
        sb.AppendLine("      zones computed for the enclosing rectangle.");
        sb.AppendLine("    - Box MUST enclose real roof; undersizing leaves");
        sb.AppendLine("      real roof area uncovered (code violation).");
        sb.AppendLine("    - Origin at buildingBox.Plane.Origin");
        sb.AppendLine();

        sb.AppendLine("  Roof");
        sb.AppendLine("    - Flat roof per §7.2.3(1): slope α within ±5°");
        sb.AppendLine("    - Sharp eaves only (roofEdgeType = 0)");
        sb.AppendLine("    - Parapet / curved / mansard reserved (1, 2, 3);");
        sb.AppendLine("      not implemented in this version.");
        sb.AppendLine();

        sb.AppendLine("  Wind");
        sb.AppendLine("    - Direction projected to horizontal (Z ignored)");
        sb.AppendLine("    - Wind perpendicular to faces governs (§7.2)");
        sb.AppendLine("    - Cardinal directions intended; oblique winds");
        sb.AppendLine("      produce conservative bbox envelope.");
        sb.AppendLine("    - National Annex variations to cpe handled");
        sb.AppendLine("      UPSTREAM via flatRoofData input.");
        sb.AppendLine();

        sb.AppendLine("  Pressure / Coefficients");
        sb.AppendLine("    - Component is qp-agnostic (no pressure math)");
        sb.AppendLine("    - ze = h across the whole roof (§7.2.3(2))");
        sb.AppendLine("    - Both cpe,10 and cpe,1 emitted per zone");
        sb.AppendLine("    - Loaded-area interpolation (§7.2.1) handled");
        sb.AppendLine("      DOWNSTREAM after mesh face classification.");
        sb.AppendLine();

        sb.AppendLine("  Zone Geometry (Figure 7.6, sharp eaves)");
        sb.AppendLine("    - e = min(b, 2h)");
        sb.AppendLine("    - F1, F2 : e/10 × e/4 at windward corners");
        sb.AppendLine("    - G      : e/10 × (b − e/2) between F1 and F2");
        sb.AppendLine("    - H      : (e/2 − e/10) × b behind F + G");
        sb.AppendLine("    - I      : (d − e/2) × b, two cases:");
        sb.AppendLine("               I_suction (cpe < 0)");
        sb.AppendLine("               I_pressure (cpe > 0)");
        sb.AppendLine("    - F1/F2 never merge: e ≤ b ⇒ G has +ve width");
        sb.AppendLine("    - I vanishes when d ≤ e/2 (low squat buildings)");
        sb.AppendLine("    - Degenerate zones omitted from output trees");
        sb.AppendLine();

        sb.AppendLine("  Sign Convention");
        sb.AppendLine("    - cpe < 0  →  suction (uplift, away from roof)");
        sb.AppendLine("    - cpe > 0  →  pressure (downforce, toward roof)");
        sb.AppendLine("    - F, G, H always suction in Table 7.2");
        sb.AppendLine("    - I has both cases (±0.2 sharp eaves)");
        sb.AppendLine();

        sb.AppendLine("  Mesh Output");
        sb.AppendLine("    - Each zone is a single quad face (4 verts, 1 face)");
        sb.AppendLine("    - No subdivision; consistent face count per zone");
        sb.AppendLine("    - Auxiliary use (preview, area); load application");
        sb.AppendLine("      uses real roof mesh classified DOWNSTREAM.");
        sb.AppendLine();

        sb.AppendLine("  Not Included");
        sb.AppendLine("    - Velocity pressure qp(ze), basic pressure qb");
        sb.AppendLine("    - Internal pressure cpi (§7.2.9)");
        sb.AppendLine("    - Friction forces (§7.5)");
        sb.AppendLine("    - Structural factor cscd");
        sb.AppendLine("    - Load combinations / partial factors");
        sb.AppendLine("    - Tilted (non-horizontal) buildings");
        sb.AppendLine("    - Loaded area interpolation (§7.2.1)");

        // -------- Hand out --------
        zonePlans      = zonePlansT;
        zonePlanMeshes = zonePlanMeshesT;
        zoneLabels     = zoneLabelsT;
        zoneCpe10      = zoneCpe10T;
        zoneCpe1       = zoneCpe1T;
        info           = sb.ToString();
    }

    // -------- Helper: build & emit one zone (single-quad mesh) --------
    private static void Emit(
        int z_i, string label, int dataIdx,
        double x0, double y0, double x1, double y1,
        Point3d origin, Vector3d xAxis, Vector3d yAxis,
        int d_i, DataTree<double> flatRoofData,
        DataTree<Curve> zonePlansT,
        DataTree<Mesh> zonePlanMeshesT,
        DataTree<string> zoneLabelsT,
        DataTree<double> zoneCpe10T,
        DataTree<double> zoneCpe1T)
    {
        if (x1 - x0 < 1e-9 || y1 - y0 < 1e-9) return;

        Point3d p0 = origin + xAxis * x0 + yAxis * y0;
        Point3d p1 = origin + xAxis * x1 + yAxis * y0;
        Point3d p2 = origin + xAxis * x1 + yAxis * y1;
        Point3d p3 = origin + xAxis * x0 + yAxis * y1;

        var path = new GH_Path(d_i, z_i);

        // Outline polyline
        var poly = new Polyline(new[] { p0, p1, p2, p3, p0 });
        zonePlansT.Add(poly.ToPolylineCurve(), path);

        // Single quad face mesh
        var m = new Mesh();
        m.Vertices.Add(p0);
        m.Vertices.Add(p1);
        m.Vertices.Add(p2);
        m.Vertices.Add(p3);
        m.Faces.AddFace(0, 1, 2, 3);
        zonePlanMeshesT.Add(m, path);

        // Labels & cpe
        zoneLabelsT.Add(label, path);
        zoneCpe10T.Add(Math.Round(flatRoofData.Branch(dataIdx)[0], 3), path);
        zoneCpe1T .Add(Math.Round(flatRoofData.Branch(dataIdx)[1], 3), path);
    }
}
# ---------- end c_script_2 ----------
zoneplanmeshes_mesh = Mesh(c_script_2.zonePlanMeshes)
zonelabels_text = Text(c_script_2.zoneLabels)
zoneplans_crv = Curve(c_script_2.zonePlans)
zonecpe10 = Number(c_script_2.zoneCpe10)
zonecpe1 = Number(c_script_2.zoneCpe1)
zoneplanmeshes_mesh_2 = Mesh(zoneplanmeshes_mesh)
zonelabels_text_2 = Text(zonelabels_text)
zoneplans_crv_2 = Curve(zoneplans_crv)
zonecpe10_2 = Number(zonecpe10)
zonecpe1_2 = Number(zonecpe1)
panel_6 = Panel(c_script_2.info)

# ---- group: USE qp ZONE E for Roof Loading
zoneqpwalls_3 = Number(zoneqpwalls)
split_15 = SplitTree(Data=zoneqpwalls_3, Masks=flatten("{4}"))  # -> Positive, Negative
qpatroof = Number(split_15.Positive)

# ----
qpatroof_2 = Number(qpatroof)

# ---- group: Preparation of MESHES for loading
mesh_loading_density = ValueList({"0.10m": 0.10, "0.25m": 0.25, "0.50m": 0.50, "0.75m": 0.75, "1.00m": 1.00, "1.50m": 1.50}, selected="0.50m")
zonemeshesroof = Mesh(zoneplanmeshes_mesh)
cluster_4 = Cluster_4(zonemeshes=zonemeshesroof, meshtargetsize=mesh_loading_density)
loadingmeshesroof = Mesh(cluster_4)

mesh_loading_density_2 = ValueList({"0.10m": 0.10, "0.25m": 0.25, "0.50m": 0.50, "0.75m": 0.75, "1.00m": 1.00, "1.50m": 1.50}, selected="0.50m")
zonemesheswalls_3 = Mesh(zonemesheswalls)
cluster_5 = Cluster_4(zonemeshes=zonemesheswalls_3, meshtargetsize=mesh_loading_density_2)
loadingmeshes = Mesh(cluster_5)

# ----
loadingmesheswalls = Mesh(loadingmeshes)
loadingmeshesroof_2 = Mesh(loadingmeshesroof)

# ---- group: VISUALISE ROOF LOADS
load_visualisation_2 = Integer(load_visualisation)
zonemeshes = Mesh(c_script_2.zonePlans)
zonelabels_text_3 = Text(zonelabels_text)
qpatroof_3 = Number(split_15.Positive)
building_box_5 = Box(building_box)
roof_height_h_3 = Number(roof_height_h)
direction_vector_4 = Vector(direction_vector)
mesh_colour = ColourSwatch(SwatchColor=RGBA(231, 255, 133, 50))
zonecperoof = Number(c_script_2.zoneCpe10)
load_view_offset = Slider(10, range=0..20)
load_view_scale = Slider(2, range=0.5..10)
vector_view_offset = Slider(20, range=0..20)
vector_view_scale = Slider(10, range=0..10)
edge_colour = ColourSwatch(SwatchColor=RGBA(157, 255, 133, 157))
filter_2 = StreamFilter(Gate=load_visualisation_2, Stream1=zonemeshes)
cluster_6 = Cluster_5(
    zonelabels=zonelabels_text_3,
    zonemeshes=filter_2,
    zonecpe=zonecperoof,
    zoneqp=qpatroof_3,
    loadviewoffset=load_view_offset,
    loadviewscale=load_view_scale,
    bounding_box=building_box_5,
    roof_height_h=roof_height_h_3,
    direction_vector=direction_vector_4,
    vectorviewoffset=vector_view_offset,
    vectorviewscale=vector_view_scale,
    edgecolour=edge_colour,
    meshcolour=mesh_colour)  # -> zonelabellocation_2, zonelabels_4, zoneoutlines_2, loadvectorlocation_2, loadvector_2, directionvectorlocation_2, directionvector_2, zonemesh_2, edgecolour_4, meshcolour_4
dot = AnnotationDot(Location=cluster_6.zonelabellocation_2, PrimaryText=graft(cluster_6.zonelabels_4))  # -> AnnotationDot, Location, PrimaryText, TextHeight
preview = CustomPreview(Geometry=cluster_6.zoneoutlines_2, Material=cluster_6.edgecolour_4)
vdisex = VectorDisplayEx(Point=cluster_6.loadvectorlocation_2, Vector=cluster_6.loadvector_2, Colour=cluster_6.edgecolour_4, Width=2)
vdisex_2 = VectorDisplayEx(Point=cluster_6.directionvectorlocation_2, Vector=cluster_6.directionvector_2, Colour=RGB(0, 0, 0), Width=2)
preview_2 = CustomPreview(Geometry=cluster_6.zonemesh_2, Material=cluster_6.meshcolour_4)

# ---- group: VISUALISE WALL LOADS
load_visualisation_3 = Integer(load_visualisation)
zonemesheswalls_4 = Mesh(zonemesheswalls)
zonecpewalls_3 = Number(zonecpewalls)
zoneqpwalls_4 = Number(zoneqpwalls)
load_view_offset_2 = Slider(10, range=0..20)
building_box_6 = Box(building_box)
roof_height_h_4 = Number(roof_height_h)
vector_view_offset_2 = Slider(20, range=0..20)
vector_view_scale_2 = Slider(10, range=0..10)
edge_colour_2 = ColourSwatch(SwatchColor=RGBA(157, 255, 133, 157))
panel_7 = Panel("""A
B
C
D
E""")
load_view_scale_2 = Slider(2, range=0.5..10)
direction_vector_5 = Vector(direction_vector)
mesh_colour_2 = ColourSwatch(SwatchColor=RGBA(231, 255, 133, 50))
filter_3 = StreamFilter(Gate=load_visualisation_3, Stream1=zonemesheswalls_4)
cluster_7 = Cluster_5(
    zonelabels=panel_7,
    zonemeshes=filter_3,
    zonecpe=zonecpewalls_3,
    zoneqp=zoneqpwalls_4,
    loadviewoffset=load_view_offset_2,
    loadviewscale=load_view_scale_2,
    bounding_box=building_box_6,
    roof_height_h=roof_height_h_4,
    direction_vector=direction_vector_5,
    vectorviewoffset=vector_view_offset_2,
    vectorviewscale=vector_view_scale_2,
    edgecolour=edge_colour_2,
    meshcolour=mesh_colour_2)  # -> zonelabellocation_2, zonelabels_4, zoneoutlines_2, loadvectorlocation_2, loadvector_2, directionvectorlocation_2, directionvector_2, zonemesh_2, edgecolour_4, meshcolour_4
dot_2 = AnnotationDot(Location=cluster_7.zonelabellocation_2, PrimaryText=graft(cluster_7.zonelabels_4))  # -> AnnotationDot, Location, PrimaryText, TextHeight
preview_3 = CustomPreview(Geometry=cluster_7.zoneoutlines_2, Material=cluster_7.edgecolour_4)
vdisex_3 = VectorDisplayEx(Point=cluster_7.loadvectorlocation_2, Vector=cluster_7.loadvector_2, Colour=cluster_7.edgecolour_4, Width=2)
vdisex_4 = VectorDisplayEx(Point=cluster_7.directionvectorlocation_2, Vector=cluster_7.directionvector_2, Colour=RGB(0, 0, 0), Width=2)
preview_4 = CustomPreview(Geometry=cluster_7.zonemesh_2, Material=cluster_7.meshcolour_4)

# ---- group: Define Load Combinations
matselect = MaterialSelectionKaramba3D(Colour=ColourSwatch(SwatchColor=RGB(191, 133, 46)), menu=[dropdown(1), dropdown(5), dropdown(3)])
matselect_2 = MaterialSelectionKaramba3D(Colour=ColourSwatch(SwatchColor=RGB(51, 46, 191)), menu=[dropdown(1), dropdown(1), dropdown(4)])
matselect_3 = MaterialSelectionKaramba3D(Colour=ColourSwatch(SwatchColor=RGB(94, 191, 46)), menu=[dropdown(1), dropdown(1), dropdown(3)])
disassemble = DisassembleMaterialKaramba3D(Material=matselect_3)  # -> Material, TypeOfMaterial, FamilyNameOfMaterial, NameOfMaterial, ElemIdentifiers, Colour, YoungsModulusKNCm²Dir12, InPlaneShearModulus_kN_cm²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
resistance_kn_cm2 = Slider(110, range=0..200)
neg = Negative(Value=resistance_kn_cm2)
matprops = MaterialPropertiesKaramba3D(
    FamilyOfMaterial=disassemble.FamilyNameOfMaterial,
    Name=disassemble.NameOfMaterial,
    Colour=disassemble.Colour,
    YoungsModulus_kN_cm²=disassemble.YoungsModulusKNCm²Dir12,
    InPlaneShearModulus_kN_cm²=disassemble.InPlaneShearModulus_kN_cm²,
    TransverseShearModulus_kN_cm²=disassemble.TransverseShearModulusKNCm²Dir12,
    SpecificWeight_kN_m³=disassemble.SpecificWeight_kN_m³,
    CoefficientOfThermalExpansion_1=disassemble.CoefficientOfThermalExpansion1Dir12,
    TensileStrength_kN_cm²=resistance_kn_cm2,
    CompressiveStrength_kN_cm²=neg,
    StrengthHypothesis=disassemble.StrengthHypothesis,
    mode="Isotrop")
mat_glulam = MaterialKaramba3D(matselect)
mat_cable = MaterialKaramba3D(matprops)
mat_steel = MaterialKaramba3D(matselect_2)

# ---- group: ELEM: CABLES
number_slider_2 = Slider(6, range=0..10)
number_slider_3 = Slider(4, range=0..10)
mat_cable_2 = MaterialKaramba3D(mat_cable)
mat_cable_3 = MaterialKaramba3D(mat_cable)
crosec = CrossSectionKaramba3D(
    FamilyNameOfCrossSection="DefaultCroSec",
    Material=mat_cable_2,
    Diameter_cm=number_slider_2,
    WallThickness_cm=expr("x/2", number_slider_2),
    mode="Circular Hollow")
crosec_2 = CrossSectionKaramba3D(
    FamilyNameOfCrossSection="DefaultCroSec",
    Material=mat_cable_3,
    Diameter_cm=number_slider_3,
    WallThickness_cm=expr("x/2", number_slider_3),
    mode="Circular Hollow")
bracing_diagonals_truss_2 = Line(flatten(bracing_diagonals_truss))
bracing_diagonals_wall_2 = Line(flatten(bracing_diagonals_wall))
bottom_chord_cable_2 = Line(flatten(bottom_chord_cable))
bending_toggle = BooleanToggle(False)
entwine_5 = Entwine(
    Branch0X=bottom_chord_cable_2,
    Branch1X=bracing_diagonals_truss_2,
    Branch2X=bracing_diagonals_wall_2,
    FlattenInputs=False)  # -> simplify(Result)
entwine_6 = Entwine(Branch0X="Cable", Branch1X="Bracing Diagonals Truss", Branch2X="Bracing Diagonals", FlattenInputs=False)  # -> simplify(Result)
entwine_7 = Entwine(Branch0X=crosec, Branch1X=crosec_2, Branch2X=crosec_2, FlattenInputs=False)  # -> simplify(Result)
lineelem = CreateLinearElementKaramba3D(
    Line=entwine_5,
    Identifier=entwine_6,
    CrossSection=entwine_7,
    LimitDistance_m=0.005,
    BucklingLengthY_m=-1,
    BucklingLengthZ_m=-1,
    BucklingLengthLT_m=-1,
    Bending=bending_toggle,
    ToPolylineMaxAngle=0.25,
    ToPolylineTolerance=0.1,
    ToPolylineMaxEdgeLength=0.25,
    New=True,
    Remove=True,
    mode="LineToBeam",
    GuidGeneratorSeed=-789232578)  # -> Element, Points, Info

# ---- group: LOADS: WIND ROOF, SDL, LL, CABLE PRESTRESS
sdl_kn_m2 = Slider(-1, range=-3..0)
ll_kn_m2 = Slider(-0.4, range=-3..0)

strain_truss_cable_mm_m = Slider(-1, range=-20..20)
strain_bracing_cables_mm_m = Slider(-0.5, range=-20..20)

loadingmeshesroof_3 = Mesh(loadingmeshesroof)
zonecpe10_3 = Number(zonecpe10)
qpatroof_4 = Number(qpatroof)
loadingmeshesroof_4 = Mesh(loadingmeshesroof)
split_16 = SplitTree(Data=zonecpe10_3, Masks=flatten("{0;5}"))  # -> Positive, Negative
split_17 = SplitTree(Data=loadingmeshesroof_3, Masks=flatten("{0;5}"))  # -> Positive, Negative
split_18 = SplitTree(Data=zonecpe10_3, Masks=flatten("{0;4}"))  # -> Positive, Negative
split_19 = SplitTree(Data=loadingmeshesroof_3, Masks=flatten("{0;4}"))  # -> Positive, Negative
multiplication = Multiplication(A=qpatroof_4, B=split_16.Negative)
multiplication_2 = Multiplication(A=qpatroof_4, B=split_18.Negative)
split_20 = SplitTree(Data=loadingmeshesroof_4, Masks=flatten("{0;5}"))  # -> Positive, Negative
neg_2 = Negative(Value=multiplication)
neg_3 = Negative(Value=multiplication_2)
Z = UnitZ(Factor=neg_2)
Z_2 = UnitZ(Factor=neg_3)
number_slider_4 = Slider(10, range=0..10)
clean = CombineClean(Meshes=flatten(split_20.Negative))
Z_3 = UnitZ(Factor=sdl_kn_m2)
Z_4 = UnitZ(Factor=ll_kn_m2)
entwine_8 = Entwine(Branch00=Z, Branch01=Z_2, FlattenInputs=True)  # -> simplify(Result)
entwine_9 = Entwine(Branch00=split_17.Negative, Branch01=split_19.Negative, FlattenInputs=True)  # -> simplify(Result)
entwine_10 = Entwine(Branch00="Wind_01_I_suction", Branch01="Wind_02_I_pressure", FlattenInputs=True)  # -> simplify(Result)
entwine_11 = Entwine(Branch00=Z_3, Branch01=Z_4, FlattenInputs=True)  # -> simplify(Result)
entwine_12 = Entwine(Branch00=clean, Branch01=clean, FlattenInputs=True)  # -> simplify(Result)
entwine_13 = Entwine(Branch00="SDL", Branch01="LL", FlattenInputs=True)  # -> simplify(Result)
entwine_14 = Entwine(Branch00=strain_truss_cable_mm_m, Branch01=strain_bracing_cables_mm_m, FlattenInputs=True)  # -> simplify(Result)
entwine_15 = Entwine(Branch00="Cable", Branch01="Bracing Diagonals", FlattenInputs=True)  # -> simplify(Result)
entwine_16 = Entwine(Branch00="Strain", Branch01="Strain", FlattenInputs=True)  # -> simplify(Result)
loads = LoadsKaramba3D(
    Vector=entwine_8,
    Mesh=entwine_9,
    ElementIdentifiers="Top Chord",
    LCase=entwine_10,
    LineLoadsPerElement=number_slider_4,
    MinimumLineLoadLength_m=0.5,
    mode="MeshLoad -Const.",
    menu=[buttons(off, on, off), buttons(off, on)])
loads_2 = LoadsKaramba3D(
    Vector=entwine_11,
    Mesh=entwine_12,
    ElementIdentifiers="Top Chord",
    LCase=entwine_13,
    LineLoadsPerElement=number_slider_4,
    MinimumLineLoadLength_m=0.5,
    mode="MeshLoad -Const.",
    menu=[buttons(on, off, off), buttons(off, on)])
loads_3 = LoadsKaramba3D(Eps0=entwine_14, ElementIdentifiers=entwine_15, LCase=entwine_16, mode="InitialStrain")

# ---- group: ELEM: COLUMNS
columns_divided_2 = Line(columns_divided)
mat_steel_2 = MaterialKaramba3D(mat_steel)
line = Line(columns_divided_2)
tstat_3 = TreeStatistics(Tree=line)  # -> Paths, Length, Count
dpath = DeconstructPath(Branch=tstat_3.Paths)
crosecrselect = CrossSectionRangeSelectorKaramba3D(
    MaximumHeight_cm=-1,
    MaximumWidth_cm=-1,
    Material=mat_steel_2,
    menu=[dropdown(1), dropdown(1), dropdown(4), dropdown(15)])
concat = Concatenate(FragmentA="Columns", FragmentB=".", FragmentB_2=dpath)
bending_toggle_2 = BooleanToggle(True)
Y_3 = UnitY(Factor=1)
lineelem_2 = CreateLinearElementKaramba3D(
    Line=line,
    Identifier=concat,
    CrossSection=crosecrselect,
    LimitDistance_m=0.005,
    ZOrientation=Y_3,
    BucklingLengthY_m=-1,
    BucklingLengthZ_m=-1,
    BucklingLengthLT_m=-1,
    Bending=bending_toggle_2,
    ToPolylineMaxAngle=0.25,
    ToPolylineTolerance=0.1,
    ToPolylineMaxEdgeLength=0.25,
    New=True,
    Remove=True,
    mode="LineToBeam",
    GuidGeneratorSeed=-726197348)  # -> Element, Points, Info
ids_columns = Text(concat)

# ---- group: JOINTS
panel_8 = Panel("""Corner.Leg
Corner.Chord""")
panel_9 = Panel("""Diagonals.Steel
Corner.Leg
Corner.Chord""")
panel_10 = Panel("""Top Chord
Corner.Leg
Corner.Chord""")
entwine_17 = Entwine(
    Branch00="Columns",
    Branch01="Diagonals.Glulam",
    Branch02="Diagonals.Steel",
    Branch03="Transverse.Side",
    Branch04="Columns",
    FlattenInputs=True)
entwine_18 = Entwine(Branch00="Top Chord", Branch01="Top Chord", Branch02=panel_8, Branch03="Columns", Branch04=panel_8, FlattenInputs=True)
entwine_19 = Entwine(Branch00="Diagonals.Glulam", Branch01="Diagonals.Steel", Branch02="Corner.Frame", Branch03=panel_9, FlattenInputs=True)
entwine_20 = Entwine(Branch00="Cable", Branch01="Top Chord", Branch02=panel_10, Branch03="Corner.Frame", FlattenInputs=True)
joint_agent = BeamJointAgentKaramba3D(
    BeamIdentifier=entwine_17,
    ToElementIdentifiers=entwine_18,
    Ct_kN_m=Vector(0, 0, 0),
    Cr_kNm_rad=Vector(0, 0, 0),
    menu=[buttons(off, off, off, off, on, on)])
joint_agent_2 = BeamJointAgentKaramba3D(
    BeamIdentifier=entwine_19,
    ToElementIdentifiers=entwine_20,
    Ct_kN_m=Vector(0, 0, 0),
    Cr_kNm_rad=Vector(0, 0, 0),
    menu=[buttons(off, off, off, off, on, off)])
joint = JointKaramba3D([joint_agent, joint_agent_2])

# ---- group: ELEM: TRANSVERSE STEEL
mat_steel_3 = MaterialKaramba3D(mat_steel)
crosecrselect_2 = CrossSectionRangeSelectorKaramba3D(
    MaximumHeight_cm=-1,
    MaximumWidth_cm=-1,
    Material=mat_steel_3,
    menu=[dropdown(1), dropdown(2), dropdown(1), dropdown(91)])
transverse_beams_side_wall_2 = Curve(transverse_beams_side_wall)
transverse_beams_bottom_2 = Line(transverse_beams_bottom)
bracing_diagonals_roof_2 = Line(bracing_diagonals_roof)
transverse_beams_top_2 = Line(transverse_beams_top)
bending_toggle_3 = BooleanToggle(False)
bending_toggle_4 = BooleanToggle(True)
entwine_21 = Entwine(
    Branch00=bracing_diagonals_roof_2,
    Branch01=transverse_beams_bottom_2,
    Branch02=transverse_beams_top_2,
    Branch03=transverse_beams_side_wall_2,
    FlattenInputs=True)
entwine_22 = Entwine(
    Branch00="Diagonals.Roof",
    Branch01="Transverse.Bottom",
    Branch02="Transverse.Top",
    Branch03="Transverse.Side",
    FlattenInputs=True)
entwine_23 = Entwine(
    Branch00=crosecrselect_2,
    Branch01=crosecrselect_2,
    Branch02=crosecrselect_2,
    Branch03=crosecrselect_2,
    FlattenInputs=True)
entwine_24 = Entwine(
    Branch00=bending_toggle_3,
    Branch01=bending_toggle_3,
    Branch02=bending_toggle_3,
    Branch03=bending_toggle_4,
    FlattenInputs=True)
lineelem_3 = CreateLinearElementKaramba3D(
    Line=entwine_21,
    Identifier=entwine_22,
    CrossSection=entwine_23,
    LimitDistance_m=0.005,
    BucklingLengthY_m=-1,
    BucklingLengthZ_m=-1,
    BucklingLengthLT_m=-1,
    Bending=entwine_24,
    ToPolylineMaxAngle=0.25,
    ToPolylineTolerance=0.1,
    ToPolylineMaxEdgeLength=0.25,
    New=True,
    Remove=True,
    mode="LineToBeam",
    GuidGeneratorSeed=-966472560)  # -> Element, Points, Info

# ---- group: LOADS: SW
Z_5 = UnitZ(Factor=Slider(-1, range=-5..5))
loads_4 = LoadsKaramba3D(Vector=Z_5, LCase="Gravity", mode="Gravity")

# ---- group: ELEM: TRUSS STEEL
mat_steel_4 = MaterialKaramba3D(mat_steel)
crosecselect = CrossSectionSelectorKaramba3D(NameOrListIndexOfCrossSection="HEA260", Material=mat_steel_4, UseFuzzySearch=False)  # -> CrossSection, Info
diagonals_steel_2 = Line(diagonals_steel)
frame_corner_2 = Line(frame_corner)
bending_toggle_5 = BooleanToggle(True)
entwine_25 = Entwine(Branch0X=flatten(frame_corner_2), Branch1X=flatten(diagonals_steel_2), FlattenInputs=False)
entwine_26 = Entwine(Branch0X="Corner.Frame", Branch1X="Diagonals.Steel", FlattenInputs=False)
entwine_27 = Entwine(Branch0X=crosecselect.CrossSection, Branch1X=crosecselect.CrossSection, FlattenInputs=False)
lineelem_4 = CreateLinearElementKaramba3D(
    Line=entwine_25,
    Identifier=entwine_26,
    CrossSection=entwine_27,
    LimitDistance_m=0.005,
    BucklingLengthY_m=-1,
    BucklingLengthZ_m=-1,
    BucklingLengthLT_m=-1,
    Bending=bending_toggle_5,
    ToPolylineMaxAngle=0.25,
    ToPolylineTolerance=0.1,
    ToPolylineMaxEdgeLength=0.25,
    New=True,
    Remove=True,
    mode="LineToBeam",
    GuidGeneratorSeed=1043640584)  # -> Element, Points, Info

# ---- group: ELEM: GLULAM
number_slider_5 = Slider(48, range=0..100)
number_slider_6 = Slider(48, range=0..100)
number_slider_7 = Slider(48, range=0..100)
top_chord_divided_3 = Line(top_chord_divided)
mat_glulam_2 = MaterialKaramba3D(mat_glulam)
mat_glulam_3 = MaterialKaramba3D(mat_glulam)
mat_glulam_4 = MaterialKaramba3D(mat_glulam)
crosec_3 = CrossSectionKaramba3D(
    FamilyNameOfCrossSection="DefaultCroSec",
    Material=mat_glulam_2,
    Height_cm=Slider(56, range=0..100),
    UpperFlangeWidth_cm=number_slider_5,
    LowerFlangeWidth_cm=number_slider_5,
    mode="Trapezoid")
crosec_4 = CrossSectionKaramba3D(
    FamilyNameOfCrossSection="DefaultCroSec",
    Material=mat_glulam_3,
    Height_cm=Slider(48, range=0..100),
    UpperFlangeWidth_cm=number_slider_7,
    LowerFlangeWidth_cm=number_slider_7,
    mode="Trapezoid")
crosec_5 = CrossSectionKaramba3D(
    FamilyNameOfCrossSection="DefaultCroSec",
    Material=mat_glulam_4,
    Height_cm=Slider(36, range=0..100),
    UpperFlangeWidth_cm=number_slider_6,
    LowerFlangeWidth_cm=number_slider_6,
    mode="Trapezoid")
tstat_4 = TreeStatistics(Tree=top_chord_divided_3)  # -> Paths, Length, Count
k3d_cross_section_diagonals_glulam = CrossSectionKaramba3D(crosec_5)
k3d_cross_section_corner_glulam = CrossSectionKaramba3D(crosec_4)
k3d_cross_section_top_chord = CrossSectionKaramba3D(crosec_3)
dpath_2 = DeconstructPath(Branch=tstat_4.Paths)
concat_2 = Concatenate(FragmentA="Top Chord", FragmentB=".", FragmentB_2=dpath_2)
ids_topchord = Text(concat_2)
tstat_5 = TreeStatistics(Tree=ids_topchord)  # -> Paths, Length, Count
k3d_cross_section_diagonals_glulam_2 = CrossSectionKaramba3D(k3d_cross_section_diagonals_glulam)
k3d_cross_section_top_chord_2 = CrossSectionKaramba3D(k3d_cross_section_top_chord)
k3d_cross_section_corner_glulam_2 = CrossSectionKaramba3D(k3d_cross_section_corner_glulam)
panel_11 = Panel("Corner Glulam")
dup_3 = DuplicateData(Data=k3d_cross_section_top_chord_2, Number=tstat_5.Count, Order=True)  # -> graft(Data)
bottom_chord_glulam_2 = Line(flatten(bottom_chord_glulam))
diagonals_glulam_2 = Line(flatten(diagonals_glulam))
top_chord_divided_4 = Line(top_chord_divided)
frame_angle_2 = Line(flatten(frame_angle))
match_3 = MatchTree(Tree=dup_3, Guide=ids_topchord)
bending_toggle_6 = BooleanToggle(True)
entwine_28 = Entwine(
    Branch0X=top_chord_divided_4,
    Branch1X=diagonals_glulam_2,
    Branch2X=frame_angle_2,
    Branch3X=bottom_chord_glulam_2,
    FlattenInputs=False)
entwine_29 = Entwine(Branch0X=ids_topchord, Branch1X="Diagonals.Glulam", Branch2X="Corner.Leg", Branch3X="Corner.Chord", FlattenInputs=False)
entwine_30 = Entwine(
    Branch0X=match_3,
    Branch1X=k3d_cross_section_diagonals_glulam_2,
    Branch2X=k3d_cross_section_corner_glulam_2,
    Branch3X=k3d_cross_section_corner_glulam_2,
    FlattenInputs=False)
lineelem_5 = CreateLinearElementKaramba3D(
    Line=entwine_28,
    Identifier=entwine_29,
    CrossSection=entwine_30,
    LimitDistance_m=0.005,
    BucklingLengthY_m=-1,
    BucklingLengthZ_m=-1,
    BucklingLengthLT_m=-1,
    Bending=bending_toggle_6,
    ToPolylineMaxAngle=0.25,
    ToPolylineTolerance=0.1,
    ToPolylineMaxEdgeLength=0.25,
    New=True,
    Remove=True,
    mode="LineToBeam",
    GuidGeneratorSeed=-744469964)  # -> Element, Points, Info
ids_topchord_2 = Text(concat_2)

# ---- group: Define Load Combinations
panel_12 = Panel("""G = Gravity + Strain
WL = (Wind_01_I_suction | Wind_02_I_pressure) + Strain
ULS1 = G + SDL + LL
ULS2 = 1.35*G + 1.5*WL""")
lccombinator = LoadCaseCombinatorKaramba3D(LoadCaseCombinationRulesKaramba3D=panel_12)  # -> LoadCaseCombinations, NamesOfLoadCases, NumberOfLoadCases

# ---- group: SUPPORTS
support_points_2 = Point(support_points)
supp = SupportKaramba3D(PosInd=support_points_2, Ct_kN_m=Vector(0, 0, 0), Cr_kNm_rad=Vector(0, 0, 0), menu=[buttons(on, on, on, off, off, off)])

# ----
support = SupportKaramba3D(supp)
element = ElementKaramba3D([lineelem_2.Element, lineelem.Element, lineelem_5.Element, lineelem_4.Element, lineelem_3.Element])
joint_2 = JointKaramba3D(joint)

# ---- group: LOADS: WIND WALLS
loadingmesheswalls_2 = Mesh(loadingmeshes)
zonemesheswalls_5 = Mesh(zonemesheswalls)
zonecpewalls_4 = Number(zonecpewalls)
zoneqpwalls_5 = Number(zoneqpwalls)
facen = FaceNormals(Mesh=zonemesheswalls_5)  # -> Centers, Normals
multiplication_3 = Multiplication(A=zonecpewalls_4, B=zoneqpwalls_5)
mesh = Mesh(loadingmesheswalls_2)
split_21 = SplitTree(Data=mesh, Masks=flatten("{3,4}"))  # -> graft(Positive), Negative
split_22 = SplitTree(Data=multiplication_3, Masks=flatten("{3,4}"))  # -> graft(Positive), Negative
trim_2 = TrimTree(Tree=facen.Centers, Depth=1)
trim_3 = TrimTree(Tree=facen.Normals, Depth=1)
area_2 = Area(Geometry=split_21.Positive)  # -> Area, Centroid
amp_2 = Amplitude(Vector=trim_3, Amplitude=multiplication_3)
multiplication_4 = Multiplication(A=area_2.Area, B=split_22.Positive)
abs = Absolute(Value=multiplication_4)
neg_4 = Negative(Value=amp_2)
ma = MassAddition(Input=flatten(abs))  # -> Result, PartialResults
sum_reaction_check_zones_d_e_kn = Panel(ma.Result)
graft_3 = GraftTree(Tree=neg_4, IncludeEmptyLists=True, IncludeNullItems=True)
graft_4 = GraftTree(Tree=mesh, IncludeEmptyLists=True, IncludeNullItems=True)
panel_13 = Panel("""Wind_01_I_suction
Wind_02_I_pressure""")
vdisex_5 = VectorDisplayEx(Point=trim_2, Vector=expr("x*10", neg_4), Colour=RGB(255, 0, 170), Width=2)

# ---- group: LOADS: WIND WALLS / DEFINE LOADING IDs
ids_topchord_3 = Text(ids_topchord_2)
ids_columns_2 = Text(ids_columns)
item_7 = ListItem(List=flatten(ids_topchord_3), Index=0, Wrap=True)  # -> Item1, Item
item_8 = ListItem(List=flatten(ids_columns_2), Index=0, Wrap=True)  # -> Item1, Item
entwine_31 = Entwine(
    Branch00="Columns",
    Branch01="Columns",
    Branch02="Columns",
    Branch03=item_7.Item,
    Branch04=item_7.Item1,
    FlattenInputs=True)  # -> simplify(Result)
entwine_32 = Entwine(
    Branch00="Columns",
    Branch01="Columns",
    Branch02="Columns",
    Branch03=item_7.Item1,
    Branch04=item_7.Item,
    FlattenInputs=True)  # -> simplify(Result)
entwine_33 = Entwine(
    Branch00=[item_7.Item, item_7.Item1],
    Branch01=[item_7.Item, item_7.Item1],
    Branch02=[item_7.Item, item_7.Item1],
    Branch03=item_8.Item,
    Branch04=item_8.Item1,
    FlattenInputs=True)  # -> simplify(Result)
entwine_34 = Entwine(
    Branch00=[item_7.Item1, item_7.Item],
    Branch01=[item_7.Item1, item_7.Item],
    Branch02=[item_7.Item1, item_7.Item],
    Branch03=item_8.Item1,
    Branch04=item_8.Item,
    FlattenInputs=True)  # -> simplify(Result)
lng_3 = ListLength(List=mesh)
wind_direction_3 = Integer(wind_direction)
dup_4 = DuplicateData(Data=entwine_31, Number=lng_3, Order=True)
dup_5 = DuplicateData(Data=entwine_32, Number=lng_3, Order=True)
filter_4 = StreamFilter(Gate=wind_direction_3, Stream0=dup_4, Stream1=dup_5, Stream2=entwine_33, Stream3=entwine_34)
graft_5 = GraftTree(Tree=filter_4, IncludeEmptyLists=True, IncludeNullItems=True)  # -> simplify(Tree)
clean_2 = CleanTree(RemoveNulls=True, RemoveInvalid=True, RemoveEmpty=True, Tree=graft_5)

# ----
panel_14 = Panel(clean_2)

# ---- group: LOADS: WIND WALLS (continued)
loads_5 = LoadsKaramba3D(
    Vector=graft_3,
    Mesh=graft_4,
    ElementIdentifiers=clean_2,
    LCase=panel_13,
    LineLoadsPerElement=Slider(10, range=0..20),
    MinimumLineLoadLength_m=0.5,
    mode="MeshLoad -Const.",
    menu=[buttons(off, on, off), buttons(off, on)])

# ----
entwine_35 = Entwine(
    Branch0X=loads_4,
    Branch1X=loads,
    Branch2X=loads_2,
    Branch3X=loads_3,
    Branch4X=loads_5,
    Branch5X=lccombinator.LoadCaseCombinations,
    FlattenInputs=False)
load = LoadKaramba3D(entwine_35)

assemble = AssembleModelKaramba3D(Elem=flatten(element), Support=flatten(support), Load=flatten(load), Joint=flatten(joint_2), LimitDistance_m=0.005)  # -> Model, Info, Mass_kg, CentreOfGravity, LoadCaseNames
system_mass_kg = Panel(assemble.Mass_kg)

# ---- group: Analyze Model
analysethii = AnalyseThIIKaramba3D(
    Model=assemble.Model,
    UseInitialNII=True,
    NIIFromCombination=True,
    NoTensionalNII=False,
    NoCompressiveNII=False,
    RTolerance=1e-07,
    MaxIterations=50)  # -> AnalysedModel, MaximumDisplacement_cm, ResultingForce_kN, ChangeOfElasticEnergy_kNm
panel_15 = Panel(analysethii.MaximumDisplacement_cm)
panel_16 = Panel(assemble.LoadCaseNames)

# ---- group: Buckling Analysis Model
bmodes_karamba3d = BucklingModesKaramba3D(
    Model=analysethii.AnalysedModel,
    FromIndex=1,
    NumberOfModes=Slider(10, range=0..50),
    LoadCasesNII=["ULS2", "ULS1"],
    MaximumNumberOfIterations=400,
    Epsilon=1e-07)  # -> ModelWithBucklingModes, BucklingLoadFactors

# ---- group: Export File STP
press_to_export = Button()
folder_path_for_export = FilePath("C:\Users\drago\OneDrive\Desktop\")
dstv_name_extension = Panel("ENG03-Hybrid Truss.stp")
concat_3 = Concatenate(FragmentA=folder_path_for_export, FragmentB=dstv_name_extension)
filter_5 = StreamFilter(Gate=press_to_export, Stream1=bmodes_karamba3d.ModelWithBucklingModes)
extodstv = ExportModelToDStVKaramba3D(
    Model=filter_5,
    Path=concat_3,
    ExportPath="C:\Users\drago\OneDrive\Desktop\ENG03-Hybrid Truss.stp",
    menu=[buttons(off, off, off, on, off, off)])  # -> DStV, Info
panel_17 = Panel(extodstv.DStV)

# ----
press_to_export_2 = Button()
folder_path_for_export_2 = FilePath("C:\Users\drago\OneDrive\Desktop\")
saf_name_extension = Panel("ENG03-Hybrid Truss.saf")
concat_4 = Concatenate(FragmentA=folder_path_for_export_2, FragmentB=saf_name_extension)
extosaf = ExportModelToSAFKaramba3D(
    Model=bmodes_karamba3d.ModelWithBucklingModes,
    Filepath=concat_4,
    ExportNow=press_to_export_2,
    OrientationGlobalCS=0,
    OrientationLocalCS=0,
    Discipline="Load-bearing structure",
    BuildingCodeIndex=0,
    LengthSegment_m=-1,
    MaximumFacesMesh=2000,
    SAFVersion="1.0.5",
    CrossSectionNameConversion="CrossSectionNameAliases.csv")  # -> Model, Info
panel_18 = Panel(extosaf.Info)

# ---- group: Model View
resultselect = ResultSelectorKaramba3D(
    Model=bmodes_karamba3d.ModelWithBucklingModes,
    menu=[buttons(off, on), dropdown(9), dropdown(1), buttons(off, off, off, off, off, off, off), buttons(off, off, off, off, off, off), buttons(off, off, off, off, off, off, off, off), buttons(off, off, off, off, off, off, off, off)])  # -> Model, LoadCaseSelection
modelview = ModelViewKaramba3D(Model=resultselect.Model)  # -> Model, DeformedMesh, DeformedAxes, DeformedModel, MaximumDeformation
beamview = BeamViewKaramba3D(Model=modelview.Model)  # -> Model, MeshesOfRenderedBeams, DeformedBeamAxes, LegendColours, LegendTags

# ---- group: Buckling Factors
panel_19 = Panel(bmodes_karamba3d.BucklingLoadFactors)
roundd = RoundToDecimalPlace(NumberX=panel_19, DecimalPlace=2, RoundType=0)  # -> Rounded, Difference
split_23 = SplitList(List=roundd.Rounded, I10=10)  # -> ListA, ListB
join_6 = TextJoin(Text=split_23.ListA, Join=" / ")
concat_5 = Concatenate(FragmentA="Buckling Factors : ", FragmentB=join_6)
texttoscreen = RenderTextToScreen(Text=concat_5, Location="{10,70,0}", Size=12, Color=RGB(0, 0, 0), m_scWithvp=False)

# ---- group: Results - Reaction Forces
react = ReactionForcesKaramba3D(AnalysedModel=beamview.Model)  # -> Model, ReactionForces_kN, ReactionMoments_kNm, SupportPosition, SumOfReactionForces_kN, SumOfReactionMoments_kNm, GoverningLoadCaseIndex
reactview = ReactionViewKaramba3D(Model=beamview.Model)  # -> Model, LegendColours, LegendTags
panel_20 = Panel(react.SumOfReactionForces_kN)

# ==== cluster Cluster
truss_plane = ClusterInput()
span_at_supports_m = ClusterInput()
height_at_supports_m = ClusterInput()
height_at_midspan_m = ClusterInput()
truss_depth_at_start_m = ClusterInput()
truss_depth_at_midspan_m = ClusterInput()
portal_frame_width_m = ClusterInput()
truss_plane_2 = Plane(truss_plane)
span_at_supports_m_2 = Number(span_at_supports_m)
height_at_supports_m_2 = Number(height_at_supports_m)
height_at_midspan_m_2 = Number(height_at_midspan_m)
height_at_supports_m_3 = Number(height_at_supports_m)
truss_depth_at_start_m_2 = Number(truss_depth_at_start_m)
height_at_midspan_m_3 = Number(height_at_midspan_m)
truss_depth_at_midspan_m_2 = Number(truss_depth_at_midspan_m)
truss_plane_3 = Plane(truss_plane)
portal_frame_width_m_2 = Number(portal_frame_width_m)
span_at_supports_m_3 = Number(span_at_supports_m)
deplane = DeconstructPlane(Plane=truss_plane_3)  # -> Origin, XAxis, YAxis, ZAxis
deplane_2 = DeconstructPlane(Plane=truss_plane_2)  # -> Origin, XAxis, YAxis, ZAxis
subtraction = Subtraction(A=height_at_supports_m_3, B=truss_depth_at_start_m_2)
subtraction_2 = Subtraction(A=height_at_midspan_m_3, B=truss_depth_at_midspan_m_2)
pl = ConstructPlane(Origin=deplane.Origin, XAxis=deplane.ZAxis, YAxis=deplane.YAxis)
amp = Amplitude(Vector=deplane_2.XAxis, Amplitude=span_at_supports_m_2)
amp_2 = Amplitude(Vector=deplane_2.YAxis, Amplitude=height_at_supports_m_2)
amp_3 = Amplitude(Vector=deplane_2.YAxis, Amplitude=height_at_midspan_m_2)
amp_4 = Amplitude(Vector=deplane_2.YAxis, Amplitude=subtraction)
amp_5 = Amplitude(Vector=deplane_2.YAxis, Amplitude=subtraction_2)
neg = Negative(Value=portal_frame_width_m_2)
subtraction_3 = Subtraction(A=span_at_supports_m_3, B=portal_frame_width_m_2)
move = Move(Geometry=truss_plane_2, Motion=amp)  # -> Geometry, Transform
neg_2 = Negative(Value=subtraction_3)
deplane_3 = DeconstructPlane(Plane=move.Geometry)  # -> Origin, XAxis, YAxis, ZAxis
pl_offset = PlaneOffset(BasePlane=pl, Offset=neg)
pl_offset_2 = PlaneOffset(BasePlane=pl, Offset=neg_2)
pt = Point(deplane_3.Origin)
pt_2 = Point(deplane_2.Origin)
ln = Line(StartPoint=pt_2, EndPoint=pt)
midpt = CurveMiddle(Curve=ln)
move_2 = Move(Geometry=pt, Motion=amp_4)  # -> Geometry, Transform
move_3 = Move(Geometry=pt_2, Motion=amp_2)  # -> Geometry, Transform
move_4 = Move(Geometry=midpt, Motion=amp_3)  # -> Geometry, Transform
move_5 = Move(Geometry=pt, Motion=amp_2)  # -> Geometry, Transform
move_6 = Move(Geometry=pt_2, Motion=amp_4)  # -> Geometry, Transform
move_7 = Move(Geometry=midpt, Motion=amp_5)  # -> Geometry, Transform
arc = Arc3Pt(PointA=move_6.Geometry, PointB=move_7.Geometry, PointC=move_2.Geometry)  # -> Arc, Plane, Radius
pcx = CurvePlane(Curve=arc.Arc, Plane=pl_offset)  # -> Points, ParamsC, ParamsP
pcx_2 = CurvePlane(Curve=arc.Arc, Plane=pl_offset_2)  # -> Points, ParamsC, ParamsP
ln_2 = Line(StartPoint=pt_2, EndPoint=move_3.Geometry)
ln_3 = Line(StartPoint=pt, EndPoint=move_5.Geometry)
shatter = Shatter(Curve=arc.Arc, Parameters=[pcx.ParamsC, pcx_2.ParamsC])
entwine = Entwine(Branch00=ln_2, Branch01=ln_3, FlattenInputs=True)  # -> flatten(Result)
len = Length(Curve=shatter)
sort = SortList(Keys=len, ValuesA=shatter)  # -> Keys, reverse(ValuesA)
ln_4 = Line(StartPoint=pt_2, EndPoint=pcx.Points)
ln_5 = Line(StartPoint=pt, EndPoint=pcx_2.Points)
arc_2 = Arc3Pt(PointA=move_3.Geometry, PointB=move_4.Geometry, PointC=move_5.Geometry)  # -> Arc, Plane, Radius
item = ListItem(List=sort.ValuesA, Index=0, Wrap=True)
truss_plane_4 = Plane(truss_plane)
entwine_2 = Entwine(Branch00=ln_4, Branch01=ln_5, FlattenInputs=True)  # -> flatten(Result)
number_slider = Slider(100, range=0..100)
vec2pt = Vector2Pt(PointA=pt_2, PointB=midpt, Unitize=False)  # -> Vector, Length
vec2pt_2 = Vector2Pt(PointA=move_3.Geometry, PointB=move_4.Geometry, Unitize=False)  # -> Vector, Length
angle = Angle(VectorA=vec2pt.Vector, VectorB=vec2pt_2.Vector, Plane=truss_plane_4)  # -> Angle, Reflex
divide = DivideCurve(Curve=arc_2.Arc, Count=number_slider, Kinks=False)  # -> Points, Tangents, Parameters
divide_2 = DivideCurve(Curve=item, Count=number_slider, Kinks=False)  # -> Points, Tangents, Parameters
deg = Degrees(Radians=angle.Angle)
ln_6 = Line(StartPoint=divide.Points, EndPoint=divide_2.Points)
panel = Panel(deg)
flip = FlipCurve(Curve=ln_6)  # -> Curve, Flag
vec2pt_3 = Vector2Pt(PointA=move_3.Geometry, PointB=move_4.Geometry, Unitize=False)  # -> Vector, Length
loft = Loft(
    Curves=flatten(flip.Curve),
    Options={Adjust=False, Closed=False, LoftEnds=0, LoftSimp=0, LoftType=0, Rebuild=10, Refit=0.01})
project = Project(Geometry=vec2pt_3.Vector, Plane=PlaneXY(0, 0, 0))  # -> Geometry, Transform
angle_2 = Angle(VectorA=vec2pt_3.Vector, VectorB=project.Geometry)  # -> Angle, ApproximateRoofAngle
vdis = VectorDisplay(Anchor=move_3.Geometry, Vector=[project.Geometry, vec2pt_3.Vector])
truss_surface = Surface(reparameterize(loft))
support_points = Point([pt, pt_2])
frame_angle = Line(entwine_2)
truss_plane_5 = Plane(truss_plane_2)
columns = Line(entwine)
truss_plane_6 = ClusterOutput(truss_plane_5)
support_points_2 = ClusterOutput(support_points)
columns_2 = ClusterOutput(columns)
frame_angle_2 = ClusterOutput(frame_angle)
truss_surface_2 = ClusterOutput(truss_surface)
approximate_roof_angle = ClusterOutput(angle_2.ApproximateRoofAngle)

# ==== cluster Cluster_2
top_chord = ClusterInput()
top_chord_2 = Line(top_chord)
join = JoinCurves(Curves=top_chord_2, Preserve=False)  # -> flatten(Curves)
shift = ShiftList(List=join, Shift=1, Wrap=invert(True))
short = ShortestList(ListA=join, ListB=shift, TrimMode=2)  # -> ListA, ListB
graft = GraftTree(Tree=short.ListA, IncludeEmptyLists=True, IncludeNullItems=True)
graft_2 = GraftTree(Tree=short.ListB, IncludeEmptyLists=True, IncludeNullItems=True)
explode = Explode(Curve=graft, Recursive=True)  # -> graft(Segments), Vertices
explode_2 = Explode(Curve=graft_2, Recursive=True)  # -> graft(Segments), Vertices
loft = Loft(
    Curves=[explode.Segments, explode_2.Segments],
    Options={Adjust=False, Closed=False, LoftEnds=0, LoftSimp=0, LoftType=0, Rebuild=10, Refit=0.01})  # -> simplify(Loft)
tstat = TreeStatistics(Tree=loft)  # -> Paths, Length, Count
dpath = DeconstructPath(Branch=tstat.Paths)
item = ListItem(List=dpath, Index=0, Wrap=True)
cset = CreateSet(List=flatten(item))  # -> Set, Map
cull = CullPattern(List=cset.Set, CullPattern=[True, False])
concat = Concatenate(FragmentA="{", FragmentB=cull, FragmentA_2=";*}")
split = SplitTree(Data=loft, Masks=flatten(concat))  # -> Positive, Negative
top_chord_bracing_surfaces = Surface(split.Positive)
top_chord_bracing_surfaces_2 = ClusterOutput(top_chord_bracing_surfaces)

# ==== cluster Cluster_3
top_chord = ClusterInput()
bottom_chord = ClusterInput()
columns = ClusterInput()
top_chord_2 = Line(top_chord)
bottom_chord_2 = Line(bottom_chord)
columns_2 = Line(columns)
end = EndPoints(Curve=top_chord_2)  # -> Start, End
end_2 = EndPoints(Curve=bottom_chord_2)  # -> Start, End
item = ListItem(List=columns_2, Index=0, Wrap=True)  # -> Item, Item1
item_2 = ListItem(List=end.Start, Index=0, Wrap=True)  # -> Item, Item1
item_3 = ListItem(List=end_2.Start, Index=0, Wrap=True)  # -> Item, Item1
item_4 = ListItem(List=end.End, Index=0, Wrap=True)  # -> Item2, Item1, Item
item_5 = ListItem(List=end_2.End, Index=0, Wrap=True)  # -> Item2, Item1, Item
end_3 = EndPoints(Curve=item.Item)  # -> Start, End
end_4 = EndPoints(Curve=item.Item1)  # -> Start, End
pt = Point(item_2.Item1)
pt_2 = Point(item_3.Item1)
pt_3 = Point(item_4.Item1)
pt_4 = Point(item_5.Item1)
pt_5 = Point(end_3.End)
pt_6 = Point(end_4.End)
pt_7 = Point(item_2.Item)
pt_8 = Point(item_3.Item)
pt_9 = Point(item_4.Item2)
pt_10 = Point(item_5.Item2)
pt_11 = Point(end_3.Start)
pt_12 = Point(end_4.Start)
pline = PolyLine(Vertices=flatten(pt_7), Closed=False)
pline_2 = PolyLine(Vertices=flatten(pt_8), Closed=False)
pline_3 = PolyLine(Vertices=flatten(pt_9), Closed=False)
pline_4 = PolyLine(Vertices=flatten(pt_10), Closed=False)
pline_5 = PolyLine(Vertices=flatten(pt_11), Closed=False)
pline_6 = PolyLine(Vertices=flatten(pt_12), Closed=False)
pline_7 = PolyLine(Vertices=flatten(pt), Closed=False)
pline_8 = PolyLine(Vertices=flatten(pt_2), Closed=False)
pline_9 = PolyLine(Vertices=flatten(pt_3), Closed=False)
pline_10 = PolyLine(Vertices=flatten(pt_4), Closed=False)
pline_11 = PolyLine(Vertices=flatten(pt_5), Closed=False)
pline_12 = PolyLine(Vertices=flatten(pt_6), Closed=False)
explode = Explode(Curve=pline, Recursive=True)  # -> Segments, Vertices
explode_2 = Explode(Curve=pline_7, Recursive=True)  # -> Segments, Vertices
explode_3 = Explode(Curve=pline_3, Recursive=True)  # -> Segments, Vertices
explode_4 = Explode(Curve=pline_9, Recursive=True)  # -> Segments, Vertices
explode_5 = Explode(Curve=pline_5, Recursive=True)  # -> Segments, Vertices
explode_6 = Explode(Curve=pline_6, Recursive=True)  # -> Segments, Vertices
explode_7 = Explode(Curve=pline_2, Recursive=True)  # -> Segments, Vertices
explode_8 = Explode(Curve=pline_8, Recursive=True)  # -> Segments, Vertices
explode_9 = Explode(Curve=pline_4, Recursive=True)  # -> Segments, Vertices
explode_10 = Explode(Curve=pline_10, Recursive=True)  # -> Segments, Vertices
explode_11 = Explode(Curve=pline_11, Recursive=True)  # -> Segments, Vertices
explode_12 = Explode(Curve=pline_12, Recursive=True)  # -> Segments, Vertices
graft = GraftTree(Tree=explode.Segments, IncludeEmptyLists=True, IncludeNullItems=True)
graft_2 = GraftTree(Tree=explode_2.Segments, IncludeEmptyLists=True, IncludeNullItems=True)
graft_3 = GraftTree(Tree=explode_3.Segments, IncludeEmptyLists=True, IncludeNullItems=True)
graft_4 = GraftTree(Tree=explode_4.Segments, IncludeEmptyLists=True, IncludeNullItems=True)
graft_5 = GraftTree(Tree=explode_5.Segments, IncludeEmptyLists=True, IncludeNullItems=True)
graft_6 = GraftTree(Tree=explode_6.Segments, IncludeEmptyLists=True, IncludeNullItems=True)
graft_7 = GraftTree(Tree=explode_7.Segments, IncludeEmptyLists=True, IncludeNullItems=True)
graft_8 = GraftTree(Tree=explode_8.Segments, IncludeEmptyLists=True, IncludeNullItems=True)
graft_9 = GraftTree(Tree=explode_9.Segments, IncludeEmptyLists=True, IncludeNullItems=True)
graft_10 = GraftTree(Tree=explode_10.Segments, IncludeEmptyLists=True, IncludeNullItems=True)
graft_11 = GraftTree(Tree=explode_11.Segments, IncludeEmptyLists=True, IncludeNullItems=True)
graft_12 = GraftTree(Tree=explode_12.Segments, IncludeEmptyLists=True, IncludeNullItems=True)
loft = Loft(
    Curves=[graft, graft_7],
    Options={Adjust=False, Closed=False, LoftEnds=0, LoftSimp=0, LoftType=0, Rebuild=10, Refit=0.01})
loft_2 = Loft(
    Curves=[graft_2, graft_8],
    Options={Adjust=False, Closed=False, LoftEnds=0, LoftSimp=0, LoftType=0, Rebuild=10, Refit=0.01})
loft_3 = Loft(
    Curves=[graft_3, graft_9],
    Options={Adjust=False, Closed=False, LoftEnds=0, LoftSimp=0, LoftType=0, Rebuild=10, Refit=0.01})
loft_4 = Loft(
    Curves=[graft_4, graft_10],
    Options={Adjust=False, Closed=False, LoftEnds=0, LoftSimp=0, LoftType=0, Rebuild=10, Refit=0.01})
loft_5 = Loft(
    Curves=[graft_5, graft_11],
    Options={Adjust=False, Closed=False, LoftEnds=0, LoftSimp=0, LoftType=0, Rebuild=10, Refit=0.01})
loft_6 = Loft(
    Curves=[graft_6, graft_12],
    Options={Adjust=False, Closed=False, LoftEnds=0, LoftSimp=0, LoftType=0, Rebuild=10, Refit=0.01})
cull = CullPattern(List=flatten(loft), CullPattern=[True, False])
cull_2 = CullPattern(List=flatten(loft_2), CullPattern=[True, False])
cull_3 = CullPattern(List=flatten(loft_3), CullPattern=[True, False])
cull_4 = CullPattern(List=flatten(loft_4), CullPattern=[True, False])
cull_5 = CullPattern(List=flatten(loft_5), CullPattern=[True, False])
cull_6 = CullPattern(List=flatten(loft_6), CullPattern=[True, False])
entwine = Entwine(Branch00=cull, Branch01=cull_2, Branch02=cull_3, Branch03=cull_4, Branch04=loft_5, Branch05=loft_6, FlattenInputs=True)
entwine_2 = Entwine(Branch00=cull, Branch01=cull_2, Branch02=cull_3, Branch03=cull_4, Branch04=cull_5, Branch05=cull_6, FlattenInputs=True)
clean = CleanTree(RemoveNulls=True, RemoveInvalid=True, RemoveEmpty=True, Tree=entwine_2)
bracing_surfaces = Surface(clean)
bracing_surfaces_2 = ClusterOutput(bracing_surfaces)

# ==== cluster Cluster_4
zonemeshes = ClusterInput()
zonemeshes_2 = Mesh(zonemeshes)
meshtargetsize = ClusterInput()
medges = MeshEdges(Mesh=zonemeshes_2)  # -> NakedEdges, InteriorEdges, NonManifoldEdges
meshtargetsize_2 = Number(meshtargetsize)
join = JoinCurves(Curves=medges.NakedEdges, Preserve=False)
trim = TrimTree(Tree=join, Depth=2)
boundary = BoundarySurfaces(Edges=trim)
dim = Dimensions(Surface=boundary)  # -> UDimension, VDimension
division = Division(A=dim.UDimension, B=meshtargetsize_2)
division_2 = Division(A=dim.VDimension, B=meshtargetsize_2)
round = Round(Number=division)  # -> Nearest, Floor, Ceiling
round_2 = Round(Number=division_2)  # -> Nearest, Floor, Ceiling
mesh_uv = MeshSurface(Surface=boundary, UCount=round.Nearest, VCount=round_2.Nearest, Overhang=True, Equalize=False)
loadingmeshes = Mesh(mesh_uv)
loadingmeshes_2 = ClusterOutput(loadingmeshes)

# ==== cluster Cluster_5
vectorviewoffset = ClusterInput()
direction_vector = ClusterInput()
vectorviewscale = ClusterInput()
loadviewoffset = ClusterInput()
roof_height_h = ClusterInput()
loadviewscale = ClusterInput()
bounding_box = ClusterInput()
zonemeshes = ClusterInput()
meshcolour = ClusterInput()
edgecolour = ClusterInput()
zonelabels = ClusterInput()
zonecpe = ClusterInput()
zoneqp = ClusterInput()
vectorviewoffset_2 = Number(vectorviewoffset)
direction_vector_2 = Vector(direction_vector)
vectorviewscale_2 = Number(vectorviewscale)
loadviewoffset_2 = Number(loadviewoffset)
roof_height_h_2 = Number(roof_height_h)
loadviewscale_2 = Number(loadviewscale)
bounding_box_2 = Box(bounding_box)
zonemeshes_2 = Mesh(zonemeshes)
meshcolour_2 = Colour(meshcolour)
edgecolour_2 = Colour(edgecolour)
zonelabels_2 = Text(zonelabels)
zonecpe_2 = Number(zonecpe)
zoneqp_2 = Number(zoneqp)
expression = Expression(h=roof_height_h_2, o=vectorviewoffset_2, Expression="h/2+o")
multiplication = Multiplication(A=zonecpe_2, B=zoneqp_2)
neg = Negative(Value=loadviewoffset_2)
area = Area(Geometry=bounding_box_2)  # -> Area, Centroid
multiplication_2 = Multiplication(A=direction_vector_2, B=vectorviewscale_2)
Z = UnitZ(Factor=expression)
multiplication_3 = Multiplication(A=multiplication, B=loadviewscale_2)
mesh = Mesh(zonemeshes_2)
area_2 = MeshArea(Mesh=mesh)  # -> Area, Centroid
meshcp = MeshClosestPoint(Point=area_2.Centroid, Mesh=mesh)  # -> Point, Index, Parameter
neg_2 = Negative(Value=neg)
meval = MeshEval(Mesh=mesh, Parameter=meshcp.Parameter)  # -> Point, Normal, Colour
amp = Amplitude(Vector=meval.Normal, Amplitude=neg_2)
move = Move(Geometry=area.Centroid, Motion=Z)  # -> Geometry, Transform
move_2 = Move(Geometry=mesh, Motion=amp)  # -> Geometry, Transform
mesh_2 = Mesh(move_2.Geometry)
area_3 = MeshArea(Mesh=mesh_2)  # -> Area, Centroid
meshcp_2 = MeshClosestPoint(Point=area_3.Centroid, Mesh=mesh_2)  # -> Point, Index, Parameter
neg_3 = Negative(Value=multiplication_3)
meval_2 = MeshEval(Mesh=mesh_2, Parameter=meshcp_2.Parameter)  # -> Point, Normal, Colour
amp_2 = Amplitude(Vector=meval_2.Normal, Amplitude=neg_3)
move_3 = Move(Geometry=mesh_2, Motion=amp_2)  # -> Geometry, Transform
mesh_3 = Mesh(move_3.Geometry)
medges = MeshEdges(Mesh=move_2.Geometry)  # -> NakedEdges, InteriorEdges, NonManifoldEdges
medges_2 = MeshEdges(Mesh=mesh_3)  # -> NakedEdges, InteriorEdges, NonManifoldEdges
mesh_4 = Mesh(move_3.Geometry)
clean = CleanTree(RemoveNulls=True, RemoveInvalid=True, RemoveEmpty=False, Tree=mesh_4)
divide = DivideCurve(Curve=[medges.NakedEdges, medges.InteriorEdges, medges.NonManifoldEdges], Count=2, Kinks=False)  # -> Points, Tangents, Parameters
divide_2 = DivideCurve(Curve=[medges_2.NakedEdges, medges_2.InteriorEdges, medges_2.NonManifoldEdges], Count=2, Kinks=False)  # -> Points, Tangents, Parameters
area_4 = Area(Geometry=clean)  # -> Area, Centroid
vec2pt = Vector2Pt(PointA=divide.Points, PointB=divide_2.Points, Unitize=False)  # -> Vector, Length
directionvectorlocation = Point(move.Geometry)
loadvectorlocation = Point(divide.Points)
zonelabellocation = Point(area_4.Centroid)
directionvector = Vector(multiplication_2)
zoneoutlines = Curve([medges.NakedEdges, medges.InteriorEdges, medges.NonManifoldEdges])
meshcolour_3 = Colour(meshcolour_2)
edgecolour_3 = Colour(edgecolour_2)
zonelabels_3 = Text(zonelabels_2)
loadvector = Vector(vec2pt.Vector)
zonemesh = Mesh(move_3.Geometry)
zonelabellocation_2 = ClusterOutput(zonelabellocation)
zonelabels_4 = ClusterOutput(zonelabels_3)
zoneoutlines_2 = ClusterOutput(zoneoutlines)
loadvectorlocation_2 = ClusterOutput(loadvectorlocation)
loadvector_2 = ClusterOutput(loadvector)
directionvectorlocation_2 = ClusterOutput(directionvectorlocation)
directionvector_2 = ClusterOutput(directionvector)
zonemesh_2 = ClusterOutput(zonemesh)
edgecolour_4 = ClusterOutput(edgecolour_3)
meshcolour_4 = ClusterOutput(meshcolour_3)
