# Grasshopper definition 01_IndustrialHall.gh (Grasshopper 1.0.7)
# plug-ins: Karamba3D

# ---- group: Slider to adapt geometry
approx_column_spacing_m = Slider(5.4, range=5..12)
span_divisions = Slider(2, range=1..3)
width_m = Slider(10, range=10..20)
length_m = Slider(30, range=10..50)
height_m = Slider(5, range=5..10)
typology = ValueList({"Beam": 0, "Truss": 1}, selected="Truss")

# ---- group: Set Cross Sections
crosecrselect = CrossSectionRangeSelectorKaramba3D(MaximumHeight_cm=-1, MaximumWidth_cm=-1, menu=[dropdown(1), dropdown(0), dropdown(3)])
item = ListItem(List=crosecrselect, Index=0, Wrap=True)

# ---- group: Define Joints
beam_joints = BeamJointsKaramba3D(
    BeamIdentifier="Column",
    CtKNMAtStartingNode=Vector(0, 0, 0),
    CrKNmRadAtStartingNode=Vector(0, 0, 0),
    CtKNMAtEndNode=Vector(0, 0, 0),
    CrKNmRadAtEndNode=Vector(0, 0, 0),
    menu=[buttons(off, off, off, off, off, off), buttons(off, off, off, off, on, on)])

# ---- group: Define Element Set
panel = Panel("""A2
A1""")
mkset = MakeElementSetKaramba3D(ElementIdentifiers=panel, SetIdentifier="A", MinimumSplitLength_m=0.001)

# ---- group: Generate Geometry - Columns, Beams, Trusses
dom = ConstructDomain(DomainStart=expr("-x", width_m), DomainEnd=0)
dom_2 = ConstructDomain(DomainStart=0, DomainEnd=length_m)
division = Division(A=length_m, B=approx_column_spacing_m)
expression = Expression(x=division, y=division, Expression="If(Ceiling(x)=y,1,0)")
# 01 - Industrial Hall
# Difficulty: Moderate | Version 3.1.4
# Two options for the design of an industrial hall: a simple post and beam system or a trussed roof. Using the Optimize Cross Section component the total amount of steel required can be determined for the given design load criteria.
rectangle = Rectangle(Plane=PlaneXY(0, 0, 0), XSize=dom, YSize=dom_2, Radius=0)  # -> Rectangle, Length
expression_2 = Expression(x=length_m, y=division, Expression="(Ceiling(y))-1")
height = Number(height_m)
Z = UnitZ(Factor=height)
panel_2 = Panel("""0
-1""")

# ----
filter = StreamFilter(Gate=expression, Stream0=expression_2, Stream1=division)

# ---- group: Generate Geometry - Columns, Beams, Trusses (continued)
smaller = SmallerThan(FirstNumber=filter, SecondNumber="1")  # -> SmallerThan, OrEqualTo
filter_2 = StreamFilter(Gate=smaller.SmallerThan, Stream0=filter, Stream1="1")
multiplication = Multiplication(A=filter_2, B=span_divisions)
series = Series(Start=0, Step=span_divisions, Count=expr("x+1", filter_2))
sdivide = DivideSurface(Surface=rectangle.Rectangle, UCount="1", VCount=multiplication)  # -> Points, Normals, Parameters
move = Move(Geometry=sdivide.Points, Motion=Z)  # -> Geometry, Transform
flip = FlipMatrix(Data=move.Geometry)
item_2 = ListItem(List=sdivide.Points, Index=series, Wrap=True)  # -> Item1, Item
item_3 = ListItem(List=move.Geometry, Index=series, Wrap=True)
pline = PolyLine(Vertices=flip, Closed=False)  # -> flatten(Polyline)
pline_2 = PolyLine(Vertices=move.Geometry, Closed=False)
cull_i = CullIndex(List=pline, Indices=panel_2, Wrap=True)
item_4 = ListItem(List=pline, Index=panel_2, Wrap=True)
columns = Line(StartPoint=item_2.Item, EndPoint=item_3)

# ---- group: Define Loads
load_kn_m2 = Slider(2, range=2..10)
expression_3 = Expression(x=width_m, v=length_m, y=multiplication, u=load_kn_m2, Expression="((x*u)*v)/y/x/2")
expression_4 = Expression(x=width_m, v=length_m, y=multiplication, u=load_kn_m2, Expression="((x*u)*v)/y/x")
entwine = Entwine(Branch00=expression_4, Branch01=expression_3, FlattenInputs=True)
Z_2 = UnitZ(Factor=expr("-x", entwine))
panel_3 = Panel("""A2
A1""")
beam_loads = BeamLoadsKaramba3D(
    BeamIdentifier=graft(panel_3),
    LoadCase="LC0",
    ForceVector=Z_2,
    TStart=0,
    TEnd=1,
    mode="Block",
    menu=[buttons(on, off, off)])
loads = LoadsKaramba3D(Vector=Vector(0, 0, -1), LCase="LC0", mode="Gravity")
load = LoadKaramba3D(flatten([loads, beam_loads]))

# ---- group: Define Beam Elements for Beam Structure
crv_columns = Curve(columns)
crv_main_beams_end = Curve(item_4)
crv_main_beams = Curve(cull_i)
crv_sec_beams = Curve(pline_2)
entwine_2 = Entwine(Branch00=crv_columns, Branch01=crv_main_beams_end, Branch02=crv_main_beams, Branch03=crv_sec_beams, FlattenInputs=True)  # -> graft(Result)
clean = CleanTree(RemoveNulls=True, RemoveInvalid=True, RemoveEmpty=invert(False), Tree=entwine_2)
llinter = LineLineIntersectionKaramba3D(IntersectingLines=flatten(clean), LinesToIntersect=flatten(clean), LimitDistance_m=0.005)  # -> InterSecPoints, LineSubSegments
panel_4 = Panel("""Column
A1
A2
B
Diagonal""")
match = MatchTree(Tree=llinter.LineSubSegments, Guide=clean)
trim = TrimTree(Tree=match, Depth=1)
crosec = CrossSectionKaramba3D(item)
lineelem = CreateLinearElementKaramba3D(
    Line=trim,
    Identifier=graft(panel_4),
    CrossSection=crosec,
    LimitDistance_m=0.005,
    BucklingLengthY_m=-1,
    BucklingLengthZ_m=-1,
    BucklingLengthLT_m=-1,
    Bending=True,
    ToPolylineMaxAngle=0.03,
    ToPolylineTolerance=0.01,
    ToPolylineMaxEdgeLength=0.25,
    New=True,
    Remove=True,
    mode="LineToBeam")  # -> Element, Points, Info

# ---- group: Define Supports
pt_supports = Point(item_2.Item)
supp = SupportKaramba3D(PosInd=flatten(pt_supports), menu=[buttons(on, on, on, on, on, on)])

# ---- group: Define Beam Elements for Truss Structure
crv_main_beams_2 = Curve(pline)
len = Length(Curve=flatten(crv_main_beams_2))
item_5 = ListItem(List=len, Index=0, Wrap=True)
expression_5 = Expression(x=item_5, y="1", Expression="Abs(Int((x/y)/2)*2)-2")
Z_3 = UnitZ(Factor=expr("-1", "1"))
move_2 = Move(Geometry=crv_main_beams_2, Motion=Z_3)  # -> Geometry, Transform
panel_5 = Panel("""0
1""")
divide = DivideCurve(Curve=crv_main_beams_2, Count=expression_5, Kinks=False)  # -> Points, Tangents, Parameters
divide_2 = DivideCurve(Curve=move_2.Geometry, Count=expression_5, Kinks=False)  # -> Points, Tangents, Parameters
long = LongestList(ListA=panel_5, ListB=divide.Points, PaddingMode=4)  # -> ListA, ListB
p_n_c = PickNChoose(Pattern=long.ListA, Stream0=divide.Points, Stream1=divide_2.Points)
pline_3 = PolyLine(Vertices=p_n_c, Closed=False)
pline_4 = PolyLine(Vertices=divide_2.Points, Closed=False)
ln = Line(StartPoint=divide.Points, EndPoint=divide_2.Points)
explode = Explode(Curve=pline_3, Recursive=True)  # -> Segments, Vertices
explode_2 = Explode(Curve=pline_4, Recursive=True)  # -> Segments, Vertices
panel_6 = Panel("""-1
0""")
cull_i_2 = CullIndex(List=explode.Segments, Indices=panel_6, Wrap=True)
cull_i_3 = CullIndex(List=ln, Indices=panel_6, Wrap=True)
cull_i_4 = CullIndex(List=explode_2.Segments, Indices=panel_6, Wrap=True)
item_6 = ListItem(List=explode.Segments, Index=panel_6, Wrap=True)
crv_columns_2 = Curve(columns)
crv_main_beams_end_2 = Curve(item_4)
crv_main_beams_3 = Curve(cull_i)
crv_sec_beams_2 = Curve(pline_2)
entwine_3 = Entwine(
    Branch00=crv_columns_2,
    Branch01=crv_main_beams_end_2,
    Branch02=crv_main_beams_3,
    Branch03=crv_sec_beams_2,
    Branch04=cull_i_2,
    Branch05=cull_i_3,
    Branch06=[item_6, cull_i_4],
    FlattenInputs=True)  # -> graft(Result)
clean_2 = CleanTree(RemoveNulls=True, RemoveInvalid=True, RemoveEmpty=invert(False), Tree=entwine_3)
panel_7 = Panel("""Column
A1
A2
B
C
D
E""")
panel_8 = Panel("""1
1
1
1
0
1
1""")
crosec_2 = CrossSectionKaramba3D(item)

# ----
llinter_2 = LineLineIntersectionKaramba3D(IntersectingLines=flatten(clean_2), LinesToIntersect=flatten(clean_2), LimitDistance_m=0.005)  # -> InterSecPoints, LineSubSegments

# ---- group: Define Beam Elements for Truss Structure (continued)
match_2 = MatchTree(Tree=llinter_2.LineSubSegments, Guide=clean_2)
trim_2 = TrimTree(Tree=match_2, Depth=1)
lineelem_2 = CreateLinearElementKaramba3D(
    Line=trim_2,
    Identifier=graft(panel_7),
    CrossSection=crosec_2,
    LimitDistance_m=0.005,
    BucklingLengthY_m=-1,
    BucklingLengthZ_m=-1,
    BucklingLengthLT_m=-1,
    Bending=graft(panel_8),
    ToPolylineMaxAngle=0.03,
    ToPolylineTolerance=0.01,
    ToPolylineMaxEdgeLength=0.25,
    New=True,
    Remove=True,
    mode="LineToBeam")  # -> Element, Points, Info

# ---- group: Assemble Model
filter_3 = StreamFilter(Gate=typology, Stream0=lineelem.Element, Stream1=lineelem_2.Element)
assemble = AssembleModelKaramba3D(Elem=flatten(filter_3), Support=supp, Load=load, Joint=beam_joints, BeamSet=mkset, LimitDistance_m=0.005)  # -> Model, Info, Mass_kg, CentreOfGravity, LoadCaseNames

# ---- group: Analyze Model using Second Order Theory
panel_9 = Panel("""Column
A
B
C
D""")
crosec_3 = CrossSectionKaramba3D(crosecrselect)
opticrosec = OptimizeCrossSectionKaramba3D(
    Model=assemble.Model,
    GroupIdentifiers=panel_9,
    CrossSections=flatten(crosec_3),
    MaximumUtilization=1,
    MaximumVirtualWork_kNcm=0.01,
    NumberOfUtilizationIterations=5,
    NumberOfDisplacementIterations=5,
    NumberOfDisplacementIncrementsPerIteration=2,
    DisplacementTolerance=0.01,
    NumberOfSamplePoints=3,
    ElasticDesign=True,
    GammaM0=1,
    GammaM1=1.1,
    SwayFrame=True)  # -> OptimizedModel, Info, Mass_kg, MaximumDisplacement_cm, ElasticEnergyChange_kNm, MaximumUtilizationViewInsufficientCrossSections, MaximumDisplacementViewLimitCrossSections
panel_10 = Panel(opticrosec.Mass_kg)
panel_11 = Panel(opticrosec.MaximumDisplacement_cm)

# ---- group: View Results
modelview = ModelViewKaramba3D(Model=opticrosec.OptimizedModel)  # -> Model, DeformedMesh, DeformedAxes, DeformedModel, MaximumDeformation
beamview = BeamViewKaramba3D(Model=modelview.Model)  # -> Model, MeshesOfRenderedBeams, DeformedBeamAxes, LegendColours, LegendTags
legend = Legend(Colour=beamview.LegendColours, Tags=beamview.LegendTags, LegendType=1)

# ---- group: Utilisation
utilization = UtilizationOfElementsKaramba3D(
    AnalysedModel=opticrosec.OptimizedModel,
    NumberOfSamplePoints=3,
    ElasticDesign=True,
    GammaM0=1,
    GammaM1=1.1,
    SwayFrame=True,
    WithDetails=False,
    mode="Beams")  # -> Model, flatten(Utilization), SigMax_kN_cm², SigMin_kN_cm², TauMax_kN_cm², UtilN, UtilVy, UtilVz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
sort = SortList(Keys=utilization.Utilization)  # -> Keys, ValuesA
bnd = Bounds(Numbers=utilization.Utilization)
item_7 = ListItem(List=reverse(sort.Keys), Index=0, Wrap=True)
panel_12 = Panel(bnd)
expression_6 = Expression(x=item_7, Expression="x*100")

# ---- group: Display Results
expression_7 = Expression(x=length_m, y=division, Expression="x/(Ceiling(y))")
multiplication_2 = Multiplication(A=width_m, B=length_m)
merge = Merge(
    Data1=flatten(multiplication_2),
    Data2=flatten(expression_7),
    Data3=flatten(opticrosec.Mass_kg),
    Data4=flatten(opticrosec.MaximumDisplacement_cm),
    Data5=flatten(expression_6))
panel_13 = Panel("""Area
Column Spacing
Total Weight
Max. Displacement
Max. Utilisation""")
lng = ListLength(List=merge)
expression_8 = Expression(x=merge, Expression="Round(x,1)")
series_2 = Series(Start="0.4", Step="0.4", Count=lng)
panel_14 = Panel("""m2
m
kg
cm
%""")
concat = Concatenate(FragmentA=panel_13, FragmentB=expression_8, JoinSeparator=": ")
pt = ConstructPoint(XCoordinate="1", YCoordinate=0, ZCoordinate=series_2)
concat_2 = Concatenate(FragmentA=concat, FragmentB=panel_14, JoinSeparator=" ")
xz = XZPlane(Origin=pt)
tag = TextTag3D(Location=xz, Text=reverse(concat_2), Size="0.2", Colour="Black", Justification=4)
