# Grasshopper definition 01_InputCurvesAndAnalyzeStructure.gh (Grasshopper 1.0.7)
# plug-ins: Karamba3D

# ---- group: Reference Geometry
# to apply to a new model:
# right-click and set multiple surface
# ** note: low mesh density can
# result in uneven distribution of load
number_slider = Slider(76, range=0..100)
srf = Surface([<surface referenced from the Rhino model> x4])
mesh_uv = MeshSurface(Surface=srf, UCount=number_slider, VCount=number_slider, Overhang=True, Equalize=False)

# to apply to a new model:
# right-click and set multiple points;
# 
# ** points must be near intended supports;
# definition will automatically snap to closest node in model
pt = Point([<point referenced from the Rhino model> x10])

# to apply to a new model:
# right-click and set multiple curves;
# 
# ** pay close attention to intersections of rhino curves;
# Karamba3D will not read joints if lines are not intersecting
crv = Curve([<curve referenced from the Rhino model> x195])
explode = Explode(Curve=crv, Recursive=True)  # -> flatten(Segments), Vertices
# 01 Input Curves and Analyze Structure
# Difficulty: Moderate | Version 3.1.4
# This definition takes curve input from rhino, converts them to beams and optimizes each cross section.
# 
# Steps to alter:
# 1. change slider that controls loads
# 2. alter existing geometry
# 3. test your own curves, surface loads, and support point input
llinter = LineLineIntersectionKaramba3D(IntersectingLines=explode.Segments, LinesToIntersect=explode.Segments, LimitDistance_m=0.005)  # -> InterSecPoints, flatten(LineSubSegments)

# ---- group: Define Cross Sections
# This work is licensed under a Creative Commons Attribution 4.0 licence. You are free to copy, communicate and adapt the work, so long as you attribute the work in the manner specified by the author or licensor (but not in any way that suggests that they endorse you or your use of the work). A copy of this licence is available at http://http://creativecommons.org/licenses/by/4.0/ or write to info@creativecommons.org
crosecrselect = CrossSectionRangeSelectorKaramba3D(MaximumHeight_cm=-1, MaximumWidth_cm=-1, menu=[dropdown(3), dropdown(1), dropdown(1)])
index = Slider(0, range=0..272)
crosecselect = CrossSectionSelectorKaramba3D(CrossSections=crosecrselect, NameOrListIndexOfCrossSection=index)  # -> CrossSection, Info
panel = Panel(crosecselect.CrossSection)

# ---- group: Define Loads
# live load applied as uniform distributed (mesh) loads
# ** note: low mesh density can
# result in uneven distribution of load
# LIVE LOAD REFERENCE:
# ref: The Structural Basis of Architecture, Sandaker et al.
# residential (typical) 	2 kN/m2  	.04 kip/ft2
# office (tyipcal)  			3 kN/m2  	.06 kip/ft2
# public plazas  	12 kN/m2  	.25 kip/ft2
# athletic facilities (typical)  5 kN/m2  	.1 kip/ft2
# hospitals (operating rooms)  3 kN/m2   .06 kip/ft2
# libraries (book stacks)  7 kN/m2   .15 kip/ft2
# manufacturing (typical)  6 kN/m2   .125 kip/ft2
# heavy equipment   12 kN/m2   .25 kip/ft2
# schools (classrooms)   2 kN/m2   .04 kip/ft2
# schools (hallways)   5 kN/m2   .1 kip/ft2
live_load = Slider(-2, range=-5..5)
Z = UnitZ(Factor="-1")
Z_2 = UnitZ(Factor=live_load)
loads = LoadsKaramba3D(Vector=Z, LCase="LC0", mode="Gravity")
loads_2 = LoadsKaramba3D(Vector=Z_2, Mesh=mesh_uv, LCase="LC0", mode="MeshLoad -Const.", menu=[buttons(off, on, off), buttons(on, on)])
load = LoadKaramba3D(flatten([loads, loads_2]))

# ---- group: Define Elements
lineelem = CreateLinearElementKaramba3D(
    Line=llinter.LineSubSegments,
    Colour=ColourSwatch(SwatchColor=RGB(0, 0, 255)),
    Identifier="beams",
    CrossSection=crosecselect.CrossSection,
    LimitDistance_m=0.005,
    BucklingLengthY_m=-1,
    BucklingLengthZ_m=-1,
    BucklingLengthLT_m=-1,
    Bending=True,
    ToPolylineMaxAngle=0.03,
    ToPolylineTolerance=0.01,
    ToPolylineMaxEdgeLength=0.25,
    New=True,
    Remove=True,
    mode="LineToBeam")  # -> Element, Points, Info

# ---- group: Define Supports
fsim = FindSimilarMember(Data=pt, Set=lineelem.Points)  # -> Hit, Index
supp = SupportKaramba3D(PosInd=fsim.Hit, menu=[buttons(on, on, on, off, off, off)])

# ---- group: Assemble Model
assemble = AssembleModelKaramba3D(Elem=lineelem.Element, Support=supp, Load=load, LimitDistance_m=0.005)  # -> Model, Info, Mass_kg, CentreOfGravity, LoadCaseNames
mass = Panel(assemble.Mass_kg)

# ---- group: Optimize Cross Section
opticrosec = OptimizeCrossSectionKaramba3D(
    Model=assemble.Model,
    CrossSections=crosecrselect,
    MaximumUtilization=1,
    MaximumVirtualWork_kNcm=0.01,
    NumberOfUtilizationIterations=5,
    NumberOfDisplacementIterations=5,
    NumberOfDisplacementIncrementsPerIteration=2,
    DisplacementTolerance=0.01,
    NumberOfSamplePoints=3,
    ElasticDesign=True,
    GammaM0=1,
    GammaM1=1.1,
    SwayFrame=True)  # -> OptimizedModel, Info, Mass_kg, MaximumDisplacement_cm, ElasticEnergyChange_kNm, MaximumUtilizationViewInsufficientCrossSections, MaximumDisplacementViewLimitCrossSections
displacement = Panel(opticrosec.MaximumDisplacement_cm)
mass_2 = Panel(opticrosec.Mass_kg)

# ---- group: View Results
modelview = ModelViewKaramba3D(Model=opticrosec.OptimizedModel)  # -> Model, DeformedMesh, DeformedAxes, DeformedModel, MaximumDeformation
beamview = BeamViewKaramba3D(Model=modelview.Model)  # -> Model, MeshesOfRenderedBeams, DeformedBeamAxes, LegendColours, LegendTags
legend = Legend(Colour=beamview.LegendColours, Tags=beamview.LegendTags, LegendType=1)

# ---- group: Check Beam Internal Forces
# -You can call a specific group of beams using
# the 'BeamIds' input.
# -Adding '3' to the resolution input provides values
# at the middle of each beam in addition to the
# two ends (default).
panel_2 = Panel("3")
cluster = Cluster(C=panel_2)
b_forces = BeamForcesKaramba3D(AnalysedModel=opticrosec.OptimizedModel, Ts=cluster)  # -> Model, NormalForce_kN, ShearForceVz_kN, ShearForceVy_kN, TorsionalMomentMt_kNm, BendingMomentMy_kNm, BendingMomentMz_kNm, LoadCaseIndex
panel_3 = Panel(b_forces.NormalForce_kN)

# ==== cluster Cluster
C = ClusterInput()
series = Series(Start=0, Step=1, Count=C)
bnd = Bounds(Numbers=series)
remap = RemapNumbers(Value=series, Source=bnd, Target="0 to 1")  # -> Mapped, Clipped
C_2 = ClusterOutput(remap.Clipped)
