# Grasshopper definition 01_InputSurfacesAndAnalyzeStructure.gh (Grasshopper 1.0.7)
# plug-ins: Karamba3D

# ---- group: Reference Geometry
brep = Brep([<brep referenced from the Rhino model> x8])
mesh_breps = MeshBrepsKaramba3D(
    Brep=brep,
    MeshResolution=Slider(4, range=0..100),
    EdgeRefinementFactor=0.67,
    PointReduction=False,
    SmoothingStepSize=0,
    SmoothingIterations=5)  # -> Mesh, Info
# 01 Input Surfaces and Analyze Structure
# Difficulty: Moderate | Version 3.1.4
# This definition takes surface input from rhino, divides them as meshes according to density sliders, converts the mesh edges to beams and optimizes each cross section.
# 
# Steps to alter:
# 1. change slider that controls mesh density
# 2. change slider that controls loads
# 3. test your own surfaces
faceb = FaceBoundaries(Mesh=mesh_breps.Mesh)  # -> flatten(Boundaries)
explode = Explode(Curve=faceb, Recursive=True)  # -> flatten(Segments), Vertices
# This work is licensed under a Creative Commons Attribution 4.0 licence. You are free to copy, communicate and adapt the work, so long as you attribute the work in the manner specified by the author or licensor (but not in any way that suggests that they endorse you or your use of the work). A copy of this licence is available at http://http://creativecommons.org/licenses/by/4.0/ or write to info@creativecommons.org
rdlines = RemoveDuplicateLinesKaramba3D(Line=flatten(explode.Segments), LimitDistance=0.005)  # -> flatten(OutLine), Info, Indexes

# ---- group: Define Cross Sections
crosecrselect = CrossSectionRangeSelectorKaramba3D(MaximumHeight_cm=-1, MaximumWidth_cm=-1, menu=[dropdown(3), dropdown(1), dropdown(1)])
index = Slider(50, range=0..272)
crosecselect = CrossSectionSelectorKaramba3D(CrossSections=crosecrselect, NameOrListIndexOfCrossSection=index)  # -> CrossSection, Info
panel = Panel(crosecselect.CrossSection)

# ---- group: Define Elements
lineelem = CreateLinearElementKaramba3D(
    Line=rdlines.OutLine,
    Colour=ColourSwatch(SwatchColor=RGB(0, 0, 255)),
    Identifier="beams",
    CrossSection=crosecselect.CrossSection,
    LimitDistance_m=0.005,
    BucklingLengthY_m=-1,
    BucklingLengthZ_m=-1,
    BucklingLengthLT_m=-1,
    Bending=True,
    ToPolylineMaxAngle=0.03,
    ToPolylineTolerance=0.01,
    ToPolylineMaxEdgeLength=0.25,
    New=True,
    Remove=True,
    mode="LineToBeam")  # -> Element, Points, Info

# ---- group: Define Supports
# Plug this into supports to set lowest points (z-value) as supports
rdpoints = RemoveDuplicatePointsKaramba3D(Point=lineelem.Points, LimitDistance=0.005)  # -> OutPoint, Info, Indexes
pdecon = Deconstruct(Point=rdpoints.OutPoint)  # -> XComponent, YComponent, ZComponent
sort = SortList(Keys=pdecon.ZComponent)  # -> Keys, ValuesA
item = ListItem(List=sort.Keys, Index=0, Wrap=True)
expression = Expression(x=item, y=Slider(1, range=0..5), Expression="x+y")
smaller = SmallerThan(FirstNumber=pdecon.ZComponent, SecondNumber=expression)  # -> SmallerThan, OrEqualTo
cull = CullPattern(List=rdpoints.OutPoint, CullPattern=smaller.OrEqualTo)
supp = SupportKaramba3D(PosInd=cull, menu=[buttons(on, on, on, on, on, on)])

# ---- group: Define Loads
# LIVE LOAD REFERENCE:
# ref: The Structural Basis of Architecture, Sandaker et al.
# residential (typical) 	2 kN/m2  	.04 kip/ft2
# office (tyipcal)  			3 kN/m2  	.06 kip/ft2
# public plazas  	12 kN/m2  	.25 kip/ft2
# athletic facilities (typical)  5 kN/m2  	.1 kip/ft2
# hospitals (operating rooms)  3 kN/m2   .06 kip/ft2
# libraries (book stacks)  7 kN/m2   .15 kip/ft2
# manufacturing (typical)  6 kN/m2   .125 kip/ft2
# heavy equipment   12 kN/m2   .25 kip/ft2
# schools (classrooms)   2 kN/m2   .04 kip/ft2
# schools (hallways)   5 kN/m2   .1 kip/ft2
live_load = Slider(-1, range=-5..5)
Z = UnitZ(Factor="-1")
Z_2 = UnitZ(Factor=live_load)
mesh = Mesh(mesh_breps.Mesh)
loads = LoadsKaramba3D(Vector=Z_2, Mesh=mesh, LCase="LC0", mode="MeshLoad -Const.", menu=[buttons(off, on, off), buttons(on, off)])

# ----
loads_2 = LoadsKaramba3D(Vector=Z, LCase="LC0", mode="Gravity")

# ---- group: Define Loads (continued)
load = LoadKaramba3D(flatten([loads_2, loads]))

# ---- group: Assemble Model
assemble = AssembleModelKaramba3D(Elem=lineelem.Element, Support=supp, Load=load, LimitDistance_m=0.005)  # -> Model, Info, Mass_kg, CentreOfGravity, LoadCaseNames

# ---- group: Analyze Model
analyse = AnalyseKaramba3D(Model=assemble.Model)  # -> AnalysedModel, MaximumDisplacement_cm, ResultingForce_kN, ChangeOfElasticEnergy_kNm
displacement = Panel(analyse.MaximumDisplacement_cm)

# ---- group: View Results
modelview = ModelViewKaramba3D(Model=analyse.AnalysedModel)  # -> Model, DeformedMesh, DeformedAxes, DeformedModel, MaximumDeformation
beamview = BeamViewKaramba3D(Model=modelview.Model)  # -> Model, MeshesOfRenderedBeams, DeformedBeamAxes, LegendColours, LegendTags
legend = Legend(Colour=beamview.LegendColours, Tags=beamview.LegendTags, LegendType=1)
