# Grasshopper definition 01_IntegratedSteelTower.gh (Grasshopper 1.0.8)
# plug-ins: Karamba3D

# ---- group: Define GEOMETRIC STAIR INPUTS
# Some fine tuning of the values leads to suitable geometries. But no checks are in place for values that create conflicting situations. Use with caution.
stair_width_m = Panel("0.9")
stair_edge_offset_m = Slider(0.3, range=0..1)
stair_gap_m = Slider(0.375, range=0..1)
hanger_position_1_offset_m = Slider(0.12, range=0..1)
hanger_position_2_offset_m = Slider(2.655, range=2.5..4)
expression = Expression(w=stair_width_m, g=stair_gap_m, Expression="2*w+g")
entwine = Entwine(Branch00=stair_edge_offset_m, Branch01=expression, Branch02=stair_width_m, Branch03=stair_gap_m, FlattenInputs=True)
entwine_2 = Entwine(Branch00=hanger_position_1_offset_m, Branch01=hanger_position_2_offset_m, FlattenInputs=True)
hanger_positions = Number(entwine_2)
stair_data = Number(entwine)

# ---- group: Define GEOMETRIC INPUTS
structure_length_along_x_m = Slider(6, range=4..10)
structure_width_along_y_m = Slider(6, range=4..10)
floor_height_m = Slider(2.4, range=2..4)
floor_number = Slider(3, range=3..20)
no_secondaries = Panel("6")
stair_bay_length_m = Slider(4, range=3..10)
division_secondaries = Integer(no_secondaries)
stair_bay_length_m_2 = Number(stair_bay_length_m)

# ---- group: Define WIND LOADING INPUTS
basic_velocity_wind_pressure_q_b_kn_m2 = Slider(0.32, range=0.25..2)
list = ValueList({"Wind X": 0, "Wind Y": 1}, selected="Wind X")
terrain_category = ValueList({"0", "I": 1, "II": 2, "III": 3, "IV": 4}, selected="0")
wind_direction = Integer(list)
wind_direction_2 = Integer(wind_direction)
X = UnitX(Factor=1)
Y = UnitY(Factor=1)
filter = StreamFilter(Gate=wind_direction_2, Stream0=X, Stream1=Y)
direction_vector = Vector(filter)
terrain_category_2 = Number(terrain_category)
q_b_kn_m2 = Number(basic_velocity_wind_pressure_q_b_kn_m2)

# ---- group: Define GEOMETRIC INPUTS
# 01 - Integrated Steel Tower
# Difficulty: Hard | Version 3.1.6
# A parametric steel tower with an integrated staircase.
# Wind loads are derived according to EN 1991-1-4 using the basic EC1 procedure as an enclosed rectangular building.
structure_length_b1_m = Number(structure_length_along_x_m)
structure_width_b2_m = Number(structure_width_along_y_m)

floor_number_2 = Integer(floor_number)
floor_height_m_2 = Number(floor_height_m)

# ---- group: EC 1 Data For Rectangular Buildings
# Data based on BS EN 1991-1-4:2005.
# Section 7.2.2: Figure 7.5 and Table 7.1
panel = Panel("""5
1
0.25""")
building_data_h_d = Number(panel)
c_pe_10 = Panel("""-1.2
-1.2
-1.2""")
building_data_a_c_pe_10 = Number(c_pe_10)
c_pe_10_2 = Panel("""-0.8
-0.8
-0.8""")
building_data_b_c_pe_10 = Number(c_pe_10_2)
c_pe_10_3 = Panel("""-0.5
-0.5
-0.5""")
building_data_c_c_pe_10 = Number(c_pe_10_3)
c_pe_10_4 = Panel("""+0.8
+0.8
+0.7""")
building_data_d_c_pe_10 = Number(c_pe_10_4)
c_pe_10_5 = Panel("""-0.7
-0.5
-0.3""")
building_data_e_c_pe_10 = Number(c_pe_10_5)

# ---- group: EC 1 Terrain Category Data
# Data based on BS EN 1991-1-4:2005.
# Section 4.3.2: Table 4.1
terrain_category_3 = Panel("""0
1
2
3
4""")
terrain_data_category = Number(terrain_category_3)
z_0_m = Panel("""0.003
0.01
0.05
0.3
1""")
terrain_data_z_0_m = Number(z_0_m)
z_min_m = Panel("""1
1
2
5
10""")
terrain_data_z_min_m = Number(z_min_m)

# ----
floor_number_3 = Integer(floor_number_2)
floor_height_m_3 = Number(floor_height_m_2)

# ---- group: Define BOUNDING BOX GEOMETRY
structure_length_m = Number(structure_length_b1_m)
structure_width_m = Number(structure_width_b2_m)
floor_number_4 = Integer(floor_number_2)
floor_height_m_4 = Number(floor_height_m_2)
xy = XYPlane(Origin=Point(0, 0, 0))
rectangle = Rectangle(Plane=xy, XSize=structure_length_m, YSize=structure_width_m, Radius=0)  # -> Rectangle, Length
multiplication = Multiplication(A=floor_height_m_4, B=floor_number_4)
boxrec = BoxRectangle(Rectangle=rectangle.Rectangle, Height=multiplication)
debox = DeconstructBox(Box=boxrec)  # -> Plane, X, Y, Z
div = DivideDomain(Domain=debox.Z, Count=floor_number_4)
box = DomainBox(Base=debox.Plane, X=debox.X, Y=debox.Y, Z=div)
bbox = BoundingBox(Content=box, Plane=xy, UnionBox=True)  # -> Box, Box_2
debrep = DeconstructBrep(Brep=box)  # -> simplify(Faces), simplify(Edges), simplify(Vertices)
tower_box = Box(bbox.Box)

# ----
multiplication_2 = Multiplication(A=floor_height_m_3, B=floor_number_3)
building_height_h_m = Number(multiplication_2)

# ---- group: Define COLUMNS
cluster = Cluster_5(edges=debrep.Edges)
columns_hea240_s235 = Curve(cluster)

# ---- group: Define SIDE BEAMS
cluster_2 = Cluster_4(edges=debrep.Edges)  # -> side_beams_top_2, side_beams_left_2, side_beams_right_2
side_beams_right = Curve(cluster_2.side_beams_right_2)
side_beams_top = Curve(cluster_2.side_beams_top_2)
side_beams_left = Curve(cluster_2.side_beams_left_2)

# ---- group: Define SIDE BRACING AND BEAMS
cluster_3 = Cluster_3(faces=debrep.Faces)  # -> wireframe_curves_2, points_level_side_2
points_level_side = Point(cluster_3.points_level_side_2)
wireframe_curves = Curve(cluster_3.wireframe_curves_2)
cluster_4 = Cluster_2(wireframe_curves=wireframe_curves)
pline = PolyLine(Vertices=points_level_side, Closed=False)
explode = Explode(Curve=pline, Recursive=True)  # -> Segments, Vertices
braced_beams_floor = Curve(cluster_4)
bracing_beams = Curve(flatten(explode.Segments))

# ----
terrain_data_z_min_m_2 = Number(terrain_data_z_min_m)
terrain_data_category_2 = Number(terrain_data_category)
building_data_a_c_pe_10_2 = Number(building_data_a_c_pe_10)
building_data_c_c_pe_10_2 = Number(building_data_c_c_pe_10)
building_data_d_c_pe_10_2 = Number(building_data_d_c_pe_10)
building_data_b_c_pe_10_2 = Number(building_data_b_c_pe_10)
building_data_e_c_pe_10_2 = Number(building_data_e_c_pe_10)
terrain_data_z_0_m_2 = Number(terrain_data_z_0_m)
building_data_h_d_2 = Number(building_data_h_d)
entwine_3 = Entwine(Branch00=terrain_data_category_2, Branch01=terrain_data_z_0_m_2, Branch02=terrain_data_z_min_m_2, FlattenInputs=True)
entwine_4 = Entwine(
    Branch00=building_data_h_d_2,
    Branch01=building_data_a_c_pe_10_2,
    Branch02=building_data_b_c_pe_10_2,
    Branch03=building_data_c_c_pe_10_2,
    Branch04=building_data_d_c_pe_10_2,
    Branch05=building_data_e_c_pe_10_2,
    FlattenInputs=True)
panel_2 = Panel(entwine_3)
panel_3 = Panel(entwine_4)
building_data_walls = Number(entwine_4)
terrain_data = Number(entwine_3)

# ---- group: Calculation of MESH LOADING PARAMETERS
direction_vector_2 = Vector(direction_vector)
tower_box_2 = Box(tower_box)
terrain_category_4 = Number(terrain_category_2)
q_b_kn_m2_2 = Number(q_b_kn_m2)
building_data_walls_2 = Number(building_data_walls)
terrain_data_2 = Number(terrain_data)
int = Integer(terrain_category_4)
c_script = CSharpScript(
    box=tower_box_2,
    terrainCat=int,
    qb=q_b_kn_m2_2,
    buildingData=building_data_walls_2,
    terrainData=terrain_data_2,
    windDir=direction_vector_2,
    nMidStrips=Slider(1, range=0..10))  # -> out, Info, zoneMeshes, zoneCpe, zoneQp, profile; inputs box: Box, terrainCat: Int32, qb: Double, buildingData: tree of Double, terrainData: tree of Double, windDir: Vector3d, nMidStrips: Int32
# ---------- c_script: C# ----------
// Grasshopper Script Instance
#region Usings
using System;
using System.Linq;
using System.Collections;
using System.Collections.Generic;
using System.Drawing;

using Rhino;
using Rhino.Geometry;

using Grasshopper;
using Grasshopper.Kernel;
using Grasshopper.Kernel.Data;
using Grasshopper.Kernel.Types;
#endregion

public class Script_Instance : GH_ScriptInstance
{
    #region Notes
    /* 
      Members:
        RhinoDoc RhinoDocument
        GH_Document GrasshopperDocument
        IGH_Component Component
        int Iteration

      Methods (Virtual & overridable):
        Print(string text)
        Print(string format, params object[] args)
        Reflect(object obj)
        Reflect(object obj, string method_name)
    */
    #endregion

    // GH C# Script Component: Wall Zones - EN 1991-1-4 Section 7.2
    // Inputs:
    //   box         (Box)                     - Building bounding box
    //   terrainCat  (int)                     - Terrain category (0-4)
    //   qb          (double)                  - Basic velocity pressure [kN/m²]
    //   buildingData (DataTree<double>)       - Table 7.1 data tree
    //   terrainData  (DataTree<double>)       - Table 4.1 terrain data tree
    //   windDir     (Vector3d)               - Wind direction vector (+X, -X, +Y, -Y)
    //   nMidStrips  (int)                     - Number of strips for middle zone (h>2b case)
    //
    // Outputs:
    //   Info         (string)                 - Diagnostic output
    //   zoneMeshes   (DataTree<Mesh>)         - Zone meshes: {0}=A, {1}=B, {2}=C, {3}=D, {4}=E
    //   zoneCpe      (DataTree<double>)       - cpe,10 per mesh: {0}=A, {1}=B, {2}=C, {3}=D, {4}=E
    //   zoneQp       (DataTree<double>)       - qp per mesh: {0}=A, {1}=B, {2}=C, {3}=D, {4}=E
    //   profile      (string)                 - Windward face profile case

    private void RunScript(
		Box box,
		int terrainCat,
		double qb,
		DataTree<double> buildingData,
		DataTree<double> terrainData,
		Vector3d windDir,
		int nMidStrips,
		ref object Info,
		ref object zoneMeshes,
		ref object zoneCpe,
		ref object zoneQp,
		ref object profile)
    {
        // ============================================================
        // INPUT VALIDATION
        // ============================================================
        if (!box.IsValid)
        {
            AddRuntimeMessage(GH_RuntimeMessageLevel.Error, "Invalid box input.");
            return;
        }
        if (terrainCat < 0 || terrainCat > 4)
        {
            AddRuntimeMessage(GH_RuntimeMessageLevel.Error, "Terrain category must be 0-4.");
            return;
        }
        if (qb <= 0)
        {
            AddRuntimeMessage(GH_RuntimeMessageLevel.Error, "qb must be positive.");
            return;
        }
        if (windDir.Length < 0.01)
        {
            AddRuntimeMessage(GH_RuntimeMessageLevel.Error, "Wind direction vector is zero.");
            return;
        }
        if (nMidStrips < 1) nMidStrips = 2;

        // ============================================================
        // EXTRACT DIMENSIONS AND ORIGIN FROM BOX
        // ============================================================
        Point3d[] corners = box.GetCorners();
        Point3d origin = corners[0];

        double b1 = box.X.Length;
        double b2 = box.Y.Length;
        double h  = box.Z.Length;

        if (b1 <= 0 || b2 <= 0 || h <= 0)
        {
            AddRuntimeMessage(GH_RuntimeMessageLevel.Error, "Box has zero or negative dimensions.");
            return;
        }

        Vector3d axisX = box.Plane.XAxis;
        Vector3d axisY = box.Plane.YAxis;
        Vector3d axisZ = box.Plane.ZAxis;

        Point3d boxCenter = origin + 0.5 * b1 * axisX + 0.5 * b2 * axisY + 0.5 * h * axisZ;

        // ============================================================
        // DETERMINE b, d, AND WIND SENSE FROM DIRECTION
        // ============================================================
        double bVal, dVal;
        string dirLabel;
        bool windAlongX = Math.Abs(windDir.X) > Math.Abs(windDir.Y);
        double s;
        double aw_ww;

        if (windAlongX)
        {
            bVal = b2;
            dVal = b1;
            bool positive = windDir.X > 0;
            s = positive ? 1.0 : -1.0;
            aw_ww = positive ? 0.0 : b1;
            dirLabel = positive ? "+X" : "-X";
        }
        else
        {
            bVal = b1;
            dVal = b2;
            bool positive = windDir.Y > 0;
            s = positive ? 1.0 : -1.0;
            aw_ww = positive ? 0.0 : b2;
            dirLabel = positive ? "+Y" : "-Y";
        }

        // ============================================================
        // TERRAIN LOOKUP (Table 4.1)
        // ============================================================
        List<double> z0List = terrainData.Branch(terrainData.Paths[1]);
        List<double> zminList = terrainData.Branch(terrainData.Paths[2]);

        double z0 = z0List[terrainCat];
        double zmin = zminList[terrainCat];
        double kr = 0.19 * Math.Pow(z0 / 0.05, 0.07);

        // ============================================================
        // PEAK VELOCITY PRESSURE AT h (Expression 4.8)
        // ============================================================
        double qpH_val = ComputeQp(h, z0, zmin, kr, qb);

        // ============================================================
        // h/d RATIO AND TABLE 7.1 INTERPOLATION
        // ============================================================
        double hd = h / dVal;

        double[] hdArr = buildingData.Branch(buildingData.Paths[0]).ToArray();
        double[] cpeAArr = buildingData.Branch(buildingData.Paths[1]).ToArray();
        double[] cpeBArr = buildingData.Branch(buildingData.Paths[2]).ToArray();
        double[] cpeCArr = buildingData.Branch(buildingData.Paths[3]).ToArray();
        double[] cpeDArr = buildingData.Branch(buildingData.Paths[4]).ToArray();
        double[] cpeEArr = buildingData.Branch(buildingData.Paths[5]).ToArray();

        if (hdArr.Length > 1 && hdArr[0] > hdArr[hdArr.Length - 1])
        {
            Array.Reverse(hdArr);
            Array.Reverse(cpeAArr);
            Array.Reverse(cpeBArr);
            Array.Reverse(cpeCArr);
            Array.Reverse(cpeDArr);
            Array.Reverse(cpeEArr);
        }

        bool hdExceeds5 = hd > hdArr[hdArr.Length - 1];
        double hdClamped = Math.Max(hdArr[0], Math.Min(hdArr[hdArr.Length - 1], hd));

        double cpeA_val = Interpolate(hdArr, cpeAArr, hdClamped);
        double cpeB_val = Interpolate(hdArr, cpeBArr, hdClamped);
        double cpeC_val = Interpolate(hdArr, cpeCArr, hdClamped);
        double cpeD_val = Interpolate(hdArr, cpeDArr, hdClamped);
        double cpeE_val = Interpolate(hdArr, cpeEArr, hdClamped);

        // ============================================================
        // ZONE GEOMETRY — SIDE FACES (Figure 7.5)
        // ============================================================
        double eVal = Math.Min(bVal, 2.0 * h);

        double wA = eVal / 5.0;
        double wB;
        double wC;

        if (dVal > eVal)
        {
            wB = 4.0 * eVal / 5.0;
            wC = dVal - eVal;
        }
        else
        {
            wB = dVal - wA;
            wC = 0.0;
        }

        bool zoneCExists = wC > 0.0;
        bool zoneBExists = wB > 0.0;

        // ============================================================
        // WINDWARD FACE STRIPS (Figure 7.4)
        // ============================================================
        var dStrips = new List<double[]>();
        int profileType;

        if (h <= bVal)
        {
            profileType = 1;
            dStrips.Add(new double[] { 0, h, h, qpH_val });
        }
        else if (h <= 2.0 * bVal)
        {
            profileType = 2;
            double qpB = ComputeQp(bVal, z0, zmin, kr, qb);
            dStrips.Add(new double[] { 0, bVal, bVal, qpB });
            dStrips.Add(new double[] { bVal, h, h, qpH_val });
        }
        else
        {
            profileType = 3;
            double zBot = bVal;
            double zTop = h - bVal;
            double midH = zTop - zBot;
            double stripH = midH / nMidStrips;

            double qpBot = ComputeQp(bVal, z0, zmin, kr, qb);
            dStrips.Add(new double[] { 0, bVal, bVal, qpBot });

            for (int i = 0; i < nMidStrips; i++)
            {
                double zb = zBot + i * stripH;
                double zt = zBot + (i + 1) * stripH;
                double ze = zt;
                double qpStrip = ComputeQp(ze, z0, zmin, kr, qb);
                dStrips.Add(new double[] { zb, zt, ze, qpStrip });
            }

            dStrips.Add(new double[] { h - bVal, h, h, qpH_val });
        }

        string profileCase;
        if (profileType == 1)
            profileCase = "h <= b : Uniform pressure over full height, ze = h";
        else if (profileType == 2)
            profileCase = "b < h <= 2b : Two strips (lower ze=b, upper ze=h)";
        else
            profileCase = "h > 2b : Bottom strip b, " + nMidStrips + " middle strips, top strip b";

        // ============================================================
        // MESH TREE SETUP
        // ============================================================
        var meshTree = new DataTree<Mesh>();
        var cpeTree = new DataTree<double>();
        var qpTree = new DataTree<double>();

        var pathA = new GH_Path(0);
        var pathB = new GH_Path(1);
        var pathC = new GH_Path(2);
        var pathD = new GH_Path(3);
        var pathE = new GH_Path(4);

        meshTree.EnsurePath(pathA);
        meshTree.EnsurePath(pathB);
        meshTree.EnsurePath(pathC);
        meshTree.EnsurePath(pathD);
        meshTree.EnsurePath(pathE);

        cpeTree.EnsurePath(pathA);
        cpeTree.EnsurePath(pathB);
        cpeTree.EnsurePath(pathC);
        cpeTree.EnsurePath(pathD);
        cpeTree.EnsurePath(pathE);

        qpTree.EnsurePath(pathA);
        qpTree.EnsurePath(pathB);
        qpTree.EnsurePath(pathC);
        qpTree.EnsurePath(pathD);
        qpTree.EnsurePath(pathE);

        double a0 = aw_ww;
        double a1 = aw_ww + s * wA;
        double a2 = aw_ww + s * (wA + wB);
        double aE = aw_ww + s * eVal;
        double aL = aw_ww + s * dVal;

        // ============================================================
        // MESH GENERATION — SIDE FACES (A, B, C), LEEWARD (E), WINDWARD (D)
        // ============================================================
        if (windAlongX)
        {
            // Side face at y = 0
            meshTree.Add(MakeQuadWorld(origin, axisX, axisY, axisZ, boxCenter,
                a0, 0, 0,  a1, 0, 0,  a1, 0, h,  a0, 0, h), pathA);
            if (zoneBExists)
                meshTree.Add(MakeQuadWorld(origin, axisX, axisY, axisZ, boxCenter,
                    a1, 0, 0,  a2, 0, 0,  a2, 0, h,  a1, 0, h), pathB);
            if (zoneCExists)
                meshTree.Add(MakeQuadWorld(origin, axisX, axisY, axisZ, boxCenter,
                    aE, 0, 0,  aL, 0, 0,  aL, 0, h,  aE, 0, h), pathC);

            // Side face at y = b2
            meshTree.Add(MakeQuadWorld(origin, axisX, axisY, axisZ, boxCenter,
                a0, b2, 0,  a1, b2, 0,  a1, b2, h,  a0, b2, h), pathA);
            if (zoneBExists)
                meshTree.Add(MakeQuadWorld(origin, axisX, axisY, axisZ, boxCenter,
                    a1, b2, 0,  a2, b2, 0,  a2, b2, h,  a1, b2, h), pathB);
            if (zoneCExists)
                meshTree.Add(MakeQuadWorld(origin, axisX, axisY, axisZ, boxCenter,
                    aE, b2, 0,  aL, b2, 0,  aL, b2, h,  aE, b2, h), pathC);

            // Leeward E
            meshTree.Add(MakeQuadWorld(origin, axisX, axisY, axisZ, boxCenter,
                aL, 0, 0,  aL, b2, 0,  aL, b2, h,  aL, 0, h), pathE);

            // Windward D strips
            foreach (var strip in dStrips)
            {
                double zb = strip[0];
                double zt = strip[1];
                meshTree.Add(MakeQuadWorld(origin, axisX, axisY, axisZ, boxCenter,
                    a0, 0, zb,  a0, b2, zb,  a0, b2, zt,  a0, 0, zt), pathD);
            }
        }
        else
        {
            // Side face at x = 0
            meshTree.Add(MakeQuadWorld(origin, axisX, axisY, axisZ, boxCenter,
                0, a0, 0,  0, a1, 0,  0, a1, h,  0, a0, h), pathA);
            if (zoneBExists)
                meshTree.Add(MakeQuadWorld(origin, axisX, axisY, axisZ, boxCenter,
                    0, a1, 0,  0, a2, 0,  0, a2, h,  0, a1, h), pathB);
            if (zoneCExists)
                meshTree.Add(MakeQuadWorld(origin, axisX, axisY, axisZ, boxCenter,
                    0, aE, 0,  0, aL, 0,  0, aL, h,  0, aE, h), pathC);

            // Side face at x = b1
            meshTree.Add(MakeQuadWorld(origin, axisX, axisY, axisZ, boxCenter,
                b1, a0, 0,  b1, a1, 0,  b1, a1, h,  b1, a0, h), pathA);
            if (zoneBExists)
                meshTree.Add(MakeQuadWorld(origin, axisX, axisY, axisZ, boxCenter,
                    b1, a1, 0,  b1, a2, 0,  b1, a2, h,  b1, a1, h), pathB);
            if (zoneCExists)
                meshTree.Add(MakeQuadWorld(origin, axisX, axisY, axisZ, boxCenter,
                    b1, aE, 0,  b1, aL, 0,  b1, aL, h,  b1, aE, h), pathC);

            // Leeward E
            meshTree.Add(MakeQuadWorld(origin, axisX, axisY, axisZ, boxCenter,
                0, aL, 0,  b1, aL, 0,  b1, aL, h,  0, aL, h), pathE);

            // Windward D strips
            foreach (var strip in dStrips)
            {
                double zb = strip[0];
                double zt = strip[1];
                meshTree.Add(MakeQuadWorld(origin, axisX, axisY, axisZ, boxCenter,
                    0, a0, zb,  b1, a0, zb,  b1, a0, zt,  0, a0, zt), pathD);
            }
        }

        // ============================================================
        // POPULATE cpe AND qp TREES
        // ============================================================
        int meshCountA = meshTree.Branch(pathA).Count;
        for (int i = 0; i < meshCountA; i++)
        {
            cpeTree.Add(cpeA_val, pathA);
            qpTree.Add(qpH_val, pathA);
        }

        int meshCountB = meshTree.Branch(pathB).Count;
        for (int i = 0; i < meshCountB; i++)
        {
            cpeTree.Add(cpeB_val, pathB);
            qpTree.Add(qpH_val, pathB);
        }

        int meshCountC = meshTree.Branch(pathC).Count;
        for (int i = 0; i < meshCountC; i++)
        {
            cpeTree.Add(cpeC_val, pathC);
            qpTree.Add(qpH_val, pathC);
        }

        int meshCountE = meshTree.Branch(pathE).Count;
        for (int i = 0; i < meshCountE; i++)
        {
            cpeTree.Add(cpeE_val, pathE);
            qpTree.Add(qpH_val, pathE);
        }

        foreach (var strip in dStrips)
        {
            cpeTree.Add(cpeD_val, pathD);
            qpTree.Add(strip[3], pathD);
        }

        // ============================================================
        // BUILD INFO STRING
        // ============================================================
        var sb = new System.Text.StringBuilder();

        sb.AppendLine("========================================");
        sb.AppendLine(" WALL ZONES — EN 1991-1-4 Section 7.2");
        sb.AppendLine("========================================");
        sb.AppendLine();

        sb.AppendLine("--- Box Geometry ---");
        sb.AppendFormat("  Origin          : ({0:F2}, {1:F2}, {2:F2})\n", origin.X, origin.Y, origin.Z);
        sb.AppendFormat("  b1 (along X)    : {0:F2} m\n", b1);
        sb.AppendFormat("  b2 (along Y)    : {0:F2} m\n", b2);
        sb.AppendFormat("  h               : {0:F2} m\n", h);
        sb.AppendLine();

        sb.AppendLine("--- Wind Direction ---");
        sb.AppendFormat("  Direction       : {0}\n", dirLabel);
        sb.AppendFormat("  b (crosswind)   : {0:F2} m\n", bVal);
        sb.AppendFormat("  d (along-wind)  : {0:F2} m\n", dVal);
        sb.AppendLine();

        sb.AppendLine("--- Terrain (Table 4.1) ---");
        sb.AppendFormat("  Category        : {0}\n", terrainCat);
        sb.AppendFormat("  z0              : {0} m\n", z0);
        sb.AppendFormat("  zmin            : {0} m\n", zmin);
        sb.AppendFormat("  kr              : {0:F4}\n", kr);
        sb.AppendLine();

        sb.AppendLine("--- Pressure ---");
        sb.AppendFormat("  qb              : {0:F3} kN/m2\n", qb);
        sb.AppendFormat("  qp(h)           : {0:F3} kN/m2\n", qpH_val);
        sb.AppendLine();

        sb.AppendLine("--- Zone Geometry (Figure 7.5) ---");
        sb.AppendFormat("  h/d             : {0:F3}\n", hd);
        sb.AppendFormat("  e = min(b,2h)   : {0:F2} m\n", eVal);
        sb.AppendFormat("  Zone A width    : e/5   = {0:F2} m\n", wA);
        if (zoneBExists)
            sb.AppendFormat("  Zone B width    : {0}  = {1:F2} m\n",
                dVal > eVal ? "4e/5 " : "d-wA ", wB);
        else
            sb.AppendFormat("  Zone B          : does not exist (wA >= d)\n");
        if (zoneCExists)
            sb.AppendFormat("  Zone C width    : d-e   = {0:F2} m\n", wC);
        else
            sb.AppendFormat("  Zone C          : does not exist (d <= e)\n");
        sb.AppendLine();

        sb.AppendLine("--- Coefficients cpe,10 (Table 7.1) ---");
        sb.AppendFormat("  Zone A          : {0:F2}\n", cpeA_val);
        if (zoneBExists)
            sb.AppendFormat("  Zone B          : {0:F2}\n", cpeB_val);
        else
            sb.AppendFormat("  Zone B          : N/A\n");
        if (zoneCExists)
            sb.AppendFormat("  Zone C          : {0:F2}\n", cpeC_val);
        else
            sb.AppendFormat("  Zone C          : N/A\n");
        sb.AppendFormat("  Zone D          : {0:F2}\n", cpeD_val);
        sb.AppendFormat("  Zone E          : {0:F2}\n", cpeE_val);
        sb.AppendLine();

        sb.AppendLine("--- Windward Profile (Figure 7.4) ---");
        sb.AppendFormat("  {0}\n", profileCase);
        sb.AppendLine();

        sb.AppendLine("--- Zone D Strips ---");
        for (int i = 0; i < dStrips.Count; i++)
        {
            var strip = dStrips[i];
            sb.AppendFormat("  Strip {0}: z = {1:F2} to {2:F2} m, ze = {3:F2} m, qp = {4:F3} kN/m2\n",
                i, strip[0], strip[1], strip[2], strip[3]);
        }
        sb.AppendLine();

        sb.AppendLine("--- Tree Structure ---");
        sb.AppendLine("  {0} Zone A : " + meshTree.Branch(pathA).Count + " meshes");
        sb.AppendLine("  {1} Zone B : " + meshTree.Branch(pathB).Count + " meshes");
        sb.AppendLine("  {2} Zone C : " + meshTree.Branch(pathC).Count + " meshes");
        sb.AppendLine("  {3} Zone D : " + meshTree.Branch(pathD).Count + " meshes");
        sb.AppendLine("  {4} Zone E : " + meshTree.Branch(pathE).Count + " meshes");
        sb.AppendLine();

        if (hdExceeds5)
        {
            sb.AppendLine("WARNING: h/d = " + hd.ToString("F2") + " exceeds Table 7.1 max (5.0).");
            sb.AppendLine("  Coefficients clamped to h/d = 5.0 values.");
            AddRuntimeMessage(GH_RuntimeMessageLevel.Warning,
                "h/d = " + hd.ToString("F2") + " exceeds Table 7.1 range. Clamped to 5.0.");
        }

        if (h < zmin)
        {
            sb.AppendLine("NOTE: Building height h < zmin.");
            sb.AppendLine("  qp evaluated at zmin = " + zmin.ToString("F1") + " m (Clause 4.3.2).");
        }

        sb.AppendLine();
        sb.AppendLine("========================================");
        sb.AppendLine(" ASSUMPTIONS");
        sb.AppendLine("========================================");
        sb.AppendLine();

        sb.AppendLine("  Geometry");
        sb.AppendLine("    - Rectangular enclosed building (Section 7.2)");
        sb.AppendLine("    - Bounding box approximation: real geometry");
        sb.AppendLine("      may differ, zones computed for enclosing rectangle");
        sb.AppendLine("    - Building origin at box corner[0]");
        sb.AppendLine();

        sb.AppendLine("  Wind Climate");
        sb.AppendLine("    - Flat terrain: co(z) = 1.0 (no orography)");
        sb.AppendLine("    - Turbulence factor kI = 1.0 (recommended)");
        sb.AppendLine("    - Air density rho = 1.25 kg/m3 (sea level, in qb)");
        sb.AppendLine("    - No altitude correction applied");
        sb.AppendLine("    - Cardinal wind directions only (no diagonal)");
        sb.AppendLine("    - Perpendicular-to-face governs (Section 7.2)");
        sb.AppendLine();

        sb.AppendLine("  Pressure Profile");
        sb.AppendLine("    - Standard EN logarithmic profile (Cl. 4.3-4.5)");
        sb.AppendLine("    - Not a National Annex variant (e.g. DIN power-law)");
        sb.AppendLine("    - qp(z) = ce(z) * qb");
        sb.AppendLine("    - ce(z) = kr^2 * [ln^2(z/z0) + 7*ln(z/z0)]");
        sb.AppendLine("    - z clamped to max(z, zmin) per Cl. 4.3.2");
        sb.AppendLine("    - Zones A,B,C,E: ze = h (Cl. 7.2.2(1) Note)");
        sb.AppendLine("    - Zone D strips: ze = top of each strip");
        sb.AppendLine();

        sb.AppendLine("  Coefficients");
        sb.AppendLine("    - cpe,10 throughout (loaded area >= 10 m2)");
        sb.AppendLine("    - No cpe,1 correction for small areas");
        sb.AppendLine("    - Linear interpolation of Table 7.1 for D and E");
        sb.AppendLine("    - h/d clamped to range [0.25, 5.0]");
        sb.AppendLine();

        sb.AppendLine("  Zone Geometry");
        sb.AppendLine("    - Side face widths per Figure 7.5");
        sb.AppendLine("    - wB capped to d-wA when d < e (Figure 7.5)");
        sb.AppendLine("    - Middle zone (h>2b) divided into equal strips");
        sb.AppendLine("      (user-specified, not prescribed by code)");
        sb.AppendLine();

        sb.AppendLine("  Not Included");
        sb.AppendLine("    - Structural factor cscd (taken as 1.0)");
        sb.AppendLine("    - Internal pressure cpi (external only)");
        sb.AppendLine("    - Torsional loading (Cl. 7.1.2)");

        // ============================================================
        // ASSIGN OUTPUTS
        // ============================================================
        Info = sb.ToString();
        zoneMeshes = meshTree;
        zoneCpe = cpeTree;
        zoneQp = qpTree;
        profile = profileCase;
    }

    // ============================================================
    // HELPER: Compute qp(z) = ce(z) * qb
    // ============================================================
    private double ComputeQp(double z, double z0, double zmin, double kr, double qb)
    {
        double zEff = Math.Max(z, zmin);
        double lnZ = Math.Log(zEff / z0);
        double ce = kr * kr * (lnZ * lnZ + 7.0 * lnZ);
        return ce * qb;
    }

    // ============================================================
    // HELPER: Create quad mesh, ensure normal points outward from box
    // ============================================================
    private Mesh MakeQuadWorld(
        Point3d origin, Vector3d axX, Vector3d axY, Vector3d axZ,
        Point3d boxCenter,
        double x0, double y0, double z0,
        double x1, double y1, double z1,
        double x2, double y2, double z2,
        double x3, double y3, double z3)
    {
        Point3d p0 = LocalToWorld(origin, axX, axY, axZ, x0, y0, z0);
        Point3d p1 = LocalToWorld(origin, axX, axY, axZ, x1, y1, z1);
        Point3d p2 = LocalToWorld(origin, axX, axY, axZ, x2, y2, z2);
        Point3d p3 = LocalToWorld(origin, axX, axY, axZ, x3, y3, z3);

        var m = new Mesh();
        m.Vertices.Add(p0);
        m.Vertices.Add(p1);
        m.Vertices.Add(p2);
        m.Vertices.Add(p3);
        m.Faces.AddFace(0, 1, 2, 3);
        m.Normals.ComputeNormals();

        Point3d faceCenter = new Point3d(
            (p0.X + p1.X + p2.X + p3.X) / 4.0,
            (p0.Y + p1.Y + p2.Y + p3.Y) / 4.0,
            (p0.Z + p1.Z + p2.Z + p3.Z) / 4.0);

        Vector3d outward = faceCenter - boxCenter;
        Vector3d normal = m.Normals[0];

        if (Vector3d.Multiply(outward, normal) < 0)
        {
            m.Flip(true, true, true);
        }

        return m;
    }

    private Point3d LocalToWorld(
        Point3d origin, Vector3d axX, Vector3d axY, Vector3d axZ,
        double x, double y, double z)
    {
        return origin + x * axX + y * axY + z * axZ;
    }

    // ============================================================
    // LINEAR INTERPOLATION (ascending x array)
    // ============================================================
    private double Interpolate(double[] xs, double[] ys, double x)
    {
        if (x <= xs[0]) return ys[0];
        if (x >= xs[xs.Length - 1]) return ys[ys.Length - 1];

        for (int i = 0; i < xs.Length - 1; i++)
        {
            if (x >= xs[i] && x <= xs[i + 1])
            {
                double t = (x - xs[i]) / (xs[i + 1] - xs[i]);
                return ys[i] + t * (ys[i + 1] - ys[i]);
            }
        }
        return ys[ys.Length - 1];
    }
}
# ---------- end c_script ----------
meshes = Panel(c_script.zoneMeshes)
zonemeshes = Mesh(c_script.zoneMeshes)
zonecpe = Number(c_script.zoneCpe)
zoneqp = Number(c_script.zoneQp)
qp_kn_m2 = Panel(c_script.zoneQp)
zonemeshes_2 = Mesh(zonemeshes)
zonecpe_2 = Number(zonecpe)
zoneqp_2 = Number(zoneqp)
cpe = Panel(c_script.zoneCpe)
panel_4 = Panel(c_script.profile)
wind_loading_information = Panel(c_script.Info)

# ---- group: Preparation of MESHES for loading
zonemeshes_3 = Mesh(zonemeshes)
mesh_loading_density = ValueList({"0.10m": 0.10, "0.25m": 0.25, "0.50m": 0.50, "0.75m": 0.75, "1.00m": 1.00, "1.50m": 1.50}, selected="0.10m")
medges = MeshEdges(Mesh=zonemeshes_3)  # -> NakedEdges, InteriorEdges, NonManifoldEdges
join = JoinCurves(Curves=medges.NakedEdges, Preserve=False)
trim = TrimTree(Tree=join, Depth=2)
boundary = BoundarySurfaces(Edges=trim)
dim = Dimensions(Surface=boundary)  # -> UDimension, VDimension
division = Division(A=dim.UDimension, B=mesh_loading_density)
division_2 = Division(A=dim.VDimension, B=mesh_loading_density)
round = Round(Number=division)  # -> Nearest, Floor, Ceiling
round_2 = Round(Number=division_2)  # -> Nearest, Floor, Ceiling
mesh_uv = MeshSurface(Surface=boundary, UCount=round.Nearest, VCount=round_2.Nearest, Overhang=True, Equalize=False)
loadingmeshes = Mesh(mesh_uv)

# ---- group: Calculate Pitch Angle
cluster_5 = Cluster_6(floor_number=floor_number_2, stair_data=stair_data, braced_beams_floor=cluster_4)  # -> base_curve_for_hangers_2, transverse_stair_beams_2
base_curve_for_hangers = Curve(cluster_5.base_curve_for_hangers_2)
transverse_stair_beams = Curve(cluster_5.transverse_stair_beams_2)

# ---- group: Prepare STAIR LANDINGS and final BRACING SIDE BEAMS
stair_data_2 = Number(stair_data)
bang = ExplodeTree(Data=stair_data_2)  # -> Branch0, Branch1, Branch2, Branch3
addition = Addition(A=bang.Branch2, B=bang.Branch3)
addition_2 = Addition(A=addition, B=bang.Branch2)
merge = Merge(Data1=bang.Branch2, Data2=addition, Data3=addition_2)
panel_5 = Panel(merge)
num = Number(panel_5)
transverse_stair_beams_2 = Curve(transverse_stair_beams)
braced_beams_floor_2 = Curve(braced_beams_floor)
stair_division_lengths = Number(num)
cluster_6 = Cluster_7(
    transverse_stair_beams=transverse_stair_beams_2,
    stair_division_lengths=stair_division_lengths,
    braced_beams_floor=braced_beams_floor_2)  # -> landingside_stair_short_2, transverse_stair_beams_3, landingside_stair_bracing_2, C, landingside_stair_long_2, side_beams_braced_side_level_2
side_beams_braced_side_level = Curve(cluster_6.side_beams_braced_side_level_2)
landingside_stair_bracing = Curve(cluster_6.landingside_stair_bracing_2)
landingside_riserpoints = Point(cluster_6.C)
landingside_stair_short = Curve(cluster_6.landingside_stair_short_2)
landingside_stair_long = Curve(cluster_6.landingside_stair_long_2)
transverse_stair_beams_3 = Curve(cluster_6.transverse_stair_beams_3)

# ---- group: Define SECONDARIES AND CENTRAL BEAMS
item = ListItem(List=points_level_side, Index="1", Wrap=True)  # -> simplify(Item)
trim_2 = TrimTree(Tree=item, Depth=1)
item_2 = ListItem(List=trim_2, Index=0, Wrap=True)  # -> Item1, Item
ln = Line(StartPoint=item_2.Item1, EndPoint=item_2.Item)  # -> flatten(Line)
division_secondaries_2 = Integer(division_secondaries)
side_beams_right_2 = Curve(side_beams_right)
item_3 = ListItem(List=ln, Index=0, Wrap=True)  # -> Item1, Item
cull_i = CullIndex(List=ln, Indices="-1", Wrap=True)
divide = DivideCurve(Curve=side_beams_right_2, Count=division_secondaries_2, Kinks=False)  # -> Points, Tangents, Parameters
divide_2 = DivideCurve(Curve=cull_i, Count=division_secondaries_2, Kinks=False)  # -> Points, Tangents, Parameters
pline_2 = PolyLine(Vertices=divide.Points, Closed=False)
ln_2 = Line(StartPoint=divide.Points, EndPoint=divide_2.Points)
panel_6 = Panel("""0
-1""")
pline_3 = PolyLine(Vertices=divide_2.Points, Closed=False)
cull_i_2 = CullIndex(List=ln_2, Indices=panel_6, Wrap=True)  # -> simplify(List)
explode_2 = Explode(Curve=pline_3, Recursive=True)  # -> Segments, Vertices
explode_3 = Explode(Curve=pline_2, Recursive=True)  # -> flatten(Segments), Vertices
panel_7 = Panel("""0
1""")
middle_beams_divided = Curve(explode_2.Segments)
transverse_stair_beams_4 = Curve(transverse_stair_beams_3)
cluster_7 = Cluster(D=cull_i_2, T=cull_i_2)  # -> secondary_floor_beams_2, tertiary_floor_beams_2
item_4 = ListItem(List=middle_beams_divided, Index=panel_7, Wrap=True)
ccinter = CurveCurveIntersectionKaramba3D(IntersectingCurves=transverse_stair_beams_4, CurvesToIntersect=item_4, LimitDistance_m=0.005)
side_beams_floor_side = Curve(explode_3.Segments)
secondary_floor_beams = Line(flatten(cluster_7.secondary_floor_beams_2))
middle_beam_top = Curve(item_3.Item1)
tertiary_floor_beams = Line(flatten(cluster_7.tertiary_floor_beams_2))
panel_8 = Panel("""0
1""")
cull_i_3 = CullIndex(List=middle_beams_divided, Indices=panel_8, Wrap=True)
ins = InsertItems(List=cull_i_3, Item=ccinter, Indices="0", Wrap=True)  # -> flatten(List)
middle_beams = Curve(ins)

# ----
zonemeshes_4 = Mesh(zonemeshes)
zonecpe_3 = Number(zonecpe)
zoneqp_3 = Number(zoneqp)
tower_box_3 = Box(tower_box)
building_height_h_m_2 = Number(building_height_h_m)
direction_vector_3 = Vector(direction_vector)
expression_2 = Expression(h=building_height_h_m_2, Expression="h/2+2")
multiplication_3 = Multiplication(A=zonecpe_3, B=zoneqp_3)
area = Area(Geometry=tower_box_3)  # -> Area, Centroid
Z = UnitZ(Factor=expression_2)
multiplication_4 = Multiplication(A=direction_vector_3, B=2)
multiplication_5 = Multiplication(A=multiplication_3, B=Slider(2, range=0.5..3))
move = Move(Geometry=area.Centroid, Motion=Z)  # -> Geometry, Transform
cluster_8 = Cluster_9(mesh=zonemeshes_4, A=Slider(5, range=0..10))
cluster_9 = Cluster_9(mesh=cluster_8, A=multiplication_5)
mesh = Mesh(cluster_9)
medges_2 = MeshEdges(Mesh=cluster_8)  # -> NakedEdges, InteriorEdges, NonManifoldEdges
medges_3 = MeshEdges(Mesh=mesh)  # -> NakedEdges, InteriorEdges, NonManifoldEdges
medges_4 = MeshEdges(Mesh=cluster_8)  # -> NakedEdges, InteriorEdges, NonManifoldEdges
mesh_2 = Mesh(cluster_9)
clean = CleanTree(RemoveNulls=True, RemoveInvalid=True, RemoveEmpty=False, Tree=mesh_2)
divide_3 = DivideCurve(Curve=[medges_3.NakedEdges, medges_3.InteriorEdges, medges_3.NonManifoldEdges], Count=2, Kinks=False)  # -> Points, Tangents, Parameters
divide_4 = DivideCurve(Curve=[medges_4.NakedEdges, medges_4.InteriorEdges, medges_4.NonManifoldEdges], Count=2, Kinks=False)  # -> Points, Tangents, Parameters
area_2 = Area(Geometry=clean)  # -> Area, Centroid
vec2pt = Vector2Pt(PointA=divide_3.Points, PointB=divide_4.Points, Unitize=False)  # -> Vector, Length
panel_9 = Panel("""A
B
C
D
E""")
swatch = ColourSwatch(SwatchColor=RGBA(157, 255, 133, 157))
dot = AnnotationDot(Location=area_2.Centroid, PrimaryText=graft(panel_9))  # -> AnnotationDot, Location, PrimaryText, TextHeight
preview = CustomPreview(Geometry=[medges_2.NakedEdges, medges_2.InteriorEdges, medges_2.NonManifoldEdges], Material=swatch)
vdisex = VectorDisplayEx(Point=divide_3.Points, Vector=vec2pt.Vector, Colour=swatch, Width=2)
vdisex_2 = VectorDisplayEx(Point=move.Geometry, Vector=multiplication_4, Colour=RGB(0, 0, 0), Width=2)
preview_2 = CustomPreview(Geometry=cluster_9, Material=ColourSwatch(SwatchColor=RGBA(231, 255, 133, 50)))

# ---- group: Prepare HANGERS and define final PRIMARY BEAMS
hanger_positions_2 = Number(flatten(hanger_positions))
base_curve_for_hangers_2 = Curve(base_curve_for_hangers)
stair_bay_length_m_3 = Number(stair_bay_length_m_2)
side_beams_left_2 = Curve(side_beams_left)
panel_10 = Panel(hanger_positions_2)
X_2 = UnitX(Factor=stair_bay_length_m_3)
move_2 = Move(Geometry=base_curve_for_hangers_2, Motion=X_2)  # -> Geometry, Transform
flip = FlipCurve(Curve=move_2.Geometry)  # -> Curve, Flag
ccinter_2 = CurveCurveIntersectionKaramba3D(IntersectingCurves=move_2.Geometry, CurvesToIntersect=side_beams_left_2, LimitDistance_m=0.005)  # -> flatten(Curves)
eval = EvaluateLength(Curve=flip.Curve, Length=hanger_positions_2, Normalized=False)  # -> Point, Tangent, Parameter
shatter = Shatter(Curve=flip.Curve, Parameters=eval.Parameter)
middle_beams_2 = Curve(middle_beams)
side_beams_floor_side_2 = Curve(side_beams_floor_side)
side_beams_stair_side = Curve(ccinter_2)
ccinter_3 = CurveCurveIntersectionKaramba3D(IntersectingCurves=shatter, CurvesToIntersect=middle_beams_2, LimitDistance_m=0.005)  # -> flatten(Curves)
middle_beam_top_2 = Curve(middle_beam_top)
side_beams_top_2 = Curve(side_beams_top)
entwine_5 = Entwine(
    Branch0X=side_beams_stair_side,
    Branch1X=side_beams_floor_side_2,
    Branch2X=side_beams_top_2,
    Branch3X=ccinter_3,
    Branch4X=middle_beam_top_2,
    FlattenInputs=False)  # -> simplify(Result)
hanger_beam_segments = Curve(shatter)
primary_beams = Curve(entwine_5)

# ---- group: Define final HANGER ELEMENTS
hanger_positions_3 = Number(flatten(hanger_positions))
stair_data_3 = Number(flatten(stair_data))
hanger_beam_segments_2 = Curve(hanger_beam_segments)
floor_height_m_5 = Number(floor_height_m_2)
floor_number_5 = Integer(floor_number_2)
expression_3 = Expression(h=floor_height_m_5, Expression="h/2")
series = Series(Start=expression_3, Step=floor_height_m_5, Count=expr("x-1", floor_number_5))
item_5 = ListItem(List=hanger_beam_segments_2, Index="1", Wrap=True)
item_6 = ListItem(List=stair_data_3, Index=0, Wrap=True)  # -> Item, Item1
Z_2 = UnitZ(Factor=series)
item_7 = ListItem(List=hanger_positions_3, Index=0, Wrap=True)
end = EndPoints(Curve=item_5)  # -> Start, End
item_8 = ListItem(List=series, Index=0, Wrap=True)  # -> Item1, Item
panel_11 = Panel("""0.18
2.355""")
move_3 = Move(Geometry=item_5, Motion=expr("-x", Z_2))  # -> Geometry, Transform
subtraction = Subtraction(A=item_6.Item, B=item_7)
Z_3 = UnitZ(Factor=expr("-x", item_8.Item1))
merge_2 = Merge(Data1=end.Start, Data2=end.End)
addition_3 = Addition(A=subtraction, B=item_6.Item1)
panel_12 = Panel([subtraction, addition_3])
line = LineSDL(Start=merge_2, Direction=Z_3, Length=item_8.Item1)
eval_2 = EvaluateLength(Curve=move_3.Geometry, Length=flatten(panel_12), Normalized=False)  # -> Point, Tangent, Parameter
hanger_beam_segments_3 = Curve(hanger_beam_segments)
shatter_2 = Shatter(Curve=move_3.Geometry, Parameters=eval_2.Parameter)
eval_3 = EvaluateLength(Curve=graft(line), Length=series, Normalized=False)  # -> Point, Tangent, Parameter
panel_13 = Panel("""0.2
1.1""")
shatter_3 = Shatter(Curve=graft(line), Parameters=eval_3.Parameter)
entwine_6 = Entwine(Branch00=hanger_beam_segments_3, Branch01=shatter_2, FlattenInputs=True)
item_9 = ListItem(List=shatter_2, Index="1", Wrap=True)
X_3 = UnitX(Factor=panel_13)
move_4 = Move(Geometry=graft(item_9), Motion=expr("-x", X_3))  # -> Geometry, Transform
hangers_r16_s235 = Curve(flatten(shatter_3))
hanger_beams_shs120x4_s235 = Curve(entwine_6)
transverse_beams_hanger_side = Curve(move_4.Geometry)

# ---- group: Define final STAIR and HANGER ELEMENTS
transverse_beams_hanger_side_2 = Curve(transverse_beams_hanger_side)
end_2 = EndPoints(Curve=transverse_beams_hanger_side_2)  # -> Start, End
item_10 = ListItem(List=end_2.Start, Index=0, Wrap=True)  # -> Item1, Item
stair_division_lengths_2 = Number(stair_division_lengths)
ln_3 = Line(StartPoint=item_10.Item1, EndPoint=item_10.Item)
ext = ExtendCurve(Curve=ln_3, Type=0, Start="0.1", End="0.2")
Y_2 = UnitY(Factor=stair_division_lengths_2)
move_5 = Move(Geometry=ext, Motion=Y_2)  # -> Geometry, Transform
explode_4 = Explode(Curve=[ext, move_5.Geometry], Recursive=True)  # -> Segments, Vertices
cluster_10 = Cluster_8(L=explode_4.Vertices)
transverse_beams_hanger_side_3 = Curve(transverse_beams_hanger_side)
landingside_stair_short_2 = Curve(landingside_stair_short)
hangerside_stair_short = Curve(explode_4.Segments)
transverse_stair_beams_5 = Curve(transverse_stair_beams_3)
item_11 = ListItem(List=explode_4.Vertices, Index=0, Wrap=True)  # -> flatten(Item)
partition = PartitionList(List=item_11, Size="2")
landingside_riserpoints_2 = Point(landingside_riserpoints)
ccinter_4 = CurveCurveIntersectionKaramba3D(IntersectingCurves=flatten(landingside_stair_short_2), CurvesToIntersect=transverse_stair_beams_5, LimitDistance_m=0.005)
ccinter_5 = CurveCurveIntersectionKaramba3D(
    IntersectingCurves=flatten(hangerside_stair_short),
    CurvesToIntersect=transverse_beams_hanger_side_3,
    LimitDistance_m=0.005)
rev = ReverseList(List=partition)
ln_4 = Line(StartPoint=rev, EndPoint=landingside_riserpoints_2)
landingside_stair_short_3 = Curve(landingside_stair_short)
hangerside_stair_short_2 = Curve(explode_4.Segments)
stair_risers = Curve(ln_4)
stair_risers_landing_hanger = Curve(simplify(hangerside_stair_short_2))
hanger_beams_shs120x4_s235_2 = Curve(hanger_beams_shs120x4_s235)
stair_risers_landing_side = Curve(simplify(landingside_stair_short_3))
stair_transverse_landing_hanger = Curve(simplify(ccinter_5))
stair_transverse_landing_side = Curve(simplify(ccinter_4))
stair_risers_2 = Curve(simplify(stair_risers))
ccinter_6 = CurveCurveIntersectionKaramba3D(
    IntersectingCurves=flatten(stair_risers_landing_hanger),
    CurvesToIntersect=hanger_beams_shs120x4_s235_2,
    LimitDistance_m=0.005)
merge_3 = Merge(Data1=stair_transverse_landing_side, Data2=stair_transverse_landing_hanger)  # -> flatten(Result)
merge_4 = Merge(Data1=stair_risers_landing_side, Data2=stair_risers_landing_hanger, Data3=stair_risers_2)  # -> flatten(Result)
stair_transverse_beams = Curve(merge_3)
hangerside_stair_bracing = Curve(cluster_10)
stair_riser_beams = Curve(merge_4)
stair_hanger_beams = Curve(ccinter_6)

# ---- group: Gather Beam Axis
side_beams_braced_hea180_s235 = Curve(side_beams_braced_side_level)
split = SplitTree(Data=side_beams_braced_hea180_s235, Masks=flatten("{0;?}"))  # -> Positive, Negative
tstat = TreeStatistics(Tree=split.Positive)  # -> Paths, Length, Count
tstat_2 = TreeStatistics(Tree=split.Negative)  # -> Paths, Length, Count
item_12 = ListItem(List=tstat.Paths, Index=0, Wrap=True)  # -> Item1, Item
item_13 = ListItem(List=tstat_2.Paths, Index=0, Wrap=True)  # -> Item1, Item
split_2 = SplitTree(Data=split.Positive, Masks=flatten(item_12.Item1))  # -> Positive, Negative
split_3 = SplitTree(Data=split.Negative, Masks=flatten(item_13.Item1))  # -> Positive, Negative
secondary_floor_beams_2 = Line(secondary_floor_beams)
tertiary_floor_beams_2 = Line(tertiary_floor_beams)
stair_transverse_beams_2 = Curve(stair_transverse_beams)
stair_riser_beams_2 = Curve(stair_riser_beams)
bracing_beams_2 = Curve(bracing_beams)
hangerside_stair_bracing_2 = Curve(hangerside_stair_bracing)
landingside_stair_bracing_2 = Curve(landingside_stair_bracing)
stair_hanger_beams_2 = Curve(stair_hanger_beams)
hangers_r16_s235_2 = Curve(flatten(hangers_r16_s235))
landing_side_top = Curve(split_3.Positive)
landing_side_typical = Curve(split_3.Negative)
hanger_side_top = Curve(split_2.Positive)
hanger_side_typical = Curve(split_2.Negative)
side_beams_hea220_s235 = Curve(primary_beams)
columns_hea240_s235_2 = Curve(columns_hea240_s235)
entwine_7 = Entwine(
    Branch00=hanger_side_top,
    Branch01=hanger_side_typical,
    Branch02=landing_side_top,
    Branch03=landing_side_typical,
    FlattenInputs=True)
entwine_8 = Entwine(Branch00=secondary_floor_beams_2, Branch01=tertiary_floor_beams_2, FlattenInputs=True)
entwine_9 = Entwine(Branch00=stair_transverse_beams_2, Branch01=stair_riser_beams_2, FlattenInputs=True)
entwine_10 = Entwine(Branch00=bracing_beams_2, Branch01=[hangerside_stair_bracing_2, landingside_stair_bracing_2], FlattenInputs=True)
entwine_11 = Entwine(
    Branch0X=columns_hea240_s235_2,
    Branch1X=side_beams_hea220_s235,
    Branch2X=entwine_7,
    Branch3X=entwine_8,
    Branch4X=entwine_9,
    Branch5X=entwine_10,
    Branch6X=stair_hanger_beams_2,
    Branch7X=hangers_r16_s235_2,
    FlattenInputs=False)

# ---- group: Define Basic Material
matselect = MaterialSelectionKaramba3D(menu=[dropdown(0), dropdown(1), dropdown(2)])
material = MaterialKaramba3D(matselect)

# ---- group: Define Cross Sections
crosecselect = CrossSectionSelectorKaramba3D(NameOrListIndexOfCrossSection="IPE220", UseFuzzySearch=False)  # -> CrossSection, Info
material_2 = MaterialKaramba3D(material)
division_3 = Division(A="1.6", B=2)
material_3 = MaterialKaramba3D(material)
num_2 = Number("12")
crosec = CrossSectionKaramba3D(
    FamilyNameOfCrossSection="DefaultCroSec",
    NameOfCrossSection="R16",
    Material=material_2,
    Diameter_cm="1.6",
    WallThickness_cm=division_3,
    mode="Circular Hollow")
disassemble = DisassembleCrossSectionKaramba3D(CroSec=crosecselect.CrossSection)  # -> CrossSection, FamilyNameOfCrossSection, TypeNameOfCrossSection, ElemIdentifiers, Colour, Material, LocalEccentricity_cm, Heights_cm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
expression_4 = Expression(x=disassemble.Heights_cm, y=num_2, Expression="(x/2)+(y/2)+1")
crosec_2 = CrossSectionKaramba3D(
    FamilyNameOfCrossSection="DefaultCroSec",
    NameOfCrossSection="SHS 120x4",
    Material=material_3,
    Height_cm="12",
    UpperFlangeWidth_cm="12",
    LowerFlangeWidth_cm="12",
    UpperFlangeThickness_cm="0.4",
    LowerFlangeThickness_cm="0.4",
    SidewallsThickness_cm="0.4",
    FilletRadius_cm="0.4",
    mode="Box")
panel_14 = Panel("""HEA240
HEA220
HEA180
IPE160
IPE220
IPE80""")
neg = Negative(Value="67")
X_4 = UnitX(Factor=expression_4)
neg_2 = Negative(Value="0.4")
crosecselect_2 = CrossSectionSelectorKaramba3D(NameOrListIndexOfCrossSection=panel_14)  # -> CrossSection, Info
modify_crosec = ModifyCrossSectionKaramba3D(
    CrossSection=crosec_2,
    TypeNameOfCrossSection="SHS 120x4",
    Area_cm²="18.10",
    AreaY_cm²="7.83",
    AreaZ_cm²="7.83",
    Iyy_cm⁴="402",
    Izz_cm⁴="402",
    Ipp_cm⁴="637",
    Cw_cm⁶="2.38",
    Wely_cm³="67",
    Wely_cm³_2=neg,
    Wply_cm³="78.3",
    Welz_cm³="67",
    Welz_cm³_2=neg,
    Wplz_cm³="78.3",
    Wt_cm³="101",
    Lg_cm="804",
    mode="Beam")
modify_crosec_2 = ModifyCrossSectionKaramba3D(
    CrossSection=crosec,
    TypeNameOfCrossSection="R16",
    LocalEccentricity_cm=X_4,
    Area_cm²="2.01",
    AreaY_cm²="1.69",
    AreaZ_cm²="1.69",
    Iyy_cm⁴="0.32",
    Izz_cm⁴="0.32",
    Ipp_cm⁴="0.64",
    Wely_cm³="0.4",
    Wely_cm³_2=neg_2,
    Wply_cm³="0.68",
    Welz_cm³="0.4",
    Welz_cm³_2=neg_2,
    Wplz_cm³="0.68",
    Wt_cm³="0.8",
    Lg_cm="0.64",
    mode="Beam")
merge_5 = Merge(Data1=flatten(crosecselect_2.CrossSection), Data2=flatten(modify_crosec), Data3=flatten(modify_crosec_2))

# ---- group: Define Load - Wind
loadingmeshes_2 = Mesh(loadingmeshes)
zonecpe_4 = Number(zonecpe)
zoneqp_4 = Number(zoneqp)
zonemeshes_5 = Mesh(zonemeshes)
panel_15 = Panel("Beams.Side.Fixed.Floor Side")
panel_16 = Panel("Beams.Side.Fixed.Stair Side")
panel_17 = Panel("Beams.Side.Braced.Hanger Side")
panel_18 = Panel("Beams.Side.Braced.Landing Side")
facen = FaceNormals(Mesh=zonemeshes_5)  # -> Centers, Normals
multiplication_6 = Multiplication(A=zonecpe_4, B=zoneqp_4)
mesh_3 = Mesh(loadingmeshes_2)
wind_direction_3 = Integer(wind_direction)
tstat_3 = TreeStatistics(Tree=mesh_3)  # -> Paths, Length, Count
lng = ListLength(List=mesh_3)
merge_6 = Merge(Data1=panel_15, Data2=panel_16)
merge_7 = Merge(Data1=panel_18, Data2=panel_17)
equals = Equality(FirstNumber=lng, SecondNumber=0)  # -> Equality, Inequality
cull = CullPattern(List=graft(tstat_3.Paths), CullPattern=equals.Equality)  # -> flatten(List)
split_4 = SplitTree(Data=mesh_3, Masks=flatten("{3,4}"))  # -> graft(Positive), Negative
split_5 = SplitTree(Data=multiplication_6, Masks=flatten("{3,4}"))  # -> graft(Positive), Negative
entwine_12 = Entwine(Branch00=merge_6, Branch01=merge_6, Branch02=merge_6, Branch03=panel_18, Branch04=panel_17, FlattenInputs=True)  # -> simplify(Result)
entwine_13 = Entwine(Branch00=merge_7, Branch01=merge_7, Branch02=merge_7, Branch03=panel_16, Branch04=panel_15, FlattenInputs=True)  # -> simplify(Result)
area_3 = Area(Geometry=split_4.Positive)  # -> Area, Centroid
split_6 = SplitTree(Data=mesh_3, Masks=flatten(cull))  # -> Positive, Negative
filter_2 = StreamFilter(Gate=wind_direction_3, Stream0=entwine_12, Stream1=entwine_13)
split_7 = SplitTree(Data=filter_2, Masks=flatten(cull))  # -> Positive, Negative
multiplication_7 = Multiplication(A=area_3.Area, B=split_5.Positive)
lng_2 = ListLength(List=split_6.Negative)
panel_19 = Panel(entwine_12)
dup = DuplicateData(Data=split_7.Negative, Number=lng_2, Order=True)
abs = Absolute(Value=multiplication_7)
trim_3 = TrimTree(Tree=facen.Centers, Depth=1)
trim_4 = TrimTree(Tree=facen.Normals, Depth=1)
partition_2 = PartitionList(List=dup, Size=lng_2)  # -> simplify(Chunks)
ma = MassAddition(Input=flatten(abs))  # -> Result, PartialResults
amp = Amplitude(Vector=trim_4, Amplitude=multiplication_6)
split_8 = SplitTree(Data=partition_2, Masks=flatten("{3;0}"))  # -> graft(Positive), Negative
sum_reaction_check_zones_d_e_kn = Panel(ma.Result)
panel_20 = Panel(entwine_13)
neg_3 = Negative(Value=amp)
path_mapper = PathMapper(split_8.Positive, source="{A;B;C}", target="{A;C}")
split_9 = SplitTree(Data=neg_3, Masks=flatten(cull))  # -> Positive, Negative
merge_8 = Merge(Data1=path_mapper, Data2=split_8.Negative)
graft = GraftTree(Tree=split_9.Negative, IncludeEmptyLists=True, IncludeNullItems=True)
graft_2 = GraftTree(Tree=split_6.Negative, IncludeEmptyLists=True, IncludeNullItems=True)
vdisex_3 = VectorDisplayEx(Point=trim_3, Vector=neg_3, Colour=RGB(255, 0, 170), Width=2)
loads = LoadsKaramba3D(
    Vector=graft,
    Mesh=graft_2,
    ElementIdentifiers=merge_8,
    LCase="Wind",
    LineLoadsPerElement=Slider(10, range=0..20),
    MinimumLineLoadLength_m=0.5,
    mode="MeshLoad -Const.",
    menu=[buttons(off, on, off), buttons(off, on)])
load = LoadKaramba3D(loads)

# ---- group: Define Elements - Beam IDs
panel_21 = Panel("Hanger.Hangers")
panel_22 = Panel("""Stair.Transverse Beams
Stair.Riser Beams""")
panel_23 = Panel("""Beams.Side.Bracing
Stair.Bracing Beams""")
panel_24 = Panel("""Stair Side.Typical
Floor Side.Typical
Stair Side.Top
Floor Side.Top""")
panel_25 = Panel("""Typical
Top""")
panel_26 = Panel("""Hanger Side.Top
Hanger Side.Typical
Landing Side.Top
Landing Side.Typical""")
panel_27 = Panel("""Beams.Secondaries
Beams.Tertiaries""")
panel_28 = Panel("""Hanger.Top Beam
Hanger.Floor Beams""")
concat = Concatenate(FragmentA="Beams.Side.Fixed.", FragmentB=panel_24)
concat_2 = Concatenate(FragmentA="Beams.Middle.", FragmentB=panel_25)
concat_3 = Concatenate(FragmentA="Beams.Side.Braced.", FragmentB=panel_26)
merge_9 = Merge(Data1=concat, Data2=concat_2)
entwine_14 = Entwine(
    Branch0X="Columns",
    Branch1X=merge_9,
    Branch2X=concat_3,
    Branch3X=panel_27,
    Branch4X=panel_22,
    Branch5X=panel_23,
    Branch6X=panel_28,
    Branch7X=panel_21,
    FlattenInputs=False)

# ---- group: Define Supports
columns_hea240_s235_3 = Curve(columns_hea240_s235)
stair_riser_beams_3 = Curve(stair_riser_beams)
end_3 = EndPoints(Curve=columns_hea240_s235_3)  # -> Start, End
end_4 = EndPoints(Curve=stair_riser_beams_3)  # -> Start, End
rdpoints = RemoveDuplicatePointsKaramba3D(Point=[end_3.Start, end_3.End], LimitDistance=0.005)  # -> OutPoint, Info, Indexes
rdpoints_2 = RemoveDuplicatePointsKaramba3D(Point=[end_4.Start, end_4.End], LimitDistance=0.005)  # -> OutPoint, Info, Indexes
staircase_end_points = Point(rdpoints_2.OutPoint)
column_end_points = Point(rdpoints.OutPoint)
pdecon = Deconstruct(Point=column_end_points)  # -> XComponent, YComponent, ZComponent
pdecon_2 = Deconstruct(Point=staircase_end_points)  # -> XComponent, YComponent, ZComponent
smaller = SmallerThan(FirstNumber=pdecon.ZComponent, SecondNumber="0.01")  # -> SmallerThan, OrEqualTo
smaller_2 = SmallerThan(FirstNumber=pdecon_2.ZComponent, SecondNumber="0.01")  # -> SmallerThan, OrEqualTo
cull_2 = CullPattern(List=column_end_points, CullPattern=smaller.SmallerThan)
cull_3 = CullPattern(List=staircase_end_points, CullPattern=smaller_2.SmallerThan)
rdpoints_3 = RemoveDuplicatePointsKaramba3D(Point=cull_2, LimitDistance=0.005)  # -> OutPoint, Info, Indexes
rdpoints_4 = RemoveDuplicatePointsKaramba3D(Point=cull_3, LimitDistance=0.005)  # -> OutPoint, Info, Indexes
supp = SupportKaramba3D(
    PosInd=rdpoints_3.OutPoint,
    Ct_kN_m=Vector(0, 0, 0),
    Cr_kNm_rad=Vector(0, 0, 0),
    menu=[buttons(on, on, on, off, off, on)])
supp_2 = SupportKaramba3D(
    PosInd=rdpoints_4.OutPoint,
    Ct_kN_m=Vector(0, 0, 0),
    Cr_kNm_rad=Vector(0, 0, 0),
    menu=[buttons(on, on, on, off, off, off)])
support = SupportKaramba3D([supp, supp_2])

# ---- group: Define Elements
panel_29 = Panel("""True
True
True
True
True
False
True
False""")
long = LongestList(ListA=entwine_14, ListB=graft(merge_5), ListC=graft(panel_29), PaddingMode=2)  # -> ListA, ListB, ListC
lineelem = CreateLinearElementKaramba3D(
    Line=entwine_11,
    Identifier=graft(entwine_14),
    CrossSection=graft(long.ListB),
    LimitDistance_m=0.005,
    BucklingLengthY_m=-1,
    BucklingLengthZ_m=-1,
    BucklingLengthLT_m=-1,
    Bending=graft(True),
    ToPolylineMaxAngle=0.25,
    ToPolylineTolerance=0.1,
    ToPolylineMaxEdgeLength=0.25,
    New=True,
    Remove=True,
    mode="LineToBeam",
    GuidGeneratorSeed=-1252977369)  # -> Element, Points, Info

# ---- group: Define Joints
panel_30 = Panel("""Beams.Middle.Typical
Beams.Middle.Top""")
panel_31 = Panel("""Beams.Side
Beams.Middle.Typical""")
panel_32 = Panel("""Stair.Riser Beams
Beams.Middle.Typical""")
panel_33 = Panel("""Beams.Middle.Typical
Beams.Side""")
panel_34 = Panel("Stair.Transverse Beams")
entwine_15 = Entwine(
    Branch00="Beams.Side.Braced",
    Branch01=panel_30,
    Branch02="Beams.Secondaries",
    Branch03="Beams.Tertiaries",
    Branch04="Stair.Transverse Beams",
    Branch05="Stair.Riser Beams",
    Branch06="Hanger.Top Beam",
    FlattenInputs=True)
entwine_16 = Entwine(
    Branch00="Columns",
    Branch01="Beams.Side.Braced",
    Branch02=panel_31,
    Branch03="Beams.Secondaries",
    Branch04=panel_32,
    Branch05="Beams.Side.Braced.Landing Side",
    Branch06=panel_33,
    FlattenInputs=True)
joint_agent = BeamJointAgentKaramba3D(
    BeamIdentifier=entwine_15,
    ToElementIdentifiers=entwine_16,
    Ct_kN_m=Vector(0, 0, 0),
    Cr_kNm_rad=Vector(0, 0, 0),
    menu=[buttons(off, off, off, off, on, on)])
joint_agent_2 = BeamJointAgentKaramba3D(
    BeamIdentifier="Stair.Riser Beams",
    ToElementIdentifiers="Hanger.Floor Beams",
    Ct_kN_m=Vector(0, 0, 0),
    Cr_kNm_rad=Vector(0, 0, 0),
    menu=[buttons(off, off, off, off, off, on)])
joint = JointKaramba3D([joint_agent, joint_agent_2])

# ---- group: Define Loads - Gravity
Z_4 = UnitZ(Factor=Slider(-1.15, range=-1.15..0))
loads_2 = LoadsKaramba3D(Vector=Z_4, LCase="Gravity", mode="Gravity")
load_2 = LoadKaramba3D(loads_2)

# ---- group: Modify Elements
item_14 = ListItem(List=reverse(panel_23), Index=0, Wrap=True)
panel_35 = Panel(item_14)
item_15 = ListItem(List=reverse(panel_28), Index=0, Wrap=True)
Z_5 = UnitZ(Factor=expr("-x", expression_4))
panel_36 = Panel(item_15)
merge_10 = Merge(Data1=panel_23, Data2=panel_21)
panel_37 = Panel(merge_10)
orientate = OrientateElemKaramba3D(BeamIdentifier=item_14, Alpha_deg="90", mode="Beam")  # -> simplify(Element)
modifyelem = ModifyElementKaramba3D(BeamIdentifierIndex=item_15, LocalEccentricity_cm=Z_5, mode="Beam")
modifyelem_2 = ModifyElementKaramba3D(BeamIdentifierIndex=merge_10, Bending=Toggle(False), mode="Beam")
element = ElementKaramba3D([lineelem.Element, orientate, modifyelem, modifyelem_2])

# ---- group: Define Load Combinations
panel_38 = Panel("""G = Gravity
W = Wind
SLS = G + W
ULS = 1.35*G + 1.5*W""")
lccombinator = LoadCaseCombinatorKaramba3D(LoadCaseCombinationRulesKaramba3D=panel_38)  # -> LoadCaseCombinations, NamesOfLoadCases, NumberOfLoadCases

# ----
merge_11 = Merge(Data1=load_2, Data2=load, Data3=lccombinator.LoadCaseCombinations)

element_2 = ElementKaramba3D(element)
load_3 = LoadKaramba3D(merge_11)
joint_2 = JointKaramba3D(joint)
support_2 = SupportKaramba3D(support)
assemble = AssembleModelKaramba3D(Elem=flatten(element_2), Support=flatten(support_2), Load=flatten(load_3), Joint=flatten(joint_2), LimitDistance_m=0.005)  # -> Model, Info, Mass_kg, CentreOfGravity, LoadCaseNames
system_mass_kg = Panel(assemble.Mass_kg)

# ---- group: Analyze Model
analyse = AnalyseKaramba3D(Model=assemble.Model)  # -> AnalysedModel, MaximumDisplacement_cm, ResultingForce_kN, ChangeOfElasticEnergy_kNm
panel_39 = Panel(analyse.MaximumDisplacement_cm)
panel_40 = Panel(assemble.LoadCaseNames)

# ----
model = ModelKaramba3D(analyse.AnalysedModel)

press_to_export = Button()
folder_path_for_export = FilePath("C:\Users\drago\OneDrive\Desktop\")
dstv_name_extension = Panel("ENG02-Steel Tower.saf")
concat_4 = Concatenate(FragmentA=folder_path_for_export, FragmentB=dstv_name_extension)
extosaf = ExportModelToSAFKaramba3D(
    Model=model,
    Filepath=concat_4,
    ExportNow=press_to_export,
    OrientationGlobalCS=0,
    OrientationLocalCS=0,
    Discipline="Load-bearing structure",
    BuildingCodeIndex=0,
    LengthSegment_m=-1,
    MaximumFacesMesh=2000,
    SAFVersion="1.0.5",
    CrossSectionNameConversion="CrossSectionNameAliases.csv")  # -> Model, Info
panel_41 = Panel(extosaf.Info)

# ---- group: View Results - Model & Beam View
resultselect = ResultSelectorKaramba3D(
    Model=model,
    menu=[buttons(on, on), dropdown(4), dropdown(0), buttons(off, off, off, off, off, off, off), buttons(off, off, off, off, off, off), buttons(off, off, off, off, off, off, off, off), buttons(off, off, off, off, off, off, off, off)])  # -> Model, LoadCaseSelection
modelview = ModelViewKaramba3D(Model=resultselect.Model)  # -> Model, DeformedMesh, DeformedAxes, DeformedModel, MaximumDeformation
beamview = BeamViewKaramba3D(Model=modelview.Model)  # -> Model, MeshesOfRenderedBeams, DeformedBeamAxes, LegendColours, LegendTags
legend = LegendKaramba3D(
    Colors=beamview.LegendColours,
    Tags=beamview.LegendTags,
    Scale=0.6,
    Textsize=30,
    Legend_HasHeader=False,
    Legend_Justification=2,
    Legend_Position=2)

# ---- group: Results - Reaction Forces
react = ReactionForcesKaramba3D(AnalysedModel=model)  # -> Model, ReactionForces_kN, ReactionMoments_kNm, SupportPosition, SumOfReactionForces_kN, SumOfReactionMoments_kNm, GoverningLoadCaseIndex
panel_42 = Panel(react.SumOfReactionForces_kN)

# ---- group: Export File STP
press_to_export_2 = Button()
folder_path_for_export_2 = FilePath("C:\Users\drago\OneDrive\Desktop\")
dstv_name_extension_2 = Panel("ENG02-Steel Tower.stp")
concat_5 = Concatenate(FragmentA=folder_path_for_export_2, FragmentB=dstv_name_extension_2)
filter_3 = StreamFilter(Gate=press_to_export_2, Stream1=model)
extodstv = ExportModelToDStVKaramba3D(
    Model=filter_3,
    Path=concat_5,
    ExportPath="C:\Users\drago\OneDrive\Desktop\ENG01-Canopy.stp",
    menu=[buttons(off, off, off, on, off, off)])  # -> DStV, Info
panel_43 = Panel(extodstv.DStV)

# ---- group: Show Warning in case Hanger Cables are in compression.
b_forces = BeamForcesKaramba3D(AnalysedModel=model, BeamsIdentifiers="Hanger.Hangers", Ts=[0, 1])  # -> Model, NormalForce_kN, ShearForceVz_kN, ShearForceVy_kN, TorsionalMomentMt_kNm, BendingMomentMy_kNm, BendingMomentMz_kNm, LoadCaseIndex
smaller_3 = SmallerThan(FirstNumber=b_forces.NormalForce_kN, SecondNumber=0)  # -> SmallerThan, OrEqualTo
panel_44 = Panel(b_forces.NormalForce_kN)
cset = CreateSet(List=flatten(smaller_3.SmallerThan))  # -> Set, Map
ma_2 = MassAddition(Input=cset.Set)  # -> Result, PartialResults
filter_4 = StreamFilter(Gate=ma_2.Result, Stream1="Warning: some hanger cables are in compression.")
panel_45 = Panel(ma_2.Result)
tag = TextTag3D(Location="{0,0,0}", Text=filter_4, Size=0.5, Justification=1)

# ==== cluster Cluster
T = ClusterInput()
tstat = TreeStatistics(Tree=T)  # -> Paths, Length, Count
item = ListItem(List=tstat.Paths, Index=Slider(3, range=0..3), Wrap=True)
D = ClusterInput()
panel = Panel("""-1
-2""")
split = SplitTree(Data=D, Masks=flatten(item))  # -> Positive, Negative
panel_2 = Panel("""0
1""")
item_2 = ListItem(List=split.Negative, Index=panel, Wrap=True)
item_3 = ListItem(List=split.Negative, Index="2", Wrap=True)
item_4 = ListItem(List=split.Negative, Index=panel_2, Wrap=True)
divide = DivideCurve(Curve=graft(item_4), Count="3", Kinks=False)  # -> simplify(Points), Tangents, Parameters
divide_2 = DivideCurve(Curve=item_2, Count="2", Kinks=False)  # -> Points, Tangents, Parameters
panel_3 = Panel("""False
True
True
False
False""")
panel_4 = Panel("""False
True
False
False""")
cull = CullPattern(List=divide.Points, CullPattern=panel_3)
cull_2 = CullPattern(List=divide_2.Points, CullPattern=panel_4)
bang = ExplodeTree(Data=cull_2)  # -> Branch0, Branch1, Branch2, Branch3, Branch4, Branch5
bang_2 = ExplodeTree(Data=cull)  # -> Branch0, Branch1, Branch2, Branch3, Branch4, Branch5
ln = Line(StartPoint=[bang_2.Branch0, bang_2.Branch2, bang_2.Branch4], EndPoint=[bang_2.Branch1, bang_2.Branch3, bang_2.Branch5])
ln_2 = Line(StartPoint=[bang.Branch0, bang.Branch2, bang.Branch4], EndPoint=[bang.Branch1, bang.Branch3, bang.Branch5])
llinter = LineLineIntersectionKaramba3D(IntersectingLines=flatten([ln, ln_2]), LinesToIntersect=flatten([item_4, item_2]), LimitDistance_m=0.005)  # -> InterSecPoints, flatten(LineSubSegments)
merge = Merge(Data1=split.Positive, Data2=item_3, Data3=llinter.LineSubSegments)  # -> flatten(Result)
secondary_floor_beams = Curve(merge)
tertiary_floor_beams = Curve([ln, ln_2])
secondary_floor_beams_2 = ClusterOutput(secondary_floor_beams)
tertiary_floor_beams_2 = ClusterOutput(tertiary_floor_beams)

# ==== cluster Cluster_2
wireframe_curves = ClusterInput()
wireframe_curves_2 = Curve(wireframe_curves)
item = ListItem(List=wireframe_curves_2, Index="1", Wrap=True)
divide = DivideCurve(Curve=item, Count="2", Kinks=False)  # -> Points, Tangents, Parameters
shatter = Shatter(Curve=item, Parameters=flatten(divide.Parameters))  # -> flatten(Segments)
rdlines = RemoveDuplicateLinesKaramba3D(Line=shatter, LimitDistance=0.005)  # -> OutLine, Info, Indexes
partition = PartitionList(List=rdlines.OutLine, Size="4")
braced_beams_floor = Curve(partition)
braced_beams_floor_2 = ClusterOutput(braced_beams_floor)

# ==== cluster Cluster_3
faces = ClusterInput()
faces_2 = Surface(faces)
panel = Panel("""1
3""")
item = ListItem(List=faces_2, Index=panel, Wrap=True)
wires = BrepWireframe(Brep=item, Density=-1)
panel_2 = Panel("""0
1""")
item_2 = ListItem(List=wires, Index=panel_2, Wrap=True)
item_3 = ListItem(List=item_2, Index=0, Wrap=True)  # -> Item, Item1
crv = Curve(item_3.Item)
crv_2 = Curve(item_3.Item1)
midpt = CurveMiddle(Curve=crv_2)
end = EndPoints(Curve=crv)  # -> Start, End
entwine = Entwine(Branch0X=end.Start, Branch1X=midpt, Branch2X=end.End, FlattenInputs=False)
path_mapper = PathMapper(entwine, source="{A;B;C}", target="{B;C}[A]")
wireframe_curves = Curve(wires)
points_level_side = Point(path_mapper)
wireframe_curves_2 = ClusterOutput(wireframe_curves)
points_level_side_2 = ClusterOutput(points_level_side)

# ==== cluster Cluster_4
edges = ClusterInput()
panel = Panel("""0
1
2
3""")
edges_2 = Curve(edges)
cull_i = CullIndex(List=edges_2, Indices=panel, Wrap=True)  # -> simplify(List)
tstat = TreeStatistics(Tree=cull_i)  # -> Paths, Length, Count
item = ListItem(List=tstat.Paths, Index=0, Wrap=True)  # -> Item1, Item
split = SplitTree(Data=cull_i, Masks=flatten(item.Item1))  # -> Positive, Negative
panel_2 = Panel("""0
2""")
item_2 = ListItem(List=split.Negative, Index=0, Wrap=True)  # -> Item, Item1, Item2, Item3
item_3 = ListItem(List=split.Positive, Index=panel_2, Wrap=True)
item_4 = ListItem(List=item_3, Index=0, Wrap=True)  # -> Item, Item1
entwine = Entwine(Branch00=item_4.Item, Branch01=item_4.Item1, FlattenInputs=True)  # -> simplify(Result)
side_beams_right = Curve(item_2.Item2)
side_beams_top = Curve(entwine)
side_beams_left = Curve(item_2.Item)
side_beams_top_2 = ClusterOutput(side_beams_top)
side_beams_left_2 = ClusterOutput(side_beams_left)
side_beams_right_2 = ClusterOutput(side_beams_right)

# ==== cluster Cluster_5
edges = ClusterInput()
edges_2 = Curve(edges)
eval = EvaluateLength(Curve=edges_2, L05=0.5, Normalized=True)  # -> Point, Tangent, Parameter
Z = UnitZ(Factor=1)
dprod = DotProduct(VectorA=eval.Tangent, VectorB=Z, Unitize=False)
num = Number("0")
abs = Absolute(Value=dprod)
expression = Expression(A=abs, B=num, tol=Slider(0.001, range=0..0.001), Expression="if (abs(A-B)<tol,True,False)")
bool = Boolean(invert(expression))
cull = CullPattern(List=edges_2, CullPattern=bool)
columns = Curve(flatten(cull))
columns_2 = ClusterOutput(columns)

# ==== cluster Cluster_6
braced_beams_floor = ClusterInput()
floor_number = ClusterInput()
stair_data = ClusterInput()
braced_beams_floor_2 = Curve(braced_beams_floor)
floor_number_2 = Integer(floor_number)
stair_data_2 = Number(flatten(stair_data))
item = ListItem(List=braced_beams_floor_2, Index=0, Wrap=True)  # -> Item, Item1, Item2, Item3
item_2 = ListItem(List=stair_data_2, Index=0, Wrap=True)  # -> Item, Item1
cull_i = CullIndex(List=flatten(item.Item3), Indices="-1", Wrap=True)  # -> graft(List)
item_3 = ListItem(List=flatten(item.Item3), Index=expr("x-2", floor_number_2), Wrap=True)
flip = FlipCurve(Curve=cull_i)  # -> Curve, Flag
eval = EvaluateLength(Curve=flip.Curve, Length=item_2.Item, Normalized=False)  # -> Point, Tangent, Parameter
end = EndPoints(Curve=cull_i)  # -> Start, End; disabled
panel = Panel("0.9")  # disabled
shatter = Shatter(Curve=flip.Curve, Parameters=eval.Parameter)
scale = Scale(Geometry=cull_i, Center=end.Start, Factor=panel)  # -> Geometry, Transform; disabled
item_4 = ListItem(List=shatter, Index=0, Wrap=True)  # -> Item, Item1
panel_2 = Panel("""0.2
1.1""")
X = UnitX(Factor=panel_2)
flip_2 = FlipCurve(Curve=item_4.Item1)  # -> Curve, Flag
move = Move(Geometry=simplify(flip_2.Curve), Motion=X)  # -> Geometry, Transform
transverse_stair_beams = Curve(move.Geometry)
base_curve_for_hangers = Curve(item_3)
transverse_stair_beams_2 = ClusterOutput(transverse_stair_beams)
base_curve_for_hangers_2 = ClusterOutput(base_curve_for_hangers)

# ==== cluster Cluster_7
transverse_stair_beams = ClusterInput()
transverse_stair_beams_2 = Curve(transverse_stair_beams)
end = EndPoints(Curve=transverse_stair_beams_2)  # -> Start, End
transverse_stair_beams_3 = ClusterOutput(transverse_stair_beams_2)
stair_division_lengths = ClusterInput()
item = ListItem(List=end.End, Index=0, Wrap=True)  # -> Item, Item1
ln = Line(StartPoint=item.Item, EndPoint=item.Item1)
stair_division_lengths_2 = Number(stair_division_lengths)
ext = ExtendCurve(Curve=ln, Type=0, Start="0.2", End="0.1")
tstat = TreeStatistics(Tree=ext)  # -> Paths, Length, Count
item_2 = ListItem(List=tstat.Paths, Index=0, Wrap=True)  # -> Item1, Item
split = SplitTree(Data=ext, Masks=flatten(item_2.Item1))  # -> Positive, Negative
panel = Panel("""0.9
1.275
2.175""")
braced_beams_floor = ClusterInput()
Y = UnitY(Factor=stair_division_lengths_2)
move = Move(Geometry=split.Negative, Motion=Y)  # -> Geometry, Transform
braced_beams_floor_2 = Curve(braced_beams_floor)
crv = Curve(split.Negative)
match = MatchTree(Tree=move.Geometry, Guide=crv)
llinter = LineLineIntersectionKaramba3D(IntersectingLines=[move.Geometry, ln], LinesToIntersect=transverse_stair_beams_2, LimitDistance_m=0.005)  # -> InterSecPoints, LineSubSegments
merge = Merge(Data1=crv, Data2=match)
explode = Explode(Curve=merge, Recursive=True)  # -> Segments, Vertices
trim = TrimTree(Tree=llinter.LineSubSegments, Depth=1)
panel_2 = Panel("""1
2""")
Y_2 = UnitY(Factor="0.9")
item_3 = ListItem(List=explode.Vertices, Index=panel_2, Wrap=True)
move_2 = Move(Geometry=split.Positive, Motion=Y_2)  # -> Geometry, Transform
trim_2 = TrimTree(Tree=item_3, Depth=1)
explode_2 = Explode(Curve=[split.Positive, move_2.Geometry], Recursive=True)  # -> Segments, Vertices
panel_3 = Panel("""2
4""")
panel_4 = Panel("""1
7""")
item_4 = ListItem(List=trim_2, Index=panel_3, Wrap=True)
item_5 = ListItem(List=simplify(braced_beams_floor_2), Index=0, Wrap=True)  # -> Item, Item1, Item2, Item3
panel_5 = Panel("""1
2""")
item_6 = ListItem(List=trim_2, Index=panel_4, Wrap=True)
merge_2 = Merge(Data1=explode.Vertices, Data2=explode_2.Vertices)
merge_3 = Merge(Data1=explode_2.Segments, Data2=explode.Segments)
item_7 = ListItem(List=explode_2.Vertices, Index=panel_5, Wrap=True)  # -> flatten(Item)
item_8 = ListItem(List=flatten(item_5.Item3), Index=0, Wrap=True)  # -> Item1, Item
cull_i = CullIndex(List=flatten(item_5.Item3), Indices="-1", Wrap=True)  # -> graft(List)
item_9 = ListItem(List=item_7, Index=0, Wrap=True)  # -> Item, Item1, Item2
item_10 = ListItem(List=merge_2, Index="3", Wrap=True)
ln_2 = Line(StartPoint=item_6, EndPoint=item_4)  # -> simplify(Line)
ln_3 = Line(StartPoint=item_9.Item1, EndPoint=item_9.Item2)
partition = PartitionList(List=flatten(item_10), Size="2")  # -> simplify(Chunks)
merge_4 = Merge(Data1=ln_3, Data2=ln_2)
landingside_stair_short = Curve(simplify(merge_3))
crv_2 = Curve(landingside_stair_short)
llinter_2 = LineLineIntersectionKaramba3D(IntersectingLines=flatten(crv_2), LinesToIntersect=cull_i, LimitDistance_m=0.005)  # -> InterSecPoints, LineSubSegments
landingside_stair_long = Curve(trim)
landingside_stair_bracing = Curve(merge_4)
bang = ExplodeTree(Data=partition)  # -> Branch0, Branch1, Branch2
entwine = Entwine(Branch0X=llinter_2.LineSubSegments, Branch1X=item_8.Item1, FlattenInputs=False)
path_mapper = PathMapper(partition, source="{A}", target="{A + 1}")
landingside_stair_long_2 = ClusterOutput(landingside_stair_long)
landingside_stair_short_2 = ClusterOutput(landingside_stair_short)
renumber = RenumberPaths(Data=entwine)
landingside_stair_bracing_2 = ClusterOutput(landingside_stair_bracing)
project = Project(Geometry=bang.Branch1, Plane=PlaneXY(0, 0, 0))  # -> Geometry, Transform
rev = ReverseList(List=flatten(path_mapper))
rev_2 = ReverseList(List=project.Geometry)
entwine_2 = Entwine(Branch0X=item_5.Item, Branch1X=item_5.Item1, Branch2X=item_5.Item2, Branch3X=renumber, FlattenInputs=False)
merge_5 = Merge(Data1=rev, Data2=rev_2)
split_2 = SplitTree(Data=entwine_2, Masks=flatten("{0,1;*}"))  # -> Positive, Negative
partition_2 = PartitionList(List=merge_5, Size="2")
path_mapper_2 = PathMapper(split_2.Positive, source="{A;B}", target="{B;A}")
path_mapper_3 = PathMapper(split_2.Negative, source="{A;B}", target="{B;A}")
C = ClusterOutput(partition_2)
data = Data(path_mapper_2)
data_2 = Data(path_mapper_3)
trim_3 = TrimTree(Tree=data, Depth=1)
trim_4 = TrimTree(Tree=data_2, Depth=1)
entwine_3 = Entwine(Branch0X=trim_3, Branch1X=trim_4, FlattenInputs=False)
side_beams_braced_side_level = Curve(entwine_3)
side_beams_braced_side_level_2 = ClusterOutput(side_beams_braced_side_level)

# ==== cluster Cluster_8
L = ClusterInput()
panel = Panel("""1
2""")
item = ListItem(List=L, Index=panel, Wrap=True)
trim = TrimTree(Tree=item, Depth=1)
panel_2 = Panel("""3
5""")
panel_3 = Panel("""0
6""")
item_2 = ListItem(List=trim, Index=panel_3, Wrap=True)
item_3 = ListItem(List=trim, Index=panel_2, Wrap=True)
ln = Line(StartPoint=item_2, EndPoint=item_3)  # -> simplify(Line)
L_2 = ClusterOutput(ln)

# ==== cluster Cluster_9
mesh = ClusterInput()
mesh_2 = Mesh(mesh)
area = MeshArea(Mesh=mesh_2)  # -> Area, Centroid
meshcp = MeshClosestPoint(Point=area.Centroid, Mesh=mesh_2)  # -> Point, Index, Parameter
A = ClusterInput()
meval = MeshEval(Mesh=mesh_2, Parameter=meshcp.Parameter)  # -> Point, Normal, Colour
amp = Amplitude(Vector=meval.Normal, Amplitude=A)
move = Move(Geometry=mesh_2, Motion=amp)  # -> Geometry, Transform
G = ClusterOutput(move.Geometry)
