# Grasshopper definition 01_MovingLoadOnCantilever.gh (Grasshopper 1.0.7)
# plug-ins: Karamba3D

# ---- group: Generate Cantilever Beam
range = Range(Domain="0 to 10", Steps=Slider(9, range=0..10))
pt = ConstructPoint(XCoordinate=range, YCoordinate=0, ZCoordinate=0)
# 00 - Moving Load on Cantilever
# Difficulty: Simple | Version 3.1.4
# This example shows how to use the Cross Section Optimizer with a moving point load.
pline = PolyLine(Vertices=pt, Closed=False)
explode = Explode(Curve=pline, Recursive=True)  # -> Segments, Vertices

# ---- group: Set Cross Section
crosecrselect = CrossSectionRangeSelectorKaramba3D(MaximumHeight_cm=-1, MaximumWidth_cm=-1, menu=[dropdown(0), dropdown(1), dropdown(3)])
beam_ids = Panel("Beams_A")
crosecselect = CrossSectionSelectorKaramba3D(CrossSections=crosecrselect, NameOrListIndexOfCrossSection="HEA200", ElementsIdentifiers=beam_ids)  # -> CrossSection, Info

# ---- group: Define Supports
item = ListItem(List=pt, Index=0, Wrap=True)
supp = SupportKaramba3D(PosInd=item, menu=[buttons(on, on, on, on, on, on)])

# ---- group: Line To Beam
beam_ids_2 = Panel("Beams_A")
lineelem = CreateLinearElementKaramba3D(
    Line=explode.Segments,
    Identifier=beam_ids_2,
    CrossSection=crosecselect.CrossSection,
    LimitDistance_m=0.005,
    BucklingLengthY_m=-1,
    BucklingLengthZ_m=-1,
    BucklingLengthLT_m=-1,
    Bending=True,
    ToPolylineMaxAngle=0.03,
    ToPolylineTolerance=0.01,
    ToPolylineMaxEdgeLength=0.25,
    New=True,
    Remove=True,
    mode="LineToBeam")  # -> Element, Points, Info

# ---- group: Define Loads
curve = Curve(lineelem.Element)
join_curves = JoinCurves(Curves=curve, Preserve=False)
c_script = CSharpScript(Polyline=join_curves, t=Slider(0.382, range=0..1))  # -> out, ElemInd, ElemParam; inputs Polyline: Polyline, t: Double
# ---------- c_script: C# ----------
    var l = _Polyline.Length;
    var pos = l * _t;
    int ind = 0;
    foreach(var line in _Polyline.GetSegments())
    {
      pos -= line.Length;
      if(pos < 0)
      {
        ElemInd_ = ind;
        ElemParam_ = 1.0 + pos / line.Length;
        return;
      }
      ++ind;
    }
# ---------- end c_script ----------
element_karamba3d = ElementKaramba3D(curve)
list_item = ListItem(List=element_karamba3d, Index=c_script.ElemInd, Wrap=True)
Z = UnitZ(Factor="-10")
loads = LoadsKaramba3D(Vector=Vector(0, 0, -1), LCase="LC0", mode="Gravity")
beam_loads = BeamLoadsKaramba3D(
    BeamIdentifier=list_item,
    LoadCase="LC0",
    ForceVector=Z,
    TPosition=c_script.ElemParam,
    mode="Concentrated",
    menu=[buttons(off, on)])
load = LoadKaramba3D(flatten([loads, beam_loads]))

# ---- group: Assemble Model
assemble = AssembleModelKaramba3D(Elem=lineelem.Element, Support=supp, Load=load, LimitDistance_m=0.005)  # -> Model, Info, Mass_kg, CentreOfGravity, LoadCaseNames

# ---- group: Cross Section Optimization
opticrosec = OptimizeCrossSectionKaramba3D(
    Model=assemble.Model,
    CrossSections=crosecrselect,
    MaximumUtilization=1,
    MaximumVirtualWork_kNcm=0.01,
    NumberOfUtilizationIterations=5,
    NumberOfDisplacementIterations=5,
    NumberOfDisplacementIncrementsPerIteration=2,
    DisplacementTolerance=0.01,
    NumberOfSamplePoints=3,
    ElasticDesign=True,
    GammaM0=1,
    GammaM1=1.1,
    SwayFrame=True)  # -> OptimizedModel, Info, Mass_kg, MaximumDisplacement_cm, ElasticEnergyChange_kNm, MaximumUtilizationViewInsufficientCrossSections, MaximumDisplacementViewLimitCrossSections
mass = Panel(opticrosec.Mass_kg)
displacement = Panel(opticrosec.MaximumDisplacement_cm)

# ---- group: View Results
modelview = ModelViewKaramba3D(Model=opticrosec.OptimizedModel)  # -> Model, DeformedMesh, DeformedAxes, DeformedModel, MaximumDeformation
beamview = BeamViewKaramba3D(Model=modelview.Model)  # -> Model, MeshesOfRenderedBeams, DeformedBeamAxes, LegendColours, LegendTags
legend = Legend(Colour=beamview.LegendColours, Tags=beamview.LegendTags, LegendType=1)

# ----
mesh_edges = MeshEdges(Mesh=beamview.MeshesOfRenderedBeams)  # -> NakedEdges, InteriorEdges, NonManifoldEdges
custom_preview = CustomPreview(Geometry=[mesh_edges.NakedEdges, mesh_edges.InteriorEdges, mesh_edges.NonManifoldEdges], Material="black")
