# Grasshopper definition 01_ParametricTruss.gh (Grasshopper 1.0.7)
# Copyright: B+G Engineers
# Copyright: Karamba3D
# plug-ins: Karamba3D

# ---- group: Define Materials
matselect = MaterialSelectionKaramba3D(menu=[dropdown(1), dropdown(2)])

# ---- group: Create Geometry
pt = Point(Point(0.6132713423, 1.260593929, 0))
pt_2 = Point(Point(5.613271342, 1.260593929, 0))
ln = Line(StartPoint=pt, EndPoint=pt_2)
aligndim = AlignedDimension(Plane=PlaneXY(0, 0, 0), PointA=pt, PointB=pt_2, Offset=-1, Text="{0:0.00}", Size=0.2)
truss_height = Slider(1.2, range=0..5)
truss_divisions = Slider(5, range=2..20)
Z = UnitZ(Factor=truss_height)
# 01 - Parametric Truss
# Difficulty: Simple | Version 3.1.4
# A truss set up parametrically where the height and number of divisions can be altered. The Beam Joint component releases the joints of the diagonal members and the Tension Compression Eliminator eliminates all members
# under tension. Assigning beam ids allows various cross sections in one model.
extr = Extrude(Base=ln, Direction=Z)
cluster = Cluster(S=extr, d1=truss_divisions)  # -> T, N

# ---- group: Define Cross Sections
crosecrselect = CrossSectionRangeSelectorKaramba3D(MaximumHeight_cm=-1, MaximumWidth_cm=-1, Material=matselect, menu=[dropdown(0), dropdown(1), dropdown(3)])
crosecselect = CrossSectionSelectorKaramba3D(CrossSections=crosecrselect, NameOrListIndexOfCrossSection="4")  # -> CrossSection, Info
crosecselect_2 = CrossSectionSelectorKaramba3D(CrossSections=crosecrselect, NameOrListIndexOfCrossSection="2")  # -> CrossSection, Info
crosecselect_3 = CrossSectionSelectorKaramba3D(CrossSections=crosecrselect, NameOrListIndexOfCrossSection="0")  # -> CrossSection, Info
entwine = Entwine(
    Branch00=crosecselect.CrossSection,
    Branch01=crosecselect_2.CrossSection,
    Branch02=crosecselect_3.CrossSection,
    Branch03=crosecselect_3.CrossSection,
    FlattenInputs=True)

# ---- group: Define Elements
merge = Merge(
    Data1=ColourSwatch(SwatchColor=RGB(0, 42, 255)),
    Data2=ColourSwatch(SwatchColor=RGB(246, 42, 255)),
    Data3=ColourSwatch(SwatchColor=RGB(0, 245, 255)),
    Data4=ColourSwatch(SwatchColor=RGB(152, 230, 49)))  # -> graft(Result)
panel = Panel("""A
B
C1
C2""")
lineelem = CreateLinearElementKaramba3D(
    Line=cluster.T,
    Colour=merge,
    Identifier=graft(panel),
    CrossSection=entwine,
    LimitDistance_m=0.005,
    BucklingLengthY_m=-1,
    BucklingLengthZ_m=-1,
    BucklingLengthLT_m=-1,
    Bending=True,
    ToPolylineMaxAngle=0.03,
    ToPolylineTolerance=0.01,
    ToPolylineMaxEdgeLength=0.25,
    New=True,
    Remove=True,
    mode="LineToBeam")  # -> Element, Points, Info

# ---- group: Define Loads
position_of_load = Slider(0.498, range=0..1)
load_multiplier = Slider(-350, range=-500..0)
vec = VectorXYZ(XComponent="1", YComponent=position_of_load, ZComponent=0)  # -> Vector, Length
evalsrf = EvaluateSurface(Surface=reparameterize(extr), Point=vec.Vector)  # -> Point, Normal, UDirection, VDirection, Frame
pull = PullPoint(Point=evalsrf.Point, Geometry=flatten(lineelem.Points), ClosestOnly=True)  # -> ClosestPoint, Distance
Z_2 = UnitZ(Factor=load_multiplier)
loads = LoadsKaramba3D(ForceVector=Z_2, Local=False, PosInd=pull.ClosestPoint, LCase="LC0", mode="Point")

# ---- group: Define Supports
panel_2 = Panel("""0,0,0
0,1,0""")
evalsrf_2 = EvaluateSurface(Surface=reparameterize(extr), Point=panel_2)  # -> Point, Normal, UDirection, VDirection, Frame
supp = SupportKaramba3D(PosInd=evalsrf_2.Point, menu=[buttons(on, on, on, on, on, off)])

panel_3 = Panel("""C1
C2""")
beam_joints = BeamJointsKaramba3D(
    BeamIdentifier=panel_3,
    CtKNMAtStartingNode=Vector(0, 0, 0),
    CrKNmRadAtStartingNode=Vector(0, 0, 0),
    CtKNMAtEndNode=Vector(0, 0, 0),
    CrKNmRadAtEndNode=Vector(0, 0, 0),
    menu=[buttons(off, off, off, off, on, off), buttons(off, off, off, off, on, off)])

# ---- group: Assemble Model
assemble = AssembleModelKaramba3D(Elem=flatten(lineelem.Element), Support=supp, Load=loads, Joint=beam_joints, LimitDistance_m=0.005)  # -> Model, Info, Mass_kg, CentreOfGravity, LoadCaseNames

# ---- group: Tension Compression Eliminator
panel_4 = Panel("""C1
C2""")
tencomelim = TensionCompressionEliminatorKaramba3D(Model=assemble.Model, MaximumIterations=20, BeamIdentifiers=panel_4, CompressionElementsOnly=Toggle(False))  # -> MaximumDisplacement, OptimizedModel, ElementIsActive

# ---- group: Analyze Model
analyse = AnalyseKaramba3D(Model=tencomelim.OptimizedModel)  # -> AnalysedModel, MaximumDisplacement_cm, ResultingForce_kN, ChangeOfElasticEnergy_kNm
panel_5 = Panel(analyse.MaximumDisplacement_cm)

# ---- group: View Results
modelview = ModelViewKaramba3D(Model=analyse.AnalysedModel)  # -> Model, DeformedMesh, DeformedAxes, DeformedModel, MaximumDeformation
beamview = BeamViewKaramba3D(Model=modelview.Model)  # -> Model, MeshesOfRenderedBeams, DeformedBeamAxes, LegendColours, LegendTags
legend = Legend(Colour=beamview.LegendColours, Tags=beamview.LegendTags, LegendType=1)

# ==== cluster Cluster
S = ClusterInput()
d1 = ClusterInput()
merge = Merge(Data1=d1, Data2="0")
sdivide = DivideSurface(Surface=S, UCount="1", VCount=d1)  # -> Points, Normals, Parameters
cull_i = CullIndex(List=sdivide.Points, Indices=reverse(graft(merge)), Wrap=True)
cull_i_2 = CullIndex(List=sdivide.Points, Indices=graft(merge), Wrap=True)
flip = FlipMatrix(Data=cull_i)
flip_2 = FlipMatrix(Data=sdivide.Points)
flip_3 = FlipMatrix(Data=cull_i_2)
pline = PolyLine(Vertices=sdivide.Points, Closed=False)
pline_2 = PolyLine(Vertices=flip_2, Closed=False)
pline_3 = PolyLine(Vertices=flip_3, Closed=False)
pline_4 = PolyLine(Vertices=flip, Closed=False)
entwine = Entwine(Branch00=pline, Branch01=pline_2, Branch02=pline_3, Branch03=pline_4, FlattenInputs=True)
explode = Explode(Curve=entwine, Recursive=True)  # -> Segments, Vertices
trim = TrimTree(Tree=explode.Segments, Depth=1)
curvepoint = PointOnCurve(trim, parameter=0.5)
srf_cp = SurfaceClosestPoint(Point=curvepoint, Surface=S)  # -> Point, UVPoint, Distance
evalsrf = EvaluateSurface(Surface=S, Point=srf_cp.UVPoint)  # -> Point, Normal, UDirection, VDirection, Frame
T = ClusterOutput(trim)
N = ClusterOutput(evalsrf.Normal)
