# Grasshopper definition 01_ProjectedLinesToTruss_SRF_to_Truss.gh (Grasshopper 1.0.8)
# plug-ins: Karamba3D

crv = Curve([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])
designsrf = Surface([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])
supportsrf = Surface(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)
llinter = LineLineIntersectionKaramba3D(IntersectingLines=crv, LinesToIntersect=crv, LimitDistance_m=0.005)  # -> InterSecPoints, LineSubSegments
# 01 - Projected Lines to Truss
# Difficulty: Moderate | Version 3.1.5
# 
# This definition generates a series of truss structures by projecting a set of input lines onto two reference surfaces.  The projected geometries are then processed and the Surface to Truss component is used to create the truss systems.
project = Project(Curve=graft(llinter.LineSubSegments), Brep=designsrf, Direction=Vector(0, 0, 1))
trim = TrimTree(Tree=simplify(project), Depth=1)
clean = CleanTree(RemoveNulls=True, RemoveInvalid=True, RemoveEmpty=True, Tree=trim)
panel = Panel("""False
True""")
end = EndPoints(Curve=clean)  # -> Start, End
len = Length(Curve=clean)
dispatch = Dispatch(List=flatten(clean), DispatchPattern=panel)  # -> ListA, ListB
pline = PolyLine(Vertices=end.Start, Closed=False)
pline_2 = PolyLine(Vertices=end.End, Closed=False)
len_2 = Length(Curve=pline)
len_3 = Length(Curve=pline_2)
avr = Average(Input=[len_2, len_3])
avr_2 = Average(Input=len)
rulesrf = RuledSurface(CurveA=dispatch.ListA, CurveB=dispatch.ListB)
expression = Expression(x=avr, y=avr_2, z=Slider(2.56, range=0.25..4), Expression="max(round(y/x*z/2),1)")  # -> flatten(R)
list = ValueList({"Pratt Truss": 1, "Warren Truss": 2, "Warren Truss with verticals": 3, "K-Truss": 4, "Diamond": 5, "Diamond Straight": 6, "Vierendeel Truss": 7}, selected="Pratt Truss")
surf2truss = SurfaceToTrussKaramba3D(
    Surface=reparameterize(rulesrf),
    TrussType=list,
    NumberOfSubdivisions=expression,
    FlipUDirection=False,
    FlipVDirection=False,
    SwapUVDirections=Toggle(False),
    RelaxAngles=False,
    TargetPostDirection=Vector(0, 0, 0),
    MaximumRelaxationIterations=30,
    LengthTolerance=0.0001,
    DampingFactor=0.8)  # -> Info, simplify(Lines), YOrientations, ZOrientations, SpecificEnergy

# ---- group: Set Cross Section
A = Slider(300, range=10..400)
B = Slider(276, range=10..300)
panel_2 = Panel("""A
B""")
dom = ConstructDomain(DomainStart=expr("x*0.2", [A, B]), DomainEnd=[A, B])
range = Range(Domain=dom, Steps=10)  # -> expr("int(x)", Range)
num = Number(expr("round(x*0.1,1)", range))
expression_2 = Expression(f=graft(panel_2), d=range, t=num, Expression="f&\" \"&d&\"/\"&t")
crosec = CrossSectionKaramba3D(
    FamilyNameOfCrossSection=graft(panel_2),
    NameOfCrossSection=expression_2,
    Diameter_cm=range,
    WallThickness_cm=num,
    mode="Circular Hollow")
item = ListItem(List=crosec, Index=0, Wrap=True)
item_2 = ListItem(List=flatten(item), Index=0, Wrap=True)  # -> Item, Item1
entwine = Entwine(
    Branch00=item_2.Item,
    Branch01=item_2.Item,
    Branch02=item_2.Item1,
    Branch03=item_2.Item1,
    Branch04=item_2.Item1,
    FlattenInputs=True)

# ----
srf = Surface(supportsrf)

# ---- group: Line to Beam
lng = ListLength(List=surf2truss.Lines)
panel_3 = Panel("""top
bottom
left_diagonal
right_diagonal
vertical""")
series = Series(Start=0, Step=1, Count=lng)
concat = Concatenate(FragmentA=graft(panel_3), FragmentB=series, JoinSeparator="_")
lineelem = CreateLinearElementKaramba3D(
    Line=surf2truss.Lines,
    Identifier=concat,
    CrossSection=entwine,
    LimitDistance_m=0.005,
    BucklingLengthY_m=-1,
    BucklingLengthZ_m=-1,
    BucklingLengthLT_m=-1,
    Bending=True,
    ToPolylineMaxAngle=0.03,
    ToPolylineTolerance=0.01,
    ToPolylineMaxEdgeLength=0.25,
    New=True,
    Remove=True,
    mode="LineToBeam")  # -> Element, simplify(Points), Info

# ---- group: Define Supports
clean_2 = CleanTree(RemoveNulls=True, RemoveInvalid=True, RemoveEmpty=Toggle(True), Tree=lineelem.Points)
rdpoints = RemoveDuplicatePointsKaramba3D(Point=flatten(clean_2), LimitDistance=0.005)  # -> OutPoint, Info, Indexes
pull = PullPoint(Point=rdpoints.OutPoint, Geometry=srf, ClosestOnly=True)  # -> ClosestPoint, Distance, Index
smaller = SmallerThan(FirstNumber=pull.Distance, SecondNumber="0.1")  # -> SmallerThan, OrEqualTo
cull = CullPattern(List=rdpoints.OutPoint, CullPattern=smaller.SmallerThan)
supp = SupportKaramba3D(PosInd=cull, menu=[buttons(on, on, on, off, off, off)])

# ---- group: Modify Beams
# NOTE: Make sure to set bending to true for Vierendeel truss
panel_4 = Panel("""left_diagonal
right_diagonal
vertical""")
modifyelem = ModifyElementKaramba3D(BeamIdentifierIndex=panel_4, Bending=Toggle(False), mode="Beam")

# ---- group: Define Loads
item_3 = ListItem(List=designsrf, Index=0, Wrap=True)
mesh_uv = MeshSurface(Surface=item_3, UCount=Slider(59, range=0..100), VCount=Slider(33, range=0..100), Overhang=True, Equalize=False)
Z = UnitZ(Factor="-10")
loads = LoadsKaramba3D(Vector=Vector(0, 0, -1), LCase="LC0", mode="Gravity")
loads_2 = LoadsKaramba3D(
    Vector=Z,
    Mesh=mesh_uv,
    ElementIdentifiers="top",
    LCase="LC0",
    mode="MeshLoad -Const.",
    menu=[buttons(on, off, off), buttons(off, on)])

# ---- group: Make Element Set
mkset = MakeElementSetKaramba3D(ElementIdentifiers=concat, SetIdentifier=graft(panel_3), MinimumSplitLength_m=0.001)

# ---- group: Assemble Model
assemble = AssembleModelKaramba3D(
    Elem=flatten([lineelem.Element, modifyelem]),
    Support=flatten(supp),
    Load=flatten([loads, loads_2]),
    BeamSet=flatten(mkset),
    LimitDistance_m=0.005)  # -> Model, Info, Mass_kg, CentreOfGravity, LoadCaseNames

# ----
txt = Text(flatten(concat))

# ---- group: Optimize Cross Section
opticrosec_opticrosec = OptimizeCrossSectionKaramba3D(
    Model=assemble.Model,
    GroupIdentifiers=flatten(txt),
    CrossSections=flatten(crosec),
    MaximumUtilization=1,
    MaximumDisplacement_cm=-1,
    MaximumVirtualWork_kNcm=0.01,
    NumberOfUtilizationIterations=5,
    NumberOfDisplacementIterations=5,
    NumberOfDisplacementIncrementsPerIteration=2,
    DisplacementTolerance=0.01,
    NumberOfSamplePoints=3,
    ElasticDesign=True,
    GammaM0=1,
    GammaM1=1.1,
    SwayFrame=True)  # -> OptimizedModel, Info, Mass_kg, MaximumDisplacement_cm, ElasticEnergyChange_kNm, MaximumUtilizationViewInsufficientCrossSections, MaximumDisplacementViewLimitCrossSections

# ---- group: Model View
modelview = ModelViewKaramba3D(Model=opticrosec_opticrosec.OptimizedModel)  # -> Model, DeformedMesh, DeformedAxes, DeformedModel, MaximumDeformation
beamview = BeamViewKaramba3D(Model=modelview.Model)  # -> Model, MeshesOfRenderedBeams, DeformedBeamAxes, LegendColours, LegendTags
legend = Legend(Colour=beamview.LegendColours, Tags=beamview.LegendTags, LegendType=1)
