# Grasshopper definition 01_RegularFacadeSystem.gh (Grasshopper 1.0.8)
# plug-ins: Karamba3D, treesloth01, Pufferfish

# ---- group: Define GEOMETRY INPUTS
span_m = Slider(8, range=4..20)
height_at_supports_m = Slider(16, range=4..35)
angle_deg = Slider(-10, range=-45..45)
truss_depth_m = Slider(0.41, range=0..1)
facade_offset_m = Slider(1.32, range=0..2)
bracing_arm_length_percentage = Slider(25, range=10..45)
bay_number = ValueList({"1", "2", "3", "4", "5", "6", "7", "8", "9", "10"}, selected="3")
height_divisions = ValueList({"1", "2", "3", "4", "5", "6", "7", "8", "9", "10"}, selected="5")
mullion_divisions = ValueList({"1", "2", "3", "4", "5", "6", "7", "8", "9", "10"}, selected="4")
xy = XYPlane(Origin=Point(0, 0, 0))
Y = UnitY(Factor=1)
division = Division(A=bracing_arm_length_percentage, _100=100)
rot3d = Rotate3D(Geometry=xy, Angle=degrees(angle_deg), Center=xy, Axis=Y)  # -> Geometry, Transform
height_at_supports_m_2 = Number(height_at_supports_m)
# 01 - Regular Facade System
# Difficulty: Hard | Version 3.1.6
# A simple and regular steel facade structure inspired by Heathrow Terminal 5.
# Gravity and wind pressure loads are generated and applied using mesh loading and allow the engineer to study facade segmentation and geometry versus structural performance.
span_at_supports_m = Number(span_m)
mullion_divisions_2 = Number(mullion_divisions)
height_divisions_2 = Number(height_divisions)
facade_offset_m_2 = Number(facade_offset_m)
truss_depth_m_2 = Number(truss_depth_m)
bay_number_2 = Number(bay_number)
bracing_arm = Number(division)
base_plane = Plane(rot3d.Geometry)

# ---- group: Define LOADING INPUTS
glazing_load_kn_m2 = Slider(0.5, range=0..1)
wind_load_kn_m2 = Slider(1, range=-1.5..1.5)
glazing_load_kn_m2_2 = Number(glazing_load_kn_m2)
wind_load_kn_m2_2 = Number(wind_load_kn_m2)

# ----
angle_deg_2 = Number(angle_deg)

# ---- group: Initial Geometry Setup
xy_2 = XYPlane(Origin=Point(0, 0, 0))
height_at_supports_m_3 = Number(height_at_supports_m_2)
base_plane_2 = Plane(base_plane)
span_at_supports_m_2 = Number(span_at_supports_m)
bay_number_3 = Number(bay_number_2)
deplane = DeconstructPlane(Plane=xy_2)  # -> Origin, XAxis, YAxis, ZAxis
series = Series(Start=1, Step=1, Count=bay_number_3)
multiplication = Multiplication(A=span_at_supports_m_2, B=series)
amp = Amplitude(Vector=deplane.YAxis, Amplitude=multiplication)
amp_2 = Amplitude(Vector=deplane.ZAxis, Amplitude=height_at_supports_m_3)
base_plane_3 = Plane(base_plane)
move = Move(Geometry=deplane.Origin, Motion=amp)  # -> Geometry, Transform
deplane_2 = DeconstructPlane(Plane=base_plane_3)  # -> Origin, XAxis, YAxis, ZAxis
merge = Merge(Data1=deplane.Origin, Data2=move.Geometry)  # -> flatten(Result)
pl = ConstructPlane(Origin=deplane_2.Origin, XAxis=deplane_2.YAxis, YAxis=deplane_2.ZAxis)
move_2 = Move(Geometry=merge, Motion=amp_2)  # -> Geometry, Transform
X = UnitX(Factor=1)
projecta = ProjectAlong(Geometry=move_2.Geometry, Plane=pl, Direction=X)  # -> Geometry, Transform
bottom_points = Point(merge)
top_points = Point(projecta.Geometry)

# ---- group: Setup division points
bottom_points_2 = Point(bottom_points)
top_points_2 = Point(top_points)
ln = Line(StartPoint=bottom_points_2, EndPoint=top_points_2)
graft = GraftTree(Tree=ln, IncludeEmptyLists=True, IncludeNullItems=True)  # -> simplify(Tree)
height_divisions_3 = Number(height_divisions_2)
renumber = RenumberPaths(Data=graft)
divide = DivideCurve(Curve=graft, Count=height_divisions_3, Kinks=False)  # -> simplify(Points), simplify(Tangents), Parameters
main_division_points = Point(divide.Points)

# ---- group: Setup Primary Truss Elements
truss_depth_m_3 = Number(truss_depth_m_2)
main_division_points_2 = Point(main_division_points)
base_plane_4 = Plane(base_plane)
shift = ShiftList(List=main_division_points_2, Shift=1, Wrap=invert(True))
item = ListItem(List=main_division_points_2, Index=0, Wrap=True)  # -> Item1, Item
shift_2 = ShiftList(List=shift, Shift=-1, Wrap=invert(True))
deplane_3 = DeconstructPlane(Plane=base_plane_4)  # -> Origin, XAxis, YAxis, ZAxis
division_2 = Division(A=truss_depth_m_3, B=2)
pt = Point(shift_2)
amp_3 = Amplitude(Vector=deplane_3.XAxis, Amplitude=division_2)
neg = Negative(Value=amp_3)
move_3 = Move(Geometry=pt, Motion=amp_3)  # -> simplify(Geometry), Transform
move_4 = Move(Geometry=pt, Motion=neg)  # -> simplify(Geometry), Transform
merge_2 = Merge(Data1=item.Item, Data2=move_3.Geometry, Data3=item.Item1)
merge_3 = Merge(Data1=item.Item, Data2=move_4.Geometry, Data3=item.Item1)
pline = PolyLine(Vertices=merge_2, Closed=False)
pline_2 = PolyLine(Vertices=merge_3, Closed=False)
ln_2 = Line(StartPoint=move_3.Geometry, EndPoint=move_4.Geometry)
merge_4 = Merge(Data1=pline, Data2=pline_2)
divide_2 = DivideCurve(Curve=ln_2, Count=2, Kinks=False)  # -> Points, Tangents, Parameters
item_2 = ListItem(List=divide_2.Parameters, Index=1, Wrap=True)
item_3 = ListItem(List=divide_2.Points, Index=1, Wrap=True)
trim = TrimTree(Tree=item_3, Depth=1)
shatter = Shatter(Curve=graft(ln_2), Parameters=item_2)  # -> simplify(Segments)
tstat = TreeStatistics(Tree=trim)  # -> Paths, Length, Count
item_4 = ListItem(List=tstat.Paths, Index=0, Wrap=True)  # -> Item1, Item
trim_2 = TrimTree(Tree=shatter, Depth=1)
split = SplitTree(Data=trim, Masks=flatten(item_4.Item))  # -> Positive, Negative
split_2 = SplitTree(Data=split.Negative, Masks=flatten(item_4.Item1))  # -> Positive, Negative
entwine = Entwine(Branch00=split.Positive, Branch01=split_2.Positive, FlattenInputs=True)
end_bay_support_points = Point(entwine)
truss_polylines = Curve(merge_4)
truss_web = Curve(trim_2)

# ---- group: Setup horizontal reference geometry
main_division_points_3 = Point(main_division_points)
base_plane_5 = Plane(base_plane)
facade_offset_m_3 = Number(facade_offset_m_2)
deplane_4 = DeconstructPlane(Plane=base_plane_5)  # -> Origin, XAxis, YAxis, ZAxis
amp_4 = Amplitude(Vector=deplane_4.XAxis, Amplitude=facade_offset_m_3)
neg_2 = Negative(Value=amp_4)
move_5 = Move(Geometry=main_division_points_3, Motion=neg_2)  # -> graft(Geometry), Transform
relitem2 = RelativeItems(TreeA=move_5.Geometry, TreeB=move_5.Geometry, Offset="{1;0}", WrapPaths=False, WrapItems=False)  # -> ItemA, ItemB
ln_3 = Line(StartPoint=relitem2.ItemA, EndPoint=relitem2.ItemB)
horizontal_elements = Curve(ln_3)

# ---- group: Preparation of MESHES for loading
horizontal_elements_2 = Curve(horizontal_elements)
yz = YZPlane(Origin=Point(0, 0, 0))
mesh_loading_density = ValueList({"0.10m": 0.10, "0.25m": 0.25, "0.50m": 0.50, "0.75m": 0.75, "1.00m": 1.00, "1.50m": 1.50}, selected="0.10m")
brec = BoundingRectangle(Geometry=flatten(horizontal_elements_2), Plane=yz, Axis=0, Slide=0, Union=True)  # -> Bounding, DimensionX, DimensionY
mesh_uv = MeshSurface(Surface=brec.Bounding, UCount=1, VCount=1, Overhang=True, Equalize=False)
cluster = Cluster(zonemeshes=mesh_uv, meshtargetsize=mesh_loading_density)
zonemesh = Mesh(mesh_uv)
loadingmesh = Mesh(cluster)
base_plane_6 = Plane(base_plane)
facade_offset_m_4 = Number(facade_offset_m_2)
deplane_5 = DeconstructPlane(Plane=base_plane_6)  # -> Origin, XAxis, YAxis, ZAxis
pl_2 = ConstructPlane(Origin=deplane_5.Origin, XAxis=deplane_5.YAxis, YAxis=deplane_5.ZAxis)
neg_3 = Negative(Value=facade_offset_m_4)
orthogonal_mesh = Mesh(loadingmesh)
pl_offset = PlaneOffset(BasePlane=pl_2, Offset=neg_3)
X_2 = UnitX(Factor=1)
projecta_2 = ProjectAlong(Geometry=orthogonal_mesh, Plane=pl_offset, Direction=X_2)  # -> Geometry, Transform
aligned_mesh = Mesh(projecta_2.Geometry)
alignedloadingmesh = Mesh(aligned_mesh)

# ---- group: Setup Secondary Elements
bay_number_4 = Number(bay_number_2)
main_division_points_4 = Point(main_division_points)
bracing_arm_2 = Number(bracing_arm)
horizontal_elements_3 = Curve(horizontal_elements)
mullion_divisions_3 = Number(mullion_divisions_2)
pt_2 = Point(main_division_points_4)
expression = Expression(n=bay_number_4, Expression="if (n=1, 0, 1)")
tstat_2 = TreeStatistics(Tree=pt_2)  # -> Paths, Length, Count
subtraction = Subtraction(A=1, B=bracing_arm_2)
divide_3 = DivideCurve(Curve=horizontal_elements_3, Count=mullion_divisions_3, Kinks=False)  # -> simplify(Points), Tangents, simplify(Parameters)
item_5 = ListItem(List=tstat_2.Paths, Index=0, Wrap=True)  # -> Item1, Item
eval = EvaluateLength(Curve=horizontal_elements_3, Length=[bracing_arm_2, subtraction], Normalized=True)  # -> Point, Tangent, simplify(Parameter)
split_3 = SplitTree(Data=pt_2, Masks=flatten(item_5.Item))  # -> Positive, Negative
filter = StreamFilter(Gate=expression, Stream0="{1}", Stream1="{0;1}")
graft_2 = GraftTree(Tree=eval.Point, IncludeEmptyLists=True, IncludeNullItems=True)
split_4 = SplitTree(Data=split_3.Negative, Masks=flatten(item_5.Item1))  # -> Positive, Negative
shatter_2 = Shatter(Curve=horizontal_elements_3, Parameters=[eval.Parameter, divide_3.Parameters])  # -> simplify(Segments)
relitem2_2 = RelativeItems(TreeA=divide_3.Points, TreeB=divide_3.Points, Offset=filter, WrapPaths=False, WrapItems=False)  # -> ItemA, ItemB
path_mapper = PathMapper(graft_2, source="{A;B;C}", target="{A;C}")
dup = DuplicateData(Data=split_4.Negative, Number=2, Order=True)
lng = ListLength(List=split_4.Negative)
partition = PartitionList(List=dup, Size=lng)
ln_4 = Line(StartPoint=relitem2_2.ItemA, EndPoint=relitem2_2.ItemB)
data = Data(path_mapper)
merge_5 = Merge(Data1=split_3.Positive, Data2=partition, Data3=split_4.Positive)
match = MatchTree(Tree=merge_5, Guide=data)
ln_5 = Line(StartPoint=match, EndPoint=data)
horizontal_members = Line(shatter_2)
vertical_members = Line(ln_4)
bracing_arms = Line(ln_5)

# ---- group: Setup end bay connectors
horizontal_elements_4 = Curve(horizontal_elements)
truss_polylines_2 = Curve(truss_polylines)
item_6 = ListItem(List=truss_polylines_2, Index=0, Wrap=True)  # -> Item1, Item
path_mapper_2 = PathMapper(horizontal_elements_4, source="{A;B}", target="{B}")
crv = Curve(item_6.Item1)
item_7 = ListItem(List=flatten(crv), Index=0, Wrap=True)  # -> Item1, Item
join = JoinCurves(Curves=path_mapper_2, Preserve=False)
explode = Explode(Curve=item_7.Item1, Recursive=True)  # -> Segments, Vertices
end = EndPoints(Curve=join)  # -> Start, End
explode_2 = Explode(Curve=item_7.Item, Recursive=True)  # -> Segments, Vertices
ln_6 = Line(StartPoint=graft(explode.Vertices), EndPoint=end.End)  # -> simplify(Line)
ln_7 = Line(StartPoint=graft(explode_2.Vertices), EndPoint=end.Start)  # -> simplify(Line)
entwine_2 = Entwine(Branch0X=ln_6, Branch1X=ln_7, FlattenInputs=False)
trim_3 = TrimTree(Tree=entwine_2, Depth=1)
end_bay_connectors = Curve(trim_3)

# ---- group: Define Load Combinations
matselect = MaterialSelectionKaramba3D(Colour=ColourSwatch(SwatchColor=RGB(51, 46, 191)), menu=[dropdown(1), dropdown(1), dropdown(4)])
matselect_2 = MaterialSelectionKaramba3D(Colour=ColourSwatch(SwatchColor=RGB(94, 191, 46)), menu=[dropdown(1), dropdown(1), dropdown(3)])
matselect_3 = MaterialSelectionKaramba3D(Colour=ColourSwatch(SwatchColor=RGB(191, 133, 46)), menu=[dropdown(1), dropdown(5), dropdown(3)])
disassemble = DisassembleMaterialKaramba3D(Material=matselect_2)  # -> Material, TypeOfMaterial, FamilyNameOfMaterial, NameOfMaterial, ElemIdentifiers, Colour, YoungsModulusKNCm²Dir12, InPlaneShearModulus_kN_cm²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
resistance_kn_cm2 = Slider(110, range=0..200)
neg_4 = Negative(Value=resistance_kn_cm2)
isotrop = MaterialPropertiesKaramba3D(
    FamilyOfMaterial=disassemble.FamilyNameOfMaterial,
    Name=disassemble.NameOfMaterial,
    Colour=disassemble.Colour,
    YoungsModulus_kN_cm²=disassemble.YoungsModulusKNCm²Dir12,
    InPlaneShearModulus_kN_cm²=disassemble.InPlaneShearModulus_kN_cm²,
    TransverseShearModulus_kN_cm²=disassemble.TransverseShearModulusKNCm²Dir12,
    SpecificWeight_kN_m³=disassemble.SpecificWeight_kN_m³,
    CoefficientOfThermalExpansion_1=disassemble.CoefficientOfThermalExpansion1Dir12,
    TensileStrength_kN_cm²=resistance_kn_cm2,
    CompressiveStrength_kN_cm²=neg_4,
    StrengthHypothesis=disassemble.StrengthHypothesis,
    mode="Isotrop")
mat_glulam = MaterialKaramba3D(matselect_3)
mat_cable = MaterialKaramba3D(isotrop)
mat_steel = MaterialKaramba3D(matselect)

# ---- group: Define Elements
mat_steel_2 = MaterialKaramba3D(mat_steel)
crosecrselect = CrossSectionRangeSelectorKaramba3D(
    MaximumHeight_cm=-1,
    MaximumWidth_cm=-1,
    Material=mat_steel_2,
    menu=[dropdown(1), dropdown(3), dropdown(1), dropdown(79)])
crosecrselect_2 = CrossSectionRangeSelectorKaramba3D(
    MaximumHeight_cm=-1,
    MaximumWidth_cm=-1,
    Material=mat_steel_2,
    menu=[dropdown(1), dropdown(3), dropdown(1), dropdown(23)])
base_plane_7 = Plane(base_plane)
horizontal_members_2 = Line(horizontal_members)
vertical_members_2 = Line(vertical_members)
deplane_6 = DeconstructPlane(Plane=base_plane_7)  # -> Origin, XAxis, YAxis, ZAxis
entwine_3 = Entwine(Branch00=horizontal_members_2, Branch01=vertical_members_2, FlattenInputs=True)
entwine_4 = Entwine(Branch00="Glazing.Horizontals", Branch01="Glazing.Mullions", FlattenInputs=True)
entwine_5 = Entwine(Branch00=crosecrselect, Branch01=crosecrselect_2, FlattenInputs=True)
entwine_6 = Entwine(Branch00=deplane_6.XAxis, Branch01=deplane_6.XAxis, FlattenInputs=True)
linetobeam = CreateLinearElementKaramba3D(
    Line=entwine_3,
    Identifier=entwine_4,
    CrossSection=entwine_5,
    LimitDistance_m=0.005,
    ZOrientation=entwine_6,
    BucklingLengthY_m=-1,
    BucklingLengthZ_m=-1,
    BucklingLengthLT_m=-1,
    Bending=True,
    ToPolylineMaxAngle=0.25,
    ToPolylineTolerance=0.1,
    ToPolylineMaxEdgeLength=0.25,
    New=True,
    Remove=True,
    mode="LineToBeam",
    GuidGeneratorSeed=1142275002)  # -> Element, Points, Info

mat_steel_3 = MaterialKaramba3D(mat_steel)
crosecrselect_3 = CrossSectionRangeSelectorKaramba3D(
    MaximumHeight_cm=-1,
    MaximumWidth_cm=-1,
    Material=mat_steel_3,
    menu=[dropdown(1), dropdown(2), dropdown(1), dropdown(91)])
crosecrselect_4 = CrossSectionRangeSelectorKaramba3D(
    MaximumHeight_cm=-1,
    MaximumWidth_cm=-1,
    Material=mat_steel_3,
    menu=[dropdown(1), dropdown(2), dropdown(1), dropdown(78)])
truss_polylines_3 = Curve(truss_polylines)
truss_web_2 = Curve(truss_web)
entwine_7 = Entwine(Branch00=truss_polylines_3, Branch01=truss_web_2, FlattenInputs=True)
entwine_8 = Entwine(Branch00="Truss.Chords", Branch01="Truss.Web", FlattenInputs=True)
entwine_9 = Entwine(Branch00=crosecrselect_3, Branch01=crosecrselect_4, FlattenInputs=True)
linetobeam_2 = CreateLinearElementKaramba3D(
    Line=entwine_7,
    Identifier=entwine_8,
    CrossSection=entwine_9,
    LimitDistance_m=0.005,
    BucklingLengthY_m=-1,
    BucklingLengthZ_m=-1,
    BucklingLengthLT_m=-1,
    Bending=True,
    ToPolylineMaxAngle=0.25,
    ToPolylineTolerance=0.1,
    ToPolylineMaxEdgeLength=0.25,
    New=True,
    Remove=True,
    mode="LineToBeam",
    GuidGeneratorSeed=1819577723)  # -> Element, Points, Info

# ---- group: Define Loads
wind_load_kn_m2_3 = Number(wind_load_kn_m2_2)
alignedloadingmesh_2 = Mesh(alignedloadingmesh)
number_slider = Slider(10, range=0..20)
number_slider_2 = Slider(0.4, range=0..1)
glazing_load_kn_m2_3 = Number(glazing_load_kn_m2_2)
alignedloadingmesh_3 = Mesh(alignedloadingmesh)
facen = FaceNormals(Mesh=alignedloadingmesh_2)  # -> Centers, Normals
avr = Average(Input=facen.Normals)
Z = UnitZ(Factor=glazing_load_kn_m2_3)
amp_5 = Amplitude(Vector=avr, Amplitude=wind_load_kn_m2_3)
neg_5 = Negative(Value=Z)
gravity = LoadsKaramba3D(Vector=Vector(0, 0, -1), LCase="SW", mode="Gravity")
meshload_const = LoadsKaramba3D(
    Vector=neg_5,
    Mesh=alignedloadingmesh_3,
    ElementIdentifiers="Glazing.Mullions",
    LCase="SDL",
    LineLoadsPerElement=number_slider,
    MinimumLineLoadLength_m=number_slider_2,
    mode="MeshLoad -Const.",
    menu=[buttons(off, on, off), buttons(off, on)])
meshload_const_2 = LoadsKaramba3D(
    Vector=amp_5,
    Mesh=alignedloadingmesh_2,
    ElementIdentifiers=["Glazing.Horizontals", "Glazing.Mullions"],
    LCase="WL",
    LineLoadsPerElement=number_slider,
    MinimumLineLoadLength_m=number_slider_2,
    mode="MeshLoad -Const.",
    menu=[buttons(off, on, off), buttons(off, on)])

# ----
base_plane_8 = Plane(base_plane)
deplane_7 = DeconstructPlane(Plane=base_plane_8)  # -> Origin, XAxis, YAxis, ZAxis

# ---- group: Define Load Combinations
panel = Panel("""G = SW + SDL
SLS.G = G
SLS.W = G + WL
ULS.G = 1.35*G
ULS.W = 1.35*G + 1.5*WL
ULS.all = ULS.G | ULS.W""")
lccombinator = LoadCaseCombinatorKaramba3D(LoadCaseCombinationRulesKaramba3D=panel)  # -> LoadCaseCombinations, NamesOfLoadCases, NumberOfLoadCases

# ---- group: Define Joints
panel_2 = Panel("""Bracing
Bracing""")
panel_3 = Panel("""Glazing.Horizontals
Truss""")
joint_agent = BeamJointAgentKaramba3D(
    BeamIdentifier="Glazing.Mullions",
    ToElementIdentifiers="Glazing.Horizontals",
    Ct_kN_m=Vector(0, 0, 0),
    Cr_kNm_rad=Vector(0, 0, 0),
    menu=[buttons(off, off, off, off, on, on)])
joint_agent_2 = BeamJointAgentKaramba3D(
    BeamIdentifier=panel_2,
    ToElementIdentifiers=panel_3,
    Ct_kN_m=Vector(0, 0, 0),
    Cr_kNm_rad=Vector(0, 0, 0),
    menu=[buttons(off, off, off, off, off, on)])

# ---- group: Define Supports
end_bay_support_points_2 = Point(end_bay_support_points)
bottom_points_3 = Point(bottom_points)
top_points_3 = Point(top_points)
supp = SupportKaramba3D(PosInd=bottom_points_3, Ct_kN_m=Vector(0, 0, 0), Cr_kNm_rad=Vector(0, 0, 0), menu=[buttons(on, on, on, off, off, on)])
supp_2 = SupportKaramba3D(PosInd=top_points_3, Ct_kN_m=Vector(0, 0, 0), Cr_kNm_rad=Vector(0, 0, 0), menu=[buttons(on, on, off, off, off, off)])
supp_3 = SupportKaramba3D(
    PosInd=end_bay_support_points_2,
    Ct_kN_m=Vector(0, 0, 0),
    Cr_kNm_rad=Vector(0, 0, 0),
    menu=[buttons(off, on, off, off, off, off)])

# ----
joint = JointKaramba3D(flatten([joint_agent, joint_agent_2]))
load = LoadKaramba3D([gravity, meshload_const, meshload_const_2, lccombinator.LoadCaseCombinations])
support = SupportKaramba3D([supp, supp_3, supp_2])

# ---- group: Define Elements
mat_steel_4 = MaterialKaramba3D(mat_steel)
crosecrselect_5 = CrossSectionRangeSelectorKaramba3D(
    MaximumHeight_cm=-1,
    MaximumWidth_cm=-1,
    Material=mat_steel_4,
    menu=[dropdown(1), dropdown(2), dropdown(1), dropdown(54)])
end_bay_connectors_2 = Curve(end_bay_connectors)
bracing_arms_2 = Line(bracing_arms)
crosecrselect_6 = CrossSectionRangeSelectorKaramba3D(
    MaximumHeight_cm=-1,
    MaximumWidth_cm=-1,
    Material=mat_steel_4,
    menu=[dropdown(1), dropdown(2), dropdown(1), dropdown(36)])
entwine_10 = Entwine(Branch00=bracing_arms_2, Branch01=end_bay_connectors_2, FlattenInputs=True)
entwine_11 = Entwine(Branch00="Bracing.Arms", Branch01="Bracing.Ends", FlattenInputs=True)
entwine_12 = Entwine(Branch00=crosecrselect_5, Branch01=crosecrselect_6, FlattenInputs=True)

# ----
eval_2 = EvaluateLength(Curve=entwine_10, L05=0.5, Normalized=True)  # -> Point, Tangent, Parameter
xprod = CrossProduct(VectorA=eval_2.Tangent, VectorB=deplane_7.XAxis, Unitize=False)  # -> Vector, Length
entwine_13 = Entwine(Branch00=xprod.Vector, Branch01=xprod.Vector, FlattenInputs=True)

# ---- group: Define Elements (continued)
linetobeam_3 = CreateLinearElementKaramba3D(
    Line=entwine_10,
    Identifier=entwine_11,
    CrossSection=entwine_12,
    LimitDistance_m=0.005,
    ZOrientation=entwine_13,
    BucklingLengthY_m=-1,
    BucklingLengthZ_m=-1,
    BucklingLengthLT_m=-1,
    Bending=True,
    ToPolylineMaxAngle=0.25,
    ToPolylineTolerance=0.1,
    ToPolylineMaxEdgeLength=0.25,
    New=True,
    Remove=True,
    mode="LineToBeam",
    GuidGeneratorSeed=-387236499)  # -> Element, Points, Info

# ----
element = ElementKaramba3D([linetobeam_2.Element, linetobeam.Element, linetobeam_3.Element])

assemble = AssembleModelKaramba3D(Elem=flatten(element), Support=flatten(support), Load=flatten(load), Joint=flatten(joint), LimitDistance_m=0.005)  # -> Model, Info, Mass_kg, CentreOfGravity, LoadCaseNames
system_mass_kg = Panel(assemble.Mass_kg)

# ---- group: Analyze Model
analyse = AnalyseKaramba3D(Model=assemble.Model)  # -> AnalysedModel, MaximumDisplacement_cm, ResultingForce_kN, ChangeOfElasticEnergy_kNm
panel_4 = Panel(assemble.LoadCaseNames)
panel_5 = Panel(analyse.MaximumDisplacement_cm)

# ---- group: Natural Frequency Analysis Model
eigen_modes = EigenModesKaramba3D(
    Model=analyse.AnalysedModel,
    FromIndex=1,
    NumberOfModes=Slider(10, range=0..50),
    WithThIIEffects=False,
    MaximumNumberOfIterations=300,
    Epsilon=1e-07)  # -> ModelWithEigenModes, Eigenvalues
panel_6 = Panel(eigen_modes.Eigenvalues)

# ----
resultselect = ResultSelectorKaramba3D(
    Model=eigen_modes.ModelWithEigenModes,
    menu=[buttons(off, on), dropdown(5), dropdown(0), buttons(off, off, off, off, off, off, off), buttons(off, off, off, off, off, off), buttons(off, off, off, off, off, off, off, off), buttons(off, off, off, off, off, off, off, off)])  # -> Model, LoadCaseSelection
modelview = ModelViewKaramba3D(Model=resultselect.Model)  # -> Model, DeformedMesh, DeformedAxes, DeformedModel, MaximumDeformation
beamview = BeamViewKaramba3D(Model=modelview.Model)  # -> Model, MeshesOfRenderedBeams, DeformedBeamAxes, LegendColours, LegendTags
legend = LegendKaramba3D(
    Colors=beamview.LegendColours,
    Tags=beamview.LegendTags,
    Scale=0.8,
    Textsize=30,
    Legend_HasHeader=False,
    Legend_Justification=2,
    Legend_Position=2)

# ---- group: Results - Reaction Forces
react = ReactionForcesKaramba3D(AnalysedModel=beamview.Model)  # -> Model, ReactionForces_kN, ReactionMoments_kNm, SupportPosition, SumOfReactionForces_kN, SumOfReactionMoments_kNm, GoverningLoadCaseIndex
reactview = ReactionViewKaramba3D(Model=beamview.Model)  # -> Model, LegendColours, LegendTags
panel_7 = Panel(react.SumOfReactionForces_kN)

# ----
legend_2 = Legend(Colour=reactview.LegendColours, Tags=reactview.LegendTags, LegendType=1)

# ==== cluster Cluster
zonemeshes = ClusterInput()
zonemeshes_2 = Mesh(zonemeshes)
meshtargetsize = ClusterInput()
medges = MeshEdges(Mesh=zonemeshes_2)  # -> NakedEdges, InteriorEdges, NonManifoldEdges
meshtargetsize_2 = Number(meshtargetsize)
join = JoinCurves(Curves=medges.NakedEdges, Preserve=False)
trim = TrimTree(Tree=join, Depth=2)
boundary = BoundarySurfaces(Edges=trim)
dim = Dimensions(Surface=boundary)  # -> UDimension, VDimension
division = Division(A=dim.UDimension, B=meshtargetsize_2)
division_2 = Division(A=dim.VDimension, B=meshtargetsize_2)
round = Round(Number=division)  # -> Nearest, Floor, Ceiling
round_2 = Round(Number=division_2)  # -> Nearest, Floor, Ceiling
mesh_uv = MeshSurface(Surface=boundary, UCount=round.Nearest, VCount=round_2.Nearest, Overhang=True, Equalize=False)
loadingmeshes = Mesh(mesh_uv)
loadingmeshes_2 = ClusterOutput(loadingmeshes)
