# Grasshopper definition 01_RoofCanopyStructure.gh (Grasshopper 1.0.9)
# plug-ins: Karamba3D, MeshEdit Components, Pufferfish

peak_velocity_wind_pressure_q_p_kn_m2 = Slider(0.75, range=0.25..2)

# ---- group: EC 1 Data For Duopitch Canopies
# (neg for V shape, pos for inverse V shape)
# Data based on BS EN 1991-1-4:2005.
# Section 7.3: Figure 7.17 and Table 7.7.
roof_pitch_angle_α_deg = Panel("""-20
-15
-10
-5
+5
+10
+15
+20
+25
+30""")
duopitch_data_α_deg = Number(roof_pitch_angle_α_deg)
overall_force_coefficient_c_f = Panel("""+0.7
+0.5
+0.4
+0.3
+0.3
+0.4
+0.4
+0.6
+0.7
+0.9""")
duopitch_data_max_c_f = Number(overall_force_coefficient_c_f)
overall_force_coefficient_c_f_2 = Panel("""-0.7
-0.6
-0.6
-0.5
-0.6
-0.7
-0.8
-0.9
-1.0
-1.0""")
duopitch_data_min_c_f_φ_0 = Number(overall_force_coefficient_c_f_2)
overall_force_coefficient_c_f_3 = Panel("""-1.3
-1.4
-1.4
-1.3
-1.3
-1.3
-1.3
-1.3
-1.3
-1.3""")
duopitch_data_min_c_f_φ_1 = Number(overall_force_coefficient_c_f_3)

# ---- group: Define Geometry
column_height_m = Slider(6, range=0..15)
transverse_beam_side_extension_m = Slider(2.5, range=0..10)
column_span_m = Slider(10, range=0..15)
cantilever_span_m = Slider(6, range=0..10)
cantilever_tip_rise_m = Slider(0.525, range=-5..5)
cantilever_division_side = Slider(3, range=1..10)
# 01 - Roof Canopy Structure
# Difficulty: Hard | Version 3.1.4
# A simple steel roof canopy structure can be easily controlled using several sliders.
# Wind suction and pressure is generated using a c# algorithm according to BS EN 1991-1-4:2005 based on the different parameters and applied as several mesh loads in two main directions.
pt = ConstructPoint(XCoordinate=0, YCoordinate=0, ZCoordinate=0)
Z = UnitZ(Factor=column_height_m)
X = UnitX(Factor=column_span_m)
move = Move(Geometry=pt, Motion=X)  # -> Geometry, Transform
neg = Negative(Value=cantilever_span_m)
merge = Merge(Data1=cantilever_span_m, Data2=neg)
merge_2 = Merge(Data1=pt, Data2=move.Geometry)
move_2 = Move(Geometry=merge_2, Motion=Z)  # -> Geometry, Transform
vec = VectorXYZ(XComponent=0, YComponent=merge, ZComponent=cantilever_tip_rise_m)  # -> Vector, Length
vec_2 = VectorXYZ(XComponent=0, YComponent=merge, ZComponent=0)  # -> Vector, Length
move_3 = Move(Geometry=graft(move_2.Geometry), Motion=vec.Vector)  # -> Geometry, Transform
move_4 = Move(Geometry=graft(move_2.Geometry), Motion=vec_2.Vector)  # -> Geometry, Transform
ln = Line(StartPoint=merge_2, EndPoint=move_2.Geometry)
graft = GraftTree(Tree=move_2.Geometry, IncludeEmptyLists=True, IncludeNullItems=True)
ins = InsertItems(List=move_3.Geometry, Item=graft, Indices="1", Wrap=True)
item = ListItem(List=ins, Index=0, Wrap=True)  # -> Item, Item1, Item2
ln_2 = Line(StartPoint=item.Item1, EndPoint=item.Item2)
ln_3 = Line(StartPoint=item.Item, EndPoint=item.Item1)
join = JoinCurves(Curves=[ln_3, ln_2], Preserve=False)
multiplication = Multiplication(A=cantilever_division_side, B=2)
divide = DivideCurve(Curve=join, Count=multiplication, Kinks=False)  # -> simplify(Points), Tangents, Parameters
bang = ExplodeTree(Data=divide.Points)  # -> Branch0, Branch1
ln_4 = Line(StartPoint=bang.Branch0, EndPoint=bang.Branch1)
ext = ExtendCurve(Curve=ln_4, Type="0", Start=transverse_beam_side_extension_m, End=transverse_beam_side_extension_m)
ccx = CurveCurve(CurveA=graft(ext), CurveB=flatten(join))  # -> Points, ParamsA, ParamsB
trim = TrimTree(Tree=ccx.ParamsA, Depth=1)
shatter = Shatter(Curve=graft(ext), Parameters=trim)  # -> simplify(Segments)
shatter_2 = Shatter(Curve=join, Parameters=divide.Parameters)
tstat = TreeStatistics(Tree=shatter)  # -> Paths, Length, Count
expression = Expression(C=tstat.Count, Expression="(C-1)/2")
split = SplitList(List=tstat.Paths, Index=expression)  # -> ListA, ListB
shift = ShiftList(List=split.ListB, Shift=1, Wrap=False)
item_2 = ListItem(List=split.ListB, Index=0, Wrap=True)
split_2 = SplitTree(Data=shatter, Masks=flatten(split.ListA))  # -> flatten(Positive), Negative
split_3 = SplitTree(Data=shatter, Masks=flatten(item_2))  # -> flatten(Positive), Negative
split_4 = SplitTree(Data=shatter, Masks=flatten(shift))  # -> flatten(Positive), Negative
entwine = Entwine(Branch00=split_2.Positive, Branch01=split_3.Positive, Branch02=split_4.Positive, FlattenInputs=True)
bang_2 = ExplodeTree(Data=entwine)  # -> Branch0, Branch1, Branch2
mainbeams = Curve(flatten(shatter_2))
roof_beams = Curve(entwine)
columns = Curve(ln)
secl = Curve(bang_2.Branch0)
secc = Curve(bang_2.Branch1)
secr = Curve(bang_2.Branch2)
entwine_2 = Entwine(Branch00=columns, Branch01=mainbeams, Branch02=secl, Branch03=secc, Branch04=secr, FlattenInputs=True)

# ---- group: Calculate Pitch Angle
vec2pt = Vector2Pt(PointA=item.Item1, PointB=move_3.Geometry, Unitize=False)  # -> Vector, Length
vec2pt_2 = Vector2Pt(PointA=item.Item1, PointB=move_4.Geometry, Unitize=False)  # -> Vector, Length
angle = Angle(VectorA=vec2pt.Vector, VectorB=vec2pt_2.Vector)  # -> Angle, Reflex
vdis = VectorDisplay(Anchor=item.Item1, Vector=[vec2pt_2.Vector, vec2pt.Vector])
deg = Degrees(Radians=angle.Angle)  # -> flatten(Degrees)
cset = CreateSet(List=deg)  # -> Set, Map
cantilever_tip_rise_fall = Number(cantilever_tip_rise_m)
roundd = RoundToDecimalPlace(NumberX=cset.Set, DecimalPlace=1, RoundType=0)  # -> Rounded, Difference
panel = Panel([roundd.Rounded, roundd.Difference])
smaller = SmallerThan(FirstNumber=cantilever_tip_rise_fall, SecondNumber=0)  # -> SmallerThan, OrEqualTo
neg_2 = Negative(Value=roundd.Rounded)
filter = StreamFilter(Gate=smaller.SmallerThan, Stream0=neg_2, Stream1=roundd.Rounded)

# ---- group: Create Loading Mesh for Wind Load
roof_beams_2 = Curve(roof_beams)
join_2 = JoinCurves(Curves=roof_beams_2, Preserve=False)
bang_3 = ExplodeTree(Data=join_2)  # -> Branch0, Branch1, Branch2
rev = ReverseList(List=bang_3.Branch2)
item_3 = ListItem(List=bang_3.Branch0, Index=0, Wrap=True)
item_4 = ListItem(List=bang_3.Branch1, Index=0, Wrap=True)
item_5 = ListItem(List=rev, Index=0, Wrap=True)
entwine_3 = Entwine(Branch00=item_3, Branch01=item_4, Branch02=item_5, FlattenInputs=True)
flatten = FlattenTree(Tree=entwine_3, Path="{0}")
shift_2 = ShiftList(List=flatten, Shift=1, Wrap=False)
short = ShortestList(ListA=flatten, ListB=shift_2, TrimMode=2)  # -> ListA, ListB
entwine_4 = Entwine(Branch00=short.ListA, Branch01=short.ListB, FlattenInputs=True)
flip = FlipMatrix(Data=entwine_4)
loft = Loft(Curves=flip, Options={Adjust=False, Closed=False, LoftEnds=0, LoftSimp=0, LoftType=3, Rebuild=10, Refit=0.01})
mesh_uv = MeshSurface(Surface=loft, UCount=Slider(6, range=0..100), VCount=Slider(21, range=0..100), Overhang=True, Equalize=False)
clean = CombineClean(Meshes=flatten(mesh_uv))
roof_meshes_left_and_right = Mesh(mesh_uv)
unified_roof_mesh = Mesh(clean)

# ---- group: Calculate Pitch Angle
α_deg = Number(filter)
panel_2 = Panel(α_deg)

# ----
# Calculation based on BS EN 1991-1-4:2005, Section 7.3.
degree_of_blockage_φ = Slider(0.5, range=0..1)
duopitch_data_min_c_f_φ_0_2 = Number(duopitch_data_min_c_f_φ_0)
duopitch_data_min_c_f_φ_1_2 = Number(duopitch_data_min_c_f_φ_1)
duopitch_data_max_c_f_2 = Number(duopitch_data_max_c_f)
duopitch_data_α_deg_2 = Number(duopitch_data_α_deg)
α_deg_2 = Number(α_deg)
pitch_angle_deg = Panel(α_deg_2)
blockage_φ = Number(degree_of_blockage_φ)
blockage_φ_2 = Number(blockage_φ)
c_script = CSharpScript(
    angle=α_deg_2,
    blockage=blockage_φ_2,
    angles=duopitch_data_α_deg_2,
    c_f_max_list=duopitch_data_max_c_f_2,
    c_f_min_0=duopitch_data_min_c_f_φ_0_2,
    c_f_min_1=duopitch_data_min_c_f_φ_1_2)  # -> out, info, c_f_max, c_f_min; inputs angle: Double, blockage: Double, angles: list of Double, c_f_max_list: list of Double, c_f_min_0: list of Double, c_f_min_1: list of Double
# ---------- c_script: C# ----------
// Grasshopper Script Instance
#region Usings
using System;
using System.Linq;
using System.Collections;
using System.Collections.Generic;
using System.Drawing;

using Rhino;
using Rhino.Geometry;

using Grasshopper;
using Grasshopper.Kernel;
using Grasshopper.Kernel.Data;
using Grasshopper.Kernel.Types;
#endregion

public class Script_Instance : GH_ScriptInstance
{
    #region Notes
    /* 
      Members:
        RhinoDoc RhinoDocument
        GH_Document GrasshopperDocument
        IGH_Component Component
        int Iteration

      Methods (Virtual & overridable):
        Print(string text)
        Print(string format, params object[] args)
        Reflect(object obj)
        Reflect(object obj, string method_name)
    */
    #endregion

    private void RunScript(
		double angle,
		double blockage,
		List<double> angles,
		List<double> c_f_max_list,
		List<double> c_f_min_0,
		List<double> c_f_min_1,
		ref object info,
		ref object c_f_max,
		ref object c_f_min)
    {
        // Write your logic here
        // inputs:
        //   double angle
        //   double blockage
        //   List<double> angles
        //   List<double> c_f_max_list
        //   List<double> c_f_min_0
        //   List<double> c_f_min_1
        //
        // outputs:
        //   string info
        //   double? c_f_max
        //   double? c_f_min

        // validation
        if (angles.Count < 2 ||
            angles.Count != c_f_max_list.Count ||
            angles.Count != c_f_min_0.Count ||
            angles.Count != c_f_min_1.Count)
        {
            info = "Input list lengths don't match";
            c_f_max = null;
            c_f_min = null;
            return;
        }

        if (angle < angles[0] || angle > angles[angles.Count - 1])
        {
            info = "Calculation not applicable: angle outside range and canopy too steep.";
            c_f_max = null;
            c_f_min = null;
            return;
        }

        if (angle > -5 && angle < 5)
        {
            info = "Calculation not applicable: angle is too shallow.";
            c_f_max = null;
            c_f_min = null;
            return;
        }

        if (blockage < 0 || blockage > 1)
        {
            info = "Blockage must be between 0 and 1";
            c_f_max = null;
            c_f_min = null;
            return;
        }

        // find bounding interval in angles list
        int i = 0;
        for (i = 0; i < angles.Count - 1; i++)
        {
            if (angle >= angles[i] && angle <= angles[i + 1])
                break;
        }

        // interpolation parameter
        double t = (angle - angles[i]) / (angles[i + 1] - angles[i]);

        // interpolate c_f_max
        c_f_max = c_f_max_list[i] + t * (c_f_max_list[i + 1] - c_f_max_list[i]);

        // interpolate c_f_min at psi=0 and psi=1
        double min_0 = c_f_min_0[i] + t * (c_f_min_0[i + 1] - c_f_min_0[i]);
        double min_1 = c_f_min_1[i] + t * (c_f_min_1[i + 1] - c_f_min_1[i]);

        // round c_f_max
        c_f_max = Math.Round((double)c_f_max, 3);

        // interpolate between psi=0 and psi=1 and round c_f_min
        c_f_min = Math.Round(min_0 + blockage * (min_1 - min_0), 3);

        info = "Data is OK and calculation method is valid.";
     }
}
# ---------- end c_script ----------
q_p_kn_m2 = Number(peak_velocity_wind_pressure_q_p_kn_m2)
c_f_max = Number(c_script.c_f_max)
c_f_min = Number(c_script.c_f_min)
pressure_coefficients_information = Panel(c_script.info)
net_downward_pressure = Panel(c_f_max)
net_upward_suction = Panel(c_f_min)

# ---- group: Create preview showing wind direction & blockage diagram
unified_roof_mesh_2 = Mesh(unified_roof_mesh)
blockage_φ_3 = Number(blockage_φ)
roof_beams_3 = Curve(roof_beams)
bbox = BoundingBox(Content=flatten(roof_beams_3), Plane=PlaneXY(0, 0, 0), UnionBox=True)  # -> Box, Box_2
area = MeshArea(Mesh=unified_roof_mesh_2)  # -> Area, Centroid
xy = XYPlane(Origin=Point(0, 0, 0))
debox = DeconstructBox(Box=bbox.Box)  # -> Plane, X, Y, Z
project = Project(Geometry=area.Centroid, Plane=xy)  # -> Geometry, Transform
addition = Addition(Span=column_span_m, Extension=transverse_beam_side_extension_m, Extension_2=transverse_beam_side_extension_m)
dedomain = DeconstructDomain(Domain=debox.Z)  # -> Start, End
xz = XZPlane(Origin=project.Geometry)
multiplication_2 = Multiplication(A=blockage_φ_3, B=dedomain.End)
dom = ConstructDomain(DomainStart=expr("-x/2", addition), DomainEnd=expr("x/2", addition))
pl_offset = PlaneOffset(BasePlane=xz, Offset=expr("-x*1.1", cantilever_span_m))
concat = Concatenate(FragmentA="φ =", FragmentB=blockage_φ_3)
Y = UnitY(Factor=3)
dom_2 = ConstructDomain(DomainStart=0, DomainEnd=multiplication_2)
rectangle = Rectangle(Plane=pl_offset, XSize=dom, YSize=dom_2, Radius=0)  # -> Rectangle, Length
srf = Surface(rectangle.Rectangle)
vdisex = VectorDisplayEx(Point=project.Geometry, Vector=Y, Colour=RGB(0, 0, 0), Width=2)
preview = CustomPreview(Geometry=srf, Material=ColourSwatch(SwatchColor=RGBA(97, 186, 194, 100)))
tag = TextTag(Location=pl_offset, Text=concat)

# ---- group: Define CrossSections
matselect = MaterialSelectionKaramba3D(menu=[dropdown(1), dropdown(1), dropdown(2)])
crosecrselect = CrossSectionRangeSelectorKaramba3D(MaximumHeight_cm=-1, MaximumWidth_cm=-1, Material=matselect, menu=[dropdown(1), dropdown(0), dropdown(0)])
panel_3 = Panel("""CHS 355.6x8.0
HEA 360
HEA 220
HEA 220
HEA 220""")
crosecselect = CrossSectionSelectorKaramba3D(CrossSections=crosecrselect, NameOrListIndexOfCrossSection=panel_3, Material=matselect)  # -> CrossSection, Info
match = MatchTree(Tree=crosecselect.CrossSection, Guide=entwine_2)

# ---- group: Define Load Combinations
panel_4 = Panel("""G = Gravity
W_pressure = WL_0 | WL_1 | WL_2
W_suction = WL_3 | WL_4 | WL_5
W = W_pressure | W_suction
SLS = G + W
ULS = 1.35*G + 1.5*W""")
lccombinator = LoadCaseCombinatorKaramba3D(LoadCaseCombinationRulesKaramba3D=panel_4)  # -> LoadCaseCombinations, NamesOfLoadCases, NumberOfLoadCases

# ---- group: Define Beams
panel_5 = Panel("""Columns
MainBeams
SecL
SecC
SecR""")
lineelem = CreateLinearElementKaramba3D(
    Line=entwine_2,
    Identifier=graft(panel_5),
    CrossSection=match,
    LimitDistance_m=0.005,
    BucklingLengthY_m=-1,
    BucklingLengthZ_m=-1,
    BucklingLengthLT_m=-1,
    Bending=True,
    ToPolylineMaxAngle=0.25,
    ToPolylineTolerance=0.1,
    ToPolylineMaxEdgeLength=0.25,
    New=True,
    Remove=True,
    mode="LineToBeam",
    GuidGeneratorSeed=-1417286374)  # -> simplify(Element), Points, Info

# ---- group: Define Loads
loads = LoadsKaramba3D(Vector=Vector(0, 0, -1), LCase="Gravity", mode="Gravity")

# ---- group: Define Supports
end = EndPoints(Curve=columns)  # -> Start, End
supp = SupportKaramba3D(PosInd=end.Start, Ct_kN_m=Vector(0, 0, 0), Cr_kNm_rad=Vector(0, 0, 0), menu=[buttons(on, on, on, on, on, on)])

# ----
support = SupportKaramba3D(supp)

# ---- group: Define Loads
roof_meshes_left_and_right_2 = Mesh(simplify(roof_meshes_left_and_right))
c_f_max_2 = Number(c_f_max)
c_f_min_2 = Number(c_f_min)
cluster = Cluster(c_f_max=c_f_max_2, c_f_min=c_f_min_2)
area_2 = MeshArea(Mesh=roof_meshes_left_and_right_2)  # -> flatten(Area), Centroid
unflatten = UnflattenTree(Tree=area_2.Area, Guide=roof_meshes_left_and_right_2)
num = Number(cluster)
expression_2 = Expression(x=num, Expression="if (x>0,\"Pressure\",if(x<0,\"Suction\",0))")
panel_6 = Panel(expression_2)
panel_7 = Panel(cluster)
panel_8 = Panel("""SecC
SecR""")
panel_9 = Panel("""SecL
SecC""")
mesh = Mesh(simplify(mesh_uv))
flatten_2 = FlattenTree(Tree=mesh, Path="{0}")
entwine_5 = Entwine(Branch00=panel_9, Branch01=panel_8, FlattenInputs=True)  # -> simplify(Result)
lng = ListLength(List=flatten_2)
lng_2 = ListLength(List=entwine_5)

area_3 = MeshArea(Mesh=roof_meshes_left_and_right_2)  # -> Area, Centroid
meshcp = MeshClosestPoint(Point=area_3.Centroid, Mesh=roof_meshes_left_and_right_2)  # -> Point, Index, Parameter
meval = MeshEval(Mesh=roof_meshes_left_and_right_2, Parameter=meshcp.Parameter)  # -> Point, Normal, Colour
Z_2 = UnitZ(Factor=1)
dprod = DotProduct(VectorA=meval.Normal, VectorB=Z_2, Unitize=False)
larger = LargerThan(FirstNumber=dprod, SecondNumber=0)  # -> LargerThan, OrEqualTo
dispatch = Dispatch(List=meval.Normal, DispatchPattern=larger.LargerThan)  # -> ListA, ListB
rev_2 = Reverse(Vector=dispatch.ListA)
merge_3 = Merge(Data1=rev_2, Data2=dispatch.ListB)
mesh_centroid_vector = Vector(merge_3)
flatten_3 = FlattenTree(Tree=mesh_centroid_vector, Path="{0}")
vdis_2 = VectorDisplay(Anchor=meshcp.Point, Vector=mesh_centroid_vector)

tstat_2 = TreeStatistics(Tree=cluster)  # -> Paths, Length, Count
dup = DuplicateData(Data=area_2.Area, Number=tstat_2.Count, Order=True)
lng_3 = ListLength(List=area_2.Area)
partition = PartitionList(List=dup, Size=lng_3)  # -> simplify(Chunks)
q_p_kn_m2_2 = Number(q_p_kn_m2)
expression_3 = Expression(A_ref=partition, q_p=q_p_kn_m2_2, c_f_max=cluster, Expression="c_f_max * A_ref * q_p")

division = Division(A=expression_3, B=unflatten)
amp = Amplitude(Vector=flatten_3, Amplitude=division)
panel_10 = Panel(expression_3)
tstat_3 = TreeStatistics(Tree=amp)  # -> Paths, Length, Count
dup_2 = DuplicateData(Data=entwine_5, Number=tstat_3.Count, Order=True)  # -> simplify(Data)
dup_3 = DuplicateData(Data=flatten_2, Number=tstat_3.Count, Order=True)
partition_2 = PartitionList(List=dup_3, Size=lng)  # -> simplify(Chunks)
partition_3 = PartitionList(List=dup_2, Size=lng_2)  # -> simplify(Chunks)
path_mapper = PathMapper(partition_3, source="{A;B}", target="{B;A}")
graft_2 = GraftTree(Tree=amp, IncludeEmptyLists=True, IncludeNullItems=True)
graft_3 = GraftTree(Tree=partition_2, IncludeEmptyLists=True, IncludeNullItems=True)
elem_id_situation_mesh = Data(path_mapper)
vec_situation_mesh = Vector(graft_2)
mesh_situation_mesh = Mesh(graft_3)

tstat_4 = TreeStatistics(Tree=division)  # -> Paths, Length, Count
dpath = DeconstructPath(Branch=tstat_4.Paths)
concat_2 = Concatenate(FragmentA="WL_", FragmentB=dpath)  # -> simplify(Result)

dup_4 = DuplicateData(Data=concat_2, Number=lng, Order=True)  # -> simplify(Data)
lng_4 = ListLength(List=concat_2)
partition_4 = PartitionList(List=dup_4, Size=lng_4)  # -> simplify(Chunks)
load_case_situation_mesh = Data(partition_4)
loads_2 = LoadsKaramba3D(
    Vector=vec_situation_mesh,
    Mesh=mesh_situation_mesh,
    ElementIdentifiers=elem_id_situation_mesh,
    LCase=load_case_situation_mesh,
    mode="MeshLoad -Const.",
    menu=[buttons(off, on, off), buttons(off, on)])

# ----
entwine_6 = Entwine(Branch00=loads, Branch01=loads_2, Branch02=lccombinator.LoadCaseCombinations, FlattenInputs=True)
load = LoadKaramba3D(entwine_6)

# ---- group: Orientate Beams
bang_4 = ExplodeTree(Data=simplify(lineelem.Element))  # -> Branch0, Branch1, Branch2, Branch3, Branch4
disassemble = DisassembleElementKaramba3D(Element=bang_4.Branch1)  # -> Element, ElementIdentifier, simplify(AxisOfElement), CrossSection, Joint, Material, LocalCoordinateSystem, ElementIsActive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
num_2 = Number(cantilever_division_side)
Z_3 = UnitZ(Factor=1)
panel_11 = Panel("""SecL
SecR""")
neg_3 = Negative(Value=Z_3)
orientate = OrientateElemKaramba3D(BeamIdentifier=graft("SecC"), ZOrientation=neg_3, mode="Beam")

# ----
multiplication_3 = Multiplication(A=num_2, B=2)

# ---- group: Orientate Beams (continued)
split_5 = SplitList(List=disassemble.AxisOfElement, Index=multiplication_3)  # -> ListA, ListB
split_6 = SplitList(List=split_5.ListA, Index=num_2)  # -> ListA, ListB
entwine_7 = Entwine(Branch00=split_6.ListA, Branch01=split_6.ListB, FlattenInputs=True)
orientate_2 = OrientateElemKaramba3D(BeamIdentifier=graft(panel_11), YOrientation=entwine_7, mode="Beam")

# ----
merge_4 = Merge(Data1=lineelem.Element, Data2=orientate, Data3=orientate_2)
element = ElementKaramba3D(merge_4)

# ---- group: Assemble Model
assemble = AssembleModelKaramba3D(Elem=flatten(element), Support=flatten(support), Load=flatten(load), LimitDistance_m=0.005)  # -> Model, Info, Mass_kg, CentreOfGravity, LoadCaseNames
panel_12 = Panel(assemble.LoadCaseNames)
system_mass_kg = Panel(assemble.Mass_kg)

# ---- group: Analyze Model
analyse = AnalyseKaramba3D(Model=assemble.Model)  # -> AnalysedModel, MaximumDisplacement_cm, ResultingForce_kN, ChangeOfElasticEnergy_kNm
max_displacement_cm = Panel(analyse.MaximumDisplacement_cm)

# ---- group: Model View
resultselect = ResultSelectorKaramba3D(
    Model=analyse.AnalysedModel,
    menu=[buttons(off, on), dropdown(12), dropdown(0), buttons(off, off, off, off, off, off, off), buttons(off, off, off, off, off, off), buttons(off, off, off, off, off, off, off, off), buttons(off, off, off, off, off, off, off, off)])  # -> Model, LoadCaseSelection
modelview = ModelViewKaramba3D(Model=resultselect.Model)  # -> Model, DeformedMesh, DeformedAxes, DeformedModel, MaximumDeformation
beamview = BeamViewKaramba3D(Model=modelview.Model)  # -> Model, MeshesOfRenderedBeams, DeformedBeamAxes, LegendColours, LegendTags
legend = Legend(Colour=beamview.LegendColours, Tags=beamview.LegendTags, LegendType=1)
reactview = ReactionViewKaramba3D(Model=beamview.Model)  # -> Model, LegendColours, LegendTags

# ---- group: Export Model
dstv_name_extension = Panel("ENG01-Canopy.stp")
folder_path_for_export = FilePath("C:\Users\mattt\Desktop\")
filter_2 = StreamFilter(Gate=Toggle(False), Stream1=analyse.AnalysedModel)
concat_3 = Concatenate(FragmentA=folder_path_for_export, FragmentB=dstv_name_extension)
extodstv = ExportModelToDStVKaramba3D(
    Model=filter_2,
    Path=concat_3,
    ExportPath="C:\Users\mattt\Desktop\ENG01-Canopy.stp",
    menu=[buttons(off, off, off, on, off)])  # -> DStV, Info
panel_13 = Panel(extodstv.DStV)

# ==== cluster Cluster
c_f_max = ClusterInput()
c_f_min = ClusterInput()

# ---- group: Define EC1 based 6 load situations
c_f_max_2 = Number(c_f_max)
c_f_min_2 = Number(c_f_min)
entwine = Entwine(Branch00=c_f_max_2, Branch01=c_f_max_2, FlattenInputs=True)  # -> simplify(Result)
entwine_2 = Entwine(Branch00=c_f_max_2, Branch01="0", FlattenInputs=True)  # -> simplify(Result)
entwine_3 = Entwine(Branch00="0", Branch01=c_f_max_2, FlattenInputs=True)  # -> simplify(Result)
entwine_4 = Entwine(Branch00=c_f_min_2, Branch01=c_f_min_2, FlattenInputs=True)  # -> simplify(Result)
entwine_5 = Entwine(Branch00=c_f_min_2, Branch01="0", FlattenInputs=True)  # -> simplify(Result)
entwine_6 = Entwine(Branch00="0", Branch01=c_f_min_2, FlattenInputs=True)  # -> simplify(Result)
entwine_7 = Entwine(
    Branch0X=entwine,
    Branch1X=entwine_2,
    Branch2X=entwine_3,
    Branch3X=entwine_4,
    Branch4X=entwine_5,
    Branch5X=entwine_6,
    FlattenInputs=False)
trim = TrimTree(Tree=entwine_7, Depth=1)

# ----
T = ClusterOutput(trim)
