# Grasshopper definition 01_ScriptedTruss.gh (Grasshopper 1.0.8)
# plug-ins: Karamba3D

# ----
# GH Input Curves
height = Slider(2.3, range=1..5)
line = LineSDL(Start="0,0,0", Direction="{1,0,0}", Length=Slider(9, range=8..20))
Z = UnitZ(Factor=height)
move = Move(Geometry=line, Motion=Z)  # -> Geometry, Transform

# ----
# Rhino Input Curves
# Truss Maker
panel = Panel("example: triangle")
panel_2 = Panel("example: arch")

# ----
# Pratt, K-Truss
crv = Curve(reparameterize(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))
crv_2 = Curve(reparameterize(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))
crv_3 = Curve(reparameterize(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))
crv_4 = Curve(reparameterize(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))

# ----
# Warren, Vierendeel
crv_5 = Curve(reparameterize(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))
crv_6 = Curve(reparameterize(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))
crv_7 = Curve(reparameterize(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))
crv_8 = Curve(reparameterize(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))

uppergirder = Curve(reparameterize(move.Geometry))
lowergirder = Curve(reparameterize(line))
end = EndPoints(Curve=lowergirder)  # -> Start, End

# ----
# Difficulty: Simple| Version 3.1.5
# The "TrussMaker“ allows different truss typologies to be parametrically set up  in C#, called. With this tool, you can choose between the truss-types Pratt, Warren, K-Truss, and Vierendeel.
# This script uses a custom Mirror Component C# by Garcia del Castillo: https://github.com/ParametricCamp/TutorialFiles/tree/master/Advanced_Development_Grasshopper/csharp-scripting
type_of_truss = ValueList({"Pratt": 1, "Warren": 2, "Warren With Verticals": 3, "K-Truss": 4, "Vierendeel": 5}, selected="Vierendeel")
# 01 - Scripted Truss
trussmaker = TrussMaker(Upper=uppergirder, Lower=lowergirder, Type=type_of_truss, N=Slider(6, range=2..12))  # -> out, UpperGirder, LowerGirder, Diagonals, Posts; inputs Upper: Curve, Lower: Curve, Type: Int32, N: Int32
# ---------- trussmaker: C# usings ----------
using System.Linq;
# ---------- trussmaker: C# ----------
    #region Component Description
    Component.Name = "Truss Maker";
    Component.NickName = "TrussMaker";
    Component.Description = "Creates different types of trusses based on given curves for upper and lower girder.";

    Component.Params.Input[0].Description = "Curve for Upper Girder.";
    Component.Params.Input[0].Name = "Upper Girder";
    Component.Params.Input[0].NickName = "Upper";
    Component.Params.Input[1].Description = "Curve for Lower Girder.";
    Component.Params.Input[1].Name = "Lower Girder";
    Component.Params.Input[1].NickName = "Lower";
    Component.Params.Input[2].Description = "Type of Truss to be generated: 1: PrattTruss; 2: WarrenTruss; 3: WarrenTrussWithVerticals; 4: KTruss; 5: VierendeelTruss";
    Component.Params.Input[2].Name = "Type of Truss";
    Component.Params.Input[2].NickName = "Type";
    Component.Params.Input[3].Description = "Number of truss subdivisions.";
    Component.Params.Input[3].Name = "Number of Subdivisions";
    Component.Params.Input[3].NickName = "N";

    Component.Params.Output[1].Description = "Upper Girder Members";
    Component.Params.Output[1].Name = "Upper Girder Members";
    Component.Params.Output[1].NickName = "UpperGirder";
    Component.Params.Output[2].Description = "Lower Girder Members";
    Component.Params.Output[2].Name = "Lower Girder Members";
    Component.Params.Output[2].NickName = "LowerGirder";
    Component.Params.Output[3].Description = "Diagonal Members";
    Component.Params.Output[3].Name = "Diagonal Members";
    Component.Params.Output[3].NickName = "Diagonals";
    Component.Params.Output[4].Description = "Posts";
    Component.Params.Output[4].Name = "Posts";
    Component.Params.Output[4].NickName = "Posts";

    #endregion


    List<Line> uGirder_ = new List<Line>();
    List<Line> lGirder_ = new List<Line>();
    List<Line> diagonals_ = new List<Line>();
    List<Line> posts_ = new List<Line>();

    switch (Type)
    {
      case 1:
        PrattTruss(N, Upper, Lower, uGirder_, lGirder_, diagonals_, posts_);
        break;
      case 2:
        WarrenTruss(N, Upper, Lower, uGirder_, lGirder_, diagonals_, posts_);
        break;
      case 3:
        WarrenTrussWithVerticals(N, Upper, Lower, uGirder_, lGirder_, diagonals_, posts_);
        break;
      case 4:
        KTruss(N, Upper, Lower, uGirder_, lGirder_, diagonals_, posts_);
        break;
      case 5:
        VierendeelTruss(N, Upper, Lower, uGirder_, lGirder_, diagonals_, posts_);
        break;
    }

    UpperGirder = uGirder_.Where(i => i.Length != 0).ToList();
    LowerGirder = lGirder_.Where(i => i.Length != 0).ToList();
    Diagonals = diagonals_.Where(i => i.Length != 0).ToList();
    Posts = posts_.Where(i => i.Length != 0).ToList();
# ---------- trussmaker: C# additional code ----------
  public void PrattTruss(int N, Curve uLine, Curve lLine, List<Line> uGirder, List<Line> lGirder, List<Line> diagonals, List<Line> posts)
  {
    for (int nInd = 0; nInd < N; ++nInd) {
      List <double> ts = new List<double>{ (nInd + 0.0) / N, (nInd + 1.0) / N };
      List <Point3d> ups = new List <Point3d>();
      List <Point3d> lps = new List <Point3d>();
      foreach (double t in ts)
      {
        ups.Add(uLine.PointAt(t));
        lps.Add(lLine.PointAt(t));
      }

      uGirder.Add(new Line(ups[0], ups[1]));
      lGirder.Add(new Line(lps[0], lps[1]));

      if (nInd == 0) {
        posts.Add(new Line(lps[0], ups[0]));
      }
      posts.Add(new Line(lps[1], ups[1]));

      diagonals.Add(new Line(ups[0], lps[1]));
    }
  }

  public void WarrenTruss(int N, Curve lLine, Curve uLine, List<Line> uGirder, List<Line> lGirder, List<Line> diagonals, List<Line> posts)
  {
    Point3d cPoint = lLine.PointAt(0);
    for (int nInd = 0; nInd < N; ++nInd) {
      List <double> ts = new List<double>{ (nInd + 0.0) / N, (nInd + 0.5) / N, (nInd + 1.0) / N };
      List <Point3d> ups = new List <Point3d>();
      List <Point3d> lps = new List <Point3d>();
      foreach (double t in ts)
      {
        ups.Add(uLine.PointAt(t));
        lps.Add(lLine.PointAt(t));
      }

      lGirder.Add(new Line(ups[0], ups[2]));
      if (nInd != 0) {
        uGirder.Add(new Line(cPoint, lps[1]));
      }
      cPoint = lps[1];

      diagonals.Add(new Line(ups[0], lps[1]));
      diagonals.Add(new Line(lps[1], ups[2]));
    }
  }

  public void WarrenTrussWithVerticals(int N, Curve uLine, Curve lLine, List<Line> uGirder, List<Line> lGirder, List<Line> diagonals, List<Line> posts)
  {
    for (int nInd = 0; nInd < N; ++nInd) {
      List <double> ts = new List<double>{ (nInd + 0.0) / N, (nInd + 0.5) / N, (nInd + 1.0) / N };
      List <Point3d> ups = new List <Point3d>();
      List <Point3d> lps = new List <Point3d>();
      foreach (double t in ts)
      {
        ups.Add(uLine.PointAt(t));
        lps.Add(lLine.PointAt(t));
      }

      uGirder.Add(new Line(ups[0], ups[1]));
      uGirder.Add(new Line(ups[1], ups[2]));
      lGirder.Add(new Line(lps[0], lps[1]));
      lGirder.Add(new Line(lps[1], lps[2]));

      if (nInd == 0) {
        posts.Add(new Line(lps[0], ups[0]));
      }
      posts.Add(new Line(lps[1], ups[1]));
      posts.Add(new Line(lps[2], ups[2]));

      diagonals.Add(new Line(ups[0], lps[1]));
      diagonals.Add(new Line(lps[1], ups[2]));
    }
  }

  public void KTruss(int N, Curve uLine, Curve lLine, List<Line> uGirder, List<Line> lGirder, List<Line> diagonals, List<Line> posts)
  {
    for (int nInd = 0; nInd < N; ++nInd) {
      List <double> ts = new List<double>{ (nInd + 0.0) / N, (nInd + 1.0) / N };
      List <Point3d> ups = new List <Point3d>();
      List <Point3d> lps = new List <Point3d>();
      List <Point3d> mps = new List <Point3d>();
      foreach (double t in ts)
      {
        var upperPoint = uLine.PointAt(t);
        ups.Add(upperPoint);
        var lowerPoint = lLine.PointAt(t);
        lps.Add(lowerPoint);
        var midPoint = (upperPoint + lowerPoint) * 0.5;
        mps.Add(midPoint);
      }

      uGirder.Add(new Line(ups[0], ups[1]));
      lGirder.Add(new Line(lps[0], lps[1]));

      if (nInd == 0) {
        posts.Add(new Line(lps[0], ups[0]));
      }
      posts.Add(new Line(lps[1], mps[1]));
      posts.Add(new Line(mps[1], ups[1]));

      diagonals.Add(new Line(mps[1], lps[0]));
      diagonals.Add(new Line(mps[1], ups[0]));
    }
  }

  public void VierendeelTruss(int N, Curve uLine, Curve lLine, List<Line> uGirder, List<Line> lGirder, List<Line> diagonals, List<Line> posts)
  {
    for (int nInd = 0; nInd < N; ++nInd) {
      List <double> ts = new List<double>{ (nInd + 0.0) / N, (nInd + 1.0) / N };
      List <Point3d> ups = new List <Point3d>();
      List <Point3d> lps = new List <Point3d>();
      foreach (double t in ts)
      {
        var upperPoint = uLine.PointAt(t);
        ups.Add(upperPoint);
        var lowerPoint = lLine.PointAt(t);
        lps.Add(lowerPoint);
      }

      uGirder.Add(new Line(ups[0], ups[1]));
      lGirder.Add(new Line(lps[0], lps[1]));

      if (nInd == 0) {
        posts.Add(new Line(lps[0], ups[0]));
      }
      posts.Add(new Line(lps[1], ups[1]));
    }
  }
# ---------- end trussmaker ----------

merge = Merge(Data1=trussmaker.Diagonals, Data2=trussmaker.Posts)
yz = YZPlane(Origin=end.End)
entwine = Entwine(Branch00=trussmaker.UpperGirder, Branch01=trussmaker.LowerGirder, Branch02=merge, FlattenInputs=True)
gh_mirror = CSharpScript(G=entwine, P=yz, Typ=type_of_truss)  # -> out, Gout, X; inputs G: GeometryBase, P: Plane, Typ: Int32
# ---------- gh_mirror: C# ----------
    // Component written by @garciadelcastillo

    // This component creates a Transformation that mirrors an object on a plane.

    // Compute the Transform and output it
    if ( Typ == 2 || Typ == 3 || Typ == 5)
    {
      Print("Type is Warren, no mirrow. No Lines come from this component");
    }
    else
    {
      Transform xform = Transform.Mirror(P);
      X = xform;  // *

      // Apply it to the object and output it only if it exists
      if (G != null)
      {
        G.Transform(xform);
        Gout = G;
        };;
    }


    // * NOTE:
    //   This transform stringifies to "Generic" because it doesn't use
    //   the GH-flavored transforms in Grasshopper.Kernel.Types.Transforms.
# ---------- end gh_mirror ----------
bang = ExplodeTree(Data=entwine)  # -> Branch0, Branch1, Branch2
bang_2 = ExplodeTree(Data=gh_mirror.Gout)  # -> Branch0, Branch1, Branch2
entwine_2 = Entwine(
    Branch00=[bang.Branch0, bang_2.Branch0],
    Branch01=[bang_2.Branch1, bang.Branch1],
    Branch02=[bang.Branch2, bang_2.Branch2],
    FlattenInputs=True)
clean = CleanTree(RemoveNulls=True, RemoveInvalid=True, RemoveEmpty=False, Tree=entwine_2)
line_2 = Line(clean)

# ---- group: Define Cross Section
matselect = MaterialSelectionKaramba3D(menu=[dropdown(1), dropdown(1)])
crosecrselect = CrossSectionRangeSelectorKaramba3D(MaximumHeight_cm=-1, MaximumWidth_cm=-1, Material=matselect, menu=[dropdown(1), dropdown(1), dropdown(3)])
ind = Slider(6, range=0..17)
crosecrselect_2 = CrossSectionRangeSelectorKaramba3D(MaximumHeight_cm=-1, MaximumWidth_cm=-1, Material=matselect, menu=[dropdown(1), dropdown(3), dropdown(1)])
ind_2 = Slider(40, range=0..130)
crosecselect = CrossSectionSelectorKaramba3D(CrossSections=crosecrselect, NameOrListIndexOfCrossSection=ind)  # -> CrossSection, Info
crosecselect_2 = CrossSectionSelectorKaramba3D(CrossSections=crosecrselect_2, NameOrListIndexOfCrossSection=ind_2)  # -> CrossSection, Info

# ---- group: Define Supports
bang_3 = ExplodeTree(Data=line_2)  # -> Branch0, Branch1, Branch2
join = JoinCurves(Curves=[bang_3.Branch0, bang_3.Branch1], Preserve=False)  # -> flatten(Curves)
end_2 = EndPoints(Curve=join)  # -> Start, End
merge_2 = Merge(Data1=end_2.Start, Data2=end_2.End)
pdecon = Deconstruct(Point=flatten(merge_2))  # -> XComponent, YComponent, ZComponent
smaller = SmallerThan(FirstNumber=pdecon.ZComponent, SecondNumber="0.1")  # -> SmallerThan, OrEqualTo
dispatch = Dispatch(List=merge_2, DispatchPattern=smaller.SmallerThan)  # -> ListA, ListB
supp = SupportKaramba3D(PosInd=dispatch.ListA, Ct_kN_m=Vector(0, 0, 0), Cr_kNm_rad=Vector(0, 0, 0), menu=[buttons(on, on, on, on, off, off)])

# ---- group: Define Joints
panel_3 = Panel("web")
beam_joints = BeamJointsKaramba3D(
    BeamIdentifier=panel_3,
    CtKNMAtStartingNode=Vector(0, 0, 0),
    CrKNmRadAtStartingNode=Vector(0, 0, 0),
    CtKNMAtEndNode=Vector(0, 0, 0),
    CrKNmRadAtEndNode=Vector(0, 0, 0),
    menu=[buttons(off, off, off, off, on, off), buttons(off, off, off, off, on, off)])

# ---- group: Define Loads
force = Slider(-50, range=-50..0)
Z_2 = UnitZ(Factor=force)
loads = LoadsKaramba3D(Vector=Vector(0, 0, -1), LCase="LC0", mode="Gravity")
beam_loads = BeamLoadsKaramba3D(BeamIdentifier="Upper", LoadCase="LC0", ForceVector=Z_2, TStart=0, TEnd=1, mode="Block", menu=[buttons(off, on, off)])
load = LoadKaramba3D(flatten([loads, beam_loads]))

# ---- group: Line To Beam
entwine_3 = Entwine(
    Branch00=crosecselect.CrossSection,
    Branch01=crosecselect.CrossSection,
    Branch02=crosecselect_2.CrossSection,
    FlattenInputs=True)
panel_4 = Panel("""Upper
Lower
web""")
lineelem = CreateLinearElementKaramba3D(
    Line=line_2,
    Identifier=graft(panel_4),
    CrossSection=entwine_3,
    LimitDistance_m=0.005,
    BucklingLengthY_m=-1,
    BucklingLengthZ_m=-1,
    BucklingLengthLT_m=-1,
    Bending=True,
    ToPolylineMaxAngle=0.25,
    ToPolylineTolerance=0.1,
    ToPolylineMaxEdgeLength=0.25,
    New=True,
    Remove=True,
    mode="LineToBeam")  # -> flatten(Element), Points, Info

# ---- group: Assemble Model
assemble = AssembleModelKaramba3D(Elem=lineelem.Element, Support=supp, Load=load, Joint=beam_joints, LimitDistance_m=0.005)  # -> Model, Info, Mass_kg, CentreOfGravity, LoadCaseNames

# ----
mass_kg = Panel(assemble.Mass_kg)

# ---- group: Analyze Model
analyse = AnalyseKaramba3D(Model=assemble.Model)  # -> AnalysedModel, MaximumDisplacement_cm, ResultingForce_kN, ChangeOfElasticEnergy_kNm

# ----
displacement_cm = Panel(analyse.MaximumDisplacement_cm)

# ---- group: View Results
modelview = ModelViewKaramba3D(Model=analyse.AnalysedModel)  # -> Model, DeformedMesh, DeformedAxes, DeformedModel, MaximumDeformation
beamview = BeamViewKaramba3D(Model=modelview.Model)  # -> Model, MeshesOfRenderedBeams, DeformedBeamAxes, LegendColours, LegendTags
legend = Legend(Colour=beamview.LegendColours, Tags=beamview.LegendTags, LegendType=1)
