# Grasshopper definition 01_SimpleFrame.gh (Grasshopper 1.0.7)
# plug-ins: Karamba3D

# ---- group: Create Geometry
X = UnitX(Factor=1)
width = Slider(5, range=2..20)
height = Slider(5, range=2..20)
line = LineSDL(Start="0,0,0", Direction=X, Length=width)
# 01 - Simple Frame
# Difficulty: Simple | Version 3.1.4
# Here a simple portal frame with two load cases are analysed: a vertical load case on the upper beam and horizontal load case on one column.  By setting the boundary conditions of the individual supports and releasing joints at the
# beam to column connection, it is possible to see the change in deformation shape as well as the change in the bending moments in the individual elements.
end = EndPoints(Curve=line)  # -> Start, End
merge = Merge(Data1=end.Start, Data2=end.End)
Z = UnitZ(Factor=height)
move = Move(Geometry=merge, Motion=Z)  # -> Geometry, Transform
item = ListItem(List=move.Geometry, Index=0, Wrap=True)  # -> Item, Item1
ln = Line(StartPoint=end.Start, EndPoint=item.Item)
ln_2 = Line(StartPoint=item.Item, EndPoint=item.Item1)
ln_3 = Line(StartPoint=item.Item1, EndPoint=end.End)
merge_2 = Merge(Data1=ln, Data2=ln_2, Data3=ln_3)

# ---- group: Define Materials
matselect = MaterialSelectionKaramba3D(menu=[dropdown(1), dropdown(2)])

# ---- group: Define Cross Sections
crosecrselect = CrossSectionRangeSelectorKaramba3D(MaximumHeight_cm=-1, MaximumWidth_cm=-1, Material=matselect, menu=[dropdown(0), dropdown(1), dropdown(3)])
crosecselect = CrossSectionSelectorKaramba3D(CrossSections=crosecrselect, NameOrListIndexOfCrossSection="HEA300")  # -> CrossSection, Info

# ---- group: Define Loads
Z_2 = UnitZ(Factor=Slider(5, range=1..20))  # -> expr("x*-1", UnitVector)
X_2 = UnitX(Factor=Slider(-2, range=-20..20))
beam_loads = BeamLoadsKaramba3D(BeamIdentifier="B", LoadCase="Vertical", ForceVector=Z_2, TStart=0, TEnd=1, mode="Block", menu=[buttons(on, off, off)])
beam_loads_2 = BeamLoadsKaramba3D(BeamIdentifier="C", LoadCase="Horizontal", ForceVector=X_2, TStart=0, TEnd=1, mode="Block", menu=[buttons(off, on, off)])
merge_3 = Merge(Data2=beam_loads, Data3=beam_loads_2)
load = LoadKaramba3D(flatten(merge_3))

# ---- group: Define Elements
panel = Panel("""A
B
C""")
lineelem = CreateLinearElementKaramba3D(
    Line=merge_2,
    Identifier=panel,
    CrossSection=crosecselect.CrossSection,
    LimitDistance_m=0.005,
    BucklingLengthY_m=-1,
    BucklingLengthZ_m=-1,
    BucklingLengthLT_m=-1,
    Bending=True,
    ToPolylineMaxAngle=0.03,
    ToPolylineTolerance=0.01,
    ToPolylineMaxEdgeLength=0.25,
    New=True,
    Remove=True,
    mode="LineToBeam")  # -> Element, Points, Info

# ---- group: Define Supports
item_2 = ListItem(List=merge, Index=0, Wrap=True)  # -> Item, Item1
supp = SupportKaramba3D(PosInd=item_2.Item, menu=[buttons(on, on, on, on, on, off)])
supp_2 = SupportKaramba3D(PosInd=item_2.Item1, menu=[buttons(on, on, on, off, on, off)])
merge_4 = Merge(Data1=supp, Data2=supp_2)
support = SupportKaramba3D(flatten(merge_4))

# ---- group: Define Joints
joint_agent = BeamJointAgentKaramba3D(
    BeamIdentifier="B",
    ToElementIdentifiers="A",
    Ct_kN_m=Vector(0, 0, 0),
    Cr_kNm_rad=Vector(0, 0, 0),
    menu=[buttons(off, off, off, off, off, off)])
joint_agent_2 = BeamJointAgentKaramba3D(
    BeamIdentifier="B",
    ToElementIdentifiers="C",
    Ct_kN_m=Vector(0, 0, 0),
    Cr_kNm_rad=Vector(0, 0, 0),
    menu=[buttons(off, off, off, off, off, off)])
merge_5 = Merge(Data1=joint_agent, Data2=joint_agent_2)
joint = JointKaramba3D(flatten(merge_5))

# ---- group: Assemble Model
assemble = AssembleModelKaramba3D(Elem=lineelem.Element, Support=support, Load=load, Joint=joint, LimitDistance_m=0.005)  # -> Model, Info, Mass_kg, CentreOfGravity, LoadCaseNames

# ---- group: Eigenmodes
emodes = EigenModesKaramba3D(Model=assemble.Model, FromIndex=1, NumberOfModes=1, WithThIIEffects=True, MaximumNumberOfIterations=300, Epsilon=1e-07)  # -> ModelWithEigenModes, Eigenvalues
panel_2 = Panel(emodes.Eigenvalues)

# ---- group: Analyze Model
analyse = AnalyseKaramba3D(Model=assemble.Model)  # -> AnalysedModel, MaximumDisplacement_cm, ResultingForce_kN, ChangeOfElasticEnergy_kNm
panel_3 = Panel(analyse.MaximumDisplacement_cm)

# ---- group: View Results
modelview = ModelViewKaramba3D(Model=analyse.AnalysedModel)  # -> Model, DeformedMesh, DeformedAxes, DeformedModel, MaximumDeformation
beamview = BeamViewKaramba3D(Model=modelview.Model)  # -> Model, MeshesOfRenderedBeams, DeformedBeamAxes, LegendColours, LegendTags
legend = Legend(Colour=beamview.LegendColours, Tags=beamview.LegendTags, LegendType=1)

modelview_2 = ModelViewKaramba3D(Model=emodes.ModelWithEigenModes)  # -> Model, DeformedMesh, DeformedAxes, DeformedModel, MaximumDeformation
beamview_2 = BeamViewKaramba3D(Model=modelview_2.Model)  # -> Model, MeshesOfRenderedBeams, DeformedBeamAxes, LegendColours, LegendTags
legend_2 = Legend(Colour=beamview_2.LegendColours, Tags=beamview_2.LegendTags, LegendType=1)
