# Grasshopper definition 01_SingleSpanBeam.gh (Grasshopper 1.0.7)
# Copyright: B+G Engineers
# plug-ins: Karamba3D

# ---- group: Create Geometry
pt = Point(Point(0.6132713423, 1.260593929, 0))
pt_2 = Point(Point(5.613271342, 1.260593929, 0))
i = Slider(17, range=10..30)
ln = Line(StartPoint=pt, EndPoint=pt_2)
aligndim = AlignedDimension(Plane=PlaneXY(0, 0, 0), PointA=pt, PointB=pt_2, Offset=-1, Text="{0:0.00}", Size=0.2)
range = Range(Domain=Domain(0, 1), Steps=i)
# 01 - Single Span Beam
# Difficulty: Simple | Version 3.1.4
# A single span beam with two supports and a uniform line load is analyzed using the cross section optimizer to find the optimal cross sections for each element. The moment section forces can be visualized in the Beam View component.
# The FREE version does not include the Cross Section Optimizer.
shatter = Shatter(Curve=ln, Parameters=range)

# ---- group: Define Materials
matselect = MaterialSelectionKaramba3D(menu=[dropdown(1), dropdown(2)])

# ---- group: Define Cross Sections
crosecrselect = CrossSectionRangeSelectorKaramba3D(MaximumHeight_cm=-1, MaximumWidth_cm=-1, menu=[dropdown(0), dropdown(1), dropdown(1)])
i_2 = Slider(0, range=0..10)
crosecselect = CrossSectionSelectorKaramba3D(CrossSections=crosecrselect, NameOrListIndexOfCrossSection=i_2, Material=matselect)  # -> CrossSection, Info

# ---- group: Define Loads
f = Slider(-7.3, range=-10..10)
Z = UnitZ(Factor=f)
beam_loads = BeamLoadsKaramba3D(BeamIdentifier="BeamA", LoadCase="LC0", ForceVector=Z, TStart=0, TEnd=1, mode="Block", menu=[buttons(off, on, off)])

# ---- group: Define Supports
hframe = HorizontalFrame(Curve=ln, Parameter=0)
supp = SupportKaramba3D(PosInd=[pt, pt_2], PlaneOfReference=hframe, menu=[buttons(on, on, on, on, off, off)])

# ---- group: Define Elements
lineelem = CreateLinearElementKaramba3D(
    Line=shatter,
    Colour=ColourSwatch(SwatchColor=RGB(0, 42, 255)),
    Identifier="BeamA",
    CrossSection=crosecselect.CrossSection,
    LimitDistance_m=0.005,
    BucklingLengthY_m=-1,
    BucklingLengthZ_m=-1,
    BucklingLengthLT_m=-1,
    Bending=True,
    ToPolylineMaxAngle=0.03,
    ToPolylineTolerance=0.01,
    ToPolylineMaxEdgeLength=0.25,
    New=True,
    Remove=True,
    mode="LineToBeam")  # -> Element, Points, Info

# ---- group: Assemble Model
assemble = AssembleModelKaramba3D(Elem=lineelem.Element, Support=supp, Load=beam_loads, LimitDistance_m=0.005)  # -> Model, Info, Mass_kg, CentreOfGravity, LoadCaseNames

# ---- group: Optimize Cross Sections
opticrosec = OptimizeCrossSectionKaramba3D(
    Model=assemble.Model,
    ElemIdentifiers="BeamA",
    CrossSections=crosecrselect,
    MaximumUtilization=1,
    MaximumVirtualWork_kNcm=0.01,
    NumberOfUtilizationIterations=5,
    NumberOfDisplacementIterations=5,
    NumberOfDisplacementIncrementsPerIteration=2,
    DisplacementTolerance=0.01,
    NumberOfSamplePoints=3,
    ElasticDesign=True,
    GammaM0=1,
    GammaM1=1.1,
    SwayFrame=True)  # -> OptimizedModel, Info, Mass_kg, MaximumDisplacement_cm, ElasticEnergyChange_kNm, MaximumUtilizationViewInsufficientCrossSections, MaximumDisplacementViewLimitCrossSections
panel = Panel(opticrosec.MaximumDisplacement_cm)

# ---- group: View Results
modelview = ModelViewKaramba3D(Model=opticrosec.OptimizedModel)  # -> Model, DeformedMesh, DeformedAxes, DeformedModel, MaximumDeformation
beamview = BeamViewKaramba3D(Model=modelview.Model)  # -> Model, MeshesOfRenderedBeams, DeformedBeamAxes, LegendColours, LegendTags
legend = Legend(Colour=beamview.LegendColours, Tags=beamview.LegendTags, LegendType=1)
