# Grasshopper definition 01_SpaceBall.gh (Grasshopper 1.0.7)
# plug-ins: Karamba3D

# ---- group: Geometry / Inside
geo = Geometry([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])

# ---- group: Geometry / Ropes
geo_2 = Geometry([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])

# ---- group: Geometry / Outer
geo_3 = Geometry([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])

# ---- group: Geometry
explode = Explode(Curve=geo_3, Recursive=True)  # -> Segments, flatten(Vertices)
debrep = DeconstructBrep(Brep=geo)  # -> Faces, Edges, Vertices
explode_2 = Explode(Curve=geo_2, Recursive=True)  # -> Segments, Vertices
# 01 - Space Ball
# Difficulty: Moderate | Version 3.1.4
# This signature children's playground equipment is comprised of a frame and a cablenet structure. Initial strain is defined in the net and the entire structure is analyzed in Second Order Theory.
# Move the position of the child to see how the structure deforms.
rdlines = RemoveDuplicateLinesKaramba3D(Line=flatten(debrep.Edges), LimitDistance=0.005)  # -> OutLine, Info, Indexes
rdlines_2 = RemoveDuplicateLinesKaramba3D(Line=flatten(explode_2.Segments), LimitDistance=0.005)  # -> OutLine, Info, Indexes
crv = Curve(flatten(explode.Segments))
curvepoint = PointOnCurve(crv, parameter=0.5)
pdecon = Deconstruct(Point=curvepoint)  # -> XComponent, YComponent, ZComponent
expression = Expression(x=pdecon.ZComponent, Expression="if(x ≤ 0.001, False, True)")
merge = Merge(Data1=rdlines.OutLine, Data2=rdlines_2.OutLine)  # -> flatten(Result)
cull = CullPattern(List=crv, CullPattern=expression)

# ---- group: Define Net-Cross Section
matselect = MaterialSelectionKaramba3D(menu=[dropdown(1), dropdown(1)])
crosec = CrossSectionKaramba3D(
    FamilyNameOfCrossSection="DefaultCroSec",
    Material=matselect,
    Diameter_cm="1.5",
    WallThickness_cm=0.4,
    mode="Circular Hollow")

# ---- group: Define Beam-Cross Section
matselect_2 = MaterialSelectionKaramba3D(menu=[dropdown(1), dropdown(1)])
crosec_2 = CrossSectionKaramba3D(
    FamilyNameOfCrossSection="DefaultCroSec",
    Material=matselect_2,
    Diameter_cm="8",
    WallThickness_cm=0.4,
    mode="Circular Hollow")

# ---- group: Define and Orientate the Net-Elements
rdlines_3 = RemoveDuplicateLinesKaramba3D(Line=merge, LimitDistance=0.005)  # -> OutLine, Info, Indexes
end = EndPoints(Curve=rdlines_3.OutLine)  # -> Start, End
lineelem = CreateLinearElementKaramba3D(
    Line=rdlines_3.OutLine,
    Identifier="net",
    LimitDistance_m=0.005,
    BucklingLengthY_m=-1,
    BucklingLengthZ_m=-1,
    BucklingLengthLT_m=-1,
    Bending=False,
    ToPolylineMaxAngle=0.03,
    ToPolylineTolerance=0.01,
    ToPolylineMaxEdgeLength=0.25,
    New=True,
    Remove=True,
    mode="LineToTruss")  # -> Element, Points, Info
vec2pt = Vector2Pt(PointA=end.Start, PointB=end.End, Unitize=Toggle(True))  # -> Vector, Length
orientate = OrientateElemKaramba3D(Beam=lineelem.Element, XOrientation=vec2pt.Vector, mode="Beam")
modifyelem = ModifyElementKaramba3D(Beam=orientate, CrossSection=crosec, NII_kN="1", mode="Beam")

# ---- group: Define Loads
eps0 = Slider(0.4, range=0..3)
rdpoints = RemoveDuplicatePointsKaramba3D(Point=lineelem.Points, LimitDistance=0.005)  # -> OutPoint, Info, Indexes
crv_2 = Curve(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)
position_monkey = Slider(0.425, range=0..1)
loads = LoadsKaramba3D(Vector="{0,0,-1}", LCase="gravity", mode="Gravity")
eval = EvaluateCurve(Curve=reparameterize(crv_2), Parameter=position_monkey)  # -> Point, Tangent, Angle
neg = Negative(Value=eps0)
X = UnitX(Factor=neg)
dist = Distance(PointA=rdpoints.OutPoint, PointB=eval.Point)
srf = Surface(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)
loads_2 = LoadsKaramba3D(Eps0=X, ElementIdentifiers="net", LCase="cable", mode="InitialStrain")
expression_2 = Expression(x=dist, Expression="if(x ≤ 0.3, False, True)")
orient = Orient(Geometry=srf, Source=PlaneXY(0, 0, 0), Target=eval.Point)  # -> Geometry, Transform
preview = CustomPreview(Geometry=[orient.Geometry, crv_2], Material=ColourSwatch(SwatchColor=RGBA(186, 186, 186, 120)))
cull_2 = CullPattern(List=rdpoints.OutPoint, CullPattern=invert(expression_2))
panel = Panel("""LC0 = gravity + cable 
LC1 = gravity + cable + live""")
weight_of_child_kg = Panel("20")
lng = ListLength(List=cull_2)
division = Division(A=weight_of_child_kg, B=lng)
Z = UnitZ(Factor=expr("-x/100", division))
loads_3 = LoadsKaramba3D(ForceVector=Z, Local=False, PosInd=cull_2, LCase="live", mode="Point")
lccombinator = LoadCaseCombinatorKaramba3D(LoadCaseCombinationRulesKaramba3D=panel)  # -> LoadCaseCombinations, NamesOfLoadCases, NumberOfLoadCases
merge_2 = Merge(Data1=loads, Data2=loads_2, Data3=loads_3, Data4=lccombinator.LoadCaseCombinations)  # -> flatten(Result)
load = LoadKaramba3D(merge_2)

# ---- group: Define Outer Beam-Elements
crv_3 = Curve(cull)
rdlines_4 = RemoveDuplicateLinesKaramba3D(Line=crv_3, LimitDistance=0.005)  # -> OutLine, Info, Indexes
lineelem_2 = CreateLinearElementKaramba3D(
    Line=rdlines_4.OutLine,
    Identifier="beam",
    CrossSection=crosec_2,
    LimitDistance_m=0.005,
    BucklingLengthY_m=-1,
    BucklingLengthZ_m=-1,
    BucklingLengthLT_m=-1,
    Bending=True,
    ToPolylineMaxAngle=0.03,
    ToPolylineTolerance=0.01,
    ToPolylineMaxEdgeLength=0.25,
    New=True,
    Remove=True,
    mode="LineToBeam")  # -> Element, Points, Info

# ---- group: Define Supports
cluster = Cluster(point=lineelem_2.Points)
supp = SupportKaramba3D(PosInd=cluster, menu=[buttons(on, on, on, off, off, off)])

# ----
element = ElementKaramba3D([lineelem_2.Element, modifyelem])

# ---- group: Assamble Model
assemble = AssembleModelKaramba3D(Elem=flatten(element), Support=flatten(supp), Load=flatten(load), LimitDistance_m=0.005)  # -> Model, Info, Mass_kg, CentreOfGravity, LoadCaseNames

# ---- group: Analyze Model
panel_2 = Panel("""LC0
LC1""")
analysethii = AnalyseThIIKaramba3D(
    Model=assemble.Model,
    LoadCases=panel_2,
    UseInitialNII=True,
    NIIFromCombination=True,
    NoTensionalNII=False,
    RTolerance=1e-07,
    MaxIterations=50)  # -> AnalysedModel, MaximumDisplacement_cm, ResultingForce_kN, ChangeOfElasticEnergy_kNm
panel_3 = Panel(analysethii.ResultingForce_kN)
panel_4 = Panel(analysethii.ChangeOfElasticEnergy_kNm)
panel_5 = Panel(analysethii.MaximumDisplacement_cm)

# ---- group: View Beam Results
modelview = ModelViewKaramba3D(Model=analysethii.AnalysedModel)  # -> Model, DeformedMesh, DeformedAxes, DeformedModel, MaximumDeformation
beamview = BeamViewKaramba3D(Model=modelview.Model)  # -> Model, MeshesOfRenderedBeams, DeformedBeamAxes, LegendColours, LegendTags
legend = Legend(Colour=beamview.LegendColours, Tags=beamview.LegendTags, LegendType=1)

# ==== cluster Cluster
point = ClusterInput()
point_2 = Point(point)
deconstruct = Deconstruct(Point=point_2)  # -> XComponent, YComponent, ZComponent
expression = Expression(x=deconstruct.ZComponent, Expression="if(x=0, true, false)")
cull_pattern = CullPattern(List=point_2, CullPattern=expression)
point_3 = Point(cull_pattern)
point_4 = ClusterOutput(point_3)
