# Grasshopper definition 01_TruckOnABridge.gh (Grasshopper 1.0.7)
# Copyright: Karamba3D
# Copyright: B+G Engineers
# plug-ins: Karamba3D

# ---- group: Create Geometry
beam_spacing = Slider(1.8, range=0..10)
bridge_width = Slider(14, range=8..20)
panel = Panel("""-0.5
0.0
0.5""")
pt = Point([Point(10, 15, 0), Point(45, 15, 0), Point(95, 15, 0), Point(140, 15, 0)])
pline = PolyLine(Vertices=pt, Closed=False)
multiplication = Multiplication(A=panel, B=bridge_width)
# 01 - Truck on a Bridge
# Difficulty: Moderate | Version 3.1.4
# A truck moves over a simple bridge. It is simulated using mesh loads. Beam IDs are set to define several cross section sizes. Various Load Cases act on the model including gravity, point loads of the trucks and wind loads.
# See the vibrations of the structure by enabling the Natural Vibrations component. See the eigenmodes of the structure by enabling the Eingenmodes component.
offset_l = OffsetLoose(Curve=pline, Distance=multiplication)
explode = Explode(Curve=offset_l, Recursive=True)  # -> Segments, Vertices
flip = FlipMatrix(Data=explode.Segments)
len = Length(Curve=flip)
cluster = Cluster_4(D=explode.Vertices)  # -> i, item_2_2, L_2, L
division = Division(A=len, B=beam_spacing)
avr = Average(Input=division)
aligndim = AlignedDimension(
    Plane=PlaneXY(0, 0, 0),
    PointA=[cluster.i, cluster.L],
    PointB=[cluster.item_2_2, cluster.L_2],
    Offset=-5,
    Text="{0:0.00}",
    Size=1)
divide = DivideCurve(Curve=flip, Count=avr, Kinks=False)  # -> simplify(Points), Tangents, Parameters
path_mapper = PathMapper(divide.Points, source="{A;B}", target="{B}")
dcon = DeleteConsecutive(Set=path_mapper, Wrap=False)  # -> Set, Count
flip_2 = FlipMatrix(Data=dcon.Set)
pline_2 = PolyLine(Vertices=dcon.Set, Closed=False)
pline_3 = PolyLine(Vertices=flip_2, Closed=False)
explode_2 = Explode(Curve=pline_2, Recursive=True)  # -> Segments, Vertices
explode_3 = Explode(Curve=pline_3, Recursive=True)  # -> Segments, Vertices
entwine = Entwine(Branch00=explode_2.Segments, Branch01=explode_3.Segments, FlattenInputs=True)
preview = CustomPreview(Geometry=[pline_2, pline_3], Shader=ColourSwatch(SwatchColor=RGB(120, 120, 120)))

# ---- group: Define Materials
matselect = MaterialSelectionKaramba3D(menu=[dropdown(1), dropdown(2)])

# ---- group: Define Cross Sections
crosecrselect = CrossSectionRangeSelectorKaramba3D(MaximumHeight_cm=-1, MaximumWidth_cm=-1, menu=[dropdown(1), dropdown(1), dropdown(3)])
lng = ListLength(List=crosecrselect)  # -> expr("x-1", Length)
multiplication_2 = Multiplication(A=[Slider(0.84, range=0..1), Slider(0.46, range=0..1)], B=lng)
ids = Panel("""Main
Sec""")
crosecselect = CrossSectionSelectorKaramba3D(
    CrossSections=crosecrselect,
    NameOrListIndexOfCrossSection=graft(multiplication_2),
    ElementsIdentifiers=graft(ids),
    Material=matselect)  # -> CrossSection, Info

# ---- group: Define Supports
number_slider = Slider(1, range=0..3)
pt_2 = Point(explode.Vertices)
cull_i = CullIndex(List=pt_2, Indices=number_slider, Wrap=True)  # -> flatten(List)
item = ListItem(List=pt_2, Index=number_slider, Wrap=True)  # -> flatten(Item)
supp = SupportKaramba3D(PosInd=item, menu=[buttons(on, on, on, off, off, on)])
supp_2 = SupportKaramba3D(PosInd=cull_i, menu=[buttons(off, on, on, off, off, off)])
support = SupportKaramba([supp, supp_2])

# ---- group: Define Elements
ids_2 = Panel("""Main
Sec""")
lineelem = CreateLinearElementKaramba3D(
    Line=entwine,
    Identifier=graft(ids_2),
    CrossSection=crosecselect.CrossSection,
    LimitDistance_m=0.005,
    BucklingLengthY_m=-1,
    BucklingLengthZ_m=-1,
    BucklingLengthLT_m=-1,
    Bending=True,
    ToPolylineMaxAngle=0.03,
    ToPolylineTolerance=0.01,
    ToPolylineMaxEdgeLength=0.25,
    New=True,
    Remove=True,
    mode="LineToBeam")  # -> Element, Points, Info

# ---- group: Define Loads
length_of_truck = Slider(6, range=3..10)
loas_cases = Slider(26, range=2..30)
list = ValueList({"left side": 0, "right side": 2}, selected="right side")
cluster_2 = Cluster(D=dcon.Set, B=beam_spacing, I=list, N=loas_cases, A=length_of_truck)  # -> M, F
lng_2 = ListLength(List=cluster_2.M)
load_of_truck = Panel("-100")
series = Series(Start=0, Step=1, Count=lng_2)
ids_3 = Panel("Sec")
Z = UnitZ(Factor=load_of_truck)
loads = LoadsKaramba3D(Vector=Vector(0, 0, -1), LCase="LC-1", mode="Gravity")

# ----
concat = Concatenate(FragmentA="LC", FragmentB=series)

# ---- group: Define Loads (continued)
loads_2 = LoadsKaramba3D(
    Vector=Z,
    Mesh=cluster_2.M,
    ElementIdentifiers=ids_3,
    LCase=concat,
    mode="MeshLoad -Const.",
    menu=[buttons(off, off, on), buttons(on, off)])
load = LoadKaramba(flatten([loads, loads_2]))

# ---- group: Assemble Model
assemble = AssembleModelKaramba3D(Elem=flatten(lineelem.Element), Support=flatten(support), Load=flatten(load), LimitDistance_m=0.005)  # -> Model, Info, Mass_kg, CentreOfGravity, LoadCaseNames

# ---- group: Analyse Model
analyse = AnalyseKaramba3D(Model=assemble.Model)  # -> AnalysedModel, MaximumDisplacement_cm, ResultingForce_kN, ChangeOfElasticEnergy_kNm
panel_2 = Panel(analyse.MaximumDisplacement_cm)

# ---- group: View Eigenmodes
emodes = EigenModesKaramba3D(
    Model=assemble.Model,
    FromIndex=1,
    NumberOfModes="11",
    WithThIIEffects=True,
    MaximumNumberOfIterations=300,
    Epsilon=1e-07)  # -> ModelWithEigenModes, Eigenvalues
panel_3 = Panel(emodes.Eigenvalues)

# ---- group: Calculate Natual Vibrations
nvibes = NaturalVibrationsKaramba3D(Model=assemble.Model, FromIndex=1, NumberOfModes="4", WithThIIEffects=True, MaximumNumberOfIterations=30, Epsilon=1e-05)  # -> ModelWithVibrationModes, NaturalFrequencies_Hz, ModalMass_kg, ParticipationFactorInGlobalXYAndZDirection
panel_4 = Panel(nvibes.NaturalFrequencies_Hz)

# ---- group: View Results
number_of_mode = Slider(3, range=0..10)
modelview = ModelViewKaramba3D(Model=emodes.ModelWithEigenModes, LoadCase=number_of_mode)  # -> Model, DeformedMesh, DeformedAxes, DeformedModel, MaximumDeformation
beamview = BeamViewKaramba3D(Model=modelview.Model)  # -> Model, MeshesOfRenderedBeams, DeformedBeamAxes, LegendColours, LegendTags

number_of_mode_2 = Slider(0, range=0..3)
modelview_2 = ModelViewKaramba3D(Model=nvibes.ModelWithVibrationModes, LoadCase=number_of_mode_2)  # -> Model, DeformedMesh, DeformedAxes, DeformedModel, MaximumDeformation
beamview_2 = BeamViewKaramba3D(Model=modelview_2.Model)  # -> Model, MeshesOfRenderedBeams, DeformedBeamAxes, LegendColours, LegendTags

select_loadcase = Slider(0.992, range=0..1)
cluster_3 = Cluster_2(L=concat, y=select_loadcase)  # -> R, i
modelview_3 = ModelViewKaramba3D(Model=analyse.AnalysedModel, LoadCase=cluster_3.i)  # -> Model, DeformedMesh, DeformedAxes, DeformedModel, MaximumDeformation

# ----
panel_5 = Panel(cluster_3.i)
beamview_3 = BeamViewKaramba3D(Model=modelview_3.Model)  # -> Model, MeshesOfRenderedBeams, DeformedBeamAxes, LegendColours, LegendTags

# ---- group: View Results (continued)
legend = Legend(Colour=beamview_3.LegendColours, Tags=beamview_3.LegendTags, LegendType=1)

# ---- group: View Truck
cluster_4 = Cluster_3(model=beamview_3.Model, num=cluster_3.R, num_2="6", pln=cluster_2.F, F=length_of_truck)
preview_2 = CustomPreview(Geometry=cluster_4, Shader=ColourSwatch(SwatchColor=RGBA(56, 56, 56, 153)))

# ==== cluster Cluster
D = ClusterInput()
B = ClusterInput()
I = ClusterInput()
N = ClusterInput()
A = ClusterInput()
path = ConstructPath(Indices=I)
split = SplitTree(Data=simplify(D), Masks=flatten(path))  # -> Positive, Negative
range = Range(Domain=Domain(0, 1), Steps=N)
division = Division(A=A, B=B)
lng = ListLength(List=split.Negative)
expression = Expression(x=lng, y=range, z=division, Expression="min((x-1)*y+z/2,x-1)")
expression_2 = Expression(x=lng, y=range, z=division, Expression="max((x-1)*y-z/2,0)")
item = ListItem(List=split.Negative, Index=expression_2, Wrap=True)
item_2 = ListItem(List=split.Negative, Index=expression, Wrap=False)
bang = ExplodeTree(Data=item)  # -> Branch0, Branch1
bang_2 = ExplodeTree(Data=item_2)  # -> Branch0, Branch1
srf4pt = _4PointSurface(CornerA=bang.Branch0, CornerB=bang.Branch1, CornerC=bang_2.Branch1, CornerD=bang_2.Branch0)  # -> reparameterize(graft(Surface))
panel = Panel(""""0 to "&0.5/x/0.8
1-0.5/0.8/x&" to 1"
""")
area = Area(Geometry=srf4pt)  # -> Area, Centroid
evalsrf = EvaluateSurface(Surface=reparameterize(srf4pt), Point="0.5,0.5,0")  # -> Point, Normal, UDirection, VDirection, flatten(Frame)
eval = Evaluate(F=panel, x=area.Area)
dom² = ConstructDomain²(DomainU="0.1 to 0.9", DomainV=eval)
subsrf = Isotrim(Surface=srf4pt, Domain=dom²)
mesh = MeshBrep(
    Brep=subsrf,
    Settings={GridMaxCount=0, GridMinCount=60, JaggedSeams=False, MaxEdgeLength=0, MinEdgeLength=0.0001, MinTolerance=0, Refine=False, RefineAngle=0, RelativeTolerance=0, SimplePlanes=False, Tolerance=0})
mjoin = MeshJoin(Meshes=mesh)  # -> flatten(Mesh)
M = ClusterOutput(mjoin)
F = ClusterOutput(evalsrf.Frame)

# ==== cluster Cluster_2
L = ClusterInput()
y = ClusterInput()
lng = ListLength(List=L)
expression = Expression(x=lng, y=y, Expression="(x-1)*y")
item = ListItem(List=L, Index=expression, Wrap=True)
R = ClusterOutput(expression)
i = ClusterOutput(item)

# ==== cluster Cluster_3
mesh = Mesh(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)
model = ClusterInput()
num = ClusterInput()
num_2 = ClusterInput()
pln = ClusterInput()
F = ClusterInput()
nodedisp = NodalDisplacementsKaramba3D(AnalysedModel=model)  # -> Model, flatten(NodalTranslations_m), flatten(NodalRotations_rad), LoadCaseIndex
disassemble = DisassembleModelKaramba3D(Model=model)  # -> Model, Point, Beam, Shell, Support, Load, Line, Mesh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
scale = Scale(Geometry=mesh, Center=Point(0, 0, 0), Factor=expr("x/3.8", F))  # -> Geometry, Transform
num_3 = Number(num_2)
pln_2 = Plane(pln)
num_4 = Number(num)
item = ListItem(List=pln_2, Index=num_4, Wrap=True)
cps = ClosestPoints(Point=item, Cloud=disassemble.Point, Count="4")  # -> ClosestPoint, CPIndex, Distance
item_2 = ListItem(List=nodedisp.NodalRotations_rad, Index=cps.CPIndex, Wrap=True)
item_3 = ListItem(List=nodedisp.NodalTranslations_m, Index=cps.CPIndex, Wrap=True)
multiplication = Multiplication(A=item_3, B=num_3)
multiplication_2 = Multiplication(A=item_2, B=num_3)
avr = Average(Input=multiplication)
avr_2 = Average(Input=multiplication_2)
move = Move(Geometry=item, Motion=avr)  # -> Geometry, Transform
devec = DeconstructVector(Vector=avr_2)  # -> XComponent, expr("-x", YComponent), ZComponent
move_2 = Move(Geometry=item, Motion=avr)  # -> Geometry, Transform
deplane = DeconstructPlane(Plane=move_2.Geometry)  # -> Origin, XAxis, YAxis, ZAxis
pt = Point(move_2.Geometry)
rot3d = Rotate3D(Geometry=move_2.Geometry, Angle=devec.XComponent, Center=pt, Axis=deplane.YAxis)  # -> Geometry, Transform
rot3d_2 = Rotate3D(Geometry=rot3d.Geometry, Angle=devec.YComponent, Center=pt, Axis=deplane.XAxis)  # -> Geometry, Transform
rot3d_3 = Rotate3D(Geometry=rot3d_2.Geometry, Angle=devec.ZComponent, Center=pt, Axis=deplane.ZAxis)  # -> Geometry, Transform
orient = Orient(Geometry=scale.Geometry, Source=PlaneXY(0, 0, 0), Target=rot3d_3.Geometry)  # -> Geometry, Transform
G = ClusterOutput(orient.Geometry)

# ==== cluster Cluster_4
D = ClusterInput()
flip = FlipMatrix(Data=D)
item = ListItem(List=flatten(flip), Index=0, Wrap=True)  # -> Item, Item1, Item2
item_2 = ListItem(List=flip, Index=0, Wrap=True)  # -> flatten(Item)
i = ClusterOutput(item.Item)
item_2_2 = ClusterOutput(item.Item2)
cull_i = CullIndex(List=reverse(item_2), Indices=0, Wrap=True)  # -> reverse(List)
cull_i_2 = CullIndex(List=item_2, Indices=0, Wrap=True)
L = ClusterOutput(cull_i_2)
L_2 = ClusterOutput(cull_i)
