# Grasshopper definition 01_Zollamtssteg.gh (Grasshopper 1.0.7)
# plug-ins: Karamba3D

# ---- group: Define Cross Sections
multiplication = Multiplication(A="2", B="0.5")
Z = UnitZ(Factor="-15")
crosec = CrossSectionKaramba3D(
    FamilyNameOfCrossSection="DefaultCroSec",
    NameOfCrossSection="Horizontal",
    ElementIdentifier="Horizontal",
    Material=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,
    Height_cm="21",
    UpperFlangeWidth_cm="13.5",
    LowerFlangeWidth_cm="13.5",
    UpperFlangeThickness_cm="0.5",
    LowerFlangeThickness_cm="0.5",
    WebThickness_cm="0.2",
    FilletRadius_cm=0,
    mode="I")
crosec_2 = CrossSectionKaramba3D(
    FamilyNameOfCrossSection="DefaultCroSec",
    NameOfCrossSection="Arch",
    ElementIdentifier="Arch",
    Material=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,
    Height_cm="43",
    UpperFlangeWidth_cm="45",
    LowerFlangeWidth_cm="45-21",
    UpperFlangeThickness_cm="4",
    LowerFlangeThickness_cm="4",
    WebThickness_cm="4",
    FilletRadius_cm=0,
    mode="I")
crosec_3 = CrossSectionKaramba3D(
    FamilyNameOfCrossSection="DefaultCroSec",
    NameOfCrossSection="Hange",
    ElementIdentifier="Hange",
    Material=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,
    Height_cm="21",
    UpperFlangeWidth_cm="13.5",
    LowerFlangeWidth_cm="13.5",
    UpperFlangeThickness_cm="0.5",
    LowerFlangeThickness_cm="0.5",
    WebThickness_cm="0.2",
    FilletRadius_cm=0,
    mode="I")
crosec_4 = CrossSectionKaramba3D(
    FamilyNameOfCrossSection="DefaultCroSec",
    NameOfCrossSection="CrossGird",
    ElementIdentifier="CrossGird",
    Material=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,
    LocalEccentricity_cm=Z,
    Height_cm="30",
    UpperFlangeWidth_cm="13.5",
    LowerFlangeWidth_cm="13.5",
    UpperFlangeThickness_cm="0.5",
    LowerFlangeThickness_cm="0.5",
    WebThickness_cm="0.2",
    FilletRadius_cm=0,
    mode="I")
crosec_5 = CrossSectionKaramba3D(
    FamilyNameOfCrossSection="DefaultCroSec",
    NameOfCrossSection="Diagonal",
    ElementIdentifier="Diagonal",
    Material=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,
    Diameter_cm="2",
    WallThickness_cm=multiplication,
    mode="Circular Hollow")
merge = Merge(Data1=crosec, Data2=crosec_2, Data3=crosec_3, Data4=crosec_4, Data5=crosec_5)  # -> graft(Result)

# ---- group: Create a Beam and Analyze to determine the arch geometry
bridge_length_m = Slider(30, range=20..40)
panel = Panel("7.5")
addition = Addition(A="5", B=panel)
pt = ConstructPoint(XCoordinate=0, YCoordinate=["5", addition], ZCoordinate=0)
pt_2 = ConstructPoint(XCoordinate=bridge_length_m, YCoordinate=["5", addition], ZCoordinate=0)
Z_2 = UnitZ(Factor=Slider(1, range=1..10))
# 01 - Zollamtssteg
# Difficulty: Simple | Version: 3.1.4
# The Zollamtssteg is a steel arch bridge and was built in 1900. The arch is connected to the plattform with steel elements. These elements take tension and compression forces depending on their position within the bridge.
# There is one bracing between the two arches on each side of the bridge; Structural Engineer: Martin Paul, Architects: Josef Hackhofer, Friedrich Ohmann
ln = Line(StartPoint=pt, EndPoint=pt_2)
neg = Negative(Value=Z_2)
supp = SupportKaramba3D(PosInd=pt, menu=[buttons(off, on, on, off, off, off)])
supp_2 = SupportKaramba3D(PosInd=pt_2, menu=[buttons(on, on, on, on, off, off)])
loads = LoadsKaramba3D(Vector=neg, LCase="LC0", mode="Gravity")
support = SupportKaramba3D(flatten([supp, supp_2]))
crv = Curve(ln)

# ----
lineelem = CreateLinearElementKaramba3D(
    Line=ln,
    LimitDistance_m=0.005,
    BucklingLengthY_m=-1,
    BucklingLengthZ_m=-1,
    BucklingLengthLT_m=-1,
    Bending=True,
    ToPolylineMaxAngle=0.03,
    ToPolylineTolerance=0.01,
    ToPolylineMaxEdgeLength=0.25,
    New=True,
    Remove=True,
    mode="LineToBeam")  # -> Element, Points, Info

# ---- group: Create a Beam and Analyze to determine the arch geometry (continued)
assemble = AssembleModelKaramba3D(Elem=lineelem.Element, Support=support, Load=loads, LimitDistance_m=0.005)  # -> Model, Info, Mass_kg, CentreOfGravity, LoadCaseNames
panel_2 = Panel(assemble.Mass_kg)
analyse = AnalyseKaramba3D(Model=assemble.Model)  # -> AnalysedModel, MaximumDisplacement_cm, ResultingForce_kN, ChangeOfElasticEnergy_kNm
panel_3 = Panel(analyse.MaximumDisplacement_cm)
modelview = ModelViewKaramba3D(Model=analyse.AnalysedModel)  # -> Model, DeformedMesh, DeformedAxes, DeformedModel, MaximumDeformation
crv_2 = Curve(modelview.DeformedAxes)
rotax = RotateAxis(Geometry=crv_2, Angle="pi", Axis=crv)  # -> Geometry, Transform

# ---- group: Create Bridge based on analyzed Arch Model
bbox = BoundingBox(Content=rotax.Geometry, Plane=PlaneXY(0, 0, 0))  # -> Box, Box_2
debox = DeconstructBox(Box=bbox.Box)  # -> Plane, X, Y, Z
dedomain = DeconstructDomain(Domain=debox.Z)  # -> Start, End
relative_position_of_arch_to_bridge_deck = Slider(-5, range=-10..10)  # "Relative position of arch to bridge deck (m)"
subtraction = Subtraction(A=dedomain.End, B=dedomain.Start)
division = Division(A=Slider(11, range=6..12), B=subtraction)
scale_nu = ScaleNU(Geometry=rotax.Geometry, Plane=PlaneXY(0, 0, 0), ScaleX=1, ScaleY=1, ScaleZ=division)  # -> Geometry, Transform
Z_3 = UnitZ(Factor=relative_position_of_arch_to_bridge_deck)
move = Move(Geometry=scale_nu.Geometry, Motion=Z_3)  # -> Geometry, Transform
crv_3 = Curve(crv)
ccx = CurveCurve(CurveA=crv_3, CurveB=move.Geometry)  # -> Points, ParamsA, ParamsB
lng = ListLength(List=ccx.ParamsB)
shatter = Shatter(Curve=crv_3, Parameters=ccx.ParamsA)  # -> graft(Segments)
shatter_2 = Shatter(Curve=move.Geometry, Parameters=ccx.ParamsB)  # -> graft(Segments)
cull = CullPattern(List=move.Geometry, CullPattern=invert(lng))
cull_2 = CullPattern(List=crv_3, CullPattern=invert(lng))
merge_2 = Merge(Data1=shatter, Data2=cull_2)
merge_3 = Merge(Data1=shatter_2, Data2=cull)
clean = CleanTree(RemoveNulls=True, RemoveInvalid=True, RemoveEmpty=True, Tree=merge_2)
clean_2 = CleanTree(RemoveNulls=True, RemoveInvalid=True, RemoveEmpty=True, Tree=merge_3)
crv_4 = Curve(simplify(graft(clean)))
crv_5 = Curve(simplify(graft(clean_2)))
len = Length(Curve=crv_4)
division_2 = Division(A=len, B=Slider(1, range=1..2.5))
divide = DivideCurve(Curve=crv_4, Count=division_2, Kinks=False)  # -> Points, Tangents, Parameters
line = LineSDL(Start=divide.Points, Direction=Vector(0, 0, 1), Length=1)
clx = CurveLine(Curve=crv_5, Line=line)  # -> Points, Params, Count
trim = TrimTree(Tree=clx.Points, Depth=1)
bang = ExplodeTree(Data=divide.Points)  # -> _0000, _0010, _0020, _0100, _0110, _0120, _1000, _1010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
pline = PolyLine(Vertices=divide.Points, Closed=False)
pline_2 = PolyLine(Vertices=trim, Closed=False)
explode = Explode(Curve=pline, Recursive=True)  # -> Segments, Vertices
explode_2 = Explode(Curve=pline_2, Recursive=True)  # -> Segments, Vertices
ln_2 = Line(StartPoint=divide.Points, EndPoint=trim)
ln_3 = Line(StartPoint=bang._0010, EndPoint=bang._0110)
bang_2 = ExplodeTree(Data=trim)  # -> _0000, _0010, _0020, _0100, _0110, _0120, _1000, _1010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
pt_3 = Point(bang_2._0100)
pt_4 = Point(bang_2._0120)
pt_5 = Point(bang_2._0000)
pt_6 = Point(bang_2._0020)
entwine = Entwine(Branch00=pt_5, Branch01=pt_6, Branch02=pt_3, Branch03=pt_4, FlattenInputs=True)
panel_4 = Panel("""0
3""")
item = ListItem(List=entwine, Index=panel_4, Wrap=True)
bang_3 = ExplodeTree(Data=item)  # -> Branch0, Branch1, Branch2, Branch3
ln_4 = Line(StartPoint=bang_3.Branch0, EndPoint=reverse(bang_3.Branch2))
ln_5 = Line(StartPoint=bang_3.Branch1, EndPoint=reverse(bang_3.Branch3))
line_2 = Line([ln_4, ln_5])
entwine_2 = Entwine(
    Branch00=explode.Segments,
    Branch01=explode_2.Segments,
    Branch02=ln_2,
    Branch03=ln_3,
    Branch04=line_2,
    FlattenInputs=True)
line_3 = Line(entwine_2)

# ---- group: Define Elements
line_4 = Line(line_3)
panel_5 = Panel("""Horizontal
Arch
Hanger
CrossGirder
Diagonal""")
lineelem_2 = CreateLinearElementKaramba3D(
    Line=line_4,
    Identifier=graft(panel_5),
    CrossSection=merge,
    LimitDistance_m=0.005,
    BucklingLengthY_m=-1,
    BucklingLengthZ_m=-1,
    BucklingLengthLT_m=-1,
    Bending=True,
    ToPolylineMaxAngle=0.03,
    ToPolylineTolerance=0.01,
    ToPolylineMaxEdgeLength=0.25,
    New=True,
    Remove=True,
    mode="LineToBeam")  # -> Element, Points, Info
modifyelem = ModifyElementKaramba3D(BeamIdentifierIndex="Diagonal", Bending="false", mode="Beam")
Y = UnitY(Factor=1)
orientate = OrientateElemKaramba3D(BeamIdentifier="Hanger", ZOrientation=Y, mode="Beam")
element = ElementKaramba3D([orientate, lineelem_2.Element, modifyelem])

# ---- group: Define Loads
num = Number(panel)
multiplication_2 = Multiplication(A=num, B="3")
neg_2 = Negative(Value=multiplication_2)
Z_4 = UnitZ(Factor=neg_2)
loads_2 = LoadsKaramba3D(Vector=Vector(0, 0, -1), LCase="gravity", mode="Gravity")
beam_loads = BeamLoadsKaramba3D(
    BeamIdentifier="Horizontal",
    LoadCase="superimposed",
    ForceVector=Z_4,
    TStart=0,
    TEnd=1,
    mode="Block",
    menu=[buttons(on, off, off)])
lccombinator = LoadCaseCombinatorKaramba3D(LoadCaseCombinationRulesKaramba3D="LC0 = gravity + superimposed*1.4")  # -> LoadCaseCombinations, NamesOfLoadCases, NumberOfLoadCases
load = LoadKaramba3D([beam_loads, loads_2, lccombinator.LoadCaseCombinations])

# ---- group: Define Supports
end = EndPoints(Curve=crv_3)  # -> Start, End
end_2 = EndPoints(Curve=move.Geometry)  # -> Start, End
supp_3 = SupportKaramba3D(PosInd=[end.End, end.Start], menu=[buttons(off, on, off, off, off, off)])
supp_4 = SupportKaramba3D(PosInd=[end_2.Start, end_2.End], menu=[buttons(on, on, on, on, off, off)])
support_2 = SupportKaramba3D([supp_3, supp_4])

# ---- group: Assemble Model
assemble_2 = AssembleModelKaramba3D(Elem=flatten(element), Support=flatten(support_2), Load=flatten(load), LimitDistance_m=0.005)  # -> Model, Info, Mass_kg, CentreOfGravity, LoadCaseNames
panel_6 = Panel(assemble_2.Mass_kg)

# ---- group: Analyze Model
analysethii = AnalyseThIIKaramba3D(
    Model=assemble_2.Model,
    LoadCases=assemble_2.LoadCaseNames,
    UseInitialNII=True,
    NIIFromCombination=True,
    NoTensionalNII=False,
    RTolerance=1e-07,
    MaxIterations=50)  # -> AnalysedModel, MaximumDisplacement_cm, ResultingForce_kN, ChangeOfElasticEnergy_kNm
analyse_2 = AnalyseKaramba3D(Model=assemble_2.Model, LoadCases=assemble_2.LoadCaseNames)  # -> AnalysedModel, MaximumDisplacement_cm, ResultingForce_kN, ChangeOfElasticEnergy_kNm
bmodes_karamba3d = BucklingModesKaramba3D(Model=analysethii.AnalysedModel, FromIndex=1, NumberOfModes=1, MaximumNumberOfIterations=300, Epsilon=1e-07)  # -> ModelWithBucklingModes, BucklingLoadFactors
panel_7 = Panel(analyse_2.MaximumDisplacement_cm)
panel_8 = Panel(bmodes_karamba3d.BucklingLoadFactors)

# ---- group: View Results
modelview_2 = ModelViewKaramba3D(Model=analyse_2.AnalysedModel)  # -> Model, DeformedMesh, DeformedAxes, DeformedModel, MaximumDeformation
beamview = BeamViewKaramba3D(Model=modelview_2.Model)  # -> Model, MeshesOfRenderedBeams, DeformedBeamAxes, LegendColours, LegendTags
legend = Legend(Colour=beamview.LegendColours, Tags=beamview.LegendTags, LegendType=1)
