# Grasshopper definition 02_3dObjectsToShell.gh (Grasshopper 1.0.7)
# plug-ins: Karamba3D

# ---- group: Input Geometry
internalized_brep = Brep([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])

# ---- group: Generate Geometry
internalized_srf = Surface(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)
mesh_breps = MeshBrepsKaramba3D(
    Brep=internalized_srf,
    MeshResolution=1,
    EdgeRefinementFactor=0.67,
    PointReduction=False,
    SmoothingStepSize=0,
    SmoothingIterations=5)  # -> Mesh, Info

internalized_brep_2 = Brep([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])
# 02 - 3D Objects to Karamba
# Difficulty: Moderate | Version 3.1.4
# Input any surface into Karamba3D and perform a cross section optimisation
crossref = CrossReference(ListA=internalized_brep_2, ListB=internalized_brep_2, CrossMode=7)  # -> ListA, ListB
number_slider = Slider(2, range=0..10)
bbx = BrepBrep(BrepA=crossref.ListA, BrepB=crossref.ListB)  # -> Curves, Points
len = Length(Curve=bbx.Curves)
division = Division(A=len, B=number_slider)
divide = DivideCurve(Curve=bbx.Curves, Count=division, Kinks=False)  # -> Points, Tangents, Parameters
mesh_breps_2 = MeshBrepsKaramba3D(
    Brep=internalized_brep_2,
    InclusionPoints=flatten(divide.Points),
    MeshResolution=number_slider,
    EdgeRefinementFactor=0.67,
    PointReduction=False,
    SmoothingStepSize=0,
    SmoothingIterations=5)  # -> Mesh, Info

internalized_brep_3 = Brep(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)
mesh_breps_3 = MeshBrepsKaramba3D(
    Brep=internalized_brep_3,
    MeshResolution=Slider(6, range=0..10),
    EdgeRefinementFactor=0.67,
    PointReduction=False,
    SmoothingStepSize=0,
    SmoothingIterations=5)  # -> Mesh, Info

# ---- group: Define Cross Sections
dom = ConstructDomain(DomainStart=Slider(1, range=0..100), DomainEnd=Slider(71, range=0..900))
range = Range(Domain=dom, Steps=Slider(200, range=0..200))
crosec = CrossSectionKaramba3D(FamilyNameOfCrossSection="DefaultCroSec", Height_cm=range, mode="Shell - Const")
item = ListItem(List=crosec, Index=0, Wrap=True)

# ----
neg = Negative(Value=Slider(9, range=0..10))
Z = UnitZ(Factor=neg)
loads = LoadsKaramba3D(Vector=Z, Mesh=mesh_breps.Mesh, LCase="LC0", mode="MeshLoad -Const.", menu=[buttons(off, on, off), buttons(on, on)])
loads_2 = LoadsKaramba3D(Vector=Vector(0, 0, -1), LCase="LC0", mode="Gravity")
load = LoadKaramba3D(flatten([loads_2, loads]))

# ---- group: Define Elements
surfelem = CreateSurfaceElementKaramba3D(Mesh=flatten(mesh_breps_2.Mesh), CrossSection=item, LimitDistance_m=0.005, Bending=True, mode="MeshToShell")  # -> Element, Points, Info

# ----
pt = Point(flatten(surfelem.Points))
brepsinc = PointInBreps(Brep=internalized_brep, Point=pt, Strict=False)  # -> Inside, Index
cull = CullPattern(List=pt, CullPattern=brepsinc.Inside)
supp = SupportKaramba3D(PosInd=cull, menu=[buttons(on, on, on, on, on, on)])

# ---- group: Assemble Model
assemble = AssembleModelKaramba3D(Elem=flatten(surfelem.Element), Support=supp, Load=load, LimitDistance_m=0.005)  # -> Model, Info, Mass_kg, CentreOfGravity, LoadCaseNames

# ---- group: Analyze Model
# is it nessecary to get the ULS with type in the formular ?
# 
# in the previous software it was possible to add ULSIter
number_slider_2 = Slider(6, range=0..100)
opticrosec = OptimizeCrossSectionKaramba3D(
    Model=assemble.Model,
    CrossSections=crosec,
    MaximumUtilization=number_slider_2,
    MaximumVirtualWork_kNcm=0.01,
    NumberOfUtilizationIterations=5,
    NumberOfDisplacementIterations=5,
    NumberOfDisplacementIncrementsPerIteration=2,
    DisplacementTolerance=0.01,
    NumberOfSamplePoints=3,
    ElasticDesign=True,
    GammaM0=1,
    GammaM1=1.1,
    SwayFrame=True)  # -> OptimizedModel, Info, Mass_kg, MaximumDisplacement_cm, ElasticEnergyChange_kNm, MaximumUtilizationViewInsufficientCrossSections, MaximumDisplacementViewLimitCrossSections
panel = Panel(opticrosec.MaximumDisplacement_cm)

# ---- group: View Results
range_2 = Range(Domain=Domain(0, 1), Steps=Slider(73, range=0..100))
gradient = Gradient(
    LowerLimit=0,
    UpperLimit=1,
    Parameter=range_2,
    stops=[0: RGB(243, 57, 0), 0.1: RGB(236, 27, 60), 0.2: RGB(210, 0, 118), 0.3: RGB(103, 0, 120), 0.4: RGB(39, 72, 161), 0.5: RGB(1, 192, 229), 0.6: RGB(18, 178, 90), 0.7: RGB(79, 186, 8), 0.8: RGB(220, 237, 32), 0.9: RGB(247, 159, 20), 1: RGB(243, 57, 0)])
modelview = ModelViewKaramba3D(Model=opticrosec.OptimizedModel, Colours=gradient)  # -> Model, DeformedMesh, DeformedAxes, DeformedModel, MaximumDeformation
shellview = ShellViewKaramba3D(Model=modelview.Model, IndexOfLayer=0)  # -> Model, MeshesOfRenderedShells, LegendColours, LegendTags
legend = Legend(Colour=shellview.LegendColours, Tags=shellview.LegendTags, LegendType=1)
mblur = BlurMesh(Mesh=shellview.MeshesOfRenderedShells, Iterations=1)

# ---- group: Line Results on Shells
mjoin = MeshJoin(Meshes=mesh_breps_2.Mesh)
popgeo = PopulateGeometry(Geometry=mjoin, Count=100, Seed=1)
shelllineresults = LineResultsOnShellsKaramba3D(
    AnalysedModel=modelview.Model,
    LayerPosition=0,
    ListOfSourcesOfPrincipalStressLinesLinesPoints=popgeo,
    SegmentLength_m=0.5,
    DA_deg=5,
    mode="PrincStress")  # -> Model, Lines1, Lines2
