# Grasshopper definition 02_BracingWalls.gh (Grasshopper 1.0.7)
# plug-ins: Karamba3D

# ---- group: Generate Geometry
r1 = Slider(0.62, range=0..1)
panel = Panel("""0
pi*2/3
pi*4/3""")
r2 = Slider(0.82, range=0..1)
r3 = Slider(0.32, range=0..1)
Z = UnitZ(Factor="3")
vec = VectorXYZ(XComponent=expr("sin(x*2*pi)", [r1, r2, r3]), YComponent=expr("cos(x*2*pi)", [r1, r2, r3]), ZComponent=0)  # -> Vector, Length
pt = PointCylindrical(BasePlane=PlaneXY(0, 0, 0), Angle=panel, Radius="3", Elevation=0)
# 02 - Bracing Walls
# Difficulty: Simple | Version 3.1.4
# This example shows a shell construction with bracing walls. To select the material use the Material Selector from Karamba3D. There are two different LoadCases analyzed and the one with the higher displacement
# is choosen as a ResultCase for the visualization.
planesrf = PlaneSurface(Plane=Z, XSize="-5 to 5", YSize="-5 to 5")
pl = ConstructPlane(Origin=pt, XAxis=vec.Vector, YAxis=Z)
planesrf_2 = PlaneSurface(Plane=pl, XSize="-2 to 2", YSize="3")
merge = Merge(Data1=planesrf, Data2=planesrf_2)
mesh_breps = MeshBrepsKaramba3D(
    Brep=merge,
    MeshResolution="0.5",
    EdgeRefinementFactor=0.67,
    PointReduction=False,
    SmoothingStepSize=0.3,
    SmoothingIterations=5)  # -> Mesh, Info

# ---- group: Define Supports
demesh = DeconstructMesh(Mesh=mesh_breps.Mesh)  # -> Vertices, Faces, Colours, Normals
devec = DeconstructVector(Vector=demesh.Vertices)  # -> XComponent, YComponent, ZComponent
smaller = SmallerThan(FirstNumber=devec.ZComponent, SecondNumber=0.01)  # -> SmallerThan, OrEqualTo
cull = CullPattern(List=demesh.Vertices, CullPattern=smaller.SmallerThan)  # -> flatten(List)
supp = SupportKaramba3D(PosInd=cull, menu=[buttons(on, on, on, off, off, off)])

# ---- group: Define Material
matselect = MaterialSelectionKaramba3D(menu=[dropdown(9), dropdown(19)])

# ---- group: Define Loads
panel_2 = Panel("""0
1""")
vec_2 = VectorXYZ(XComponent=panel_2, YComponent=reverse(panel_2), ZComponent=0)  # -> Vector, Length
panel_3 = Panel("""LC0
LC1""")
loads = LoadsKaramba3D(Vector=vec_2.Vector, LCase=panel_3, mode="Gravity")

# ---- group: Define CrossSection
crosec = CrossSectionKaramba3D(FamilyNameOfCrossSection="DefaultCroSec", Material=matselect, Height_cm="15", mode="Shell - Const")

# ---- group: Define Elements
surfelem = CreateSurfaceElementKaramba3D(Mesh=mesh_breps.Mesh, CrossSection=crosec, LimitDistance_m=0.005, Bending=True, mode="MeshToShell")  # -> Element, Points, Info

# ---- group: Assemble Model
assemble = AssembleModelKaramba3D(Elem=flatten(surfelem.Element), Support=flatten(supp), Load=flatten(loads), LimitDistance_m=0.005)  # -> Model, Info, Mass_kg, CentreOfGravity, LoadCaseNames
mass = Panel(assemble.Mass_kg)

# ---- group: Analyze Model
analyse = AnalyseKaramba3D(Model=assemble.Model)  # -> AnalysedModel, MaximumDisplacement_cm, ResultingForce_kN, ChangeOfElasticEnergy_kNm
displacement = Panel(analyse.MaximumDisplacement_cm)

# ---- group: View Results
panel_4 = Panel("""1
2""")
sort = SortList(Keys=displacement, ValuesA=panel_4)  # -> Keys, ValuesA
item = ListItem(List=reverse(sort.ValuesA), Index=0, Wrap=True)
modelview = ModelViewKaramba3D(Model=analyse.AnalysedModel, LoadCase=item)  # -> Model, DeformedMesh, DeformedAxes, DeformedModel, MaximumDeformation
shellview = ShellViewKaramba3D(Model=modelview.Model, IndexOfLayer=0)  # -> Model, MeshesOfRenderedShells, LegendColours, LegendTags
legend = Legend(Colour=shellview.LegendColours, Tags=shellview.LegendTags, LegendType=1)
