# Grasshopper definition 02_CrossSectionOptimizationOfShellPatches.gh (Grasshopper 1.0.7)
# plug-ins: MeshEdit Components, Weaverbird, Karamba3D

# ---- group: Generate Geometry
pt = Point([Point(2.543693867, 3.116646895, 0), Point(5.404953629, 15.87065674, 0), Point(16.16600086, 2.99672361, 0), Point(25.36833617, 22.79128384, 0)])
# 1
panel = Panel("2")
frompoints = MeshFromPoints(Points=pt, UDirection=panel, VDirection=panel)
wbsplitquads = WeaverbirdsConstantQuadsSplitSubdivision(MeshCurves=frompoints, Level=Slider(3, range=0..5), SmoothNakedEdges=0)

# 2
panel_2 = Panel("2")
pt_2 = Point([Point(2.543693867, 3.116646895, 0), Point(5.404953629, 15.87065674, 0), Point(16.16600086, 2.99672361, 0), Point(25.36833617, 22.79128384, 0)])
frompoints_2 = MeshFromPoints(Points=pt_2, UDirection=panel_2, VDirection=panel_2)
wbsplitquads_2 = WeaverbirdsConstantQuadsSplitSubdivision(MeshCurves=frompoints_2, Level=Slider(2, range=0..5), SmoothNakedEdges=0)

# 3
panel_3 = Panel("4")
pt_3 = Point([Point(3.260661135, 3.162947148, 0), Point(7.167982744, 1.709188328, 3.030784563), Point(12.15627321, 1.686421173, 4.745505461), Point(18.50362883, 3.681767162, 3.230765877), Point(2.29572469, 6.696488146, 0.7027253048), Point(7.687025302, 9.158332547, 4.0629873), Point(15.97929715, 10.23409953, 5.506711258), Point(21.79497522, 9.381952741, 0), Point(1.807612226, 11.50742461, 1.68865986), Point(7.86371067, 14.39508912, 4.266384066), Point(18.38404673, 15.33407288, 6.653720466), Point(26.77075075, 15.0086392, 0), Point(-0.9368806366, 17.85950916, 5.233951301), Point(8.006062207, 20.80635243, 0.2184352219), Point(16.39073136, 23.46423107, 2.567255608), Point(33.43051354, 21.94368976, 4.6230526)])
frompoints_3 = MeshFromPoints(Points=pt_3, UDirection=panel_3, VDirection=panel_3)
wbcatmullclark = WeaverbirdsCatmullClarkSubdivision(MeshCurves=frompoints_3, Level=Slider(3, range=0..5), SmoothNakedEdges=2)

# ----
# Choose one geometry to analyze:
list = ValueList({"One": 0, "Two": 1, "Three": 2}, selected="One")
# 02 - Cross Section Optimization of Shell Patches
# Difficulty: Moderate | Version 3.1.4
# Different shell geometries can be split into different patches and analyzed as groups to have a consistent shell thickness.
# This definition requires the MeshEdit and Weaverbird plugins.
entwine = Entwine(Branch00=wbsplitquads, Branch01=wbsplitquads_2, Branch02=wbcatmullclark, FlattenInputs=True)
branch = TreeBranch(Tree=simplify(entwine), Path=list, MaintainPaths=True)
mesh = Mesh(branch)

# ---- group: Define Material
matselect = MaterialSelectionKaramba3D(menu=[dropdown(7), dropdown(7)])

# ---- group: Define CrossSection
range = Range(Domain="5 to 90", Steps=10)
concat = Concatenate(FragmentA="shell", FragmentB=range)
crosec = CrossSectionKaramba3D(FamilyNameOfCrossSection="shell", NameOfCrossSection=concat, Material=matselect, Height_cm=range, mode="Shell - Const")
item = ListItem(List=crosec, Index=0, Wrap=True)

# ---- group: Define Elements
explode = MeshExplode(Mesh=mesh, Interpolate=False)
wbsplitquads_3 = WeaverbirdsConstantQuadsSplitSubdivision(MeshCurves=explode, Level=Slider(2, range=0..5), SmoothNakedEdges=0)  # -> flatten(OutputMeshCurves)
lng = ListLength(List=wbsplitquads_3)
series = Series(Start=0, Step=1, Count=lng)
concat_2 = Concatenate(FragmentA="S", FragmentB=series)
surfelem = CreateSurfaceElementKaramba3D(Mesh=wbsplitquads_3, Identifier=concat_2, CrossSection=item, LimitDistance_m=0.005, Bending=True, mode="MeshToShell")  # -> Element, Points, Info

# ---- group: Define Supports
pt_4 = Point([Point(5.949270248, 3.086666107, 0), Point(8.172534943, 10.34374046, 0), Point(3.259008884, 6.305149555, 0), Point(12.76042366, 3.02670455, 0), Point(18.46658325, 7.945363998, 0), Point(16.56895638, 12.0439167, 0), Point(23.06775284, 17.84264374, 0), Point(20.377491, 21.06112671, 0), Point(10.39579868, 17.60081482, 0), Point(4.689638615, 12.68215466, 0), Point(12.37074566, 11.19382858, 0), Point(9.354846954, 3.056685448, 0), Point(20.76716805, 12.89400387, 0), Point(15.38664436, 19.33097076, 0), Point(3.97432375, 9.493652344, 0), Point(2.543693781, 3.116647005, 0), Point(5.40495348, 15.87065697, 0), Point(16.16600037, 2.996723652, 0), Point(25.36833572, 22.79128456, 0)])
pt_5 = Point([Point(12.37074566, 11.19382858, 0), Point(9.354846954, 3.056685448, 0), Point(20.76716805, 12.89400387, 0), Point(15.38664436, 19.33097076, 0), Point(3.97432375, 9.493652344, 0), Point(2.543693781, 3.116647005, 0), Point(5.40495348, 15.87065697, 0), Point(16.16600037, 2.996723652, 0), Point(25.36833572, 22.79128456, 0)])
pt_6 = Point([Point(3.260661135, 3.162947148, 0), Point(7.167982744, 1.709188328, 3.030784563), Point(12.15627321, 1.686421173, 4.745505461), Point(18.50362883, 3.681767162, 3.230765877), Point(2.29572469, 6.696488146, 0.7027253048), Point(21.79497522, 9.381952741, 0), Point(1.807612226, 11.50742461, 1.68865986), Point(26.77075075, 15.0086392, 0), Point(8.006062207, 20.80635243, 0.2184352219), Point(16.39073136, 23.46423107, 2.567255608), Point(33.43051354, 21.94368976, 4.6230526)])
entwine_2 = Entwine(Branch00=pt_4, Branch01=pt_5, Branch02=pt_6, FlattenInputs=True)
branch_2 = TreeBranch(Tree=simplify(entwine_2), Path=list, MaintainPaths=True)
fsim = FindSimilarMember(Data=branch_2, Set=surfelem.Points)  # -> Hit, Index
supp = SupportKaramba3D(PosInd=fsim.Hit, menu=[buttons(on, on, on, off, off, off)])

# ---- group: Define Loads
loads = LoadsKaramba3D(Vector=Vector(0, 0, -1), LCase="LC0", mode="Gravity")

# ---- group: Assemble Model
assemble = AssembleModelKaramba3D(Elem=flatten(surfelem.Element), Support=flatten(supp), Load=flatten(loads), LimitDistance_m=0.005)  # -> Model, Info, Mass_kg, CentreOfGravity, LoadCaseNames
mass = Panel(assemble.Mass_kg)

# ---- group: Optimize Cross Sections
max_displacement = Panel("1")
opticrosec = OptimizeCrossSectionKaramba3D(
    Model=assemble.Model,
    GroupIdentifiers=concat_2,
    CrossSections=crosec,
    MaximumUtilization=1,
    MaximumDisplacement_cm=max_displacement,
    MaximumVirtualWork_kNcm=0.01,
    NumberOfUtilizationIterations=5,
    NumberOfDisplacementIterations=5,
    NumberOfDisplacementIncrementsPerIteration=2,
    DisplacementTolerance=0.01,
    NumberOfSamplePoints=3,
    ElasticDesign=True,
    GammaM0=1,
    GammaM1=1.1,
    SwayFrame=True)  # -> OptimizedModel, Info, Mass_kg, MaximumDisplacement_cm, ElasticEnergyChange_kNm, MaximumUtilizationViewInsufficientCrossSections, MaximumDisplacementViewLimitCrossSections
mass_2 = Panel(opticrosec.Mass_kg)
displacement = Panel(opticrosec.MaximumDisplacement_cm)

# ---- group: View Results
modelview = ModelViewKaramba3D(Model=opticrosec.OptimizedModel)  # -> Model, DeformedMesh, DeformedAxes, DeformedModel, MaximumDeformation
shellview = ShellViewKaramba3D(Model=modelview.Model, IndexOfLayer=0)  # -> Model, MeshesOfRenderedShells, LegendColours, LegendTags
legend = Legend(Colour=shellview.LegendColours, Tags=shellview.LegendTags, LegendType=1)
