# Grasshopper definition 02_CrossSectionOptimizationOfShells_ElementSets.gh (Grasshopper 1.0.7)
# plug-ins: Weaverbird, MeshEdit Components, Karamba3D

# ---- group: Generate Geometry
pt = Point([Point(3.508923474, 2.557513046, 0), Point(11.62823275, 17.46824398, 0), Point(29.05200292, 12.75089233, 0), Point(19.03527459, 4.589458146, 0)])
del = DelaunayMesh(Points=pt, Plane=PlaneXY(0, 0, 0))
wbloop = WeaverbirdsLoopSubdivision(MeshCurves=del, Level=Slider(2, range=0..4), SmoothNakedEdges=0)
explode = MeshExplode(Mesh=wbloop, Interpolate=False)
lng = ListLength(List=explode)
range = Range(Domain=Domain(0, 1), Steps=expr("x-1", lng))
# 02 - Optimize Cross Section of a Shell with Element Sets
# Difficulty: Moderate | Version 3.1.4
# ElementSets for shells allow you to group mesh faces for the Cross Section Optimization process.
wbloop_2 = WeaverbirdsLoopSubdivision(MeshCurves=explode, Level=Slider(3, range=0..4), SmoothNakedEdges=0)  # -> flatten(OutputMeshCurves)
hsl = ColourHSL(Alpha=Slider(0.46, range=0..1), Hue=range, Saturation=1, Luminance=0.5)
preview = CustomPreview(Geometry=wbloop_2, Shader=hsl)

# ---- group: Define Cross Section
range_2 = Range(Domain="2 to 15", Steps=10)
concat = Concatenate(FragmentA="s", FragmentB=range_2)
crosec = CrossSectionKaramba3D(FamilyNameOfCrossSection="s", NameOfCrossSection=graft(concat), Heights_cm=graft(range_2), mode="Shell - Var")
crosecselect = CrossSectionSelectorKaramba3D(CrossSections=flatten(crosec), NameOrListIndexOfCrossSection="0")  # -> CrossSection, Info

# ---- group: Define Elements and ElementSet
mesh = Mesh(wbloop_2)
lng_2 = ListLength(List=mesh)
series = Series(Start=0, Step=1, Count=lng_2)
range_3 = Range(Domain=Domain(0, 1), Steps=expr("x-1", lng_2))
int = Integer(series)
hsl_2 = ColourHSL(Alpha=1, Hue=range_3, Saturation=1, Luminance=0.5)
concat_2 = Concatenate(FragmentA="s", FragmentB=int)
concat_3 = Concatenate(FragmentA="G", FragmentB=int)
mkset = MakeElementSetKaramba3D(
    ElementIdentifiers=graft(concat_2),
    SetIdentifier=graft(concat_3),
    MinimumSplitLength_m=0.001,
    ColourOfTheSet=graft(hsl_2))
surfelem = CreateSurfaceElementKaramba3D(
    Mesh=mesh,
    Identifier=concat_2,
    CrossSection=crosecselect.CrossSection,
    LimitDistance_m=0.005,
    Bending=True,
    mode="MeshToShell")  # -> Element, Points, Info

# ---- group: Define Loads
loads = LoadsKaramba3D(Vector=Vector(0, 0, -1), LCase="LC0", mode="Gravity")

# ---- group: Define Supports
pt_2 = Point([Point(11.01775898, 3.51523998, 0), Point(21.02150012, 16.53784173, 0), Point(8.114010643, 12.33483255, 0)])
fsim = FindSimilarMember(Data=pt_2, Set=surfelem.Points)  # -> Hit, Index
supp = SupportKaramba3D(PosInd=fsim.Hit, menu=[buttons(on, on, on, on, on, on)])

# ---- group: Assemble Model
assemble = AssembleModelKaramba3D(Elem=surfelem.Element, Support=flatten(supp), Load=flatten(loads), BeamSet=flatten(mkset), LimitDistance_m=0.005)  # -> Model, Info, Mass_kg, CentreOfGravity, LoadCaseNames

# ---- group: Optimize CrossSection
panel = Panel(concat_2)
opticrosec = OptimizeCrossSectionKaramba3D(
    Model=assemble.Model,
    GroupIdentifiers=panel,
    CrossSections=flatten(crosec),
    MaximumUtilization="1.5",
    MaximumVirtualWork_kNcm=0.01,
    NumberOfUtilizationIterations=5,
    NumberOfDisplacementIterations=5,
    NumberOfDisplacementIncrementsPerIteration=2,
    DisplacementTolerance=0.01,
    NumberOfSamplePoints=3,
    ElasticDesign=True,
    GammaM0=1,
    GammaM1=1.1,
    SwayFrame=True)  # -> OptimizedModel, Info, Mass_kg, MaximumDisplacement_cm, ElasticEnergyChange_kNm, MaximumUtilizationViewInsufficientCrossSections, MaximumDisplacementViewLimitCrossSections
displacement = Panel(opticrosec.MaximumDisplacement_cm)
mass = Panel(opticrosec.Mass_kg)

# ---- group: View Results
modelview = ModelViewKaramba3D(Model=opticrosec.OptimizedModel)  # -> Model, DeformedMesh, DeformedAxes, DeformedModel, MaximumDeformation
shellview = ShellViewKaramba3D(Model=modelview.Model, IndexOfLayer=0)  # -> Model, MeshesOfRenderedShells, LegendColours, LegendTags
