# Grasshopper definition 02_CurvedGlassShell.gh (Grasshopper 1.0.7)
# plug-ins: MeshEdit Components, Karamba3D

# ---- group: Generate Geometry
Y = Slider(-1, range=-1..1)
Y_2 = Slider(-1, range=-1..1)
panel = Panel("""0
3
6""")
panel_2 = Panel("""0
1
0""")
panel_3 = Panel("""0
2
4""")
multiplication = Multiplication(A=panel_2, B=Y)
multiplication_2 = Multiplication(A=panel_2, B=Y_2)
vec = VectorXYZ(XComponent=panel_3, YComponent=multiplication, ZComponent=0)  # -> Vector, Length
vec_2 = VectorXYZ(XComponent=0, YComponent=multiplication_2, ZComponent=panel)  # -> Vector, Length
# 02 - Curved Glass Shell
# Difficulty: Moderate | Version 3.1.4
# Analyze a glass surface by inputting the material values generated from some input curves with a constant mesh load applied.
nurbs = NurbsCurve(Vertices=vec.Vector, Degree=2, Periodic=False)  # -> Curve, Length, Domain
nurbs_2 = NurbsCurve(Vertices=vec_2.Vector, Degree=2, Periodic=False)  # -> Curve, Length, Domain
sumsrf = SumSurface(CurveA=nurbs.Curve, CurveB=nurbs_2.Curve)
number_slider = Slider(0.31, range=0.1..1)
dim = Dimensions(Surface=sumsrf)  # -> UDimension, VDimension
division = Division(A=dim.UDimension, B=number_slider)
division_2 = Division(A=dim.VDimension, B=number_slider)
range = Range(Domain=Domain(0, 1), Steps=division)
range_2 = Range(Domain=Domain(0, 1), Steps=division_2)
vec_3 = VectorXYZ(XComponent=graft(range), YComponent=range_2, ZComponent=0)  # -> Vector, Length
evalsrf = EvaluateSurface(Surface=reparameterize(sumsrf), Point=vec_3.Vector)  # -> Point, Normal, UDirection, VDirection, Frame

# ---- group: Define Supports
geo = Geometry(evalsrf.Frame)
cull_i = CullIndex(List=geo, Indices="0", Wrap=True)
flip = FlipMatrix(Data=evalsrf.Frame)
cull_i_2 = CullIndex(List=reverse(cull_i), Indices="0", Wrap=True)  # -> reverse(List)
branch = TreeBranch(Tree=simplify(cull_i_2), Path="0", MaintainPaths=True)
branch_2 = TreeBranch(Tree=simplify(cull_i_2), Path=division, MaintainPaths=True)
branch_3 = TreeBranch(Tree=simplify(flip), Path="0", MaintainPaths=True)
branch_4 = TreeBranch(Tree=simplify(flip), Path=division_2, MaintainPaths=True)
pt = Point(branch)
pt_2 = Point(branch_2)
pt_3 = Point(branch_3)
pt_4 = Point(branch_4)
merge = Merge(Data1=pt, Data2=pt_2)
merge_2 = Merge(Data1=branch, Data2=branch_2)
merge_3 = Merge(Data1=pt_3, Data2=pt_4)
merge_4 = Merge(Data1=branch_3, Data2=branch_4)
supp = SupportKaramba3D(PosInd=flatten(merge), PlaneOfReference=flatten(merge_2), menu=[buttons(off, on, on, off, off, off)])
supp_2 = SupportKaramba3D(PosInd=flatten(merge_3), PlaneOfReference=flatten(merge_4), menu=[buttons(on, off, on, off, off, off)])
support = SupportKaramba3D([supp, supp_2])

# ---- group: Define Material
matprops = MaterialPropertiesKaramba3D(
    FamilyOfMaterial="Steel",
    Name="Gussglas",
    YoungsModulus_kN_cm²="7000",
    InPlaneShearModulus_kN_cm²="2845",
    TransverseShearModulus_kN_cm²=8076,
    SpecificWeight_kN_m³="25",
    CoefficientOfThermalExpansion_1="9e-6",
    TensileStrength_kN_cm²="2.5/2",
    CompressiveStrength_kN_cm²=expr("-x", "2.5/2"),
    StrengthHypothesis="MISES",
    mode="Isotrop")

# ---- group: Define CrossSection
crosec = CrossSectionKaramba3D(FamilyNameOfCrossSection="DefaultCroSec", Material=matprops, Height_cm="2", mode="Shell - Const")

# ---- group: Define Elements
frompoints = MeshFromPoints(Points=flatten(evalsrf.Point), UDirection=expr("x+1", division), VDirection=expr("x+1", division_2))
surfelem = CreateSurfaceElementKaramba3D(Mesh=frompoints, CrossSection=crosec, LimitDistance_m=0.005, Bending=True, mode="MeshToShell")  # -> Element, Points, Info

# ---- group: Define Loads
Z = UnitZ(Factor=1)
loads = LoadsKaramba3D(Vector=Vector(0, 0, -1), LCase="LC0", mode="Gravity")
loads_2 = LoadsKaramba3D(Vector=Z, Mesh=frompoints, LCase="LC0", mode="MeshLoad -Const.", menu=[buttons(on, off, off), buttons(on, on)])
load = LoadKaramba3D([loads, loads_2])

# ---- group: Assemble Model
assemble = AssembleModelKaramba3D(Elem=flatten(surfelem.Element), Support=flatten(support), Load=flatten(load), LimitDistance_m=0.005)  # -> Model, Info, Mass_kg, CentreOfGravity, LoadCaseNames
mass = Panel(assemble.Mass_kg)

# ---- group: Analyze Model
analyse = AnalyseKaramba3D(Model=assemble.Model)  # -> AnalysedModel, MaximumDisplacement_cm, ResultingForce_kN, ChangeOfElasticEnergy_kNm
displacement = Panel(analyse.MaximumDisplacement_cm)

# ---- group: View Results
modelview = ModelViewKaramba3D(Model=analyse.AnalysedModel)  # -> Model, DeformedMesh, DeformedAxes, DeformedModel, MaximumDeformation
shellview = ShellViewKaramba3D(Model=modelview.Model, IndexOfLayer=0)  # -> Model, MeshesOfRenderedShells, LegendColours, LegendTags
legend = Legend(Colour=shellview.LegendColours, Tags=shellview.LegendTags, LegendType=1)
