# Grasshopper definition 02_IntersectedTiles.gh (Grasshopper 1.0.8)
# plug-ins: Karamba3D

# ---- group: Define Geometry
number_slider = Slider(13, range=0..20)
genes = GenePool(Decimals=3, Maximum=1, Minimum=-1, Value=[-0.949, -0.426])
genes_2 = GenePool(Decimals=3, Maximum=1, Minimum=-1, Value=[-0.74, 0.74])
range = Range(Domain="0 to 20", Steps=number_slider)
range_2 = Range(Domain="0 to 20", Steps=Slider(7, range=0..20))
repeat = RepeatData(Data=genes_2, Length=expr("x+1", number_slider))  # -> graft(Data)
repeat_2 = RepeatData(Data=genes, Length=expr("x+1", number_slider))  # -> graft(Data)
# 02 - Intersected Tiles
# Difficulty: Simple | Version 3.1.4
# 
# Generate a grid of interesected tiles and analyze them as mesh shell elements.
pt = ConstructPoint(XCoordinate=range_2, YCoordinate=graft(range), ZCoordinate=0)
pt_2 = PointPolar(BasePlane=pt, XYAngle=repeat, ZAngle=0, Offset=1)
pt_3 = PointPolar(BasePlane=pt, XYAngle=0, ZAngle=repeat_2, Offset=1)
pl_3pt = Plane3Pt(PointA=pt, PointB=pt_2, PointC=pt_3)
planesrf = PlaneSurface(Plane=pl_3pt, XSize="-2.5 to 2.5", YSize="-1.0 to 1.0")  # -> flatten(Plane)

# ----
srf = Surface(flatten(planesrf))

# ---- group: Define IPoints for Mesh
bbx = BrepBrep(BrepA=graft(srf), BrepB=srf)  # -> Curves, Points
number_slider_2 = Slider(0.63, range=0..10)
trim = TrimTree(Tree=bbx.Curves, Depth=1)
len = Length(Curve=trim)
division = Division(A=len, B=number_slider_2)
divide = DivideCurve(Curve=trim, Count=division, Kinks=False)  # -> Points, Tangents, Parameters
trim_2 = TrimTree(Tree=divide.Points, Depth=1)
brep = Brep(graft(srf))

# ---- group: Cross Section and Material
matselect = MaterialSelectionKaramba3D(menu=[dropdown(4), dropdown(11)])
crosec = CrossSectionKaramba3D(FamilyNameOfCrossSection="DefaultCroSec", Material=matselect, Height_cm=Slider(20, range=0..20), mode="Shell - Const")

# ---- group: Mesh Elements
mesh_breps = MeshBrepsKaramba3D(
    Brep=flatten(brep),
    InclusionPoints=flatten(trim_2),
    MeshResolution=number_slider_2,
    EdgeRefinementFactor=0.67,
    PointReduction=False,
    SmoothingStepSize=0,
    SmoothingIterations=5)  # -> Mesh, Info
surfelem = CreateSurfaceElementKaramba3D(Mesh=mesh_breps.Mesh, LimitDistance_m=0.005, Bending=True, mode="MeshToShell")  # -> Element, Points, Info

# ---- group: Define Loads
Z = UnitZ(Factor=Slider(3, range=0..10))
loads = LoadsKaramba3D(Vector=Vector(0, 0, -1), LCase="LC0", mode="Gravity")
loads_2 = LoadsKaramba3D(
    Vector=expr("-x", Z),
    Mesh=mesh_breps.Mesh,
    LCase="LC0",
    mode="MeshLoad -Const.",
    menu=[buttons(off, off, on), buttons(on, off)])
load = LoadKaramba3D(flatten([loads, loads_2]))

# ---- group: Define Supports
debrep = DeconstructBrep(Brep=srf)  # -> Faces, Edges, Vertices
pt_4 = Point(flatten(debrep.Vertices))
pdecon = Deconstruct(Point=pt_4)  # -> XComponent, YComponent, ZComponent
smaller = SmallerThan(FirstNumber=pdecon.ZComponent, SecondNumber=Slider(-0.72, range=-1..0.05))  # -> SmallerThan, OrEqualTo
dispatch = Dispatch(List=pt_4, DispatchPattern=smaller.OrEqualTo)  # -> ListA, ListB

# ----
hull = ConvexHull(Points=dispatch.ListA, Plane=PlaneXY(0, 0, 0))  # -> Hull, HullZ, Indices
incurve = PointInCurve(Point=dispatch.ListA, Curve=hull.HullZ)  # -> Relationship, Point
equals = Equality(FirstNumber=incurve.Relationship, SecondNumber="1")  # -> Equality, Inequality
dispatch_2 = Dispatch(List=incurve.Point, DispatchPattern=equals.Equality)  # -> ListA, ListB

# ---- group: Define Supports (continued)
fsim = FindSimilarMember(Data=surfelem.Points, Set=dispatch_2.ListA)  # -> Hit, Index
rdpoints = RemoveDuplicatePointsKaramba3D(Point=fsim.Hit, LimitDistance=0.005)  # -> OutPoint, Info, Indexes
supp = SupportKaramba3D(PosInd=rdpoints.OutPoint, Ct_kN_m=Vector(0, 0, 0), Cr_kNm_rad=Vector(0, 0, 0), menu=[buttons(on, on, on, off, off, off)])

# ----
assemble = AssembleModelKaramba3D(Elem=surfelem.Element, Support=supp, Load=load, LimitDistance_m=0.005, CrossSection=crosec)  # -> Model, Info, Mass_kg, CentreOfGravity, LoadCaseNames

# ---- group: Analyze Model
analyse = AnalyseKaramba3D(Model=assemble.Model)  # -> AnalysedModel, MaximumDisplacement_cm, ResultingForce_kN, ChangeOfElasticEnergy_kNm
panel = Panel(analyse.MaximumDisplacement_cm)

# ---- group: Model View
modelview = ModelViewKaramba3D(Model=analyse.AnalysedModel)  # -> Model, DeformedMesh, DeformedAxes, DeformedModel, MaximumDeformation
shellview = ShellViewKaramba3D(Model=modelview.Model, IndexOfLayer=0)  # -> Model, MeshesOfRenderedShells, LegendColours, LegendTags
legend = Legend(Colour=shellview.LegendColours, Tags=shellview.LegendTags, LegendType=1)
