# Grasshopper definition 02_OptimizeCrossSectionOfFreeformShell.gh (Grasshopper 1.0.7)
# plug-ins: MeshEdit Components, Karamba3D, Human

# ---- group: Generate Geometry
panel = Panel("""-2
2
2""")
panel_2 = Panel("""0
4
8""")
pt = Point([Point(-4.734497998, -14.0465191, 0), Point(2.869729098, -11.0233295, 0), Point(10.47395619, -8.000139902, 0), Point(12.65935908, 4.352244255, 0), Point(14.84476197, 16.70462841, 0), Point(17.03016486, 29.05701257, 0), Point(7.181320333, 21.87575699, 0), Point(-2.667524196, 14.69450141, 0), Point(-12.51636873, 7.513245828, 0), Point(-12.45715418, -0.6810723461, 0), Point(-12.39793964, -8.875390521, 0), Point(-12.33872509, -17.0697087, 0)])
Z = UnitZ(Factor=panel_2)
addition = Addition(A=pt, B=graft(Z))
# 02 - Optimize Cross Section of a Freeform Shell
# Difficulty: Simple | Version 3.1.4
# When inputing any freeform geometry, we can optimize the shell thickness for the defined loads. The principal stress lines are drawn on the shell.
nurbs = NurbsCurve(Vertices=addition, Degree=3, Periodic=True)  # -> flatten(Curve), Length, Domain
number_slider = Slider(6, range=0..100)
number_slider_2 = Slider(64, range=0..100)
offset_l = OffsetLoose(Curve=nurbs.Curve, Distance=panel)
loft = Loft(Curves=offset_l, Options={Adjust=False, Closed=False, LoftEnds=0, LoftSimp=0, LoftType=1, Rebuild=10, Refit=0.01})
sdivide = DivideSurface(Surface=loft, UCount=number_slider, VCount=number_slider_2)  # -> Points, Normals, Parameters
frompoints = MeshFromPoints(Points=flatten(sdivide.Points), UDirection=expr("x+1", number_slider), VDirection=expr("x+1", number_slider_2))
weldvertices = MeshWeldVertices(Mesh=frompoints, Tolerance=0.01)  # -> RuntimeMessage, Mesh
tri = Triangulate(Mesh=weldvertices.Mesh)  # -> Mesh, Count

# ---- group: Define Cross Section
range = Range(Domain="1 to 5", Steps=10)
eval = Evaluate(F="x&y", x="S", y=range)
crosec = CrossSectionKaramba3D(FamilyNameOfCrossSection="S", NameOfCrossSection=eval, Height_cm=range, mode="Shell - Const")
item = ListItem(List=crosec, Index=0, Wrap=True)

# ---- group: Define Supports
branch = TreeBranch(Tree=simplify(sdivide.Points), Path="0", MaintainPaths=True)
repeat = RepeatData(Data="0", Length=Slider(12, range=0..20))
cull = CullPattern(List=branch, CullPattern=flatten(["1", repeat]))
supp = SupportKaramba3D(PosInd=cull, menu=[buttons(on, on, on, off, off, off)])

# ---- group: Define Loads
Z_2 = UnitZ(Factor="-1.5")
loads = LoadsKaramba3D(Vector=Z_2, LCase="LC0", mode="Gravity")

Z_3 = UnitZ(Factor="-0.7")
loads_2 = LoadsKaramba3D(Vector=Z_3, Mesh=tri.Mesh, LCase="LC0", mode="MeshLoad -Const.", menu=[buttons(off, on, off), buttons(on, on)])

# ---- group: Define Elements
surfelem = CreateSurfaceElementKaramba3D(Mesh=tri.Mesh, Identifier="S", CrossSection=item, LimitDistance_m=0.005, Bending=True, mode="MeshToShell")  # -> Element, Points, Info

# ----
load = LoadKaramba3D([loads_2, loads])

# ---- group: Assemble Model
assemble = AssembleModelKaramba3D(Elem=flatten(surfelem.Element), Support=flatten(supp), Load=flatten(load), LimitDistance_m=0.005)  # -> Model, Info, Mass_kg, CentreOfGravity, LoadCaseNames

# ---- group: Optimize Cross Section
opticrosec = OptimizeCrossSectionKaramba3D(
    Model=assemble.Model,
    CrossSections=crosec,
    MaximumUtilization=1,
    MaximumVirtualWork_kNcm=0.01,
    NumberOfUtilizationIterations=5,
    NumberOfDisplacementIterations=5,
    NumberOfDisplacementIncrementsPerIteration=2,
    DisplacementTolerance=0.01,
    NumberOfSamplePoints=3,
    ElasticDesign=True,
    GammaM0=1,
    GammaM1=1.1,
    SwayFrame=True)  # -> OptimizedModel, Info, Mass_kg, MaximumDisplacement_cm, ElasticEnergyChange_kNm, MaximumUtilizationViewInsufficientCrossSections, MaximumDisplacementViewLimitCrossSections
displacement = Panel(opticrosec.MaximumDisplacement_cm)

# ---- group: View Results
modelview = ModelViewKaramba3D(Model=opticrosec.OptimizedModel)  # -> Model, DeformedMesh, DeformedAxes, DeformedModel, MaximumDeformation
shellview = ShellViewKaramba3D(Model=modelview.Model, IndexOfLayer=0)  # -> Model, MeshesOfRenderedShells, LegendColours, LegendTags
legend = Legend(Colour=shellview.LegendColours, Tags=shellview.LegendTags, LegendType=1)

# ---- group: View Line Results on Shells
popgeo = PopulateGeometry(Geometry=tri.Mesh, Count=Slider(56, range=0..100), Seed=1)
shelllineresults = LineResultsOnShellsKaramba3D(
    AnalysedModel=modelview.Model,
    LayerPosition=Slider(1, range=-1..1),
    ListOfSourcesOfPrincipalStressLinesLinesPoints=popgeo,
    SegmentLength_m=0.5,
    DA_deg=5,
    mode="PrincStress")  # -> Model, Lines1, Lines2
number_slider_3 = Slider(2, range=0..2)
previewlw = CustomPreviewLineweights(
    Geometry=shelllineresults.Lines1,
    Shader=ColourSwatch(SwatchColor=RGB(255, 0, 0)),
    Thickness=number_slider_3,
    Absolute=False)
previewlw_2 = CustomPreviewLineweights(
    Geometry=shelllineresults.Lines2,
    Shader=ColourSwatch(SwatchColor=RGB(0, 89, 255)),
    Thickness=number_slider_3,
    Absolute=False)
