# Grasshopper definition 02_PrincipalStressLinesToCurve.gh (Grasshopper 1.0.7)
# plug-ins: Karamba3D, Weaverbird, ShapeDiverForGrasshopper

sddp = ShapeDiverDocumentPayload({AbsoluteTolerance=0, AngleTolerance=0, DistanceDisplayPrecision=0, GltfVersion="Gltf2", GrasshopperVersion="1.0.0007", InputGroups="{}", OutputGroups="{}", RelativeTolerance=0, RhinoVersion="7.38.24338.17001", UnitSystem=0, VersionCreated="1.16.0.0", VersionSaved="1.14.0.0"})

# ---- group: Generate Geometry
xz = XZPlane(Origin=Point(0, 0, 0))
planesrf = PlaneSurface(Plane=xz, XSize="-15 to 15", YSize="0 to 10")
# 02 - Principal Stress Lines To Curve
# Difficulty: Moderate | Version 3.1.4
# This example shows how to generate a curve based structure from principal stress lines from an analysis of a surface.
srf = Surface(planesrf)
vec = VectorXYZ(
    XComponent=[Slider(0.257, range=0..1), Slider(0.491, range=0..1), Slider(0.77, range=0..1)],
    YComponent=[Slider(0.396, range=0..1), Slider(0.864, range=0..1), Slider(0, range=0..1)],
    ZComponent=0)  # -> Vector, Length
evalsrf = EvaluateSurface(Surface=reparameterize(srf), Point=vec.Vector)  # -> Point, Normal, UDirection, VDirection, Frame
mesh_breps = MeshBrepsKaramba3D(
    Brep=srf,
    InclusionPoints=evalsrf.Point,
    MeshResolution="1",
    EdgeRefinementFactor=0.67,
    PointReduction=False,
    SmoothingStepSize=0.5,
    SmoothingIterations=5)  # -> Mesh, Info

# ---- group: Define Cross Section
ids = Panel("A")
crosec = CrossSectionKaramba3D(FamilyNameOfCrossSection="DefaultCroSec", ElementIdentifier=ids, Height_cm="2.5", mode="Shell - Const")

# ---- group: Define Supports
supp = SupportKaramba3D(PosInd=evalsrf.Point, menu=[buttons(on, on, on, on, on, on)])

# ---- group: Define Loads
loads = LoadsKaramba3D(Vector=Vector(0, 0, -1), LCase="LC0", mode="Gravity")

# ---- group: Define Elements
surfelem = CreateSurfaceElementKaramba3D(Mesh=mesh_breps.Mesh, Identifier=ids, CrossSection=crosec, LimitDistance_m=0.005, Bending=True, mode="MeshToShell")  # -> Element, Points, Info

# ---- group: Assemble Model
assemble = AssembleModelKaramba3D(Elem=flatten(surfelem.Element), Support=flatten(supp), Load=flatten(loads), LimitDistance_m=0.005)  # -> Model, Info, Mass_kg, CentreOfGravity, LoadCaseNames

# ---- group: Analyze Model
analyse = AnalyseKaramba3D(Model=assemble.Model)  # -> AnalysedModel, MaximumDisplacement_cm, ResultingForce_kN, ChangeOfElasticEnergy_kNm

# ---- group: View Results
modelview = ModelViewKaramba3D(Model=analyse.AnalysedModel)  # -> Model, DeformedMesh, DeformedAxes, DeformedModel, MaximumDeformation
popgeo = PopulateGeometry(Geometry=mesh_breps.Mesh, Count=Slider(15, range=0..100), Seed=Slider(4088, range=0..10000))
shellview = ShellViewKaramba3D(Model=modelview.Model, IndexOfLayer=0)  # -> Model, MeshesOfRenderedShells, LegendColours, LegendTags
shelllineresults = LineResultsOnShellsKaramba3D(
    AnalysedModel=analyse.AnalysedModel,
    LayerPosition=Slider(-0.44, range=-1..1),
    ListOfSourcesOfPrincipalStressLinesLinesPoints=popgeo,
    SegmentLength_m=0.5,
    DA_deg=5,
    mode="PrincStress")  # -> Model, Lines1, Lines2

# ---- group: Generate Geometry from Principal Stress Lines
trim = TrimTree(Tree=shelllineresults.Lines2, Depth=1)
trim_2 = TrimTree(Tree=shelllineresults.Lines1, Depth=1)
edges = BrepEdges(Brep=srf)  # -> Naked, Interior, NonManifold
join = JoinCurves(Curves=trim, Preserve=False)
join_2 = JoinCurves(Curves=trim_2, Preserve=False)
merge = Merge(Data1=flatten(join_2), Data2=flatten(join), Data3=flatten(edges.Naked))
mcx = MultipleCurves(Curves=reparameterize(merge))  # -> Points, IndexA, IndexB, ParamA, ParamB
tstat = TreeStatistics(Tree=graft([mcx.ParamA, mcx.ParamB]))  # -> Paths, Length, Count
replace = ReplacePaths(Data=graft([mcx.ParamA, mcx.ParamB]), Search=tstat.Paths, Replace=[mcx.IndexA, mcx.IndexB])
expression = Expression(x=replace, Expression="round(x,4)")
sort = SortList(Keys=expression)  # -> Keys, ValuesA
dcon = DeleteConsecutive(Set=sort.Keys, Wrap=False)  # -> Set, Count
shatter = Shatter(Curve=reparameterize(graft(merge)), Parameters=dcon.Set)
end = EndPoints(Curve=shatter)  # -> Start, End
cullpt = CullDuplicates(Points=flatten([end.Start, end.End]), Tolerance=Slider(0.39, range=0..1), CullMode=3)  # -> Points, Indices, Valence
cp = ClosestPoint(Point=end.Start, Cloud=cullpt.Points)  # -> ClosestPoint, CPIndex, Distance
cp_2 = ClosestPoint(Point=end.End, Cloud=cullpt.Points)  # -> ClosestPoint, CPIndex, Distance
ln = Line(StartPoint=cp.ClosestPoint, EndPoint=cp_2.ClosestPoint)
rdlines = RemoveDuplicateLinesKaramba3D(Line=flatten(ln), LimitDistance=0.005)  # -> OutLine, Info, Indexes
wbweave = WeaverbirdsMeshFromLinesWeaveBack(Lines=rdlines.OutLine, MaximumValence=Slider(6, range=0..10))
wbframe = WeaverbirdsPictureFrame(MeshPolylines=wbweave, Distance=Slider(6, range=0..100), InsetType=0)
wbcatmullclark = WeaverbirdsCatmullClarkSubdivision(MeshCurves=wbframe, Level=2, SmoothNakedEdges=1)
medges = MeshEdges(Mesh=wbcatmullclark)  # -> NakedEdges, InteriorEdges, NonManifoldEdges
crv = Curve(medges.NakedEdges)
join_3 = JoinCurves(Curves=crv, Preserve=False)
