# Grasshopper definition 02_PrincipalStressLinesToMesh.gh (Grasshopper 1.0.7)
# plug-ins: Karamba3D, Weaverbird

# ---- group: Generate Geometry
xz = XZPlane(Origin=Point(0, 0, 0))
planesrf = PlaneSurface(Plane=xz, XSize="-15 to 15", YSize="0 to 6")
# 02 - PrincipalStressLinesToMesh
# Difficulty: Moderate | Version 3.1.4
# This example shows how to generate a structure based on principal stress lines of a surface. With the plug-in Weaverbird it's possible to generate an optimized surface for the principal stress of the input surface.
srf = Surface(planesrf)
vec = VectorXYZ(
    XComponent=[Slider(0.261, range=0..1), Slider(0.77, range=0..1)],
    YComponent=[Slider(0.396, range=0..1), Slider(0, range=0..1)],
    ZComponent=0)  # -> Vector, Length
evalsrf = EvaluateSurface(Surface=reparameterize(srf), Point=vec.Vector)  # -> Point, Normal, UDirection, VDirection, Frame
mesh_breps = MeshBrepsKaramba3D(
    Brep=srf,
    InclusionPoints=evalsrf.Point,
    MeshResolution="1",
    EdgeRefinementFactor=0.67,
    PointReduction=False,
    SmoothingStepSize=0.5,
    SmoothingIterations=5)  # -> Mesh, Info

# ----
ids = Panel("A")

# ---- group: Define Cross Section
crosec = CrossSectionKaramba3D(FamilyNameOfCrossSection="DefaultCroSec", ElementIdentifier=ids, Height_cm="2.5", mode="Shell - Const")

# ---- group: Define Supports
supp = SupportKaramba3D(PosInd=evalsrf.Point, menu=[buttons(on, on, on, on, on, on)])

# ---- group: Define Loads
loads = LoadsKaramba3D(Vector=Vector(0, 0, -1), LCase="LC0", mode="Gravity")

# ---- group: Define Elements
surfelem = CreateSurfaceElementKaramba3D(Mesh=mesh_breps.Mesh, Identifier=ids, CrossSection=crosec, LimitDistance_m=0.005, Bending=True, mode="MeshToShell")  # -> Element, Points, Info

# ---- group: Assemble Model
assemble = AssembleModelKaramba3D(Elem=flatten(surfelem.Element), Support=flatten(supp), Load=flatten(loads), LimitDistance_m=0.005)  # -> Model, Info, Mass_kg, CentreOfGravity, LoadCaseNames

# ---- group: Analyze Model
analyse = AnalyseKaramba3D(Model=assemble.Model)  # -> AnalysedModel, MaximumDisplacement_cm, ResultingForce_kN, ChangeOfElasticEnergy_kNm

# ---- group: View Results
popgeo = PopulateGeometry(Geometry=mesh_breps.Mesh, Count=Slider(60, range=0..100), Seed=Slider(1961, range=0..10000))
shelllineresults = LineResultsOnShellsKaramba3D(
    AnalysedModel=analyse.AnalysedModel,
    LayerPosition=Slider(-0.33, range=-1..0),
    ListOfSourcesOfPrincipalStressLinesLinesPoints=popgeo,
    SegmentLength_m=0.5,
    DA_deg=5,
    mode="PrincStress")  # -> Model, Lines1, Lines2
modelview = ModelViewKaramba3D(Model=analyse.AnalysedModel)  # -> Model, DeformedMesh, DeformedAxes, DeformedModel, MaximumDeformation
shellview = ShellViewKaramba3D(Model=modelview.Model, IndexOfLayer=0)  # -> Model, MeshesOfRenderedShells, LegendColours, LegendTags

# ---- group: Genereate Geometry from Principle Stress Lines
crv = Curve(shelllineresults.Lines1)
crv_2 = Curve(shelllineresults.Lines2)
trim = TrimTree(Tree=crv, Depth=1)
trim_2 = TrimTree(Tree=crv_2, Depth=1)
edges = BrepEdges(Brep=srf)  # -> Naked, Interior, NonManifold
join = JoinCurves(Curves=trim, Preserve=False)
join_2 = JoinCurves(Curves=trim_2, Preserve=False)
merge = Merge(Data1=flatten(join), Data2=flatten(join_2), Data3=flatten(edges.Naked))
mcx = MultipleCurves(Curves=reparameterize(merge))  # -> Points, IndexA, IndexB, ParamA, ParamB
tstat = TreeStatistics(Tree=graft([mcx.IndexA, mcx.IndexB]))  # -> Paths, Length, Count
replace = ReplacePaths(Data=graft([mcx.ParamA, mcx.ParamB]), Search=tstat.Paths, Replace=[mcx.IndexA, mcx.IndexB])
sort = SortList(Keys=replace)  # -> Keys, ValuesA
expression = Expression(x=sort.Keys, Expression="round(x,4)")
dcon = DeleteConsecutive(Set=expression, Wrap=False)  # -> Set, Count
shatter = Shatter(Curve=reparameterize(graft(merge)), Parameters=dcon.Set)
end = EndPoints(Curve=shatter)  # -> Start, End
cullpt = CullDuplicates(Points=flatten([end.Start, end.End]), Tolerance=Slider(0.18, range=0..1), CullMode=3)  # -> Points, Indices, Valence
cp = ClosestPoint(Point=end.End, Cloud=cullpt.Points)  # -> ClosestPoint, CPIndex, Distance
cp_2 = ClosestPoint(Point=end.Start, Cloud=cullpt.Points)  # -> ClosestPoint, CPIndex, Distance
ln = Line(StartPoint=cp_2.ClosestPoint, EndPoint=cp.ClosestPoint)
rdlines = RemoveDuplicateLinesKaramba3D(Line=flatten(ln), LimitDistance=0.005)  # -> OutLine, Info, Indexes
wbweave = WeaverbirdsMeshFromLinesWeaveBack(Lines=rdlines.OutLine, MaximumValence=Slider(6, range=0..10))
quad = Quadrangulate(Mesh=wbweave, Angle=0.03490658504, Ratio=0)  # -> Mesh, Count
wbframe = WeaverbirdsPictureFrame(MeshPolylines=quad.Mesh, Distance=Slider(12, range=0..100), InsetType=0)
wbcatmullclark = WeaverbirdsCatmullClarkSubdivision(MeshCurves=wbframe, Level=2, SmoothNakedEdges=2)
