# Grasshopper definition 02_ShellThicknessFromImage.gh (Grasshopper 1.0.7)
# plug-ins: Karamba3D

# ---- group: Generate Geometry
pt = Point([Point(0.6195443211, 0.6731465889, 0), Point(1.180868586, 3.142313202, 0), Point(2.50871305, 0.8228635272, 0), Point(4.061493053, 3.806671036, 0)])
srfgrid = SurfaceFromPoints(Points=pt, UCount="2", Interpolate=False)
# 02 - Shell Thickness from Image
# Difficulty: Moderate | Version 3.1.4
# Use the image sampler to define the cross section thickness of a shell.
mesh_uv = MeshSurface(Surface=srfgrid, UCount=Slider(60, range=1..100), VCount=Slider(60, range=1..100), Overhang=True, Equalize=False)

# ---- group: Define Loads
loads = LoadsKaramba3D(Vector=Vector(0, 0, -1), LCase="LC0", mode="Gravity")

# ---- group: Define Supports
genes = GenePool(Decimals=2, Maximum=1, Minimum=0, Value=[0, 0.27])
dispatch = Dispatch(List=genes, DispatchPattern=[True, False])  # -> ListA, ListB
vec = VectorXYZ(XComponent=dispatch.ListA, YComponent=dispatch.ListB, ZComponent=0)  # -> Vector, Length
evalsrf = EvaluateSurface(Surface=reparameterize(srfgrid), Point=vec.Vector)  # -> Point, Normal, UDirection, VDirection, Frame

# ---- group: Define Elements
tri = Triangulate(Mesh=mesh_uv)  # -> Mesh, Count

# ---- group: Define Cross Section with Image Sampler
facen = FaceNormals(Mesh=tri.Mesh)  # -> Centers, Normals
srf_cp = SurfaceClosestPoint(Point=facen.Centers, Surface=reparameterize(srfgrid))  # -> Point, UVPoint, Distance
image = ImageSampler(
    srf_cp.UVPoint,
    FilePath="C:\Users\sarar\Karamba3D\Karamba3D-Content - Documents\02_Examples\2_WebsiteExamples\WebsiteExamples_3-0-0\_toprep\02_ShellThicknessFromImage_leaf.jpg",
    Filter="Value",
    Interpolate=False,
    Umax=1,
    Umin=0,
    Vmax=1,
    Vmin=0,
    Wrap=1)
bnd = Bounds(Numbers=image)
remap = RemapNumbers(Value=image, Source=bnd, Target="0.5 to 10")  # -> Mapped, Clipped
crosec = CrossSectionKaramba3D(
    FamilyNameOfCrossSection="DefaultCroSec",
    NameOfCrossSection="Shell",
    ElementIdentifier="s",
    Heights_cm=remap.Mapped,
    mode="Shell - Var")

# ---- group: Define Elements (continued)
surfelem = CreateSurfaceElementKaramba3D(Mesh=tri.Mesh, Identifier="s", CrossSection=crosec, LimitDistance_m=0.005, Bending=True, mode="MeshToShell")  # -> Element, Points, Info

# ---- group: Define Supports (continued)
cps = ClosestPoints(Point=evalsrf.Point, Cloud=surfelem.Points, Count=Slider(6, range=0..10))  # -> ClosestPoint, CPIndex, Distance
supp = SupportKaramba3D(PosInd=cps.ClosestPoint, menu=[buttons(on, on, on, on, on, on)])

# ---- group: Assemble Model
assemble = AssembleModelKaramba3D(Elem=surfelem.Element, Support=flatten(supp), Load=flatten(loads), LimitDistance_m=0.005)  # -> Model, Info, Mass_kg, CentreOfGravity, LoadCaseNames

# ---- group: Analyze Model
analyse = AnalyseKaramba3D(Model=assemble.Model)  # -> AnalysedModel, MaximumDisplacement_cm, ResultingForce_kN, ChangeOfElasticEnergy_kNm
panel = Panel(analyse.MaximumDisplacement_cm)

# ---- group: View Results
modelview = ModelViewKaramba3D(Model=analyse.AnalysedModel)  # -> Model, DeformedMesh, DeformedAxes, DeformedModel, MaximumDeformation
shellview = ShellViewKaramba3D(Model=modelview.Model, IndexOfLayer=0)  # -> Model, MeshesOfRenderedShells, LegendColours, LegendTags
legend = Legend(Colour=shellview.LegendColours, Tags=shellview.LegendTags, LegendType=1)
