# Grasshopper definition 02_SimpleShell.gh (Grasshopper 1.0.7)
# plug-ins: Karamba3D

# ---- group: Define Geometry
pt = Point([Point(0.6195443211, 0.6731465889, 0), Point(1.180868586, 3.142313202, 0), Point(2.50871305, 0.8228635272, 0), Point(4.061493053, 3.806671036, 0)])
srfgrid = SurfaceFromPoints(Points=pt, UCount="2", Interpolate=False)
# 02 - Simple Shell
# Difficulty: Simple | Version 3.1.4
# This example shows how to analyze a simple shell with a constant CrossSection. Support and load positions are defined with GenePools.
mesh_uv = MeshSurface(Surface=srfgrid, UCount=Slider(12, range=1..20), VCount=Slider(12, range=1..20), Overhang=True, Equalize=False)

# ---- group: Define Supports
genes = GenePool(Decimals=2, Maximum=1, Minimum=0, Value=[1, 0, 0, 0, 1, 1, 0, 1])
dispatch = Dispatch(List=genes, DispatchPattern=[True, False])  # -> ListA, ListB
vec = VectorXYZ(XComponent=dispatch.ListA, YComponent=dispatch.ListB, ZComponent=0)  # -> Vector, Length
evalsrf = EvaluateSurface(Surface=reparameterize(srfgrid), Point=vec.Vector)  # -> Point, Normal, UDirection, VDirection, Frame
dispatch_2 = Dispatch(List=evalsrf.Point, DispatchPattern=[True, False])  # -> ListA, ListB
supp = SupportKaramba3D(PosInd=dispatch_2.ListA, menu=[buttons(on, on, on, off, off, on)])
supp_2 = SupportKaramba3D(PosInd=dispatch_2.ListB, menu=[buttons(on, on, on, off, off, off)])

# ---- group: Define Cross Section
t = Slider(1.3, range=0.5..4)
crosec = CrossSectionKaramba3D(FamilyNameOfCrossSection="DefaultCroSec", ElementIdentifier="s", Height_cm=t, mode="Shell - Const")

# ---- group: Define Element
surfelem = CreateSurfaceElementKaramba3D(Mesh=mesh_uv, Identifier="s", LimitDistance_m=0.005, Bending=True, mode="MeshToShell")  # -> Element, Points, Info

# ---- group: Define Loads
genes_2 = GenePool(Decimals=2, Maximum=1, Minimum=0, Value=[0.29, 0.29])
dispatch_3 = Dispatch(List=genes_2, DispatchPattern=[True, False])  # -> ListA, ListB
vec_2 = VectorXYZ(XComponent=dispatch_3.ListA, YComponent=dispatch_3.ListB, ZComponent=0)  # -> Vector, Length
evalsrf_2 = EvaluateSurface(Surface=reparameterize(srfgrid), Point=vec_2.Vector)  # -> Point, Normal, UDirection, VDirection, Frame
fsim = FindSimilarMember(Data=evalsrf_2.Point, Set=surfelem.Points)  # -> Hit, Index
Z = UnitZ(Factor="-15")
loads = LoadsKaramba3D(ForceVector=Z, Local=False, PosInd=fsim.Hit, LCase="LC0", mode="Point")

# ---- group: Define Gravity
loads_2 = LoadsKaramba3D(Vector=Vector(0, 0, -1), LCase="LC0", mode="Gravity")

# ----
support = SupportKaramba3D([supp, supp_2])
load = LoadKaramba3D([loads_2, loads])

# ---- group: Assemble Model
assemble = AssembleModelKaramba3D(Elem=surfelem.Element, Support=flatten(support), Load=flatten(load), LimitDistance_m=0.005, CrossSection=flatten(crosec))  # -> Model, Info, Mass_kg, CentreOfGravity, LoadCaseNames

# ---- group: Analyze Model
analyse = AnalyseKaramba3D(Model=assemble.Model)  # -> AnalysedModel, MaximumDisplacement_cm, ResultingForce_kN, ChangeOfElasticEnergy_kNm
panel = Panel(analyse.MaximumDisplacement_cm)

# ---- group: View Results
modelview = ModelViewKaramba3D(Model=analyse.AnalysedModel)  # -> Model, DeformedMesh, DeformedAxes, DeformedModel, MaximumDeformation
shellview = ShellViewKaramba3D(Model=modelview.Model, IndexOfLayer=0)  # -> Model, MeshesOfRenderedShells, LegendColours, LegendTags
legend = Legend(Colour=shellview.LegendColours, Tags=shellview.LegendTags, LegendType=1)
