# Grasshopper definition 02_SimpleStructure - Shells+Beams.gh (Grasshopper 1.0.7)
# plug-ins: Karamba3D, MeshEdit Components

# ---- group: Internalized Geometry
crv = Curve([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])

# ---- group: Geometry
brep = Brep([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])
s = Slider(0.76, range=0..1)
r = Slider(1.3, range=0.1..3)
end = EndPoints(Curve=crv)  # -> Start, End
# 02 - Simple Structure - Shells + Beams
# Difficulty: Moderate | Version 3.1.4
# This example shows how to analyze simple structures of shells and beams with Karamba3D. The loads are calculated as Gravity, Selfweight, Liveload and Windloads. Therfore five loadcases are calculated refering to the
# wind direction.
mesh_breps = MeshBrepsKaramba3D(
    Brep=brep,
    InclusionPoints=[end.Start, end.End],
    MeshResolution=r,
    EdgeRefinementFactor=0.67,
    PointReduction=False,
    SmoothingStepSize=s,
    SmoothingIterations=5)  # -> Mesh, Info
facen = FaceNormals(Mesh=mesh_breps.Mesh)  # -> Centers, Normals
item = ListItem(List=facen.Normals, Index=0, Wrap=True)  # -> flatten(Item)
devec = DeconstructVector(Vector=item)  # -> XComponent, YComponent, expr("abs(x)", ZComponent)
larger = LargerThan(FirstNumber=devec.ZComponent, SecondNumber="0.5")  # -> LargerThan, OrEqualTo
dispatch = Dispatch(List=mesh_breps.Mesh, DispatchPattern=larger.LargerThan)  # -> ListA, ListB
entwine = Entwine(Branch00=dispatch.ListA, Branch01=dispatch.ListB, FlattenInputs=True)

# ---- group: Define Cross Sections
readmattable = ReadMaterialTableFromFileKaramba3D()
panel = Panel("""slab
wall""")
t = Slider(35, range=10..50)
t_2 = Slider(40, range=10..50)
t_3 = Slider(60, range=10..60)
matselect = MaterialSelectionKaramba3D(Materials=readmattable, ElementIdentifier=panel, menu=[dropdown(7), dropdown(7)])
matselect_2 = MaterialSelectionKaramba3D(Materials=readmattable, ElementIdentifier="col", menu=[dropdown(7), dropdown(6)])
crosec = CrossSectionKaramba3D(
    FamilyNameOfCrossSection="DefaultCroSec",
    ElementIdentifier="col",
    Material=matselect_2,
    Diameter_cm=t_3,
    WallThickness_cm=expr("x/2", t_3),
    mode="Circular Hollow")
crosec_2 = CrossSectionKaramba3D(
    FamilyNameOfCrossSection="DefaultCroSec",
    ElementIdentifier=graft(panel),
    Material=matselect,
    Height_cm=graft([t, t_2]),
    mode="Shell - Const")

# ----
panel_2 = Panel("""LCC0 = Gravity_0 + LC_0 + Wind_0
LCC1 = Gravity_1 + LC_1 + Wind_1
LCC2 = Gravity_2 + LC_2 + Wind_2
LCC3 = Gravity_3 + LC_3 + Wind_3
LCC4 = Gravity_4 + LC_4 + Wind_4""")

# ---- group: Define Elements
lineelem = CreateLinearElementKaramba3D(
    Line=crv,
    Identifier="col",
    CrossSection=crosec,
    LimitDistance_m=0.005,
    BucklingLengthY_m=-1,
    BucklingLengthZ_m=-1,
    BucklingLengthLT_m=-1,
    Bending=True,
    ToPolylineMaxAngle=0.03,
    ToPolylineTolerance=0.01,
    ToPolylineMaxEdgeLength=0.25,
    New=True,
    Remove=True,
    mode="LineToBeam")  # -> Element, Points, Info

panel_3 = Panel("""slab
wall""")
surfelem = CreateSurfaceElementKaramba3D(Mesh=entwine, Identifier=graft(panel_3), CrossSection=crosec_2, LimitDistance_m=0.005, Bending=True, mode="MeshToShell")  # -> Element, Points, Info

# ---- group: Define Supports
rdpoints = RemoveDuplicatePointsKaramba3D(Point=flatten([lineelem.Points, surfelem.Points]), LimitDistance=0.005)  # -> OutPoint, Info, Indexes
pdecon = Deconstruct(Point=rdpoints.OutPoint)  # -> XComponent, YComponent, ZComponent
smaller = SmallerThan(FirstNumber=pdecon.ZComponent, SecondNumber="0.1")  # -> SmallerThan, OrEqualTo
cull = CullPattern(List=rdpoints.OutPoint, CullPattern=smaller.SmallerThan)
supp = SupportKaramba3D(PosInd=cull, menu=[buttons(on, on, on, off, off, off)])

# ----
lccombinator = LoadCaseCombinatorKaramba3D(LoadCaseCombinationRulesKaramba3D=panel_2)  # -> LoadCaseCombinations, NamesOfLoadCases, NumberOfLoadCases

# ---- group: Define Loads
windload = Panel("2*1.5")
x = Panel("""1
0
-1
0""")
internalized_brep = Brep([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])
earthquake = Panel("0.5")
x_2 = Panel("""0
1
0
-1
0""")
y = Panel("""0
1
0
-1""")
y_2 = Panel("""0
0
1
0
-1""")
build_up_liveload = Panel("""2 + 5
2*1.35 + 5*1.5
2*1.35 + 5*1.5
2*1.35 + 5*1.5
2*1.35 + 5*1.5""")
mesh = MeshBrep(
    Brep=internalized_brep,
    Settings={GridMaxCount=0, GridMinCount=0, JaggedSeams=False, MaxEdgeLength=0.5, MinEdgeLength=0.5, MinTolerance=0, Refine=True, RefineAngle=0, RelativeTolerance=0, SimplePlanes=False, Tolerance=0})
multiplication = Multiplication(A=windload, B=x)
multiplication_2 = Multiplication(A=windload, B=y)
selfweight_z = Panel("""1.0
1.35
1.35
1.35
1.35""")
multiplication_3 = Multiplication(A=earthquake, B=x_2)
multiplication_4 = Multiplication(A=earthquake, B=y_2)
lc = Panel("""Wind_0
Wind_1
Wind_2
Wind_3
Wind_4""")
mesh_2 = Mesh(dispatch.ListA)
vec = VectorXYZ(XComponent=multiplication, YComponent=multiplication_2, ZComponent=0)  # -> Vector, Length
mjoin = MeshJoin(Meshes=mesh)
Z = UnitZ(Factor=expr("-x", build_up_liveload))
mjoin_2 = MeshJoin(Meshes=mesh_2)
nakededge = MeshNakedEdge(Mesh=mjoin_2)  # -> V, A, B
sort = SortList(Keys=[nakededge.A, nakededge.B])  # -> Keys, ValuesA
dcon = DeleteConsecutive(Set=sort.Keys, Wrap=False)  # -> Set, Count
item_2 = ListItem(List=nakededge.V, Index=dcon.Set, Wrap=True)
lc_2 = Panel("""LC_0
LC_1
LC_2
LC_3
LC_4""")
lc_3 = Panel("""Gravity_0
Gravity_1
Gravity_2
Gravity_3
Gravity_4""")
vec_2 = VectorXYZ(XComponent=multiplication_3, YComponent=multiplication_4, ZComponent=expr("-x", selfweight_z))  # -> Vector, Length
vdis = VectorDisplay(Anchor=Point(0, 0, 0), Vector=vec.Vector)
loads = LoadsKaramba3D(
    Vector=graft(vec.Vector),
    Mesh=mjoin,
    AddPos=item_2,
    LCase=lc,
    mode="MeshLoad -Const.",
    menu=[buttons(off, off, on), buttons(on, off)])  # -> flatten(Load)

# ----
loads_2 = LoadsKaramba3D(Vector=vec_2.Vector, LCase=lc_3, mode="Gravity")
loads_3 = LoadsKaramba3D(Vector=Z, Mesh=mjoin_2, LCase=lc_2, mode="MeshLoad -Const.", menu=[buttons(off, on, off), buttons(on, off)])

# ---- group: Define Loads (continued)
load = LoadKaramba(flatten([loads_2, loads_3, loads, lccombinator.LoadCaseCombinations]))

# ---- group: Assemble Model
assemble = AssembleModelKaramba3D(Elem=flatten([surfelem.Element, lineelem.Element]), Support=flatten(supp), Load=flatten(load), LimitDistance_m=0.005)  # -> Model, Info, Mass_kg, CentreOfGravity, LoadCaseNames

# ---- group: Analyze Model
panel_4 = Panel("""LCC0
LCC1
LCC2
LCC3
LCC4""")
analyse = AnalyseKaramba3D(Model=assemble.Model, LoadCases=panel_4)  # -> AnalysedModel, MaximumDisplacement_cm, ResultingForce_kN, ChangeOfElasticEnergy_kNm
panel_5 = Panel(analyse.MaximumDisplacement_cm)

# ---- group: View Results
resultselect = LoadCaseSelectorKaramba3D(
    Model=analyse.AnalysedModel,
    menu=[buttons(on, on), dropdown(4), dropdown(0), buttons(off, off, off, off, off, off, off), buttons(off, off, off, off, off, off), buttons(off, off, off, off, off, off, off, off), buttons(off, off, off, off, off, off, off, off)])  # -> Model, LoadCaseSelection
modelview = ModelViewKaramba3D(Model=resultselect.Model)  # -> Model, DeformedMesh, DeformedAxes, DeformedModel, MaximumDeformation
shellview = ShellViewKaramba3D(Model=modelview.Model, IndexOfLayer=0)  # -> Model, MeshesOfRenderedShells, LegendColours, LegendTags
beamview = BeamViewKaramba3D(Model=modelview.Model)  # -> Model, MeshesOfRenderedBeams, DeformedBeamAxes, LegendColours, LegendTags
legend = Legend(Colour=beamview.LegendColours, Tags=beamview.LegendTags, LegendType=1)
legend_2 = Legend(Colour=shellview.LegendColours, Tags=shellview.LegendTags, LegendType=1)
