# Grasshopper definition 02_TemperatureLoadOnBeams.gh (Grasshopper 1.0.7)
# plug-ins: Karamba3D

panel = Panel("""A
B""")
h = Slider(1.63, range=0..10)

# ---- group: Define Material
panel_2 = Panel("""1e-3
1e-7""")
panel_3 = Panel("""M1
M2""")
matprops = MaterialPropertiesKaramba3D(
    FamilyOfMaterial="Steel",
    Name=graft(panel_3),
    ElementIdentifier=graft(panel),
    YoungsModulus_kN_cm²=21000,
    InPlaneShearModulus_kN_cm²=8076,
    TransverseShearModulus_kN_cm²=8076,
    SpecificWeight_kN_m³=78.5,
    CoefficientOfThermalExpansion_1=graft(panel_2),
    TensileStrength_kN_cm²=23.5,
    CompressiveStrength_kN_cm²=-23.5,
    StrengthHypothesis="MISES",
    mode="Isotrop")  # -> flatten(Material)

# ---- group: Define Cross Section
number_slider = Slider(1.63, range=0..10)
panel_4 = Panel("""-0.5
0.5""")
expression = Expression(x=panel_4, y=number_slider, Expression="{0,0,x*y}")
crosec = CrossSectionKaramba3D(
    FamilyNameOfCrossSection="DefaultCroSec",
    ElementIdentifier=panel,
    Material=matprops,
    LocalEccentricity_cm=expression,
    Height_cm=number_slider,
    UpperFlangeWidth_cm="40",
    LowerFlangeWidth_cm="40",
    mode="Trapezoid")

# ---- group: Define Geometry
number_slider_2 = Slider(24, range=0..50)
# 02 - Temperature Load on Beams
range = Range(Domain=Domain(-1, 1), Steps=number_slider_2)
# Difficulty: Moderate | Version 3.1.4
# This example shows the impact of temperature load on metal beams and shells. The elements deform due to the given temperature load. With the Large Deformation Analysis component it is possilbe to do an incremental
# geometrically non-linear analysis for each element.
vec = VectorXYZ(XComponent=range, YComponent=0, ZComponent=0)  # -> Vector, Length
pline = PolyLine(Vertices=vec.Vector, Closed=False)
explode = Explode(Curve=pline, Recursive=True)  # -> Segments, Vertices

panel_5 = Panel("""-0.005
0.005""")
n = Slider(24, range=0..50)
expression_2 = Expression(x=panel_5, y=h, Expression="{0,0,x*y}")
mplane = MeshPlane(Boundary={Plane=PlaneXY(-1, 1, 0), Size=Domain2(u=0..2, v=0..2)}, WidthCount=n, HeightCount=n)  # -> Mesh, Area
move = Move(Geometry=mplane.Mesh, Motion=expression_2)  # -> Geometry, Transform

# ----
panel_6 = Panel("""A
B""")

# ---- group: Define Material
panel_7 = Panel("""1e-3
1e-7""")
panel_8 = Panel("""M1
M2""")
matprops_2 = MaterialPropertiesKaramba3D(
    FamilyOfMaterial="Steel",
    Name=graft(panel_8),
    ElementIdentifier=graft(panel_6),
    YoungsModulus_kN_cm²=21000,
    InPlaneShearModulus_kN_cm²=8076,
    TransverseShearModulus_kN_cm²=8076,
    SpecificWeight_kN_m³=78.5,
    CoefficientOfThermalExpansion_1=graft(panel_7),
    TensileStrength_kN_cm²=23.5,
    CompressiveStrength_kN_cm²=-23.5,
    StrengthHypothesis="MISES",
    mode="Isotrop")

# ---- group: Define Supports
multiplication = Multiplication(A=number_slider_2, B=Slider(0.2, range=0..1))
supp = SupportKaramba3D(PosInd=multiplication, menu=[buttons(on, on, on, on, on, on)])  # -> flatten(Support)

# ---- group: Define Cross Section
crosec_2 = CrossSectionKaramba3D(
    FamilyNameOfCrossSection="DefaultCroSec",
    ElementIdentifier=panel_6,
    Material=matprops_2,
    Height_cm=h,
    mode="Shell - Const")

# ---- group: Define Load
δt = Slider(10, range=-100..100)
loads = LoadsKaramba3D(UniformChangeOfTemperature=δt, ElementIdentifiers=panel, LCase="LC0", mode="Temperature")  # -> flatten(Load)

# ---- group: Define Elements
lineelem = CreateLinearElementKaramba3D(
    Line=explode.Segments,
    Identifier=graft(panel),
    CrossSection=graft(crosec),
    LimitDistance_m=0.005,
    BucklingLengthY_m=-1,
    BucklingLengthZ_m=-1,
    BucklingLengthLT_m=-1,
    Bending=True,
    ToPolylineMaxAngle=0.03,
    ToPolylineTolerance=0.01,
    ToPolylineMaxEdgeLength=0.25,
    New=True,
    Remove=True,
    mode="LineToBeam")  # -> flatten(Element), Points, Info

demesh = DeconstructMesh(Mesh=move.Geometry)  # -> Vertices, Faces, Colours, Normals
flip = FlipMatrix(Data=demesh.Vertices)
pline_2 = PolyLine(Vertices=flip, Closed=False)  # -> flatten(Polyline)
lineelem_2 = CreateLinearElementKaramba3D(
    Line=pline_2,
    Identifier=graft("x"),
    LimitDistance_m=0.005,
    BucklingLengthY_m=-1,
    BucklingLengthZ_m=-1,
    BucklingLengthLT_m=-1,
    Bending=True,
    ToPolylineMaxAngle=0.03,
    ToPolylineTolerance=0.01,
    ToPolylineMaxEdgeLength=0.25,
    New=True,
    Remove=True,
    mode="LineToBeam")  # -> Element, Points, Info

# ---- group: Define Supports
x = Slider(0.3, range=0..1)
y = Slider(0.5, range=0..1)
expression_3 = Expression(n=n, x=x, y=y, Expression="(n*x)+(round(n*y,0))*(n+1)")
item = ListItem(List=demesh.Vertices, Index=expression_3, Wrap=True)
supp_2 = SupportKaramba3D(PosInd=item, menu=[buttons(on, on, on, on, on, on)])  # -> flatten(Support)

# ---- group: Define Loads
δt_2 = Slider(10, range=-100..100)
loads_2 = LoadsKaramba3D(UniformChangeOfTemperature=δt_2, ElementIdentifiers=panel_6, LCase="LC0", mode="Temperature")

# ---- group: Assemble Model
assemble = AssembleModelKaramba3D(Elem=lineelem.Element, Support=supp, Load=loads, LimitDistance_m=0.005)  # -> Model, Info, Mass_kg, CentreOfGravity, LoadCaseNames
panel_9 = Panel(assemble.Mass_kg)

# ---- group: Define Elements
surfelem = CreateSurfaceElementKaramba3D(
    Mesh=graft(move.Geometry),
    Identifier=graft(panel_6),
    CrossSection=crosec_2,
    LimitDistance_m=0.005,
    Bending=True,
    mode="MeshToShell")  # -> flatten(Element), Points, Info

# ---- group: Large Defomration Analysis
i = Slider(20, range=0..20)
ladeform = LargeDeformationAnalysisKaramba3D(Model=assemble.Model, Increments=i, MaximumDisplacement_m=-1)  # -> CalculatedModel, MaximumDisplacement_cm
panel_10 = Panel(ladeform.MaximumDisplacement_cm)

# ---- group: Assemble Model
assemble_2 = AssembleModelKaramba3D(
    Elem=flatten([surfelem.Element, lineelem_2.Element]),
    Support=flatten(supp_2),
    Load=flatten(loads_2),
    LimitDistance_m=0.005)  # -> Model, Info, Mass_kg, CentreOfGravity, LoadCaseNames
panel_11 = Panel(assemble_2.Mass_kg)

# ---- group: View Results
modelview = ModelViewKaramba3D(Model=ladeform.CalculatedModel)  # -> Model, DeformedMesh, DeformedAxes, DeformedModel, MaximumDeformation
beamview = BeamViewKaramba3D(Model=modelview.Model)  # -> Model, MeshesOfRenderedBeams, DeformedBeamAxes, LegendColours, LegendTags
legend = Legend(Colour=beamview.LegendColours, Tags=beamview.LegendTags, LegendType=101)

# ---- group: Large Deformation Analysis
i_2 = Slider(20, range=0..20)
ladeform_2 = LargeDeformationAnalysisKaramba3D(Model=assemble_2.Model, Increments=i_2, MaximumDisplacement_m=-1)  # -> CalculatedModel, MaximumDisplacement_cm
panel_12 = Panel(ladeform_2.MaximumDisplacement_cm)

# ----
demesh_2 = DeconstructMesh(Mesh=beamview.MeshesOfRenderedBeams)  # -> Vertices, Faces, Colours, Normals

# ---- group: View Results
modelview_2 = ModelViewKaramba3D(Model=ladeform_2.CalculatedModel)  # -> Model, DeformedMesh, DeformedAxes, DeformedModel, MaximumDeformation
shellview = ShellViewKaramba3D(Model=modelview_2.Model, IndexOfLayer=0)  # -> Model, MeshesOfRenderedShells, LegendColours, LegendTags
legend_2 = Legend(Colour=shellview.LegendColours, Tags=shellview.LegendTags, LegendType=1)

# ----
conmesh = ConstructMesh(Vertices=demesh_2.Vertices, Faces=demesh_2.Faces)
medges = MeshEdges(Mesh=conmesh)  # -> NakedEdges, InteriorEdges, NonManifoldEdges
preview = CustomPreview(Geometry=conmesh, Material=ColourSwatch(SwatchColor=RGB(0, 0, 255)))
preview_2 = CustomPreview(
    Geometry=[medges.NakedEdges, medges.InteriorEdges, medges.NonManifoldEdges],
    Material=ColourSwatch(SwatchColor=RGB(0, 0, 0)))
