# Grasshopper definition 02_leaf growing_2Dagents shellWithRibs_shell anemoneLoop xSecOpti.gh (Grasshopper 1.0.8)
# plug-ins: Karamba3D, Anemone, Human

# ---- group: Generate Geometry with Anemone
pt = Point([Point(-0.9611174508, -2.19377313, 0), Point(0.7549322241, -2.260050853, 0), Point(1.739545834, -1.64799244, 0), Point(2.311636746, -0.6485451574, 0), Point(2.092098324, 1.217234483, 0), Point(0.8986774865, 2.178903724, 0), Point(-0.790749374, 2.283088447, 0), Point(-1.643576659, 1.736562309, 0), Point(-2.313826079, 0.5282155833, 0), Point(-2.09290937, -1.177179737, 0)])
number_slider = Slider(20, range=0..80)
hull = ConvexHull(Points=pt, Plane=PlaneXY(0, 0, 0))  # -> Hull, HullZ, Indices
disc = Discontinuity(Curve=hull.Hull, Level=1)  # -> Points, Parameters
# 02 - Leaf Growing - Shell with Ribs - Anemone Loop
# Difficulty: Moderate | Version 3.1.4
# In this example a geometry is generated with the Anemone plugin. It's an constant growing leaf which can be analyzed in Karamba3D as a shell with ribs on the bottom. By moving the generated points from anemone a curved shell
# can be constructed. The outcome is a combined structure of shells and beams.
loop_start = LoopStart(N=number_slider, T=Button(), D1=disc.Points)  # -> port, Counter, Data, Data_2
pt_2 = Point(graft(loop_start.Data_2))
cps = ClosestPoints(Point=pt_2, Cloud=flatten(pt_2), Count=2)  # -> ClosestPoint, CPIndex, Distance
lng = ListLength(List=loop_start.Data)
num = Number(loop_start.Counter)
avr = Average(Input=flatten(pt_2))
item = ListItem(List=reverse(cps.ClosestPoint), Index=0, Wrap=True)
random = Random(Range="0 to 1.04", Number=lng, Seed=num)  # -> graft(Random)
vec2pt = Vector2Pt(PointA=pt_2, PointB=item, Unitize=False)  # -> Vector, Length
vec2pt_2 = Vector2Pt(PointA=avr, PointB=pt_2, Unitize=False)  # -> Vector, Length
expression = Expression(x=random, Expression="floor(x)")
panel = Panel("""-1
1""")
avr_2 = Average(Input=flatten(vec2pt.Length))
cull = CullPattern(List="0", CullPattern=invert(expression))
cull_2 = CullPattern(List=panel, CullPattern=expression)
expression_2 = Expression(x="-0.4", y=vec2pt.Length, z=avr_2, Expression="x*sqrt(z/y)*0.5")
multiplication = Multiplication(A=[cull, cull_2], B="0.4")
Z = UnitZ(Factor=1)
vrot = Rotate(Vector=vec2pt_2.Vector, Axis=Z, Angle=multiplication)
amp = Amplitude(Vector=vec2pt.Vector, Amplitude=expression_2)
amp_2 = Amplitude(Vector=vrot, Amplitude="1")
avr_3 = Average(Input=disc.Points)
addition = Addition(A=pt_2, B=amp, C=amp_2)
expression_3 = Expression(x=loop_start.Counter, y="1", Expression="(x+1)*y")
vec2pt_3 = Vector2Pt(PointA=avr_3, PointB=addition, Unitize=False)  # -> Vector, Length
expression_4 = Expression(x=vec2pt_3.Length, y=expression_3, c=loop_start.Counter, i=number_slider, Expression="x*(1-c/i)+y*(c/i)")
amp_3 = Amplitude(Vector=vec2pt_3.Vector, Amplitude=expression_4)
addition_2 = Addition(A=avr_3, B=amp_3)
ln = Line(StartPoint=graft(loop_start.Data_2), EndPoint=addition_2)
pt_3 = Point(addition_2)
loop_end = LoopEnd(
    port=loop_start.port,
    Exit=False,
    Data=flatten(ln),
    Data_2=flatten(pt_3),
    TimeOutVal=0,
    pausedState=False,
    state="Constant & Record")  # -> simplify(D0), simplify(D1)

# ---- group: Generate Geometry for Karamba Analysis
pline = PolyLine(Vertices=loop_end.D1, Closed=True)
crv = Curve(loop_end.D0)
pt_4 = Point(disc.Points)
explode = Explode(Curve=pline, Recursive=True)  # -> Segments, Vertices
crv_2 = Curve(flatten(crv))
previewlw = CustomPreviewLineweights(Geometry=crv, Shader=ColourSwatch(SwatchColor=RGB(255, 255, 255)), Thickness="2")
len = Length(Curve=explode.Segments)
division = Division(A=len, B=Slider(0.54, range=0.3..3))
divide = DivideCurve(Curve=explode.Segments, Count=division, Kinks=False)  # -> Points, Tangents, Parameters
merge = Merge(Data1=divide.Points, Data2=pt_4)  # -> flatten(Result)
del = DelaunayMesh(Points=merge, Plane=PlaneXY(0, 0, 0))
facen = FaceNormals(Mesh=del)  # -> Centers, Normals
incurve = PointInCurve(Point=facen.Centers, Curve=hull.Hull)  # -> Relationship, Point
cullf = CullFaces(Mesh=del, Pattern=incurve.Relationship)
pt_5 = Point(pt_4)
crv_3 = Curve(crv_2)
demesh = DeconstructMesh(Mesh=cullf)  # -> Vertices, Faces, Colours, Normals
cp = ControlPoints(Curve=crv_3)  # -> Points, Weights, Knots
fsim = FindSimilarMember(Data=cp.Points, Set=demesh.Vertices)  # -> Hit, Index
pull = PullPoint(Point=demesh.Vertices, Geometry=flatten(crv_3), ClosestOnly=True)  # -> ClosestPoint, Distance
pull_2 = PullPoint(Point=demesh.Vertices, Geometry=flatten(pt_5), ClosestOnly=True)  # -> ClosestPoint, Distance
bnd = Bounds(Numbers=pull_2.Distance)
bnd_2 = Bounds(Numbers=pull.Distance)
remap = RemapNumbers(Value=pull_2.Distance, Source=bnd, Target=Domain(0, 1))  # -> Mapped, Clipped
remap_2 = RemapNumbers(Value=pull.Distance, Source=bnd_2, Target=Domain(0, 1))  # -> Mapped, Clipped
graph = GraphMapper(
    remap.Mapped,
    x0=0,
    x1=1,
    y0=0,
    y1=1,
    container_name="Bezier",
    cpx=[0, 0.07373046875, 0.4298290312, 1],
    cpy=[0, 0.3991197348, 0.7035270333, 1])
graph_2 = GraphMapper(
    remap_2.Mapped,
    x0=0,
    x1=1,
    y0=0,
    y1=1,
    container_name="Bezier",
    cpx=[0, 0.2541899383, 0.5279329419, 1],
    cpy=[0, 0.430267036, 1, 1])
remap_3 = RemapNumbers(Value=graph, Source=Domain(0, 1), Target="0 to 3")  # -> Mapped, Clipped
remap_4 = RemapNumbers(Value=graph_2, Source=Domain(0, 1), Target="0 to 0.8")  # -> Mapped, Clipped
addition_3 = Addition(A=remap_3.Mapped, B=remap_4.Mapped)
Z_2 = UnitZ(Factor=addition_3)
addition_4 = Addition(A=Z_2, B=demesh.Vertices)
item_2 = ListItem(List=addition_4, Index=fsim.Index, Wrap=True)
pline_2 = PolyLine(Vertices=item_2, Closed=False)  # -> flatten(Polyline)
conmesh = ConstructMesh(Vertices=addition_4, Faces=demesh.Faces)

# ----
readmattable = ReadMaterialTableFromFileKaramba3D()
matselect = MaterialSelectionKaramba3D(Materials=readmattable, menu=[dropdown(9), dropdown(19)])
matselect_2 = MaterialSelectionKaramba3D(Materials=readmattable, menu=[dropdown(9), dropdown(3)])

# ---- group: Define Cross Section
range = Range(Domain="15 to 75", Steps=10)
expression_5 = Expression(x=range, Expression="round(x/4,1)")
int = Integer(range)
Z_3 = UnitZ(Factor=expr("-x/2", int))
concat = Concatenate(FragmentA="b", FragmentB=int)
crosec = CrossSectionKaramba3D(
    FamilyNameOfCrossSection="b",
    NameOfCrossSection=graft(concat),
    Material=matselect_2,
    LocalEccentricity_cm=Z_3,
    Height_cm=int,
    UpperFlangeWidth_cm=expression_5,
    LowerFlangeWidth_cm=expression_5,
    mode="Trapezoid")  # -> flatten(CrossSection)
id = Panel("b")
crosecselect = CrossSectionSelectorKaramba3D(CrossSections=crosec, ElementsIdentifiers=id)  # -> CrossSection, Info
crosec_2 = CrossSectionKaramba3D(crosecselect.CrossSection)

range_2 = Range(Domain="5 to 35", Steps=10)
int_2 = Integer(range_2)
concat_2 = Concatenate(FragmentA="s", FragmentB=int_2)
crosec_3 = CrossSectionKaramba3D(
    FamilyNameOfCrossSection="s",
    NameOfCrossSection=graft(concat_2),
    Material=matselect,
    Height_cm=graft(int_2),
    mode="Shell - Const")  # -> flatten(CrossSection)
id_2 = Panel("s")
crosecselect_2 = CrossSectionSelectorKaramba3D(CrossSections=crosec_3, ElementsIdentifiers=id_2)  # -> CrossSection, Info
crosec_4 = CrossSectionKaramba3D(crosecselect_2.CrossSection)

# ---- group: Define Elements
id_3 = Panel("s")
surfelem = CreateSurfaceElementKaramba3D(Mesh=conmesh, Identifier=id_3, CrossSection=crosec_4, LimitDistance_m=0.005, Bending=True, mode="MeshToShell")  # -> Element, Points, Info

# ---- group: Define Supports
pt_6 = Point(pt_5)
fsim_2 = FindSimilarMember(Data=pt_6, Set=flatten(surfelem.Points))  # -> Hit, Index
supp = SupportKaramba3D(PosInd=fsim_2.Hit, menu=[buttons(on, on, on, on, on, on)])  # -> flatten(Support)

# ---- group: Define Elements
id_4 = Panel("b")
lineelem = CreateLinearElementKaramba3D(
    Line=pline_2,
    Identifier=id_4,
    CrossSection=crosec_2,
    LimitDistance_m=0.005,
    BucklingLengthY_m=-1,
    BucklingLengthZ_m=-1,
    BucklingLengthLT_m=-1,
    Bending=True,
    ToPolylineMaxAngle=0.03,
    ToPolylineTolerance=0.01,
    ToPolylineMaxEdgeLength=0.25,
    New=True,
    Remove=True,
    mode="LineToBeam")  # -> Element, Points, Info

# ---- group: Define Loads
loads = LoadsKaramba3D(Vector=Vector(0, 0, -1), LCase="LC0", mode="Gravity")

# ---- group: Assemble Model
assemble = AssembleModelKaramba3D(Elem=flatten([surfelem.Element, lineelem.Element]), Support=flatten(supp), Load=flatten(loads), LimitDistance_m=0.005)  # -> Model, Info, Mass_kg, CentreOfGravity, LoadCaseNames
mass = Panel(assemble.Mass_kg)

# ---- group: Optimize Cross Section
opticrosec = OptimizeCrossSectionKaramba3D(
    Model=assemble.Model,
    CrossSections=[crosec_3, crosec],
    MaximumUtilization=1,
    MaximumDisplacement_cm=-1,
    MaximumVirtualWork_kNcm=0.01,
    NumberOfUtilizationIterations=5,
    NumberOfDisplacementIterations=5,
    NumberOfDisplacementIncrementsPerIteration=2,
    DisplacementTolerance=0.01,
    NumberOfSamplePoints=3,
    ElasticDesign=True,
    GammaM0=1,
    GammaM1=1.1,
    SwayFrame=True)  # -> OptimizedModel, Info, Mass_kg, MaximumDisplacement_cm, ElasticEnergyChange_kNm, MaximumUtilizationViewInsufficientCrossSections, MaximumDisplacementViewLimitCrossSections
mass_2 = Panel(opticrosec.Mass_kg)
displacement = Panel(opticrosec.MaximumDisplacement_cm)

# ---- group: View Results
modelview = ModelViewKaramba3D(Model=opticrosec.OptimizedModel)  # -> Model, DeformedMesh, DeformedAxes, DeformedModel, MaximumDeformation
shellview = ShellViewKaramba3D(Model=modelview.Model, IndexOfLayer=0)  # -> Model, MeshesOfRenderedShells, LegendColours, LegendTags
beamview = BeamViewKaramba3D(Model=modelview.Model)  # -> Model, MeshesOfRenderedBeams, DeformedBeamAxes, LegendColours, LegendTags
legend = Legend(Colour=beamview.LegendColours, Tags=beamview.LegendTags, LegendType=1)
legend_2 = Legend(Colour=shellview.LegendColours, Tags=shellview.LegendTags, LegendType=1)
