# Grasshopper definition 03_BESO on a 3D Network of Lines.gh (Grasshopper 1.0.8)
# plug-ins: Karamba3D

# ---- group: Input Geometry (internalized)
base_geometry = Brep(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)
support_geometry = Brep([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])
srf = Surface(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)
load = Brep(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)

# ---- group: Population of Points
pop3d = Populate3D(Region=base_geometry, Count=Slider(1000, range=0..1000), Seed=1)

# ---- group: Define Cross Section
dom = ConstructDomain(DomainStart=Slider(1, range=0..100), DomainEnd=Slider(300, range=0..300))
range = Range(Domain=dom, Steps=Slider(200, range=0..200))
multiplication = Multiplication(A=range, B=Slider(0.088, range=0..1))
crosec = CrossSectionKaramba3D(FamilyNameOfCrossSection="DefaultCroSec", Diameter_cm=range, WallThickness_cm=multiplication, mode="Circular Hollow")
item = ListItem(List=crosec, Index=0, Wrap=True)

# ---- group: Define Loads
mesh_breps = MeshBrepsKaramba3D(Brep=load, MeshResolution=1, EdgeRefinementFactor=0.67, PointReduction=False, SmoothingStepSize=0, SmoothingIterations=5)  # -> Mesh, Info
neg = Negative(Value=Slider(9, range=0..10))
Z = UnitZ(Factor=neg)
loads = LoadsKaramba3D(Vector=Z, Mesh=mesh_breps.Mesh, LCase="LC0", mode="MeshLoad -Const.", menu=[buttons(off, on, off), buttons(on, on)])

# ---- group: Define Elements
# 03 - BESO on a 3D Network of Lines
# Difficulty: Moderate | Version 3.1.4
# A referenced geometry is used to generate a 3d population of points which are connected using the proximity 3d component. There are also referenced geometries to define the support points and the load positions.
# A BESO algorithm is performed on the line elements to reduce a certain percentage of beams.
number_slider = Slider(15, range=0..100)
prox = Proximity3D(Points=pop3d, Group=number_slider)  # -> Links, Topology
lineelem = CreateLinearElementKaramba3D(
    Line=flatten(prox.Links),
    Colour=ColourSwatch(SwatchColor=RGB(0, 0, 255)),
    CrossSection=item,
    LimitDistance_m=0.005,
    BucklingLengthY_m=-1,
    BucklingLengthZ_m=-1,
    BucklingLengthLT_m=-1,
    Bending=True,
    ToPolylineMaxAngle=0.03,
    ToPolylineTolerance=0.01,
    ToPolylineMaxEdgeLength=0.25,
    New=True,
    Remove=True,
    mode="LineToBeam")  # -> Element, Points, Info

# ---- group: Define Supports
pt = Point(pop3d)
brepsinc = PointInBreps(Brep=support_geometry, Point=pt, Strict=False)  # -> Inside, Index
cull = CullPattern(List=pt, CullPattern=brepsinc.Inside)
supp = SupportKaramba3D(PosInd=cull, menu=[buttons(on, on, on, on, on, on)])

# ---- group: Assemble Model
assemble = AssembleModelKaramba3D(Elem=lineelem.Element, Support=flatten(supp), Load=flatten(loads), LimitDistance_m=0.005)  # -> Model, Info, Mass_kg, CentreOfGravity, LoadCaseNames

# ---- group: Optimize Cross Section
opticrosec = OptimizeCrossSectionKaramba3D(
    Model=assemble.Model,
    CrossSections=crosec,
    MaximumUtilization=1,
    MaximumVirtualWork_kNcm=0.01,
    NumberOfUtilizationIterations=5,
    NumberOfDisplacementIterations=5,
    NumberOfDisplacementIncrementsPerIteration=2,
    DisplacementTolerance=0.01,
    NumberOfSamplePoints=3,
    ElasticDesign=True,
    GammaM0=1,
    GammaM1=1.1,
    SwayFrame=True)  # -> OptimizedModel, Info, Mass_kg, MaximumDisplacement_cm, ElasticEnergyChange_kNm, MaximumUtilizationViewInsufficientCrossSections, MaximumDisplacementViewLimitCrossSections
displacement = Panel(opticrosec.MaximumDisplacement_cm)

# ---- group: BESOBeam
besobeam = BESOForBeamsKaramba3D(
    Model=opticrosec.OptimizedModel,
    TargetVolumeRatio=Slider(0.7, range=0..1),
    NumberOfChangeIterations=10,
    NumberOfConvergenceIterations=20,
    WeightingFactorForTension=1,
    WeightingFactorForCompression=1,
    WeightingFactorForShear=0,
    WeightingFactorForMoments=0,
    BESOFactor=0,
    MinimumDistanceBetweenChangingElements=0,
    RelativeWeightLimit=0)  # -> MaximumDisplacement_cm, OptimizedModel, HistoryOfTheBESO, ElementIsActive, DistributionOfWeights

# ---- group: View Results
modelview = ModelViewKaramba3D(Model=besobeam.OptimizedModel)  # -> Model, DeformedMesh, DeformedAxes, DeformedModel, MaximumDeformation
beamview = BeamViewKaramba3D(Model=modelview.Model)  # -> Model, MeshesOfRenderedBeams, DeformedBeamAxes, LegendColours, LegendTags
edges = BrepEdges(Brep=[base_geometry, load, support_geometry])  # -> Naked, Interior, NonManifold
swatch = ColourSwatch(SwatchColor=RGB(0, 4, 0))
legend = Legend(Colour=beamview.LegendColours, Tags=beamview.LegendTags, LegendType=1)

# ----
preview = CustomPreview(Geometry=[edges.Naked, edges.Interior], Material=swatch)
