# Grasshopper definition 03_BESOBracingWalls.gh (Grasshopper 1.0.7)
# Copyright: Karamba3D
# plug-ins: Karamba3D

# ---- group: Create Geometry
pt = Point(Point(0, 0, 4))
panel = Panel("""0.25
0.75
0.5""")
panel_2 = Panel("""0.25
0.25
0.75""")
wall_2 = Slider(0.691, range=0..1)
wall_3 = Slider(0.284, range=0..1)
wall_1 = Slider(0.692, range=0..1)
planesrf = PlaneSurface(Plane=pt, XSize="-10 to 10", YSize="-10 to 10")
vec = VectorXYZ(XComponent=panel, YComponent=panel_2, ZComponent=0)  # -> Vector, Length
evalsrf = EvaluateSurface(Surface=reparameterize(planesrf), Point=vec.Vector)  # -> Point, Normal, UDirection, VDirection, Frame
expression = Expression(x=[wall_1, wall_2, wall_3], Expression="x*pi")
deplane = DeconstructPlane(Plane=evalsrf.Frame)  # -> Origin, XAxis, YAxis, ZAxis
vrot = Rotate(Vector=deplane.XAxis, Axis=deplane.ZAxis, Angle=expression)
Z = UnitZ(Factor=-1)
# 03 - BESO of Bracing Walls
# Difficulty: Moderate | Version 3.1.4
# The effect of the orientation of three walls on their effectiveness as bracing elements for horizontal loads on a floor plate. There are three load cases: wind in X and Y-direction and vertical point loads. Contains a workaround to display
# the loadcase with the largest deformance. Topology resulting from applying the BESO for Beams component to the structure begins to eliminate certain members.
pl = ConstructPlane(Origin=evalsrf.Point, XAxis=vrot, YAxis=Z)
devec = DeconstructVector(Vector=pt)  # -> XComponent, YComponent, ZComponent
planesrf_2 = PlaneSurface(Plane=pl, XSize="-2 to 2", YSize=devec.ZComponent)
sdivide = DivideSurface(Surface=planesrf, UCount="20", VCount="20")  # -> Points, Normals, Parameters
sdivide_2 = DivideSurface(Surface=planesrf_2, UCount="4", VCount="4")  # -> Points, Normals, Parameters
pull = PullPoint(Point=sdivide.Points, Geometry=planesrf_2, ClosestOnly=True)  # -> ClosestPoint, Distance
larger = LargerThan(FirstNumber=pull.Distance, SecondNumber="0.8")  # -> LargerThan, OrEqualTo
item = ListItem(List=reverse(sdivide_2.Points), Index=0, Wrap=True)  # -> flatten(Item)
trim = TrimTree(Tree=simplify(sdivide_2.Points), Depth=1)
item_2 = ListItem(List=sdivide_2.Points, Index=0, Wrap=True)
cull = CullPattern(List=sdivide.Points, CullPattern=larger.LargerThan)
prox = Proximity3D(Points=flatten([cull, item_2]), Group="9", MaxRadius="1.9")  # -> Links, Topology
prox_2 = Proximity3D(Points=trim, Group="9", MaxRadius="1.9")  # -> Links, Topology
trim_2 = TrimTree(Tree=simplify(prox_2.Links), Depth=1)
cluster = Cluster(L=flatten(prox.Links), P=pt)  # -> A, B
cluster_2 = Cluster(L=trim_2, P=graft(planesrf_2))  # -> A, B
entwine = Entwine(Branch00=cluster.A, Branch01=cluster.B, Branch02=cluster_2.A, Branch03=cluster_2.B, FlattenInputs=True)

cluster_3 = Cluster_2(C=[planesrf, planesrf_2])  # -> F, P, P_2
aligndim = AlignedDimension(
    Plane=cluster_3.F,
    PointA=cluster_3.P,
    PointB=cluster_3.P_2,
    Offset=Slider(1.4, range=0..10),
    Text="{0:0.00}",
    Size=Slider(0.54, range=0..1))

# ---- group: Define Materials
matselect = MaterialSelectionKaramba3D(menu=[dropdown(1), dropdown(2)])

# ---- group: Define Cross Sections
range = Range(Domain="5 to 75", Steps=10)
expression_2 = Expression(x=range, Expression="x*0.05")
crosec = CrossSectionKaramba3D(
    FamilyNameOfCrossSection="DefaultCroSec",
    Material=matselect,
    Height_cm=range,
    UpperFlangeWidth_cm=range,
    LowerFlangeWidth_cm=range,
    UpperFlangeThickness_cm=expression_2,
    LowerFlangeThickness_cm=expression_2,
    SidewallsThickness_cm=expression_2,
    FilletRadius_cm=0.6,
    mode="Box")
crosecselect = CrossSectionSelectorKaramba3D(CrossSections=crosec)  # -> CrossSection, Info

# ---- group: Define Elements
panel_3 = Panel("""1
0
1
0""")
panel_4 = Panel("""A
B
C
D""")
lineelem = CreateLinearElementKaramba3D(
    Line=entwine,
    Identifier=graft(panel_4),
    CrossSection=crosecselect.CrossSection,
    LimitDistance_m=0.005,
    BucklingLengthY_m=-1,
    BucklingLengthZ_m=-1,
    BucklingLengthLT_m=-1,
    Bending=graft(panel_3),
    ToPolylineMaxAngle=0.03,
    ToPolylineTolerance=0.01,
    ToPolylineMaxEdgeLength=0.25,
    New=True,
    Remove=True,
    mode="LineToBeam")  # -> Element, Points, Info

# ---- group: Define Supports
supp = SupportKaramba3D(PosInd=item, menu=[buttons(on, on, on, off, off, off)])

# ---- group: Define Loads
pt_2 = Point(sdivide.Points)
flip = FlipMatrix(Data=pt_2)
item_3 = ListItem(List=flip, Index=0, Wrap=True)
item_4 = ListItem(List=pt_2, Index=0, Wrap=True)
panel_5 = Panel("""50,0,0
0,50,0""")
entwine_2 = Entwine(Branch00=item_3, Branch01=item_4, FlattenInputs=True)
panel_6 = Panel("""LC0
LC1""")
loads = LoadsKaramba3D(Vector=Vector(0, 0, -1), LCase=panel_6, mode="Gravity")

# ----
loads_2 = LoadsKaramba3D(ForceVector=graft(panel_5), Local=False, PosInd=entwine_2, LCase=graft(panel_6), mode="Point")

# ---- group: Define Loads (continued)
load = LoadKaramba3D(flatten([loads_2, loads]))

# ---- group: Assemble Model
assemble = AssembleModelKaramba3D(Elem=flatten(lineelem.Element), Support=supp, Load=flatten(load), LimitDistance_m=0.005)  # -> Model, Info, Mass_kg, CentreOfGravity, LoadCaseNames

# ---- group: BESO
number_slider = Slider(0.3, range=0..1)
panel_7 = Panel("""LC0
LC1""")
panel_8 = Panel("""B
D""")
besobeam = BESOForBeamsKaramba3D(
    Model=assemble.Model,
    ElemIdentifiers=panel_8,
    LoadCases=panel_7,
    TargetMassRatio=number_slider,
    NumberOfChangeIterations="3",
    NumberOfConvergenceIterations="0",
    WeightingFactorForTension=1,
    WeightingFactorForCompression=1,
    WeightingFactorForShear=0,
    WeightingFactorForMoments=0,
    BESOFactor=0,
    MinimumDistanceBetweenChangingElements=0,
    RelativeWeightLimit=0)  # -> MaximumDisplacement_cm, OptimizedModel, HistoryOfTheBESO, ElementIsActive, DistributionOfWeights

# ---- group: Optimize Cross Sections
opticrosec = OptimizeCrossSectionKaramba3D(
    Model=besobeam.OptimizedModel,
    CrossSections=crosec,
    MaximumUtilization="0.7",
    MaximumVirtualWork_kNcm=0.01,
    NumberOfUtilizationIterations=5,
    NumberOfDisplacementIterations=5,
    NumberOfDisplacementIncrementsPerIteration=2,
    DisplacementTolerance=0.01,
    NumberOfSamplePoints=3,
    ElasticDesign=True,
    GammaM0=1,
    GammaM1=1.1,
    SwayFrame=True)  # -> OptimizedModel, Info, Mass_kg, MaximumDisplacement_cm, ElasticEnergyChange_kNm, MaximumDisplacementViewLimitCrossSections, MaximumUtilizationViewInsufficientCrossSections
panel_9 = Panel(opticrosec.MaximumDisplacement_cm)
select_highest_loadcase = SelectHighestLoadcase(K=opticrosec.MaximumDisplacement_cm)

# ---- group: View Results
modelview = ModelViewKaramba3D(Model=opticrosec.OptimizedModel, LoadCase=select_highest_loadcase)  # -> Model, DeformedMesh, DeformedAxes, DeformedModel, MaximumDeformation
beamview = BeamViewKaramba3D(Model=modelview.Model)  # -> Model, MeshesOfRenderedBeams, DeformedBeamAxes, LegendColours, LegendTags
legend = Legend(Colour=beamview.LegendColours, Tags=beamview.LegendTags, LegendType=1)

# ==== cluster Cluster
L = ClusterInput()
P = ClusterInput()
rdlines = RemoveDuplicateLinesKaramba(Line=L, LimitDistance=0.005)  # -> OutLine, Info, Indexes
deplane = DeconstructPlane(Plane=P)  # -> Origin, XAxis, YAxis, ZAxis
angle = Angle(VectorA=rdlines.OutLine, VectorB=deplane.XAxis)  # -> Angle, Reflex
expression = Expression(x=angle.Angle, Expression="(x+0.3)%(pi/2)<0.5")
dispatch = Dispatch(List=rdlines.OutLine, DispatchPattern=expression)  # -> ListA, ListB
A = ClusterOutput(dispatch.ListA)
B = ClusterOutput(dispatch.ListB)

# ==== cluster Cluster_2
C = ClusterInput()
bbox = BoundingBox(Content=C, Plane=PlaneXY(0, 0, 0), UnionBox=True)  # -> Box, Box_2
debrep = DeconstructBrep(Brep=bbox.Box)  # -> Faces, Edges, Vertices
panel = Panel("""4
4
3""")
item = ListItem(List=flatten(debrep.Faces), Index=panel, Wrap=True)
panel_2 = Panel("""0,0,0
0,1,0
1,1,0""")
panel_3 = Panel("""0,1,0
1,1,0
1,0,0""")
evalsrf = EvaluateSurface(Surface=reparameterize(item), Point=panel_2)  # -> Point, Normal, UDirection, VDirection, Frame
evalsrf_2 = EvaluateSurface(Surface=reparameterize(item), Point=panel_3)  # -> Point, Normal, UDirection, VDirection, Frame
F = ClusterOutput(evalsrf_2.Frame)
P = ClusterOutput(evalsrf.Point)
P_2 = ClusterOutput(evalsrf_2.Point)

# ==== cluster SelectHighestLoadcase
K = ClusterInput()
lng = ListLength(List=K)
series = Series(Start=0, Step=1, Count=lng)
sort = SortList(Keys=K, ValuesA=series)  # -> Keys, ValuesA
item = ListItem(List=reverse(sort.ValuesA), Index=0, Wrap=True)
i = ClusterOutput(item)
