# Grasshopper definition 03_Optimization_InclinedColumnPositions.gh (Grasshopper 1.0.7)
# plug-ins: Karamba3D, Octopus

# ---- group: Create Geometry
genes = GenePool(
    Decimals=2,
    Maximum=1,
    Minimum=0,
    Value=[0.665057336, 0.7077662486, 0.1745052601, 0.4113113332, 0.6070020028, 0.83, 0.2847266512, 0.234322781, 0.05803681769, 0.04016988055, 0.8630773999, 0.5202322027, 0.3532711247, 0.8044202345, 0.7323035874, 0.8809566366, 0.9537981276, 0.2454335597, 0.6324080497, 0.391114483])
genes_2 = GenePool(
    Decimals=2,
    Maximum=1,
    Minimum=0,
    Value=[0.04004128913, 0.09347920476, 0.5730534145, 0.89, 0.3802742397, 0.7345801615, 0.4802135903, 0.1309763088, 0.9488566339, 0.9626441298, 0.2623109883, 0.1368457183, 0.7142720111, 0.765837049, 0.09710815101, 0.3887123712, 0.4905778314, 0.1193665021, 0.9254428342, 0.2234916698])
remap = RemapNumbers(Value=genes_2, Source=Domain(0, 1), Target="0.15 to 0.85")  # -> Mapped, Clipped
remap_2 = RemapNumbers(Value=genes, Source=Domain(0, 1), Target="-3.5 to 3.5")  # -> Mapped, Clipped
# 03 - Optimization of Inclined Column Positions
# Difficulty: Hard | Version 3.1.4
# The position of inclined columns for a shell roof structure is optimized. This shows how beams and shells are integrated into a single model.
# 3d shapes are used during the optimization to reduce the columns from intersecting predefined regions. The surface, boxes and region of columns can be altered.
srf = Surface(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)
dispatch = Dispatch(List=remap.Mapped, DispatchPattern=[True, False])  # -> ListA, ListB
vec = VectorXYZ(XComponent=dispatch.ListA, YComponent=dispatch.ListB, ZComponent=0)  # -> Vector, Length
evalsrf = EvaluateSurface(Surface=reparameterize(srf), Point=vec.Vector)  # -> Point, Normal, UDirection, VDirection, Frame
devec = DeconstructVector(Vector=evalsrf.Point)  # -> XComponent, YComponent, ZComponent
dispatch_2 = Dispatch(List=remap_2.Mapped, DispatchPattern=[True, False])  # -> ListA, ListB
crv = Curve(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)
sdivide = DivideSurface(Surface=srf, UCount=1, VCount=1)  # -> flatten(Points), Normals, Parameters
addition = Addition(A=devec.XComponent, B=dispatch_2.ListA)
addition_2 = Addition(A=devec.YComponent, B=dispatch_2.ListB)
item = ListItem(List=sdivide.Points, Index=0, Wrap=True)  # -> Item, Item1, Item2, Item3
pt = ConstructPoint(XCoordinate=addition, YCoordinate=addition_2, ZCoordinate=0)
boundary = BoundarySurfaces(Edges=crv)
r = Slider(1.5, range=0.5..4)
pull = PullPoint(Point=pt, Geometry=boundary, ClosestOnly=True)  # -> ClosestPoint, Distance
preview = CustomPreview(Geometry=boundary, Shader=ColourSwatch(SwatchColor=RGB(207, 207, 207)))
aligndim = AlignedDimension(
    Plane=PlaneXY(0, 0, 0),
    PointA=[item.Item, item.Item2],
    PointB=[item.Item1, item.Item],
    Offset=4,
    Text="{0:0.00}",
    Size=1)
pt_2 = Point(evalsrf.Point)
mesh_breps = MeshBrepsKaramba3D(
    Brep=srf,
    InclusionPoints=pt_2,
    MeshResolution=r,
    EdgeRefinementFactor=0.67,
    PointReduction=False,
    SmoothingStepSize=0.8,
    SmoothingIterations=5)  # -> Mesh, Info
ln = Line(StartPoint=pt_2, EndPoint=pull.ClosestPoint)

# ---- group: Define Materials
matselect = MaterialSelectionKaramba3D(menu=[dropdown(1), dropdown(2)])

matselect_2 = MaterialSelectionKaramba3D(menu=[dropdown(9), dropdown(19)])

# ---- group: Define Cross Sections
range = Range(Domain="5 to 35", Steps=10)
concat = Concatenate(FragmentA="r", FragmentB=range)
crosec = CrossSectionKaramba3D(
    FamilyNameOfCrossSection="r",
    NameOfCrossSection=concat,
    Material=matselect,
    Diameter_cm=range,
    WallThickness_cm=expr("x*0.1", range),
    mode="Circular Hollow")
crosecselect = CrossSectionSelectorKaramba3D(CrossSections=crosec)  # -> CrossSection, Info

range_2 = Range(Domain="5 to 55", Steps=10)
concat_2 = Concatenate(FragmentA="shell", FragmentB=range_2)
crosec_2 = CrossSectionKaramba3D(
    FamilyNameOfCrossSection="shell",
    NameOfCrossSection=graft(concat_2),
    Material=matselect_2,
    Height_cm=graft(range_2),
    mode="Shell - Const")  # -> flatten(CrossSection)
crosecselect_2 = CrossSectionSelectorKaramba3D(CrossSections=crosec_2)  # -> CrossSection, Info

# ----
panel = Panel("""LCC=Gravity+Snow
LCC1=Gravity +(Wind_x0|Wind_y0|Wind_x1|Wind_y1)
LCC2= Gravity+(Wind_y2|Wind_y3)""")

# ---- group: Define Joints
beam_joints = BeamJointsKaramba3D(
    BeamIdentifier="b",
    CtKNMAtStartingNode=Vector(0, 0, 0),
    CrKNmRadAtStartingNode="{0,1,1}",
    CtKNMAtEndNode=Vector(0, 0, 0),
    CrKNmRadAtEndNode=Vector(0, 0, 0),
    menu=[buttons(off, off, off, off, on, on), buttons(off, off, off, off, off, off)])

# ----
panel_2 = Panel("""Wind_y2
Wind_y3""")
panel_3 = Panel("""Snow
Wind_x0
Wind_y0
Wind_x1
Wind_y1""")

# ---- group: Define Elements
lineelem = CreateLinearElementKaramba3D(
    Line=ln,
    Identifier="b",
    CrossSection=crosecselect.CrossSection,
    LimitDistance_m=0.005,
    BucklingLengthY_m=-1,
    BucklingLengthZ_m=-1,
    BucklingLengthLT_m=-1,
    Bending=True,
    ToPolylineMaxAngle=0.03,
    ToPolylineTolerance=0.01,
    ToPolylineMaxEdgeLength=0.25,
    New=True,
    Remove=True,
    mode="LineToBeam")  # -> Element, Points, Info
surfelem = CreateSurfaceElementKaramba3D(
    Mesh=mesh_breps.Mesh,
    Identifier="s",
    CrossSection=crosecselect_2.CrossSection,
    LimitDistance_m=0.005,
    Bending=True,
    mode="MeshToShell")  # -> Element, Points, Info

# ---- group: Define Supports
supp = SupportKaramba3D(PosInd=pull.ClosestPoint, menu=[buttons(on, on, on, off, off, off)])

# ----
lccombinator = LoadCaseCombinatorKaramba3D(LoadCaseCombinationRulesKaramba3D=panel)  # -> LoadCaseCombinations, NamesOfLoadCases, NumberOfLoadCases
panel_4 = Panel(lccombinator.LoadCaseCombinations)
panel_5 = Panel("""LCC
LCC1
LCC2""")

# ---- group: Define Loads
panel_6 = Panel("""{0,-2,0}
{0,2,0}""")
subsrf = Isotrim(Surface=reparameterize(srf), Domain=[Domain2(u=0..0.5, v=0..1), Domain2(u=0.5..1, v=0..1)])
panel_7 = Panel("{0,0,1.35}")
panel_8 = Panel("""{0,0,-1}
{2,0,0}
{0,2,0}
{-2,0,0}
{0,-2,0}""")
mesh = MeshBrep(
    Brep=subsrf,
    Settings={GridMaxCount=0, GridMinCount=16, JaggedSeams=False, MaxEdgeLength=0, MinEdgeLength=0.0001, MinTolerance=0, Refine=True, RefineAngle=0, RelativeTolerance=0.65, SimplePlanes=True, Tolerance=0})
partition = PartitionList(List=panel_6, Size=2)
loads = LoadsKaramba3D(
    Vector=panel_8,
    Mesh=mesh_breps.Mesh,
    LCase=panel_3,
    mode="MeshLoad -Const.",
    menu=[buttons(off, off, on), buttons(on, off)])
loads_2 = LoadsKaramba3D(
    Vector=partition,
    Mesh=mesh,
    LCase=graft(panel_2),
    mode="MeshLoad -Const.",
    menu=[buttons(off, off, on), buttons(on, off)])

# ----
loads_3 = LoadsKaramba3D(Vector=panel_7, LCase="Gravity", mode="Gravity")
merge = Merge(Data1=flatten(loads_3), Data2=flatten(loads), Data3=flatten(loads_2), Data4=flatten(lccombinator.LoadCaseCombinations))

# ---- group: Define Loads (continued)
load = LoadKaramba3D(flatten(merge))

# ---- group: Assemble Model
assemble = AssembleModelKaramba3D(Elem=flatten([lineelem.Element, surfelem.Element]), Support=supp, Load=load, Joint=beam_joints, LimitDistance_m=0.005)  # -> Model, Info, Mass_kg, CentreOfGravity, LoadCaseNames

# ---- group: Optimize Cross Sections
max_deformation = Panel("900/150")
opticrosec = OptimizeCrossSectionKaramba3D(
    Model=assemble.Model,
    CrossSections=flatten([crosec_2, crosec]),
    MaximumUtilization=1,
    LoadCasesUtil=panel_5,
    MaximumDisplacement_cm=max_deformation,
    LoadCasesDisp=panel_5,
    MaximumVirtualWork_kNcm=0.01,
    NumberOfUtilizationIterations=5,
    NumberOfDisplacementIterations=5,
    NumberOfDisplacementIncrementsPerIteration=2,
    DisplacementTolerance=0.01,
    NumberOfSamplePoints=3,
    ElasticDesign=True,
    GammaM0=1,
    GammaM1=1.1,
    SwayFrame=True)  # -> OptimizedModel, Info, Mass_kg, MaximumDisplacement_cm, ElasticEnergyChange_kNm, MaximumUtilizationViewInsufficientCrossSections, MaximumDisplacementViewLimitCrossSections
panel_9 = Panel(opticrosec.MaximumDisplacement_cm)

# ---- group: Multi Objective Optimization with Octopus - mass, conflicts with 3d shapes, distribution of column positions
mesh_2 = Mesh([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])
con = DelaunayEdges(Points=pull.ClosestPoint, Plane=PlaneXY(0, 0, 0))  # -> Connectivity, Edges
preview_2 = CustomPreview(Geometry=mesh_2, Shader=ColourSwatch(SwatchColor=RGBA(255, 255, 255, 168)))
len = Length(Curve=con.Edges)
mjoin = MeshJoin(Meshes=mesh_2)
preview_3 = CustomPreview(Geometry=con.Edges, Shader=ColourSwatch(SwatchColor=RGB(115, 115, 115)))
sort = SortList(Keys=len)  # -> Keys, ValuesA
mcx = MeshCurve(Mesh=mjoin, Curve=ln)  # -> flatten(Points), Faces
item_2 = ListItem(List=sort.Keys, Index=0, Wrap=True)
lng = ListLength(List=mcx.Points)  # -> expr("x/2", Length)
neg = Negative(Value=item_2)
num = Number(opticrosec.Mass_kg)
merge_2 = Merge(Data1=flatten(num), Data2=flatten(lng), Data3=flatten(neg))
octopus = Octopus(Phenotype=mjoin, OctopusData_gene=[genes, genes_2], OctopusData_obj=[num_2, txt])
num_2 = Number(merge_2)
panel_10 = Panel(num_2)
panel_11 = Panel("""total Mass
Conflicts
Distribution""")
txt = Text(panel_11)

# ---- group: Analyze Model
panel_12 = Panel("""LCC
LCC1
LCC2""")
analyse = AnalyseKaramba3D(Model=opticrosec.OptimizedModel, LoadCases=panel_12)  # -> AnalysedModel, MaximumDisplacement_cm, ResultingForce_kN, ChangeOfElasticEnergy_kNm

# ---- group: Single Objective Optimization with Galapagos - max. Displacement
num_3 = Number(opticrosec.MaximumDisplacement_cm)
sort_2 = SortList(Keys=num_3)  # -> Keys, ValuesA
item_3 = ListItem(List=reverse(sort_2.Keys), Index=0, Wrap=True)
galapagos = Galapagos(fitness=num_4, gene=[genes, genes_2])
num_4 = Number(item_3)
panel_13 = Panel(num_4)

# ---- group: View Results
resultselect = LoadCaseSelectorKaramba3D(
    Model=analyse.AnalysedModel,
    menu=[buttons(on, on), dropdown(0), dropdown(0), buttons(off, off, off, off, off, off, off), buttons(off, off, off, off, off, off), buttons(off, off, off, off, off, off, off, off), buttons(off, off, off, off, off, off, off, off)])  # -> Model, LoadCaseSelection
modelview = ModelViewKaramba3D(Model=resultselect.Model)  # -> Model, DeformedMesh, DeformedAxes, DeformedModel, MaximumDeformation
shellview = ShellViewKaramba3D(Model=modelview.Model, IndexOfLayer=0)  # -> Model, MeshesOfRenderedShells, LegendColours, LegendTags
beamview = BeamViewKaramba3D(Model=modelview.Model)  # -> Model, MeshesOfRenderedBeams, DeformedBeamAxes, LegendColours, LegendTags
legend = Legend(Colour=beamview.LegendColours, Tags=beamview.LegendTags, LegendType=1)
legend_2 = Legend(Colour=shellview.LegendColours, Tags=shellview.LegendTags, LegendType=1)
