# Grasshopper definition 03_Optimization_ShapeIrregularStructure.gh (Grasshopper 1.0.7)
# plug-ins: Karamba3D

# ---- group: Create Geometry
genes = GenePool(
    Decimals=2,
    Maximum=1,
    Minimum=0,
    Value=[0.08000850635, 0.6540338451, 0.980623988, 0.7280643986, 0.5604807975, 0.2355916804, 0.9494151016, 0.8688447773, 0.01587234718, 0.1598064802])
pt = Point(Point(106.0890811, 73.08763888, 0))
planesrf = PlaneSurface(Plane=pt, XSize=Domain(0, 10), YSize=Domain(0, 10))
preview = CustomPreview(Geometry=planesrf, Shader=ColourSwatch(SwatchColor=RGBA(168, 168, 168, 67)))
sdivide = DivideSurface(Surface=planesrf, UCount=1, VCount=1)  # -> flatten(Points), Normals, Parameters
dispatch = Dispatch(List=genes, DispatchPattern=[True, False])  # -> ListA, ListB
Z = UnitZ(Factor=10)
item = ListItem(List=sdivide.Points, Index=0, Wrap=True)  # -> Item, Item1, Item2
pt_2 = ConstructPoint(XCoordinate=dispatch.ListA, YCoordinate=dispatch.ListB, ZCoordinate=0)
# 03 - Optimization of an Irregular Structure
# Difficulty: Moderate | Version 3.1.4
# A grid of beams is supported at five points. Columns from the base to the roof grid are stitched using Element Felting creating irregularity within the structure.
# The position of the support positions is optimized using galapagos based on the deflection.
move = Move(Geometry=planesrf, Motion=Z)  # -> Geometry, Transform
evalsrf = EvaluateSurface(Surface=reparameterize(planesrf), Point=pt_2)  # -> Point, Normal, UDirection, VDirection, Frame
aligndim = AlignedDimension(
    Plane=PlaneXY(0, 0, 0),
    PointA=[item.Item, item.Item2],
    PointB=[item.Item1, item.Item],
    Offset=1,
    Text="{0:0.00}",
    Size=0.5)
sdivide_2 = DivideSurface(Surface=move.Geometry, UCount=Slider(6, range=2..10), VCount=Slider(6, range=2..10))  # -> Points, Normals, Parameters
flip = FlipMatrix(Data=sdivide_2.Points)
pline = PolyLine(Vertices=sdivide_2.Points, Closed=False)
pline_2 = PolyLine(Vertices=flip, Closed=False)
explode = Explode(Curve=[pline_2, pline], Recursive=True)  # -> Segments, Vertices
cp = ClosestPoint(Point=evalsrf.Point, Cloud=flatten(explode.Vertices))  # -> ClosestPoint, CPIndex, Distance
ln = Line(StartPoint=cp.ClosestPoint, EndPoint=evalsrf.Point)
entwine = Entwine(Branch00=explode.Segments, Branch01=ln, FlattenInputs=True)

# ---- group: Define Cross Sections
crosec = CrossSectionKaramba3D(
    FamilyNameOfCrossSection="DefaultCroSec",
    Material=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,
    Diameter_cm="30",
    WallThickness_cm="2",
    mode="Circular Hollow")

# ---- group: Define Loads
Z_2 = UnitZ(Factor="-2")
loads = LoadsKaramba3D(Vector=Vector(0, 0, -1), LCase="LC0", mode="Gravity")
loads_2 = LoadsKaramba3D(ForceVector=Z_2, Local=False, PosInd=explode.Vertices, LCase="LC0", mode="Point")
load = LoadKaramba3D([loads, loads_2])

# ---- group: Define Elements
panel = Panel("""roof
columns""")
lineelem = CreateLinearElementKaramba3D(
    Line=entwine,
    Identifier=graft(panel),
    CrossSection=crosec,
    LimitDistance_m=0.005,
    BucklingLengthY_m=-1,
    BucklingLengthZ_m=-1,
    BucklingLengthLT_m=-1,
    Bending=True,
    ToPolylineMaxAngle=0.03,
    ToPolylineTolerance=0.01,
    ToPolylineMaxEdgeLength=0.25,
    New=True,
    Remove=True,
    mode="LineToBeam")  # -> Element, Points, Info

# ---- group: Define Supports
supp = SupportKaramba3D(PosInd=evalsrf.Point, menu=[buttons(on, on, on, off, off, off)])

# ---- group: Assemble Model
assemble = AssembleModelKaramba3D(Elem=flatten(lineelem.Element), Support=supp, Load=flatten(load), LimitDistance_m=0.005)  # -> Model, Info, Mass_kg, CentreOfGravity, LoadCaseNames

# ---- group: Apply Element Felting
elemfelting = ElementFeltingKaramba3D(
    Model=assemble.Model,
    LimitDistance=Slider(7.4, range=0.5..10),
    SnapLength=Slider(0.5, range=0.05..0.5),
    MaximumElementLength=-1,
    StartingElementIndex=0,
    MaximumNumberOfConnections=-1)

# ---- group: Analyse Model
analyse = AnalyseKaramba3D(Model=elemfelting)  # -> AnalysedModel, MaximumDisplacement_cm, ResultingForce_kN, ChangeOfElasticEnergy_kNm

# ---- group: Optimisation of Form with Galapagos
galapagos = Galapagos(fitness=displace, gene=genes)
displace = Number(analyse.MaximumDisplacement_cm)
panel_2 = Panel(displace)

# ---- group: View Results
modelview = ModelViewKaramba3D(Model=analyse.AnalysedModel)  # -> Model, DeformedMesh, DeformedAxes, DeformedModel, MaximumDeformation
beamview = BeamViewKaramba3D(Model=modelview.Model)  # -> Model, MeshesOfRenderedBeams, DeformedBeamAxes, LegendColours, LegendTags
