# Grasshopper definition 03_Optimization_ShellBridge.gh (Grasshopper 1.0.7)
# plug-ins: Karamba3D, Octopus

# ---- group: Create Geometry
bridgecrosssectionheight = Slider(10, range=2..10)
pt = Point(Point(-29.62751221, -3.508493978, 0))
pt_2 = Point(Point(30.37248779, -3.508493978, 0))
width_supports = Slider(5, range=5..20)
additionalwidth_center = Slider(5.4, range=5..10)
archheight = Slider(10, range=5..10)
aligndim = AlignedDimension(Plane=PlaneXY(0, 0, 0), PointA=pt, PointB=pt_2, Offset=-1, Text="{0:0.00}", Size=1)
addition = Addition(A=archheight, B=bridgecrosssectionheight)
addition_2 = Addition(A=width_supports, B=additionalwidth_center)
merge = Merge(Data1=archheight, Data2=addition)
# 03 - Optimization of Shell Bridge
# Difficulty: Moderate | Version 3.1.4
# This definition uses Octopus to find the optimal height and width of a concrete shell bridge based on the deflection, weight and height. The octopus component contains some sample iterations.
vec2pt = Vector2Pt(PointA=pt, PointB=pt_2, Unitize=False)  # -> Vector, Length
multiplication = Multiplication(A=addition_2, B=-1)
multiplication_2 = Multiplication(A=width_supports, B=-1)
panel = Panel("""1
0
0
1""")
series = Series(Start=expr("-x/2", width_supports), Step=expr("x/3", width_supports), Count=4)
merge_2 = Merge(Data1=multiplication, Data2=multiplication_2, Data3=width_supports, Data4=addition_2)
align = AlignPlane(Plane=pt, Direction=vec2pt.Vector)  # -> Plane, Angle
range = Range(Domain=vec2pt.Length, Steps="4")
item = ListItem(List=merge, Index=panel, Wrap=True)
entwine = Entwine(Branch00=series, Branch01=merge_2, Branch02=merge_2, Branch03=merge_2, Branch04=series, FlattenInputs=True)
entwine_2 = Entwine(Branch00="0", Branch01=item, Branch02=item, Branch03=item, Branch04="0", FlattenInputs=True)
pt_3 = PointOriented(BasePlane=graft(align.Plane), UComponent=graft(range), VComponent=entwine, WComponent=entwine_2)  # -> simplify(Point)
nurbs = NurbsCurve(Vertices=pt_3, Degree=3, Periodic=False)  # -> Curve, Length, Domain
loft = Loft(
    Curves=flatten(nurbs.Curve),
    Options={Adjust=False, Closed=False, LoftEnds=0, LoftSimp=0, LoftType=1, Rebuild=10, Refit=0.01})
panel_2 = Panel("""{0.0,1.0,0.0}
{1.0,0.0,0.0}
{1.0,1.0,0.0}
{0.0,0.0,0.0}""")
srf = Surface(loft)
res = Slider(3, range=0.5..6)
evalsrf = EvaluateSurface(Surface=reparameterize(srf), Point=panel_2)  # -> Point, Normal, UDirection, VDirection, Frame
mesh_breps = MeshBrepsKaramba3D(
    Brep=srf,
    InclusionPoints=evalsrf.Point,
    MeshResolution=res,
    EdgeRefinementFactor=0.67,
    PointReduction=False,
    SmoothingStepSize=0,
    SmoothingIterations=5)  # -> Mesh, Info

# ---- group: Define Materials
matselect = MaterialSelectionKaramba3D(menu=[dropdown(7), dropdown(6)])

# ---- group: Define Cross Sections
range_2 = Range(Domain="5 to 100", Steps=10)
expression = Expression(x="Shell", y=range_2, Expression="x&\" \"&y")
crosec = CrossSectionKaramba3D(
    FamilyNameOfCrossSection="Shell",
    NameOfCrossSection=graft(expression),
    Material=matselect,
    Height_cm=graft(range_2),
    mode="Shell - Const")  # -> flatten(CrossSection)
crosecselect = CrossSectionSelectorKaramba3D(CrossSections=crosec)  # -> CrossSection, Info

# ---- group: Define Loads
Z = UnitZ(Factor="-2")
mesh = Mesh(mesh_breps.Mesh)
loads = LoadsKaramba3D(Vector=Vector(0, 0, -1), LCase="LC0", mode="Gravity")
loads_2 = LoadsKaramba3D(Vector=Z, Mesh=mesh, LCase="LC0", mode="MeshLoad -Const.", menu=[buttons(off, on, off), buttons(on, off)])

# ---- group: Define Supports
dispatch = Dispatch(List=evalsrf.Point, DispatchPattern=[True, False])  # -> ListA, ListB
supp = SupportKaramba3D(PosInd=dispatch.ListA, menu=[buttons(on, on, on, off, off, off)])
supp_2 = SupportKaramba3D(PosInd=dispatch.ListB, menu=[buttons(on, off, on, off, off, off)])

# ---- group: Define Elements
surfelem = CreateSurfaceElementKaramba3D(
    Mesh=mesh_breps.Mesh,
    Identifier="S",
    CrossSection=crosecselect.CrossSection,
    LimitDistance_m=0.005,
    Bending=True,
    mode="MeshToShell")  # -> Element, Points, Info

# ---- group: Assemble Model
assemble = AssembleModelKaramba3D(Elem=surfelem.Element, Support=flatten([supp_2, supp]), Load=flatten([loads, loads_2]), LimitDistance_m=0.005)  # -> Model, Info, Mass_kg, CentreOfGravity, LoadCaseNames

# ---- group: Optimize Cross Sections
opticrosec = OptimizeCrossSectionKaramba3D(
    Model=assemble.Model,
    CrossSections=crosec,
    MaximumUtilization="0.5",
    MaximumVirtualWork_kNcm=0.01,
    NumberOfUtilizationIterations=5,
    NumberOfDisplacementIterations=5,
    NumberOfDisplacementIncrementsPerIteration=2,
    DisplacementTolerance=0.01,
    NumberOfSamplePoints=3,
    ElasticDesign=True,
    GammaM0=1,
    GammaM1=1.1,
    SwayFrame=True)  # -> OptimizedModel, Info, Mass_kg, MaximumDisplacement_cm, ElasticEnergyChange_kNm, MaximumUtilizationViewInsufficientCrossSections, MaximumDisplacementViewLimitCrossSections
panel_3 = Panel(opticrosec.MaximumDisplacement_cm)

# ---- group: Single Objective Optimization with Galapagos - based on max. Displacement
galapagos = Galapagos(fitness=num, gene=[bridgecrosssectionheight, archheight, additionalwidth_center, width_supports])
num = Number(flatten(opticrosec.MaximumDisplacement_cm))
panel_4 = Panel(num)

# ---- group: View Results
modelview = ModelViewKaramba3D(Model=opticrosec.OptimizedModel)  # -> Model, DeformedMesh, DeformedAxes, DeformedModel, MaximumDeformation
shellview = ShellViewKaramba3D(Model=modelview.Model, IndexOfLayer=0)  # -> Model, MeshesOfRenderedShells, LegendColours, LegendTags
legend = Legend(Colour=shellview.LegendColours, Tags=shellview.LegendTags, LegendType=1)

# ---- group: Multi Objective Optimization with Octopus - based on max. displacement, mass and height
item_2 = ListItem(List=shellview.MeshesOfRenderedShells, Index=0, Wrap=True)
num_2 = Number(flatten(opticrosec.MaximumDisplacement_cm))
num_3 = Number(flatten(opticrosec.Mass_kg))
num_4 = Number(flatten(addition))
neg = Negative(Value=num_4)
octopus = Octopus(
    Phenotype=item_2,
    OctopusData_gene=[width_supports, additionalwidth_center, archheight, bridgecrosssectionheight],
    OctopusData_obj=[num_5, txt])
num_5 = Number([num_2, num_3, neg])
panel_5 = Panel(num_5)
panel_6 = Panel("""disp
mass
height""")
txt = Text(panel_6)
