# Grasshopper definition 03_Optimization_SupportPositions.gh (Grasshopper 1.0.7)
# plug-ins: Karamba3D

# ---- group: Create Geometry
slider = Slider(20, range=2..40)
genes = GeneList(Decimals=3, Maximum=1, Minimum=0, Value=[0.964, 0.561, 0.275, 0.278, 0, 0.812, 0.686, 0.097, 0.552, 0.797])
range = Range(Domain="0 to 20", Steps=slider)
# 03 - Optimization of Support Positions
# Difficulty: Simple | Version 3.1.4
# This definition uses Galapagos to find the support positions for the minimum deflection of a rectangular grid of beams.
pt = ConstructPoint(XCoordinate=range, YCoordinate=graft(range), ZCoordinate=0)
bbox = BoundingBox(Content=flatten(pt), Plane=PlaneXY(0, 0, 0), UnionBox=True)  # -> Box, Box_2
flip = FlipMatrix(Data=pt)
multiplication = Multiplication(A=slider, B=genes)
debrep = DeconstructBrep(Brep=bbox.Box)  # -> Faces, Edges, Vertices
pline = PolyLine(Vertices=pt, Closed=False)
pline_2 = PolyLine(Vertices=flip, Closed=False)
dispatch = Dispatch(List=multiplication, DispatchPattern=[True, False])  # -> ListA, ListB
item = ListItem(List=debrep.Vertices, Index=0, Wrap=True)  # -> Item, Item1, Item2, Item3
item_2 = TreeItem(Tree=simplify(pt), Path=dispatch.ListA, Index=dispatch.ListB, Wrap=True)
aligndim = AlignedDimension(
    Plane=PlaneXY(0, 0, 0),
    PointA=[item.Item1, item.Item2],
    PointB=[item.Item2, item.Item3],
    Offset=-1,
    Text="{0:0.00}",
    Size=1)
explode = Explode(Curve=[pline, pline_2], Recursive=True)  # -> flatten(Segments), Vertices

# ---- group: Define Materials
matselect = MaterialSelectionKaramba3D(menu=[dropdown(1), dropdown(2)])

# ---- group: Define Cross Sections
crosecrselect = CrossSectionRangeSelectorKaramba3D(MaximumHeight_cm=-1, MaximumWidth_cm=-1, Material=matselect, menu=[dropdown(0), dropdown(1), dropdown(3)])
crosecselect = CrossSectionSelectorKaramba3D(CrossSections=crosecrselect, NameOrListIndexOfCrossSection="HEA200")  # -> CrossSection, Info

# ---- group: Define Supports
supp = SupportKaramba3D(PosInd=item_2, menu=[buttons(on, on, on, off, off, off)])

# ---- group: Define Loads
loads = LoadsKaramba3D(Vector=Vector(0, 0, -1), LCase="LC0", mode="Gravity")

# ---- group: Define Elements
lineelem = CreateLinearElementKaramba3D(
    Line=explode.Segments,
    CrossSection=crosecselect.CrossSection,
    LimitDistance_m=0.005,
    BucklingLengthY_m=-1,
    BucklingLengthZ_m=-1,
    BucklingLengthLT_m=-1,
    Bending=True,
    ToPolylineMaxAngle=0.03,
    ToPolylineTolerance=0.01,
    ToPolylineMaxEdgeLength=0.25,
    New=True,
    Remove=True,
    mode="LineToBeam")  # -> Element, Points, Info

# ---- group: Assemble Model
assemble = AssembleModelKaramba3D(Elem=lineelem.Element, Support=supp, Load=loads, LimitDistance_m=0.005)  # -> Model, Info, Mass_kg, CentreOfGravity, LoadCaseNames

# ---- group: Optimize Cross Sections
opticrosec = OptimizeCrossSectionKaramba3D(
    Model=assemble.Model,
    CrossSections=crosecrselect,
    MaximumUtilization=1,
    MaximumDisplacement_cm="8",
    MaximumVirtualWork_kNcm=0.01,
    NumberOfUtilizationIterations=5,
    NumberOfDisplacementIterations=5,
    NumberOfDisplacementIncrementsPerIteration=2,
    DisplacementTolerance=0.01,
    NumberOfSamplePoints=3,
    ElasticDesign=True,
    GammaM0=1,
    GammaM1=1.1,
    SwayFrame=True)  # -> OptimizedModel, Info, Mass_kg, MaximumDisplacement_cm, ElasticEnergyChange_kNm, MaximumUtilizationViewInsufficientCrossSections, MaximumDisplacementViewLimitCrossSections
panel = Panel(opticrosec.MaximumDisplacement_cm)

# ---- group: Optimization with Galapagos
displacement = Number(opticrosec.MaximumDisplacement_cm)
galapagos = Galapagos(fitness=displacement, gene=genes)
displacement_2 = Panel(displacement)

# ---- group: View Results
modelview = ModelViewKaramba3D(Model=opticrosec.OptimizedModel)  # -> Model, DeformedMesh, DeformedAxes, DeformedModel, MaximumDeformation
beamview = BeamViewKaramba3D(Model=modelview.Model)  # -> Model, MeshesOfRenderedBeams, DeformedBeamAxes, LegendColours, LegendTags
legend = Legend(Colour=beamview.LegendColours, Tags=beamview.LegendTags, LegendType=1)
