# Grasshopper definition 03_Optimization_TrussDiagonals.gh (Grasshopper 1.0.7)
# Copyright: Karamba3D
# plug-ins: Karamba3D

# ---- group: Create Geometry
height = Slider(2.9, range=0..10)
genes = GenePool(
    Decimals=3,
    Maximum=0.99,
    Minimum=0.01,
    Value=[0.514, 0.121, 0.979, 0.61, 0.302, 0.808, 0.347, 0.439, 0.941, 0.795, 0.769, 0.225, 0.01, 0.206, 0.012, 0.391])
supports = Point([Point(5, 5, 0), Point(30, 15, 0)])
item = ListItem(List=supports, Index=0, Wrap=True)  # -> Item, Item1
panel = Panel("""0
1""")
multiplication = Multiplication(A=height, B=panel)
aligndim = AlignedDimension(Plane=PlaneXY(0, 0, 0), PointA=item.Item, PointB=item.Item1, Offset=-2, Text="{0:0.00}", Size=0.5)
panel_2 = Panel("""0
0""")
panel_3 = Panel("""1
1""")
Z = UnitZ(Factor=multiplication)
merge = Merge(Data1=flatten(panel_2), Data2=flatten(genes), Data3=flatten(panel_3))
partition = PartitionList(List=merge, Size="2")
interp = InterpolateData(Data=supports, Parameter=partition, Interpolation=2)
# 03 - Optimization of Truss Diagonals
# Difficulty: Simple | Version 3.1.4
# Here Galapagos is set up to play around with the position of the diagonals of a truss to achieve minimum deflection.
# Instead of using line geometry to generate the beams, here indices of the points are used to create the beams and supports.
addition = Addition(A=Z, B=interp)

# ---- group: Define Supports
panel_4 = Panel("""0
Int(x-2)""")
lng = ListLength(List=flatten(partition))
eval = Evaluate(F=panel_4, x=lng)
dispatch = Dispatch(List=supports, DispatchPattern=[True, False])  # -> ListA, ListB
vec2pt = Vector2Pt(PointA=dispatch.ListA, PointB=dispatch.ListB, Unitize=False)  # -> Vector, Length
panel_5 = Panel(eval)
dispatch_2 = Dispatch(List=panel_5, DispatchPattern=[True, False])  # -> ListA, ListB
align = AlignPlane(Plane=dispatch.ListA, Direction=vec2pt.Vector)  # -> Plane, Angle
supp = SupportKaramba3D(PosInd=dispatch_2.ListA, PlaneOfReference=align.Plane, menu=[buttons(off, on, on, on, off, off)])
supp_2 = SupportKaramba3D(PosInd=dispatch_2.ListB, PlaneOfReference=align.Plane, menu=[buttons(on, on, on, on, off, off)])

# ---- group: Define Elements
cluster = Cluster(L=flatten(partition))  # -> S, A
cull_i = CullIndex(List=reverse(cluster.A), Indices=0, Wrap=True)  # -> reverse(List)
cull_i_2 = CullIndex(List=cluster.A, Indices=0, Wrap=True)
dispatch_3 = Dispatch(List=cluster.S, DispatchPattern=[True, False])  # -> ListA, ListB
ids = Panel("""A
B""")
ids_2 = Panel("x")
lineelem = CreateLinearElementKaramba3D(IndexA=cull_i_2, IndexB=cull_i, Identifier=graft(ids), mode="IndexToBeam")  # -> Element, Points, Info
lineelem_2 = CreateLinearElementKaramba3D(IndexA=dispatch_3.ListA, IndexB=dispatch_3.ListB, Identifier=ids_2, mode="IndexToBeam")  # -> Element, Points, Info
pt = Point(flatten(addition))

# ---- group: Define Cross Section
number_slider = Slider(20.2, range=5..35)
crosec = CrossSectionKaramba3D(
    FamilyNameOfCrossSection="DefaultCroSec",
    Material=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,
    Diameter_cm=number_slider,
    WallThickness_cm=expr("x/2", number_slider),
    mode="Circular Hollow")

# ---- group: Define Loads
Z_2 = UnitZ(Factor="-5")
ids_3 = Panel("B")
beam_loads = BeamLoadsKaramba3D(BeamIdentifier=ids_3, LoadCase="LC0", ForceVector=Z_2, TStart=0, TEnd=1, mode="Block", menu=[buttons(off, on, off)])

# ---- group: Assemble Model
assemble = AssembleModelKaramba3D(
    Elem=flatten([lineelem_2.Element, lineelem.Element]),
    Support=flatten([supp, supp_2]),
    Load=flatten(beam_loads),
    LimitDistance_m=0.005,
    Points=pt,
    CrossSection=flatten(crosec))  # -> Model, Info, Mass_kg, CentreOfGravity, LoadCaseNames

# ---- group: Analyze Model
analyse = AnalyseKaramba3D(Model=assemble.Model)  # -> AnalysedModel, MaximumDisplacement_cm, ResultingForce_kN, ChangeOfElasticEnergy_kNm

# ---- group: Optimise Diagonal Positions with Galapagos
galapagos = Galapagos(fitness=displace, gene=genes)
displace = Number(analyse.MaximumDisplacement_cm)
panel_6 = Panel(displace)

# ---- group: View Results
modelview = ModelViewKaramba3D(Model=analyse.AnalysedModel)  # -> Model, DeformedMesh, DeformedAxes, DeformedModel, MaximumDeformation
beamview = BeamViewKaramba3D(Model=modelview.Model)  # -> Model, MeshesOfRenderedBeams, DeformedBeamAxes, LegendColours, LegendTags

# ==== cluster Cluster
L = ClusterInput()
lng = ListLength(List=L)
series = Series(Start=0, Step=1, Count=lng)
partition = PartitionList(List=L, Size="2")
partition_2 = PartitionList(List=series, Size="2")
flip = FlipMatrix(Data=partition)
flip_2 = FlipMatrix(Data=partition_2)
sort = SortList(Keys=flip, ValuesA=flip_2)  # -> Keys, simplify(ValuesA)
S = ClusterOutput(series)
A = ClusterOutput(sort.ValuesA)
