# Grasshopper definition 04_LargeDeformationTriangularGridshell.gh (Grasshopper 1.0.7)
# plug-ins: Karamba3D

# ---- group: Create Geometry
pt = Point([Point(1.058299944, 8.501823982, 0), Point(7.939971617, 2.755962197, 0), Point(32.52691507, 7.165577056, 0), Point(34.06359904, 16.05161912, 0), Point(23.86929237, 19.99354755, 0), Point(22.31677384, 23.06691548, 0), Point(21.16881619, 34.29138967, 0), Point(11.34740128, 30.95077235, 0)])
grid_size = Slider(1.2, range=1..10)
bnd = Bounds2D(Coordinates=pt)
item = ListItem(List=pt, Index=0, Wrap=True)  # -> Item, Item1, Item2, Item3
dedom2num = DeconstructDomain²(Domain=bnd)  # -> UMin, UMax, VMin, VMax
aligndim = AlignedDimension(
    Plane=PlaneXY(0, 0, 0),
    PointA=[item.Item, item.Item1],
    PointB=[item.Item1, item.Item2],
    Offset=-2,
    Text="{0:0.00}",
    Size=1)
expression = Expression(x=dedom2num.UMin, y=dedom2num.UMax, z=grid_size, Expression="ceiling((y-x)/z*2)")
expression_2 = Expression(x=dedom2num.VMin, y=dedom2num.VMax, z=grid_size, Expression="ceiling((y-x)/z/sin(pi/3))")
# 04 - Large Deformation of a Triangular Gridshell
# Difficulty: Moderate | Version 3.1.4
# Using the Large Deformation Analysis we can simulate the behaviour of a hanging model to find the optimum form for a triangular gridshell.
# The Beam Joint Agent releases rotation in all axes at the supports.
vec = VectorXYZ(XComponent=dedom2num.UMin, YComponent=dedom2num.VMin, ZComponent=0)  # -> Vector, Length
trigrid = Triangular(Plane=vec.Vector, Size=grid_size, ExtentX=expression, ExtentY=expression_2)  # -> Cells, Points
explode = Explode(Curve=trigrid.Cells, Recursive=True)  # -> Segments, Vertices
rdlines = RemoveDuplicateLinesKaramba3D(Line=flatten(explode.Segments), LimitDistance=0.005)  # -> OutLine, Info, Indexes
nurbs = NurbsCurve(Vertices=pt, Degree=3, Periodic=True)  # -> Curve, Length, Domain
xy = XYPlane(Origin=Point(0, 0, 0))
ccx = CurveCurve(CurveA=nurbs.Curve, CurveB=rdlines.OutLine)  # -> flatten(Points), flatten(ParamsA), ParamsB
trim = TrimWithRegion(Curve=rdlines.OutLine, Region=nurbs.Curve, Plane=xy)  # -> flatten(Inside), Outside
sort = SortList(Keys=ccx.ParamsA, ValuesA=ccx.Points)  # -> Keys, ValuesA
rdpoints = RemoveDuplicatePointsKaramba3D(Point=sort.ValuesA, LimitDistance=0.005)  # -> OutPoint, Info, Indexes
pline = PolyLine(Vertices=rdpoints.OutPoint, Closed=True)
explode_2 = Explode(Curve=pline, Recursive=True)  # -> Segments, Vertices
entwine = Entwine(Branch00=trim.Inside, Branch01=explode_2.Segments, FlattenInputs=True)

# ---- group: Define Materials
matselect = MaterialSelectionKaramba3D(menu=[dropdown(1), dropdown(2)])

# ---- group: Define Cross Sections
expression_3 = Expression(n="BOX", x="10", y="10", Expression="n&\" \"&x&\"/\"&y")
range = Range(Domain="0.5 to 1.5", Steps=10)
panel = Panel("A")
panel_2 = Panel("B")
crosec = CrossSectionKaramba3D(
    FamilyNameOfCrossSection="EDGE",
    ElementIdentifier=panel_2,
    Material=matselect,
    Height_cm="10",
    UpperFlangeWidth_cm="10",
    LowerFlangeWidth_cm="10",
    UpperFlangeThickness_cm="3",
    LowerFlangeThickness_cm="3",
    SidewallsThickness_cm="3",
    FilletRadius_cm=0.6,
    mode="Box")
crosec_2 = CrossSectionKaramba3D(
    FamilyNameOfCrossSection="BOX",
    NameOfCrossSection=expression_3,
    ElementIdentifier=panel,
    Material=matselect,
    Height_cm="10",
    UpperFlangeWidth_cm="10",
    LowerFlangeWidth_cm="10",
    UpperFlangeThickness_cm=range,
    LowerFlangeThickness_cm=range,
    SidewallsThickness_cm=range,
    FilletRadius_cm=0.6,
    mode="Box")
crosecselect = CrossSectionSelectorKaramba3D(CrossSections=crosec_2)  # -> CrossSection, Info
entwine_2 = Entwine(Branch00=crosecselect.CrossSection, Branch01=crosec, FlattenInputs=True)

# ---- group: Define Loads
Z = UnitZ(Factor=1)
loads = LoadsKaramba3D(Vector=Z, LCase="LC0", mode="Gravity")

# ---- group: Define Elements
panel_3 = Panel("""A
B""")
lineelem = CreateLinearElementKaramba3D(
    Line=entwine,
    Identifier=panel_3,
    CrossSection=entwine_2,
    LimitDistance_m=0.005,
    BucklingLengthY_m=-1,
    BucklingLengthZ_m=-1,
    BucklingLengthLT_m=-1,
    Bending=True,
    ToPolylineMaxAngle=0.03,
    ToPolylineTolerance=0.01,
    ToPolylineMaxEdgeLength=0.25,
    New=True,
    Remove=True,
    mode="LineToBeam")  # -> Element, Points, Info

# ---- group: Define Supports
pt_2 = Point([Point(18.01839589, 7.725677167, 0), Point(8.094484219, 18.13017566, 0), Point(20.29151467, 21.97537189, 0), Point(23.69776883, 16.43540467, 0)])
pt_3 = Point(explode_2.Vertices)
pull = PullPoint(Point=pt_2, Geometry=flatten(lineelem.Points), ClosestOnly=True)  # -> ClosestPoint, Distance
rdpoints_2 = RemoveDuplicatePointsKaramba3D(Point=pt_3, LimitDistance=0.005)  # -> OutPoint, Info, Indexes
supp = SupportKaramba3D(PosInd=pull.ClosestPoint, menu=[buttons(on, on, on, on, on, on)])
supp_2 = SupportKaramba3D(PosInd=rdpoints_2.OutPoint, menu=[buttons(on, on, off, off, off, off)])
support = SupportKaramba3D(flatten([supp, supp_2]))

# ---- group: Assemble Model
assemble = AssembleModelKaramba3D(Elem=flatten(lineelem.Element), Support=support, Load=loads, LimitDistance_m=0.005)  # -> Model, Info, Mass_kg, CentreOfGravity, LoadCaseNames

# ---- group: Perform Large Deformation Analysis
d = Slider(6, range=0..10)
ladeform = LargeDeformationAnalysisKaramba3D(Model=assemble.Model, Increments=Slider(20, range=0..20), MaximumDisplacement_m=d)  # -> CalculatedModel, MaximumDisplacement_cm

# ---- group: Disassemble & Reassemble Model
disassemble = DisassembleModelKaramba3D(Model=ladeform.CalculatedModel)  # -> Model, Point, Beam, Shell, Support, Load, Line, Mesh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

# ---- group: Redefine Elements
disassemble_2 = DisassembleElementKaramba3D(Element=disassemble.Beam)  # -> Element, ElementIdentifier, AxisOfElement, CrossSection, Joint, Material, LocalCoordinateSystem, ElementIsActive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
lineelem_2 = CreateLinearElementKaramba3D(
    Line=disassemble_2.AxisOfElement,
    Identifier=disassemble_2.ElementIdentifier,
    CrossSection=disassemble_2.CrossSection,
    LimitDistance_m=0.005,
    BucklingLengthY_m=-1,
    BucklingLengthZ_m=-1,
    BucklingLengthLT_m=-1,
    Bending=True,
    ToPolylineMaxAngle=0.03,
    ToPolylineTolerance=0.01,
    ToPolylineMaxEdgeLength=0.25,
    New=True,
    Remove=True,
    mode="LineToBeam")  # -> Element, Points, Info

# ---- group: Redefine Loads
loads_2 = LoadsKaramba3D(Vector=Vector(0, 0, -1), LCase="LC0", mode="Gravity")

# ---- group: Define Supports
support_2 = SupportKaramba3D(flatten(supp))

# ---- group: Reassemble Model
assemble_2 = AssembleModelKaramba3D(Elem=lineelem_2.Element, Support=support_2, Load=loads_2, LimitDistance_m=0.005)  # -> Model, Info, Mass_kg, CentreOfGravity, LoadCaseNames

# ---- group: Analyze Model
opticrosec = OptimizeCrossSectionKaramba3D(
    Model=assemble_2.Model,
    CrossSections=crosec_2,
    MaximumUtilization=1,
    MaximumVirtualWork_kNcm=0.01,
    NumberOfUtilizationIterations=5,
    NumberOfDisplacementIterations=5,
    NumberOfDisplacementIncrementsPerIteration=2,
    DisplacementTolerance=0.01,
    NumberOfSamplePoints=3,
    ElasticDesign=True,
    GammaM0=1,
    GammaM1=1.1,
    SwayFrame=True)  # -> OptimizedModel, Info, Mass_kg, MaximumDisplacement_cm, ElasticEnergyChange_kNm, MaximumUtilizationViewInsufficientCrossSections, MaximumDisplacementViewLimitCrossSections
panel_4 = Panel(opticrosec.Mass_kg)
panel_5 = Panel(opticrosec.MaximumDisplacement_cm)

# ---- group: View Results
modelview = ModelViewKaramba3D(Model=opticrosec.OptimizedModel)  # -> Model, DeformedMesh, DeformedAxes, DeformedModel, MaximumDeformation
beamview = BeamViewKaramba3D(Model=modelview.Model)  # -> Model, MeshesOfRenderedBeams, DeformedBeamAxes, LegendColours, LegendTags
legend = Legend(Colour=beamview.LegendColours, Tags=beamview.LegendTags, LegendType=1)
