# Grasshopper definition 04_LargeDeformationVoronoiGridshell.gh (Grasshopper 1.0.7)
# Copyright: Karamba3D
# plug-ins: MeshEdit Components, Karamba3D, Kangaroo2 Components

# ---- group: Create Geometry
pt = Point([Point(8.666055418, 8.465737706, 0), Point(40.95674764, 4.607729938, 0), Point(28.92526197, 22.60767562, 0), Point(2.278675989, 24.28851277, 0)])
Z = UnitZ(Factor=1)
item = ListItem(List=pt, Index=0, Wrap=True)  # -> Item, Item1, Item2, Item3
addition = Addition(A=pt, B=Z)
aligndim = AlignedDimension(
    Plane=PlaneXY(0, 0, 0),
    PointA=[item.Item, item.Item3],
    PointB=[item.Item1, item.Item],
    Offset=-2,
    Text="{0:0.00}",
    Size=1)
pt_2 = Point(addition)
pline = PolyLine(Vertices=pt_2, Closed=True)
# 04 - Large Deformation of a Voronoi Gridshell
# Difficulty: Hard | Version 3.1.4
# Using the Large Deformation Analysis we can simulate the behaviour of a hanging model to find the optimum form for a Voronoi gridshell.
# The Beam Joint Agent component releases rotation in 2 axes at the connection with the columns.
boundary = BoundarySurfaces(Edges=pline)
popgeo = PopulateGeometry(Geometry=boundary, Count=Slider(7, range=0..20), Seed=1)
voronoi = Voronoi(Points=flatten(popgeo), BruteForceOverride=False)
incurve = PointInCurve(Point=pt_2, Curve=graft(voronoi))  # -> Relationship, Point
trim = TrimWithRegion(Curve=voronoi, Region=pline)  # -> Inside, Outside
disc = Discontinuity(Curve=trim.Inside, Level=1)  # -> Points, Parameters
cull = CullPattern(List=pt_2, CullPattern=incurve.Relationship)
merge = Merge(Data1=simplify(cull), Data2=simplify(disc.Points))
path_mapper = PathMapper(merge, source=["{A}", "{A;B}"], target=["{A}", "{A}"])
del = DelaunayMesh(Points=path_mapper, Plane=PlaneXY(0, 0, 0))
f = Slider(2.5, range=0..3)
medges = MeshEdges(Mesh=del)  # -> NakedEdges, InteriorEdges, NonManifoldEdges
len = Length(Curve=medges.NakedEdges)
expression = Expression(x=len, y=f, Expression="max(int(x*y/2)*2,2)")
area = MeshArea(Mesh=del)  # -> Area, Centroid
divide = DivideCurve(Curve=medges.NakedEdges, Count=expression, Kinks=False)  # -> simplify(Points), Tangents, Parameters
multiplication = Multiplication(A=area.Area, B=f)
trim_2 = TrimTree(Tree=divide.Points, Depth=1)
popgeo_2 = PopulateGeometry(Geometry=del, Count=multiplication, Seed=1, Points=trim_2)  # -> simplify(Population)
cullpt = CullDuplicates(Points=[trim_2, popgeo_2], Tolerance=0.1, CullMode=3)  # -> Points, Indices, Valence
del_2 = DelaunayMesh(Points=cullpt.Points, Plane=PlaneXY(0, 0, 0))
mjoin = MeshJoin(Meshes=flatten(del_2))
cluster = Cluster(C=trim.Inside, B=Slider(0.8, range=0.5..2))
triremesh = TriRemesh(Geometry=mjoin, Features=cluster, Length="0.7", Iterations=25)  # -> Triangulation, Dual, Creases
line = LineSDL(Start=cluster, Direction=Vector(0, 0, 1), Length=-1)
medges_2 = MeshEdges(Mesh=triremesh.Triangulation)  # -> NakedEdges, InteriorEdges, NonManifoldEdges
entwine = Entwine(Branch00=medges_2.NakedEdges, Branch01=medges_2.InteriorEdges, Branch02=line, FlattenInputs=True)

# ---- group: Define Materials
matselect = MaterialSelectionKaramba3D(menu=[dropdown(1), dropdown(2)])

# ---- group: Define Cross Sections
range = Range(Domain="5 to 40", Steps=10)
concat = Concatenate(FragmentA="R", FragmentB=range)
lng = ListLength(List=range)  # -> expr("x-1", Length)
panel = Panel("""1
0
0.5""")
crosec = CrossSectionKaramba3D(
    FamilyNameOfCrossSection="R",
    NameOfCrossSection=concat,
    Material=matselect,
    Diameter_cm=range,
    WallThickness_cm=expr("x*0.05", range),
    mode="Circular Hollow")
multiplication_2 = Multiplication(A=lng, B=panel)
crosecselect = CrossSectionSelectorKaramba3D(CrossSections=crosec, NameOrListIndexOfCrossSection=multiplication_2)  # -> CrossSection, Info

# ---- group: Define Elements
panel_2 = Panel("""A
B
S""")
lineelem = CreateLinearElementKaramba3D(
    Line=entwine,
    Identifier=graft(panel_2),
    CrossSection=graft(crosecselect.CrossSection),
    LimitDistance_m=0.005,
    BucklingLengthY_m=-1,
    BucklingLengthZ_m=-1,
    BucklingLengthLT_m=-1,
    Bending=True,
    ToPolylineMaxAngle=0.03,
    ToPolylineTolerance=0.01,
    ToPolylineMaxEdgeLength=0.25,
    New=True,
    Remove=True,
    mode="LineToBeam")  # -> Element, Points, Info

# ---- group: Define Supports
cluster_2 = Cluster_2(M=triremesh.Triangulation)  # -> P, M_2
project = Project(Geometry=cluster, Plane=PlaneXY(0, 0, 0))  # -> Geometry, Transform
rdpoints = RemoveDuplicatePointsKaramba3D(Point=cluster_2.P, LimitDistance=0.005)  # -> OutPoint, Info, Indexes
supp = SupportKaramba3D(PosInd=project.Geometry, menu=[buttons(on, on, on, off, off, off)])
supp_2 = SupportKaramba3D(PosInd=rdpoints.OutPoint, menu=[buttons(on, on, off, off, off, off)])

# ---- group: Define Loads
Z_2 = UnitZ(Factor=1)
loads = LoadsKaramba3D(Vector=Z_2, LCase="LC0", mode="Gravity")

# ---- group: Assemble Model
assemble = AssembleModelKaramba3D(Elem=flatten(lineelem.Element), Support=flatten([supp, supp_2]), Load=loads, LimitDistance_m=0.005)  # -> Model, Info, Mass_kg, CentreOfGravity, LoadCaseNames

# ---- group: Perform Large Deformation Analysis
d = Slider(4, range=0..10)
ladeform = LargeDeformationAnalysisKaramba3D(Model=assemble.Model, Increments=Slider(20, range=0..20), MaximumDisplacement_m=d)  # -> CalculatedModel, MaximumDisplacement_cm
panel_3 = Panel(ladeform.MaximumDisplacement_cm)

# ---- group: Disassemble & Reassemble Model
disassemble = DisassembleModelKaramba3D(Model=ladeform.CalculatedModel)  # -> Model, Point, Beam, Shell, Support, Load, Line, Mesh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
disassemble_2 = DisassembleElementKaramba3D(Element=disassemble.Beam)  # -> Element, ElementIdentifier, AxisOfElement, CrossSection, Joint, Material, LocalCoordinateSystem, ElementIsActive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

# ---- group: Redefine Loads
weldvertices = MeshWeldVertices(Mesh=cluster_2.M_2, Tolerance=0.01)  # -> RuntimeMessage, Mesh
Z_3 = UnitZ(Factor="-10")
loads_2 = LoadsKaramba3D(Vector=Vector(0, 0, -1), LCase="LC0", mode="Gravity")
loads_3 = LoadsKaramba3D(Vector=Z_3, Mesh=weldvertices.Mesh, LCase="LC0", mode="MeshLoad -Const.", menu=[buttons(on, off, off), buttons(on, on)])
load = LoadKaramba3D([loads_2, loads_3])

# ---- group: Define Joints
panel_4 = Panel("""A
B""")
panel_5 = Panel("S")
joint_agent = BeamJointAgentKaramba3D(
    BeamIdentifier=panel_4,
    ToElementIdentifiers=panel_5,
    Ct_kN_m=Vector(0, 0, 0),
    Cr_kNm_rad="{0,0.1,0.1}",
    menu=[buttons(off, off, off, off, on, on)])

# ---- group: Redefine Elements
lineelem_2 = CreateLinearElementKaramba3D(
    Line=disassemble_2.AxisOfElement,
    Identifier=disassemble_2.ElementIdentifier,
    CrossSection=disassemble_2.CrossSection,
    LimitDistance_m=0.005,
    BucklingLengthY_m=-1,
    BucklingLengthZ_m=-1,
    BucklingLengthLT_m=-1,
    Bending=True,
    ToPolylineMaxAngle=0.03,
    ToPolylineTolerance=0.01,
    ToPolylineMaxEdgeLength=0.25,
    New=True,
    Remove=True,
    mode="LineToBeam")  # -> Element, Points, Info

# ---- group: Define Supports
support = SupportKaramba3D(flatten(supp))

# ---- group: Reassemble Model
assemble_2 = AssembleModelKaramba3D(Elem=lineelem_2.Element, Support=support, Load=load, Joint=joint_agent, LimitDistance_m=0.005)  # -> Model, Info, Mass_kg, CentreOfGravity, LoadCaseNames

# ---- group: Analyze Model
crosec_2 = CrossSectionKaramba3D(crosec)
opticrosec = OptimizeCrossSectionKaramba3D(
    Model=assemble_2.Model,
    CrossSections=crosec_2,
    MaximumUtilization=1,
    MaximumVirtualWork_kNcm=0.01,
    NumberOfUtilizationIterations=5,
    NumberOfDisplacementIterations=5,
    NumberOfDisplacementIncrementsPerIteration=2,
    DisplacementTolerance=0.01,
    NumberOfSamplePoints=3,
    ElasticDesign=True,
    GammaM0=1,
    GammaM1=1.1,
    SwayFrame=True)  # -> OptimizedModel, Info, Mass_kg, MaximumDisplacement_cm, ElasticEnergyChange_kNm, MaximumUtilizationViewInsufficientCrossSections, MaximumDisplacementViewLimitCrossSections
panel_6 = Panel(opticrosec.MaximumDisplacement_cm)
panel_7 = Panel(opticrosec.Mass_kg)

# ---- group: View Results
modelview = ModelViewKaramba3D(Model=opticrosec.OptimizedModel)  # -> Model, DeformedMesh, DeformedAxes, DeformedModel, MaximumDeformation
beamview = BeamViewKaramba3D(Model=modelview.Model)  # -> Model, MeshesOfRenderedBeams, DeformedBeamAxes, LegendColours, LegendTags
legend = Legend(Colour=beamview.LegendColours, Tags=beamview.LegendTags, LegendType=1)

# ==== cluster Cluster
C = ClusterInput()
explode = Explode(Curve=C, Recursive=True)  # -> Segments, Vertices
len = Length(Curve=explode.Segments)
avr = Average(Input=flatten(len))
B = ClusterInput()
multiplication = Multiplication(A=avr, B=B)
curvepoint = PointOnCurve(explode.Segments, parameter=0.5)
larger = LargerThan(FirstNumber=len, SecondNumber=multiplication)  # -> LargerThan, OrEqualTo
cull = CullPattern(List=curvepoint, CullPattern=larger.LargerThan)  # -> flatten(List)
cullpt = CullDuplicates(Points=flatten(cull), Tolerance=0.1, CullMode=3)  # -> Points, Indices, Valence
P = ClusterOutput(cullpt.Points)

# ==== cluster Cluster_2
M = ClusterInput()
mjoin = MeshJoin(Meshes=flatten(M))
M_2 = ClusterOutput(mjoin)
weldvertices = MeshWeldVertices(Mesh=mjoin, Tolerance=0.01)  # -> RuntimeMessage, Mesh
nakededge = MeshNakedEdge(Mesh=weldvertices.Mesh)  # -> V, A, B
sort = SortList(Keys=[nakededge.A, nakededge.B])  # -> Keys, ValuesA
dcon = DeleteConsecutive(Set=sort.Keys, Wrap=False)  # -> Set, Count
item = ListItem(List=nakededge.V, Index=dcon.Set, Wrap=True)
rdpoints = RemoveDuplicatePointsKaramba3D(Point=flatten(item), LimitDistance=0.005)  # -> OutPoint, Info, Indexes
P = ClusterOutput(rdpoints.OutPoint)
