# Grasshopper definition 04_MembraneFormFinding.gh (Grasshopper 1.0.7)
# plug-ins: Kangaroo2 Components, Karamba3D

# ---- group: Create Geometry
expression = Expression(x=Slider(10, range=0..100), Expression="\"0 to \" & 1/x")
cir = Circle(Plane=PlaneXY(0, 0, 0), Radius=[Slider(40, range=0..100), Slider(100, range=0..100)])
# 04 - Membrane Form Finding
# Difficulty: Moderate | Version: 3.1.4
# This example shows a method of using Kangaroo to perform a form finding procedure of a membrane. This membrane is then brought into Karamba3D for structural analysis.
subcrv = SubCurve(BaseCurve=reparameterize(cir), Domain=expression)
panel = Panel(expression)
end = EndPoints(Curve=subcrv)  # -> Start, End
pline = PolyLine(Vertices=end.Start, Closed=False)
pline_2 = PolyLine(Vertices=end.End, Closed=False)
range = Range(Domain=Domain(0, 1), Steps="3")
eval = EvaluateCurve(Curve=reparameterize(graft([pline, pline_2])), Parameter=range)  # -> Point, Tangent, Angle
graph = GraphMapper(
    reverse(range),
    x0=0,
    x1=1,
    y0=0,
    y1=1,
    container_name="Bezier",
    cpx=[0, 0.2316699922, 0.5043671727, 1],
    cpy=[0.346996367, 0.6089203358, 1, 0.5628786087])
flip = FlipMatrix(Data=eval.Point)
bnd = Bounds(Numbers=graph)
remap = RemapNumbers(Value=graph, Source=bnd, Target=Slider(35, range=0..100))  # -> Mapped, Clipped
Z = UnitZ(Factor=remap.Mapped)
move = Move(Geometry=flip, Motion=graft(Z))  # -> Geometry, Transform
loft_opt = LoftOptions(Closed=False, Adjust=False, Rebuild=0, Refit=0, Type="3")
pline_3 = PolyLine(Vertices=move.Geometry, Closed=False)
loft = Loft(Curves=flatten(pline_3), Options=loft_opt)

# ---- group: Formfinding with Kangaroo
brep = Brep(loft)
mesh_breps = MeshBrepsKaramba3D(
    Brep=brep,
    MeshResolution="3",
    EdgeRefinementFactor=0.67,
    PointReduction=False,
    SmoothingStepSize="1",
    SmoothingIterations="10")  # -> Mesh, Info
debrep = DeconstructBrep(Brep=brep)  # -> Faces, Edges, Vertices
clean = CombineClean(Meshes=mesh_breps.Mesh)
supports = Point(flatten(debrep.Vertices))
medges = MeshEdges(Mesh=clean)  # -> NakedEdges, InteriorEdges, NonManifoldEdges
crv = Curve(medges.NakedEdges)
edgelengths = EdgeLengths(Mesh=clean, LengthFactor=Slider(0.01, range=0.01..0.8), Strength="1")
anchor = Anchor(Point=supports, Strength="10000")
length_line = LengthLine(Line=crv, Length="0.1", Strength="20")
vertexloads = VertexLoads(Mesh=clean, Strength="-0.05")
show = Show(G=supports)  # -> flatten(G)
show_2 = Show(G=clean)  # -> flatten(G)
entwine = Entwine(Branch00=show, Branch01=show_2, Branch02=[vertexloads, anchor, edgelengths, length_line], FlattenInputs=True)
zombiesolver = ZombieSolver(GoalObjects=flatten(entwine), Threshold=1e-10, Tolerance=0.0001, MaxIterations=50000)  # -> I, V, O
match = MatchTree(Tree=graft(zombiesolver.O), Guide=graft(entwine))
trim = TrimTree(Tree=match, Depth=1)
bang = ExplodeTree(Data=trim)  # -> Branch0, Branch1, Branch2

# ---- group: Set Cross Section
matprops = MaterialPropertiesKaramba3D(
    FamilyOfMaterial="Steel",
    Name="S235",
    YoungsModulus_kN_cm²="2130",
    InPlaneShearModulus_kN_cm²="1000",
    TransverseShearModulus_kN_cm²="1000",
    SpecificWeight_kN_m³="20",
    CoefficientOfThermalExpansion_1=1.2e-05,
    TensileStrength_kN_cm²=23.5,
    CompressiveStrength_kN_cm²=-23.5,
    StrengthHypothesis="MISES",
    mode="Isotrop")
crosec = CrossSectionKaramba3D(FamilyNameOfCrossSection="DefaultCroSec", Material=matprops, Height_cm="0.1", mode="Shell - Const")

# ---- group: Define Loads
loads = LoadsKaramba3D(Eps0="-1", LCase="LC0", mode="InitialStrain")
loads_2 = LoadsKaramba3D(Vector=Vector(0, 0, -1), LCase="LC0", mode="Gravity")
load = LoadKaramba(flatten([loads, loads_2]))

# ---- group: Define Supports
pt = Point(bang.Branch0)
supp = SupportKaramba3D(PosInd=pt, menu=[buttons(on, on, on, off, off, off)])

# ---- group: Mesh To Membrane
mesh = Mesh(bang.Branch1)
surfelem = CreateSurfaceElementKaramba3D(Mesh=mesh, CrossSection=crosec, LimitDistance_m=0.005, Bending="0", mode="MeshToMembrane")  # -> Element, Points, Info

# ---- group: Assemble Model
assemble = AssembleModelKaramba3D(Elem=flatten(surfelem.Element), Support=flatten(supp), Load=flatten(load), LimitDistance_m=0.005)  # -> Model, Info, Mass_kg, CentreOfGravity, LoadCaseNames

# ---- group: Analyze Model with Theory 2nd Order
analysethii = AnalyseThIIKaramba3D(
    Model=assemble.Model,
    UseInitialNII=True,
    NIIFromCombination=True,
    NoTensionalNII=False,
    RTolerance=1e-07,
    MaxIterations=50)  # -> AnalysedModel, MaximumDisplacement_cm, ResultingForce_kN, ChangeOfElasticEnergy_kNm
panel_2 = Panel(analysethii.MaximumDisplacement_cm)

# ---- group: View Results
modelview = ModelViewKaramba3D(Model=analysethii.AnalysedModel)  # -> Model, DeformedMesh, DeformedAxes, DeformedModel, MaximumDeformation
shellview = ShellViewKaramba3D(Model=modelview.Model, IndexOfLayer=0)  # -> Model, MeshesOfRenderedShells, LegendColours, LegendTags
legend = Legend(Colour=shellview.LegendColours, Tags=shellview.LegendTags, LegendType=1)

# ---- group: Shell Forces
xy = XYPlane(Origin=Point(0, 0, 0))
item = ListItem(List=flatten(pline_3), Index=0, Wrap=True)
brep_2 = Brep(brep)
align = AlignPlane(Plane=xy, Direction=item)  # -> Plane, Angle
bbox = BoundingBox(Content=brep_2, Plane=align.Plane)  # -> Box, Box_2
box = EvaluateBox(Box=bbox.Box, UParameter=Slider(0.381, range=0..1), VParameter=0.5, WParameter=0.5)  # -> Plane, Point, Include
yz = YZPlane(Origin=box.Point)
pl = PlaneNormal(Origin=box.Point, ZAxis=item)
sec = BrepPlane(Brep=brep_2, Plane=pl)  # -> Curves, Points
s_forces = ShellSectionKaramba3D(
    Model=modelview.Model,
    IntersectionGeometry=sec.Curves,
    ProjectionDirection=Vector(0, 0, -1),
    mode="Forces",
    menu=[checkbox(on), checkbox(off), checkbox(on), slider(10), slider(2), slider(0.52), checkbox(on), checkbox(off), checkbox(off), checkbox(off), checkbox(off), checkbox(off), checkbox(off), checkbox(off), checkbox(off), slider(1)])  # -> Model, CuttingCurves, FaceIndices, MeshesOfRenderedResults, CurvesOfRenderedResults, Ntt_kN_m, Nnn_kN_m, Ntn_kN_m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
