# Grasshopper definition 05_CrossSectionHeightsFromMoments.gh (Grasshopper 1.0.7)
# plug-ins: Karamba3D

# ---- group: Create Geometry
pt = Point(Point(9.526762916, 20.00815252, 0))
slider = Slider(15, range=0..40)
slider_2 = Slider(20, range=0..40)
md_slider = MDSlider(
    SliderMode=0,
    slider_value=Point(0.2158537144, 0.1904877453, 0.5),
    x_domain=Domain(0, 1),
    y_domain=Domain(0, 1),
    z_domain=Domain(0, 1))
md_slider_2 = MDSlider(
    SliderMode=0,
    slider_value=Point(0.6695122137, 0.8324391435, 0.5),
    x_domain=Domain(0, 1),
    y_domain=Domain(0, 1),
    z_domain=Domain(0, 1))
md_slider_3 = MDSlider(
    SliderMode=0,
    slider_value=Point(0.916829179, 0.2912195717, 0.5),
    x_domain=Domain(0, 1),
    y_domain=Domain(0, 1),
    z_domain=Domain(0, 1))
# 05 - Cross Section Heights from Moments
# Difficulty: Moderate | Version 3.1.4
# Cross section forces of a structure under dead weight are used to scale the cross section heights in a rectangular grid of beams. Contains a trick regarding the flexible definition of support positions.
range = Range(Domain=Domain(0, 1), Steps=expr("x+1", slider))
range_2 = Range(Domain=Domain(0, 1), Steps=expr("x+1", slider_2))
cull_i = CullIndex(List=reverse(range), Indices=0, Wrap=False)  # -> reverse(List)
cull_i_2 = CullIndex(List=range, Indices=0, Wrap=False)
cull_i_3 = CullIndex(List=reverse(range_2), Indices=0, Wrap=False)  # -> reverse(List)
cull_i_4 = CullIndex(List=range_2, Indices=0, Wrap=False)
vcomp = Decompose(Vector=[md_slider, md_slider_2, md_slider_3])  # -> XComponent, YComponent, ZComponent
dom = Domain(DomainStart=cull_i, DomainEnd=cull_i_2)
dom_2 = Domain(DomainStart=cull_i_3, DomainEnd=cull_i_4)
sqgrid = Square(Plane=pt, Size=1, ExtentX=slider, ExtentY=slider_2)  # -> flatten(Cells), flatten(Points)
fdom = FindDomain(Domains=dom, Number=vcomp.XComponent, Strict=False)  # -> Index, Neighbour
fdom_2 = FindDomain(Domains=dom_2, Number=vcomp.YComponent, Strict=False)  # -> Index, Neighbour
eval = Evaluate(F="x*(y+1)+z", x=fdom.Index, y=slider_2, z=fdom_2.Index)
bbox = BoundingBox(Content=sqgrid.Cells, Plane=PlaneXY(0, 0, 0), UnionBox=True)  # -> Box, Box_2
item = ListItem(List=sqgrid.Points, Index=eval, Wrap=True)
debrep = DeconstructBrep(Brep=bbox.Box)  # -> Faces, Edges, Vertices
explode = Explode(Curve=sqgrid.Cells, Recursive=True)  # -> flatten(Segments), Vertices
item_2 = ListItem(List=debrep.Vertices, Index=0, Wrap=True)  # -> Item, Item1, Item2, Item3
rdlines = RemoveDuplicateLinesKaramba3D(Line=explode.Segments, LimitDistance=0.005)  # -> OutLine, Info, Indexes
aligndim = AlignedDimension(
    Plane=PlaneXY(0, 0, 0),
    PointA=[item_2.Item, item_2.Item1],
    PointB=[item_2.Item1, item_2.Item2],
    Offset=-1,
    Text="{0:0.00}",
    Size=1)

# ---- group: Define Supports
supp = SupportKaramba3D(PosInd=item, menu=[buttons(on, on, on, off, off, off)])

# ---- group: Define Loads
loads = LoadsKaramba3D(Vector=Vector(0, 0, -1), LCase="LC0", mode="Gravity")

# ---- group: Define Elements
lineelem = CreateLinearElementKaramba3D(
    Line=rdlines.OutLine,
    LimitDistance_m=0.005,
    BucklingLengthY_m=-1,
    BucklingLengthZ_m=-1,
    BucklingLengthLT_m=-1,
    Bending=True,
    ToPolylineMaxAngle=0.03,
    ToPolylineTolerance=0.01,
    ToPolylineMaxEdgeLength=0.25,
    New=True,
    Remove=True,
    mode="LineToBeam")  # -> Element, Points, Info

# ---- group: Assemble Model
assemble = AssembleModelKaramba3D(Elem=lineelem.Element, Support=supp, Load=loads, LimitDistance_m=0.005)  # -> Model, Info, Mass_kg, CentreOfGravity, LoadCaseNames

# ---- group: Analyze Model
analyse = AnalyseKaramba3D(Model=assemble.Model)  # -> AnalysedModel, MaximumDisplacement_cm, ResultingForce_kN, ChangeOfElasticEnergy_kNm
panel = Panel(analyse.MaximumDisplacement_cm)

# ---- group: View Results
modelview = ModelViewKaramba3D(Model=analyse.AnalysedModel)  # -> Model, DeformedMesh, DeformedAxes, DeformedModel, MaximumDeformation
beamview = BeamViewKaramba3D(Model=modelview.Model)  # -> Model, MeshesOfRenderedBeams, DeformedBeamAxes, LegendColours, LegendTags
legend = Legend(Colour=beamview.LegendColours, Tags=beamview.LegendTags, LegendType=1)

# ---- group: Create Beam Heights
crv = Curve(rdlines.OutLine)
crv_2 = Curve(beamview.DeformedBeamAxes)
curvepoint = PointOnCurve(crv_2, parameter=1)
pull = PullPoint(Point=curvepoint, Geometry=crv, ClosestOnly=True)  # -> ClosestPoint, Distance
vec2pt = Vector2Pt(PointA=pull.ClosestPoint, PointB=curvepoint, Unitize=False)  # -> Vector, Length
vcomp_2 = Decompose(Vector=vec2pt.Vector)  # -> XComponent, YComponent, ZComponent
max = Maximum(A="0.05", B=vcomp_2.ZComponent)
min = Minimum(A=vcomp_2.ZComponent, B="-0.05")
Z = UnitZ(Factor=max)
Z_2 = UnitZ(Factor=min)
move = Move(Geometry=crv, Motion=Z)  # -> Geometry, Transform
move_2 = Move(Geometry=crv, Motion=Z_2)  # -> Geometry, Transform
edgesrf = EdgeSurface(CurveA=move.Geometry, CurveB=move_2.Geometry)
