# Grasshopper definition 05_FindMaterialDistribution.gh (Grasshopper 1.0.7)
# plug-ins: Karamba3D, MeshEdit Components

# ---- group: Create Geometry
brep = Brep(<brep referenced from the Rhino model>)
# 05 Find Material Distribution
# Difficulty: Hard | Version 3.1.4
# This definition takes a polysurface input from rhino, divides a mesh according to sliders, converts the mesh edges to beams and analyzes moments at each node.
# The mesh is then redrawn with thickness of each edge determined by the bending moment value.
# Steps to alter:
# 1. change slider that controls mesh density
# 2. change slider that controls angle threshold to turn triangle segments into quads
# 3. test your own polygon
mesh_breps = MeshBrepsKaramba3D(
    Brep=brep,
    MeshResolution=Slider(4, range=1..40),
    EdgeRefinementFactor=0.67,
    PointReduction=False,
    SmoothingStepSize=0,
    SmoothingIterations=5)  # -> Mesh, Info
# This work is licensed under a Creative Commons Attribution 4.0 licence. You are free to copy, communicate and adapt the work, so long as you attribute the work in the manner specified by the author or licensor (but not in any way that suggests that they endorse you or your use of the work). A copy of this licence is available at http://http://creativecommons.org/licenses/by/4.0/ or write to info@creativecommons.org
triangulate = MeshTriangulate(Mesh=mesh_breps.Mesh, ShortDiagonal=False)
quad = Quadrangulate(Mesh=triangulate, Angle=Slider(0, range=0..1), Ratio=Slider(0.904, range=0..1))  # -> Mesh, Count
faceb = FaceBoundaries(Mesh=quad.Mesh)
crv = Curve(faceb)
explode = Explode(Curve=crv, Recursive=True)  # -> Segments, Vertices
rdlines = RemoveDuplicateLinesKaramba3D(Line=flatten(explode.Segments), LimitDistance=0.005)  # -> OutLine, Info, Indexes

# ---- group: Reference Geometry
# to apply to a new model:
# right-click and set multiple points;
# 
# ** points must be near intended supports;
# definition will automatically snap to closest node in model
pt = Point([<point referenced from the Rhino model> x8])

brep_2 = Brep([<brep referenced from the Rhino model> x14])
mesh_breps_2 = MeshBrepsKaramba3D(
    Brep=brep_2,
    MeshResolution=Slider(10, range=0..100),
    EdgeRefinementFactor=0.67,
    PointReduction=False,
    SmoothingStepSize=0,
    SmoothingIterations=5)  # -> Mesh, Info

# ---- group: Define Loads
# LIVE LOAD REFERENCE:
# ref: The Structural Basis of Architecture, Sandaker et al.
# residential (typical) 	2 kN/m2  	.04 kip/ft2
# office (tyipcal)  			3 kN/m2  	.06 kip/ft2
# public plazas  	12 kN/m2  	.25 kip/ft2
# athletic facilities (typical)  5 kN/m2  	.1 kip/ft2
# hospitals (operating rooms)  3 kN/m2   .06 kip/ft2
# libraries (book stacks)  7 kN/m2   .15 kip/ft2
# manufacturing (typical)  6 kN/m2   .125 kip/ft2
# heavy equipment   12 kN/m2   .25 kip/ft2
# schools (classrooms)   2 kN/m2   .04 kip/ft2
# schools (hallways)   5 kN/m2   .1 kip/ft2
live_load = Slider(-0.25, range=-0.25..-0.04)
Z = UnitZ(Factor="-1")
Z_2 = UnitZ(Factor=live_load)
loads = LoadsKaramba3D(Vector=Z, LCase="LC0", mode="Gravity")
loads_2 = LoadsKaramba3D(Vector=Z_2, Mesh=mesh_breps_2.Mesh, LCase="LC0", mode="MeshLoad -Const.", menu=[buttons(off, on, off), buttons(on, off)])
load = LoadKaramba3D(flatten([loads, loads_2]))

# ---- group: Define Elements
lineelem = CreateLinearElementKaramba3D(
    Line=rdlines.OutLine,
    Identifier="beams",
    LimitDistance_m=0.005,
    BucklingLengthY_m=-1,
    BucklingLengthZ_m=-1,
    BucklingLengthLT_m=-1,
    Bending=True,
    ToPolylineMaxAngle=0.03,
    ToPolylineTolerance=0.01,
    ToPolylineMaxEdgeLength=0.25,
    New=True,
    Remove=True,
    mode="LineToBeam")  # -> Element, Points, Info

# ---- group: Define Supports
rdpoints = RemoveDuplicatePointsKaramba3D(Point=lineelem.Points, LimitDistance=0.005)  # -> OutPoint, Info, Indexes
fsim = FindSimilarMember(Data=pt, Set=rdpoints.OutPoint)  # -> Hit, Index
supp = SupportKaramba3D(PosInd=fsim.Hit, menu=[buttons(on, on, on, off, off, off)])

# ---- group: Assemble Model
assemble = AssembleModelKaramba3D(Elem=lineelem.Element, Support=supp, Load=load, LimitDistance_m=0.005)  # -> Model, Info, Mass_kg, CentreOfGravity, LoadCaseNames

# ---- group: Analyze Model
analyse = AnalyseKaramba3D(Model=assemble.Model)  # -> AnalysedModel, MaximumDisplacement_cm, ResultingForce_kN, ChangeOfElasticEnergy_kNm
displacement = Panel(analyse.MaximumDisplacement_cm)

# ---- group: View Results
modelview = ModelViewKaramba3D(Model=analyse.AnalysedModel)  # -> Model, DeformedMesh, DeformedAxes, DeformedModel, MaximumDeformation
beamview = BeamViewKaramba3D(Model=modelview.Model)  # -> Model, MeshesOfRenderedBeams, DeformedBeamAxes, LegendColours, LegendTags
legend = Legend(Colour=beamview.LegendColours, Tags=beamview.LegendTags, LegendType=1)

# this step determines the midpoint of each
# edge, and clusters the values together
# per face. this means that each face has 4
# assigned datums. this is used in a later
# step to maintain order with the various
# data values.
crv_2 = Curve(explode.Segments)
crv_3 = Curve(rdlines.OutLine)
curvepoint = PointOnCurve(crv_2, parameter=0.5)
curvepoint_2 = PointOnCurve(crv_3, parameter=0.5)
fsim_2 = FindSimilarMember(Data=curvepoint, Set=curvepoint_2)  # -> Hit, simplify(Index)
int = Integer(fsim_2.Index)

b_forces = BeamForcesKaramba3D(AnalysedModel=analyse.AnalysedModel, Ts="0.5")  # -> Model, NormalForce_kN, ShearForceVz_kN, ShearForceVy_kN, TorsionalMomentMt_kNm, BendingMomentMy_kNm, BendingMomentMz_kNm, LoadCaseIndex
disassemble = DisassembleModelKaramba3D(Model=analyse.AnalysedModel)  # -> Model, Point, Beam, Shell, Support, Load, Line, Mesh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

# ----
vec = VectorXYZ(
    XComponent=b_forces.TorsionalMomentMt_kNm,
    YComponent=b_forces.BendingMomentMy_kNm,
    ZComponent=b_forces.BendingMomentMz_kNm)  # -> flatten(Vector), Length

# ---- group: View Results / connect bending moment values to mesh faces
abs = Absolute(Value=vec.Vector)
sqrt = SquareRoot(Value=abs)
item = ListItem(List=sqrt, Index=int, Wrap=True)
bnd = Bounds(Numbers=flatten(item))
remap = RemapNumbers(Value=item, Source=bnd, Target=Domain(0, 1))  # -> Mapped, Clipped

# ---- group: View Results / group face edges
item_2 = ListItem(List=disassemble.Line, Index=int, Wrap=True)

# ---- group: View Results (continued)
flip = FlipCurve(Curve=item_2, Guide=explode.Segments)  # -> Curve, Flag

# ---- group: View Results / determine center of face
end = EndPoints(Curve=flip.Curve)  # -> Start, End
avr = Average(Input=[end.Start, end.End])

# ---- group: View Results / redistribute moment value according to curve -> use as scale factor
graph = GraphMapper(
    remap.Mapped,
    x0=0,
    x1=1,
    y0=0,
    y1=1,
    container_name="Bezier",
    cpx=[0, 0.3704356253, 0.03768257424, 1],
    cpy=[1, 0.7092753649, 0, 0])
remap_2 = RemapNumbers(Value=graph, Source=Domain(0, 1), Target="0.4 to 0.95")  # -> Mapped, Clipped
shift = ShiftList(List=remap_2.Mapped, Shift=-1, Wrap=True)
expression = Expression(x=remap_2.Mapped, y=shift, Expression="(x+y)/2")

# ---- group: View Results / alternative reconfigured members
ln = Line(StartPoint=end.Start, EndPoint=avr)
ln_2 = Line(StartPoint=end.End, EndPoint=avr)
preview = CustomPreview(Geometry=[ln, ln_2], Shader=ColourSwatch(SwatchColor=RGB(171, 171, 171)))

# ---- group: View Results / boundary points; scaled points
end_2 = EndPoints(Curve=flip.Curve)  # -> Start, End
scale = Scale(Geometry=end.Start, Center=avr, Factor=expression)  # -> Geometry, Transform

# ---- group: View Results / create vertex colors
gradient = Gradient(
    LowerLimit=0,
    UpperLimit=1,
    Parameter=graph,
    stops=[0: RGB(234, 38, 0), 0.122: RGB(234, 126, 0), 0.298: RGB(254, 244, 84), 0.75: RGB(173, 203, 249), 1: RGB(75, 107, 169)])
shift_2 = ShiftList(List=gradient, Shift=-1, Wrap=True)
expression_2 = Expression(x=gradient, y=shift_2, Expression="(x+y)/2")
item_3 = ListItem(List=expression_2, Index=0, Wrap=True)
merge = Merge(Data1=expression_2, Data2=item_3, Data3=expression_2, Data4=item_3)

# ---- group: View Results / merge outer points, inner points to create new faces
pt_2 = Point(simplify(end_2.Start))
pt_3 = Point(simplify(scale.Geometry))
item_4 = ListItem(List=pt_2, Index=0, Wrap=True)
item_5 = ListItem(List=pt_3, Index=0, Wrap=True)
lng = ListLength(List=pt_2)
merge_2 = Merge(Data1=pt_2, Data2=item_4, Data3=pt_3, Data4=item_5)

# ---- group: View Results
frompoints = MeshFromPoints(Points=merge_2, UDirection=2, VDirection=expr("x+1", lng), Colour=merge)  # -> flatten(Mesh)
pline = PolyLine(Vertices=pt_2, Closed=True)
pline_2 = PolyLine(Vertices=pt_3, Closed=True)
