# Grasshopper definition 05_InformedGeometryScaleModuleEdgesByInnerForces.gh (Grasshopper 1.0.7)
# plug-ins: Karamba3D

# ---- group: Create Geometry
pipeline = GeometryPipeline(
    GroupByLayer=False,
    GroupByType=False,
    IncludeHidden=True,
    IncludeLocked=True,
    LayerFilter="input_module",
    NameFilter="*",
    SublayerFiltering=True,
    TypeFilter=1073741848)
pipeline_2 = GeometryPipeline(
    GroupByLayer=False,
    GroupByType=False,
    IncludeHidden=True,
    IncludeLocked=True,
    LayerFilter="input_surface",
    NameFilter="*",
    SublayerFiltering=True,
    TypeFilter=1073741848)
pipeline_3 = GeometryPipeline(
    GroupByLayer=False,
    GroupByType=False,
    IncludeHidden=True,
    IncludeLocked=True,
    LayerFilter="input supports",
    NameFilter="*",
    SublayerFiltering=True,
    TypeFilter=1073741849)
srf = Surface(pipeline_2)
offset = OffsetLoose(Surface=srf, Distance=Slider(1.5, range=0..3), Retrim=True)
divide = DivideDomain²(Domain=Domain2(u=0..1, v=0..1), UCount=Slider(8, range=2..10), VCount=Slider(6, range=2..20))
# 05 - Informed Geometry Scale Module Edges by Inner Forces
# Difficulty: Hard | Version 3.1.4
# The properties of modules are made dependent on the internal forces of the structure which is a tetrahedral space grid. Make sure to open the Rhino File which has the reference geometry.
subsrf = Isotrim(Surface=reparameterize(srf), Domain=divide)
subsrf_2 = Isotrim(Surface=reparameterize(offset), Domain=divide)
sdivide = DivideSurface(Surface=srf, UCount="1", VCount="1")  # -> flatten(Points), Normals, Parameters
explode = BrepComponents(Brep=subsrf)  # -> Faces, Edges, Vertices
explode_2 = BrepComponents(Brep=subsrf_2)  # -> Faces, Edges, Vertices
item = ListItem(List=sdivide.Points, Index=0, Wrap=True)  # -> Item, Item1, Item2, Item3
flip = FlipMatrix(Data=explode.Vertices)
flip_2 = FlipMatrix(Data=explode_2.Vertices)
srf_2 = Surface(pipeline)
aligndim = AlignedDimension(
    Plane=PlaneXY(0, 0, 0),
    PointA=[item.Item, item.Item2],
    PointB=[item.Item1, item.Item],
    Offset=-2,
    Text="{0:0.00}",
    Size=1)
edges = BrepEdges(Brep=srf_2)  # -> Naked, Interior, NonManifold
bang = ExplodeTree(Data=flip)  # -> Branch0, Branch1, Branch2, Branch3
bang_2 = ExplodeTree(Data=flip_2)  # -> Branch0, Branch1, Branch2, Branch3
join = JoinCurves(Curves=edges.Naked, Preserve=False)  # -> flatten(Curves)
tbox = TwistedBox(
    CornerA=bang.Branch0,
    CornerB=bang.Branch1,
    CornerC=bang.Branch2,
    CornerD=bang.Branch3,
    CornerE=bang_2.Branch0,
    CornerF=bang_2.Branch1,
    CornerG=bang_2.Branch2,
    CornerH=bang_2.Branch3)
box = Box2Pt(PointA=Point(0, 0, 0), PointB=Point(1, 1, 1), Plane=PlaneXY(0, 0, 0))
morph = BoxMorph(Geometry=join, Reference=box, Target=graft(tbox))
explode_3 = Explode(Curve=morph, Recursive=True)  # -> Segments, Vertices
end = EndPoints(Curve=explode_3.Segments)  # -> Start, End
ln = Line(StartPoint=end.Start, EndPoint=end.End)  # -> simplify(Line)
rdlines = RemoveDuplicateLinesKaramba3D(Line=flatten(ln), LimitDistance=0.005)  # -> OutLine, Info, Indexes

# ---- group: Define Elements
lineelem = CreateLinearElementKaramba3D(
    Line=rdlines.OutLine,
    Colour=ColourSwatch(SwatchColor=RGB(0, 42, 255)),
    Identifier="BeamA",
    LimitDistance_m=0.005,
    BucklingLengthY_m=-1,
    BucklingLengthZ_m=-1,
    BucklingLengthLT_m=-1,
    Bending=True,
    ToPolylineMaxAngle=0.03,
    ToPolylineTolerance=0.01,
    ToPolylineMaxEdgeLength=0.25,
    New=True,
    Remove=True,
    mode="LineToBeam")  # -> Element, Points, Info

# ---- group: Define Supports
pt = Point(lineelem.Points)
brepsinc = PointInBreps(Brep=pipeline_3, Point=pt, Strict=False)  # -> Inside, Index
cull = CullPattern(List=pt, CullPattern=brepsinc.Inside)
supp = SupportKaramba3D(PosInd=flatten(cull), menu=[buttons(on, on, on, on, off, off)])

# ---- group: Define Loads
loads = LoadsKaramba3D(Vector=Vector(0, 0, -1), LCase="LC0", mode="Gravity")

# ---- group: Assemble Model
assemble = AssembleModelKaramba3D(Elem=lineelem.Element, Support=supp, Load=loads, LimitDistance_m=0.005)  # -> Model, Info, Mass_kg, CentreOfGravity, LoadCaseNames

# ---- group: Analyze Model
analyse = AnalyseKaramba3D(Model=assemble.Model)  # -> AnalysedModel, MaximumDisplacement_cm, ResultingForce_kN, ChangeOfElasticEnergy_kNm
panel = Panel(analyse.MaximumDisplacement_cm)

# ---- group: View Results
modelview = ModelViewKaramba3D(Model=analyse.AnalysedModel)  # -> Model, DeformedMesh, DeformedAxes, DeformedModel, MaximumDeformation
beamview = BeamViewKaramba3D(Model=modelview.Model)  # -> Model, MeshesOfRenderedBeams, DeformedBeamAxes, LegendColours, LegendTags
legend = Legend(Colour=beamview.LegendColours, Tags=beamview.LegendTags, LegendType=1)

# ---- group: Scale Module Edges / Remap Values for Offset
dom = Domain(DomainStart=Slider(0.05, range=0..1), DomainEnd=Slider(0.84, range=0..1))

# ----
panel_2 = Panel("""0
1
2""")

# ---- group: Scale Module Edges
normal_false_or_moment_true_forces = BooleanToggle(True)
b_forces = BeamForcesKaramba3D(AnalysedModel=analyse.AnalysedModel, Ts="0.5")  # -> Model, flatten(NormalForce_kN), ShearForceVz_kN, ShearForceVy_kN, TorsionalMomentMt_kNm, BendingMomentMy_kNm, BendingMomentMz_kNm, LoadCaseIndex
vec = VectorXYZ(
    XComponent=b_forces.TorsionalMomentMt_kNm,
    YComponent=b_forces.BendingMomentMy_kNm,
    ZComponent=b_forces.BendingMomentMz_kNm)  # -> flatten(Vector), Length
filter = StreamFilter(Gate=normal_false_or_moment_true_forces, Stream0=b_forces.NormalForce_kN, Stream1=vec.Vector)
abs = Absolute(Value=filter)
sort = SortList(Keys=abs)  # -> Keys, ValuesA
item_2 = ListItem(List=sort.Keys, Index=0, Wrap=True)  # -> Item1, Item
dom_2 = Domain(DomainStart=item_2.Item, DomainEnd=item_2.Item1)
remap = RemapNumbers(Value=abs, Source=dom_2, Target=dom)  # -> Mapped, Clipped
crv = Curve(flatten(rdlines.OutLine))
join_2 = JoinCurves(Curves=ln, Preserve=False)  # -> flatten(Curves)
curvepoint = PointOnCurve(crv, parameter=0.5)
crv_cp = CurveCP(Point=flatten(curvepoint), Curve=graft(join_2))  # -> Point, Parameter, Distance
sort_2 = SortList(Keys=crv_cp.Distance, ValuesA=crv)  # -> Keys, ValuesA
sort_3 = SortList(Keys=crv_cp.Distance, ValuesA=curvepoint)  # -> Keys, ValuesA
pcen = PolygonCenter(Polyline=graft(join_2))  # -> CenterV, CenterE, CenterA
sort_4 = SortList(Keys=crv_cp.Distance, ValuesA=remap.Mapped)  # -> Keys, ValuesA
item_3 = ListItem(List=sort_2.ValuesA, Index=panel_2, Wrap=True)
item_4 = ListItem(List=sort_3.ValuesA, Index=panel_2, Wrap=True)
vec2pt = Vector2Pt(PointA=item_4, PointB=pcen.CenterV, Unitize=False)  # -> Vector, Length
item_5 = ListItem(List=sort_4.ValuesA, Index=panel_2, Wrap=True)
amp = Amplitude(Vector=vec2pt.Vector, Amplitude=item_5)
move = Move(Geometry=item_3, Motion=amp)  # -> simplify(Geometry), Transform
shift = ShiftList(List=move.Geometry, Shift=1, Wrap=True)
ccx = CurveCurve(CurveA=move.Geometry, CurveB=shift)  # -> Points, ParamsA, ParamsB
path_mapper = PathMapper(ccx.Points, source="{A;B;C}", target="{A}")
avr = Average(Input=amp)  # -> flatten(ArithmeticMean)
fillet_outer_edges = BooleanToggle(False)
fillet_inner_edges = BooleanToggle(True)
bnd = Bounds(Numbers=avr)
remap_2 = RemapNumbers(Value=avr, Source=bnd, Target=Domain(0, 1))  # -> Mapped, Clipped
gradient = Gradient(
    LowerLimit=0,
    UpperLimit=1,
    Parameter=remap_2.Mapped,
    stops=[0: RGB(243, 57, 0), 0.1: RGB(236, 27, 60), 0.2: RGB(210, 0, 118), 0.3: RGB(103, 0, 120), 0.4: RGB(39, 72, 161), 0.5: RGB(1, 192, 229), 0.6: RGB(18, 178, 90), 0.7: RGB(79, 186, 8), 0.8: RGB(220, 237, 32), 0.9: RGB(247, 159, 20), 1: RGB(243, 57, 0)])

# ----
crv_2 = Curve(join_2)

# ---- group: Scale Module Edges (continued)
explode_4 = Explode(Curve=crv_2, Recursive=True)  # -> Segments, Vertices
flip_3 = FlipMatrix(Data=explode_4.Vertices)
bang_3 = ExplodeTree(Data=flip_3)  # -> Branch0, Branch1, Branch2, Branch3
pl_3pt = Plane3Pt(PointA=bang_3.Branch0, PointB=bang_3.Branch1, PointC=bang_3.Branch2)  # -> flatten(Plane)
hull = ConvexHull(Points=path_mapper, Plane=simplify(graft(pl_3pt)))  # -> simplify(Hull), HullZ, Indices
fillet = Fillet(Curve=hull.Hull, Radius=0.15)
fillet_2 = Fillet(Curve=crv_2, Radius=0.05)
filter_2 = StreamFilter(Gate=fillet_inner_edges, Stream0=hull.Hull, Stream1=fillet)
filter_3 = StreamFilter(Gate=fillet_outer_edges, Stream0=crv_2, Stream1=fillet_2)
merge = Merge(Data1=simplify(filter_2), Data2=simplify(graft(filter_3)))
planar = PlanarSrf(Edges=merge)
preview = CustomPreview(Geometry=planar, Shader=graft(gradient))
