# Grasshopper definition 05_InformedGeometryScaleOpeningsByInnerForces.gh (Grasshopper 1.0.7)
# plug-ins: Karamba3D, MeshEdit Components

# ---- group: Create Geometry
pipeline = GeometryPipeline(
    GroupByLayer=False,
    GroupByType=False,
    IncludeHidden=True,
    IncludeLocked=True,
    LayerFilter="input_surface",
    NameFilter="*",
    SublayerFiltering=True,
    TypeFilter=1073741848)
number_slider = Slider(12, range=2..20)
number_slider_2 = Slider(10, range=2..20)
srf = Surface(pipeline)
# 05 - Informed Geometry - Scale Openings by Inner Forces
# Difficulty: Hard | Version 3.1.4
# Shows how to scale the size of openings on a surface depending on internal forces.  Make sure to open the Rhino File (05_InformedGeometry) which has the reference geometry.
sdivide = DivideSurface(Surface=srf, UCount=number_slider, VCount=number_slider_2)  # -> Points, Normals, Parameters
sdivide_2 = DivideSurface(Surface=srf, UCount=1, VCount=1)  # -> flatten(Points), Normals, Parameters
frompoints = MeshFromPoints(Points=flatten(sdivide.Points), UDirection=expr("x+1", number_slider), VDirection=expr("x+1", number_slider_2))
item = ListItem(List=sdivide_2.Points, Index=0, Wrap=True)  # -> Item, Item1, Item2, Item3
faceb = FaceBoundaries(Mesh=frompoints)
aligndim = AlignedDimension(
    Plane=PlaneXY(0, 0, 0),
    PointA=[item.Item, item.Item1],
    PointB=[item.Item1, item.Item3],
    Offset=-2,
    Text="{0:0.00}",
    Size=1)
explode = Explode(Curve=faceb, Recursive=True)  # -> Segments, Vertices
rdlines = RemoveDuplicateLinesKaramba3D(Line=flatten(explode.Segments), LimitDistance=0.005)  # -> OutLine, Info, Indexes

# ---- group: Define Loads
loads = LoadsKaramba3D(Vector=Vector(0, 0, -1), LCase="LC0", mode="Gravity")

# ---- group: Define Elements
lineelem = CreateLinearElementKaramba3D(
    Line=rdlines.OutLine,
    LimitDistance_m=0.005,
    BucklingLengthY_m=-1,
    BucklingLengthZ_m=-1,
    BucklingLengthLT_m=-1,
    Bending=True,
    ToPolylineMaxAngle=0.03,
    ToPolylineTolerance=0.01,
    ToPolylineMaxEdgeLength=0.25,
    New=True,
    Remove=True,
    mode="LineToBeam")  # -> Element, Points, Info

# ---- group: Define Supports
pipeline_2 = GeometryPipeline(
    GroupByLayer=False,
    GroupByType=False,
    IncludeHidden=True,
    IncludeLocked=True,
    LayerFilter="input supports",
    NameFilter="*",
    SublayerFiltering=True,
    TypeFilter=1073741848)
pt = Point(lineelem.Points)
brepsinc = PointInBreps(Brep=pipeline_2, Point=pt, Strict=False)  # -> Inside, Index
cull = CullPattern(List=pt, CullPattern=brepsinc.Inside)
supp = SupportKaramba3D(PosInd=cull, menu=[buttons(on, on, on, on, off, off)])

# ---- group: Assemble Model
assemble = AssembleModelKaramba3D(Elem=lineelem.Element, Support=supp, Load=loads, LimitDistance_m=0.005)  # -> Model, Info, Mass_kg, CentreOfGravity, LoadCaseNames

# ---- group: Analyze Model
analyse = AnalyseKaramba3D(Model=assemble.Model)  # -> AnalysedModel, MaximumDisplacement_cm, ResultingForce_kN, ChangeOfElasticEnergy_kNm
panel = Panel(analyse.MaximumDisplacement_cm)

# ---- group: View Results
modelview = ModelViewKaramba3D(Model=analyse.AnalysedModel)  # -> Model, DeformedMesh, DeformedAxes, DeformedModel, MaximumDeformation
beamview = BeamViewKaramba3D(Model=modelview.Model)  # -> Model, MeshesOfRenderedBeams, DeformedBeamAxes, LegendColours, LegendTags
legend = Legend(Colour=beamview.LegendColours, Tags=beamview.LegendTags, LegendType=1)

# ---- group: Scale Openings
disassemble = DisassembleModelKaramba3D(Model=analyse.AnalysedModel)  # -> Model, Point, Beam, Shell, Support, Load, Line, Mesh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
normal_false_or_moment_true_forces = BooleanToggle(False)
curvepoint = PointOnCurve(explode.Segments, parameter=0.5)
curvepoint_2 = PointOnCurve(rdlines.OutLine, parameter=0.5)
b_forces = BeamForcesKaramba3D(AnalysedModel=analyse.AnalysedModel, Ts="0.5")  # -> Model, flatten(NormalForce_kN), ShearForceVz_kN, ShearForceVy_kN, TorsionalMomentMt_kNm, BendingMomentMy_kNm, BendingMomentMz_kNm, LoadCaseIndex
fsim = FindSimilarMember(Data=curvepoint, Set=curvepoint_2)  # -> Hit, simplify(Index)
vec = VectorXYZ(
    XComponent=b_forces.TorsionalMomentMt_kNm,
    YComponent=b_forces.BendingMomentMy_kNm,
    ZComponent=b_forces.BendingMomentMz_kNm)  # -> flatten(Vector), Length
int = Integer(fsim.Index)
item_2 = ListItem(List=disassemble.Line, Index=int, Wrap=True)
filter = StreamFilter(Gate=normal_false_or_moment_true_forces, Stream0=b_forces.NormalForce_kN, Stream1=vec.Vector)
abs = Absolute(Value=filter)
sqrt = SquareRoot(Value=abs)
flip = FlipCurve(Curve=item_2, Guide=explode.Segments)  # -> Curve, Flag
item_3 = ListItem(List=sqrt, Index=int, Wrap=True)
bnd = Bounds(Numbers=flatten(item_3))
remap = RemapNumbers(Value=item_3, Source=bnd, Target=Domain(0, 1))  # -> Mapped, Clipped
graph = GraphMapper(remap.Mapped, x0=0, x1=1, y0=0, y1=1, container_name="Bezier", cpx=[0, 0.2849262655, 0.1706542969, 1], cpy=[1, 1, 0, 0])
remap_2 = RemapNumbers(Value=graph, Source=Domain(0, 1), Target="0.4 to 0.95")  # -> Mapped, Clipped
end = EndPoints(Curve=flip.Curve)  # -> Start, End
end_2 = EndPoints(Curve=flip.Curve)  # -> Start, End
shift = ShiftList(List=remap_2.Mapped, Shift=-1, Wrap=True)
gradient = Gradient(
    LowerLimit=0,
    UpperLimit=1,
    Parameter=graph,
    stops=[0: RGB(234, 38, 0), 0.25: RGB(234, 126, 0), 0.5: RGB(254, 244, 84), 0.75: RGB(173, 203, 249), 1: RGB(75, 107, 169)])
avr = Average(Input=[end_2.Start, end_2.End])
expression = Expression(x=remap_2.Mapped, y=shift, Expression="(x+y)/2")
scale = Scale(Geometry=end_2.Start, Center=avr, Factor=expression)  # -> Geometry, Transform
pt_2 = Point(simplify(end.Start))
pt_3 = Point(simplify(scale.Geometry))
shift_2 = ShiftList(List=gradient, Shift=-1, Wrap=True)
expression_2 = Expression(x=gradient, y=shift_2, Expression="(x+y)/2")
item_4 = ListItem(List=pt_2, Index=0, Wrap=True)
item_5 = ListItem(List=pt_3, Index=0, Wrap=True)
lng = ListLength(List=pt_2)
item_6 = ListItem(List=expression_2, Index=0, Wrap=True)
merge = Merge(Data1=pt_2, Data2=item_4, Data3=pt_3, Data4=item_5)
merge_2 = Merge(Data1=expression_2, Data2=item_6, Data3=expression_2, Data4=item_6)
frompoints_2 = MeshFromPoints(Points=merge, UDirection=2, VDirection=expr("x+1", lng), Colour=merge_2)  # -> flatten(Mesh)
