# Grasshopper definition 05_ModularBESOSpatialTruss.gh (Grasshopper 1.0.8)
# plug-ins: Karamba3D, Human

# ---- group: Create Geometry
srf = Surface([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])
dim = Dimensions(Surface=srf)  # -> UDimension, VDimension
number_slider = Slider(7, range=0..10)
avr = Average(Input=dim.VDimension)
avr_2 = Average(Input=dim.UDimension)
division = Division(A=avr_2, B=number_slider)
division_2 = Division(A=avr, B=number_slider)
# 05 - Modular BESO Spatial Truss
# Difficulty: Moderate | Version 3.1.4
# 
# A spacial truss is generated from 3 input surfaces. BESO for Beams is used to remove a certain percentage of beams. Reference geometry is used to map onto the beams by according to their normal force values.
sdivide = DivideSurface(Surface=srf, UCount=division, VCount=division_2)  # -> Points, Normals, Parameters
trim = TrimTree(Tree=sdivide.Points, Depth=1)
flip = FlipMatrix(Data=trim)
number_slider_2 = Slider(4, range=0..20)
nurbs = NurbsCurve(Vertices=flip, Degree=2, Periodic=False)  # -> Curve, Length, Domain
divide = DivideCurve(Curve=nurbs.Curve, Count=number_slider_2, Kinks=False)  # -> flatten(Points), Tangents, Parameters
series = Series(Start=0, Step=1, Count=expr("x+1", number_slider_2))
series_2 = Series(Start=0, Step=1, Count=expr("x+1", division))
series_3 = Series(Start=0, Step=1, Count=expr("x+1", division_2))
crossref = CrossReference(ListA=series, ListB=series_3, ListC=series_2, CrossMode=1)  # -> ListA, ListB, ListC
vec = VectorXYZ(XComponent=crossref.ListA, YComponent=crossref.ListB, ZComponent=crossref.ListC)  # -> Vector, Length
prox = Proximity3D(Points=vec.Vector, Group=27, MaxRadius="sqrt(3)")  # -> Links, Topology
devec = DeconstructVector(Vector=prox.Links)  # -> XComponent, YComponent, ZComponent
item = ListItem(List=divide.Points, Index=prox.Topology, Wrap=True)
larger = LargerThan(FirstNumber=expr("abs(x)", devec.XComponent), SecondNumber=0)  # -> LargerThan, OrEqualTo
ln = Line(StartPoint=graft(divide.Points), EndPoint=item)
dispatch = Dispatch(List=ln, DispatchPattern=larger.LargerThan)  # -> ListA, ListB
entwine = Entwine(Branch00=dispatch.ListA, Branch01=dispatch.ListB, FlattenInputs=True)
rdlines = RemoveDuplicateLinesKaramba3D(Line=entwine, LimitDistance=0.005)  # -> OutLine, Info, Indexes

# ---- group: Line to Beam
crv = Curve(rdlines.OutLine)
panel = Panel("""A
B""")
lineelem = CreateLinearElementKaramba3D(
    Line=crv,
    Identifier=graft(panel),
    LimitDistance_m=0.005,
    BucklingLengthY_m=-1,
    BucklingLengthZ_m=-1,
    BucklingLengthLT_m=-1,
    Bending=True,
    ToPolylineMaxAngle=0.03,
    ToPolylineTolerance=0.01,
    ToPolylineMaxEdgeLength=0.25,
    New=True,
    Remove=True,
    mode="LineToBeam")  # -> flatten(Element), flatten(Points), Info

# ---- group: Supports / support pts
pt = Point([Point(-0.2475490684, 2.341842181, 0), Point(57.13781319, -7.919745373, 0), Point(21.7356525, 24.38986411, 0)])

# ---- group: Supports
fsim = FindSimilarMember(Data=pt, Set=lineelem.Points)  # -> Hit, Index
supp = SupportKaramba3D(PosInd=fsim.Hit, menu=[buttons(on, on, on, off, off, off)])

# ----
loads = LoadsKaramba3D(Vector=Vector(0, 0, -1), LCase="LC0", mode="Gravity")

# ---- group: Assemble Model
assemble = AssembleModelKaramba3D(Elem=flatten(lineelem.Element), Support=flatten(supp), Load=flatten(loads), LimitDistance_m=0.005)  # -> Model, Info, Mass_kg, CentreOfGravity, LoadCaseNames

# ---- group: Beso for Beams
besobeam = BESOForBeamsKaramba3D(
    Model=assemble.Model,
    ElemIdentifiers="A",
    TargetVolumeRatio="0.4",
    NumberOfChangeIterations=Slider(31, range=0..100),
    NumberOfConvergenceIterations=20,
    WeightingFactorForTension=1,
    WeightingFactorForCompression=1,
    WeightingFactorForShear=0,
    WeightingFactorForMoments=0,
    BESOFactor=0,
    MinimumDistanceBetweenChangingElements=0,
    RelativeWeightLimit=0)  # -> MaximumDisplacement_cm, OptimizedModel, HistoryOfTheBESO, ElementIsActive, DistributionOfWeights

# ---- group: Analyse Model
analyse = AnalyseKaramba3D(Model=besobeam.OptimizedModel)  # -> AnalysedModel, MaximumDisplacement_cm, ResultingForce_kN, ChangeOfElasticEnergy_kNm

# ---- group: View Results and Create Geometry / reference geometry
mesh = Mesh(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)
mesh_2 = Mesh(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)
mesh_3 = Mesh(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)
entwine_2 = Entwine(Branch00=mesh, Branch01=mesh_2, Branch02=mesh_3, FlattenInputs=True)  # -> simplify(Result)
preview = CustomPreview(
    Geometry=entwine_2,
    Shader=graft([ColourSwatch(SwatchColor=RGB(255, 140, 0)), ColourSwatch(SwatchColor=RGB(222, 222, 222)), ColourSwatch(SwatchColor=RGB(0, 115, 255))]))

# ---- group: View Results and Create Geometry
modelview = ModelViewKaramba3D(Model=analyse.AnalysedModel)  # -> Model, DeformedMesh, DeformedAxes, DeformedModel, MaximumDeformation
b_forces = BeamForcesKaramba3D(AnalysedModel=modelview.Model, Ts=[0, 1])  # -> Model, NormalForce_kN, ShearForceVz_kN, ShearForceVy_kN, TorsionalMomentMt_kNm, BendingMomentMy_kNm, BendingMomentMz_kNm, LoadCaseIndex
cull = CullPattern(List=flatten(b_forces.NormalForce_kN), CullPattern=besobeam.ElementIsActive)
disassemble = DisassembleModelKaramba3D(Model=b_forces.Model)  # -> Model, Point, Beam, Shell, Support, Load, Line, Mesh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
disassemble_2 = DisassembleElementKaramba3D(Element=disassemble.Beam)  # -> Element, ElementIdentifier, AxisOfElement, CrossSection, Joint, Material, LocalCoordinateSystem, ElementIsActive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
cull_2 = CullPattern(List=disassemble_2.AxisOfElement, CullPattern=disassemble_2.ElementIsActive)
cull_3 = CullPattern(List=disassemble_2.LocalCoordinateSystem, CullPattern=disassemble_2.ElementIsActive)
len = Length(Curve=cull_2)
pln = Plane(cull_3)
crv_2 = Curve(disassemble_2.AxisOfElement)
expression = Expression(x=len, Expression="x*0.4")

# ---- group: View Results and Create Geometry / smooth numbers
y = Slider(0.49, range=0.1..1)
expression_2 = Expression(x=cull, y=y, Expression="(x/abs(x))*(abs(x))^y")

# ---- group: View Results and Create Geometry / remap negative numbers to [-1 to 0] and remap positive numbers to [0 to +1]
num = Number(expression_2)
bnd = Bounds(Numbers=num)
larger_2 = LargerThan(FirstNumber=num, SecondNumber=0)  # -> LargerThan, OrEqualTo
dedomain = DeconstructDomain(Domain=bnd)  # -> Start, End
item_2 = ListItem(List=[dedomain.Start, dedomain.End], Index=larger_2.LargerThan, Wrap=True)
abs = Absolute(Value=item_2)
division_3 = Division(A=num, B=abs)

# ---- group: View Results and Create Geometry / find results domain
num_2 = Number(cull)
bnd_2 = Bounds(Numbers=num_2)
number_slider_3 = Slider(0.055, range=0..1)
number_slider_4 = Slider(0.046, range=0..1)
dedomain_2 = DeconstructDomain(Domain=bnd_2)  # -> Start, End

# ---- group: View Results and Create Geometry (continued)
multiplication = Multiplication(A=dedomain_2.Start, B=number_slider_4)
multiplication_2 = Multiplication(A=dedomain_2.End, B=number_slider_3)
num_3 = Number(division_3)
graph = QuickGraph(division_3, SortOrder=0)
gradient = Gradient(
    LowerLimit="-1",
    UpperLimit="1",
    Parameter=num_3,
    stops=[0.304: RGB(255, 0, 0), 0.497: RGB(255, 255, 255), 0.696: RGB(0, 21, 255)])
expression_3 = Expression(x=num_3, y=Slider(9, range=0..10), Expression="abs(x)*y+1")
previewlw = CustomPreviewLineweights(Geometry=crv_2, Shader=gradient, Thickness=expression_3)

# ---- group: View Results and Create Geometry / find results domain (continued)
merge = Merge(Data1=dedomain_2.Start, Data2=multiplication, Data3=multiplication_2, Data4=dedomain_2.End)
consec = ConsecutiveDomains(Numbers=merge, Additive=False)
fdom = FindDomain(Domains=consec, Number=num_2, Strict=False)  # -> Index, Neighbour

# ---- group: View Results and Create Geometry (continued)
int = Integer(fdom.Neighbour)
branch = TreeBranch(Tree=entwine_2, Path=graft(int), MaintainPaths=False)
orient = Orient(Geometry=branch, Source=PlaneXY(0, 0, 0), Target=graft(pln))  # -> Geometry, Transform
scale_nu = ScaleNU(Geometry=orient.Geometry, Plane=graft(pln), ScaleX=graft(len), ScaleY=graft(expression), ScaleZ=graft(expression))  # -> Geometry, Transform
tstat = TreeStatistics(Tree=scale_nu.Geometry)  # -> Paths, Length, Count
replace = ReplacePaths(Data=scale_nu.Geometry, Search=tstat.Paths, Replace=int)
preview_2 = CustomPreview(
    Geometry=replace,
    Shader=graft([ColourSwatch(SwatchColor=RGB(255, 140, 0)), ColourSwatch(SwatchColor=RGB(222, 222, 222)), ColourSwatch(SwatchColor=RGB(0, 115, 255))]))
