# Grasshopper definition 05_ParametricShellAndColumns.gh (Grasshopper 1.0.7)
# plug-ins: Karamba3D

# ---- group: Generate Geometry
number_slider = Slider(7.5, range=0..10)
genes = GenePool(
    Decimals=3,
    Maximum=1,
    Minimum=0,
    Value=[0.782, 0.913, 0.1375124166, 0.7477185976, 0.6834161671, 0.114396723, 0.6820161993, 0.4946628811, 0.00762386667, 0.7694403123, 0.65854415, 0.2529002057, 0.5906279341, 0.921122123, 0.8717113281, 0.6867699645])
pt_count_x_y = Panel("4")
multiplication = Multiplication(A=genes, B=Slider(8.6, range=0..10))
dom = ConstructDomain(DomainStart=expr("-x", number_slider), DomainEnd=number_slider)
range = Range(Domain=dom, Steps=expr("x-1", pt_count_x_y))
partition = PartitionList(List=multiplication, Size=pt_count_x_y)
genes_2 = GenePool(
    Decimals=3,
    Maximum=1,
    Minimum=0,
    Value=[0.8252065954, 0.22, 0.7495298347, 0.743, 0.5213073522, 0.6779720428, 0.217897181, 0.461, 0.5343975423, 0.536])
genes_3 = GenePool(Decimals=3, Maximum=1, Minimum=0, Value=[0.369, 0.987, 0.124, 0.485, 0.583, 0, 0.914, 0.443, 0.381, 0.828])
# 05 - Parametric Shell and Columns
# Difficulty: Moderate | Version 3.1.4
# The geometry of a shell and column structure is parametrically generated, and the cross sections of the columns are optimized.
# It is possible to define the degrees of freedom of the connection between shell and beams with the Beam-Joints component.
pt = ConstructPoint(XCoordinate=graft(range), YCoordinate=range, ZCoordinate=partition)
dispatch = Dispatch(List=genes_2, DispatchPattern=[True, False])  # -> ListA, ListB
number_slider_2 = Slider(2.3, range=0..10)
srfgrid = SurfaceFromPoints(Points=flatten(pt), UCount=pt_count_x_y, Interpolate=False)
points = PointList(Points=flatten(pt), Tags=True, Lines=True, Size=0.5)
vec = VectorXYZ(XComponent=dispatch.ListA, YComponent=dispatch.ListB, ZComponent=0)  # -> Vector, Length
mesh = MeshBrep(
    Brep=srfgrid,
    Settings={GridMaxCount=240, GridMinCount=240, JaggedSeams=False, MaxEdgeLength=0, MinEdgeLength=0.0001, MinTolerance=0, Refine=False, RefineAngle=0, RelativeTolerance=0, SimplePlanes=False, Tolerance=0})
dom_2 = ConstructDomain(DomainStart=expr("-x", number_slider_2), DomainEnd=number_slider_2)
evalsrf = EvaluateSurface(Surface=reparameterize(srfgrid), Point=vec.Vector)  # -> Point, Normal, UDirection, VDirection, Frame
demesh = DeconstructMesh(Mesh=mesh)  # -> Vertices, Faces, Colours, Normals
remap = RemapNumbers(Value=genes_3, Source=Domain(0, 1), Target=dom_2)  # -> Mapped, Clipped
cp = ClosestPoint(Point=evalsrf.Point, Cloud=demesh.Vertices)  # -> ClosestPoint, CPIndex, Distance
dispatch_2 = Dispatch(List=remap.Mapped, DispatchPattern=[True, False])  # -> ListA, ListB
devec = DeconstructVector(Vector=cp.ClosestPoint)  # -> XComponent, YComponent, ZComponent
addition = Addition(A=devec.XComponent, B=dispatch_2.ListA)
addition_2 = Addition(A=devec.YComponent, B=dispatch_2.ListB)
pt_2 = ConstructPoint(XCoordinate=addition, YCoordinate=addition_2, ZCoordinate=0)

# ---- group: Define Material
matselect = MaterialSelectionKaramba3D(menu=[dropdown(7), dropdown(5)])

# ---- group: Define Cross Section
readcstable = ReadCrossSectionTableFromFileKaramba3D()  # -> CrossSection, Info
crosecrselect = CrossSectionRangeSelectorKaramba3D(
    CrossSections=readcstable.CrossSection,
    MaximumHeight_cm=-1,
    MaximumWidth_cm=-1,
    menu=[dropdown(0), dropdown(2), dropdown(7)])
crosec = CrossSectionKaramba3D(FamilyNameOfCrossSection="DefaultCroSec", Material=matselect, Height_cm="35", mode="Shell - Const")
crosecselect = CrossSectionSelectorKaramba3D(CrossSections=crosecrselect, NameOrListIndexOfCrossSection="90")  # -> CrossSection, Info

# ---- group: Define Elements
tri = Triangulate(Mesh=mesh)  # -> Mesh, Count
ln = Line(StartPoint=cp.ClosestPoint, EndPoint=pt_2)
beam_ids = Panel("Beams")
shell_ids = Panel("Shell")
lineelem = CreateLinearElementKaramba3D(
    Line=ln,
    Identifier=beam_ids,
    CrossSection=crosecselect.CrossSection,
    LimitDistance_m=0.005,
    BucklingLengthY_m=-1,
    BucklingLengthZ_m=-1,
    BucklingLengthLT_m=-1,
    Bending=True,
    ToPolylineMaxAngle=0.03,
    ToPolylineTolerance=0.01,
    ToPolylineMaxEdgeLength=0.25,
    New=True,
    Remove=True,
    mode="LineToBeam")  # -> Element, Points, Info
surfelem = CreateSurfaceElementKaramba3D(Mesh=tri.Mesh, Identifier=shell_ids, CrossSection=crosec, LimitDistance_m=0.005, Bending=True, mode="MeshToShell")  # -> Element, Points, Info

# ---- group: Define Loads
loads = LoadsKaramba3D(Vector=Vector(0, 0, -1), LCase="LC0", mode="Gravity")

# ---- group: Define Joints
beam_ids_2 = Panel("Beams")
beam_joints = BeamJointsKaramba3D(
    BeamIdentifier=beam_ids_2,
    CtKNMAtStartingNode=Vector(0, 0, 0),
    CrKNmRadAtStartingNode=Vector(0, 0, 0),
    CtKNMAtEndNode=Vector(0, 0, 0),
    CrKNmRadAtEndNode=Vector(0, 0, 0),
    menu=[buttons(off, off, off, off, off, off), buttons(off, off, off, off, off, off)])

# ---- group: Define Supports
supp = SupportKaramba3D(PosInd=pt_2, menu=[buttons(on, on, on, on, on, on)])

# ----
crosec_2 = CrossSectionKaramba3D(crosecrselect)
element = ElementKaramba3D([surfelem.Element, lineelem.Element])

# ---- group: Assemble Model
assemble = AssembleModelKaramba3D(Elem=flatten(element), Support=flatten(supp), Load=flatten(loads), Joint=beam_joints, LimitDistance_m=0.005)  # -> Model, Info, Mass_kg, CentreOfGravity, LoadCaseNames

# ---- group: Optimize CrossSection
opticrosec = OptimizeCrossSectionKaramba3D(
    Model=assemble.Model,
    CrossSections=crosec_2,
    MaximumUtilization=1,
    MaximumVirtualWork_kNcm=0.01,
    NumberOfUtilizationIterations=5,
    NumberOfDisplacementIterations=5,
    NumberOfDisplacementIncrementsPerIteration=2,
    DisplacementTolerance=0.01,
    NumberOfSamplePoints=3,
    ElasticDesign=True,
    GammaM0=1,
    GammaM1=1.1,
    SwayFrame=True)  # -> OptimizedModel, Info, Mass_kg, MaximumDisplacement_cm, ElasticEnergyChange_kNm, MaximumUtilizationViewInsufficientCrossSections, MaximumDisplacementViewLimitCrossSections
mass = Panel(opticrosec.Mass_kg)
mass_2 = Panel(opticrosec.MaximumDisplacement_cm)

# ----
modelview = ModelViewKaramba3D(Model=opticrosec.OptimizedModel)  # -> Model, DeformedMesh, DeformedAxes, DeformedModel, MaximumDeformation

# ---- group: View Results
shellview = ShellViewKaramba3D(Model=modelview.Model, IndexOfLayer=0)  # -> Model, MeshesOfRenderedShells, LegendColours, LegendTags
beamview = BeamViewKaramba3D(Model=modelview.Model)  # -> Model, MeshesOfRenderedBeams, DeformedBeamAxes, LegendColours, LegendTags
legend = Legend(Colour=shellview.LegendColours, Tags=shellview.LegendTags, LegendType=1)
legend_2 = Legend(Colour=beamview.LegendColours, Tags=beamview.LegendTags, LegendType=1)
