# Grasshopper definition 05_PrincipalMomentsAsRibs.gh (Grasshopper 1.0.7)
# plug-ins: Karamba3D

srf = Surface(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)
matselect = MaterialSelectionKaramba3D(menu=[dropdown(7), dropdown(1)])

debrep = DeconstructBrep(Brep=srf)  # -> Faces, Edges, Vertices
supp = SupportKaramba3D(PosInd=debrep.Vertices, menu=[buttons(on, on, on, off, off, on)])

crosec = CrossSectionKaramba3D(FamilyNameOfCrossSection="DefaultCroSec", Material=matselect, Height_cm="10", mode="Shell - Const")

# ----
# 05 - Principal Moments As Ribs
# Difficulty: Simple | Version 3.1.4
# After analyzing a shell the Line Results on Shells is used. The Principle Moment Lines are taken for generating a rib geometry for the shell.
# The principal moment lines are tangent to the prinicipal moment directions. After generating the rib geometry the whole system is analyzed as a static system.
number_slider = Slider(1, range=0..10)
mesh_breps = MeshBrepsKaramba3D(
    Brep=srf,
    MeshResolution=number_slider,
    EdgeRefinementFactor=0.67,
    PointReduction=False,
    SmoothingStepSize=0,
    SmoothingIterations=5)  # -> Mesh, Info
mtoshell = MeshToShellKaramba3D(Mesh=mesh_breps.Mesh, CrossSection=crosec, LimitDistance_m=0.005)  # -> Element, Points, Info

loads = LoadsKaramba3D(Vector=Vector(0, 0, -1), LCase="LC0", mode="Gravity")
load = LoadKaramba3D(loads)
srf_2 = Surface(srf)
crosec_2 = CrossSectionKaramba3D(crosec)
support = SupportKaramba3D(supp)

# ---- group: Assemble Model
assemble = AssembleModelKaramba3D(Elem=flatten(mtoshell.Element), Support=flatten(supp), Load=flatten(loads), LimitDistance_m=0.005)  # -> Model, Info, Mass_kg, CentreOfGravity, LoadCaseNames

# ----
pt = Point(mtoshell.Points)

# ---- group: Analyze Model
analyse = AnalyseKaramba3D(Model=assemble.Model)  # -> AnalysedModel, MaximumDisplacement_cm, ResultingForce_kN, ChangeOfElasticEnergy_kNm

# ---- group: View Results
modelview = ModelViewKaramba3D(Model=analyse.AnalysedModel)  # -> Model, DeformedMesh, DeformedAxes, DeformedModel, MaximumDeformation
shellview = ShellViewKaramba3D(Model=modelview.Model, IndexOfLayer=0)  # -> Model, MeshesOfRenderedShells, LegendColours, LegendTags

# ----
panel = Panel("""0
1""")
cull = CullPattern(List=pt, CullPattern=panel)
pt_2 = Point(cull)

shelllineresults = LineResultsOnShellsKaramba3D(
    AnalysedModel=shellview.Model,
    ListOfSourcesOfForceFlowLinesLinesPoints=pt_2,
    SegmentLength_m=0.5,
    DA_deg=5,
    mode="PrincMoment")  # -> Model, Lines1, Lines2
crv = Curve(simplify(shelllineresults.Lines1))
crv_2 = Curve(simplify(shelllineresults.Lines2))
pshift = ShiftPaths(Data=crv, Offset=-1)
pshift_2 = ShiftPaths(Data=crv_2, Offset=-1)
join = JoinCurves(Curves=pshift, Preserve=False)
join_2 = JoinCurves(Curves=pshift_2, Preserve=False)
merge = Merge(Data1=join, Data2=join_2)  # -> flatten(Result)

srf_3 = Surface(srf_2)
srf_4 = Surface(reparameterize(srf_3))

# ---- group: Split Surface with Prinicpal Moment Lines
project = Project(Curve=merge, Brep=srf_4, Direction=Vector(0, 0, 1))  # -> flatten(Curve)
srfsplit = SurfaceSplit(Surface=srf_4, Curves=project)
edges = BrepEdges(Brep=srfsplit)  # -> Naked, Interior, NonManifold
explode = Explode(Curve=edges.Naked, Recursive=True)  # -> Segments, Vertices
end = EndPoints(Curve=explode.Segments)  # -> Start, End
ln = Line(StartPoint=end.Start, EndPoint=end.End)  # -> flatten(Line)
rdlines = RemoveDuplicateLinesKaramba3D(Line=ln, LimitDistance=0.005)  # -> OutLine, Info, Indexes
curvepoint = PointOnCurve(rdlines.OutLine, parameter=0.5)
srf_cp = SurfaceClosestPoint(Point=curvepoint, Surface=srf_4)  # -> Point, UVPoint, Distance
evalsrf = EvaluateSurface(Surface=srf_4, Point=srf_cp.UVPoint)  # -> Point, Normal, UDirection, VDirection, Frame

# ---- group: Define Material
matselect_2 = MaterialSelectionKaramba3D(menu=[dropdown(7), dropdown(1)])

# ---- group: Set Cross Section
division = Division(A="10", B=2)
unit = UnitVector(Vector=evalsrf.Normal)
division_2 = Division(A="20", B=2)
neg = Negative(Value=unit)
addition = Addition(A=division, B=division_2)
multiplication = Multiplication(A=neg, B=addition)
crosec_3 = CrossSectionKaramba3D(
    FamilyNameOfCrossSection="DefaultCroSec",
    Material=matselect_2,
    LocalEccentricity_cm=multiplication,
    Height_cm="20",
    UpperFlangeWidth_cm="5",
    LowerFlangeWidth_cm="5",
    mode="Trapezoid")

# ----
rdpoints = RemoveDuplicatePointsKaramba3D(Point=flatten(explode.Vertices), LimitDistance=0.005)  # -> OutPoint, Info, Indexes
mesh_breps_2 = MeshBrepsKaramba3D(
    Brep=srf_3,
    InclusionPoints=rdpoints.OutPoint,
    MeshResolution=Slider(0.5, range=0..10),
    EdgeRefinementFactor=0.67,
    PointReduction=False,
    SmoothingStepSize=0,
    SmoothingIterations=5)  # -> Mesh, Info
crosec_4 = CrossSectionKaramba3D(crosec_2)
surfelem = CreateSurfaceElementKaramba3D(Mesh=mesh_breps_2.Mesh, CrossSection=crosec_4, LimitDistance_m=0.005, mode="MeshToShell")  # -> Element, Points, Info

lineelem = CreateLinearElementKaramba3D(
    Line=rdlines.OutLine,
    CrossSection=crosec_3,
    LimitDistance_m=0.005,
    ZOrientation=evalsrf.Normal,
    BucklingLengthY_m=-1,
    BucklingLengthZ_m=-1,
    BucklingLengthLT_m=-1,
    Bending=True,
    ToPolylineMaxAngle=0.03,
    ToPolylineTolerance=0.01,
    ToPolylineMaxEdgeLength=0.25,
    New=True,
    Remove=True,
    mode="LineToBeam")  # -> Element, Points, Info
support_2 = SupportKaramba3D(support)
load_2 = LoadKaramba3D(load)

# ---- group: Assemble Model
assemble_2 = AssembleModelKaramba3D(
    Elem=flatten([lineelem.Element, surfelem.Element]),
    Support=flatten(support_2),
    Load=flatten(load_2),
    LimitDistance_m=0.005)  # -> Model, Info, Mass_kg, CentreOfGravity, LoadCaseNames
mass = Panel(assemble_2.Mass_kg)

# ---- group: Analyze Model
analyse_2 = AnalyseKaramba3D(Model=assemble_2.Model)  # -> AnalysedModel, MaximumDisplacement_cm, ResultingForce_kN, ChangeOfElasticEnergy_kNm
displacement = Panel(analyse_2.MaximumDisplacement_cm)

# ---- group: View Results
modelview_2 = ModelViewKaramba3D(Model=analyse_2.AnalysedModel)  # -> Model, DeformedMesh, DeformedAxes, DeformedModel, MaximumDeformation
shellview_2 = ShellViewKaramba3D(Model=modelview_2.Model, IndexOfLayer=0)  # -> Model, MeshesOfRenderedShells, LegendColours, LegendTags
beamview = BeamViewKaramba3D(Model=modelview_2.Model)  # -> Model, MeshesOfRenderedBeams, DeformedBeamAxes, LegendColours, LegendTags
legend = Legend(Colour=beamview.LegendColours, Tags=beamview.LegendTags, LegendType=1)
legend_2 = Legend(Colour=shellview_2.LegendColours, Tags=shellview_2.LegendTags, LegendType=1)

# ----
medges = MeshEdges(Mesh=beamview.MeshesOfRenderedBeams)  # -> NakedEdges, InteriorEdges, NonManifoldEdges
preview = CustomPreview(Geometry=medges.InteriorEdges, Material=ColourSwatch(SwatchColor=RGB(56, 56, 56)))
