# Grasshopper definition 05_ShellRibs.gh (Grasshopper 1.0.7)
# plug-ins: MeshEdit Components, Karamba3D

# ---- group: Generate Geometry
n = Slider(65, range=0..100)
f = Slider(0.68, range=0..1)
o = Slider(3.2, range=0..10)
o_2 = Slider(4, range=0..10)
range = Range(Domain="-10 to 10", Steps=n)
expression = Expression(x=range, y=f, z=graft([o, o_2]), Expression="sin((x+z)*y)")
panel = Panel("""-5
5""")
# 05 - Shell Ribs
# Difficulty: Moderate | Version 3.1.4
# Concrete ribs can be generated and connected to a shell to improve the loadbearing capacity of the shell.
pt = Point(Point(14.46126173, 6.360845297, 0))
pt_2 = PointOriented(BasePlane=pt, UComponent=range, VComponent=graft(panel), WComponent=expression)
n_2 = Slider(28, range=0..100)
n_3 = Slider(17, range=0..100)
nurbs = NurbsCurve(Vertices=pt_2, Degree=3, Periodic=False)  # -> flatten(Curve), Length, Domain
range_2 = Range(Domain=Domain(0, 1), Steps=n_2)
dispatch = Dispatch(List=nurbs.Curve, DispatchPattern=[True, False])  # -> ListA, ListB
vec = VectorXYZ(XComponent=range_2, YComponent=0, ZComponent=0)  # -> Vector, Length
rulesrf = RuledSurface(CurveA=dispatch.ListA, CurveB=dispatch.ListB)
iso = IsoCurve(Surface=reparameterize(rulesrf), UVPoint=vec.Vector)  # -> UIsocurve, VIsocurve
end = EndPoints(Curve=iso.VIsocurve)  # -> flatten(Start), flatten(End)
divide = DivideCurve(Curve=iso.VIsocurve, Count=n_3, Kinks=False)  # -> Points, Tangents, Parameters
pline = PolyLine(Vertices=end.End, Closed=False)
pline_2 = PolyLine(Vertices=end.Start, Closed=False)
pline_3 = PolyLine(Vertices=divide.Points, Closed=False)
explode = Explode(Curve=pline_3, Recursive=True)  # -> Segments, Vertices
explode_2 = Explode(Curve=[pline_2, pline], Recursive=True)  # -> Segments, Vertices
entwine = Entwine(Branch00=explode_2.Segments, Branch01=explode.Segments, FlattenInputs=True)

# ---- group: Define Material
matselect = MaterialSelectionKaramba3D(menu=[dropdown(7), dropdown(4)])

# ---- group: Define Cross Section
panel_2 = Panel("""{0,0,-23}
{0,0,-8}""")
panel_3 = Panel("""45
15""")
panel_4 = Panel("""15
5""")
crosec = CrossSectionKaramba3D(
    FamilyNameOfCrossSection="DefaultCroSec",
    Material=matselect,
    LocalEccentricity_cm=graft(panel_2),
    Height_cm=graft(panel_3),
    UpperFlangeWidth_cm=graft(panel_4),
    LowerFlangeWidth_cm=graft(panel_4),
    mode="Trapezoid")

# ---- group: Define Supports
end_2 = EndPoints(Curve=iso.VIsocurve)  # -> Start, End
multiplication = Multiplication(A=n_2, B=[Slider(0.21, range=0..1), Slider(0.77, range=0..1)])
branch = TreeBranch(Tree=simplify([end_2.Start, end_2.End]), Path=multiplication, MaintainPaths=True)
bang = ExplodeTree(Data=branch)  # -> Branch0, Branch1
supp = SupportKaramba3D(PosInd=bang.Branch0, menu=[buttons(on, on, on, off, off, off)])
supp_2 = SupportKaramba3D(PosInd=bang.Branch1, menu=[buttons(off, on, on, off, off, off)])
support = SupportKaramba3D([supp, supp_2])

# ---- group: Define and Orient Element
curvepoint = PointOnCurve(pline_3, parameter=0.745)
srf_cp = SurfaceClosestPoint(Point=curvepoint, Surface=rulesrf)  # -> Point, UVPoint, Distance
evalsrf = EvaluateSurface(Surface=rulesrf, Point=srf_cp.UVPoint)  # -> Point, Normal, UDirection, VDirection, Frame
panel_5 = Panel("""Beams_A
Beams_B""")
repeat = RepeatData(Data=evalsrf.Normal, Length=n_3)
Z = UnitZ(Factor=1)
lineelem = CreateLinearElementKaramba3D(
    Line=entwine,
    Identifier=graft(panel_5),
    CrossSection=crosec,
    LimitDistance_m=0.005,
    BucklingLengthY_m=-1,
    BucklingLengthZ_m=-1,
    BucklingLengthLT_m=-1,
    Bending=True,
    ToPolylineMaxAngle=0.03,
    ToPolylineTolerance=0.01,
    ToPolylineMaxEdgeLength=0.25,
    New=True,
    Remove=True,
    mode="LineToBeam")  # -> Element, Points, Info
entwine_2 = Entwine(Branch00=Z, Branch01=repeat, FlattenInputs=True)
orientate = OrientateElemKaramba3D(Beam=lineelem.Element, ZOrientation=entwine_2, mode="Beam")

# ---- group: Define Cross Section
crosec_2 = CrossSectionKaramba3D(
    FamilyNameOfCrossSection="DefaultCroSec",
    ElementIdentifier="shell",
    Material=matselect,
    Height_cm="1",
    mode="Shell - Const")

# ---- group: Define Element
frompoints = MeshFromPoints(Points=flatten(divide.Points), UDirection=expr("x+1", n_2), VDirection=expr("x+1", n_3))
surfelem = CreateSurfaceElementKaramba3D(Mesh=frompoints, Identifier="shell", CrossSection=crosec_2, LimitDistance_m=0.005, Bending=True, mode="MeshToShell")  # -> Element, Points, Info

# ---- group: Define Loads
loads = LoadsKaramba3D(Vector=Vector(0, 0, -1), LCase="LC0", mode="Gravity")

# ---- group: Assemble Model
assemble = AssembleModelKaramba3D(Elem=flatten([orientate, surfelem.Element]), Support=flatten(support), Load=flatten(loads), LimitDistance_m=0.005)  # -> Model, Info, Mass_kg, CentreOfGravity, LoadCaseNames
mass = Panel(assemble.Mass_kg)

# ---- group: Analyze Model
analyse = AnalyseKaramba3D(Model=assemble.Model)  # -> AnalysedModel, MaximumDisplacement_cm, ResultingForce_kN, ChangeOfElasticEnergy_kNm
displacement = Panel(analyse.MaximumDisplacement_cm)

# ---- group: View Results
modelview = ModelViewKaramba3D(Model=analyse.AnalysedModel)  # -> Model, DeformedMesh, DeformedAxes, DeformedModel, MaximumDeformation
shellview = ShellViewKaramba3D(Model=modelview.Model, IndexOfLayer=0)  # -> Model, MeshesOfRenderedShells, LegendColours, LegendTags
beamview = BeamViewKaramba3D(Model=modelview.Model)  # -> Model, MeshesOfRenderedBeams, DeformedBeamAxes, LegendColours, LegendTags
legend = Legend(Colour=beamview.LegendColours, Tags=beamview.LegendTags, LegendType=1)
legend_2 = Legend(Colour=shellview.LegendColours, Tags=shellview.LegendTags, LegendType=1)
