# Grasshopper definition 05_SmoothCrossSectionHeightsFromMoments.gh (Grasshopper 1.0.7)
# plug-ins: Karamba3D, MeshEdit Components

# ---- group: Create Geometry
pt = Point(Point(9.526762916, 20.00815252, 0))
slider = Slider(15, range=0..40)
slider_2 = Slider(20, range=0..40)
# 05 - Smooth Cross Section Heights from Moments
# Difficulty: Hard | Version 3.1.4
# Takes the original CrossSectionHeightsfromMoments definition and smoothens the beam heights and then reassembling the model in Karamba to calculate the final model. A meshload is applied on the overall structure.
# The Eccentricities on Beam component aligns the top of all beams in one plane.
sqgrid = Square(Plane=pt, Size=1, ExtentX=slider, ExtentY=slider_2)  # -> flatten(Cells), flatten(Points)
bbox = BoundingBox(Content=sqgrid.Cells, Plane=PlaneXY(0, 0, 0), UnionBox=True)  # -> Box, Box_2
explode = Explode(Curve=sqgrid.Cells, Recursive=True)  # -> flatten(Segments), Vertices
debrep = DeconstructBrep(Brep=bbox.Box)  # -> Faces, Edges, Vertices
item = ListItem(List=debrep.Vertices, Index=0, Wrap=True)  # -> Item, Item1, Item2, Item3
aligndim = AlignedDimension(
    Plane=PlaneXY(0, 0, 0),
    PointA=[item.Item, item.Item1],
    PointB=[item.Item1, item.Item2],
    Offset=-1,
    Text="{0:0.00}",
    Size=1)

# ---- group: Define Supports
md_slider = MDSlider(
    SliderMode=0,
    slider_value=Point(0.8059998489, 0.2058537181, 0.5),
    x_domain=Domain(0, 1),
    y_domain=Domain(0, 1),
    z_domain=Domain(0, 1))
md_slider_2 = MDSlider(
    SliderMode=0,
    slider_value=Point(0.3089842447, 0.3034973145, 0.5),
    x_domain=Domain(0, 1),
    y_domain=Domain(0, 1),
    z_domain=Domain(0, 1))
md_slider_3 = MDSlider(
    SliderMode=0,
    slider_value=Point(0.2170731614, 0.8169756633, 0.5),
    x_domain=Domain(0, 1),
    y_domain=Domain(0, 1),
    z_domain=Domain(0, 1))
md_slider_4 = MDSlider(
    SliderMode=0,
    slider_value=Point(0.704536438, 0.6944393995, 0.5),
    x_domain=Domain(0, 1),
    y_domain=Domain(0, 1),
    z_domain=Domain(0, 1))
range = Range(Domain=Domain(0, 1), Steps=expr("x+1", slider))
range_2 = Range(Domain=Domain(0, 1), Steps=expr("x+1", slider_2))
cull_i = CullIndex(List=reverse(range), Indices=0, Wrap=False)  # -> reverse(List)
cull_i_2 = CullIndex(List=reverse(range_2), Indices=0, Wrap=False)  # -> reverse(List)
cull_i_3 = CullIndex(List=range, Indices=0, Wrap=False)
cull_i_4 = CullIndex(List=range_2, Indices=0, Wrap=False)
vcomp = Decompose(Vector=[md_slider_2, md_slider_3, md_slider_4, md_slider])  # -> XComponent, YComponent, ZComponent
dom = Domain(DomainStart=cull_i, DomainEnd=cull_i_3)
dom_2 = Domain(DomainStart=cull_i_2, DomainEnd=cull_i_4)
fdom = FindDomain(Domains=dom, Number=vcomp.XComponent, Strict=False)  # -> Index, Neighbour
fdom_2 = FindDomain(Domains=dom_2, Number=vcomp.YComponent, Strict=False)  # -> Index, Neighbour
eval = Evaluate(F="x*(y+1)+z", x=fdom.Index, y=slider_2, z=fdom_2.Index)
item_2 = ListItem(List=sqgrid.Points, Index=eval, Wrap=True)
supp = SupportKaramba3D(PosInd=item_2, menu=[buttons(on, on, on, off, off, off)])

# ---- group: Define Elements
rdlines = RemoveDuplicateLinesKaramba3D(Line=explode.Segments, LimitDistance=0.005)  # -> OutLine, Info, Indexes
lng = ListLength(List=rdlines.OutLine)
series = Series(Start=0, Step=1, Count=lng)
int = Integer(series)
concat = Concatenate(FragmentA="BEAM_", FragmentB=int)
lineelem = CreateLinearElementKaramba3D(
    Line=rdlines.OutLine,
    Identifier=concat,
    LimitDistance_m=0.005,
    BucklingLengthY_m=-1,
    BucklingLengthZ_m=-1,
    BucklingLengthLT_m=-1,
    Bending=True,
    ToPolylineMaxAngle=0.03,
    ToPolylineTolerance=0.01,
    ToPolylineMaxEdgeLength=0.25,
    New=True,
    Remove=True,
    mode="LineToBeam")  # -> Element, Points, Info

# ---- group: Define Loads
frompoints = MeshFromPoints(Points=sqgrid.Points, UDirection=expr("x+1", slider), VDirection=expr("x+1", slider_2))
Z = UnitZ(Factor="-2")
loads = LoadsKaramba3D(Vector=Vector(0, 0, -1), LCase="LC0", mode="Gravity")
loads_2 = LoadsKaramba3D(Vector=Z, Mesh=frompoints, LCase="LC0", mode="MeshLoad -Const.", menu=[buttons(off, on, off), buttons(on, on)])
load = LoadKaramba3D([loads, loads_2])

# ----
support = SupportKaramba3D(supp)

# ---- group: Assemble Model
assemble = AssembleModelKaramba3D(Elem=lineelem.Element, Support=support, Load=load, LimitDistance_m=0.005)  # -> Model, Info, Mass_kg, CentreOfGravity, LoadCaseNames

# ---- group: Analyse Model
analyse = AnalyseKaramba3D(Model=assemble.Model)  # -> AnalysedModel, MaximumDisplacement_cm, ResultingForce_kN, ChangeOfElasticEnergy_kNm

# ---- group: View Results
modelview = ModelViewKaramba3D(Model=analyse.AnalysedModel)  # -> Model, DeformedMesh, DeformedAxes, DeformedModel, MaximumDeformation
beamview = BeamViewKaramba3D(Model=modelview.Model)  # -> Model, MeshesOfRenderedBeams, DeformedBeamAxes, LegendColours, LegendTags

# ---- group: Create Beams from Heights
crv = Curve(flatten(rdlines.OutLine))
crv_2 = Curve(beamview.DeformedBeamAxes)
Z_2 = UnitZ(Factor=-1)
column_diameter_cm = Panel("30")
end = EndPoints(Curve=graft(crv))  # -> Start, End
end_2 = EndPoints(Curve=crv_2)  # -> Start, End
line = LineSDL(Start=item_2, Direction=Z_2, Length="3")
pt_2 = Point([end.Start, end.End])
pt_3 = Point([end_2.Start, end_2.End])
project = Project(Geometry=pt_3, Plane=PlaneXY(0, 0, 0))  # -> Geometry, Transform
pipe = Pipe(Curve=line, Radius=expr("x/200", column_diameter_cm), Caps=0)
pgroups = PointGroups(Points=project.Geometry, Distance="0.01")  # -> Groups, Indices
item_3 = ListItem(List=pt_3, Index=pgroups.Indices, Wrap=True)
avr = Average(Input=item_3)  # -> flatten(ArithmeticMean)
project_2 = Project(Geometry=flatten(avr), Plane=PlaneXY(0, 0, 0))  # -> Geometry, Transform
cp = ClosestPoint(Point=project.Geometry, Cloud=project_2.Geometry)  # -> ClosestPoint, CPIndex, Distance
item_4 = ListItem(List=avr, Index=cp.CPIndex, Wrap=True)
lng_2 = ListLength(List=item_4)
series_2 = Series(Start=0, Step=1, Count=expr("x/2", lng_2))
series_3 = Series(Start=series_2, Step=expr("x/2", lng_2), Count=2)
item_5 = ListItem(List=item_4, Index=series_3, Wrap=True)
pdecon = Deconstruct(Point=item_5)  # -> XComponent, YComponent, ZComponent
num = Number(pdecon.ZComponent)
bnd = Bounds(Numbers=flatten(num))
remap = RemapNumbers(Value=num, Source=bnd, Target=Domain(0, 1))  # -> Mapped, Clipped
min_beam_height_m = Panel("1")
min_beam_height_m_2 = Panel("0.02")
graph = GraphMapper(remap.Mapped, x0=0, x1=1, y0=0, y1=1, Cx=0.3282442689, Cy=0.6898550987, container_name="Conic")
dom_3 = ConstructDomain(DomainStart=min_beam_height_m_2, DomainEnd=min_beam_height_m)
remap_2 = RemapNumbers(Value=graph, Source=Domain(0, 1), Target=dom_3)  # -> Mapped, Clipped
Z_3 = UnitZ(Factor=expr("-x", remap_2.Mapped))
move = Move(Geometry=pt_2, Motion=Z_3)  # -> Geometry, Transform
item_6 = ListItem(List=pt_2, Index=0, Wrap=True)  # -> Item, Item1
item_7 = ListItem(List=move.Geometry, Index=0, Wrap=True)  # -> Item, Item1
srf4pt = _4PointSurface(CornerA=item_6.Item, CornerB=item_6.Item1, CornerC=item_7.Item1, CornerD=item_7.Item)
preview = CustomPreview(Geometry=[srf4pt, pipe], Shader=ColourSwatch(SwatchColor=RGB(150, 150, 150)))

# ---- group: Disassemble Model
disassemble = DisassembleModelKaramba3D(Model=analyse.AnalysedModel)  # -> Model, Point, Beam, Shell, Support, Load, Line, Mesh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

# ---- group: Define Cross Sections
beam_heights = Number(remap_2.Mapped)
avr_2 = Average(Input=beam_heights)  # -> simplify(ArithmeticMean)
expression = Expression(x=avr_2, Expression="Round(x*100,2)")
expression_2 = Expression(x=expression, Expression="x/2")
Z_4 = UnitZ(Factor=expression_2)
expression_3 = Expression(x="2", Expression="x/2")
neg = Negative(Value=Z_4)
crosec = CrossSectionKaramba3D(
    FamilyNameOfCrossSection="DefaultCroSec",
    NameOfCrossSection=expression,
    Material=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,
    LocalEccentricity_cm=neg,
    Height_cm=expression,
    UpperFlangeWidth_cm="2",
    LowerFlangeWidth_cm="2",
    UpperFlangeThickness_cm=expression_3,
    LowerFlangeThickness_cm=expression_3,
    SidewallsThickness_cm=0.4,
    FilletRadius_cm=0.6,
    mode="Box")  # -> flatten(CrossSection)

num_2 = Number(column_diameter_cm)
crosec_2 = CrossSectionKaramba3D(
    FamilyNameOfCrossSection="DefaultCroSec",
    Material=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,
    Diameter_cm=num_2,
    WallThickness_cm=0.4,
    mode="Circular Hollow")

# ---- group: Define Column Elements
line_2 = Line(line)
lineelem_2 = CreateLinearElementKaramba3D(
    Line=line_2,
    Identifier="column",
    CrossSection=crosec_2,
    LimitDistance_m=0.005,
    BucklingLengthY_m=-1,
    BucklingLengthZ_m=-1,
    BucklingLengthLT_m=-1,
    Bending=True,
    ToPolylineMaxAngle=0.03,
    ToPolylineTolerance=0.01,
    ToPolylineMaxEdgeLength=0.25,
    New=True,
    Remove=True,
    mode="LineToBeam")  # -> Element, Points, Info

# ---- group: Define Supports
end_3 = EndPoints(Curve=line_2)  # -> Start, End
supp_2 = SupportKaramba3D(PosInd=end_3.End, menu=[buttons(on, on, on, off, off, off)])

# ---- group: Assign Cross Section to Element
modifyelem = ModifyElementKaramba3D(Beam=disassemble.Beam, CrossSection=crosec, mode="Beam")

# ----
element = ElementKaramba3D(flatten([modifyelem, lineelem_2.Element]))
pt_4 = Point(disassemble.Point)
load_2 = LoadKaramba3D(disassemble.Load)

# ---- group: Reassemble Model
assemble_2 = AssembleModelKaramba3D(Elem=element, Support=supp_2, Load=load_2, LimitDistance_m=0.005, Points=pt_4)  # -> Model, Info, Mass_kg, CentreOfGravity, LoadCaseNames

# ---- group: Analyze Model
analyse_2 = AnalyseKaramba3D(Model=assemble_2.Model)  # -> AnalysedModel, MaximumDisplacement_cm, ResultingForce_kN, ChangeOfElasticEnergy_kNm
panel = Panel(analyse_2.MaximumDisplacement_cm)

# ---- group: View Results
modelview_2 = ModelViewKaramba3D(Model=analyse_2.AnalysedModel)  # -> Model, DeformedMesh, DeformedAxes, DeformedModel, MaximumDeformation
beamview_2 = BeamViewKaramba3D(Model=modelview_2.Model)  # -> Model, MeshesOfRenderedBeams, DeformedBeamAxes, LegendColours, LegendTags
legend = Legend(Colour=beamview_2.LegendColours, Tags=beamview_2.LegendTags, LegendType=1)
